# Dynamo custom node Add View Filters to View.dyf (Dynamo 1.1.0.2094)
# category: Bakery.Revit.Views

viewFilterElements = Input()
turnIntoList = Custom[TurnIntoList](unknownItem=viewFilterElements)  # Turns an element (or a nested list) into a flat list
targetView = Input()
HideIfFalse = Input()
python_script = Python(IN[0]=turnIntoList, IN[1]=targetView, IN[2]=HideIfFalse)
# ---------- python_script.python (35 lines) ----------
#from the forum originally
import clr

clr.AddReference("RevitServices")
import RevitServices
from RevitServices.Persistence import DocumentManager
from RevitServices.Transactions import TransactionManager

doc = DocumentManager.Instance.CurrentDBDocument

clr.AddReference("RevitAPI")
import Autodesk
from Autodesk.Revit.DB import *
import System
from System.Collections.Generic import *

dataEnteringNode = IN

filters = UnwrapElement(IN[0])
view = UnwrapElement(IN[1])
visOrNot = IN[2]
output = []

TransactionManager.Instance.EnsureInTransaction(doc)
for x in filters:
	try:
		view.AddFilter(x.Id)
		view.SetFilterVisibility(x.Id, visOrNot)
		output.append("Filter added OK")
	except:
		output.append("Filter failed to add")

TransactionManager.Instance.TransactionTaskDone()

OUT = output
# ----------------------------------------
doneOrNot = Output(python_script)
