# Dynamo custom node Bruteforce Get Elem ID and Two Parameters and Make List of Strings.dyf (Dynamo 0.8.2.2392)
# category: Bakery.Revit.Parameters
# takes list of elements

elementList = Input()
parameterOne = Input()
parameterTwo = Input()
string = StringInput(" : ")
string_2 = StringInput("NO_VALUE")
bruteforce_get_two_parameters = Custom[Bruteforce Get Two Parameters and Join to One String](parameterOne=parameterOne, parameterTwo=parameterTwo, separator=string, replaceEmptyWith=string_2)  # The first value is Element ID. use with List.Map
map = List.Map(list=elementList, f_x=bruteforce_get_two_parameters)
bv_merge_sublists_with_a = Custom[bv Merge Sublists with a separator](List=map, Character=string)  # forked from Rhythm
flat_list_to_list_of_strings = Custom[Flat List to List of Strings](Original_List=bv_merge_sublists_with_a)  # using python methods
listOfStrings = Output(flat_list_to_list_of_strings)
