# Dynamo custom node Bruteforce Get Parameter via String Split V2.dyf (Dynamo 0.8.2.2392)
# category: Bakery.Revit.Parameters
# BETTER

element = Input()
parameters = Element.Parameters(element)
string_from_array = FromArray(parameters)
string = StringInput(" :")
parameterName = Input()
string_2 = StringInput(" ")
join = String.Join(string, parameterName, string_2)
split = String.Split(string_from_array, join)
number_slider = DoubleSlider(1, range=0..100 step 0.1)
getItemAtIndex = List.GetItemAtIndex(list=split, index=number_slider)
watch = Watch(getItemAtIndex)
string_from_object = FromObject(watch)
number_slider_2 = DoubleSlider(0, range=0..100 step 0.1)
bv_get_character_from_string_at = Custom[bv Get Character from String at Index](List=string_from_object, Index=number_slider_2)  # forked from Rhythm
watch_2 = Watch(bv_get_character_from_string_at)
string_3 = StringInput(",")
eq = watch_2 == string_3
replaceEmptyWithString = Input()
string_4 = StringInput(",")
split_2 = String.Split(watch, string_4)
firstItem = List.FirstItem(split_2)
boolean_input_to_variable_string = Custom[Boolean Input to Variable String Output](Boolean_In=eq, String_if_True=replaceEmptyWithString, String_if_False=firstItem)  # you choose what you want to convert true / false to, good for validation
string_5 = StringInput("}")
boolean = BoolSelector(true)
endsWith = String.EndsWith(boolean_input_to_variable_string, string_5, boolean)
length = String.Length(boolean_input_to_variable_string)
number_slider_3 = DoubleSlider(1, range=0..100 step 0.1)
sub = length - number_slider_3
remove = String.Remove(str=boolean_input_to_variable_string, startIndex=sub, count=number_slider_3)
boolean_input_to_variable_string_2 = Custom[Boolean Input to Variable String Output](Boolean_In=endsWith, String_if_True=remove, String_if_False=boolean_input_to_variable_string)
value = Output(boolean_input_to_variable_string_2)
watch_3 = Watch(join)
