# Dynamo custom node Clean Two Lists into One.dyf (Dynamo 1.3.4.6666)
# category: Bakery.Core.List

oneList = Input()
anotherList = Input()

# group: clean two lists to one
python_script = Python(IN[0]=oneList, IN[1]=anotherList)
# ---------- python_script.python (15 lines) ----------
import clr
clr.AddReference('ProtoGeometry')
from Autodesk.DesignScript.Geometry import *
#The inputs to this node will be stored as a list in the IN variables.
centroids = IN[0]
locs = IN[1]
cleaned = []
for c in range(len(centroids)):
	if centroids[c] != None:
		cleaned.append(centroids[c])
	else:
		cleaned.append(locs[c])

#Assign your output to the OUT variable.
OUT = cleaned
# ----------------------------------------

niceList = Output(python_script)
