# Dynamo custom node Closest Value.dyf (Dynamo 1.3.2.2480)
# category: Bakery.Core.Math
# uses double to int reduction

value = Input()
listOfDoubles = Input()
list_of_float_double_to_list_of = Custom[List of float double to list of Int](double=listOfDoubles)  # no decimals
sub = value - list_of_float_double_to_list_of
formula = Formula("abs(x)", x=sub)
minimumItem = List.MinimumItem(formula)
if_equal_return_index_using = Custom[If Equal Return Index using IndexOf](searchForThese=minimumItem, inThisList=formula)
indices = Output(if_equal_return_index_using)
