# Dynamo custom node Combine Column from Three Excel Files into One Long Column.dyf (Dynamo 0.8.2.2371)
# category: Bakery.Office.Excel
# uses Sheet1

OutputExcelFile = Input()
output_Sheet_Name = Input()
startatrow = Input(startatrow : int = 0)
code_block = CodeBlock { 0; }
inputExcelFileOne = Input()
fromPath = FileObject(inputExcelFileOne)  # "File.FromPath"
string = StringInput("Sheet1")
readFromFile = Excel.ReadFromFile(file=fromPath, sheetName=string)
flatten = Flatten(readFromFile)
inputExcelFileTwo = Input()
fromPath_2 = FileObject(inputExcelFileTwo)  # "File.FromPath"
string_2 = StringInput("Sheet1")
readFromFile_2 = Excel.ReadFromFile(file=fromPath_2, sheetName=string_2)
flatten_2 = Flatten(readFromFile_2)
inputExcelFileThree = Input()
fromPath_3 = FileObject(inputExcelFileThree)  # "File.FromPath"
string_3 = StringInput("Sheet1")
readFromFile_3 = Excel.ReadFromFile(file=fromPath_3, sheetName=string_3)
flatten_3 = Flatten(readFromFile_3)
join = List.Join(flatten, flatten_2, flatten_3)
flatten_4 = Flatten(join)
code_block_2 = CodeBlock { false; }
writeToFile = Excel.WriteToFile(filePath=OutputExcelFile, sheetName=output_Sheet_Name, startRow=startatrow, startCol=code_block, data=flatten_4, overWrite=code_block_2)
done = Output(writeToFile)
