# Dynamo custom node Comma Separated Point Value to Point Object.dyf (Dynamo 1.2.1.3083)
# category: Bakery.Geometry

obj = Input()
string_from_object = FromObject(obj)
remove_first_and_last_characters = Custom[Remove First and Last Characters from String](stringIn=string_from_object)
string = StringInput(", ")
split = String.Split(remove_first_and_last_characters, string)
watch = Watch(split)
code_block = CodeBlock { 0; }
getItemAtIndex = List.GetItemAtIndex(index=code_block)  # unwired: list
map = List.Map(list=watch, f_x=getItemAtIndex)
watch_2 = Watch(map)
toNumber = String.ToNumber(watch_2)
scale = Input(scale : double = 1/304.8)
code_block_2 = CodeBlock(x=toNumber, y=scale) { x/y; }
code_block_3 = CodeBlock { 1; }
getItemAtIndex_2 = List.GetItemAtIndex(index=code_block_3)  # unwired: list
map_2 = List.Map(list=watch, f_x=getItemAtIndex_2)
watch_3 = Watch(map_2)
toNumber_2 = String.ToNumber(watch_3)
code_block_4 = CodeBlock(x=toNumber_2, y=scale) { x/y; }
code_block_5 = CodeBlock { 2; }
getItemAtIndex_3 = List.GetItemAtIndex(index=code_block_5)  # unwired: list
map_3 = List.Map(list=watch, f_x=getItemAtIndex_3)
watch_4 = Watch(map_3)
toNumber_3 = String.ToNumber(watch_4)
code_block_6 = CodeBlock(x=toNumber_3, y=scale) { x/y; }
byCoordinates = Point.ByCoordinates(x=code_block_2, y=code_block_4, z=code_block_6)
Point = Output(byCoordinates)
