# Dynamo custom node Convert String with Line Breaks into List of Strings.dyf (Dynamo 0.8.2.2371)
# category: Bakery.Core.String

string = Input()
string_2 = StringInput("\n")
split = String.Split(string, string_2)
ListOfStrings = Output(split)
