# Dynamo custom node Create JSON Files for Deep Space Sync.dyf (Dynamo 1.3.4.6666)
# category: Bakery.Data.Database.DeepSpace
# Deep Space Sync provided by Virtual Built Technology

directoryPath = Input()
string = StringInput("---")
databaseName = Input()
filenames = Input()
ctr = Input()
watch = Watch(ctr)
getItemAtIndex = List.GetItemAtIndex(list=filenames, index=watch)
join = String.Join(string, databaseName, getItemAtIndex)
string_2 = StringInput(".json")
file_path_from_directory_and = Custom[File Path from Directory and String](directoryPath=directoryPath, fileName=join, fileExtension=string_2)
watch_2 = Watch(file_path_from_directory_and)
string_3 = StringInput("""{
 "DatabaseId": """)
databaseId = Input()
watch_3 = Watch(databaseId)
fileIds = Input()
count = Count(fileIds)
cycle = List.Cycle(list=watch_3, amount=count)
getItemAtIndex_2 = List.GetItemAtIndex(list=cycle, index=watch)
string_from_object = FromObject(getItemAtIndex_2)
string_4 = StringInput(""",
 "SourceFileId": """)
getItemAtIndex_3 = List.GetItemAtIndex(list=fileIds, index=watch)
string_from_object_2 = FromObject(getItemAtIndex_3)
string_5 = StringInput("\n}")
create = List.Create(string_3, string_from_object, string_4, string_from_object_2, string_5)
merge_1d_list_to_string_pythonic = Custom[Merge 1D List to String Pythonic](aList=create)
write_string_to_file = Custom[Write String to File](pathStr=watch_2, stringToWrite=merge_1d_list_to_string_pythonic)
success = Output(write_string_to_file)
