# Dynamo custom node Element.Document Central Filename.dyf (Dynamo 1.2.1.3083)
# category: Bakery.Revit.Document

element = Input()
python_script = Python(IN[0]=element)
# ---------- python_script.python (55 lines) ----------
import clr
clr.AddReference('ProtoGeometry')
from Autodesk.DesignScript.Geometry import *

# Import RevitAPI
clr.AddReference("RevitAPI")
import Autodesk
from Autodesk.Revit.DB import *

clr.AddReference("RevitServices")
import RevitServices
from RevitServices.Persistence import DocumentManager
from RevitServices.Transactions import TransactionManager

from System.Collections.Generic import *

clr.AddReference('RevitNodes')
import Revit
clr.ImportExtensions(Revit.Elements)
clr.ImportExtensions(Revit.GeometryConversion)

from System import Guid
import System
from System.IO import Directory, Path

import sys
pyt_path = r'C:\Program Files (x86)\IronPython 2.7\Lib'
sys.path.append(pyt_path)

import os
import datetime

doc = DocumentManager.Instance.CurrentDBDocument
uiapp = DocumentManager.Instance.CurrentUIApplication
app = uiapp.Application

if isinstance(IN[0],list):
	toggle = 0
	element = UnwrapElement(IN[0])
else:
	toggle = 1
	element = [UnwrapElement(IN[0])]

listout = []	
for x in element:
	try:
		edocuments = Path.GetFileName(ModelPathUtils.ConvertModelPathToUserVisiblePath(doc.GetWorksharingCentralModelPath()))
		listout.append(edocuments)
	except:
		listout.append(None)
#Assign your output to the OUT variable.
if toggle:
	OUT = edocuments
else:
	OUT = listout
# ----------------------------------------
centralFileName = Output(python_script)
