# Dynamo custom node Element.Document Parent Link.dyf (Dynamo 1.2.1.3083)
# category: Bakery.Revit.Elements.Properties

Element = Input()
python_script = Python(IN[0]=Element)
# ---------- python_script.python (24 lines) ----------
import clr
clr.AddReference('ProtoGeometry')
from Autodesk.DesignScript.Geometry import *

#The inputs to this node will be stored as a list in the IN variables.
if isinstance(IN[0],list):
	toggle = 0
	element = UnwrapElement(IN[0])
else:
	toggle = 1
	element = [UnwrapElement(IN[0])]

listout = []	
for x in element:
	try:
		edocuments = x.Document
		listout.append(edocuments)
	except:
		listout.append(None)
#Assign your output to the OUT variable.
if toggle:
	OUT = edocuments.Title
else:
	OUT = listout
# ----------------------------------------
Docs = Output(python_script)
