# Dynamo custom node ElementFingerprintBasic.dyf (Dynamo 1.2.1.3083)
# category: Bakery.Data.Database

code_block = CodeBlock { {"RvtGuid","RvtFileName","CrawlTime","RvtElementId","RvtCategory","RvtFamilyName","RvtTypeName"}; }
columnNameList = Output(code_block)
oneElement = Input()
watch = Watch(oneElement)
element_ids = Custom[Element Ids](Element_s=watch)  # This node will query an element id that can be used with Revit nodes. Dynamo Element Id node returns integer value.
firstItem = List.FirstItem(element_ids.GUID_s)
watch_2 = Watch(firstItem)
linked_elements_revit_file_name = Custom[Linked Elements Revit File Name](item=watch)
watch_3 = Watch(linked_elements_revit_file_name)
now = DateTime.Now()
firstItem_2 = List.FirstItem(element_ids.Rvt_ElementId_s)
watch_4 = Watch(firstItem_2)
category = Custom[Element.Category](element=watch)  # This node will get the input element(s)' categories
watch_5 = Watch(category)
get_family_from_element = Custom[Get Family from Element](oneElement=watch)  # NOT WORKING
element_name_universal = Custom[Element.Name (Universal)](element=get_family_from_element)  # Gets an element's name (Dynamo's built-in Name nodes don't work for all element types, e.g. worksets...)
watch_6 = Watch(element_name_universal)
type = Custom[Element.Type](element=watch)  # Gets the family type of a given element (if applicable).
element_name_universal_2 = Custom[Element.Name (Universal)](element=type)
watch_7 = Watch(element_name_universal_2)
create = List.Create(watch_2, watch_3, now, watch_4, watch_5, watch_6, watch_7)
valueList = Output(create)
