# Dynamo custom node Filter Text Notes by Search.dyf (Dynamo 0.8.2.2371)
# category: Bakery.Revit.Elements

string = StringInput("SCHNEIDER")
TextNotes = Input()
watch = Watch(TextNotes)
text = Custom[TextElement.Text](Element_s=watch)  # Gets the text stored in a text element (i.e. text node or model text)
containing = Input()
contains = String.Contains(str=text, searchFor=containing)
filterByBoolMask = List.FilterByBoolMask(list=watch, mask=contains)
TextNotes_2 = Output(filterByBoolMask.in)  # "TextNotes"
