# Dynamo custom node Filter a List by a Given Value with second list passthrough.dyf (Dynamo 0.8.0.950)
# category: Bakery.Core.List

list = Input()
value = Input()
eq = list == value
watch = Watch(eq)
filterByBoolMask = List.FilterByBoolMask(list=list, mask=watch)
listPassthrough = Input()
filterByBoolMask_2 = List.FilterByBoolMask(list=listPassthrough, mask=watch)
create = List.Create(filterByBoolMask.in, filterByBoolMask_2.in)
inListAndPassthrough = Output(create)
