# Dynamo custom node Find Index in One List and Get From Other Sublists.dyf (Dynamo 0.8.2.2392)
# category: Bakery.Core.List

get_from_sublists_here = Input()
list_of_items_to_find = Input()
turn_into_list = Custom[Turn Into List](item=list_of_items_to_find)  # Turns an element into a (flat) list
in_this_list = Input()
if_equal_return_index_using = Custom[If Equal Return Index using IndexOf](searchForThese=turn_into_list, inThisList=in_this_list)
getItemAtIndex = List.GetItemAtIndex(index=if_equal_return_index_using)
map = List.Map(list=get_from_sublists_here, f_x=getItemAtIndex)
mapped_result = Output(map)
