# Dynamo custom node Get All Family Instances From Link Doc.dyf (Dynamo 0.8.2.2371)
# category: Bakery.Revit.Selection

linkdoc = Input()
python_script = Python(IN[0]=linkdoc)
# ---------- python_script.python (42 lines) ----------
#Copyright(c) 2015, Konrad Sobon
# @arch_laboratory, http://archi-lab.net

# This node is based on Julien Benoit's Element.GetElementFromLinkedFile 
# node. Some slight improvements were made removing unnecessary imports/references.
# Big thank you to Julien for sharing his work. 

import clr
clr.AddReference('ProtoGeometry')
from Autodesk.DesignScript.Geometry import *

# Import RevitAPI
clr.AddReference("RevitAPI")
import Autodesk
from Autodesk.Revit.DB import *

import System

import sys
pyt_path = r'C:\Program Files (x86)\IronPython 2.7\Lib'
sys.path.append(pyt_path)

#The inputs to this node will be stored as a list in the IN variable.
dataEnteringNode = IN

_linkDoc = IN[0]

try:
	errorReport = None
#	filter = ElementCategoryFilter(System.Enum.ToObject(BuiltInCategory, _category.Id))
#	result = FilteredElementCollector(_linkDoc).WherePasses(filter).WhereElementIsNotElementType().ToElements()
	result = FilteredElementCollector(_linkDoc).OfClass(FamilyInstance).ToElements()
except:
	# if error accurs anywhere in the process catch it
	import traceback
	errorReport = traceback.format_exc()

#Assign your output to the OUT variable
if errorReport == None:
	OUT = result
else:
	OUT = errorReport
# ----------------------------------------
elements = Output(python_script)
