# Dynamo custom node Get Children using Key Value list.dyf (Dynamo 0.8.2.2371)
# category: Bakery.Data.XML

list = Input(list : var[]..[])
list_2 = Input(list : var[]..[])
list_3 = Input(list : var[]..[])
index = Input(index : int)
getItemAtIndex = List.GetItemAtIndex(list=list_3, index=index)
bv_all_indices_of = Custom[bv All Indices Of](list=list_2, indices=getItemAtIndex)  # forked from Rhythm
getItemAtIndex_2 = List.GetItemAtIndex(list=list, index=bv_all_indices_of)
item = Output(getItemAtIndex_2)
