# Dynamo custom node Get Family Instance Properties.dyf (Dynamo 1.0.0.1180)
# category: Bakery.Revit.Elements.Properties

familyInstances = Input()
turnIntoList = Custom[TurnIntoList](unknownItem=familyInstances)  # Turns an element (or a nested list) into a flat list
python_script = Python(IN[0]=turnIntoList)
# ---------- python_script.python (50 lines) ----------
#By Luke Johnson for Bakery
import clr
clr.AddReference('ProtoGeometry')
from Autodesk.DesignScript.Geometry import *

# Import ToDSType(bool) extension method
clr.AddReference("RevitNodes")
import Revit
clr.ImportExtensions(Revit.Elements)

# Import DocumentManager and TransactionManager
clr.AddReference("RevitServices")
import RevitServices
from RevitServices.Persistence import DocumentManager
from RevitServices.Transactions import TransactionManager


from System.Collections.Generic import *

# Import RevitAPI
clr.AddReference("RevitAPI")
import Autodesk

doc = DocumentManager.Instance.CurrentDBDocument
uiapp = DocumentManager.Instance.CurrentUIApplication
app = uiapp.Application

#The inputs to this node will be stored as a list in the IN variable.
familyInstances = UnwrapElement(IN[0])
viewspecifics = []
ownerViewIds = []
pinneds = []
groupIds = []
categoryObjs = []
#transformIsTran = []
#vectTranX = []
#vectTranY = []
#vectTranZ = []
#determinants = []
#isconformals = []
#hasreflections = []
for y in familyInstances:
	viewspecifics.append(y.ViewSpecific)
	ownerViewIds.append(y.OwnerViewId)
	pinneds.append(y.Pinned)
	groupIds.append(y.GroupId)
	categoryObjs.append(y.Category)

#Assign your output to the OUT variable
OUT = viewspecifics, ownerViewIds, pinneds, groupIds, categoryObjs
# ----------------------------------------
code_block = CodeBlock { 1; }
getItemAtIndex = List.GetItemAtIndex(list=python_script, index=code_block)
ownerView = Output(getItemAtIndex)
code_block_2 = CodeBlock { 2; }
getItemAtIndex_2 = List.GetItemAtIndex(list=python_script, index=code_block_2)
pinned = Output(getItemAtIndex_2)
code_block_3 = CodeBlock { 3; }
getItemAtIndex_3 = List.GetItemAtIndex(list=python_script, index=code_block_3)
belongsToGroupId = Output(getItemAtIndex_3)
code_block_4 = CodeBlock { 4; }
getItemAtIndex_4 = List.GetItemAtIndex(list=python_script, index=code_block_4)
categoryObject = Output(getItemAtIndex_4)
code_block_5 = CodeBlock { 0; }
getItemAtIndex_5 = List.GetItemAtIndex(list=python_script, index=code_block_5)
viewSpecific = Output(getItemAtIndex_5)
