# Dynamo custom node Get Family List for Document.dyf (Dynamo 1.2.1.3083)
# category: Bakery.Revit.Document

doc = Input()
python_script = Python(IN[0]=doc)
# ---------- python_script.python (18 lines) ----------
#Made by Marc Tavenier @marctavenier
import clr
clr.AddReference('RevitAPI')
from Autodesk.Revit.DB import *

clr.AddReference('RevitServices')
import RevitServices
from RevitServices.Persistence import DocumentManager

#The inputs to this node will be stored as a list in the IN variable.
elementlist = []
doc = IN[0]

collector = FilteredElementCollector(doc).OfClass(Family)
elementlist = collector.ToElements()

#Assign your output to the OUT variable
OUT = elementlist
# ----------------------------------------
Families = Output(python_script)
