# Dynamo custom node Get Link Document from Link Name.dyf (Dynamo 1.3.2.2480)
# category: Bakery.Revit.Document.Links
# Only gets first occurrence

code_block = CodeBlock { "replacedNull"; }
get_linked_rvt_documents = Custom[Get Linked RVT Documents]()
bv_replace_nulls = Custom[bv Replace Nulls](replacement=code_block, seq=get_linked_rvt_documents.Link_Doc)
clean_link_name_list = Custom[Clean Link Name List](name_list=get_linked_rvt_documents.Link_Name)
searchFor = Input(searchFor : string)
startsWith = String.StartsWith(str=clean_link_name_list, searchFor=searchFor)
watch = Watch(startsWith)
code_block_2 = CodeBlock { true; }
firstIndexOf = List.FirstIndexOf(list=watch, item=code_block_2)
getItemAtIndex = List.GetItemAtIndex(list=bv_replace_nulls, index=firstIndexOf)
watch_2 = Watch(getItemAtIndex)
firstItem = List.FirstItem(watch_2)
item = Output(firstItem)
