# Dynamo custom node Get Linked Element from Element Id and Doc.dyf (Dynamo 0.8.2.2371)
# category: Bakery.Revit.Document.Links
# uses name string

Link_Name_string = Input()
watch = Watch(Link_Name_string)
get_link_document_from_link_name = Custom[Get Link Document from Link Name](searchFor=watch)
Document = Output(get_link_document_from_link_name)
Element_Ids = Input()
get_linked_elements_by_id_and = Custom[Get Linked Elements by Id and Doc](elementIdList=Element_Ids, oneLinkDoc=get_link_document_from_link_name)
Element = Output(get_linked_elements_by_id_and.foundElements)
location = FamilyInstance.Location(get_linked_elements_by_id_and.foundElements)
Point = Output(location)
