# Dynamo custom node Get View Parameter and Check for File Dates and Sizes.dyf (Dynamo 0.9.2.4472)
# category: Bakery.Revit.Document.Links

viewFromViewsList = Input()
id = Element.Id(viewFromViewsList)
bv_ids_to_elements = Custom[bv IDs to Elements](ID_s=id)  # forked from CAAD_RWTH
firstItem = List.FirstItem(bv_ids_to_elements.Element_s)
parameterName = Input()
getParameterValueByName = Element.GetParameterValueByName(element=firstItem, parameterName=parameterName)
string = StringInput("\n")
split = String.Split(getParameterValueByName, string)
watch = Watch(split)
filenames_found = Output(watch)
