# Dynamo custom node Get Workset Info for RVT files without opening.dyf (Dynamo 1.1.0.2094)
# category: Bakery.Revit.Document.Worksets
# thanks to dimven for the assist.

FilePaths = Input()
create = List.Create(FilePaths)
flatten = Flatten(create)
python_script = Python(IN[0]=flatten)
# ---------- python_script.python (43 lines) ----------
#LSJ

import clr
import sys
sys.path.append('C:\Program Files (x86)\IronPython 2.7\Lib')
clr.AddReference('ProtoGeometry')
from Autodesk.DesignScript.Geometry import *

# Import DocumentManager
clr.AddReference("RevitServices")
import RevitServices
from RevitServices.Persistence import DocumentManager

# Import RevitAPI
clr.AddReference("RevitAPI")
import Autodesk

# Import ToDSType(bool) extension method
clr.AddReference("RevitNodes")
import Revit
from Autodesk.Revit.DB import *
clr.ImportExtensions(Revit.Elements)

import traceback
#The inputs to this node will be stored as a list in the IN variable.
#doc = DocumentManager.Instance.CurrentDBDocument
uiapp = DocumentManager.Instance.CurrentUIApplication
app = uiapp.Application
paths = IN[0]
outlist = []
pathlist = []

for p in paths:
	modPath = ModelPathUtils.ConvertUserVisiblePathToModelPath(p)
	try:
		ws = WorksharingUtils.GetUserWorksetInfo(modPath)
		ws = [w.Name for w in ws]
	except:
		ws = traceback.format_exc()
	pathlist.append(p)
	outlist.append(ws)

OUT = pathlist, outlist
# ----------------------------------------
code_block = CodeBlock { 0; }
getItemAtIndex = List.GetItemAtIndex(list=python_script, index=code_block)
fileList = Output(getItemAtIndex)
code_block_2 = CodeBlock { 1; }
getItemAtIndex_2 = List.GetItemAtIndex(list=python_script, index=code_block_2)
worksetNameList = Output(getItemAtIndex_2)
