# Dynamo custom node List All View Filters in Current Document.dyf (Dynamo 1.1.0.2094)
# category: Bakery.Revit.Application.Enums
# uses ParameterFilterElement type selection

element_types = ElementTypes("ParameterFilterElement")
all_elements_of_type = ElementsOfType(element_types)
elements = Output(all_elements_of_type)
