# Dynamo custom node List Design Option Information.dyf (Dynamo 0.8.2.2371)
# category: Bakery.Revit.Document
# doesn't work that well, try Archi-lab "Get Design Options"

document_design_options = Custom[Document Design Options]()  # Returns all design options in the model, grouped by design option set
OptionElements = Output(document_design_options.DesignOptions)
code_block = CodeBlock { "Name"; }
getParameterValueByName = Element.GetParameterValueByName(parameterName=code_block)
map = List.Map(list=document_design_options.DesignOptions, f_x=getParameterValueByName)
OptionNames = Output(map)
string_from_array = FromArray(map)
OptionNamesAsString = Output(string_from_array)
code_block_2 = CodeBlock { "{}"; }
eq = string_from_array == code_block_2
NoDesignOptions = Output(eq)
design_option_and_design = Custom[Design Option and Design OptionSet](DesignOption_s=document_design_options.DesignOptionSets)  # Returns the design option set of a given design option
optionSets_beta = Output(design_option_and_design)
