# Dynamo custom node List Shared Parameter GUIDs only.dyf (Dynamo 0.8.2.2371)
# category: Bakery.Revit.Parameters
# faster

ElementOrTypeList = Input()
bettergetParamsNew = Python(IN[0]=ElementOrTypeList)
# ---------- bettergetParamsNew.python (40 lines) ----------
import clr
# Import RevitAPI
clr.AddReference("RevitAPI")
import Autodesk
from Autodesk.Revit.DB import *
# Import DocumentManager and TransactionManager
clr.AddReference("RevitServices")
import RevitServices
from RevitServices.Persistence import DocumentManager
from RevitServices.Transactions import TransactionManager
# Import ToDSType(bool) extension method
clr.AddReference("RevitNodes")
import Revit
from System import Guid
clr.ImportExtensions(Revit.Elements)
doc =  DocumentManager.Instance.CurrentDBDocument
app =  DocumentManager.Instance.CurrentUIApplication.Application

#The input to this node will be stored in the IN[0] variable.
elemIDlist = list()
combinelist1 = list()
combinelist2 = list()
combinelist3 = list()
for z in IN[0]:
	elementz = UnwrapElement(z)
	elemIDlist.append(z.Id)
	paramShared = []
	paramNames = []
	paramGu = []
	for x in elementz.Parameters:
		paramShared.append(x.IsShared)
		paramNames.append(x.Definition.Name)
		if x.IsShared:
			paramGu.append(x.GUID)
	combinelist1.append(paramNames)
	combinelist2.append(paramShared)
	combinelist3.append(paramGu)

#Assign your output to the OUT variable
OUT = elemIDlist, combinelist1, combinelist2, combinelist3
# ----------------------------------------
code_block = CodeBlock { 3; }
getItemAtIndex = List.GetItemAtIndex(list=bettergetParamsNew, index=code_block)
flatten = Flatten(getItemAtIndex)
uniqueItems = List.UniqueItems(flatten)
uniqueSPguids = Output(uniqueItems)
code_block_2 = CodeBlock { 1; }
getItemAtIndex_2 = List.GetItemAtIndex(list=bettergetParamsNew, index=code_block_2)
allParameterNames = Output(getItemAtIndex_2)
allSPguids = Output(getItemAtIndex)
watch = Watch(bettergetParamsNew)
code_block_3 = CodeBlock { 0; }
getItemAtIndex_3 = List.GetItemAtIndex(list=watch, index=code_block_3)
elementIds = Output(getItemAtIndex_3)
code_block_4 = CodeBlock { 1; }
getItemAtIndex_4 = List.GetItemAtIndex(list=watch, index=code_block_4)
code_block_5 = CodeBlock { 2; }
getItemAtIndex_5 = List.GetItemAtIndex(list=watch, index=code_block_5)
filterByBoolMask = List.FilterByBoolMask(list=getItemAtIndex_4, mask=getItemAtIndex_5)
mappedSPnames = Output(filterByBoolMask.in)
flatten_2 = Flatten(filterByBoolMask.in)
uniqueItems_2 = List.UniqueItems(flatten_2)
uniqueSPnames = Output(uniqueItems_2)
