# Dynamo custom node List of Curves to Room Separation Lines in Active View.dyf (Dynamo 0.9.2.4472)
# category: Bakery.Revit.Elements.Room

curveList = Input()
single_curve_to_room_separation = Custom[Single Curve to Room Separation Line in Active View]()  # view should be a Plan View
map = List.Map(list=curveList, f_x=single_curve_to_room_separation)
separationLines = Output(map)
