# Dynamo custom node Log Database Crawl.dyf (Dynamo 1.2.1.3083)
# category: Bakery.Data.Database

string = StringInput("RvtFileName")
string_2 = StringInput("RvtElementCount")
string_3 = StringInput("RvtCrawlKey")
string_4 = StringInput("RvtCrawlNote")
create = List.Create(string, string_2, string_3, string_4)
RvtFileName = Input()
watch = Watch(RvtFileName)
RvtElementCount = Input()
RvtCrawlKey = Input()
RvtCrawlNote = Input()
create_2 = List.Create(watch, RvtElementCount, RvtCrawlKey, RvtCrawlNote)
dbName = Input(dbName : string)
tableName = Input(tableName : string)
ConnectionString = Input(ConnectionString : string)
mysql_insert_new_row_of_data = Custom[mysql Insert New Row of Data](columnNameList=create, dataList=create_2, dbName=dbName, tableName=tableName, ConnectionString=ConnectionString)
success = Output(mysql_insert_new_row_of_data)
