# Dynamo custom node Make Insulation Direct Shapes with Geometry Input.dyf (Dynamo 1.3.3.4651)
# category: Bakery.Construction.Insulation
# make insulation node

surfaceVerticals = Input()
boundaryFloors = Input()
watch = Watch(boundaryFloors)
type = Custom[Element.Type](element=watch)  # Gets the family type of a given element (if applicable).
element_name_universal = Custom[Element Name Universal](Elements=type)  # Modified for 0.8.1
string = StringInput(" ")
split = String.Split(element_name_universal, string)
watch_2 = Watch(split)
code_block = CodeBlock { 1; }
getItemAtIndex = List.GetItemAtIndex(list=watch_2@L2, index=code_block)
toNumber = String.ToNumber(getItemAtIndex)
counter = Input()
getItemAtIndex_2 = List.GetItemAtIndex(list=toNumber, index=counter)
watch_3 = Watch(getItemAtIndex_2)

# group: verticals
boolean = BoolSelector(false)
thicken = Surface.Thicken(surface=surfaceVerticals, thickness=watch_3, both_sides=boolean)

watch_4 = Watch(thicken)
faces = Topology.Faces(watch_4)
surfaceGeometry = Face.SurfaceGeometry(faces)
filterByOrientation = Custom[Surface.FilterByOrientation](surfaces=surfaceGeometry)  # Sorts surfaces in three lists based on their orientation (vertical, horizontal up & horizontal down) and also returns three corresponding lists of booleans.
watch_5 = Watch(filterByOrientation.horizontalDown)

# group: extension piece
boolean_2 = BoolSelector(false)
thicken_2 = Surface.Thicken(surface=watch_5, thickness=watch_3, both_sides=boolean_2)

surfaceLower = Input()

# group: flat
boolean_3 = BoolSelector(false)
thicken_3 = Surface.Thicken(surface=surfaceLower, thickness=watch_3, both_sides=boolean_3)

create = List.Create(thicken_2, thicken_3, watch_4)
flatten = Flatten(create)
floorGeoms = Input()
getItemAtIndex_3 = List.GetItemAtIndex(list=floorGeoms, index=counter)
watch_6 = Watch(getItemAtIndex_3)
intersect = Geometry.Intersect(geometry=watch_6)  # unwired: other
map = List.Map(list=flatten, f_x=intersect)
flatten_2 = Flatten(map)
categories = Categories("GenericModel")
material = Input(material : Material)
byGeometry = DirectShape.ByGeometry(geometry=flatten_2, category=categories, material=material)
watch_7 = Watch(byGeometry)
code_block_2 = CodeBlock { 2; }
getItemAtIndex_4 = List.GetItemAtIndex(list=watch_2@L2, index=code_block_2)
watch_8 = Watch(getItemAtIndex_4)
getItemAtIndex_5 = List.GetItemAtIndex(list=watch_8, index=counter)
string_2 = StringInput("Comments")
set_one_parameter_to_many = Custom[Set One Parameter to Many Elements](elementList=watch_7, valueToSet=getItemAtIndex_5, parameterNameAsString=string_2)  # elements as a list, single value and single parameter name
DirectShape = Output(set_one_parameter_to_many)
