# Dynamo custom node Make Perspective 3D View at Element Location.dyf (Dynamo 0.8.2.2371)
# category: Bakery.Revit.Views

element_list = Input()
watch = Watch(element_list)
location = Custom[Element.Location](element=watch)  # Returns the location of an element as an XYZ (or if it's line-based the start and end point of the line), along with some booleans to help filtering the results. Use this for some element types (e.g. walls or lines) that do not work with the built-in Get Family Instance Location node.
watch_2 = Watch(location.points)
deconstructPoint = Geometry.Points.DeconstructPoint(watch_2)
watch_3 = Watch(deconstructPoint.out2)
offset_z = Input()
code_block = CodeBlock(x=watch_3, o=offset_z) { x+o; }
watch_4 = Watch(code_block)
id = Element.Id(watch)
flat_list_to_list_of_strings = Custom[Flat List to List of Strings](Original_List=id)  # using python methods
naming_Parameter_One = Input()
getParameterValueByName = Element.GetParameterValueByName(element=watch, parameterName=naming_Parameter_One)
naming_Parameter_Two = Input()
getParameterValueByName_2 = Element.GetParameterValueByName(element=watch, parameterName=naming_Parameter_Two)
create = List.Create(flat_list_to_list_of_strings, getParameterValueByName, getParameterValueByName_2)
transpose = List.Transpose(create)
code_block_2 = CodeBlock { " "; }
bv_merge_sublists_with_a = Custom[bv Merge Sublists with a separator](List=transpose, Character=code_block_2)  # forked from Rhythm
watch_5 = Watch(bv_merge_sublists_with_a)
code_block_3 = CodeBlock { false; }
byEyePointAndTarget = PerspectiveView.ByEyePointAndTarget(watch_2, watch_2, watch, bv_merge_sublists_with_a, code_block_3)
watch_6 = Watch(byEyePointAndTarget)
code_block_4 = CodeBlock { "Target Elevation"; }
set_list_of_values_to_list_of = Custom[Set List of Values to List of Elements for One Parameter](elementList=watch_6, parameterNameAsString=code_block_4, valuesToSet=code_block)  # as described
watch_7 = Watch(set_list_of_values_to_list_of)
code_block_5 = CodeBlock { "Eye Elevation"; }
set_list_of_values_to_list_of_2 = Custom[Set List of Values to List of Elements for One Parameter](elementList=watch_7, parameterNameAsString=code_block_5, valuesToSet=code_block)
watch_8 = Watch(set_list_of_values_to_list_of_2)
views_made = Output(watch_8)
