# Dynamo custom node Merge 1D List to String Pythonic.dyf (Dynamo 1.3.4.6666)
# category: Bakery.Core.List

aList = Input()
python_script = Python(IN[0]=aList)
# ---------- python_script.python (10 lines) ----------
import clr
clr.AddReference('ProtoGeometry')
from Autodesk.DesignScript.Geometry import *
#The inputs to this node will be stored as a list in the IN variables.
x = IN[0]
merged = []
merged.append(''.join(x))

#Assign your output to the OUT variable.
OUT = merged[0]
# ----------------------------------------
aString = Output(python_script)
