# Dynamo custom node Mirror Element Using Origin and Normal Vector.dyf (Dynamo 1.3.4.6666)
# category: Bakery.Revit.Elements

elementsToMirror = Input()
create = List.Create(elementsToMirror)
flatten = Flatten(create)
location = Custom[Element.Location](element=flatten)  # Returns the location of an element as an XYZ (or if it's line-based the start and end point of the line), along with some booleans to help filtering the results. Use this for some element types (e.g. walls or lines) that do not work with the built-in Get Family Instance Location node.
facingOrientation = Custom[HostedObject.FacingOrientation](instances=flatten)  # from old clockwork
watch = Watch(facingOrientation)
handOrientation = Custom[HostedObject.HandOrientation](familyInstance=flatten)  # "FamilyInstance.HandOrientation"; Gets the hand orientation of a hosted object (e.g. a window or a door)
create_2 = List.Create(watch, handOrientation)
Facing0orHand1 = Input()
getItemAtIndex = List.GetItemAtIndex(list=create_2, index=Facing0orHand1)
byOriginNormal = Plane.ByOriginNormal(origin=location.points, normal=getItemAtIndex)
mirror_an_element = Custom[Mirror an Element](elementList=flatten, planeList=byOriginNormal)  # using python
Done = Output(mirror_an_element)
string = StringInput("Delete Mirror Originals")
byElements = Custom[SelectionSet.ByElements](Name=string, elements=flatten)  # Creates a selections set of the given elements. Note that if a selection set of the given name already exists in the model, its contents will be replaced. Also, if the selection set is already applied as a view filter, the view filter will have to be manually updated in the visibility / graphic overrides.
Selection_Set_For_Deletion = Output(byElements)
