# Dynamo custom node Natural Sort List of Strings.dyf (Dynamo 1.1.0.2094)
# category: Bakery.Core.String

listOfStrings = Input()
python_script = Python(IN[0]=listOfStrings)
# ---------- python_script.python (9 lines) ----------
# lingkonn@gmail.com

x=IN[0]
import re
def sort(x): 
    convertText = lambda text: int(text) if text.isdigit() else text.lower() 
    Textkey = lambda key: [ convertText(c) for c in re.split('([0-9]+)', key) ] 
    return sorted(x, key = Textkey)
OUT = sort(x)
# ----------------------------------------
# note: via Md Lingkon
sortedList = Output(python_script)
