# Dynamo custom node Number to Padded String.dyf (Dynamo 1.3.4.6666)
# category: Bakery.Core.String
# padded with zeroes

listOfNums = Input()
totalLength = Input()

# group: pad
python_script = Python(IN[0]=listOfNums, IN[1]=totalLength)
# ---------- python_script.python (18 lines) ----------
import clr
clr.AddReference('ProtoGeometry')
from Autodesk.DesignScript.Geometry import *
#The inputs to this node will be stored as a list in the IN variables.
z = IN[0]
pad = IN[1]
strs = []
def add_nulls2(int, cnt):
    nulls = str(int)
    for i in range(cnt - len(str(int))):
        nulls = '0' + nulls
    return nulls
for x in z:
	temp=add_nulls2(int(x),pad)
	strs.append(temp)

#Assign your output to the OUT variable.
OUT = strs
# ----------------------------------------

paddedStrings = Output(python_script)
