# Dynamo custom node Quick Text Note in View.dyf (Dynamo 1.3.0.875)
# category: Bakery.Revit.Elements.Text
# hard coded at 0,0 point and with left alignment

text = Input(text : string)
view = Input(view : var[]..[])
byCoordinates = Point.ByCoordinates()
code_block = CodeBlock { 0; }
code_block_2 = CodeBlock { 1000; }
enumerate_text_align_flags = Custom[Enumerate Text Align Flags]()
watch = Watch(enumerate_text_align_flags)
code_block_3 = CodeBlock { 0; }
getItemAtIndex = List.GetItemAtIndex(list=watch, index=code_block_3)
byStringAndPosition = Custom[TextNote.ByStringAndPosition](text=text, view=view, point=byCoordinates, rotation=code_block, width=code_block_2, textAlignFlag=getItemAtIndex)  # Creates a text note at a given location
textNote = Output(byStringAndPosition)
