# Dynamo custom node Read From IFC.dyf (Dynamo 1.1.0.2094)
# category: Bakery.BIM.IFC
# adapted by me from original code at https://github.com/mvaerle/python-ifc

ifcFilePath = Input()
ifcSchemaFileEXP = Input()
python_script = Python(IN[0]=ifcFilePath, IN[1]=ifcSchemaFileEXP)
# ---------- python_script.python (263 lines) ----------
import clr
clr.AddReference('ProtoGeometry')
from Autodesk.DesignScript.Geometry import *
import sys
sys.path.append("C:\Program Files (x86)\IronPython 2.7\Lib")
import re, copy
import time
#The inputs to this node will be stored as a list in the IN variables.
ifcFilePath = IN[0]
schemaFilePath = IN[1]
#getThis = IN[2]
printlist = []
parseLog = []
entByIdList = []
attribList = []
partList = []
lineIds = []
lineNames = []
#ifcreader code from https://github.com/mvaerle/python-ifc/blob/master/ifcschemareader.py

t3 = time.time()

class IfcSchema:
    SIMPLETYPES = ["INTEGER", "REAL", "STRING", "NUMBER", "LOGICAL", "BOOLEAN"]
    NO_ATTR = ["WHERE", "INVERSE","WR2","WR3", "WR4", "WR5", "UNIQUE", "DERIVE"]

    def __init__(self, filename):
        self.filename = filename
        self.file = open(self.filename)
        self.data = self.file.read()
        self.types = self.readTypes()
        self.entities = self.readEntities()
        printlist.append("Parsed from schema %s: %s entities and %s types" % (self.filename, len(self.entities), len(self.types)))

    def readTypes(self):
        """
        Parse all the possible types from the schema, 
        returns a dictionary Name -> Type
        """
        types = {}
        for m in re.finditer("TYPE (.*) = (.*);", self.data):
            typename, typetype = m.groups() 
            if typetype in self.SIMPLETYPES:
                types[typename] = typetype
            else:
                types[typename] = "#" + typetype
                
        return types
        
    def readEntities(self):
        """
        Parse all the possible entities from the schema,
        returns a dictionary of the form:
        { name: { 
            "supertype": supertype, 
            "attributes": [{ key: value }, ..]
        }}  
        """
        entities = {}
        
        # Regexes must be greedy to prevent matching outer entity and end_entity strings
        # Regexes have re.DOTALL to match newlines
        for m in re.finditer("ENTITY (.*?)END_ENTITY;", self.data, re.DOTALL):
            entity = {}
            raw_entity_str = m.groups()[0]

            entity["name"] = re.search("(.*?)[;|\s]", raw_entity_str).groups()[0].upper()

            subtypeofmatch = re.search(".*SUBTYPE OF \((.*?)\);", raw_entity_str)
            entity["supertype"] = subtypeofmatch.groups()[0].upper() if subtypeofmatch else None

            # find the shortest string matched from the end of the entity type header to the
            # first occurence of a NO_ATTR string (when it occurs on a new line)
            inner_str = re.search(";(.*?)$", raw_entity_str, re.DOTALL).groups()[0]            

            attrs_str = min([inner_str.partition("\r\n "+a)[0] for a in self.NO_ATTR])
            attrs = []
            for am in re.finditer("(.*?) : (.*?);", attrs_str, re.DOTALL):
                name, attr_type = [s.replace("\r\n\t","") for s in am.groups()]
                attrs.append((name, attr_type))
            
            entity["attributes"] = attrs
            entities[entity["name"]] = entity
        

        return entities

    def getAttributes(self, name):
        """
        Get all attributes af an entity, including supertypes
        """
        ent = self.entities[name]

        attrs = []
        while ent != None:
            this_ent_attrs = copy.copy(ent["attributes"])
            this_ent_attrs.reverse()
            attrs.extend(this_ent_attrs)
            ent = self.entities.get(ent["supertype"], None)

        attrs.reverse()
        return attrs
        
	if __name__ == "__main__":
		schema = IfcSchema(schemaFilePath)


IFCLINE_RE = re.compile("#(\d+)[ ]?=[ ]?(.*?)\((.*)\);[\\r]?$")

class IfcFile:
    """
    Parses an ifc file given by filename, entities can be retrieved by name and id
    The whole file is stored in a dictionary (in memory)
    """
    
    entsById = {}
    entsByName = {}

    def __init__(self, filename, schema):
        self.filename = filename
        self.schema = schema
        self.file = open(self.filename)
        self.entById, self.entsByName = self.read()
        printlist.append("Parsed from file %s: %s entities" % (self.filename, len(self.entById)))
    
    def getEntityById(self, id):
        return self.entById.get(id, None)
    
    def getEntitiesByName(self, name):
        return self.entsByName.get(name, None)

    def read(self):
        """
        Returns 2 dictionaries, entById and entsByName
        """
        entById = {}
        entsByName = {}
        for line in self.file:
            e = self.parseLine(line)
            if e:
                entById[int(e["id"])] = e
                ids = e.get(e["name"],[])
                ids.append(e["id"])
                entByIdList.append(ids)
                entsByName[e["name"]] = list(set(ids))
        return [entById, entsByName]

    def parseLine(self, line):
        """
        Parse a line 
        """ 
        m = IFCLINE_RE.search(line)  # id,name,attrs
        if m:
            id, name, attrs = m.groups()
        else:
            return False
        
        lineIds.append(id)
        lineNames.append(name)
        
        return {"id": id, "name": name, "attributes": self.parseAttributes(name, attrs)}

    def parseAttributes(self, ent_name, attrs_str):
        """
        Parse the attributes of a line
        """
        parts = []
        lastpos = 0
        
        while lastpos < len(attrs_str):
            newpos = self.nextString(attrs_str, lastpos)
            parts.extend(self.parseAttribute(attrs_str[lastpos:newpos-1]))
            lastpos = newpos
        
        schema_attributes = self.schema.getAttributes(ent_name)
        parseLog.append("Expected %s attributes, got %s (entity: %s" % \
			(len(schema_attributes), len(parts), ent_name))

#remove this error checking, but it probably needs to come back
#        assert len(schema_attributes) == len(parts), \
#			"Expected %s attributes, got %s (entity: %s" % \
#			(len(schema_attributes), len(parts), ent_name)

        attribute_names = [a[0] for a in schema_attributes]
        attribList.append(attribute_names)
        partList.append(parts)
        
        return dict(zip(attribute_names, parts))

    def parseAttribute(self, attr_str):
        """
        Map a single attribute to a python type (recursively)
        """
        parts = []
        lastpos = 0
        while lastpos < len(attr_str):
            newpos = self.nextString(attr_str, lastpos)
            s = attr_str[lastpos:newpos-1]
            if (s[0] == "(" and s[-1] == ")"): # list, recurse
                parts.append(self.parseAttribute(s[1:-1]))
            else:
                try:
                    parts.append(float(s)) # number, any kind
                except ValueError:
                    if s[0] == "'" and s[-1] == "'": # string
                        parts.append(s[1:-1])
                    elif s == "$":
                        parts.append(None)
                    else:
                        parts.append(s) # ref, enum or other

            lastpos = newpos
        
        return parts


    def nextString(self, s, start):
        """
        Parse the data part of a line
        """
        parens = 0
        quotes = 0

        for pos in range(start,len(s)):
            c = s[pos]
            if c == "," and parens == 0 and quotes == 0:
                return pos+1
            elif c == "(" and quotes == 0:
                parens += 1
            elif c == ")" and quotes == 0:
                parens -= 1
            elif c == "\'" and quotes == 0:
                quotes = 1
            elif c =="\'" and quotes == 1:
                quotes = 0
            
        return len(s)+1                  



#if __name__ == "__main__":
    


t1 = time.time()
schema = IfcSchema(schemaFilePath)
t2 = time.time()
printlist.append("Loading schema took: %s s \n" % ((t2-t1)))

t1 = time.time()
ifcfile = IfcFile(ifcFilePath, schema) #this is the dictionary
t2 = time.time()
printlist.append("Loading file took: %s s \n" % ((t2-t1)))
    
#    print ifcfile.getEntityById(233), "\n"
#print IfcFile.getEntityById(216), "\n"

#Assign your output to the OUT variable.

#getvalue = ifcfile.getEntityById(getThis)
t4 = time.time()
printlist.append("Total run time took: %s s \n" % ((t4-t3)))
OUT = printlist, parseLog, entByIdList, attribList, partList, lineIds, lineNames
# ----------------------------------------
code_block = CodeBlock { 2; }
getItemAtIndex = List.GetItemAtIndex(list=python_script, index=code_block)
watch = Watch(getItemAtIndex)
code_block_2 = CodeBlock { 0; }
getItemAtIndex_2 = List.GetItemAtIndex(list=python_script, index=code_block_2)
log = Output(getItemAtIndex_2)
code_block_3 = CodeBlock { 5; }
getItemAtIndex_3 = List.GetItemAtIndex(list=python_script, index=code_block_3)
line_Ids = Output(getItemAtIndex_3)
code_block_4 = CodeBlock { 1; }
getItemAtIndex_4 = List.GetItemAtIndex(list=python_script, index=code_block_4)
attribute_read_status = Output(getItemAtIndex_4)
code_block_5 = CodeBlock { 3; }
getItemAtIndex_5 = List.GetItemAtIndex(list=python_script, index=code_block_5)
attributesFromSchema = Output(getItemAtIndex_5)
code_block_6 = CodeBlock { 4; }
getItemAtIndex_6 = List.GetItemAtIndex(list=python_script, index=code_block_6)
attribute_values = Output(getItemAtIndex_6)
code_block_7 = CodeBlock { 6; }
getItemAtIndex_7 = List.GetItemAtIndex(list=python_script, index=code_block_7)
IFC_name = Output(getItemAtIndex_7)
