# Dynamo custom node Remove Characters from end of single String.dyf (Dynamo 0.8.0.950)
# category: Bakery.Core.String

singleString = Input()
length = String.Length(singleString)
charsToRemove = Input()
sub = length - charsToRemove
remove = String.Remove(str=singleString, startIndex=sub, count=charsToRemove)
shorterString = Output(remove)
