# Dynamo custom node Remove Empty Strings from List.dyf (Dynamo 0.8.2.2371)
# category: Bakery.Core.List

listOfStrings = Input()
code_block = CodeBlock { ""; }
eq = listOfStrings == code_block
filterByBoolMask = List.FilterByBoolMask(list=listOfStrings, mask=eq)
EmptyRemoved = Output(filterByBoolMask.out)
