# Dynamo custom node Remove Equal Items from List and Preserve Counts.dyf (Dynamo 0.8.0.950)
# category: Bakery.Core.List
# this is a function version of similar Python node, created by Vikram Subbaiah

function_removeinstancesfromlist = CodeBlock()
# ---------- function_removeinstancesfromlist.designscript (24 lines) ----------
def RemoveInstancesFromList(LstFull:var[]..[],LstRmv:var[]..[])
{
return=[Imperative]
{
IndRmv={};
CntFull=0;
CntRmv=0;
while (CntRmv<List.Count(LstRmv))
 {
  if (LstRmv[CntRmv]==LstFull[CntFull])
   {
    IndRmv=List.AddItemToEnd(IndexOf(LstFull,LstFull[CntFull]),IndRmv);
    LstFull=List.ReplaceItemAtIndex(LstFull,CntFull,"");
    CntFull=CntFull+1;
    CntRmv=CntRmv+1;
   }
  else
   {
   CntFull=CntFull+1;
   }
 }
return=Flatten(List.RemoveItemAtIndex(LstFull,IndRmv));
}
};
# ----------------------------------------
list_to_Remove_from = Input()
list_to_Remove = Input()
code_block = CodeBlock(a=list_to_Remove_from, b=list_to_Remove) { RemoveInstancesFromList(a,b); }
reduced_List = Output(code_block)
