# Dynamo custom node Report Import Summary.dyf (Dynamo 0.9.1.4062)
# category: Bakery.Revit.Document.Imports

string = StringInput("ImportSummary")
string_2 = StringInput("---No Imports if True---")
code_block = CodeBlock { false; }
linksAndImports = Custom[Document.LinksAndImports](toggle=code_block)  # Gets all linked and imported files in the document
watch = Watch(linksAndImports.imports)
isEmpty = List.IsEmpty(watch)
string_3 = StringInput("---Number of Imports---")
count = List.Count(linksAndImports.imports)
string_4 = StringInput("---Imported Element ID List---")
id = Element.Id(linksAndImports.imports)
string_5 = StringInput("---List of Imports---")
list_import_information = Custom[List Import Information]()  # shows Element ID, import name and Workset
create = List.Create(string, string_2, isEmpty, string_3, count, string_4, id, string_5, list_import_information)
flatten = Flatten(create)
string_6 = StringInput("NULL VALUE probably no imports")
replaceNull = Custom[List.ReplaceNull](seq=flatten, replacement=string_6)  # Replaces all null values within a given list with a substitute
flatList = Output(replaceNull)
