# Dynamo custom node Report Revit Link Worksets.dyf (Dynamo 0.8.2.2392)
# category: Bakery.Revit.Document.Worksets
# for instance and type

get_all_revit_links_as_element = Custom[Get All Revit Links as Element List]()
bv_elements_to_ids = Custom[bv Elements to IDs](Element_s=get_all_revit_links_as_element)  # forked from CAAD_RWTH
workset = Custom[Element.Workset](Element_s=get_all_revit_links_as_element)  # Retrieves the workset of a given element
element_name_universal = Custom[Element Name Universal](Element_s=workset)  # Modified for 0.8.1
element_type_for_element_lists = Custom[Element Type for Element Lists](Element_s=get_all_revit_links_as_element)
workset_2 = Custom[Element.Workset](Element_s=element_type_for_element_lists)
element_name_universal_2 = Custom[Element Name Universal](Element_s=workset_2)
eq = element_name_universal == element_name_universal_2
element_name_universal_3 = Custom[Element Name Universal](Element_s=get_all_revit_links_as_element)
create = List.Create(get_all_revit_links_as_element, bv_elements_to_ids.ID_s, element_name_universal, element_name_universal_2, eq, element_name_universal_3)
code_block = CodeBlock { 0; }
getItemAtIndex = List.GetItemAtIndex(list=create, index=code_block)
RevitLinkElements = Output(getItemAtIndex)
code_block_2 = CodeBlock { 1; }
getItemAtIndex_2 = List.GetItemAtIndex(list=create, index=code_block_2)
Ids = Output(getItemAtIndex_2)
code_block_3 = CodeBlock { 2; }
getItemAtIndex_3 = List.GetItemAtIndex(list=create, index=code_block_3)
Instance_Workset = Output(getItemAtIndex_3)
code_block_4 = CodeBlock { 3; }
getItemAtIndex_4 = List.GetItemAtIndex(list=create, index=code_block_4)
Type_Workset = Output(getItemAtIndex_4)
code_block_5 = CodeBlock { 4; }
getItemAtIndex_5 = List.GetItemAtIndex(list=create, index=code_block_5)
Do_Instance_Type_Worksets_Match = Output(getItemAtIndex_5)  # "Do Instance/Type Worksets Match?"
Combined_List = Output(create)
code_block_6 = CodeBlock { 5; }
getItemAtIndex_6 = List.GetItemAtIndex(list=create, index=code_block_6)
Link_Names = Output(getItemAtIndex_6)
