# Dynamo custom node Report on Inplace Families.dyf (Dynamo 0.9.2.4472)
# category: Bakery.Revit.Elements.Family

string = StringInput("InplaceFams")
string_2 = StringInput("---Any Inplace Families?---")
collect_all_familyinstance_using = Custom[Collect all FamilyInstance using Element Types]()  # should get model family instances
# note: could be cleaned up
element_list_check_for_inplace = Custom[Element List check for Inplace Families](Elements=collect_all_familyinstance_using)  # pythonic
anyTrue = Custom[List.AnyTrue](seq=element_list_check_for_inplace)  # Returns true if any item in a list of booleans is true.
string_3 = StringInput("---Number of Inplace Families?---")
countTrue = CountTrue(element_list_check_for_inplace)
string_4 = StringInput("---Show List---")
id = Element.Id(collect_all_familyinstance_using)
filterByBoolMask = List.FilterByBoolMask(list=id, mask=element_list_check_for_inplace)
create = List.Create(string, string_2, anyTrue, string_3, countTrue, string_4, filterByBoolMask.in)
flatten = Flatten(create)
string_5 = StringInput("NULL VALUE")
replaceNull = Custom[List.ReplaceNull](seq=flatten, replacement=string_5)  # Replaces all null values within a given list with a substitute
flatList = Output(replaceNull)
filterByBoolMask_2 = List.FilterByBoolMask(list=collect_all_familyinstance_using, mask=element_list_check_for_inplace)
inplace_families = Output(filterByBoolMask_2.in)
