# Dynamo custom node Rooms to PolyCurves.dyf (Dynamo 0.8.2.2371)
# category: Bakery.Revit.Elements.Room
# deeply nested, could be hidden

roomList = Input()
one_room_to_its_polycurves = Custom[one Room to its PolyCurves]()  # for list.map
map = List.Map(list=roomList, f_x=one_room_to_its_polycurves)
PolyCurves = Output(map)
