# Dynamo custom node Send Family Location Points to Excel.dyf (Dynamo 0.8.2.2371)
# category: Bakery.Office.Excel

excel_File_Path = Input()
code_block = CodeBlock { "Sheet1"; }
code_block_2 = CodeBlock { 0; }
code_block_3 = CodeBlock { "Id"; }
family_instance_elements = Input()
watch = Watch(family_instance_elements)
id = Element.Id(watch)
flat_list_to_list_of_strings = Custom[Flat List to List of Strings](Original_List=id)  # using python methods
addItemToFront = List.AddItemToFront(item=code_block_3, list=flat_list_to_list_of_strings)
code_block_4 = CodeBlock { "Point"; }
location = FamilyInstance.Location(watch)
addItemToFront_2 = List.AddItemToFront(item=code_block_4, list=location)
code_block_5 = CodeBlock { "X"; }
deconstructPoint = Geometry.Points.DeconstructPoint(location)
addItemToFront_3 = List.AddItemToFront(item=code_block_5, list=deconstructPoint.out0)
code_block_6 = CodeBlock { "Y"; }
addItemToFront_4 = List.AddItemToFront(item=code_block_6, list=deconstructPoint.out1)
code_block_7 = CodeBlock { "Z"; }
addItemToFront_5 = List.AddItemToFront(item=code_block_7, list=deconstructPoint.out2)
create = List.Create(addItemToFront, addItemToFront_2, addItemToFront_3, addItemToFront_4, addItemToFront_5)
transpose = List.Transpose(create)
writeToFile = Excel.WriteToFile(filePath=excel_File_Path, sheetName=code_block, startRow=code_block_2, startCol=code_block_2, data=transpose)
done = Output(writeToFile)
