# Dynamo custom node Set Instance Parameter by Type Parameter.dyf (Dynamo 0.8.0.950)
# category: Bakery.Revit.Parameters
# takes list of Elements. Works nicely with Select Model Elements input.

elements = Input()
watch = Watch(elements)
flatten = Flatten(watch)
InstanceParameterNameAsString = Input()
create = List.Create(InstanceParameterNameAsString)
count = List.Count(watch)
cycle = List.Cycle(list=create, amount=count)
flatten_2 = Flatten(cycle)
type = Custom[Element.Type](Element_s=watch)  # Gets the family type of a given element (if applicable).
TypeParameterNameAsString = Input()
getParameterValueByName = Element.GetParameterValueByName(element=type, parameterName=TypeParameterNameAsString)
flatten_3 = Flatten(getParameterValueByName)
setParameterByName = Element.SetParameterByName(element=flatten, parameterName=flatten_2, value=flatten_3)
elementsModified = Output(setParameterByName)
