# Dynamo custom node Set View Discipline for All Views by Name.dyf (Dynamo 1.2.1.3083)
# category: Bakery.Revit.Views

list_all_views = Custom[List All Views]()  # not including sheets
watch = Watch(list_all_views)
ViewDiscipline = Input(ViewDiscipline : string)
set_discipline_property_for = Custom[Set Discipline Property for Views](Views=watch, ViewDiscipline=ViewDiscipline)
watch_2 = Watch(set_discipline_property_for)
get_indices_of_null_values = Custom[Get Indices of Null Values](list=watch_2)  # .
getItemAtIndex = List.GetItemAtIndex(list=watch, index=get_indices_of_null_values)
failed = Output(getItemAtIndex)
remove_list_from_list_by_item = Custom[Remove List from List by Item not Value](ListOfItemsToRemove=getItemAtIndex, ListToRemoveFrom=watch)  # remove the items in ListA from the items in ListB and return whats left
succeeded = Output(remove_list_from_list_by_item.reducedList)
