# Dynamo custom node Set Workset for a Single Element.dyf (Dynamo 1.3.3.4651)
# category: Bakery.Revit.Elements
# use with list.map

Elementz = Input()
Worksetz = Input()
python_script = Python(IN[0]=Elementz, IN[1]=Worksetz)
# ---------- python_script.python (30 lines) ----------
import clr
clr.AddReference('RevitAPI')
from Autodesk.Revit.DB import *

clr.AddReference("RevitServices")
import RevitServices
from RevitServices.Persistence import DocumentManager
from RevitServices.Transactions import TransactionManager

doc = DocumentManager.Instance.CurrentDBDocument

faminsts = UnwrapElement(IN[0])
ws = UnwrapElement(IN[1])
wsId = ws.Id.IntegerValue
diditwork = ""
try:
	try:
		TransactionManager.Instance.ForceCloseTransaction()
	except:
		pass
	t = Transaction(doc, 'Setting value')
	t.Start()
	wsparam = faminsts.get_Parameter(BuiltInParameter.ELEM_PARTITION_PARAM)
	wsparamAsInt = wsparam.AsInteger()
	wsparam.Set(wsId)
	t.Commit
	diditwork = "Success"
except:
	diditwork = "Failed"
OUT = faminsts, ws, wsId, wsparam, wsparamAsInt, diditwork
# ----------------------------------------
ChangedElems = Output(python_script)
