# Dynamo custom node Single Curve to Room Separation Line in Active View.dyf (Dynamo 0.9.2.4472)
# category: Bakery.Revit.Elements.Room
# view should be a Plan View

curve = Input(curve : Curve)
current = Document.Current()
activeView = Document.ActiveView(current)
plane = Custom[View.Plane](view=activeView)  # Retrieves the plane of a given view
byPlane = SketchPlane.ByPlane(plane)
fromCurve = Custom[RoomSeparator.FromCurve](curve=curve, sketchPlane=byPlane, view=activeView)  # Creates room separation lines from geometry curves.
roomSeparator = Output(fromCurve)
