# Dynamo custom node String Search All Element.Parameters for a Single Element.dyf (Dynamo 0.8.2.2371)
# category: Bakery.Revit.Parameters

oneElementOnly = Input()
parameters = Element.Parameters(oneElementOnly)
flat_list_to_list_of_strings = Custom[Flat List to List of Strings](Original_List=parameters)  # using python methods
searchFor = Input()
code_block = CodeBlock { true; }
contains = String.Contains(searchFor=searchFor, ignoreCase=code_block)
map = List.Map(list=flat_list_to_list_of_strings, f_x=contains)
bools = Output(map)
anyTrue = Custom[List.AnyTrue](seq=map)  # Returns true if any item in a list of booleans is true.
Any_Found = Output(anyTrue)  # "Any Found?"
