# Dynamo custom node Translate Geometry from Centroid to Origin.dyf (Dynamo 1.2.1.3083)
# category: Bakery.Geometry
# good for moving point cloud points back closer to Revit origin

geometry = Input()
watch = Watch(geometry)
byGeometry = BoundingBox.ByGeometry(watch)
toCuboid = BoundingBox.ToCuboid(byGeometry)
centroid = Solid.Centroid(toCuboid)
byCoordinates = Point.ByCoordinates()
byTwoPoints = Vector.ByTwoPoints(start=centroid, end=byCoordinates)
watch_2 = Watch(byTwoPoints)
translate = Geometry.Translate(geometry=watch, direction=watch_2)
geometryMovedToOrigin = Output(translate)
