# Dynamo custom node Truncate X and Y Values in a String List.dyf (Dynamo 1.3.0.875)
# category: Bakery.Construction.PointCloud
# for point cloud translation

OriginalDataList = Input(OriginalDataList : string)
XstartIndex = Input(XstartIndex : int)
XremoveCount = Input(XremoveCount : int)
remove = String.Remove(str=OriginalDataList, startIndex=XstartIndex, count=XremoveCount)
YstartIndex = Input(YstartIndex : var[]..[])
YremoveCount = Input(YremoveCount : int)
remove_2 = String.Remove(str=remove, startIndex=YstartIndex, count=YremoveCount)
modifiedData = Output(remove_2)
characterAtIndex = Custom[String.CharacterAtIndex](List=OriginalDataList, Index=XstartIndex)  # Get's the character at a given index
XuniqueCheck = Output(characterAtIndex)
characterAtIndex_2 = Custom[String.CharacterAtIndex](List=remove, Index=YstartIndex)
YuniqueCheck = Output(characterAtIndex_2)
