# Dynamo custom node Unload Revit Links by Instance.dyf (Dynamo 1.2.1.3083)
# category: Bakery.Revit.Document.Links

link_instances = Input()
turnIntoList = Custom[TurnIntoList](unknownItem=link_instances)  # Turns an element (or a nested list) into a flat list
python_script = Python(IN[0]=turnIntoList)
# ---------- python_script.python (37 lines) ----------
import clr
clr.AddReference('RevitAPI')
import Autodesk
from Autodesk.Revit.DB import *
from Autodesk.Revit.Attributes import*

clr.AddReference("RevitServices")
import RevitServices
from RevitServices.Persistence import DocumentManager
from RevitServices.Transactions import TransactionManager

clr.AddReference("RevitNodes")
import Revit
clr.ImportExtensions(Revit.Elements)


linkcollector = UnwrapElement(IN[0])

doc = DocumentManager.Instance.CurrentDBDocument

revitlinktypes=list()
#linkcollector=FilteredElementCollector(doc).OfClass(RevitLinkInstance)
revitlinktypes=[]
successlist = []
TransactionManager.Instance.ForceCloseTransaction()
TransactionManager.Instance.EnsureInTransaction(doc)

for rli in linkcollector:
	rlt=doc.GetElement(rli.GetTypeId())
	try:
		revitlinktypes.append(rlt)
		rlt.Unload(None)
		successlist.append(True)
	except:
		successlist.append(False)
TransactionManager.Instance.TransactionTaskDone()
OUT= successlist
# ----------------------------------------
OUT = Output(python_script)
