# Dynamo custom node Write String to File.dyf (Dynamo 1.3.4.6666)
# category: Bakery.Core.File

pathStr = Input()
stringToWrite = Input()
python_script = Python(IN[0]=pathStr, IN[1]=stringToWrite)
# ---------- python_script.python (39 lines) ----------
import clr
#clr.AddReference('ProtoGeometry')
#from Autodesk.DesignScript.Geometry import *

# Import RevitAPI
#clr.AddReference("RevitAPI")
#import Autodesk
#from Autodesk.Revit.DB import *

#clr.AddReference("RevitServices")
#import RevitServices
#from RevitServices.Persistence import DocumentManager
#from RevitServices.Transactions import TransactionManager

#from System.Collections.Generic import *

#clr.AddReference('RevitNodes')
#import Revit
#clr.ImportExtensions(Revit.Elements)
#clr.ImportExtensions(Revit.GeometryConversion)

from System import Guid

import System
from System.IO import Directory, Path

import sys
pyt_path = r'C:\Program Files (x86)\IronPython 2.7\Lib'
sys.path.append(pyt_path)

import os
import datetime, time

outfile = IN[0]
stringdebug = []
with open(outfile, 'w') as f:
	f.write(IN[1])

OUT = "Done"
# ----------------------------------------
success = Output(python_script)
