# Dynamo custom node Zero to One Range with Divisor.dyf (Dynamo 0.8.2.2371)
# category: Bakery.Core.Math

code_block = CodeBlock { 1; }
code_block_2 = CodeBlock { 0; }
code_block_3 = CodeBlock { 0.01; }
code_block_4 = CodeBlock { 0.99; }
code_block_5 = CodeBlock { 1; }
divisor = Input()
code_block_6 = CodeBlock(x=code_block_5, y=divisor) { x/y; }
number_range = NumberRange(code_block_3, code_block_4, code_block_6, lacing=Longest)
addItemToFront = List.AddItemToFront(item=code_block_2, list=number_range)
addItemToEnd = List.AddItemToEnd(code_block, addItemToFront)
range = Output(addItemToEnd)
