# Dynamo custom node bv Remove from String Prior to Character.dyf (Dynamo 0.8.2.2392)
# category: Bakery.Dynamo.ForkedNodes
# forked from Rhythm

str = Input(str : string)
Character = Input()
ignoreCase = Input(ignoreCase : bool=false)
indexOf = String.IndexOf(string=str, searchFor=Character, ignoreCase=ignoreCase)
code_block = CodeBlock(in1=indexOf) { in2=in1+1; in2*-1; }
remove = String.Remove(str=str, startIndex=code_block.in2, count=code_block.out1)
Modifed = Output(remove)
