# Dynamo custom node mysql Element Fingerprint to File.dyf (Dynamo 1.2.1.3083)
# category: Bakery.Data.Database

oneElement = Input()
crawlKey = Input()
elementFingerprintFM = Custom[ElementFingerprintFM](oneElement=oneElement, crawlkey=crawlKey)
dbName = Input(dbName : string)
tableName = Input(tableName : string)
mysql_create_list_of_insert = Custom[mysql Create List of Insert Instructions](columnNameList=elementFingerprintFM.columnNameList, dataList=elementFingerprintFM.valueList, dbName=dbName, tableName=tableName)
commandString = Output(mysql_create_list_of_insert)
