# Dynamo custom node subnode to Set 3D CAD Worksets.dyf (Dynamo 1.3.0.875)
# category: Bakery.Revit.Document.Worksets.Helper

worksets = Input()
index = Input(index : int)
getItemAtIndex = List.GetItemAtIndex(list=worksets, index=index)
elementlist = Input()
getItemAtIndex_2 = List.GetItemAtIndex(list=elementlist, index=index)
setWorkset = Custom[Element.SetWorkset](workset=getItemAtIndex, element=getItemAtIndex_2)  # Sets the workset of a given element
typelist = Input()
getItemAtIndex_3 = List.GetItemAtIndex(list=typelist, index=index)
setWorkset_2 = Custom[Element.SetWorkset](workset=getItemAtIndex, element=getItemAtIndex_3)
create = List.Create(setWorkset.changedElements, setWorkset_2.changedElements)
changedElements = Output(create)
