# Dynamo custom node Add Prefix to Items in String List.dyf (Dynamo 1.3.0.875)
# category: Bakery.Core.String

string_list = Input()
watch = Watch(string_list)
code_block = CodeBlock { ""; }
prefix = Input()
join = String.Join(code_block, prefix)  # unwired: arg2
map = List.Map(list=watch, f_x=join)
new_strings = Output(map)
