# Dynamo custom node Add RVT Link and Unload.dyf (Dynamo 1.2.1.3083)
# category: Bakery.Revit.Document.Links

filePath = Input()
turnIntoList = Custom[TurnIntoList](unknownItem=filePath)  # Turns an element (or a nested list) into a flat list
python_script = Python(IN[0]=turnIntoList)
# ---------- python_script.python (41 lines) ----------
import clr
clr.AddReference('RevitAPI')
from Autodesk.Revit.DB import *

clr.AddReference("RevitServices")
import RevitServices
from RevitServices.Persistence import DocumentManager
from RevitServices.Transactions import TransactionManager

doc = DocumentManager.Instance.CurrentDBDocument
linkpaths = IN[0]
elementlist = list()
booleans = list()
successlist = list()


for path in linkpaths:
	try:
		TransactionManager.Instance.EnsureInTransaction(doc)
		linkpath = ModelPathUtils.ConvertUserVisiblePathToModelPath(path)
		linkoptions = RevitLinkOptions(False)
		linkloadresult = RevitLinkType.Create(doc, linkpath, linkoptions)
		TransactionManager.Instance.TransactionTaskDone()
		tempelem = RevitLinkInstance.Create(doc, linkloadresult.ElementId)
		elementlist.append(tempelem)
#		tempunload = doc.GetElement(tempelem.GetTypeId())
		try:
			x = doc.GetElement(tempelem.GetTypeId())
			try:
				TransactionManager.Instance.ForceCloseTransaction()
				x.Unload(None);
				successlist.append("unloaded")
			except:
				successlist.append("could not unload")
		except:
			successlist.append("could not get link type")
		booleans.append(True)
	except:
		booleans.append(False)

OUT = (elementlist, booleans, successlist, x)
# ----------------------------------------
allOutput = Output(python_script)
code_block = CodeBlock { 0; }
getItemAtIndex = List.GetItemAtIndex(list=python_script, index=code_block)
linkInstances = Output(getItemAtIndex)
