# Dynamo custom node Boolean Input to Variable String Output.dyf (Dynamo 0.8.2.2371)
# category: Bakery.Core.Logic
# you choose what you want to convert true / false to, good for validation

String_if_True = Input()
String_if_False = Input()
create = List.Create(String_if_True, String_if_False)
flatten = Flatten(create)
flat_list_to_list_of_strings = Custom[Flat List to List of Strings](Original_List=flatten)  # using python methods
Boolean_In = Input()
create_2 = List.Create(Boolean_In)
flatten_2 = Flatten(create_2)
flat_list_to_list_of_strings_2 = Custom[Flat List to List of Strings](Original_List=flatten_2)
boolean = BoolSelector(true)
boolean_2 = BoolSelector(false)
create_3 = List.Create(boolean, boolean_2)
flatten_3 = Flatten(create_3)
flat_list_to_list_of_strings_3 = Custom[Flat List to List of Strings](Original_List=flatten_3)
bv_if_equal_return_index = Custom[bv If Equal Return Index](listA=flat_list_to_list_of_strings_2, listB=flat_list_to_list_of_strings_3)  # forked
getItemAtIndex = List.GetItemAtIndex(list=flat_list_to_list_of_strings, index=bv_if_equal_return_index)
firstItem = List.FirstItem(getItemAtIndex)
String_Output = Output(firstItem)
