# Dynamo custom node Check if Elements are Inplace ( In-place Families ).dyf (Dynamo 0.7.5.3566)
# category: Bakery.Revit.Elements.Family
# will take list of elements and return true if inplace

List_of_Elements = Input()
flatten = Flatten(List_of_Elements)
symbol = FamilyInstance.Symbol(flatten)
family = FamilySymbol.Family(symbol)
isInPlace = Custom[Family.IsInPlace](Family=family)  # Determines if a family is an in-place family
anyTrue = Custom[List.AnyTrue](seq=isInPlace)  # Returns true if any item in a list of booleans is true.
Any_Inplace_families = Output(anyTrue)  # "Any Inplace families?"
List_of_bools = Output(isInPlace)
watch = Watch(flatten)
create = List.Create(watch, isInPlace)
Combined_List = Output(create)
watch_2 = Watch(symbol)
