# Dynamo custom node Chooser.dyf (Dynamo 1.2.0.2831)
# category: Bakery.Core.List

zeroItem = Input()
oneItem = Input()
create = List.Create(zeroItem, oneItem)
zeroOrOne = Input()
getItemAtIndex = List.GetItemAtIndex(list=create, index=zeroOrOne)
chosen = Output(getItemAtIndex)
