# Dynamo custom node Collect Sheets By Number Starting With.dyf (Dynamo 1.3.0.875)
# category: Bakery.Revit.Views.Sheet

value = Input(value : var[]..[])
boolean = BoolSelector(false)
bv_collector_for_sheets = Custom[bv Collector for Sheets](value=value, NameOrNumber=boolean)  # forked from spring nodes
watch = Watch(bv_collector_for_sheets.partial_match)
string = StringInput("Sheet Number")
getParameterValueByName = Element.GetParameterValueByName(element=watch, parameterName=string)
startsWith = String.StartsWith(str=getParameterValueByName, searchFor=value)
filterByBoolMask = List.FilterByBoolMask(list=watch, mask=startsWith)
in_ = Output(filterByBoolMask.in)  # "in"
