# Dynamo custom node Compare Two IFCs by GUIDs.dyf (Dynamo 1.2.1.3083)
# category: Bakery.BIM.IFC
# this version makes Guids 'unique' so only reports completely new or deleted, not when items are 'split'.

oldIFCfile = Input()
get_unique_guids_from_ifc_file = Custom[Get Unique GUIDs from IFC File](path=oldIFCfile)  # input is File Path to IFC
newerIFCfile = Input()
get_unique_guids_from_ifc_file_2 = Custom[Get Unique GUIDs from IFC File](path=newerIFCfile)
compare_two_lists_by_item_and = Custom[Compare Two Lists by Item and Return Item Differences](listONE=get_unique_guids_from_ifc_file.unique_list_matching_IFC_format, listTWO=get_unique_guids_from_ifc_file_2.unique_list_matching_IFC_format)

# group: new items
watch = Watch(compare_two_lists_by_item_and.inListTWObutNotInListOne)

addedToNewFile = Output(watch)

# group: items removed from new file
watch_2 = Watch(compare_two_lists_by_item_and.inListONEbutNotInListTwo)

removedFromNewFile = Output(watch_2)
