# Dynamo custom node Copy Elements To Same Place.dyf (Dynamo 1.2.0.2831)
# category: Bakery.Revit.Elements

elements = Input()
python_script = Python(IN[0]=elements)
# ---------- python_script.python (33 lines) ----------
import clr
from System.Collections.Generic import *
clr.AddReference('RevitAPI')
from Autodesk.Revit.DB import *
import Autodesk

clr.AddReference("RevitNodes")
import Revit
clr.ImportExtensions(Revit.Elements)

clr.AddReference("RevitServices")
import RevitServices
from RevitServices.Persistence import DocumentManager
from RevitServices.Transactions import TransactionManager

doc = DocumentManager.Instance.CurrentDBDocument
items = UnwrapElement(IN[0])
#revitvector = UnwrapElement((IN[1].ToXYZ()))

ids = list()
for item in items:
	ids.append(item.Id)	
itemlist = List[ElementId](ids)

TransactionManager.Instance.EnsureInTransaction(doc)
newitems = ElementTransformUtils.CopyElements(doc,itemlist,XYZ())
TransactionManager.Instance.TransactionTaskDone()

elementlist = list()
for item in newitems:
	elementlist.append(doc.GetElement(item).ToDSType(False))

OUT = elementlist
# ----------------------------------------
newelements = Output(python_script)
