# Dynamo custom node Create Floors from Rooms v3.0.dyf (Dynamo 0.8.2.2371)
# category: Bakery.Revit.Elements.Room

roomList = Input(roomList : var[]..[])
rooms_to_polycurves = Custom[Rooms to PolyCurves](roomList=roomList)  # deeply nested, could be hidden
watch = Watch(rooms_to_polycurves)
firstItem = List.FirstItem()
map = List.Map(list=watch, f_x=firstItem)
code_block = CodeBlock { null; }
bv_all_indices_of_that_can = Custom[bv All Indices Of that can handle Nulls](list=map, value=code_block)  # forked from spring nodes
watch_2 = Watch(bv_all_indices_of_that_can)
removeItemAtIndex = List.RemoveItemAtIndex(list=map, indices=watch_2)
closeWithLine = PolyCurve.CloseWithLine()
map_2 = List.Map(list=removeItemAtIndex, f_x=closeWithLine)
watch_3 = Watch(map_2)
floorType = Input(floorType : FloorType)
level = Input(level : Level)
byOutlineTypeAndLevel = Floor.ByOutlineTypeAndLevel(outlineCurves=watch_3, floorType=floorType, level=level)
watch_4 = Watch(byOutlineTypeAndLevel)
removeItemAtIndex_2 = List.RemoveItemAtIndex(list=roomList, indices=watch_2)
code_block_2 = CodeBlock { "Number"; }
getParameterValueByName = Element.GetParameterValueByName(element=removeItemAtIndex_2, parameterName=code_block_2)
watch_5 = Watch(getParameterValueByName)

# group: clean and set param
code_block_3 = CodeBlock { null; }
bv_all_indices_of_that_can_2 = Custom[bv All Indices Of that can handle Nulls](list=watch_4, value=code_block_3)
removeItemAtIndex_3 = List.RemoveItemAtIndex(list=watch_4, indices=bv_all_indices_of_that_can_2)
string = StringInput("Comments")
removeItemAtIndex_4 = List.RemoveItemAtIndex(list=watch_5, indices=bv_all_indices_of_that_can_2)
set_list_of_values_to_list_of = Custom[Set List of Values to List of Elements for One Parameter](elementList=removeItemAtIndex_3, parameterNameAsString=string, valuesToSet=removeItemAtIndex_4)  # as described

floors_made = Output(set_list_of_values_to_list_of)
