# Dynamo custom node Create Worksets for 3D CAD Links or Imports.dyf (Dynamo 1.3.0.875)
# category: Bakery.Revit.Document.Worksets

links_and_imports_in_view_or = Custom[Links and Imports in View or Model]()  # separates into view based and model based dwgs or imports
string = StringInput("")
PrefixIfDesired = Input(PrefixIfDesired : string = "Link - ")
join = String.Join(string, PrefixIfDesired)  # unwired: arg2
map = List.Map(list=links_and_imports_in_view_or.modelBasedImportNames, f_x=join)
uniqueItems = List.UniqueItems(map)
create = Custom[Workset.Create](worksetNames=uniqueItems)  # Creates a workset or worksets from input names.
names = Output(create)
