# Dynamo custom node Design Option Summary.dyf (Dynamo 0.8.2.2371)
# category: Bakery.Revit.Document
# using Archi-lab

get_design_options = Custom[Get Design Options]()  # Queries all of the design options currently in the project.
count = List.Count(get_design_options.Design_Option_s)
code_block = CodeBlock { 0; }
eq = count == code_block
TrueMeansNoDesignOptions = Output(eq)
string_from_array = FromArray(get_design_options.Name_s)
listOfOptionsAsString = Output(string_from_array)
