# Dynamo custom node DoesIntersect and AnyTrue.dyf (Dynamo 1.3.2.2480)
# category: Bakery.Geometry

geom = Input()
other = Input()
doesIntersect = Geometry.DoesIntersect(geometry=geom, other=other)
anyTrue = Custom[List.AnyTrue](seq=doesIntersect)  # Returns true if any item in a list of booleans is true.
bool = Output(anyTrue)
