# Dynamo custom node Duplicate Views.dyf (Dynamo 0.9.1.4062)
# category: Bakery.Revit.Views

viewsToDuplicate = Input()
watch = Watch(viewsToDuplicate)
enumerate_view_duplicate_options = Custom[Enumerate View Duplicate Options]()
watch_2 = Watch(enumerate_view_duplicate_options)
duplicationOption = Input(duplicationOption : string = "Duplicate")
turnIntoList = Custom[TurnIntoList](unknownItem=duplicationOption)  # Turns an element (or a nested list) into a flat list
flat_list_to_list_of_strings = Custom[Flat List to List of Strings](Original_List=watch_2)  # using python methods
if_equal_return_index_using = Custom[If Equal Return Index using IndexOf](searchForThese=turnIntoList, inThisList=flat_list_to_list_of_strings)
getItemAtIndex = List.GetItemAtIndex(list=watch_2, index=if_equal_return_index_using)
firstItem = List.FirstItem(getItemAtIndex)
python_script = Python(IN[0]=watch, IN[1]=firstItem)
# ---------- python_script.python (48 lines) ----------
#Luke Stanley Johnson for Bakery
import clr
clr.AddReference('ProtoGeometry')
from Autodesk.DesignScript.Geometry import *

# Import ToDSType(bool) extension method
clr.AddReference("RevitNodes")
import Revit
clr.ImportExtensions(Revit.Elements)

# Import DocumentManager and TransactionManager
clr.AddReference("RevitServices")
import RevitServices
from RevitServices.Persistence import DocumentManager
from RevitServices.Transactions import TransactionManager

from System.Collections.Generic import *

# Import RevitAPI
clr.AddReference("RevitAPI")
import Autodesk

doc = DocumentManager.Instance.CurrentDBDocument
uiapp = DocumentManager.Instance.CurrentUIApplication
app = uiapp.Application

#The inputs to this node will be stored as a list in the IN variable.

#viewlistOne = []
#for j in IN[0]:
#	viewlistOne.append(UnwrapElement(j))
duplicationoption = IN[1]

viewlistTwo = []
for k in IN[0]:
	viewlistTwo.append(UnwrapElement(k))

resultlist = []
TransactionManager.Instance.EnsureInTransaction(doc)
for i in viewlistTwo:
	try:
		i.Duplicate(duplicationoption)
		resultlist.append("View Duplicated OK")
	except:
		resultlist.append("View Duplication FAILED")
TransactionManager.Instance.TransactionTaskDone()
#Assign your output to the OUT variable
OUT = duplicationoption, viewlistTwo, resultlist
# ----------------------------------------
watch_3 = Watch(python_script)
all_duplicate_options_available = Output(watch_2)
code_block = CodeBlock { 1; }
getItemAtIndex_2 = List.GetItemAtIndex(list=python_script, index=code_block)
views_duplicated = Output(getItemAtIndex_2)
code_block_2 = CodeBlock { 2; }
getItemAtIndex_3 = List.GetItemAtIndex(list=python_script, index=code_block_2)
success = Output(getItemAtIndex_3)  # "success?"
