# Dynamo custom node Element.Geometry with Try.dyf (Dynamo 1.3.2.2480)
# category: Bakery.Geometry

elements = Input()
turnIntoList = Custom[TurnIntoList](unknownItem=elements)  # Turns an element (or a nested list) into a flat list
python_script = Python(IN[0]=turnIntoList)
# ---------- python_script.python (59 lines) ----------
import clr
clr.AddReference('ProtoGeometry')
from Autodesk.DesignScript.Geometry import *
# Import ToDSType(bool) extension method
clr.AddReference("RevitNodes")
import Revit
clr.ImportExtensions(Revit.Elements)
# Import geometry conversion extension methods
clr.ImportExtensions(Revit.GeometryConversion)
# Import DocumentManager and TransactionManager
clr.AddReference("RevitServices")
import RevitServices
from RevitServices.Persistence import DocumentManager
from RevitServices.Transactions import TransactionManager
from System.Collections.Generic import *
# Import RevitAPI
clr.AddReference("RevitAPI")
import Autodesk
from Autodesk.Revit.DB import *

doc = DocumentManager.Instance.CurrentDBDocument
uiapp = DocumentManager.Instance.CurrentUIApplication
app = uiapp.Application
uidoc=DocumentManager.Instance.CurrentUIApplication.ActiveUIDocument

#The inputs to this node will be stored as a list in the IN variable.
#dataEnteringNode = IN

clashElementsBdirty=IN[0]

# Start Transaction
TransactionManager.Instance.EnsureInTransaction(doc)
clashGeomBuntransformed = []
clashElementsB = []
#clashGeomB = []
FailuresB = []
gcrvs = []

for b in clashElementsBdirty:
	try:
		clashGeomBuntransformed.append(b.Geometry()[0])
		clashElementsB.append(b)
	except:
		FailuresB.append(b)

#need to transform set B geometries
#def GetTransformedGeom(geom, t=trans):
#	xyz = geom.ToXyz()
#	return t.OfPoint(xyz).ToPoint()


# End Transaction
TransactionManager.Instance.TransactionTaskDone()

#if fileversion == "":
#	OUT="Default settings used"
#else:
#	OUT=total_export
OUT = clashElementsB, clashGeomBuntransformed, FailuresB, gcrvs
# ----------------------------------------
code_block = CodeBlock { 0; }
getItemAtIndex = List.GetItemAtIndex(list=python_script, index=code_block)
watch = Watch(getItemAtIndex)
elements_2 = Output(watch)  # "elements"
code_block_2 = CodeBlock { 1; }
getItemAtIndex_2 = List.GetItemAtIndex(list=python_script, index=code_block_2)
watch_2 = Watch(getItemAtIndex_2)
geometries = Output(watch_2)
code_block_3 = CodeBlock { 2; }
getItemAtIndex_3 = List.GetItemAtIndex(list=python_script, index=code_block_3)
watch_3 = Watch(getItemAtIndex_3)
failed_elements = Output(watch_3)
