# Dynamo custom node Elements.SetWorksetByName.dyf (Dynamo 1.3.0.875)
# category: Bakery.Revit.Document.Worksets
# takes elements and a desired workset name

elements = Input()
watch = Watch(elements)
worksetName = Custom[Element.WorksetName](element=watch)  # get the workset name of the element
elementWorksetNames = Output(worksetName)
worksets = Custom[Document.Worksets]()  # Returns all Worksets in the current document
watch_2 = Watch(worksets)
element_name_universal = Custom[Element Name Universal](Elements=watch_2)  # Modified for 0.8.1
worksetNameString = Input()
firstIndexOf = List.FirstIndexOf(list=element_name_universal, item=worksetNameString)
watch_3 = Watch(firstIndexOf)
getItemAtIndex = List.GetItemAtIndex(list=watch_2, index=watch_3)
watch_4 = Watch(getItemAtIndex)
setWorkset = Custom[Element.SetWorkset](workset=watch_4, element=watch)  # Sets the workset of a given element
changedElements = Output(setWorkset.changedElements)
create = List.Create(watch, setWorkset.changedElements)
list_length_validator = Custom[List Length Validator](listOfLists=create)
completeSuccess = Output(list_length_validator)  # "completeSuccess?"
