# Dynamo custom node Example FFE Category List for a project.dyf (Dynamo 0.8.2.2371)
# category: Bakery.Revit.Document.Category

code_block = CodeBlock { {"Casework","Electrical Equipment","Furniture","Furniture Systems","Generic Models", "Specialty Equipment"}; }
category_Names = Output(code_block)
