# Dynamo custom node Export To NWC.dyf (Dynamo 1.3.3.4651)
# category: Bakery.Construction.Navisworks
# this one for single view

directoryPath = Input()
fileNamex = Input()
NavisworksExportOptions = Input()
python_script = Python(IN[0]=directoryPath, IN[1]=fileNamex, IN[2]=NavisworksExportOptions)
# ---------- python_script.python (45 lines) ----------
#python nodes in dynamo 1.0
#proposed by Julien Benoit @jbenoit44 
#http://aecuandme.wordpress.com/
import clr
clr.AddReference('ProtoGeometry')
from Autodesk.DesignScript.Geometry import *
# Import ToDSType(bool) extension method
clr.AddReference("RevitNodes")
import Revit
clr.ImportExtensions(Revit.Elements)
# Import geometry conversion extension methods
clr.ImportExtensions(Revit.GeometryConversion)
# Import DocumentManager and TransactionManager
clr.AddReference("RevitServices")
import RevitServices
from RevitServices.Persistence import DocumentManager
from RevitServices.Transactions import TransactionManager
from System.Collections.Generic import *
# Import RevitAPI
clr.AddReference("RevitAPI")
import Autodesk
from Autodesk.Revit.DB import *

doc = DocumentManager.Instance.CurrentDBDocument
uiapp = DocumentManager.Instance.CurrentUIApplication
app = uiapp.Application
uidoc=DocumentManager.Instance.CurrentUIApplication.ActiveUIDocument

#view = []
#for i in IN[0]:
#	views.append(UnwrapElement(i))
folder=UnwrapElement(IN[0])
name=UnwrapElement(IN[1])
exportoptionbldr=UnwrapElement(IN[2])

try:
	c=doc.Export(folder,name,exportoptionbldr)
except:
	c="not sure"


# End Transaction
#TransactionManager.Instance.TransactionTaskDone()

OUT=c
# ----------------------------------------
done = Output(python_script)
