# Dynamo custom node Export to Image using Directory and View Parameter.dyf (Dynamo 0.8.1.1942)
# category: Bakery.Revit.Image

viewElement = Input()
string = StringInput("\")
directoryPath = Input()
string_from_object = FromObject(directoryPath)
viewParameter = Input()
getParameterValueByName = Element.GetParameterValueByName(element=viewElement, parameterName=viewParameter)
join = String.Join(string, string_from_object, getParameterValueByName)
string_2 = StringInput("{")
string_3 = StringInput("(")
replace = String.Replace(str=join, searchFor=string_2, replaceWith=string_3)
string_4 = StringInput("}")
string_5 = StringInput(")")
replace_2 = String.Replace(str=replace, searchFor=string_4, replaceWith=string_5)
watch = Watch(replace_2)
exportAsImage = View.ExportAsImage(viewElement, watch)
done = Output(exportAsImage)
