# Dynamo custom node Filter Revit Selection to View Crop Elements and Names.dyf (Dynamo 0.8.2.2371)
# category: Bakery.Revit.Views

selectedCrops = Input()
watch = Watch(selectedCrops)
flat_list_to_list_of_strings = Custom[Flat List to List of Strings](Original_List=watch)  # using python methods
code_block = CodeBlock { "Element"; }
eq = flat_list_to_list_of_strings == code_block
filterByBoolMask = List.FilterByBoolMask(list=watch, mask=eq)
cropElements = Output(filterByBoolMask.in)
element_name_universal = Custom[Element Name Universal](Element_s=filterByBoolMask.in)  # Modified for 0.8.1
cropNames = Output(element_name_universal)
