# Dynamo custom node Find Maximum in List and Get From Other List.dyf (Dynamo 0.8.2.2392)
# category: Bakery.Core.List

get_from_this_list = Input()
find_max_in_this_list = Input()
watch = Watch(find_max_in_this_list)
maximumItem = List.MaximumItem(watch)
turn_into_list = Custom[Turn Into List](item=maximumItem)  # Turns an element into a (flat) list
list_of_float_double_to_list_of = Custom[List of float double to list of Int](double=turn_into_list)  # no decimals
firstItem = List.FirstItem(list_of_float_double_to_list_of)
indexOf = IndexOf(watch, firstItem)

# group: MAIN DATA NODE
getItemAtIndex = List.GetItemAtIndex(list=get_from_this_list, index=indexOf)

item = Output(getItemAtIndex)
