# Dynamo custom node Flatten List and Replace Null with NULL VALUE.dyf (Dynamo 0.9.1.4062)
# category: Bakery.Core.List

list = Input(list : var[]..[])
turnIntoList = Custom[TurnIntoList](unknownItem=list)  # Turns an element (or a nested list) into a flat list
flatten = Flatten(turnIntoList)
string = StringInput("NULL VALUE")
replaceNull = Custom[List.ReplaceNull](seq=flatten, replacement=string)  # Replaces all null values within a given list with a substitute
list_2 = Output(replaceNull)  # "list"
