# Dynamo custom node Get Element Parameters and Split to Names and Values.dyf (Dynamo 0.8.0.706)
# category: Bakery.Revit.Parameters
# as per title, output is strings

element = Input()
parameters = Element.Parameters(element)
string_from_object = FromObject(parameters)
string = StringInput(" : ")
boolean = BoolSelector(true)
indexOf = String.IndexOf(string=string_from_object, searchFor=string, ignoreCase=boolean)
length = String.Length(string_from_object)
sub = length - indexOf
remove = String.Remove(str=string_from_object, startIndex=indexOf, count=sub)
ParamNames_str = Output(remove)  # "ParamNames (str)"
number_slider = DoubleSlider(0, range=0..100 step 0.1)
length_2 = String.Length(remove)
number_slider_2 = DoubleSlider(3, range=0..100 step 0.1)
add = length_2 + number_slider_2
remove_2 = String.Remove(str=string_from_object, startIndex=number_slider, count=add)
ParamValues_str = Output(remove_2)  # "ParamValues (str)"
