# Dynamo custom node Get Element Position Rotate Mirror.dyf (Dynamo 0.8.0.950)
# category: Bakery.Revit.Elements
# details to various outputs

List_of_elements = Input()
dataExtractor = Python(IN[0]=List_of_elements)  # "Element.dataExtractor"
# ---------- dataExtractor.python (35 lines) ----------
import clr
clr.AddReference('ProtoGeometry')
from Autodesk.DesignScript.Geometry import *

# Import RevitAPI
clr.AddReference('RevitAPI')
import Autodesk
#The inputs to this node will be stored as a list in the IN variable.
dataEnteringNode = IN

elements = []
for i in IN[0]:
	elements.append(UnwrapElement(i))
	

outlist = [] #export list
templist = [] #temporary list to group attributes by element
for i in elements:
	countA = 0
	while countA != 1:
		templist.append(i) #element
		templist.append(i.Location.Point) #XYZ position
		templist.append(i.FacingOrientation) #vector XYZ Facing
		templist.append(i.HandOrientation) #vector XYZ Hand
		templist.append(i.Mirrored)	#is mirrored?
		templist.append(i.FacingFlipped) #is mirrored over X axis?
		templist.append(i.HandFlipped) #is mirrored over Y axis?
		templist.append(i.CanFlipFacing)
		templist.append(i.CanFlipHand)
		outlist.append(templist[:]) #append all attributes of element to outlist
		countA = 1 #up the count to kill while function
	del templist[:] #clear the templist

#Assign your output to the OUT variable
OUT = outlist #Export outlist with all atributes of elements grouped by nested list
# ----------------------------------------
transpose_list_and_split_output = CodeBlock(inputlist=dataExtractor)
# ---------- transpose_list_and_split_output.designscript (10 lines) ----------
IN=List.Transpose(inputlist);
ElementListA=IN[0];
XYZposition=IN[1];
XYZvectorFacing=IN[2];
XYZvectorHand=IN[3];
Mirrored=IN[4];
Mirrored_FacingAxis=IN[5];
Mirrored_HandAxis=IN[6];
CanFlipFacing=IN[7];
CanFlipHand=IN[8];
# ----------------------------------------
Is_Mirrorred = Output(transpose_list_and_split_output.Mirrored)  # "Is.Mirrorred"
Element = Output(transpose_list_and_split_output.ElementListA)
xyz_splitter_cleans_and = Python(IN[0]=transpose_list_and_split_output.XYZposition)
# ---------- xyz_splitter_cleans_and.python (24 lines) ----------
import clr
clr.AddReference('ProtoGeometry')
from Autodesk.DesignScript.Geometry import *
#The inputs to this node will be stored as a list in the IN variable.
dataEnteringNode = IN
outlist = []
templist = []
templistA = []
for item in IN[0]:
	item = str(item)
	item = item.replace('(', '')
	item = item.replace(')', '')
	item = item.replace(',', '')
	templist.append(item)

for item in templist:
	outlist.append(item.split(" "))
	
for itemA in outlist:
	for itemB in itemA:
		itemB = float(itemB)

#Assign your output to the OUT variable
OUT = outlist
# ----------------------------------------
# note: Position
transpose_list_and_split_output_2 = CodeBlock(inputlist=xyz_splitter_cleans_and) { IN=List.Transpose(inputlist); X=IN[0]; Y=IN[1]; Z=IN[2]; }
toFloat = Python(IN[0]=transpose_list_and_split_output_2.X)  # "list.Item.ToFloat"
# ---------- toFloat.python (12 lines) ----------
import clr
clr.AddReference('ProtoGeometry')
from Autodesk.DesignScript.Geometry import *
#The inputs to this node will be stored as a list in the IN variable.
dataEnteringNode = IN
outlist = []

for item in IN[0]:
	outlist.append(float(item))

#Assign your output to the OUT variable
OUT = outlist
# ----------------------------------------
Position_X = Output(toFloat)
toFloat_2 = Python(IN[0]=transpose_list_and_split_output_2.Y)  # "list.Item.ToFloat"; same code as toFloat
Position_Y = Output(toFloat_2)
toFloat_3 = Python(IN[0]=transpose_list_and_split_output_2.Z)  # "list.Item.ToFloat"; same code as toFloat
Position_Z = Output(toFloat_3)
xyz_splitter_cleans_and_2 = Python(IN[0]=transpose_list_and_split_output.XYZvectorHand)  # same code as xyz_splitter_cleans_and
# note: Vector Hand
transpose_list_and_split_output_3 = CodeBlock(inputlist=xyz_splitter_cleans_and_2) { IN=List.Transpose(inputlist); X=IN[0]; Y=IN[1]; Z=IN[2]; }
toFloat_4 = Python(IN[0]=transpose_list_and_split_output_3.X)  # "list.Item.ToFloat"; same code as toFloat
toFloat_5 = Python(IN[0]=transpose_list_and_split_output_3.Y)  # "list.Item.ToFloat"; same code as toFloat
vector_to_degrees = Python(IN[0]=toFloat_4, IN[1]=toFloat_5)
# ---------- vector_to_degrees.python (44 lines) ----------
import clr
from math import *
clr.AddReference('ProtoGeometry')
from Autodesk.DesignScript.Geometry import *
#The inputs to this node will be stored as a list in the IN variable.
dataEnteringNode = IN
X=IN[0]
Y=IN[1]
outlist = []
templist = []
templist2 = []
count = 0


for item in X:
	templist.append((acos(item)))


while count < len(templist):
#for item in templist:
	if Y[count] > 0:
		templist2.append(degrees(templist[count]))
	elif Y[count] == 0:
		templist2.append(degrees(templist[count]))
	elif Y[count] < 0:
		templist2.append((degrees(templist[count])) + (2*(180-(degrees(templist[count])))))
	count = count + 1

for item in templist2:
	if item == 0:
		outlist.append(0)
	else:
		outlist.append(360 - item)

#while count < len(X):
#
#	if X[count] <0:
#		outlist.append(360 - degrees(acos(Y[count]*1)))
#	else:	
#		outlist.append(degrees(acos(Y[count]*1)))
#	count = count + 1

#Assign your output to the OUT variable
OUT = outlist
# ----------------------------------------
Rotation = Output(vector_to_degrees)
FlippedFacing = Output(transpose_list_and_split_output.Mirrored_FacingAxis)
FlippedHand = Output(transpose_list_and_split_output.Mirrored_HandAxis)
CanFlipHand = Output(transpose_list_and_split_output.CanFlipHand)
CanFlipFacing = Output(transpose_list_and_split_output.CanFlipFacing)
