# Dynamo custom node Get Elements in View in Document by Category.dyf (Dynamo 0.8.2.2392)
# category: Bakery.Revit.Selection

Categories = Input()
turn_into_list = Custom[Turn Into List](item=Categories)  # Turns an element (or a nested list) into a flat list
View_s = Input()  # "View(s)"
turn_into_list_2 = Custom[Turn Into List](item=View_s)
document = Input()
python_script = Python(IN[0]=turn_into_list, IN[1]=turn_into_list_2, IN[2]=document)
# ---------- python_script.python (25 lines) ----------
import System
import clr
clr.AddReference('RevitAPI')
from Autodesk.Revit.DB import *

clr.AddReference("RevitServices")
import RevitServices
from RevitServices.Persistence import DocumentManager


cats = IN[0]
views = UnwrapElement(IN[1])
doc = IN[2]

elementlist = list()
# This could be more elegant if only I knew how to implement a Multicategory filter in Python....
for cat in cats:
	catlist = list()
	for view in views:
		collector = FilteredElementCollector(doc)
		filter = ElementOwnerViewFilter(view.Id)
		bic = System.Enum.ToObject(BuiltInCategory, cat.Id)
		catlist.append(collector.WherePasses(filter).OfCategory(bic).ToElements())
	elementlist.append(catlist)
OUT = elementlist
# ----------------------------------------
Elements = Output(python_script)
