# Dynamo custom node Get First Geometry Element with Type Name.dyf (Dynamo 1.1.0.2094)
# category: Bakery.Geometry

geometries = Input()
watch = Watch(geometries)
flat_list_to_list_of_strings = Custom[Flat List to List of Strings](Original_List=watch)  # using python methods
searchFor = Input(searchFor : string)
contains = String.Contains(str=flat_list_to_list_of_strings, searchFor=searchFor)
code_block = CodeBlock { true; }
firstIndexOf = List.FirstIndexOf(list=contains, item=code_block)
getItemAtIndex = List.GetItemAtIndex(list=watch, index=firstIndexOf)
item = Output(getItemAtIndex)
