# Dynamo custom node Get Grid Extents.dyf (Dynamo 1.0.0.1180)
# category: Bakery.Revit.Elements

unknownItem = Input(unknownItem : var[]..[])
turnIntoList = Custom[TurnIntoList](unknownItem=unknownItem)  # Turns an element (or a nested list) into a flat list
python_script = Python(IN[0]=turnIntoList)
# ---------- python_script.python (52 lines) ----------
#python nodes in dynamo 0.7
#proposed by Julien Benoit @jbenoit44 
#http://aecuandme.wordpress.com/
import clr
clr.AddReference('ProtoGeometry')
from Autodesk.DesignScript.Geometry import *

# Import ToDSType(bool) extension method
clr.AddReference("RevitNodes")
import Revit
clr.ImportExtensions(Revit.Elements)

# Import DocumentManager and TransactionManager
clr.AddReference("RevitServices")
import RevitServices
from RevitServices.Persistence import DocumentManager
from RevitServices.Transactions import TransactionManager

from System.Collections.Generic import *

# Import RevitAPI
clr.AddReference("RevitAPI")
import Autodesk

doc = DocumentManager.Instance.CurrentDBDocument
uiapp = DocumentManager.Instance.CurrentUIApplication
app = uiapp.Application

#The inputs to this node will be stored as a list in the IN variable.
dataEnteringNode = IN

#unwrap all elements to use with API
elements = []
for i in IN[0]:
	elements.append(UnwrapElement(i))
	
# "Start" the transaction
TransactionManager.Instance.EnsureInTransaction(doc)

outlinelist = list()
for item in elements:
    try:
    	outlinelist.append(item.GetExtents())
    except:
    	outlinelist.append("No outline found")

# "End" the transaction
TransactionManager.Instance.TransactionTaskDone()


#Assign your output to the OUT variable
OUT = outlinelist
# ----------------------------------------
outlineObjects = Output(python_script)
python_script_2 = Python(IN[0]=python_script)
# ---------- python_script_2.python (48 lines) ----------
#python nodes in dynamo 0.7
#proposed by Julien Benoit @jbenoit44 
#http://aecuandme.wordpress.com/
import clr
clr.AddReference('ProtoGeometry')
from Autodesk.DesignScript.Geometry import *

# Import ToDSType(bool) extension method
clr.AddReference("RevitNodes")
import Revit
clr.ImportExtensions(Revit.Elements)

# Import DocumentManager and TransactionManager
clr.AddReference("RevitServices")
import RevitServices
from RevitServices.Persistence import DocumentManager
from RevitServices.Transactions import TransactionManager

from System.Collections.Generic import *

# Import RevitAPI
clr.AddReference("RevitAPI")
import Autodesk

doc = DocumentManager.Instance.CurrentDBDocument
uiapp = DocumentManager.Instance.CurrentUIApplication
app = uiapp.Application

#The inputs to this node will be stored as a list in the IN variable.


#unwrap all elements to use with API

outlinelist = IN[0]
# "Start" the transaction
TransactionManager.Instance.EnsureInTransaction(doc)
maxlist = list()
for item in outlinelist:
    try:
    	maxlist.append(item.MaximumPoint)
    except:
    	maxlist.append("Not found")

# "End" the transaction
TransactionManager.Instance.TransactionTaskDone()

#Assign your output to the OUT variable
OUT = maxlist
# ----------------------------------------
maximumPointsXYZRevitFeet = Output(python_script_2)
python_script_3 = Python(IN[0]=python_script)
# ---------- python_script_3.python (48 lines) ----------
#python nodes in dynamo 0.7
#proposed by Julien Benoit @jbenoit44 
#http://aecuandme.wordpress.com/
import clr
clr.AddReference('ProtoGeometry')
from Autodesk.DesignScript.Geometry import *

# Import ToDSType(bool) extension method
clr.AddReference("RevitNodes")
import Revit
clr.ImportExtensions(Revit.Elements)

# Import DocumentManager and TransactionManager
clr.AddReference("RevitServices")
import RevitServices
from RevitServices.Persistence import DocumentManager
from RevitServices.Transactions import TransactionManager

from System.Collections.Generic import *

# Import RevitAPI
clr.AddReference("RevitAPI")
import Autodesk

doc = DocumentManager.Instance.CurrentDBDocument
uiapp = DocumentManager.Instance.CurrentUIApplication
app = uiapp.Application

#The inputs to this node will be stored as a list in the IN variable.


#unwrap all elements to use with API

outlinelist = IN[0]
# "Start" the transaction
TransactionManager.Instance.EnsureInTransaction(doc)
minlist = list()
for item in outlinelist:
    try:
    	minlist.append(item.MinimumPoint)
    except:
    	minlist.append("Not found")

# "End" the transaction
TransactionManager.Instance.TransactionTaskDone()

#Assign your output to the OUT variable
OUT = minlist
# ----------------------------------------
minimumPointsXYZRevitFeet = Output(python_script_3)
