# Dynamo custom node Get List of Linked Elements from Id and Doc.dyf (Dynamo 0.8.2.2371)
# category: Bakery.Revit.Document.Links

link_doc_list = Input()
counter = Input()
getItemAtIndex = List.GetItemAtIndex(list=link_doc_list, index=counter)
element_ID_list = Input()
getItemAtIndex_2 = List.GetItemAtIndex(list=element_ID_list, index=counter)
get_element_from_doc_using = Custom[Get Element from Doc using Element Id](linkdoc=getItemAtIndex, elementId=getItemAtIndex_2)
element = Output(get_element_from_doc_using.Matching)
