# Dynamo custom node Get Loaded RVT Links.dyf (Dynamo 0.8.2.2371)
# category: Bakery.Revit.Document.Links

get_linked_rvt_documents = Custom[Get Linked RVT Documents]()
code_block = CodeBlock { null; }
nullAllIndicesOf = Custom[NullAllIndicesOf](list=get_linked_rvt_documents.Link_Doc, value=code_block)  # list all of the indices of a list that match the specified value. Capable of handling null values, part of the SmartCopyMonitor workflow.
removeItemAtIndex = List.RemoveItemAtIndex(list=get_linked_rvt_documents.Link_Name, indices=nullAllIndicesOf)
loaded_Link_Names = Output(removeItemAtIndex)
removeItemAtIndex_2 = List.RemoveItemAtIndex(list=get_linked_rvt_documents.Link_Doc, indices=nullAllIndicesOf)
loaded_Link_Docs = Output(removeItemAtIndex_2)
clean_link_name_list = Custom[Clean Link Name List](name_list=removeItemAtIndex)
cleaned_Loaded_names_only = Output(clean_link_name_list)
sort = List.Sort(clean_link_name_list)
cleaned_and_sorted = Output(sort)
