# Dynamo custom node Get Parameter Element by Name.dyf (Dynamo 1.1.0.2094)
# category: Bakery.Revit.Parameters

element_types = ElementTypes("ParameterElement")
all_elements_of_type = ElementsOfType(element_types)
watch = Watch(all_elements_of_type)
element_name_universal = Custom[Element Name Universal](Elements=watch)  # Modified for 0.8.1
watch_2 = Watch(element_name_universal)
parameterName = Input()
eq = watch_2 == parameterName
watch_3 = Watch(eq)
filterByBoolMask = List.FilterByBoolMask(list=watch, mask=watch_3)
matchingParameters = Output(filterByBoolMask.in)
