# Dynamo custom node Get Project Location Details.dyf (Dynamo 0.8.2.2392)
# category: Bakery.Revit.Document
# query built-in category

python_script = Python()
# ---------- python_script.python (27 lines) ----------
import clr
clr.AddReference(‘ProtoGeometry’)
from Autodesk.DesignScript.Geometry import *

# Import DocumentManager and TransactionManager
clr.AddReference(“RevitServices”)
import RevitServices
from RevitServices.Persistence import DocumentManager
from RevitServices.Transactions import TransactionManager

# Import RevitAPI
clr.AddReference(“RevitAPI”)
import Autodesk
from Autodesk.Revit.DB import *

doc = DocumentManager.Instance.CurrentDBDocument
uiapp = DocumentManager.Instance.CurrentUIApplication
app = uiapp.Application

from System.Collections.Generic import *

#The inputs to this node will be stored as a list in the IN variable.
projLoc = FilteredElementCollector(doc).OfCategory(BuiltInCategory.OST_IOS_GeoLocations)

items = UnwrapElement(projLoc)

OUT = items
# ----------------------------------------
