# Dynamo custom node Get Standard Views as single list.dyf (Dynamo 0.8.2.2371)
# category: Bakery.Revit.Views

get_all_views = Custom[Get All Views]()  # This node will query all views in the model and return them based on category
create = List.Create(get_all_views.Elevations)
create_2 = List.Create(get_all_views.Drafting_Views)
create_3 = List.Create(get_all_views.Details)
create_4 = List.Create(get_all_views.3D_Views)
create_5 = List.Create(get_all_views.Internal_Views)
create_6 = List.Create(get_all_views.Sections)
create_7 = List.Create(get_all_views.Ceiling_Plans)
create_8 = List.Create(get_all_views.Floor_Plans)
create_9 = List.Create(get_all_views.Area_Plans)
create_10 = List.Create(get_all_views.Engineering_Plans)
create_11 = List.Create(create, create_2, create_3, create_4, create_5, create_6, create_7, create_8, create_9, create_10)
oneList = Output(create_11)
