# Dynamo custom node Get This Dynamo Version.dyf (Dynamo 1.3.0.875)
# category: Bakery.Dynamo.UI

python_script = Python()
# ---------- python_script.python (6 lines) ----------
import clr
clr.AddReference('ProtoGeometry')
from Autodesk.DesignScript.Geometry import *
import System

OUT = System.Diagnostics.Process.GetCurrentProcess().MainModule.FileVersionInfo.FileVersion
# ----------------------------------------
version = Output(python_script)
