# Dynamo custom node Get View Dependent Elements from Linked Document.dyf (Dynamo 0.9.2.4472)
# category: Bakery.Revit.Document.Links

linkDocumentName_string = Input()
get_link_document_from_link_name = Custom[Get Link Document from Link Name](searchFor=linkDocumentName_string)
categoryName = Input(categoryName : var[]..[])
convert_category_name_to_built = Custom[Convert Category Name to Built In Category Name](categoryName=categoryName)  # You must use List.Map to convert list of Category Names to list of Built In Names
firstItem = List.FirstItem(convert_category_name_to_built)
get_elements_from_link_document = Custom[Get Elements from Link Document Using Category](Link_Document=get_link_document_from_link_name, builtInName=firstItem)
watch = Watch(get_elements_from_link_document)
type = Custom[Element.Type](element=watch)  # Gets the family type of a given element (if applicable).
flat_list_to_list_of_strings = Custom[Flat List to List of Strings](Original_List=type)  # using python methods
watch_2 = Watch(flat_list_to_list_of_strings)
typeName = Input()
eq = watch_2 == typeName
filterByBoolMask = List.FilterByBoolMask(list=watch, mask=eq)
ownerView = Custom[Element.OwnerView](element=filterByBoolMask.in)  # Gets the owner view of a given Revit element (if possible)
watch_3 = Watch(ownerView)
id = Element.Id(watch_3)
element_name_universal = Custom[Element Name Universal](Element_s=watch_3)  # Modified for 0.8.1
viewNameInLink = Input()
firstIndexOf = List.FirstIndexOf(list=element_name_universal, item=viewNameInLink)
getItemAtIndex = List.GetItemAtIndex(list=watch_3, index=firstIndexOf)
watch_4 = Watch(getItemAtIndex)
id_2 = Element.Id(watch_4)
bv_all_indices_of_that_can = Custom[bv All Indices Of that can handle Nulls](list=id, value=id_2)  # forked from spring nodes
watch_5 = Watch(bv_all_indices_of_that_can)
getItemAtIndex_2 = List.GetItemAtIndex(list=filterByBoolMask.in, index=watch_5)
item = Output(getItemAtIndex_2)
watch_6 = Watch(filterByBoolMask.in)
