# Dynamo custom node Get Wall Layer Location Lines.dyf (Dynamo 1.3.2.2480)
# category: Bakery.Revit.Elements.Wall

# note: Clockwork

Input = Input()
watch = Watch(Input)
getLocation = Element.GetLocation(watch)
exteriorDirection = Custom[Wall.ExteriorDirection](Wall=watch)  # This node returns exterior direction of the wall as a vector.
# note: Archilab
type = Custom[Element.Type](element=watch)  # Gets the family type of a given element (if applicable).
# note: Clockwork
compoundStructureLayers = Custom[FamilyType.CompoundStructureLayers](elementType=type)  # Retrieves the compound layers of any layered family type (wall types, roof types, floor types etc.)
code_block = CodeBlock(getLocation, exteriorDirection, type, compoundStructureLayers.widths, compoundStructureLayers.isCore)
# ---------- code_block.designscript (73 lines) ----------
{wallcurves,direction,walltypes,Widths,cores};
/* get the distance from wall location (centerline) to the
exterior face of wall*/
distance =
 walltypes.GetParameterValueByName("Width")/2;
//get the curves at the exterior face
ExtFaceCurves =
 wallcurves.Translate(direction,distance);

/*Get the number of indicies which need to be dropped*/

ExtDrop =
 -(List.Count(cores<1L>)
  -
 IndexOf(cores<1L>, true));

/* Drop the widths which are not outside the core to get the
width from the exterior face to exterior face of the core */

ExtFaceToExtCore =
 Math.Sum(
  List.DropItems(
   Widths@@-2<1L>,
   ExtDrop<1L>
  )
 );

/* Drop the widths which are not inside the core to get the
width from the exterior face to interior face of the core */

IntDrop =
 -IndexOf(
  List.Reverse(
   cores<1L>
  )@-2<1>,
  true
 );
/* Drop the widths which are not inside the core to get the
width from the exterior face to interior face of the core */
ExtFacetoIntCore =
 Math.Sum(
  List.DropItems(
   Widths@@-2<1L>,
   (IntDrop<1L>)
  )
 );

// OffsetExterior Face to Exterior of Core
ExtCore =
 ExtFaceCurves.Translate(
  Vector.Reverse(direction),
  ExtFaceToExtCore
 );


// OffsetExterior Face to Interior of Core
IntCore =
 ExtFaceCurves.Translate(
  Vector.Reverse(direction),
  ExtFacetoIntCore
 );

//Get total wall width
TotalWidth =
 walltypes.GetParameterValueByName("Width");

/*Get interior face of wall by offsetting the
exterior face by the total width*/
IntFace =
 ExtFaceCurves.Translate(
  Vector.Reverse(direction),
  TotalWidth
 );
# ----------------------------------------
code_block_2 = CodeBlock(ExteriorofWall=code_block.ExtFaceCurves, ExteriorofCore=code_block.ExtCore, InteriorOfCore=code_block.IntCore, InteriorOfWall=code_block.IntFace) { ExteriorofWall; ExteriorofCore; InteriorOfCore; InteriorOfWall; }
watch_2 = Watch(code_block_2.InteriorOfWall)
interior = Output(watch_2)
watch_3 = Watch(code_block_2.InteriorOfCore)
interiorCore = Output(watch_3)
watch_4 = Watch(code_block_2.ExteriorofWall)
exterior = Output(watch_4)
watch_5 = Watch(code_block_2.ExteriorofCore)
exteriorCore = Output(watch_5)
