# Dynamo custom node If Equal Return Index using IndexOf.dyf (Dynamo 0.8.2.2371)
# category: Bakery.Core.List

searchForThese = Input()
inThisList = Input()
indexOf = IndexOf(inThisList)
map = List.Map(list=searchForThese, f_x=indexOf)
indices = Output(map)
