# Dynamo custom node Index Of Pythonic.dyf (Dynamo 1.3.3.4651)
# category: Bakery.Core.List

lookForList = Input()
membershipList = Input()
python_script = Python(IN[0]=lookForList, IN[1]=membershipList)
# ---------- python_script.python (16 lines) ----------
import clr
clr.AddReference('ProtoGeometry')
from Autodesk.DesignScript.Geometry import *
#The inputs to this node will be stored as a list in the IN variables.
thisModel = IN[0]
referenceList = IN[1]
locations = []
for z in thisModel:
	try:
		location=referenceList.index(z)
	except:
		location="NotLocated"
	locations.append(location)

#Assign your output to the OUT variable.
OUT = locations
# ----------------------------------------
locations = Output(python_script)
