# Dynamo custom node Keep First Matching Result After Search.dyf (Dynamo 0.9.2.4472)
# category: Bakery.Core.List

searchResults = Input()
foundSearchItems = Input()
watch = Watch(foundSearchItems)
originalSearchList = Input()
firstIndexOf = List.FirstIndexOf(list=watch, item=originalSearchList)
watch_2 = Watch(firstIndexOf)
getItemAtIndex = List.GetItemAtIndex(list=searchResults, index=watch_2)
firstMatchesOnly = Output(getItemAtIndex)
