# Dynamo custom node LISTCLEAN Flatten_ReplaceNulls_ConvertToStrings.dyf (Dynamo 0.9.1.4062)
# category: Bakery.Core.List

unknown = Input()
flatten_list_and_replace_null = Custom[Flatten List and Replace Null with NULL VALUE](list=unknown)
flat_list_to_list_of_strings = Custom[Flat List to List of Strings](Original_List=flatten_list_and_replace_null)  # using python methods
List_of_Strings = Output(flat_list_to_list_of_strings)
