# Dynamo custom node List Phase Information.dyf (Dynamo 0.9.1.4062)
# category: Bakery.Revit.Document
# uses Clockwork

code_block = CodeBlock { true; }
phases = Custom[Document.Phases](toggle=code_block)  # Retrieves all phases in the active document in *chronological* order
phaseElements = Output(phases)
code_block_2 = CodeBlock { "Name"; }
getParameterValueByName = Element.GetParameterValueByName(parameterName=code_block_2)
map = List.Map(list=phases, f_x=getParameterValueByName)
phaseNames = Output(map)
string_from_array = FromArray(map)
phaseNamesAsString = Output(string_from_array)
