# Dynamo custom node List Room Names from API and show failures.dyf (Dynamo 0.8.2.2392)
# category: Bakery.Revit.Parameters

code_block = CodeBlock { "New Construction"; }
elementList = Input()
watch = Watch(elementList)
get_element_room_parameter_from = Custom[Get Element Room parameter from API](Phase_string=code_block, Elements=watch)
full_list_including_failed_shown_as_stri = Output(get_element_room_parameter_from)  # "full list including failed shown as string"
code_block_2 = CodeBlock { "failed"; }
create = List.Create(code_block_2)
bv_if_equal_return_index = Custom[bv If Equal Return Index](listA=create, listB=get_element_room_parameter_from)  # forked
getItemAtIndex = List.GetItemAtIndex(list=watch, index=bv_if_equal_return_index)
elements_that_failed = Output(getItemAtIndex)
