# Dynamo custom node List Room and Space Elements.dyf (Dynamo 0.9.1.4062)
# category: Bakery.Revit.Elements.Room
# with a general bool test too

categories = Categories("Rooms")
all_elements_of_category = ElementsOfCategory(categories)
categories_2 = Categories("MEPSpaces")
all_elements_of_category_2 = ElementsOfCategory(categories_2)
create = List.Create(all_elements_of_category, all_elements_of_category_2)
flatten = Flatten(create)
isEmpty = List.IsEmpty(flatten)
create_2 = List.Create(isEmpty, flatten)
True_Means_Empty = Output(create_2)
