# Dynamo custom node List of float double to list of Int.dyf (Dynamo 0.8.2.2371)
# category: Bakery.Core.Math
# no decimals

double = Input()
python_script = Python(IN[0]=double)
# ---------- python_script.python (12 lines) ----------
import clr
clr.AddReference('ProtoGeometry')
from Autodesk.DesignScript.Geometry import *
import math
#The inputs to this node will be stored as a list in the IN variables.
dataEnteringNode = IN[0]
listed = []
for x in dataEnteringNode:
	temp = int(round(x))
	listed.append(temp)
#Assign your output to the OUT variable.
OUT = listed
# ----------------------------------------
int = Output(python_script)
