# Dynamo custom node Make Floor using NURBS from Point Lists.dyf (Dynamo 1.2.0.2831)
# category: Bakery.Construction.Civil

lowerPoints = Input()
watch = Watch(lowerPoints)
byControlPoints = NurbsCurve.ByControlPoints(watch)
UpperPoints = Input()
byControlPoints_2 = NurbsCurve.ByControlPoints(UpperPoints)
lines_between_start_and_end = Custom[Lines Between Start and End Points](pointListOne=lowerPoints, PointListTwo=UpperPoints)
create = List.Create(byControlPoints, byControlPoints_2, lines_between_start_and_end.Line1, lines_between_start_and_end.Line2)
flatten = Flatten(create)
byJoinedCurves = PolyCurve.ByJoinedCurves(flatten)
closeWithLine = PolyCurve.CloseWithLine(byJoinedCurves)
floorType = Input(floorType : FloorType)
level = Input(level : Level)
byOutlineTypeAndLevel = Floor.ByOutlineTypeAndLevel(outline=closeWithLine, floorType=floorType, level=level)
Floor = Output(byOutlineTypeAndLevel)
