# Dynamo custom node Make Geometry from Elements via SAT.dyf (Dynamo 1.3.3.4651)
# category: Bakery.Geometry

elements = Input()
watch = Watch(elements)
originalElements = Output(watch)
turnIntoList = Custom[TurnIntoList](unknownItem=watch)  # Turns an element (or a nested list) into a flat list
viewThatShowsElements = Input()
duplicate_view_and_isolate = Custom[Duplicate View and Isolate Elements](sourceViewIn=viewThatShowsElements)  # unwired: elementsIn
map = List.Map(list=turnIntoList, f_x=duplicate_view_and_isolate.ViewOut)
flatten = Flatten(map)
id = Element.Id(watch)
string_from_object = FromObject(id)
setName = Custom[Element.SetName](element=flatten, name=string_from_object)  # Gets the name of a given Revit element
viewsCreated = Output(setName.Success)
tempDirectory = Input()
make_geometry_from_view_via_sat = Custom[Make Geometry from View via SAT](tempDirectory=tempDirectory)  # uses element ID as SAT name; unwired: view
map_2 = List.Map(list=setName.Success, f_x=make_geometry_from_view_via_sat)
geoms = Output(map_2)
