# Dynamo custom node Missing from List.dyf (Dynamo 1.3.2.2480)
# category: Bakery.Core.List
# checks one list against another and reports missing items

ListWithMissing = Input()
BiggerList = Input()
python_script = Python(IN[0]=ListWithMissing, IN[1]=BiggerList)
# ---------- python_script.python (15 lines) ----------
import clr
clr.AddReference('ProtoGeometry')
from Autodesk.DesignScript.Geometry import *
#The inputs to this node will be stored as a list in the IN variables.
smalllist=IN[0]
biglist=IN[1]
result=[]
for x in biglist:
	if x in smalllist:
		pass
	else:
		result.append(x)

#Assign your output to the OUT variable.
OUT = result
# ----------------------------------------
MissingItems = Output(python_script)
