# Dynamo custom node Name Unnamed Reference Planes.dyf (Dynamo 1.3.0.875)
# category: Bakery.Revit.Document.Utility
# if there is no name, it will apply a new GUID name to the reference plane

categories = Categories("CLines")
all_elements_of_category = ElementsOfCategory(categories)
watch = Watch(all_elements_of_category)
element_name_universal = Custom[Element Name Universal](Elements=watch)  # Modified for 0.8.1
watch_2 = Watch(element_name_universal)
code_block = CodeBlock { "Reference Plane"; }
eq = watch_2 == code_block
watch_3 = Watch(eq)
filterByBoolMask = List.FilterByBoolMask(list=watch, mask=watch_3)
watch_4 = Watch(filterByBoolMask.in)
uuid_guid_generator_for_lists = Custom[UUID GUID Generator for Lists](list=watch_4)  # just makes a new GUID for every item in a list, has no relationship to item or element itself
setName = Custom[Element.SetName](element=watch_4, name=uuid_guid_generator_for_lists.uuidsAsStrings)  # Gets the name of a given Revit element
new_names_applied_to_these = Output(setName.Success)
already_named = Output(filterByBoolMask.out)
