# Dynamo custom node Perpendicular Curves at Spacing.dyf (Dynamo 1.2.0.2690)
# category: Bakery.Geometry

pointListOne = Input()
uniqueItems = List.UniqueItems(pointListOne)
byPoints = PolyCurve.ByPoints(points=uniqueItems)
code_block = CodeBlock { 1; }
length = Curve.Length(byPoints)
UVgridSpacing = Input()
watch = Watch(UVgridSpacing)
code_block_2 = CodeBlock(x=length, y=watch) { x/y; }
ceiling = Math.Ceiling(code_block_2)
code_block_3 = CodeBlock(x=ceiling) { 1/x; }
code_block_4 = CodeBlock(x=code_block_3) { 0..1..x; }
addItemToEnd = List.AddItemToEnd(item=code_block, list=code_block_4)
pointAtParameter = Curve.PointAtParameter(curve=byPoints, param=addItemToEnd)
pointListTwo = Input()
uniqueItems_2 = List.UniqueItems(pointListTwo)
byPoints_2 = PolyCurve.ByPoints(points=uniqueItems_2)
pointAtParameter_2 = Curve.PointAtParameter(curve=byPoints_2, param=addItemToEnd)
byStartPointEndPoint = Line.ByStartPointEndPoint(startPoint=pointAtParameter, endPoint=pointAtParameter_2)
length_2 = Curve.Length(byStartPointEndPoint)
code_block_5 = CodeBlock(x=length_2, y=watch) { x/y; }
ceiling_2 = Math.Ceiling(code_block_5)
code_block_6 = CodeBlock(x=ceiling_2) { 1/x; }
code_block_7 = CodeBlock(x=code_block_6) { 0..1..x; }
code_block_8 = CodeBlock { 1; }
dropItems = List.DropItems(list=code_block_7@@L2, amount=code_block_8)
pointAtParameter_3 = Curve.PointAtParameter(curve=byStartPointEndPoint, param=dropItems)
normalAtParameter = Curve.NormalAtParameter(curve=byStartPointEndPoint, param=dropItems)
direction = Line.Direction(byStartPointEndPoint)
code_block_9 = CodeBlock { 90; }
rotate = Vector.Rotate(normalAtParameter, direction, code_block_9)
length_3 = Input(length : double)
byStartPointDirectionLength = Line.ByStartPointDirectionLength(startPoint=pointAtParameter_3, direction=rotate, length=length_3)
Line = Output(byStartPointDirectionLength)
watch_2 = Watch(uniqueItems)
