# Dynamo custom node Preflight for Section View Creation.dyf (Dynamo 0.8.2.2371)
# category: Bakery.Revit.Views

csOrigin = Input()
xAxis = Input(xAxis : Vector)
yAxis = Input(yAxis : Vector)

# group: APPLY CS AND WORKPLANE
byOriginVectors = CoordinateSystem.ByOriginVectors(origin=csOrigin, xAxis=xAxis, yAxis=yAxis, lacing=Longest)

CoordinateSystem = Output(byOriginVectors)
PointList = Input()
turnIntoList = Custom[TurnIntoList](PointList)  # Turns an element (or a nested list) into a flat list

# group: TRANSLATE TO WCS FOR minPoint / maxPoint Calc
X = Point.X(turnIntoList)
maximumItem = List.MaximumItem(X)
Y = Point.Y(turnIntoList)
maximumItem_2 = List.MaximumItem(Y)
minimumItem = List.MinimumItem(X)
minimumItem_2 = List.MinimumItem(Y)

CropRegionOffset = Input()
ViewDepth = Input()
code_block = CodeBlock(CropRegionOffset=CropRegionOffset, ViewDepth=ViewDepth)
# ---------- code_block.designscript (7 lines) ----------
//Z value calculation
//in accordance with the
//Centroid point
//Startingpoint of sectionview
-CropRegionOffset;
//Relative depth of sectionview
ViewDepth-CropRegionOffset;
# ----------------------------------------
byCoordinates = Point.ByCoordinates(x=maximumItem, y=maximumItem_2, z=code_block.out1)
maxPoint = Output(byCoordinates)
byCoordinates_2 = Point.ByCoordinates(x=minimumItem, y=minimumItem_2, z=code_block.out0)
minPoint = Output(byCoordinates_2)
