# Dynamo custom node Python Version.dyf (Dynamo 1.2.1.3083)
# category: Bakery.Dynamo.Python

python_script = Python()
# ---------- python_script.python (9 lines) ----------
import clr
clr.AddReference('ProtoGeometry')
from Autodesk.DesignScript.Geometry import *
import sys
#The inputs to this node will be stored as a list in the IN variables.
dataEnteringNode = IN

#Assign your output to the OUT variable.
OUT = sys.version
# ----------------------------------------
version = Output(python_script)
