# Dynamo custom node Replace Point Z Value.dyf (Dynamo 1.2.0.2831)
# category: Bakery.Geometry

points = Input()
watch = Watch(points)
X = Point.X(watch)
Y = Point.Y(watch)
desired_Z_value = Input()
count = Count(X)
cycle = List.Cycle(list=desired_Z_value, amount=count)
byCoordinates = Point.ByCoordinates(x=X, y=Y, z=cycle)
Point = Output(byCoordinates)
