# Dynamo custom node Report on DWG Links.dyf (Dynamo 0.9.1.4062)
# category: Bakery.Revit.Document.Utility

string = StringInput("LinksDWG")
string_2 = StringInput("---Link list is Empty?---")
code_block = CodeBlock { true; }
linksAndImports = Custom[Document.LinksAndImports](toggle=code_block)  # Gets all linked and imported files in the document
isEmpty = List.IsEmpty(linksAndImports.links)
string_3 = StringInput("---Link List contains DWG---")
search_for_dwgs_in_document_link = Custom[Search for DWGs in Document Link List]()  # returns true if they exist, and then lists parameters
string_4 = StringInput("---Number of DWG Links---")
flat_list_to_list_of_strings = Custom[Flat List to List of Strings](Original_List=linksAndImports.links)  # using python methods
count = List.Count(flat_list_to_list_of_strings)
string_5 = StringInput("---DWG Link List---")
list_dwg_link_information = Custom[List DWG Link Information]()  # shows element IDs, DWG name and Workset
string_6 = StringInput("---DWG Link Parameter List---")
create = List.Create(isEmpty, string_3, search_for_dwgs_in_document_link.Any_DWGs_Links, string_4, count, string_5, list_dwg_link_information, string_6, search_for_dwgs_in_document_link.DWG_Link_Parameters)
flatten = Flatten(create)
create_2 = List.Create(string, string_2, flatten)
flatten_2 = Flatten(create_2)
flatList = Output(flatten_2)
