# Dynamo custom node Revit Section View at Line.dyf (Dynamo 1.3.2.2480)
# category: Bakery.Revit.Views

revitLines = Input()
turnIntoList = Custom[TurnIntoList](unknownItem=revitLines)  # Turns an element (or a nested list) into a flat list
ViewDepth = Input(ViewDepth : double = 100)
ViewHeight = Input(ViewHeight : double = 3000)
FlipSection = Input(FlipSection : bool = false)
preflight_to_make_revit_section = Custom[Preflight to Make Revit Section Views from Lines](ViewDepth=ViewDepth, ViewHeight=ViewHeight, flip=FlipSection)  # unwired: element
map = List.Map(list=turnIntoList, f_x=preflight_to_make_revit_section.CoordinateSystem)
watch = Watch(map)
map_2 = List.Map(list=turnIntoList, f_x=preflight_to_make_revit_section.minPoint)
watch_2 = Watch(map_2)
map_3 = List.Map(list=turnIntoList, f_x=preflight_to_make_revit_section.maxPoint)
watch_3 = Watch(map_3)
byCoordinateSystemMinPointMaxPoint = SectionView.ByCoordinateSystemMinPointMaxPoint(watch, watch_2, watch_3)
SectionView = Output(byCoordinateSystemMinPointMaxPoint)
