# Dynamo custom node Save To Central with Options.dyf (Dynamo 1.2.1.3083)
# category: Bakery.Revit.Document

python_script = Python()  # unwired: IN[0], IN[1], IN[2], IN[3]
# ---------- python_script.python (50 lines) ----------
import clr
clr.AddReference('ProtoGeometry')
from Autodesk.DesignScript.Geometry import *

# Import Element wrapper extension methods
clr.AddReference("RevitNodes")
import Revit
clr.ImportExtensions(Revit.Elements)

# Import geometry conversion extension methods
clr.ImportExtensions(Revit.GeometryConversion)

# Import DocumentManager and TransactionManager
clr.AddReference("RevitServices")
import RevitServices
from RevitServices.Persistence import DocumentManager
from RevitServices.Transactions import TransactionManager

doc = DocumentManager.Instance.CurrentDBDocument
uiapp = DocumentManager.Instance.CurrentUIApplication
app = uiapp.Application

# Import RevitAPI
clr.AddReference("RevitAPI")
import Autodesk
from Autodesk.Revit.DB import *

items = IN[0]
overwrite = IN[1]
savecentral = IN[2]
pathin = IN[3]


soptions = SaveAsOptions()
woptions = WorksharingSaveAsOptions()
woptions.OpenWorksetsDefault = AllWorksets
soptions.OverwriteExistingFile = overwrite
woptions.SaveAsCentral = savecentral
soptions.SetWorksharingOptions(woptions)

typelist = list()


for i, (one, two) in enumerate(zip(items, pathin)): 	
		try:
			one.SaveAs(two,soptions)
		except:
			one.Save()
		
OUT = items
# ----------------------------------------
Document = Input()
code_block = CodeBlock(item=Document) { Flatten({item}); }
code_block_2 = CodeBlock { true; }
FilePath = Input()
code_block_3 = CodeBlock(item=FilePath) { Flatten({item}); }
python_script_2 = Python(IN[0]=code_block, IN[1]=code_block_2, IN[2]=code_block_2, IN[3]=code_block_3)
# ---------- python_script_2.python (51 lines) ----------
import clr
clr.AddReference('ProtoGeometry')
from Autodesk.DesignScript.Geometry import *

# Import Element wrapper extension methods
clr.AddReference("RevitNodes")
import Revit
clr.ImportExtensions(Revit.Elements)

# Import geometry conversion extension methods
clr.ImportExtensions(Revit.GeometryConversion)

# Import DocumentManager and TransactionManager
clr.AddReference("RevitServices")
import RevitServices
from RevitServices.Persistence import DocumentManager
from RevitServices.Transactions import TransactionManager

doc = DocumentManager.Instance.CurrentDBDocument
uiapp = DocumentManager.Instance.CurrentUIApplication
app = uiapp.Application

# Import RevitAPI
clr.AddReference("RevitAPI")
import Autodesk
from Autodesk.Revit.DB import *

items = IN[0]
overwrite = IN[1]
savecentral = IN[2]
pathin = IN[3]


soptions = SaveAsOptions()
woptions = WorksharingSaveAsOptions()
swconfig = SimpleWorksetConfiguration.AllWorksets
woptions.OpenWorksetsDefault = swconfig
soptions.OverwriteExistingFile = overwrite
woptions.SaveAsCentral = savecentral
soptions.SetWorksharingOptions(woptions)

typelist = list()


for i, (one, two) in enumerate(zip(items, pathin)): 	
		try:
			one.SaveAs(two,soptions)
		except:
			one.Save()
		
OUT = items
# ----------------------------------------
clean = Custom[Output.Clean](input=python_script_2)  # This will return a single value or list from one input.
Document_2 = Output(clean)  # "Document"
