# Dynamo custom node ScopeBox.Elements.dyf (Dynamo 1.3.0.875)
# category: Bakery.Revit.Selection.ByCategory
# in current document

categories = Categories("VolumeOfInterest")
all_elements_of_category = ElementsOfCategory(categories)
Elements = Output(all_elements_of_category)
