# Dynamo custom node Set 3D CAD Instance and Type Worksets by Filename.dyf (Dynamo 1.3.0.875)
# category: Bakery.Revit.Document.Worksets

code_block = CodeBlock { 0; }
worksets = Custom[Document.Worksets]()  # Returns all Worksets in the current document
watch = Watch(worksets)
element_name_universal = Custom[Element Name Universal](Elements=watch)  # Modified for 0.8.1
links_and_imports_in_view_or = Custom[Links and Imports in View or Model]()  # separates into view based and model based dwgs or imports
PrefixIfUsed = Input(PrefixIfUsed : string = "Link - ")
add_prefix_to_items_in_string = Custom[Add Prefix to Items in String List](string_list=links_and_imports_in_view_or.modelBasedImportNames, prefix=PrefixIfUsed)
firstIndexOf = List.FirstIndexOf(list=element_name_universal, item=add_prefix_to_items_in_string)
getItemAtIndex = List.GetItemAtIndex(list=watch, index=firstIndexOf)
count = Count(getItemAtIndex)
code_block_2 = CodeBlock(x=count) { 0..(x-1); }
type = Custom[Element.Type](element=links_and_imports_in_view_or.modelBasedImports)  # Gets the family type of a given element (if applicable).
subnode_to_set_3d_cad_worksets = Custom[subnode to Set 3D CAD Worksets](worksets=getItemAtIndex, elementlist=links_and_imports_in_view_or.modelBasedImports, typelist=type)  # unwired: index
map = List.Map(list=code_block_2, f_x=subnode_to_set_3d_cad_worksets)
done = Output(map)
