# Dynamo custom node Speak Single String via Speech Synthesizer.dyf (Dynamo 1.3.0.875)
# category: Bakery.Core

str = Input(str : string)
string = StringInput(" ")
split = String.Split(str, string)
speed = Input(speed : int = 5)
python_script = Python(IN[0]=split, IN[1]=speed)
# ---------- python_script.python (13 lines) ----------
import clr
clr.AddReference('System.Speech')
from System.Speech.Synthesis import SpeechSynthesizer

str = IN[0]
speed = IN[1]

for i in str:
	spk = SpeechSynthesizer()
	spk.Rate = speed
	spk.Speak(i)
#Assign your output to the OUT variable.
OUT = "done"
# ----------------------------------------
sent_to_speakers = Output(python_script)
string_2 = StringInput("speed must be from -10 to 10")
Output = Output(string_2)  # ""
