# Dynamo custom node Sublists of Point Values to Sublists of Points.dyf (Dynamo 0.8.2.2371)
# category: Bakery.Geometry.Point

list_with_sublists = Input()
divide_by_this_for_scale = Input()
comma_separated_point_value_to = Custom[Comma Separated Point Value to Point Object](y=divide_by_this_for_scale)
map = List.Map(list=list_with_sublists, f_x=comma_separated_point_value_to)
mapped = Output(map)
