# Dynamo custom node Summary of Revit Link File Information.dyf (Dynamo 0.9.2.4472)
# category: Bakery.Revit.Document.Links

string = StringInput("NULL VALUE")
FilePathList = Input()
watch = Watch(FilePathList)
isEmpty = List.IsEmpty(watch)
code_block = CodeBlock { "No Revit Links"; }
code_block_2 = CodeBlock { "Link Paths"; }
boolean_input_to_variable_string = Custom[Boolean Input to Variable String Output](Boolean_In=isEmpty, String_if_True=code_block, String_if_False=code_block_2)  # you choose what you want to convert true / false to, good for validation
turnIntoList = Custom[TurnIntoList](unknownItem=watch)  # Turns an element (or a nested list) into a flat list
addItemToFront = List.AddItemToFront(item=boolean_input_to_variable_string, list=turnIntoList)
LinkTypeList = Input()
watch_2 = Watch(LinkTypeList)
isEmpty_2 = List.IsEmpty(watch_2)
code_block_3 = CodeBlock { "No Revit Links"; }
code_block_4 = CodeBlock { "Link Path Type"; }
boolean_input_to_variable_string_2 = Custom[Boolean Input to Variable String Output](Boolean_In=isEmpty_2, String_if_True=code_block_3, String_if_False=code_block_4)
turnIntoList_2 = Custom[TurnIntoList](unknownItem=watch_2)
addItemToFront_2 = List.AddItemToFront(item=boolean_input_to_variable_string_2, list=turnIntoList_2)
create = List.Create(addItemToFront, addItemToFront_2)
transpose = List.Transpose(create)
bv_replace_nulls = Custom[bv Replace Nulls](replacement=string, seq=transpose)
twoColumnOutput = Output(bv_replace_nulls)
