# Dynamo custom node Summary of Selected Parameter Values for Duct and Pipe Elements.dyf (Dynamo 0.8.1.1942)
# category: Bakery.Revit.Elements.Systems
# gives a two column output

list_duct_and_pipe_related = Custom[List Duct and Pipe Related Elements]()
parameter = Input()
getParameterValueByName = Element.GetParameterValueByName(element=list_duct_and_pipe_related.elements, parameterName=parameter)
ValueAcheckFor = Input()
ValueBcheckFor = Input()
summary_of_unique_values_present = Custom[Summary of Unique Values present in List](inList=getParameterValueByName, listPassthrough=list_duct_and_pipe_related.elements, colheading=parameter, equalToA=ValueAcheckFor, equalToB=ValueBcheckFor)
watch = Watch(summary_of_unique_values_present.inListSummary_TwoColumn)
twoColumnList = Output(watch)
