# Dynamo custom node Truncate X and Y Values and Write to New File.dyf (Dynamo 1.3.0.875)
# category: Bakery.Construction.PointCloud
# for doing a row by row translation of data

newFilePath = Input(newFilePath : string)
originalFilePath = Input(originalFilePath : var[]..[])
text_file_to_list_of_strings = Custom[Text File to List of Strings](path=originalFilePath)
XstartIndex = Input(XstartIndex : int)
XremoveCount = Input(XremoveCount : int)
YstartIndex = Input(YstartIndex : var[]..[])
YremoveCount = Input(YremoveCount : int)
truncate_x_and_y_values_in_a = Custom[Truncate X and Y Values in a String List](OriginalDataList=text_file_to_list_of_strings, XstartIndex=XstartIndex, XremoveCount=XremoveCount, YstartIndex=YstartIndex, YremoveCount=YremoveCount)  # for point cloud translation
watch = Watch(truncate_x_and_y_values_in_a.modifiedData)
list_to_single_string = Custom[List to Single String](Original_List=watch)  # renamed fork of "Convert List into List of Strings with Line Breaks"
writeText = File.WriteText(newFilePath, list_to_single_string)
void = Output(writeText)
watch_2 = Watch(truncate_x_and_y_values_in_a.XuniqueCheck)
flatten = Flatten(watch_2)
uniqueItems = List.UniqueItems(flatten)
xUniqueCheck = Output(uniqueItems)
watch_3 = Watch(truncate_x_and_y_values_in_a.YuniqueCheck)
flatten_2 = Flatten(watch_3)
uniqueItems_2 = List.UniqueItems(flatten_2)
yUniqueCheck = Output(uniqueItems_2)
