# Dynamo custom node Unique Item Selector.dyf (Dynamo 0.9.2.4472)
# category: Bakery.Core.List

items = Input()
watch = Watch(items)
uniqueItems = List.UniqueItems(watch)
index = Input(index : int = 0)
getItemAtIndex = List.GetItemAtIndex(list=uniqueItems, index=index)
selectedItem = Output(getItemAtIndex)
uniqueItems_2 = Output(uniqueItems)  # "uniqueItems"
