# Dynamo custom node Write gbXML Data to File.dyf (Dynamo 1.0.0.1180)
# category: Bakery.Data.XML
# from Ezra at https://forum.dynamobim.com/t/how-do-you-create-an-xml-file-using-a-python-script/3859/6?u=luke_johnson

roomElements = Input()
watch = Watch(roomElements)
string = StringInput("Name")
getParameterValueByName = Element.GetParameterValueByName(element=watch, parameterName=string)
string_2 = StringInput("Number")
getParameterValueByName_2 = Element.GetParameterValueByName(element=watch, parameterName=string_2)
string_3 = StringInput("Area")
getParameterValueByName_3 = Element.GetParameterValueByName(element=watch, parameterName=string_3)
count = Count(getParameterValueByName)
savePathAndFilenameWithExt = Input()
python_script = Python(IN[0]=getParameterValueByName, IN[1]=getParameterValueByName_2, IN[2]=getParameterValueByName_3, IN[3]=count, IN[4]=savePathAndFilenameWithExt)
# ---------- python_script.python (63 lines) ----------
import clr
clr.AddReference('ProtoGeometry')
from Autodesk.DesignScript.Geometry import *
import sys
sys.path.append("C:\Program Files (x86)\IronPython 2.7\Lib")
#from xml.parsers.expat import expat -- can't find this
import xml.etree.ElementTree as ET


#The inputs to this node will be stored as a list in the IN variable.
room_name = IN[0]
room_num = IN[1]
room_area = IN[2]
room_count = IN[3]
save_path = IN[4]

number_rooms_created = 0


#start xml element tree
gbXML = ET.Element("gbXML", lengthUnit="Feet", areaUnit="SquareFeet", useSIUnitsForResults="false", version="1.0")
Campus = ET.SubElement(gbXML, "Campus", id="cmps-1")
Building = ET.SubElement(Campus, "Building", id="bldg-1")


for i in range (0, room_count):

	#skip if room name or room number is blank
	if room_name[i] != "" and room_num[i] != "":
		
		try:

			#convert room area to a string
			area_string = str(room_area[i])
			#string includes ft2 units at end of string. split string at "ft" to get just the number
			area_number = area_string.split("ft")[0]
			#convert string to float
			area_float = float(area_number)
			#round float to zero decimal places, and convert back to string
			area_string = str(round(area_float, 0))
			#split string at "." to truncate the period and the zeros following the period
			area_print = area_string.split(".")[0]
			
			#add space to element tree
			Space = ET.SubElement(Building, "Space")
			ET.SubElement(Space, "Name").text = room_num[i] + " - " + room_name[i]
			ET.SubElement(Space, "Area").text = area_print
			
			#keep track of number of rooms added to file
			number_rooms_created +=1
			
		except:
			#skip errors due to "Redundant Room" and "Not Placed" listed as the Area
			pass
		

#create xml tree and write to file
tree = ET.ElementTree(gbXML)
tree.write(save_path, encoding="utf-8", xml_declaration=True) 


#Assign your output to the OUT variable
OUT = str(room_count) + " rooms found, " + str(number_rooms_created) + " rooms created"
# ----------------------------------------
OUT = Output(python_script)
