# Dynamo custom node bv All Indices Of that can handle Nulls.dyf (Dynamo 0.8.2.2392)
# category: Bakery.Dynamo.ForkedNodes
# forked from spring nodes

list = Input()
value = Input()
code_block = CodeBlock(list, value)
# ---------- code_block.designscript (17 lines) ----------
def NullAllInd(l1:var[],val)
{
return = [Imperative]
{
out1 = {};
for(i in GetKeys(l1))
{
if(l1[i] == val)
{
out1 = List.AddItemToEnd(i,out1);
}
}
return = out1;
}
};

NullAllInd(l1,val);
# ----------------------------------------
indices = Output(code_block)
