# Dynamo custom node bv Element Add Void Cut.dyf (Dynamo 1.1.0.2094)
# category: Bakery.Dynamo.ForkedNodes

element_s_ToBeCut = Input()  # "element(s)ToBeCut"
cuttingElements = Input()
python_script = Python(IN[0]=element_s_ToBeCut, IN[1]=cuttingElements)
# ---------- python_script.python (41 lines) ----------
import clr

clr.AddReference("RevitServices")
import RevitServices
from RevitServices.Persistence import DocumentManager
from RevitServices.Transactions import TransactionManager
doc = DocumentManager.Instance.CurrentDBDocument

clr.AddReference("RevitAPI")
from Autodesk.Revit.DB import *

def tolist(obj1):
	if hasattr(obj1,"__iter__"): return obj1
	else: return [obj1]

def output1(l1):
	if len(l1) == 1: return l1[0]
	else: return l1

ToBeCut = UnwrapElement(tolist(IN[0]))
Cuts = UnwrapElement(tolist(IN[1]))
out1 = []

cutU = InstanceVoidCutUtils
TransactionManager.Instance.EnsureInTransaction(doc)
for i in xrange(len(ToBeCut)):
	if cutU.CanBeCutWithVoid(ToBeCut[i]):
		count = 0
		for j in xrange(len(Cuts)):
			if cutU.IsVoidInstanceCuttingElement(Cuts[j]) and \
			not cutU.InstanceVoidCutExists(ToBeCut[i],Cuts[j]):
				try: 
					cutU.AddInstanceVoidCut(doc,ToBeCut[i],Cuts[j])
					count += 1
				except: pass
		out1.append("%s out of %s cuts created." %(count, len(Cuts)) )
	else:
		out1.append("Element could not be cut")
TransactionManager.Instance.TransactionTaskDone()

OUT = output1(out1)
# ----------------------------------------
result = Output(python_script)
