# Dynamo custom node bv Get Element Rotation.dyf (Dynamo 0.8.2.2371)
# category: Bakery.Dynamo.ForkedNodes

FamInstance = Input()
python_script_listassurance = Python(IN[0]=FamInstance)
# ---------- python_script_listassurance.python (13 lines) ----------
import clr
clr.AddReference('ProtoGeometry')
from Autodesk.DesignScript.Geometry import *
#The inputs to this node will be stored as a list in the IN variables.
input = IN[0]

if isinstance(input,list) == False:
	elements = [input]
else:
	elements = input

#Assign your output to the OUT variable.
OUT = elements
# ----------------------------------------
python_script = Python(IN[0]=python_script_listassurance)
# ---------- python_script.python (22 lines) ----------
import clr
clr.AddReference('ProtoGeometry')
from Autodesk.DesignScript.Geometry import *

# Import RevitAPI
clr.AddReference('RevitAPI')
import Autodesk
#The inputs to this node will be stored as a list in the IN variable.
elements = UnwrapElement(IN[0])

outlist = [] #export list
templist = [] #temporary list to group attributes by element
for i in elements:
	templist.append(i.HandOrientation) #vector XYZ Hand
	templist.append(i.FacingFlipped) #is mirrored over X axis?
	templist.append(i.HandFlipped) #is mirrored over Y axis?
	outlist.append(templist[:])

	del templist[:] #clear the templist

#Assign your output to the OUT variable
OUT = outlist
# ----------------------------------------
transpose = List.Transpose(python_script)
code_block = CodeBlock(list=transpose)
# ---------- code_block.designscript (3 lines) ----------
XYZvectorHand = List.GetItemAtIndex(list, 0);
xMirrored = List.GetItemAtIndex(list, 1);
yMirrored = List.GetItemAtIndex(list, 2);
# ----------------------------------------
python_script_2 = Python(IN[0]=code_block.XYZvectorHand)
# ---------- python_script_2.python (24 lines) ----------
import clr
clr.AddReference('ProtoGeometry')
from Autodesk.DesignScript.Geometry import *
#The inputs to this node will be stored as a list in the IN variable.
vect = IN[0]
outlist = []
templist = []

for e in vect:
	e = str(e)
	e = e.replace('(', '')
	e = e.replace(')', '')
	e = e.replace(',', '')
	templist.append(e)

for i in templist:
	outlist.append(i.split(" "))
	
for e in outlist:
	for i in e:
		i = float(i)

#Assign your output to the OUT variable
OUT = outlist
# ----------------------------------------
transpose_list_and_split_output = CodeBlock(inputlist=python_script_2) { IN=List.Transpose(inputlist); X=IN[0]; Y=IN[1]; Z=IN[2]; }
toNumber = String.ToNumber(transpose_list_and_split_output.X)
toNumber_2 = String.ToNumber(transpose_list_and_split_output.Y)
python_script_3 = Python(IN[0]=toNumber, IN[1]=toNumber_2)
# ---------- python_script_3.python (34 lines) ----------
import clr
from math import *
clr.AddReference('ProtoGeometry')
from Autodesk.DesignScript.Geometry import *
#The inputs to this node will be stored as a list in the IN variable.
dataEnteringNode = IN
X=IN[0]
Y=IN[1]
outlist = []
templist = []
templist2 = []
count = 0


for e in X:
	templist.append((acos(e)))


while count < len(templist):
#for item in templist:
	if Y[count] >= 0:
		templist2.append(degrees(templist[count]))
	elif Y[count] < 0:
		templist2.append((degrees(templist[count])) + (2*(180-(degrees(templist[count])))))
	count = count + 1

for e in templist2:
	if e == 0:
		outlist.append(0)
	else:
		outlist.append(360 - e)

#Assign your output to the OUT variable
OUT = outlist
# ----------------------------------------
Rotation = Output(python_script_3)
watch_isxmirrored = Watch(code_block.xMirrored)
isXmirrored = Output(watch_isxmirrored)  # "isXmirrored?"
watch_isymirrored = Watch(code_block.yMirrored)
isYmirrored = Output(watch_isymirrored)  # "isYmirrored?"
