# Dynamo custom node bv Merge Sublists with a separator.dyf (Dynamo 1.2.1.3083)
# category: Bakery.ZZ
# forked from Rhythm, has problems with string like }---{

List = Input()
Character = Input()
python_script = Python(IN[0]=List, IN[1]=Character)
# ---------- python_script.python (3 lines) ----------
initial = IN[0]
result = map(IN[1].join, initial)
OUT=result
# ----------------------------------------
OUT = Output(python_script)
