# Dynamo custom node bv Output Clean.dyf (Dynamo 0.8.2.2392)
# category: Bakery.Dynamo.ForkedNodes
# forked from Rhythm

input = Input()
count = List.Count(input)
code_block = CodeBlock(input=count) { input>1; }
firstItem = List.FirstItem(input)

# group: Special thanks to Mark Thorley for this definition
code_block_2 = CodeBlock()
# ---------- code_block_2.designscript (15 lines) ----------
def oldif(test,iftrue:var[]..[],
iffalse:var[]..[])
{
return = [Imperative]
{
if (test)
{
return = iftrue;
}
else
{
return = iffalse;
}
}
};
# ----------------------------------------
code_block_3 = CodeBlock(test=code_block, iftrue=input, iffalse=firstItem) { oldif(test,iftrue,iffalse); }

result = Output(code_block_3)
