# Dynamo custom node bv Remove from String after Character.dyf (Dynamo 0.9.2.4472)
# category: Bakery.Dynamo.ForkedNodes
# forked from Rhythm

str = Input(str : string)
watch = Watch(str)
Character = Input()
ignoreCase = Input(ignoreCase : bool=false)
indexOf = String.IndexOf(string=watch, searchFor=Character, ignoreCase=ignoreCase)
code_block = CodeBlock { -1; }
code_block_2 = CodeBlock { 0; }
change_value_if_matches = Custom[Change Value If Matches](originalValue=indexOf, ifMatchingThis=code_block, replaceWithThis=code_block_2)
watch_2 = Watch(change_value_if_matches)
length = String.Length(watch)
code_block_3 = CodeBlock { -1; }
change_value_if_matches_2 = Custom[Change Value If Matches](originalValue=indexOf, ifMatchingThis=code_block_3, replaceWithThis=length)
watch_3 = Watch(change_value_if_matches_2)
code_block_4 = CodeBlock(in1=length, in2=watch_3) { out1=in1-in2; out1; }
remove = String.Remove(str=watch, startIndex=watch_2, count=code_block_4.out1)
string = Output(remove)
