# Dynamo custom node bv Send to Clipboard from Revit.dyf (Dynamo 0.8.2.2371)
# category: Bakery.Dynamo.ForkedNodes

str = Input()
python_script = Python(IN[0]=str)
# ---------- python_script.python (8 lines) ----------
import clr
clr.AddReference('System.Windows.Forms')
from System.Windows.Forms import Clipboard
try:
	Clipboard.SetText(IN[0])
	OUT = IN[0]
except:
	OUT = 'Data could not be copied to clipboard'
# ----------------------------------------
str_2 = Output(python_script)  # "str"
