# Dynamo custom node mysql Create Database by Name.dyf (Dynamo 1.2.1.3083)
# category: Bakery.Data.Database

connectionString = Input()
code_block = CodeBlock { true; }
databaseName = Input()
string = StringInput("CREATE DATABASE `")
string_2 = StringInput("`")
join = String.Join(databaseName, string, string_2)
mySQL_Command = Database.Command.MySQL_Command(connectionString, code_block, join)
Success = Output(mySQL_Command)  # "Success?"
