# Dynamo custom node mysql Create List of Insert Instructions.dyf (Dynamo 1.2.1.3083)
# category: Bakery.Data.Database

dbName = Input(dbName : string)
tableName = Input(tableName : string)
columnNameList = Input()
dataList = Input()
python_script = Python(IN[0]=dbName, IN[1]=tableName, IN[2]=columnNameList, IN[3]=dataList)
# ---------- python_script.python (30 lines) ----------
import clr
import sys
clr.AddReference('ProtoGeometry')
from Autodesk.DesignScript.Geometry import *
#The inputs to this node will be stored as a list in the IN variables.
mydbname = IN[0]
mytablename = IN[1]
mycolumnlist = IN[2]
mydatalist = IN[3]

columnstringlist = ', '.join(mycolumnlist)
datastringlist = []
for i in mydatalist:
	datastringlist.append("'%s'" % i)
datastringlistq = ', '.join(datastringlist)

joinlist = []
joinlist.append("INSERT INTO ")
joinlist.append(mydbname)
joinlist.append(".")
joinlist.append(mytablename)
joinlist.append(" (")
joinlist.append(columnstringlist)
joinlist.append(") VALUES (")
joinlist.append(datastringlistq)
joinlist.append(");")
joined = ''.join(joinlist)

#Assign your output to the OUT variable.
OUT = joined
# ----------------------------------------
commandString = Output(python_script)
