# Dynamo custom node mysql Insert New Row of Data.dyf (Dynamo 1.2.1.3083)
# category: Bakery.Data.Database

ConnectionString = Input(ConnectionString : string)
code_block = CodeBlock { true; }
columnNameList = Input()
dataList = Input()
dbName = Input(dbName : string)
tableName = Input(tableName : string)
mysql_create_list_of_insert = Custom[mysql Create List of Insert Instructions](columnNameList=columnNameList, dataList=dataList, dbName=dbName, tableName=tableName)
watch = Watch(mysql_create_list_of_insert)
mySQL_Command = Database.Command.MySQL_Command(ConnectionString, code_block, watch)
code_block_2 = CodeBlock { 1; }
wait_then_passthrough = Custom[Wait Then Passthrough](anyData=mySQL_Command, secondsToWait=code_block_2)
success = Output(wait_then_passthrough)
