# Dynamo custom node mysql Send Element Fingerprint to Db.dyf (Dynamo 1.2.1.3083)
# category: Bakery.Data.Database

oneElement = Input()
crawlKey = Input()
elementFingerprintFM = Custom[ElementFingerprintFM](oneElement=oneElement, crawlkey=crawlKey)
watch = Watch(elementFingerprintFM.columnNameList)
watch_2 = Watch(elementFingerprintFM.valueList)
dbName = Input(dbName : string)
tableName = Input(tableName : string)
ConnectionString = Input(ConnectionString : string)
mysql_insert_new_row_of_data = Custom[mysql Insert New Row of Data](columnNameList=watch, dataList=watch_2, dbName=dbName, tableName=tableName, ConnectionString=ConnectionString)
success = Output(mysql_insert_new_row_of_data)
