# Dynamo custom node mysql Send List to Db for Multiple Columns.dyf (Dynamo 1.2.1.3083)
# category: Bakery.Data.Database

dataLists = Input()
transpose = List.Transpose(dataLists)
ColumnNameList = Input()
dbName = Input()
tableName = Input()
connectionString = Input()
mysql_insert_data_into_new_rows = Custom[mysql Insert Data into New Rows for Multiple Columns](ColumnNameList=ColumnNameList, dbName=dbName, tableName=tableName, connectionString=connectionString)  # unwired: dataPiece
map = List.Map(list=transpose, f_x=mysql_insert_data_into_new_rows)
watch = Watch(map)
Success = Output(watch)  # "Success?"
