# Dynamo custom node mysql Send List to Db.dyf (Dynamo 0.8.2.2371)
# category: Bakery.Data.Database

mysql_default_connection_string = Custom[mysql Default Connection String]()
code_block = CodeBlock { true; }
list = Input()
string_from_object = FromObject()
map = List.Map(list=list, f_x=string_from_object)
ColumnName = Input()
mysql_insert_data_into_new_row = Custom[mysql Insert Data into New Row](ColumnName=ColumnName)
map_2 = List.Map(list=map, f_x=mysql_insert_data_into_new_row)
mySQL_Command = Database.Command.MySQL_Command(mysql_default_connection_string, code_block, map_2)
Success = Output(mySQL_Command)  # "Success?"
