# Dynamo custom node one Element to Connector Origin Dynamo Point.dyf (Dynamo 1.3.4.6666)
# category: Bakery.Revit.API.MEP
# scaled feet to mm

oneElement = Input()
get_connectormanager = Custom[Get ConnectorManager](elements=oneElement)  # Get the connector manager object from Revit
get_connectors_from = Custom[Get Connectors from ConnectorManager](connectorManagerObject=get_connectormanager)
firstItem = List.FirstItem(get_connectors_from)
get_connector_origin = Custom[Get Connector.Origin](connectors=firstItem)
firstItem_2 = List.FirstItem(get_connector_origin)
comma_separated_revit_data_to = Custom[Comma Separated Revit Data to XYZ Values](item=firstItem_2)
byCoordinates = Point.ByCoordinates(x=comma_separated_revit_data_to.X, y=comma_separated_revit_data_to.Y, z=comma_separated_revit_data_to.Z)
code_block = CodeBlock { 1; }
convert_between_units = DynamoConvert(code_block, conversionMetric=Length, conversionFrom=Feet, conversionTo=Millimeters)
scale = Geometry.Scale(geometry=byCoordinates, amount=convert_between_units)
onePoint = Output(scale)
