# Dynamo custom node subnode to Make One Linked Part.dyf (Dynamo 0.8.2.2371)
# category: Bakery.Revit.Elements.Parts.Helper

oneElement = Input()
oneLinkDoc = Input()
oneLinkInstanceId = Input()
python_script = Python(IN[0]=oneElement, IN[1]=oneLinkDoc, IN[2]=oneLinkInstanceId)
# ---------- python_script.python (55 lines) ----------
import clr
clr.AddReference('ProtoGeometry')
from Autodesk.DesignScript.Geometry import *
# Import ToDSType(bool) extension method
clr.AddReference("RevitNodes")
import Revit
clr.ImportExtensions(Revit.Elements)
# Import geometry conversion extension methods
clr.ImportExtensions(Revit.GeometryConversion)
# Import DocumentManager and TransactionManager
clr.AddReference("RevitServices")
import RevitServices
from RevitServices.Persistence import DocumentManager
from RevitServices.Transactions import TransactionManager
from System.Collections.Generic import *
# Import RevitAPI
clr.AddReference("RevitAPI")
import Autodesk
from Autodesk.Revit.DB import *

doc = DocumentManager.Instance.CurrentDBDocument
uiapp = DocumentManager.Instance.CurrentUIApplication
app = uiapp.Application

docs = UnwrapElement(IN[1])
instId = IN[2]
elts = []
Ids = []
for i in IN[0]:
	elts.append(UnwrapElement(i))
for e in elts:
	y = LinkElementId(instId, e.Id)
	Ids.append(y)
IDS = List[Autodesk.Revit.DB.LinkElementId](Ids)
TransactionManager.Instance.EnsureInTransaction(doc)
#created = []
try:
	a=PartUtils.CreateParts(doc,IDS)
	result = True
except:
	result = False
#if PartUtils.AreElementsValidForCreateParts(doc, IDS):

#	results.append("should work")
#try:
#	PartUtils.CreateParts(docs, IDS)
#	results.append("success")
#except:
#	results.append("failure")


TransactionManager.Instance.TransactionTaskDone()
#TransactionManager.Instance.ForceCloseTransaction()

OUT = result
# ----------------------------------------
OUT = Output(python_script)
