# Dynamo custom node Add One Point to Slabshape.dyf (Dynamo 1.2.0.2831)
# category: Bakery.BETA

point = Input()
floor = Input()
python_script = Python(IN[0]=point, IN[1]=floor)
# ---------- python_script.python (28 lines) ----------
import clr
clr.AddReference('RevitAPI')
from Autodesk.Revit.DB import *

clr.AddReference("RevitNodes")
import Revit
clr.ImportExtensions(Revit.GeometryConversion)

clr.AddReference("RevitServices")
import RevitServices
from RevitServices.Persistence import DocumentManager
from RevitServices.Transactions import TransactionManager

doc = DocumentManager.Instance.CurrentDBDocument
item = IN[0]
slabshape = UnwrapElement(IN[1])
successlist = list()
faillist = list()

TransactionManager.Instance.EnsureInTransaction(doc)
slabshape.SlabShapeEditor.ResetSlabShape()
try:
	slabshape.SlabShapeEditor.DrawPoint(item.ToXyz())
except:
	faillist.append(item)
TransactionManager.Instance.TransactionTaskDone()

OUT = slabshape, faillist
# ----------------------------------------
OUT = Output(python_script)
