# Dynamo custom node All Constraints in Current Document.dyf (Dynamo 1.3.0.875)
# category: Bakery.Revit.Elements.Dimension

string = StringInput("Constraints")
byName = Custom[BuiltInCategory.ByName](searchFor=string)  # Looks up all the built-in categories based on a given name (or part of a name) of the category. Search is case-insensitive.
select_elements_using_builtin = Custom[Select Elements Using BuiltIn Category Names](builtIns=byName.BuiltInCategories)  # works on a list of BuiltIn Names
elements = Output(select_elements_using_builtin)
