# Dynamo custom node Auto Create Detail Lines and Dimensions.dyf (Dynamo 1.3.2.2480)
# category: Bakery.Revit.Elements.Dimension

elementsToDim = Input()
watch = Watch(elementsToDim)
ctr = Input()
getItemAtIndex = List.GetItemAtIndex(list=watch, index=ctr)
location = Custom[Element.Location](element=getItemAtIndex)  # Returns the location of an element as an XYZ (or if it's line-based the start and end point of the line), along with some booleans to help filtering the results. Use this for some element types (e.g. walls or lines) that do not work with the built-in Get Family Instance Location node.
firstItem = List.FirstItem(location.points)
watch_2 = Watch(firstItem)
walls = Input(walls : var[]..[])
nearest_x_and_y_walls_for_list = Custom[Nearest X and Y Walls for List of Elements](elementz=watch, walls=walls)
getItemAtIndex_2 = List.GetItemAtIndex(list=nearest_x_and_y_walls_for_list, index=ctr)
watch_3 = Watch(getItemAtIndex_2)
get_wall_layer_location_lines = Custom[Get Wall Layer Location Lines](watch_3)

# group: interior faces
watch_4 = Watch(get_wall_layer_location_lines.interior)

# group: exterior faces
watch_5 = Watch(get_wall_layer_location_lines.exterior)

create = List.Create(watch_4, watch_5)
transpose = List.Transpose(create)
firstItem_2 = List.FirstItem(transpose)
measure_perpendicular_lines = Custom[Measure Perpendicular Lines](point=watch_2, lines=firstItem_2)
minimumItem = List.MinimumItem(measure_perpendicular_lines.lengths)
indexOf = IndexOf(measure_perpendicular_lines.lengths, minimumItem)
getItemAtIndex_3 = List.GetItemAtIndex(list=firstItem_2, index=indexOf)
lastItem = List.LastItem(transpose)
measure_perpendicular_lines_2 = Custom[Measure Perpendicular Lines](point=watch_2, lines=lastItem)
minimumItem_2 = List.MinimumItem(measure_perpendicular_lines_2.lengths)
indexOf_2 = IndexOf(measure_perpendicular_lines_2.lengths, minimumItem_2)
getItemAtIndex_4 = List.GetItemAtIndex(list=lastItem, index=indexOf_2)
create_2 = List.Create(getItemAtIndex_3, getItemAtIndex_4)
measure_perpendicular_lines_3 = Custom[Measure Perpendicular Lines](point=watch_2, lines=create_2)
byStartPointEndPoint = Line.ByStartPointEndPoint(startPoint=watch_2, endPoint=measure_perpendicular_lines_3.resultPoint)
view = Input(view : var[]..[])
fromCurve = Custom[DetailLine.FromCurve](curve=byStartPointEndPoint, view=view)  # Creates a detail line based on a given curve
dimensionOffset = Input()
dimension_to_detail_line = Custom[Dimension to Detail Line Endpoints](detailLines=fromCurve, offsetDist=dimensionOffset)
done = Output(dimension_to_detail_line)
