# Dynamo custom node Build New Order of Headings by Search.dyf (Dynamo 1.3.0.875)
# category: Bakery.Core.List

NewHeadingOrderWildcards = Input()
toUpper = String.ToUpper(NewHeadingOrderWildcards)
OriginalHeadingOrder = Input()
flat_list_to_list_of_strings = Custom[Flat List to List of Strings](Original_List=OriginalHeadingOrder)  # using python methods
toUpper_2 = String.ToUpper(flat_list_to_list_of_strings)

# group: Case sensitive
wildcard_string_search_one_list = Custom[Wildcard String Search One List in Another List (Faster)](searchForTheseFragments=toUpper, insideStringsInThisList=toUpper_2)  # uses straight Python not String.Contains

keep_first_matching_result_after = Custom[Keep First Matching Result After Search](foundSearchItems=wildcard_string_search_one_list.SearchItems, originalSearchList=toUpper, searchResults=wildcard_string_search_one_list.foundInThese)
watch = Watch(keep_first_matching_result_after)
newHeadings = Output(watch)
watch_2 = Watch(toUpper_2)
check_common_items_between_two = Custom[Check Common Items between Two Lists and Get From One](in_this_and_get_from_this=watch_2, searchForThese=watch)
watch_3 = Watch(check_common_items_between_two.cleaned_indices)

# group: Get from
firstItem = List.FirstItem()  # unwired: arg0
map = List.Map(list=watch_3, f_x=firstItem)
watch_4 = Watch(map)

create = List.Create(NewHeadingOrderWildcards, watch_4)
list_length_validator = Custom[List Length Validator](listOfLists=create)
indicesMatchDesiredOrder = Output(list_length_validator)
create_2 = List.Create(wildcard_string_search_one_list.foundInThese, watch)
list_length_validator_2 = Custom[List Length Validator](listOfLists=create_2)
FalseIfDuplicatesFoundAndRemoved = Output(list_length_validator_2)
indices = Output(watch_4)
