# Dynamo custom node CSV File Path to Lists.dyf (Dynamo 1.2.1.3083)
# category: Bakery.Core

path = Input()
fromPath = FileObject(path)  # "File.FromPath"
readFromFile = CSV.ReadFromFile(fromPath)
transpose = List.Transpose(readFromFile)
lists = Output(transpose)
