# Dynamo custom node Category Id to BuiltInCategory.dyf (Dynamo 0.9.1.4062)
# category: Bakery.Revit.Document.Category

oneId = Input()
python_script = Python(IN[0]=oneId)
# ---------- python_script.python (28 lines) ----------
#LSJ

import clr
clr.AddReference('ProtoGeometry')
from Autodesk.DesignScript.Geometry import *

# Import DocumentManager
clr.AddReference("RevitServices")
import RevitServices
from RevitServices.Persistence import DocumentManager

# Import RevitAPI
clr.AddReference("RevitAPI")
import Autodesk

# Import ToDSType(bool) extension method
clr.AddReference("RevitNodes")
import Revit
from Autodesk.Revit.DB import *
clr.ImportExtensions(Revit.Elements)

import System
#The inputs to this node will be stored as a list in the IN variables.
dataEnteringNode = IN
result = System.Enum.ToObject(BuiltInCategory, IN[0])

#Assign your output to the OUT variable.
OUT = result
# ----------------------------------------
OUT = Output(python_script)
