# Dynamo custom node Centroid of First Solid of Element.dyf (Dynamo 1.3.4.6666)
# category: Bakery.Revit.Elements

linkElementz = Input()
solids = Revit.LinkElement.Solids(linkElementz)
firstItem = List.FirstItem(solids)
centroid = Solid.Centroid(firstItem)
pt = Output(centroid)
