# Dynamo custom node Check Project Shared Parameter against benchmark GUID.dyf (Dynamo 0.8.2.2371)
# category: Bakery.Revit.Parameters
# and report results

searchForSP = Input()
TrueForType = Input()
get_list_of_guids_for_a_specific = Custom[Get list of GUIDs for a Specific Shared Parameter Name](SPnameAsString=searchForSP, TrueForType=TrueForType)  # iterates through model elements
isNotEmpty = Custom[List.IsNotEmpty](seq=get_list_of_guids_for_a_specific)  # Just the inversion of the built-in Is Empty List node.
uniqueItems = List.UniqueItems(get_list_of_guids_for_a_specific)
string_from_object = FromObject()
map = List.Map(list=uniqueItems, f_x=string_from_object)
flatten = Flatten(map)
GUIDinStringNode = Input()
string_from_object_2 = FromObject(GUIDinStringNode)
turnIntoList = Custom[TurnIntoList](string_from_object_2)  # Turns an element (or a nested list) into a flat list
eq = flatten == turnIntoList
create = List.Create(isNotEmpty, eq)
flatten_2 = Flatten(create)
anyFalse = Custom[List.AnyFalse](seq=flatten_2)  # Returns true if any item in a list of booleans is false.
ifTrueThenFAIL = Output(anyFalse)
listOfGuids = Output(uniqueItems)
code_block = CodeBlock { "_"; }
code_block_2 = CodeBlock { "SP"; }
join = String.Join(code_block, code_block_2, searchForSP)
colHeading = Output(join)
watch = Watch(eq)
watch_2 = Watch(GUIDinStringNode)
lists = Output(flatten)
lists2 = Output(turnIntoList)
