# Dynamo custom node Check for Duplicate Parameter Values and Make Selection Set.dyf (Dynamo 0.8.0.950)
# category: Bakery.Revit.Parameters
# will take Parameter name, list of Elements and output to desired Selection Set

Save_to_Selection_Set_name = Input()
elementList = Input()
watch = Watch(elementList)
parameterName = Input()
getParameterValueByName = Element.GetParameterValueByName(element=watch, parameterName=parameterName)
duplicate_item_indices = Custom[Duplicate Item Indices](List=getParameterValueByName)  # Searches an input list for duplicate entries and lists their index numbers. Couple with Get From List to delete duplicates from a list.
watch_2 = Watch(duplicate_item_indices.Duplicate_Indices)
getItemAtIndex = List.GetItemAtIndex(list=watch, index=watch_2)
watch_3 = Watch(getItemAtIndex)
flatten = Flatten(watch_3)
byElements = Custom[SelectionSet.ByElements](Name=Save_to_Selection_Set_name, Element_s=flatten)  # Creates a selections set of the given elements. Note that if a selection set of the given name already exists in the model, its contents will be replaced. Also, if the selection set is already applied as a view filter, the view filter will have to be manually updated in the visibility / graphic overrides.
watch_4 = Watch(byElements)
feedback = Output(watch_4)
