# Dynamo custom node Clean String by UTF8 to Unicode roundtrip.dyf (Dynamo 0.8.2.2371)
# category: Bakery.Core.String

IN_0 = Input()  # "IN[0]"
python_script = Python(IN[0]=IN_0)
# ---------- python_script.python (17 lines) ----------
import clr
import sys
clr.AddReference('ProtoGeometry')
from Autodesk.DesignScript.Geometry import *
sys.path.append("C:\Program Files (x86)\IronPython 2.7\Lib")
#from xml.parsers.expat import expat -- can't find this
import xml.etree.ElementTree as ET
#The inputs to this node will be stored as a list in the IN variables.
stringIn = IN[0]
uniStr = unicode(stringIn)
fixed = uniStr.decode('utf-8', 'replace')
#Assign your output to the OUT variable.
fixed.decode('utf-8')
tree = ET.ElementTree(ET.fromstring(fixed))
#start tree code
#Assign your output to the OUT variable.
OUT = tree
# ----------------------------------------
ElementTree = Output(python_script)
