# Dynamo custom node Collect All Elements in Model faster.dyf (Dynamo 0.9.1.4062)
# category: Bakery.Revit.Selection
# does not report count or categories

built_in_name_lister = Custom[Built In Name Lister]()  # for document
select_elements_using_builtin = Custom[Select Elements Using BuiltIn Category Names](builtIns=built_in_name_lister.builtins)  # works on a list of BuiltIn Names
elementList = Output(select_elements_using_builtin)
element_types = ElementTypes("SketchPlane")
all_elements_of_type = ElementsOfType(element_types)
element_types_2 = ElementTypes("RevitLinkInstance")
all_elements_of_type_2 = ElementsOfType(element_types_2)
element_types_3 = ElementTypes("RevitLinkType")
all_elements_of_type_3 = ElementsOfType(element_types_3)
list_groups = Custom[List Groups]()
watch = Watch(list_groups.groupElements)
join = List.Join(select_elements_using_builtin, all_elements_of_type, all_elements_of_type_2, all_elements_of_type_3, watch)
extendedElementList = Output(join)
