# Dynamo custom node Collect All Elements in Model.dyf (Dynamo 1.2.0.2690)
# category: Bakery.Revit.Selection

python_script = Python()
# ---------- python_script.python (53 lines) ----------
#LSJ

import clr
clr.AddReference('ProtoGeometry')
from Autodesk.DesignScript.Geometry import *

# Import DocumentManager
clr.AddReference("RevitServices")
import RevitServices
from RevitServices.Persistence import DocumentManager

# Import RevitAPI
clr.AddReference("RevitAPI")
import Autodesk

# Import ToDSType(bool) extension method
clr.AddReference("RevitNodes")
import Revit
from Autodesk.Revit.DB import *
clr.ImportExtensions(Revit.Elements)

import System

#The inputs to this node will be stored as a list in the IN variable.
doc = DocumentManager.Instance.CurrentDBDocument
uiapp = DocumentManager.Instance.CurrentUIApplication
app = uiapp.Application

#create workset collector
userCategories = doc.Settings.Categories
#extract workset's name and ids
ids = []
for i in userCategories:
	try:
		ids.append(i.Id.IntegerValue)
	except:
		ids.append(0)
#Assign your output to the OUT variable
builtInNames = []
for x in ids:
	try:
		builtInNames.append(System.Enum.ToObject(BuiltInCategory, x))
	except:
		pass

listed = []
for z in builtInNames:
	try:
		listed.append(FilteredElementCollector(doc).WhereElementIsNotElementType().OfCategory(z).ToElements())
	except:
		pass
	
OUT = listed, builtInNames
# ----------------------------------------
watch = Watch(python_script)
code_block = CodeBlock { 0; }
getItemAtIndex = List.GetItemAtIndex(list=watch, index=code_block)
watch_2 = Watch(getItemAtIndex)
flatten = Flatten(watch_2)
bv_remove_nulls = Custom[bv Remove Nulls](List=flatten)  # forked from Lunchbox
elements = Output(bv_remove_nulls)
listed = Output(watch_2)
code_block_2 = CodeBlock { 1; }
getItemAtIndex_2 = List.GetItemAtIndex(list=watch, index=code_block_2)
flat_list_to_list_of_strings = Custom[Flat List to List of Strings](Original_List=getItemAtIndex_2)  # using python methods
convert_builtin_category_name_to = Custom[Convert Builtin Category Name to Normal Name](builtInNameStrings=flat_list_to_list_of_strings)
categoryName = Output(convert_builtin_category_name_to)
