# Dynamo custom node Compare Two Columns From Excel and Report Differences.dyf (Dynamo 1.0.0.1180)
# category: Bakery.Office.Excel

excelFileToRead = Input()
fromPath = FileObject(excelFileToRead)  # "File.FromPath"
sheetOneName = Input()
code_block = CodeBlock { true; }
readFromFile = Excel.ReadFromFile(file=fromPath, sheetName=sheetOneName, readAsStrings=code_block)
sheetOneColIndex = Input()
getItemAtIndex = List.GetItemAtIndex(index=sheetOneColIndex)
map = List.Map(list=readFromFile, f_x=getItemAtIndex)
flat_list_to_list_of_strings = Custom[Flat List to List of Strings](Original_List=map)  # using python methods
sheetTwoName = Input()
code_block_2 = CodeBlock { true; }
readFromFile_2 = Excel.ReadFromFile(file=fromPath, sheetName=sheetTwoName, readAsStrings=code_block_2)
sheetTwoColIndex = Input()
getItemAtIndex_2 = List.GetItemAtIndex(index=sheetTwoColIndex)
map_2 = List.Map(list=readFromFile_2, f_x=getItemAtIndex_2)
flat_list_to_list_of_strings_2 = Custom[Flat List to List of Strings](Original_List=map_2)
compare_two_lists_by_item_and = Custom[Compare Two Lists by Item and Return Item Differences](listONE=flat_list_to_list_of_strings, listTWO=flat_list_to_list_of_strings_2)
inSheetTwoButNotInOne = Output(compare_two_lists_by_item_and.inListTWObutNotInListOne)
inSheetOneButNotInTwo = Output(compare_two_lists_by_item_and.inListONEbutNotInListTwo)
