# Dynamo custom node Convert String with Line Breaks into List of Strings.dyf (Dynamo 1.3.4.6666)
# category: Bakery.Core.String

string = Input()
string_2 = StringInput("\n")
split = String.Split(string, string_2)
ListOfStrings = Output(split)
