# Dynamo custom node Copy File to Directory.dyf (Dynamo 1.3.4.6666)
# category: Bakery.Core.Directory

filePath = Input()
targetDirString = Input()
go = Input()

# group: copy the version file
fromPath = FileObject(filePath)  # "File.FromPath"
string = StringInput("\")
fileName = FilePath.FileName(filePath, go)
join = String.Join(string, targetDirString, fileName)
copy = File.Copy(fromPath, join, go)

void = Output(copy)
