# Dynamo custom node Create Insulation by View and Link and Element.dyf (Dynamo 1.3.3.4651)
# category: Bakery.Geometry
# this is a subnode for multiple object selection

oneElement = Input()
watch = Watch(oneElement)
turnIntoList = Custom[TurnIntoList](unknownItem=watch)  # Turns an element (or a nested list) into a flat list
count = Count(turnIntoList)
code_block = CodeBlock(x=count) { 0..x; }
viewThatShowsElements = Input(viewThatShowsElements : var[]..[])
tempDirectory = Input(tempDirectory : var[]..[])
make_geometry_from_elements_via = Custom[Make Geometry from Elements via SAT](elements=watch, viewThatShowsElements=viewThatShowsElements, tempDirectory=tempDirectory)
watch_2 = Watch(make_geometry_from_elements_via.geoms)
flatten = Flatten(watch_2)
firstItem = List.FirstItem(flatten)
elements = Input(elements : var[]..[])
make_geometry_from_elements_via_2 = Custom[Make Geometry from Elements via SAT](elements=elements, viewThatShowsElements=viewThatShowsElements, tempDirectory=tempDirectory)
watch_3 = Watch(make_geometry_from_elements_via_2.geoms)
flatten_2 = Flatten(watch_3)
intersect = Geometry.Intersect(geometry=firstItem, other=flatten_2)
flatten_3 = Flatten(intersect)
faces = Topology.Faces(flatten_3)
surfaceGeometry = Face.SurfaceGeometry(faces)
filterByOrientation = Custom[Surface.FilterByOrientation](surfaces=surfaceGeometry)  # Sorts surfaces in three lists based on their orientation (vertical, horizontal up & horizontal down) and also returns three corresponding lists of booleans.
watch_4 = Watch(filterByOrientation.vertical)
watch_5 = Watch(filterByOrientation.horizontalDown)
name = Input(name : string)
byName = Material.ByName(name)
make_insulation_direct_shapes = Custom[Make Insulation Direct Shapes](boundaryFloors=turnIntoList, surfaceVerticals=watch_4, surfaceLower=watch_5, material=byName)  # make insulation node; unwired: counter
map = List.Map(list=code_block, f_x=make_insulation_direct_shapes)
directShapes = Output(map)
eraser = Custom[Tool.Eraser](List=make_geometry_from_elements_via_2.viewsCreated)  # Try to delete any element from project
eraser_2 = Custom[Tool.Eraser](List=make_geometry_from_elements_via.viewsCreated)
