# Dynamo custom node Create Plan View for Room v1.dyf (Dynamo 0.8.2.2371)
# category: Bakery.Revit.Views
# originally from Brian Myers. Doesn't work yet.

roomList = Input()
name_prefix = Input()
offset = Input()
boolean = BoolSelector(true)
create_plan_views = Python(IN[0]=roomList, IN[1]=name_prefix, IN[2]=offset, IN[3]=boolean)
# ---------- create_plan_views.python (94 lines) ----------
#Copyright(c) 2015, Konrad K Sobon
# @arch_laboratory, http://archi-lab.net

import clr
clr.AddReference('ProtoGeometry')
from Autodesk.DesignScript.Geometry import *

# Import DocumentManager and TransactionManager
clr.AddReference("RevitServices")
import RevitServices
from RevitServices.Persistence import DocumentManager
from RevitServices.Transactions import TransactionManager

doc = DocumentManager.Instance.CurrentDBDocument
uiapp = DocumentManager.Instance.CurrentUIApplication
app = uiapp.Application

# Import ToDSType(bool) extension method
clr.AddReference("RevitNodes")
import Revit
clr.ImportExtensions(Revit.Elements)

# Import RevitAPI
clr.AddReference("RevitAPI")
import Autodesk
from Autodesk.Revit.DB import *

#The inputs to this node will be stored as a list in the IN variable.
dataEnteringNode = IN

rooms = UnwrapElement(IN[0])
namePrefix = IN[1]
bboxOffset = IN[2]
runMe = IN[3]

def OffsetBBox(bbox, offset):
	bboxMinX = bbox.Min.X - offset
	bboxMinY = bbox.Min.Y - offset
	bboxMinZ = bbox.Min.Z - offset
	bboxMaxX = bbox.Max.X + offset
	bboxMaxY = bbox.Max.Y + offset
	bboxMaxZ = bbox.Max.Z + offset
	newBbox = BoundingBoxXYZ()
	newBbox.Min = XYZ(bboxMinX, bboxMinY, bboxMinZ)
	newBbox.Max = XYZ(bboxMaxX, bboxMaxY, bboxMaxZ)
	return newBbox

if runMe:
	viewTypes = FilteredElementCollector(doc).OfClass(ViewFamilyType)
	for i in viewTypes:
		if i.ViewFamily == ViewFamily.FloorPlan:
			viewTypeId = i.Id
			break
		else:
			continue
	existingPlans = FilteredElementCollector(doc).OfClass(View).ToElements()
	existingPlanNames, existingPlanElements = [], []
	for i in existingPlans:
		if not i.IsTemplate:
			if i.ViewType == ViewType.FloorPlan:
				existingPlanNames.append(i.ToDSType(True).Name)
				existingPlanElements.append(i)
				
	# Start Transaction
	doc = DocumentManager.Instance.CurrentDBDocument
	TransactionManager.Instance.EnsureInTransaction(doc)
	
	floorPlans = []
	for i in rooms:
		levelId = i.LevelId
		bbox = i.BoundingBox[doc.ActiveView]
		newBbox = OffsetBBox(bbox, bboxOffset)
		viewName = namePrefix + "-" + i.get_Parameter("Number").AsString() + "-" + i.get_Parameter("Name").AsString()
		if viewName in existingPlanNames:
			view = existingPlanElements[existingPlanNames.index(viewName)]
			view.CropBox = newBbox
			view.CropBoxActive = True
			view.CropBoxVisible = False
			floorPlans.append(view)
		else:
			view = ViewPlan.Create(doc, viewTypeId, levelId)
			view.ViewName = viewName
			view.CropBox = newBbox
			view.CropBoxActive = True
			view.CropBoxVisible = False
			floorPlans.append(view)

	# End Transaction
	TransactionManager.Instance.TransactionTaskDone()
else:
	floorPlans = "Run Me set to False"

#Assign your output to the OUT variable
OUT = floorPlans
# ----------------------------------------
views = Output(create_plan_views)
