# Dynamo custom node Document Design Option Sets.dyf (Dynamo 0.8.2.2371)
# category: Bakery.Revit.Document
# taken originally from Clockwork

DesignOption_s = Input()  # "DesignOption(s)"
turn_into_list = Custom[Turn Into List](item=DesignOption_s)  # Turns an element (or a nested list) into a flat list
python_script = Python(IN[0]=turn_into_list)
# ---------- python_script.python (14 lines) ----------
import clr
clr.AddReference('RevitAPI')
from Autodesk.Revit.DB import *

clr.AddReference("RevitServices")
import RevitServices
from RevitServices.Persistence import DocumentManager

doc = DocumentManager.Instance.CurrentDBDocument
desopts = UnwrapElement(IN[0])
elementlist = list()
for item in desopts:
	elementlist.append(doc.GetElement(item.get_Parameter(BuiltInParameter.OPTION_SET_ID).AsElementId()))
OUT = elementlist
# ----------------------------------------
DesignOptionSet_s = Output(python_script)  # "DesignOptionSet(s)"
