# Dynamo custom node Dynamo Lesson 1.dyf (Dynamo 1.3.0.875)
# category: Bakery.Dynamo.Training

string = StringInput("""Welcome to Dynamo! 
1) Switch to Manual
2) Press Run to continue...""")
Instructions = Output(string)
string_2 = StringInput("C:\tempDyn\Lesson.file")
code_block = CodeBlock { 1; }
turnIntoList = Custom[TurnIntoList](unknownItem=code_block)  # Turns an element (or a nested list) into a flat list
writeToFile = CSV.WriteToFile(string_2, turnIntoList)
Completed_Steps = Output(writeToFile)
file_path = Filename("C:\tempDynamoLesson.file")
