# Dynamo custom node ElementFingerprintFM.dyf (Dynamo 1.2.1.3083)
# category: Bakery.Data.Database

code_block = CodeBlock { {"RvtGuid","RvtFileName","RvtKeynote","RvtElementId","RvtCategory","RvtFamilyName","RvtTypeName","RvtAssetCode","RvtDesignationCode","RvtCrawlKey"}; }
columnNameList = Output(code_block)
oneElement = Input()
watch = Watch(oneElement)
element_ids = Custom[Element Ids](Element_s=watch)  # This node will query an element id that can be used with Revit nodes. Dynamo Element Id node returns integer value.
firstItem = List.FirstItem(element_ids.GUID_s)
watch_2 = Watch(firstItem)
linked_elements_revit_file_name = Custom[Linked Elements Revit File Name](item=watch)
watch_3 = Watch(linked_elements_revit_file_name)
type = Custom[Element.Type](element=watch)  # Gets the family type of a given element (if applicable).
string = StringInput("Keynote")
getParameterValueByName = Element.GetParameterValueByName(element=type, parameterName=string)
clean_string_for_mysql = Custom[Clean String for mysql](str=getParameterValueByName)
firstItem_2 = List.FirstItem(element_ids.Rvt_ElementId_s)
watch_4 = Watch(firstItem_2)
category = Custom[Element.Category](element=watch)  # This node will get the input element(s)' categories
watch_5 = Watch(category)
get_family_from_element = Custom[Get Family from Element](oneElement=watch)  # NOT WORKING
name = Custom[Element.Name (Universal)](element=get_family_from_element)  # "Element.Name+"; Gets an element's name (Dynamo's built-in Name nodes don't work for all element types, e.g. worksets...)
watch_6 = Watch(name)
clean_string_for_mysql_2 = Custom[Clean String for mysql](str=watch_6)
name_2 = Custom[Element.Name (Universal)](element=type)  # "Element.Name+"
watch_7 = Watch(name_2)
clean_string_for_mysql_3 = Custom[Clean String for mysql](str=watch_7)
string_2 = StringInput("Asset Code")
getParameterValueByName_2 = Element.GetParameterValueByName(element=watch, parameterName=string_2)
string_3 = StringInput("Designation Code")
getParameterValueByName_3 = Element.GetParameterValueByName(element=type, parameterName=string_3)
crawlkey = Input()
create = List.Create(watch_2, watch_3, clean_string_for_mysql, watch_4, watch_5, clean_string_for_mysql_2, clean_string_for_mysql_3, getParameterValueByName_2, getParameterValueByName_3, crawlkey)
valueList = Output(create)
flat_list_to_list_of_strings = Custom[Flat List to List of Strings](Original_List=create)  # using python methods
valueListAsStrs = Output(flat_list_to_list_of_strings)
