# Dynamo custom node Flex Duct Geometry Check.dyf (Dynamo 0.8.2.2371)
# category: Bakery.Revit.API.MEP

one_flex_element = Input()
watch = Watch(one_flex_element)
string = StringInput("Length")
getParameterValueByName = Element.GetParameterValueByName(element=watch, parameterName=string)
PI = Math.PI()
string_2 = StringInput("Equivalent Diameter")
bruteforce_get_parameter_via = Custom[Bruteforce Get Parameter via String Split V2](element=watch, parameterName=string_2, replaceEmptyWithString=string_2)  # BETTER
firstItem = List.FirstItem(bruteforce_get_parameter_via)
toNumber = String.ToNumber(firstItem)
code_block = CodeBlock(x=toNumber) { x/2; }
code_block_2 = CodeBlock(z=code_block, k=code_block) { z*k; }
code_block_3 = CodeBlock(p=PI, t=code_block_2) { p*t; }
code_block_4 = CodeBlock(x=getParameterValueByName, y=code_block_3) { x*y; }

# group: SHOULD BE
watch_2 = Watch(code_block_4)

geometry = Element.Geometry(watch)
flatten = Flatten(geometry)
firstItem_2 = List.FirstItem(flatten)
volume = Solid.Volume(firstItem_2)

# group: CURRENT GEOM
watch_3 = Watch(volume)

code_block_5 = CodeBlock(t=watch_2, u=watch_3) { t-u; }
watch_4 = Watch(code_block_5)
code_block_6 = CodeBlock(i=watch_4, r=watch_2) { i/r; }
watch_5 = Watch(code_block_6)
code_block_7 = CodeBlock { 0.01; }
lt = watch_5 < code_block_7
vol_within_one_percent = Output(lt)
watch_6 = Watch(bruteforce_get_parameter_via)
watch_7 = Watch(geometry)
