# Dynamo custom node Get Active Project Place Name.dyf (Dynamo 0.9.1.4062)
# category: Bakery.Revit.Document
# from city list etc

python_script = Python()
# ---------- python_script.python (7 lines) ----------
import clr
clr.AddReference("RevitServices")
import RevitServices
from RevitServices.Persistence import DocumentManager

doc = DocumentManager.Instance.CurrentDBDocument
OUT = doc.ProjectLocationSet.Name
# ----------------------------------------
param = Output(python_script)
