# Dynamo custom node Get All Elevations View Name and Sheet Number for Document.dyf (Dynamo 0.8.2.2371)
# category: Bakery.Revit.Views

DOC = Input(DOC : var[]..[])
super_collect_views_from = Custom[Super Collect Views from Document](DOC=DOC)
code_block = CodeBlock { "Sheet Number"; }
getParameterValueByName = Element.GetParameterValueByName(element=super_collect_views_from.Elevations, parameterName=code_block)
element_name_universal = Custom[Element.Name (Universal)](element=super_collect_views_from.Elevations)  # Gets an element's name (Dynamo's built-in Name nodes don't work for all element types, e.g. worksets...)
create = List.Create(getParameterValueByName, element_name_universal)
list = Output(create)
