# Dynamo custom node Get All Revisions.dyf (Dynamo 0.8.2.2371)
# category: Bakery.Revit.Document
# using python api, get IDs of Revisions

python_script = Python()
# ---------- python_script.python (14 lines) ----------
import clr
clr.AddReference('RevitAPI')
from Autodesk.Revit.DB import *

clr.AddReference("RevitNodes")
import Revit
clr.ImportExtensions(Revit.Elements)

clr.AddReference("RevitServices")
import RevitServices
from RevitServices.Persistence import DocumentManager

doc = DocumentManager.Instance.CurrentDBDocument
OUT = Revision.GetAllRevisionIds(doc)
# ----------------------------------------
RevisionIds = Output(python_script)
get_worksets = Custom[Get Worksets]()  # Retrieves user worksets from specified document
