# Dynamo custom node Get Design Option Element by Set Name and Option Name.dyf (Dynamo 0.8.2.2392)
# category: Bakery.Revit.Document

document_design_options = Custom[Document Design Options]()  # taken originally from Clockwork
flatten = Flatten(document_design_options.DesignOptions)
design_option_and_design = Custom[Design Option and Design OptionSet](DesignOption_s=document_design_options.DesignOptions)  # taken originally from Clockwork
element_name_universal = Custom[Element Name Universal](Element_s=design_option_and_design)  # Modified for 0.8.1
DesignOptionSetName = Input()
contains = String.Contains(str=element_name_universal, searchFor=DesignOptionSetName)
filterByBoolMask = List.FilterByBoolMask(list=flatten, mask=contains)
DesignOptionName = Input()
turn_into_list = Custom[Turn Into List](item=DesignOptionName)  # Turns an element into a list
element_name_universal_2 = Custom[Element Name Universal](Element_s=filterByBoolMask.in)
bv_if_equal_return_index = Custom[bv If Equal Return Index](listA=turn_into_list, listB=element_name_universal_2)  # forked
getItemAtIndex = List.GetItemAtIndex(list=filterByBoolMask.in, index=bv_if_equal_return_index)
firstItem = List.FirstItem(getItemAtIndex)
item = Output(firstItem)
