# Dynamo custom node Get Family from Element.dyf (Dynamo 1.2.1.3083)
# category: Bakery.Revit.Elements.Family
# working now

oneElement = Input()
type = FamilyInstance.Type(oneElement)
family = FamilyType.Family(type)
FamilyObject = Output(family)
