# Dynamo custom node Get Indices Where Sublists Contain Item.dyf (Dynamo 1.3.0.875)
# category: Bakery.Core.List

listWithSublists = Input()
itemToFindInSublist = Input()
allIndicesOf = List.AllIndicesOf(list=listWithSublists@L2, item=itemToFindInSublist)
count = Count(allIndicesOf@L2)
code_block = CodeBlock { 0; }
gt = count > code_block
code_block_2 = CodeBlock { true; }
allIndicesOf_2 = List.AllIndicesOf(list=gt, item=code_block_2)
indicesOfSublists = Output(allIndicesOf_2)
