# Dynamo custom node Get Linked Element by Link Name Search and Element GUID.dyf (Dynamo 0.8.2.2371)
# category: Bakery.Revit.Document.Links

one_GUID_string = Input()
search_link_names_for = Input()
search_link_names_and_send = Custom[Search Link Names and Send Instance Ids to Clipboard](searchFor=search_link_names_for)
firstItem = List.FirstItem(search_link_names_and_send.id_List)
get_link_document_from_link = Custom[Get Link Document from Link Instance Id](index0=firstItem)
get_linked_element_from_element = Custom[Get Linked Element from Element Id and Doc](one_GUID_string=one_GUID_string, one_Doc_internal_element=get_link_document_from_link)
element = Output(get_linked_element_from_element)
