# Dynamo custom node Get Linked RVT Documents.dyf (Dynamo 1.2.1.3083)
# category: Bakery.Revit.Document.Links

empty = List.Empty()
python_script = Python(IN[0]=empty)
# ---------- python_script.python (44 lines) ----------
#Copyright(c) 2015, Konrad K Sobon
# @arch_laboratory, http://archi-lab.net

import clr
clr.AddReference('ProtoGeometry')
from Autodesk.DesignScript.Geometry import *

# Import DocumentManager and TransactionManager
clr.AddReference("RevitServices")
import RevitServices
from RevitServices.Persistence import DocumentManager
from RevitServices.Transactions import TransactionManager

from System.Collections.Generic import *

# Import RevitAPI
clr.AddReference("RevitAPI")
import Autodesk
from Autodesk.Revit.DB import *
from Autodesk.Revit.DB.Analysis import *

doc = DocumentManager.Instance.CurrentDBDocument
uiapp = DocumentManager.Instance.CurrentUIApplication
app = uiapp.Application

# Import ToDSType(bool) extension method
clr.AddReference("RevitNodes")
import Revit
clr.ImportExtensions(Revit.Elements)

#The inputs to this node will be stored as a list in the IN variable.
dataEnteringNode = IN

collector = Autodesk.Revit.DB.FilteredElementCollector(doc)
linkInstances = collector.OfClass(Autodesk.Revit.DB.RevitLinkInstance)

linkDoc, linkName, linkInstId, linktype = [], [], [], []
for i in linkInstances:
	linkDoc.append(i.GetLinkDocument())
	linkName.append(i.Name)
	linkInstId.append(i.Id)
	linktype.append(i.GetTypeId())

OUT = linkDoc, linkName, linkInstances, linkInstId, linktype
# ----------------------------------------
number = DoubleInput(0)
getItemAtIndex = List.GetItemAtIndex(list=python_script, index=number)
Link_Doc = Output(getItemAtIndex)
number_2 = DoubleInput(1)
getItemAtIndex_2 = List.GetItemAtIndex(list=python_script, index=number_2)
Link_Name = Output(getItemAtIndex_2)
number_3 = DoubleInput(2)
getItemAtIndex_3 = List.GetItemAtIndex(list=python_script, index=number_3)
Link_Instance = Output(getItemAtIndex_3)
number_4 = DoubleInput(3)
getItemAtIndex_4 = List.GetItemAtIndex(list=python_script, index=number_4)
Link_Instance_Id = Output(getItemAtIndex_4)
number_5 = DoubleInput(4)
getItemAtIndex_5 = List.GetItemAtIndex(list=python_script, index=number_5)
LinkType = Output(getItemAtIndex_5)
