# Dynamo custom node Get Matching Tag Info from single BCF file.dyf (Dynamo 0.8.2.2371)
# category: Bakery.BIM.BCF

path = Input()
read_file_path_to_elementtree = Custom[Read File Path to ElementTree with UTF8 roundtrip](filePath=path)  # to clean unsupported characters...
XPATH = Input()
xpath_expression_find_for = Custom[XPATH Expression Find for Element Tree](ElementTree=read_file_path_to_elementtree, XPATH=XPATH)
matching_texts = Output(xpath_expression_find_for.text)
