# Dynamo custom node Get Points from Connector Sublists.dyf (Dynamo 1.2.1.3083)
# category: Bakery.Revit.API.MEP

connectorList = Input(connectorList : var[]..[])
mappingIndexValue = Input()
getItemAtIndex = List.GetItemAtIndex(list=connectorList, index=mappingIndexValue)
code_block = CodeBlock { 0; }
getItemAtIndex_2 = List.GetItemAtIndex(list=getItemAtIndex, index=code_block)
get_connector_coordinatesystem = Custom[Get Connector.CoordinateSystem](connectors=getItemAtIndex_2)
firstRevitCoordinateSystem = Output(get_connector_coordinatesystem)
get_connector_origin = Custom[Get Connector.Origin](connectors=getItemAtIndex_2)

# group: scale
code_block_2 = CodeBlock { 1/304.8; }

comma_separated_point_value_to = Custom[Comma Separated Point Value to Point Object](obj=get_connector_origin, scale=code_block_2)
firstPoint = Output(comma_separated_point_value_to)
turnIntoList = Custom[TurnIntoList](unknownItem=getItemAtIndex)  # Turns an element (or a nested list) into a flat list
count = Count(turnIntoList)
code_block_3 = CodeBlock(x=count) { x-1; }
getItemAtIndex_3 = List.GetItemAtIndex(list=getItemAtIndex, index=code_block_3)
get_connector_coordinatesystem_2 = Custom[Get Connector.CoordinateSystem](connectors=getItemAtIndex_3)
lastRevitCoordinateSystem = Output(get_connector_coordinatesystem_2)
get_connector_origin_2 = Custom[Get Connector.Origin](connectors=getItemAtIndex_3)
comma_separated_point_value_to_2 = Custom[Comma Separated Point Value to Point Object](obj=get_connector_origin_2, scale=code_block_2)
lastPoint = Output(comma_separated_point_value_to_2)
