# Dynamo custom node Get Sublist and Make Curve.dyf (Dynamo 1.2.0.2690)
# category: Bakery.Geometry

list = Input(list : var[]..[])
index = Input(index : int)
getItemAtIndex = List.GetItemAtIndex(list=list, index=index)
any_null_in_list = Custom[Any Null in List](list=getItemAtIndex)  # returns boolean true if a null is found
item = Output(any_null_in_list)
removeNulls = Lists.Manage.RemoveNulls(getItemAtIndex)
byPoints = NurbsCurve.ByPoints(removeNulls)
NurbsCurve = Output(byPoints)
