# Dynamo custom node Get System Type List by Category Name.dyf (Dynamo 1.2.0.2690)
# category: Bakery.Revit.Elements.Family
# takes category name as string

get_type_list_for_this_project = Custom[Get Type List for this project]()
watch = Watch(get_type_list_for_this_project.System_Types)
bv_get_category_name = Custom[bv Get Category Name](Elements=watch)  # forked from Blackbox
categoryName = Input()
eq = bv_get_category_name == categoryName
filterByBoolMask = List.FilterByBoolMask(list=watch, mask=eq)
Types = Output(filterByBoolMask.in)
