# Dynamo custom node Get Text by View Workset and Value.dyf (Dynamo 1.2.1.3083)
# category: Bakery.Revit.Elements.Text
# model must be workshared

code_block = CodeBlock { "Text Notes"; }
turnIntoList = Custom[Turn Into List](unknownItem=code_block)  # Turns an element into a (flat) list
collect_elements_from_list_of = Custom[Collect Elements from List of Category Names](categoryNameList=turnIntoList)
workset = Custom[Element.Workset](element=collect_elements_from_list_of.elements)  # Retrieves the workset of a given element
element_name_universal = Custom[Element Name Universal](Elements=workset)  # Modified for 0.8.1
search_view_names = Input()
contains = String.Contains(str=element_name_universal, searchFor=search_view_names)
filterByBoolMask = List.FilterByBoolMask(list=collect_elements_from_list_of.elements, mask=contains)
watch = Watch(filterByBoolMask.in)
text = Custom[TextElement.Text](element=watch)  # Gets the text stored in a text element (i.e. text node or model text)
search_text_values = Input()
contains_2 = String.Contains(str=text, searchFor=search_text_values)
filterByBoolMask_2 = List.FilterByBoolMask(list=watch, mask=contains_2)
in_ = Output(filterByBoolMask_2.in)  # "in"
