# Dynamo custom node Get Two Parameters and Join to One String.dyf (Dynamo 0.8.2.2392)
# category: Bakery.Revit.Parameters
# uses getparameter node to get two values and return one string. Use with List.Map for list of elements.

separator = Input()
parameterOne = Input()
element = Input()
bv_get_parameter_value_from_type = Custom[bv Get Parameter value from Type or Instance](element=parameterOne, parameterName=element)  # forked from Rhythm
string_from_object = FromObject(bv_get_parameter_value_from_type)
parameterTwo = Input()
bv_get_parameter_value_from_type_2 = Custom[bv Get Parameter value from Type or Instance](element=element, parameterName=parameterTwo)
string_from_object_2 = FromObject(bv_get_parameter_value_from_type_2)
join = String.Join(separator, string_from_object, string_from_object_2)
joinedString = Output(join)
