# Dynamo custom node Get View Dependency as Internal not String.dyf (Dynamo 0.8.2.2371)
# category: Bakery.Revit.Parameters

View_s = Input()  # "View(s)"
turn_into_list = Custom[Turn Into List](item=View_s)  # Turns an element (or a nested list) into a flat list
python_script = Python(IN[0]=turn_into_list)
# ---------- python_script.python (12 lines) ----------
import clr
clr.AddReference('RevitAPI')
from Autodesk.Revit.DB import *

views = UnwrapElement(IN[0])
elementlist = list()
for view in views:
	try:
		elementlist.append(view.Dependency)
	except:
		elementlist.append(list())
OUT = elementlist
# ----------------------------------------
Scale_s_1 = Output(python_script)  # "Scale(s) 1:X"
