# Dynamo custom node Get View Discipline Code By Name.dyf (Dynamo 1.2.0.2690)
# category: Bakery.Revit.Views

enumerate_view_discipline = Custom[Enumerate View Discipline]()
ViewDiscipline = Input()
turnIntoList = Custom[TurnIntoList](unknownItem=ViewDiscipline)  # Turns an element (or a nested list) into a flat list
flat_list_to_list_of_strings = Custom[Flat List to List of Strings](Original_List=enumerate_view_discipline.ViewDiscipline)  # using python methods
if_equal_return_index_using = Custom[If Equal Return Index using IndexOf](searchForThese=turnIntoList, inThisList=flat_list_to_list_of_strings)
getItemAtIndex = List.GetItemAtIndex(list=enumerate_view_discipline.HashCodes, index=if_equal_return_index_using)
firstItem = List.FirstItem(getItemAtIndex)
item = Output(firstItem)
