# Dynamo custom node HostedObject.FacingOrientation.dyf (Dynamo 1.3.4.6666)
# category: Bakery.Dynamo.ForkedNodes
# from old clockwork

instances = Input()
python_script = Python(IN[0]=instances)
# ---------- python_script.python (17 lines) ----------
import clr
clr.AddReference('RevitAPI')
from Autodesk.Revit.DB import *

clr.AddReference("RevitNodes")
import Revit
clr.ImportExtensions(Revit.Elements)
clr.ImportExtensions(Revit.GeometryConversion)

objinstances = UnwrapElement(IN[0])
vectorlist = list()
for item in objinstances:
	try:
		vectorlist.append(item.FacingOrientation.ToVector())
	except:
		vectorlist.append(list())
OUT = vectorlist
# ----------------------------------------
vectorlist = Output(python_script)
