# Dynamo custom node List All Views.dyf (Dynamo 1.2.0.2690)
# category: Bakery.Revit.Views
# not including sheets

get_all_views = Custom[Get All Views]()  # This node will query all views in the model and return them based on category
create = List.Create(get_all_views.Renderings)
create_2 = List.Create(get_all_views.Pressure_Loss_Reports)
create_3 = List.Create(get_all_views.Panel_Schedules)
create_4 = List.Create(get_all_views.Walkthroughs)
create_5 = List.Create(get_all_views.Elevations)
create_6 = List.Create(get_all_views.Drafting_Views)
create_7 = List.Create(get_all_views.Undefined_Views)
create_8 = List.Create(get_all_views.Details)
create_9 = List.Create(get_all_views.Loads_Reports)
create_10 = List.Create(get_all_views.Cost_Reports)
create_11 = List.Create(get_all_views.Legends)
create_12 = List.Create(get_all_views.3D_Views)
create_13 = List.Create(get_all_views.Column_Schedules)
create_14 = List.Create(get_all_views.Internal_Views)
create_15 = List.Create(get_all_views.Sections)
create_16 = List.Create(get_all_views.Ceiling_Plans)
create_17 = List.Create(get_all_views.Floor_Plans)
create_18 = List.Create(get_all_views.Schedules)
create_19 = List.Create(get_all_views.Area_Plans)
create_20 = List.Create(get_all_views.Engineering_Plans)
create_21 = List.Create(get_all_views.Reports)
create_22 = List.Create(create, create_2, create_3, create_4, create_5, create_6, create_7, create_8, create_9, create_10, create_11, create_12, create_13, create_14, create_15, create_16, create_17, create_18, create_19, create_20, create_21)
flatten = Flatten(create_22)
bv_remove_nulls = Custom[bv Remove Nulls](List=flatten)  # forked from Lunchbox
AllViews = Output(bv_remove_nulls)
