# Dynamo custom node List Import Information.dyf (Dynamo 0.9.1.4062)
# category: Bakery.Revit.Document.Imports
# shows Element ID, import name and Workset

string = StringInput("Category")
string_2 = StringInput("Workset")
code_block = CodeBlock { true; }
linksAndImports = Custom[Document.LinksAndImports](toggle=code_block)  # Gets all linked and imported files in the document
bruteforce_get_elem_id_and_two = Custom[Bruteforce Get Elem ID and Two Parameters and Make List of Strings](parameterOne=string, parameterTwo=string_2, elementList=linksAndImports.imports)  # takes list of elements
importInformation = Output(bruteforce_get_elem_id_and_two)
