# Dynamo custom node List Views not on Sheets.dyf (Dynamo 0.9.1.4062)
# category: Bakery.Revit.Views
# also give Views On Sheets as other output

view_statistics = Custom[View Statistics]()  # some key view details
watch = Watch(view_statistics.List_of_Views_as_Elements)
code_block = CodeBlock { "Sheet Number"; }
getParameterValueByName = Element.GetParameterValueByName(element=watch, parameterName=code_block)
code_block_2 = CodeBlock { "---"; }
eq = getParameterValueByName == code_block_2
filterByBoolMask = List.FilterByBoolMask(list=watch, mask=eq)
watch_2 = Watch(filterByBoolMask.in)
element_name_universal = Custom[Element.Name (Universal)](element=watch_2)  # Gets an element's name (Dynamo's built-in Name nodes don't work for all element types, e.g. worksets...)
id = Element.Id(watch_2)
flat_list_to_list_of_strings = Custom[Flat List to List of Strings](Original_List=id)  # using python methods
create = List.Create(element_name_universal, flat_list_to_list_of_strings)
transpose = List.Transpose(create)
string_from_array = FromArray()
map = List.Map(list=transpose, f_x=string_from_array)
flatten = Flatten(map)
View_Id = Output(flatten)  # "View,Id"
remove_list_from_list_by_item = Custom[Remove List from List by Item not Value](ListOfItemsToRemove=watch_2, ListToRemoveFrom=watch)  # remove the items in ListA from the items in ListB and return whats left
ViewsOnSheetsAsElements = Output(remove_list_from_list_by_item.reducedList)
