# Dynamo custom node List of Model Elements simplified with Annotation removed.dyf (Dynamo 1.0.0.1180)
# category: Bakery.Revit.Selection
# also reports categories included and excluded. Only works on Workshared models...

list_of_model_elements = Custom[List of Model Elements simplified]()  # uses familyinstance select now
Original_Element_List = Output(list_of_model_elements.Element_List)
filter_family_instances_by_view = Custom[Filter Family Instances by View Specific Property](familyInstances=list_of_model_elements.Element_List)
Element_List_without_Annotation = Output(filter_family_instances_by_view.nonViewSpecific)
get_categories_from_elements = Custom[Get Categories from Elements](Elements=filter_family_instances_by_view.nonViewSpecific)  # designed to use document category list
Categories_kept = Output(get_categories_from_elements.CategoriesPresent)
get_categories_from_elements_2 = Custom[Get Categories from Elements](Elements=filter_family_instances_by_view.isViewSpecific)
Categories_removed = Output(get_categories_from_elements_2.CategoriesPresent)
