# Dynamo custom node One Crawl Package Sent To mysql.dyf (Dynamo 1.2.1.3083)
# category: Bakery.Data.Database

rvtFileName = Input()
watch = Watch(rvtFileName)
ChoppedElementList = Input()
watch_2 = Watch(ChoppedElementList)
counter = Input()
getItemAtIndex = List.GetItemAtIndex(list=watch_2, index=counter)
count = Count(getItemAtIndex)
turnIntoList = Custom[TurnIntoList](unknownItem=counter)  # Turns an element (or a nested list) into a flat list
uuid_guid_generator_for_lists = Custom[UUID GUID Generator for Lists](list=turnIntoList)  # just makes a new GUID for every item in a list, has no relationship to item or element itself
firstItem = List.FirstItem(uuid_guid_generator_for_lists.uuids)
watch_3 = Watch(firstItem)
startCrawlNote = Input()
watch_4 = Watch(startCrawlNote)
databaseName = Input()
watch_5 = Watch(databaseName)
logTableName = Input()
watch_6 = Watch(logTableName)
connectionString = Input()
watch_7 = Watch(connectionString)
log_database_crawl = Custom[Log Database Crawl](RvtFileName=watch, RvtElementCount=count, RvtCrawlKey=watch_3, RvtCrawlNote=watch_4, dbName=watch_5, tableName=watch_6, ConnectionString=watch_7, RvtListInt=counter)
switch = Custom[Switch](boolean_switch=log_database_crawl, data=getItemAtIndex)
flatten = Flatten(switch)
watch_8 = Watch(flatten)
elementTableName = Input()
watch_9 = Watch(elementTableName)
mysql_send_element_fingerprint = Custom[mysql Send Element Fingerprint to Db](dbName=watch_5, tableName=watch_9, ConnectionString=watch_7, crawlKey=watch_3)  # unwired: oneElement
map = List.Map(list=watch_8, f_x=mysql_send_element_fingerprint)
flatten_2 = Flatten(map)
countTrue = CountTrue(flatten_2)
endCrawlNote = Input()
watch_10 = Watch(endCrawlNote)
log_database_crawl_2 = Custom[Log Database Crawl](RvtFileName=watch, RvtElementCount=countTrue, RvtCrawlKey=watch_3, RvtCrawlNote=watch_10, dbName=watch_5, tableName=watch_6, ConnectionString=watch_7, RvtListInt=counter)
packageSuccess = Output(log_database_crawl_2)
