# Dynamo custom node Reload Revit Links by Instance.dyf (Dynamo 1.2.1.3083)
# category: Bakery.Revit.Document.Links

link_instances = Input()
turnIntoList = Custom[TurnIntoList](unknownItem=link_instances)  # Turns an element (or a nested list) into a flat list
python_script = Python(IN[0]=turnIntoList)
# ---------- python_script.python (39 lines) ----------
#python nodes in dynamo 1.0.0
#created by Nicklas Østertgaard  nvo@bimshark.com / nvo@shl.fk
import clr
clr.AddReference('ProtoGeometry')
from Autodesk.DesignScript.Geometry import *
# Import ToDSType(bool) extension method
clr.AddReference("RevitNodes")
import Revit
clr.ImportExtensions(Revit.Elements)
# Import geometry conversion extension methods
clr.ImportExtensions(Revit.GeometryConversion)
# Import DocumentManager and TransactionManager
clr.AddReference("RevitServices")
import RevitServices
from RevitServices.Persistence import DocumentManager
from RevitServices.Transactions import TransactionManager
from System.Collections.Generic import *
# Import RevitAPI
clr.AddReference("RevitAPI")
import Autodesk
from Autodesk.Revit.DB import *
doc = DocumentManager.Instance.CurrentDBDocument
uiapp = DocumentManager.Instance.CurrentUIApplication
app = uiapp.Application
uidoc=DocumentManager.Instance.CurrentUIApplication.ActiveUIDocument
collector = Autodesk.Revit.DB.FilteredElementCollector(doc)
#linkInstances = collector.OfClass(Autodesk.Revit.DB.RevitLinkInstance)
linkInstances = IN[0]
successlist = []

for i in linkInstances:
	RevitLinkType  = doc.GetElement(i.GetTypeId())
	try:
		RevitLinkType.Load();
		successlist.append(i)
	except:
		successlist.append("Failure")

OUT= successlist
# ----------------------------------------
instanceOrFail = Output(python_script)
