# Dynamo custom node Remove Character from List of Strings.dyf (Dynamo 1.2.1.3083)
# category: Bakery.Core.String

listOfStrings = Input()
charToRemove = Input()
python_script = Python(IN[0]=listOfStrings, IN[1]=charToRemove)
# ---------- python_script.python (14 lines) ----------
import clr
clr.AddReference('ProtoGeometry')
from Autodesk.DesignScript.Geometry import *
#The inputs to this node will be stored as a list in the IN variables.
stringlist = IN[0]
removechar = IN[1]
def EscapeStringQuotes(instring):
	escapedstring = instring.Replace(removechar, r"")
	return escapedstring
#Assign your output to the OUT variable.
newstringlist = []
for s in stringlist:
	newstringlist.append(EscapeStringQuotes(s))
OUT = newstringlist
# ----------------------------------------
newList = Output(python_script)
