# Dynamo custom node Remove First Revision from Each Sheet.dyf (Dynamo 0.8.2.2371)
# category: Bakery.Revit.Elements.Revision

sheets = Input()
watch = Watch(sheets)
count = Count(watch)
code_block = CodeBlock(x=count) { 0..(x-1); }
revisions_on_sheet = Custom[Revisions on Sheet](Sheets=watch)  # This node will return all Revisions specified in "Revisions on Sheet" selection of the sheet.
remove_revision_from_sheet = Custom[Remove Revision From Sheet subnode for listMap](sheetList=watch, revisionList=revisions_on_sheet)
map = List.Map(list=code_block, f_x=remove_revision_from_sheet)
done = Output(map)
