# Dynamo custom node Remove First and Last Characters from String.dyf (Dynamo 0.8.1.1942)
# category: Bakery.Core.String

stringIn = Input()
code_block = CodeBlock { 0; }
code_block_2 = CodeBlock { 1; }
remove = String.Remove(str=stringIn, startIndex=code_block, count=code_block_2)
length = String.Length(remove)
code_block_3 = CodeBlock(x=length) { x-1; }
code_block_4 = CodeBlock { 1; }
remove_2 = String.Remove(str=remove, startIndex=code_block_3, count=code_block_4)
stringOut = Output(remove_2)
