# Dynamo custom node Remove Points with Duplicate XY Values.dyf (Dynamo 1.2.1.3083)
# category: Bakery.Geometry
# cleanup tool for points into Revit topography

points = Input(points : var[]..[])
code_block = CodeBlock { 0; }
replace_point_z_value = Custom[Replace Point Z Value](points=points, desired_Z_value=code_block)
duplicate_item_indices = Custom[Duplicate Item Indices](List=replace_point_z_value)  # Searches an input list for duplicate entries and lists their index numbers. Couple with Get From List to delete duplicates from a list.
watch = Watch(duplicate_item_indices.Duplicate_Indices)
removeItemAtIndex = List.RemoveItemAtIndex(list=points, indices=watch)
pointsCleaned = Output(removeItemAtIndex)
duplicateXYindices = Output(watch)
