# Dynamo custom node Renumber By Spline.dyf (Dynamo 1.2.1.3083)
# category: Bakery.Revit.Parameters
# set parameter based on a spline curve in the revit view

selectedSpline = Input()
geometry = Element.Geometry(selectedSpline)
firstItem = List.FirstItem(geometry)
resolution = Input()
code_block = CodeBlock(n=resolution) { 0..1..#n; }
pointAtParameter = Curve.PointAtParameter(curve=firstItem, param=code_block)
Family_Type = Input()
all_elements_of_family_type = ElementsOfFamilyType(Family_Type)
watch = Watch(all_elements_of_family_type)
boundingBox = Geometry.BoundingBox(watch)
contains = BoundingBox.Contains(boundingBox)  # unwired: arg1
map = List.Map(list=pointAtParameter, f_x=contains)
filterByBoolMask = List.FilterByBoolMask(list=watch)  # unwired: mask
map_2 = List.Map(list=map, f_x=filterByBoolMask.in)
flatten = Flatten(map_2)
uniqueItems = List.UniqueItems(flatten)
watch_reordered = Watch(uniqueItems)
parameterNameToNumber = Input()
getKeys = GetKeys(uniqueItems)
code_block_2 = CodeBlock(k=getKeys) { k+1; }
string_from_object = FromObject(code_block_2)
setParameterByName = Element.SetParameterByName(element=uniqueItems, parameterName=parameterNameToNumber, value=string_from_object)
renumberedElems = Output(setParameterByName)
