# Dynamo custom node Report Category Summary.dyf (Dynamo 0.9.1.4062)
# category: Bakery.Revit.Document.Utility
# for BEP compliance

CategoryToCheck = Input()
all_elements_of_category = ElementsOfCategory(CategoryToCheck)
create = List.Create(all_elements_of_category)
flatten = Flatten(create)
name = Element.Name(flatten)
Names = Output(name)
count = Count(flatten)
NumberOf = Output(count)
Elements = Output(flatten)
id = Element.Id(flatten)
Ids = Output(id)
workset = Custom[Element.Workset](element=flatten)  # Retrieves the workset of a given element
element_name_universal = Custom[Element.Name (Universal)](element=workset)  # Gets an element's name (Dynamo's built-in Name nodes don't work for all element types, e.g. worksets...)
Worksets = Output(element_name_universal)
type = Custom[Element.Type](element=flatten)  # Gets the family type of a given element (if applicable).
Types = Output(type)
uniqueItems = List.UniqueItems(element_name_universal)
UniqueWorksets = Output(uniqueItems)
uniqueItems_2 = List.UniqueItems(name)
sort = List.Sort(uniqueItems_2)
UniqueNames = Output(sort)
