# Dynamo custom node Revit Element Clash Detection v2.dyf (Dynamo 1.1.0.2094)
# category: Bakery.Construction.Coordination
# with transform

RevitElementSetA = Input()
RevitElementSetB = Input()
element_geometry_with_try = Custom[Element.Geometry with Try](elements=RevitElementSetB)
TransformSetBGeoms = Input()
transform = Geometry.Transform(element_geometry_with_try.geometries, TransformSetBGeoms)
python_script = Python(IN[0]=RevitElementSetA, IN[1]=transform, IN[2]=element_geometry_with_try.elements, IN[3]=element_geometry_with_try.failed_elements)
# ---------- python_script.python (79 lines) ----------
import clr
clr.AddReference('ProtoGeometry')
from Autodesk.DesignScript.Geometry import *
# Import ToDSType(bool) extension method
clr.AddReference("RevitNodes")
import Revit
clr.ImportExtensions(Revit.Elements)
# Import geometry conversion extension methods
clr.ImportExtensions(Revit.GeometryConversion)
# Import DocumentManager and TransactionManager
clr.AddReference("RevitServices")
import RevitServices
from RevitServices.Persistence import DocumentManager
from RevitServices.Transactions import TransactionManager
from System.Collections.Generic import *
# Import RevitAPI
clr.AddReference("RevitAPI")
import Autodesk
from Autodesk.Revit.DB import *

doc = DocumentManager.Instance.CurrentDBDocument
uiapp = DocumentManager.Instance.CurrentUIApplication
app = uiapp.Application
uidoc=DocumentManager.Instance.CurrentUIApplication.ActiveUIDocument

#The inputs to this node will be stored as a list in the IN variable.
#dataEnteringNode = IN

clashElementsAdirty=IN[0]
clashGeomB = IN[1]
clashElementsB = IN[2]
FailuresB = IN[3]
# Start Transaction
TransactionManager.Instance.EnsureInTransaction(doc)
clashElementsA = []
clashGeomA = []
FailuresA = []
clashFoundA = []
clashFoundB = []
clashSolids = []
clashPoints = []
for a in clashElementsAdirty:
	try:
		clashGeomA.append(a.Geometry()[0])
		clashElementsA.append(a)
	except:
		FailuresA.append(a)

#need to transform set B geometries
#def GetTransformedGeom(geom, t=trans):
#	xyz = geom.ToXyz()
#	return t.OfPoint(xyz).ToPoint()


counterA = range(len(clashElementsA))
counterB = range(len(clashElementsB))

for i in counterA:
	tempGeomA = clashGeomA[i]
	for j in counterB:
#		tempGeomB = clashGeomB[j]
#		clashIntersectResults.append(tempGeomB.DoesIntersect(tempGeomA))
#		if tempGeomA.DoesIntersect(tempGeomB):
		if clashGeomA[i].DoesIntersect(clashGeomB[j]) == True:
#		clashIntersectResults.append(clashGeomA[i].DoesIntersect(clashGeomB[j]))
			clashFoundA.append(clashElementsA[i])
			clashFoundB.append(clashElementsB[j])
			tempSolid = clashGeomA[i].Intersect(clashGeomB[j])
			clashSolids.append(tempSolid[0])
			clashPoints.append(tempSolid[0].Centroid())

# End Transaction
TransactionManager.Instance.TransactionTaskDone()

#if fileversion == "":
#	OUT="Default settings used"
#else:
#	OUT=total_export
OUT = clashFoundA, clashFoundB, clashSolids, clashPoints, FailuresA, FailuresB
# ----------------------------------------
code_block = CodeBlock { 0; }
getItemAtIndex = List.GetItemAtIndex(list=python_script, index=code_block)
clashSetA = Output(getItemAtIndex)
code_block_2 = CodeBlock { 1; }
getItemAtIndex_2 = List.GetItemAtIndex(list=python_script, index=code_block_2)
clashSetB = Output(getItemAtIndex_2)
code_block_3 = CodeBlock { 3; }
getItemAtIndex_3 = List.GetItemAtIndex(list=python_script, index=code_block_3)
clashPoint = Output(getItemAtIndex_3)
code_block_4 = CodeBlock { 2; }
getItemAtIndex_4 = List.GetItemAtIndex(list=python_script, index=code_block_4)
intersectingSolid = Output(getItemAtIndex_4)
code_block_5 = CodeBlock { 4; }
getItemAtIndex_5 = List.GetItemAtIndex(list=python_script, index=code_block_5)
SetA_GeometryFailures = Output(getItemAtIndex_5)
code_block_6 = CodeBlock { 5; }
getItemAtIndex_6 = List.GetItemAtIndex(list=python_script, index=code_block_6)
SetB_GeometryFailures = Output(getItemAtIndex_6)
watch = Watch(transform)
watch_2 = Watch(element_geometry_with_try.elements)
