# Dynamo custom node Revit Section View at Line with Height List.dyf (Dynamo 1.3.2.2480)
# category: Bakery.Revit.Views
# allows input of height list to match number of views

lineElements = Input()
geometry = Element.Geometry(lineElements)
flipSection = Input()
code_block = CodeBlock { -90; 90; }
if_ = If(test=flipSection, true=code_block.out0, false=code_block.out1)
depth = Input()
offsetBelowLevel = Input()
count = List.Count(geometry)
cycle = List.Cycle(list=offsetBelowLevel, amount=count, lacing=Longest)
flatten = Flatten(cycle)
listOfHeights = Input()
create = List.Create(flatten, listOfHeights)

# group: Sections from lines
code_block_2 = CodeBlock { 0.5; }
pointAtParameter = Curve.PointAtParameter(curve=geometry, param=code_block_2)
normalAtParameter = Curve.NormalAtParameter(curve=geometry, param=code_block_2)
code_block_3 = CodeBlock { Vector.ZAxis(); }
byOriginVectors = CoordinateSystem.ByOriginVectors(origin=pointAtParameter, xAxis=normalAtParameter, yAxis=code_block_3)
rotate = CoordinateSystem.Rotate(coordinateSystem=byOriginVectors, origin=pointAtParameter, axis=code_block_3, degrees=if_)
flatten_2 = Flatten(rotate)
length = Curve.Length(geometry)
flatten_3 = Flatten(length)
code_block_4 = CodeBlock(b1=flatten_3, x=depth) { {-b1/2,b1/2}; {0,x}; }
byCoordinates = Point.ByCoordinates(x=code_block_4.out0, y=create, z=code_block_4.out1, lacing=Longest)
code_block_5 = CodeBlock(p=byCoordinates) { p[0]; p[1]; }
byCoordinateSystemMinPointMaxPoint = SectionView.ByCoordinateSystemMinPointMaxPoint(flatten_2, code_block_5.out0, code_block_5.out1)

SectionView = Output(byCoordinateSystemMinPointMaxPoint)
