# Dynamo custom node Set Link Instance and Type Worksets by Revit Link Filename.dyf (Dynamo 0.8.2.2371)
# category: Bakery.Revit.Document.Worksets

get_linked_rvt_documents = Custom[Get Linked RVT Documents]()
count = Count(get_linked_rvt_documents.Link_Instance)
code_block = CodeBlock(x=count) { 0..x-1; }
subnode_to_set_link_worksets_by = Custom[subnode to Set Link Worksets by Name Match](rvtLinkInstances=get_linked_rvt_documents.Link_Instance)
map = List.Map(list=code_block, f_x=subnode_to_set_link_worksets_by)
done = Output(map)  # "done?"
