# Dynamo custom node Split Comma Separated Sublist Item to Multiple Items.dyf (Dynamo 0.8.2.2371)
# category: Bakery.Core.List

first_sublist_items_comma_sep = Input()
firstItem = List.FirstItem()
map = List.Map(list=first_sublist_items_comma_sep, f_x=firstItem)
string = StringInput(", ")
split = String.Split(map, string)
more_sublist_items = Output(split)
