# Dynamo custom node String Replace using RegEx.dyf (Dynamo 0.8.1.1942)
# category: Bakery.Core.String
# for lists

regex = Input()
string_s = Input()  # "string(s)"
turn_into_list = Custom[Turn Into List](item=string_s)  # Turns an element (or a nested list) into a flat list
replacement = Input()
python_script = Python(IN[0]=regex, IN[1]=turn_into_list, IN[2]=replacement)
# ---------- python_script.python (14 lines) ----------
import clr
import re

regexstring = IN[0]
regexlist = IN[1]
replacement = IN[2]
elementlist = list()
thisexp = re.compile(regexstring)
for item in regexlist:
	try:
		elementlist.append(thisexp.sub(replacement,item))
	except:
		elementlist.append(list())
OUT = elementlist
# ----------------------------------------
replaced = Output(python_script)
