# Dynamo custom node Subnode for creating list hierarchy by nest level.dyf (Dynamo 0.8.2.2392)
# category: Bakery.Core.List.Helper

get_from_here = Input()
searchForThese = Input(searchForThese : var[]..[])
inThisList = Input(inThisList : var[]..[])
if_equal_return_index_using = Custom[If Equal Return Index using IndexOf](searchForThese=searchForThese, inThisList=inThisList)
replace_unmatched_indices_With = Input()
code_block = CodeBlock { -1; }
eq = _ == code_block
replaceByCondition = Replace(if_equal_return_index_using, replace_unmatched_indices_With, eq)
getItemAtIndex = List.GetItemAtIndex(list=get_from_here, index=replaceByCondition)
resolvable = Output(getItemAtIndex)
turn_into_list = Custom[Turn Into List](item=getItemAtIndex)  # Turns an element into a (flat) list
flattened = Output(turn_into_list)
