# Dynamo custom node Summary of Unique Values present in List.dyf (Dynamo 0.9.2.4472)
# category: Bakery.Core.List

inList = Input()
uniqueItems = List.UniqueItems(inList)
listPassthrough = Input()
filter_a_list_by_a_given_value = Custom[Filter a List by a Given Value with second list passthrough](list=inList, listPassthrough=listPassthrough)
map = List.Map(list=uniqueItems, f_x=filter_a_list_by_a_given_value)
watch = Watch(map)
mapped = Output(watch)
code_block = CodeBlock { 1; }
getItemAtIndex = List.GetItemAtIndex(index=code_block)
map_2 = List.Map(list=watch, f_x=getItemAtIndex)
passthroughList_index1 = Output(map_2)  # "passthroughList(index1)"
uniqueValues = Output(uniqueItems)
code_block_2 = CodeBlock { 0; }
getItemAtIndex_2 = List.GetItemAtIndex(index=code_block_2)
map_3 = List.Map(list=watch, f_x=getItemAtIndex_2)
inList_index0 = Output(map_3)  # "inList(index0)"
count = List.Count()
map_4 = List.Map(list=map_3, f_x=count)
inListCounts = Output(map_4)

# group: Find undefined
equalToB = Input()
create = List.Create(equalToB)

equalToA = Input()
code_block_3 = CodeBlock { 0; }
getItemAtIndex_3 = List.GetItemAtIndex(index=code_block_3)
map_5 = List.Map(list=map_3, f_x=getItemAtIndex_3)

# group: blank title
addItemToFront = List.AddItemToFront(item=equalToA, list=map_5)

# group: Undefined title
addItemToFront_2 = List.AddItemToFront(item=equalToB, list=addItemToFront)

# group: Top of column 1
colheading = Input()
addItemToFront_3 = List.AddItemToFront(item=colheading, list=addItemToFront_2)

flat_list_to_list_of_strings = Custom[Flat List to List of Strings](Original_List=addItemToFront_3)  # using python methods
bv_if_equal_return_index = Custom[bv If Equal Return Index](listA=create, listB=map_5)  # forked

# group (continued): Find undefined
watch_2 = Watch(bv_if_equal_return_index)

firstItem = List.FirstItem(watch_2)
getItemAtIndex_4 = List.GetItemAtIndex(list=map_4, index=firstItem)

# group: Find zero values
create_2 = List.Create(equalToA)

bv_if_equal_return_index_2 = Custom[bv If Equal Return Index](listA=create_2, listB=map_5)

# group (continued): Find zero values
watch_3 = Watch(bv_if_equal_return_index_2)

# group: Get and Place zero value (3)
firstItem_2 = List.FirstItem(watch_3)
getItemAtIndex_5 = List.GetItemAtIndex(list=map_4, index=firstItem_2)
addItemToFront_4 = List.AddItemToFront(item=getItemAtIndex_5, list=map_4)

# group: Undefined value at top (2)
watch_4 = Watch(getItemAtIndex_4)
addItemToFront_5 = List.AddItemToFront(item=watch_4, list=addItemToFront_4)

# group: Top of column 2 (1)
code_block_4 = CodeBlock { "Data"; }
addItemToFront_6 = List.AddItemToFront(item=code_block_4, list=addItemToFront_5)

flat_list_to_list_of_strings_2 = Custom[Flat List to List of Strings](Original_List=addItemToFront_6)
create_3 = List.Create(flat_list_to_list_of_strings, flat_list_to_list_of_strings_2)
transpose = List.Transpose(create_3)
inListSummary_TwoColumn = Output(transpose)  # "inListSummary(TwoColumn)"
watch_5 = Watch(getItemAtIndex_5)
watch_6 = Watch(map_5)
watch_7 = Watch(create_2)
watch_8 = Watch(equalToA)
watch_9 = Watch(create)
watch_10 = Watch(equalToB)
