# Dynamo custom node Write RVT Link and Workset Details to Active View.dyf (Dynamo 0.8.2.2371)
# category: Bakery.Revit.Views
# uses 5 instance parameters...

current = Document.Current()
activeView = Document.ActiveView(current)
create = List.Create(activeView)
firstItem = List.FirstItem(create)
View_Parameter_for_Current_Date_Time = Input()
now = DateTime.Now()
string_from_object = FromObject(now)
setParameterByName = Element.SetParameterByName(element=firstItem, parameterName=View_Parameter_for_Current_Date_Time, value=string_from_object)
current_date_time_written = Output(setParameterByName)  # "current date time written?"
View_Parameter_for_Worksets = Input()
get_open_worksets_and_write_to = Custom[Get Open Worksets and Write to View Parameter](targetParameter=View_Parameter_for_Worksets, InputViewAsElement=firstItem)
open_worksets_written = Output(get_open_worksets_and_write_to)  # "open worksets written?"
View_Parameter_for_RVT_Link_Filenames = Input()
View_Parameter_for_RVT_Link_File_Sizes = Input()
View_Parameter_for_RVT_Link_Dates_Modifi = Input(View Parameter for RVT Link Dates Modified)

# group: Links
current_2 = Document.Current()
activeView_2 = Document.ActiveView(current_2)
all_elements_in_active_view = ElementsInView()
get_revit_link_names_from_an = Custom[Get Revit Link Names from an Element List](ElementList=all_elements_in_active_view)
sort = List.Sort(get_revit_link_names_from_an)
get_file_size_and_date_modified = Custom[Get File Size and Date Modified using RVT Link Filename](listOfFilenames=sort)
convert_list_into_list_of = Custom[Convert List into List of Strings with Line Breaks](Original_List=get_file_size_and_date_modified.filenames)
setParameterByName_2 = Element.SetParameterByName(element=activeView_2, parameterName=View_Parameter_for_RVT_Link_Filenames, value=convert_list_into_list_of)
convert_list_into_list_of_2 = Custom[Convert List into List of Strings with Line Breaks](Original_List=get_file_size_and_date_modified.file_sizes_in_KB)
setParameterByName_3 = Element.SetParameterByName(element=activeView_2, parameterName=View_Parameter_for_RVT_Link_File_Sizes, value=convert_list_into_list_of_2)
convert_list_into_list_of_3 = Custom[Convert List into List of Strings with Line Breaks](Original_List=get_file_size_and_date_modified.dates_modified)
setParameterByName_4 = Element.SetParameterByName(element=activeView_2, parameterName=View_Parameter_for_RVT_Link_Dates_Modifi, value=convert_list_into_list_of_3)

file_names_written = Output(setParameterByName_2)  # "file names written?"
file_sizes_written = Output(setParameterByName_3)  # "file sizes written?"
dates_modified_written = Output(setParameterByName_4)  # "dates modified written?"
create_2 = List.Create(setParameterByName_2, setParameterByName_4, setParameterByName_3, get_open_worksets_and_write_to, setParameterByName)
flatten = Flatten(create_2)
count = Count(flatten)
code_block = CodeBlock { 5; }
eq = count == code_block
all_successful = Output(eq)  # "all successful?"
