# Dynamo custom node bv Select in Revit.dyf (Dynamo 0.8.2.2371)
# category: Bakery.Dynamo.ForkedNodes

Element_s = Input()  # "Element(s)"
python_script = Python(IN[0]=Element_s)
# ---------- python_script.python (40 lines) ----------
# Default imports
import clr
clr.AddReference('RevitAPI')
clr.AddReference('RevitAPIUI')
from Autodesk.Revit.DB import *
import Autodesk
import sys
import clr
path = r'C:\Autodesk\Dynamo\Core'
exec_path = r'C:\Autodesk\Dynamo\Core\dll'
sys.path.append(path)
sys.path.append(exec_path)
clr.AddReference('LibGNet')
from Autodesk.LibG import *

def addToSet(doc, set, element):
	try:
		el = doc.GetElement(element)
	except:
		el = element
		
	set.Add(el)

#The input to this node will be stored in the IN[0] variable.
elements = IN[0]
uidoc = __revit__.ActiveUIDocument
doc = uidoc.Document
set = Autodesk.Revit.UI.Selection.SelElementSet.Create()


try:
	for el in elements:
		addToSet(doc, set, el)
except:
	addToSet(doc, set, elements)
	
uidoc.Selection.Elements = set

#Assign your output to the OUT variable
OUT = uidoc.Selection
# ----------------------------------------
Selection = Output(python_script)
