# Dynamo custom node mysql Insert Data into New Rows for Multiple Columns.dyf (Dynamo 1.2.1.3083)
# category: Bakery.Data.Database

connectionString = Input()
code_block = CodeBlock { true; }
code_block_2 = CodeBlock { ""; }
string = StringInput("""USE zzxkr_dbName_zzxkr;
INSERT INTO zzxkr_dbName_zzxkr.zzxkr_tableName_zzxkr (zxkr_Column_zxkr) VALUES (""")
string_2 = StringInput("zzxkr_dbName_zzxkr")
dbName = Input()
replace = String.Replace(str=string, searchFor=string_2, replaceWith=dbName)
string_3 = StringInput("zzxkr_tableName_zzxkr")
tableName = Input()
replace_2 = String.Replace(str=replace, searchFor=string_3, replaceWith=tableName)
string_4 = StringInput("zxkr_Column_zxkr")
ColumnNameList = Input()
string_from_array = FromArray(ColumnNameList)
remove_first_and_last_characters = Custom[Remove First and Last Characters from String](stringIn=string_from_array)
replace_3 = String.Replace(str=replace_2, searchFor=string_4, replaceWith=remove_first_and_last_characters)
dataPiece = Input()
string_from_array_2 = FromArray(dataPiece)
watch = Watch(string_from_array_2)
remove_first_and_last_characters_2 = Custom[Remove First and Last Characters from String](stringIn=watch)
string_5 = StringInput(");")
join = String.Join(code_block_2, replace_3, remove_first_and_last_characters_2, string_5)
mySQL_Command = Database.Command.MySQL_Command(connectionString, code_block, join)
Success = Output(mySQL_Command)  # "Success?"
watch_2 = Watch(join)
