# Dynamo custom node subnode for Filtering Lists by List.dyf (Dynamo 0.8.2.2371)
# category: Bakery.Core.List.Helper

main_list = Input()
watch = Watch(main_list)
uniques = Input()
counter = Input()
getItemAtIndex = List.GetItemAtIndex(list=uniques, index=counter)
eq = getItemAtIndex == watch
filterByBoolMask = List.FilterByBoolMask(list=watch, mask=eq)
matched = Output(filterByBoolMask.in)
