# Dynamo custom node subnode for Nurbs surface creation with diameter list.dyf (Dynamo 0.8.2.2371)
# category: Bakery.Geometry.Helper

code_block = CodeBlock { 3; }
curve_list = Input()
watch = Watch(curve_list)
index = Input()
watch_2 = Watch(index)
getItemAtIndex = List.GetItemAtIndex(list=watch, index=watch_2)
diameter_list = Input()
code_block_2 = CodeBlock(x=diameter_list) { x/2; }
getItemAtIndex_2 = List.GetItemAtIndex(list=code_block_2, index=watch_2)
circle_sweep_along_nurbs_path = Custom[Circle Sweep along NURBS path with smoothing](resolution=code_block, nurbs_curve=getItemAtIndex, radius=getItemAtIndex_2)
nurbs_surface = Output(circle_sweep_along_nurbs_path.NurbsSurface)
simple_loft = Output(circle_sweep_along_nurbs_path.simplified_loft)
simple_nurbs_surface = Output(circle_sweep_along_nurbs_path.simplified_NurbsSurface)
