# Dynamo custom node subnode to Filter Sublists.dyf (Dynamo 0.8.2.2371)
# category: Bakery.Core.List.Helper

listToFilter = Input()
counter = Input()
watch = Watch(counter)
getItemAtIndex = List.GetItemAtIndex(list=listToFilter, index=watch)
maskList = Input()
getItemAtIndex_2 = List.GetItemAtIndex(list=maskList, index=watch)
filterByBoolMask = List.FilterByBoolMask(list=getItemAtIndex, mask=getItemAtIndex_2)
in_ = Output(filterByBoolMask.in)  # "in"
