# Dynamo custom node 3DView by BoundingBox.dyf (Dynamo 1.3.4.6666)
# category: GeniusLoci.View
# Use a boundingbox to create a new 3D View with a specified name and a section box.
# Inspired by archilab

BoundingBox = Input()
code_block = CodeBlock(x=BoundingBox) { x[0]; }
Viewname = Input()
python_script = Python(IN[0]=code_block, IN[1]=Viewname)
# ---------- python_script.python (44 lines) ----------
#Based on the codes originally posted by Dimitar Venkov and Konrad Sobon

import clr
clr.AddReference("RevitAPI")
import Autodesk
from Autodesk.Revit.DB import *

clr.AddReference("RevitNodes")
import Revit
clr.ImportExtensions(Revit.GeometryConversion)
clr.ImportExtensions(Revit.Elements)

clr.AddReference("RevitServices")
import RevitServices
from RevitServices.Persistence import DocumentManager
from RevitServices.Transactions import TransactionManager

doc = DocumentManager.Instance.CurrentDBDocument
bbox = IN[0]
viewName = IN[1]

#get ViewFamilyType for a 3D View
collector = FilteredElementCollector(doc)
viewTypeColl = collector.OfClass(ViewFamilyType)
for i in viewTypeColl:
	if i.ViewFamily == ViewFamily.ThreeDimensional:
		viewType = i
	else:
		continue

# "Start" the transaction
TransactionManager.Instance.EnsureInTransaction(doc)
newmax = UnwrapElement(bbox.MaxPoint).ToRevitType()
newmin = UnwrapElement(bbox.MinPoint).ToRevitType()
newbox = BoundingBoxXYZ()
newbox.Max = newmax
newbox.Min = newmin
    
#create 3d View
view = View3D.CreateIsometric(doc, viewType.Id)
view.Name = viewName
view.SetSectionBox(newbox)

OUT = view
# ----------------------------------------
Views = Output(python_script)
