# Dynamo custom node Acquire Coordinates.dyf (Dynamo 1.3.3.4651)
# category: GeniusLoci.Document
# Works only in Revit 2018 and later.
# Acquires coordinates from the specified link instance (RevitLinkInstance or DWG ImportInstance).
# The geolocation information will be pulled from the linked model to the host model.

LinkInstance = Input()  # RevitLinkInstance or DWG ImportInstance
acquire_coordinates = Python(IN[0]=LinkInstance)
# ---------- acquire_coordinates.python (27 lines) ----------
import clr
clr.AddReference('RevitAPI')
import Autodesk
from Autodesk.Revit.DB import *
import System

clr.AddReference('RevitNodes')
import Revit
clr.ImportExtensions(Revit.Elements)

clr.AddReference('RevitServices')
import RevitServices
from RevitServices.Persistence import DocumentManager
from RevitServices.Transactions import TransactionManager
doc = DocumentManager.Instance.CurrentDBDocument

linkInstance = UnwrapElement(IN[0])

if not hasattr(linkInstance, '__iter__'):
	linkInstance = [linkInstance]

TransactionManager.Instance.EnsureInTransaction(doc)
for inst in linkInstance:
	doc.AcquireCoordinates(inst.Id)
TransactionManager.Instance.TransactionTaskDone()

OUT = linkInstance
# ----------------------------------------
LinkInstance_2 = Output(acquire_coordinates)  # "LinkInstance"
