# Dynamo custom node All Elements Of Types In Document.dyf "All Elements of Types in Document" (Dynamo 1.3.3.4651)
# category: GeniusLoci.Select
# Collect all elements of a type in a given document.

docOrRevitLinkInstance = Input(docOrRevitLinkInstance : var = null)  # Use only if you want to query a linked model
ElementTypes = Input()
element_types_in_document = Python(IN[0]=docOrRevitLinkInstance, IN[1]=ElementTypes)
# ---------- element_types_in_document.python (31 lines) ----------
import clr
clr.AddReference('RevitServices')
from RevitServices.Persistence import DocumentManager

clr.AddReference('RevitNodes')
import Revit
clr.ImportExtensions(Revit.Elements)

clr.AddReference('RevitAPI')
from Autodesk.Revit.DB import *
from Autodesk.Revit.DB.Mechanical import *

inputdocs = UnwrapElement(IN[0])
elementType = IN[1]

if not hasattr(inputdocs , '__iter__'):
	inputdocs = [inputdocs]

#Part of script from Clockwork
for inputdoc in inputdocs :
	if inputdoc == None:
		doc = DocumentManager.Instance.CurrentDBDocument
	elif inputdoc.GetType().ToString() == "Autodesk.Revit.DB.Document":
		doc = inputdoc
	elif inputdoc.GetType().ToString() == "Autodesk.Revit.DB.RevitLinkInstance":
		doc = inputdoc.GetLinkDocument()
	else: doc = None

docElementType = FilteredElementCollector(doc).OfClass(elementType).ToElements()

OUT = doc, docElementType
# ----------------------------------------
code_block = CodeBlock(x=element_types_in_document) { x[0]; x[1]; }
Document = Output(code_block.out0)
Element = Output(code_block.out1)
