# Dynamo custom node Create DWG Export Setup.dyf (Dynamo 1.3.3.4651)
# category: GeniusLoci.Export
# Create a DWG export settings with values of the given DWGExportOptions.

Document = Input()  # Singleton
DWGExportSetupName = Input(DWGExportSetupName : string)
DWGExportOptions = Input()
createDWGExportOptions = Python(IN[0]=Document, IN[1]=DWGExportSetupName, IN[2]=DWGExportOptions)
# ---------- createDWGExportOptions.python (36 lines) ----------
#Alban de Chasteigner 2018
#twitter : @geniusloci_bim
#geniusloci.bim@gmail.com

import clr
clr.AddReference('RevitAPI')
import Autodesk
from Autodesk.Revit.DB import *

clr.AddReference("RevitNodes")
import Revit
clr.ImportExtensions(Revit.Elements)

clr.AddReference("RevitServices")
import RevitServices
from RevitServices.Persistence import DocumentManager
from RevitServices.Transactions import TransactionManager

def tolist(input):
	if isinstance(input,list):
		return input
	else:
		return [input]

doc = IN[0]
name = tolist(IN[1])
options = tolist(IN[2])
DWGExports = []

t = Transaction(doc,'create')
t.Start()
result = Autodesk.Revit.DB.ExportDWGSettings.Create(doc,name[0],options[0])
DWGExports.append(result)
t.Commit()

OUT = doc,DWGExports
# ----------------------------------------
code_block = CodeBlock(x=createDWGExportOptions) { x[0]; x[1]; }
Document_2 = Output(code_block.out0)  # "Document"
ExportDwgSettings = Output(code_block.out1)
