# Dynamo custom node Dimension By References.dyf (Dynamo 1.3.4.6666)
# category: GeniusLoci.Reference
# Creates a new linear dimension from at least two element references.

line = Input()  # Dynamo Curve
References = Input()
View = Input(View:var[]..[] = Revit.Application.Document.Current.ActiveView)
dimensionWithReference = Python(IN[0]=line, IN[1]=References, IN[2]=View)
# ---------- dimensionWithReference.python (34 lines) ----------
import clr
clr.AddReference('RevitAPI')
from Autodesk.Revit.DB import *

clr.AddReference('RevitNodes')
import Revit
clr.ImportExtensions(Revit.GeometryConversion)
clr.ImportExtensions(Revit.Elements)

clr.AddReference('RevitServices')
import RevitServices
from RevitServices.Persistence import DocumentManager
from RevitServices.Transactions import TransactionManager

doc = DocumentManager.Instance.CurrentDBDocument

def tolist(obj1):
    if hasattr(obj1,"__iter__"): return obj1
    else: return [obj1]

lines = tolist(IN[0])
references= IN[1]
view = tolist(UnwrapElement(IN[2]))[0]

elementsRef = ReferenceArray()
for reference in references :
	elementsRef.Append(reference)
	
TransactionManager.Instance.EnsureInTransaction(doc)
for line in lines:
	dim = doc.Create.NewDimension(view, line.ToRevitType(), elementsRef).ToDSType(True)
TransactionManager.Instance.TransactionTaskDone()

OUT=dim
# ----------------------------------------
Dimension = Output(dimensionWithReference)
