# Dynamo custom node Element Pattern Reference.dyf (Dynamo 1.3.4.6666)
# category: GeniusLoci.Reference
# Retrieves Top Surface, top Material, top Fill Pattern and its references of a roof, floor or ceiling.
# These references can then be used to dimension the FillPattern.

Element = Input()  # Roof, floor or ceiling
ReferenceNumber = Input(ReferenceNumber:int=2)
pattern_ref = Python(IN[0]=Element, IN[1]=ReferenceNumber)
# ---------- pattern_ref.python (57 lines) ----------
# C# code by FAIR59
import clr
clr.AddReference('RevitServices')
import RevitServices
from RevitServices.Persistence import DocumentManager
from RevitServices.Transactions import TransactionManager
doc = DocumentManager.Instance.CurrentDBDocument

clr.AddReference('RevitAPI')
from Autodesk.Revit.DB import *
from Autodesk.Revit.DB.Structure import *

# Import ToDSType  (bool) extension method
clr.AddReference("RevitNodes")
import Revit
# Adds ToProtoType, ToRevitType geometry conversion extension methods to objects
clr.ImportExtensions(Revit.GeometryConversion)
# Import Element wrapper extension methods
clr.ImportExtensions(Revit.Elements)
from Revit.Elements import *

elements = UnwrapElement(IN[0])
if not hasattr(elements, '__iter__'):
	elements = [elements]
	
n = IN[1]
topFaces,mats,patterntypes,resArr=[],[],[],[]

for element in elements:
	top = HostObjectUtils.GetTopFaces(element)
	for t in top:
		topFace = element.GetGeometryObjectFromReference(t)
		topFaces.append(topFace.ToProtoType()[0])
		#Check for model surfacepattern
		mat=doc.GetElement(topFace.MaterialElementId)
		mats.append(mat)
		patterntype = doc.GetElement(mat.SurfacePatternId)
		patterntypes.append(patterntype)
		pattern = patterntype.GetFillPattern()

		#Get number of gridLines in pattern                
		gridCount = pattern.GridCount

		#Construct StableRepresentations and find the Reference to HatchLines
		StableRef = t.ConvertToStableRepresentation(doc)
	
		ip = 0
		while (ip < n):
			ip = ip + 1
			index = 1 + ( ip * gridCount * 2 )

			stableHatchString = StableRef + str.Format( "/{0}", index )
			HatchRef = Reference.ParseFromStableRepresentation( doc, stableHatchString )
			resArr.append(HatchRef)
	
if isinstance(IN[0], (list)): OUT = topFaces,mats,patterntypes,resArr
else: OUT = topFaces[0],mats[0],patterntypes[0],resArr
# ----------------------------------------
code_block = CodeBlock(x=pattern_ref) { x[0]; x[1]; x[2]; x[3]; }
Top_Surface = Output(code_block.out0)
Material = Output(code_block.out1)
FillPatternElement = Output(code_block.out2)
References = Output(code_block.out3)
