# Dynamo custom node Element Top and Bottom References.dyf (Dynamo 1.3.4.6666)
# category: GeniusLoci.Reference
# Retrieves Top and Bottom Surfaces, Materials, and references of a roof, floor or ceiling.

Element = Input()  # Roof, floor or ceiling
surface_ref = Python(IN[0]=Element)
# ---------- surface_ref.python (48 lines) ----------
import clr
clr.AddReference('RevitServices')
import RevitServices
from RevitServices.Persistence import DocumentManager
from RevitServices.Transactions import TransactionManager
doc = DocumentManager.Instance.CurrentDBDocument

clr.AddReference('RevitAPI')
from Autodesk.Revit.DB import *
from Autodesk.Revit.DB.Structure import *

# Import ToDSType  (bool) extension method
clr.AddReference("RevitNodes")
import Revit
# Adds ToProtoType, ToRevitType geometry conversion extension methods to objects
clr.ImportExtensions(Revit.GeometryConversion)
# Import Element wrapper extension methods
clr.ImportExtensions(Revit.Elements)
from Revit.Elements import *

elements = UnwrapElement(IN[0])
if not hasattr(elements, '__iter__'):
	elements = [elements]
	
resArr,topFaces,bottomFaces,topMats,bottomMats=[],[],[],[],[]
elementsRef=ReferenceArray()

for element in elements:
	top = HostObjectUtils.GetTopFaces(element)
	bottom = HostObjectUtils.GetBottomFaces(element)
	for t in top:
		elementsRef.Append(t)
		topFace = element.GetGeometryObjectFromReference(t)
		topFaces.append(topFace.ToProtoType()[0])
		#Check for model surfacepattern
		topmat=doc.GetElement(topFace.MaterialElementId)
		topMats.append(topmat)

	for b in bottom:
		elementsRef.Append(b)
		bottomFace = element.GetGeometryObjectFromReference(b)
		bottomFaces.append(bottomFace.ToProtoType()[0])
		#Check for model surfacepattern
		bottommat=doc.GetElement(bottomFace.MaterialElementId)
		bottomMats.append(bottommat)

if isinstance(IN[0], (list)): OUT = topFaces,bottomFaces,topMats,bottomMats,elementsRef
else: OUT = topFaces[0],bottomFaces[0],topMats[0],bottomMats[0],elementsRef
# ----------------------------------------
code_block = CodeBlock(x=surface_ref) { x[0]; x[1]; x[2]; x[3]; x[4]; }
Top_Surface = Output(code_block.out0)
Bottom_Surface = Output(code_block.out1)
Top_Material = Output(code_block.out2)
Bottom_Material = Output(code_block.out3)
References = Output(code_block.out4)
