# Dynamo custom node Elements From Linked File in Space.dyf (Dynamo 1.3.3.4651)
# category: GeniusLoci.Room
# This node will check what elements from a linked model are inside of any of the spaces in the current model.
# From archilab

Elements = Input()
Spaces = Input()
Link_Instance = Input()
python_script = Python(IN[0]=Elements, IN[1]=Spaces, IN[2]=Link_Instance)
# ---------- python_script.python (56 lines) ----------
#Copyright(c) 2015, Konrad Sobon
# @arch_laboratory, http://archi-lab.net

# This code is based on Family.InRoom node originally created
# by Peter Kompolschek and published on Dynamo blog. Big thanks 
# to Peter for sharing his work so graciously.

import clr
clr.AddReference('ProtoGeometry')
from Autodesk.DesignScript.Geometry import *

# Import DocumentManager and TransactionManager
clr.AddReference("RevitServices")
import RevitServices
from RevitServices.Persistence import DocumentManager
from RevitServices.Transactions import TransactionManager

# Import RevitAPI
clr.AddReference("RevitAPI")
import Autodesk
from Autodesk.Revit.DB import *

doc = DocumentManager.Instance.CurrentDBDocument
uiapp = DocumentManager.Instance.CurrentUIApplication
app = uiapp.Application

from System.Collections.Generic import *

#The inputs to this node will be stored as a list in the IN variable.
dataEnteringNode = IN

rvtLink = UnwrapElement(IN[2])
transform = rvtLink.GetTotalTransform()

def FamiliesInSpace(_space, _families, _transform):
	outList = []
	for family in _families:
		pt = _transform.OfPoint(family.Location.Point)
		if _space.IsPointInSpace(pt):
			outList.append(family)
	return outList

families = []
for i in IN[0]:
	families.append(UnwrapElement(i))

spaces = []
for i in IN[1]:
	if UnwrapElement(i).Area > 0:
		spaces.append(UnwrapElement(i))

outData = [[] for i in range(len(spaces))]
for index, space in enumerate(spaces):
	outData[index].extend(FamiliesInSpace(space, families, transform))

OUT = outData
# ----------------------------------------
Elements_2 = Output(python_script)  # "Elements"
