# Dynamo custom node Enumerate Datum Extent Type.dyf (Dynamo 1.3.3.4651)
# category: GeniusLoci.Level
# Enumerate Datum Extent Type : Model (3D extent) or ViewSpecific (2D extent).
# Use with "Switch between 2D or 3D extent" node.

enumerate_datum_extent_type = Python()
# ---------- enumerate_datum_extent_type.python (20 lines) ----------
#From Bakery
import clr
clr.AddReference('ProtoGeometry')
from Autodesk.DesignScript.Geometry import *

# Import DocumentManager and TransactionManager
clr.AddReference("RevitServices")
import RevitServices
from RevitServices.Persistence import DocumentManager
from RevitServices.Transactions import TransactionManager

# Import RevitAPI
clr.AddReference("RevitAPI")
import Autodesk
from Autodesk.Revit.DB import *
from Autodesk.Revit.DB import Structure
import System

#Assign your output to the OUT variable
OUT = System.Enum.GetValues(Autodesk.Revit.DB.DatumExtentType)
# ----------------------------------------
code_block = CodeBlock(Option=enumerate_datum_extent_type) { Option[0]; Option[1]; }
n3D_extent = Output(code_block.out0)  # "3D extent"
n2D_extent = Output(code_block.out1)  # "2D extent"
