# Dynamo custom node Export DWG in Document.dyf (Dynamo 1.3.3.4651)
# category: GeniusLoci.Export
# Export views to DWG file from document with export setup.
# From archilab

Document = Input()  # Singleton
DirectoryPath = Input()
views = Input()  # As list
Filenames = Input()  # As list
Exportsetup = Input()  # ExportDWGSetting's name as list
SharedCoords = Input(SharedCoords:bool=true)
MergeViews = Input(MergeViews : bool = true)
RunIt = Input(RunIt:bool=false)
export_dwg_from_directory = Python(IN[0]=Document, IN[1]=DirectoryPath, IN[2]=views, IN[3]=Filenames, IN[4]=Exportsetup, IN[5]=SharedCoords, IN[6]=MergeViews, IN[7]=RunIt)
# ---------- export_dwg_from_directory.python (84 lines) ----------
# Copyright(c) 2016, Konrad K Sobon
# @arch_laboratory, http://archi-lab.net

# Import Element wrapper extension methods
import clr
clr.AddReference("RevitNodes")
import Revit
clr.ImportExtensions(Revit.Elements)

# Import DocumentManager and TransactionManager
clr.AddReference("RevitServices")
import RevitServices
from RevitServices.Persistence import DocumentManager

# Import RevitAPI
clr.AddReference("RevitAPI")
import Autodesk
from Autodesk.Revit.DB import *

import System
from System.Collections.Generic import *

import sys
pyt_path = r'C:\Program Files (x86)\IronPython 2.7\Lib'
sys.path.append(pyt_path)

#The inputs to this node will be stored as a list in the IN variable.
dataEnteringNode = IN

doc = IN[0]

def ProcessList(_func, _list):
    return map( lambda x: ProcessList(_func, x) if type(x)==list else _func(x), _list )

def ProcessParallelLists(_func, *lists):
	return map( lambda *xs: ProcessParallelLists(_func, *xs) if all(type(x) is list for x in xs) else _func(*xs), *lists )

def Unwrap(item):
	return UnwrapElement(item)

folderPath = IN[1]

if isinstance(IN[2], list):
	views = ProcessList(Unwrap, IN[2])
else:
	views = list(Unwrap(IN[2]))

if isinstance(IN[3], list):
	names = IN[3]
else:
	names = list(IN[3])

Predef = IN[4]

RunIt = IN[7]

def ExportDwg(name, view, folder = folderPath):
	options = DWGExportOptions()
	options = options.GetPredefinedOptions(doc, Predef[0])
	options.SharedCoords = IN[5]
	options.MergedViews = IN[6]
	views = List[ElementId]()
	views.Add(view.Id)
	result = doc.Export(folder, name, views, options)
	return result

if RunIt:
	try:
		errorReport = None
		# run export
		ProcessParallelLists(ExportDwg, names, views)
		
	except:
		# if error accurs anywhere in the process catch it
		import traceback
		errorReport = traceback.format_exc()
else:
	errorReport = "Please set the RunIt to True!"

#Assign your output to the OUT variable
if errorReport == None:
	OUT = "Success"
else:
	OUT = errorReport
# ----------------------------------------
Result = Output(export_dwg_from_directory)
