# Dynamo custom node Export IFC.dyf (Dynamo 1.3.3.4651)
# category: GeniusLoci.Export
# Export Views to IFC file.
# The Project Origin option works only with Revit 2018 and above.
# Some other IFC options are embedded inside the python script.

DirectoryPath = Input()
# note: IFC Version :
# "IFC2x2";
# "IFC2x3";
# "IFC2x3CV2";
# "IFC2x2";
# "IFC4";
# "IFCBCA";
# "IFCCOBIE";
Filenames = Input()  # Filename as list
code_block = CodeBlock(item=Filenames) { DSCore.List.Flatten(item,-1); }
views = Input()  # Views as list
IFCversion = Input(IFCversion : string = "IFC2x3")  # IFC Version
WallAndColumnSplitting = Input(WallAndColumnSplitting : bool = false)
ExportBaseQuantities = Input(ExportBaseQuantities : bool = false)
ProjectOrigin = Input(ProjectOrigin : string = "3")  # SharedCoordinates ="0", SiteSurveyPoint ="1", ProjectBasePoint="2", InternalCoordinates="3"
export_ifc = Python(IN[0]=DirectoryPath, IN[1]=code_block, IN[2]=views, IN[3]=IFCversion, IN[4]=WallAndColumnSplitting, IN[5]=ExportBaseQuantities, IN[6]=ProjectOrigin)
# ---------- export_ifc.python (101 lines) ----------
#Based on a Nicklas Verdier Østergaard's script, nvo@niras.dk
#https://github.com/pzurek/ifcexporter/blob/master/IFCExporterUI/Source/IFCExportConfiguration.cs
#Revised by Alban de Chasteigner

import clr
clr.AddReference('ProtoGeometry')
from Autodesk.DesignScript.Geometry import *
# Import ToDSType(bool) extension method
clr.AddReference("RevitNodes")
import Revit
clr.ImportExtensions(Revit.Elements)
# Import geometry conversion extension methods
clr.ImportExtensions(Revit.GeometryConversion)
# Import DocumentManager and TransactionManager
clr.AddReference("RevitServices")
import RevitServices
from RevitServices.Persistence import DocumentManager
from RevitServices.Transactions import TransactionManager
from System.Collections.Generic import *
# Import RevitAPI
clr.AddReference("RevitAPI")
import Autodesk
from Autodesk.Revit.DB import *

doc = DocumentManager.Instance.CurrentDBDocument
uiapp = DocumentManager.Instance.CurrentUIApplication
app = uiapp.Application
uidoc=DocumentManager.Instance.CurrentUIApplication.ActiveUIDocument

folder=UnwrapElement(IN[0])
name=UnwrapElement(IN[1])
view = UnwrapElement(IN[2])
fileversion = IN[3]
wallandcolumnsplitting = IN[4]
exportbasequantities = IN[5]
Projectorigin = IN[6]

#IFCVersion=UnwrapElement(IN[3])

TransactionManager.Instance.EnsureInTransaction(doc)
result = []

for i,v in enumerate(view):
	options=IFCExportOptions()
	
	#if fileversion != None:
	#	options.FileVersion = fileversion
	if fileversion == "IFC4":
		options.FileVersion = IFCVersion.IFC4
	if fileversion == "IFC2x2":
		options.FileVersion = IFCVersion.IFC2x2
	if fileversion == "IFC2x3":
		options.FileVersion = IFCVersion.IFC2x3
	if fileversion == "IFC2x3":
		options.FileVersion = IFCVersion.IFC2x3CV2
	if fileversion == "IFCBCA":
		options.FileVersion = IFCVersion.IFCBCA
	if fileversion == "IFCCOBIE":
		options.FileVersion = IFCVersion.IFCCOBIE
	if fileversion == "":
		options.FileVersion = IFCVersion.Default
		
	options.WallAndColumnSplitting = wallandcolumnsplitting
	options.ExportBaseQuantities = exportbasequantities
	options.FilterViewId = v.Id
	options.AddOption("ExportInternalRevitPropertySets","true");
	options.AddOption("ExportIFCCommonPropertySets","true");	
	options.AddOption("ExportAnnotations ","true");
	options.AddOption("SpaceBoundaries ", "0");
	options.AddOption("ExportRoomsInView", "false");	
	options.AddOption("Use2DRoomBoundaryForVolume ", "true");
	options.AddOption("UseFamilyAndTypeNameForReference ", "true");
	options.AddOption("Export2DElements", "false");
	options.AddOption("ExportPartsAsBuildingElements", "false");
	options.AddOption("ExportBoundingBox", "false");
	options.AddOption("ExportSolidModelRep", "true");
	options.AddOption("ExportSchedulesAsPsets", "false");
	options.AddOption("ExportSpecificSchedules", "false");
	#Doesn't work. It would be necessary to use OpenInBackground.
	options.AddOption("ExportLinkedFiles", "false");
	options.AddOption("IncludeSiteElevation","true");
	options.AddOption("StoreIFCGUID", "true");
	options.AddOption("VisibleElementsOfCurrentView ", "true");
	options.AddOption("UseActiveViewGeometry", "true");
	options.AddOption("TessellationLevelOfDetail", "1");
 	options.AddOption("ExportUserDefinedPsets","false");
 	options.AddOption("SitePlacement", IN[6]);
#	options.AddOption("ExportUserDefinedPsetsFileName","the filepath")
#IFCVersion Version = (IFCVersion) Enum.Parse( typeof(IFCVersion), UnwrapElement(IN[3]), true );
#x.FileVersion = IFCVersion.IFC2x3CV2

	c=doc.Export(folder, name[i], options)
	result.append(c)

# End Transaction
TransactionManager.Instance.TransactionTaskDone()

if fileversion == "":
	OUT="Default settings used"
else:
	OUT='Success'
# ----------------------------------------
Succeed = Output(export_ifc)
