# Dynamo custom node Export NWC in Document.dyf (Dynamo 1.3.3.4651)
# category: GeniusLoci.Export
# !! This node needs Navisworks Exporters for Revit to export NWC.
# This node exports Views to NWC files from from document.
# Navisworks options are embedded inside the python script.

DirectoryPath = Input()
Views = Input()
Filename = Input(Filename : string)
ExportScope = Input()  # ExportScope = View, Model, SelectedElements
ExportLinks = Input(ExportLinks : bool = true)
ChooseCoordinates = Input()  # ChooseCoordinates = Shared or Internal
Document = Input()
export_nwc_from_directory = Python(IN[0]=DirectoryPath, IN[1]=Views, IN[2]=Filename, IN[3]=ExportScope, IN[4]=ExportLinks, IN[5]=ChooseCoordinates, IN[6]=Document)
# ---------- export_nwc_from_directory.python (45 lines) ----------
#Based on a mostafa el ayoubi's script, 2016 elayoub.mostafa@gmail.com
#http://revitapisearch.com.s3-website-us-east-1.amazonaws.com/html/8a8483f0-b8b8-219e-1bcd-e26833495ba8.htm

import clr
clr.AddReference('RevitAPI')
import Autodesk
from Autodesk.Revit.DB import*

clr.AddReference('RevitServices')
from RevitServices.Persistence import DocumentManager

doc = IN[6]
uiapp = DocumentManager.Instance.CurrentUIApplication
app = uiapp.Application

folder=IN[0]

if isinstance(IN[1],list):
	views = UnwrapElement(IN[1])
else: 
	views = [UnwrapElement(IN[1])]

names = IN[2]
NWCExportScope = IN[3]
Linksbool = IN[4]
ChooseCoordinates = IN[5]

for v in views:
	options = NavisworksExportOptions()
	options.ExportScope = NWCExportScope
	options.ViewId = v.Id
	#All,Elements, or None
	options.ExportLinks=Linksbool
	options.Coordinates=ChooseCoordinates
	options.ExportParts = False
	options.ExportElementIds = True
	options.ConvertElementProperties = False
	options.ExportRoomAsAttribute = True
	options.ExportRoomGeometry = True
	options.ExportUrls  = True
	options.DivideFileIntoLevels = False
	options.FindMissingMaterials = True
	doc.Export(folder,names,options)

OUT = "Success"
# ----------------------------------------
Result = Output(export_nwc_from_directory)
