# Dynamo custom node FamilyInstance Reference.dyf (Dynamo 1.3.4.6666)
# category: GeniusLoci.Reference
# Works only in Revit 2018.1 and later.
# Gets family instance references corresponding to the reference planes or reference lines in the instance's family.

FamilyInstance = Input()
ReferenceType = Input(ReferenceType=null)  # Default = Center (Left/Right)
python_script = Python(IN[0]=FamilyInstance, IN[1]=ReferenceType)
# ---------- python_script.python (31 lines) ----------
import clr
clr.AddReference('RevitServices')
import RevitServices
from RevitServices.Persistence import DocumentManager
from RevitServices.Transactions import TransactionManager
doc = DocumentManager.Instance.CurrentDBDocument

clr.AddReference('RevitAPI')
from Autodesk.Revit.DB import *
from Autodesk.Revit.DB.Structure import *

elements = UnwrapElement(IN[0])
reftype = UnwrapElement(IN[1])
if not hasattr(elements, '__iter__'):
	elements = [elements]
ref=[]
refname=[]
sketch=[]
TransactionManager.Instance.EnsureInTransaction(doc)
#Get Reference Planes from Families
for element in elements:
	if reftype == None:
		reference = element.GetReferences(FamilyInstanceReferenceType.CenterLeftRight)
	else :
		reference = element.GetReferences(reftype)
	name = element.GetReferenceName(reference[0])
	ref.append(reference[0])
	refname.append(name)
	sketch.append(SketchPlane.Create(doc,reference[0]))
TransactionManager.Instance.TransactionTaskDone()
OUT=ref,refname,sketch
# ----------------------------------------
code_block = CodeBlock(x=python_script) { x[0]; x[1]; x[2]; }
Reference = Output(code_block.out0)
ReferenceName = Output(code_block.out1)
SketchPlane = Output(code_block.out2)
