# Dynamo custom node FamilyInstance ReferenceType.dyf (Dynamo 1.3.4.6666)
# category: GeniusLoci.Reference
# Works only in Revit 2018.1 and later.
# Identifies references of family instances corresponding to reference planes and reference lines in the family.

familyInstanceReferenceType = Python()
# ---------- familyInstanceReferenceType.python (20 lines) ----------
#From Bakery
import clr
clr.AddReference('ProtoGeometry')
from Autodesk.DesignScript.Geometry import *

# Import DocumentManager and TransactionManager
clr.AddReference("RevitServices")
import RevitServices
from RevitServices.Persistence import DocumentManager
from RevitServices.Transactions import TransactionManager

# Import RevitAPI
clr.AddReference("RevitAPI")
import Autodesk
from Autodesk.Revit.DB import *
from Autodesk.Revit.DB import Structure
import System

#Assign your output to the OUT variable
OUT = System.Enum.GetValues(Autodesk.Revit.DB.FamilyInstanceReferenceType)
# ----------------------------------------
ReferenceType = Output(familyInstanceReferenceType)
