# Dynamo custom node FilledRegionType Pattern Change.dyf (Dynamo 1.3.3.4651)
# category: GeniusLoci.Graphics
# Change the pattern of a Filled Region Type to another given pattern.

FilledRegionType = Input()
FillPatternId = Input()  # As many FillPatternId as FilledRegionType
python_script = Python(IN[0]=FilledRegionType, IN[1]=FillPatternId)
# ---------- python_script.python (30 lines) ----------
#Alban de Chasteigner, 2018
#geniusloci.bim@gmail.com

import clr
clr.AddReference('RevitAPI')
import Autodesk
from Autodesk.Revit.DB import *

clr.AddReference('RevitServices')
import RevitServices
from RevitServices.Persistence import DocumentManager
from RevitServices.Transactions import TransactionManager
doc = DocumentManager.Instance.CurrentDBDocument

def tolist(obj1):
	if hasattr(obj1,"__iter__"): return obj1
	else: return [obj1]

Filledregion = tolist(UnwrapElement(IN[0]))

fillPatid = tolist(IN[1])

TransactionManager.Instance.EnsureInTransaction(doc)

for i,j in zip(Filledregion,fillPatid):
	i.FillPatternId=j

TransactionManager.Instance.TransactionTaskDone()

OUT = Filledregion
# ----------------------------------------
FilledRegionType_2 = Output(python_script)  # "FilledRegionType"
