# Dynamo custom node Get Hidden Element.dyf (Dynamo 1.3.3.4651)
# category: GeniusLoci.Element
# Reports the hidden elements in the given view.

Element = Input()
View = Input()
isHidden = Python(IN[0]=Element, IN[1]=View)
# ---------- isHidden.python (30 lines) ----------
import clr
clr.AddReference('RevitAPI')
from Autodesk.Revit.DB import *

clr.AddReference("RevitNodes")
import Revit
clr.ImportExtensions(Revit.Elements)

clr.AddReference("RevitServices")
import RevitServices
from RevitServices.Persistence import DocumentManager
doc = DocumentManager.Instance.CurrentDBDocument

def toList(obj):
    if hasattr(obj, '__iter__'): return obj
    else: return [obj]

elements = toList(UnwrapElement(IN[0]))
views = toList(UnwrapElement(IN[1]))
elementsHidden = []
elementsNotHidden = []

for view in views:
	for element in elements:
		if element.IsHidden(view) is True:
			elementsHidden.append(element)
		else:
			elementsNotHidden.append(element)

OUT = elementsHidden, elementsNotHidden
# ----------------------------------------
code_block = CodeBlock(x=isHidden) { x[0]; x[1]; }
Hidden_element = Output(code_block.out0)
Not_hidden_element = Output(code_block.out1)
