# Dynamo custom node Get Phase Map.dyf (Dynamo 1.3.3.4651)
# category: GeniusLoci.Phase
# Works only in Revit 2019 and later.
# The node returns a mapping between phases in the host document and phases in the linked document.

revitLinkInstance = Input()  # Singleton
getphasemap_method = Python(IN[0]=revitLinkInstance)
# ---------- getphasemap_method.python (44 lines) ----------
#ElementById from package Clockwork
#By Alban de CHasteigner, 2018
import clr
clr.AddReference('RevitAPI')
import Autodesk
from Autodesk.Revit.DB import *
from Autodesk.Revit.Attributes import*

clr.AddReference("RevitServices")
import RevitServices
from RevitServices.Persistence import DocumentManager
from RevitServices.Transactions import TransactionManager

clr.AddReference("RevitNodes")
import Revit
clr.ImportExtensions(Revit.Elements)

doc = DocumentManager.Instance.CurrentDBDocument

def ElementById(item, doc):
	try: 
		return doc.GetElement(item).ToDSType(True)
	except:
		try:
			return doc.GetElement(ElementId(item)).ToDSType(True)
		except:
			return None

revitlinkinstance = IN[0]
phasemaps = []
revitlinktypes = []
values = []
keys = []
value = [] 

revitlinktype=doc.GetElement(revitlinkinstance.GetTypeId())
phasemap=revitlinktype.GetPhaseMap()
for phase in phasemap:
	phasemaps.append(phase)
	keys.append(ElementById((phase.Key),doc))
	values.append(ElementById((phase.Value),doc))
	value.append(phase.Value)
	
OUT = revitlinktype,phasemaps,keys,values,value
# ----------------------------------------
code_block = CodeBlock(x=getphasemap_method) { x[0]; x[1]; x[2]; x[3]; x[4]; }
RevitLinkType = Output(code_block.out0)
Phase_Map_ID_KeyValuePair = Output(code_block.out1)
Phases_in_the_host = Output(code_block.out2)
Phases_in_the_link = Output(code_block.out3)
Phases_ID_in_the_link = Output(code_block.out4)
