# Dynamo custom node Get ScheduleView.dyf (Dynamo 1.3.3.4651)
# category: GeniusLoci.Schedule
# Get Schedule View from ScheduleSheetInstance.

ScheduleSheetInstance = Input()
get_schedule_view = Python(IN[0]=ScheduleSheetInstance)
# ---------- get_schedule_view.python (42 lines) ----------
import clr
clr.AddReference('ProtoGeometry')
from Autodesk.DesignScript.Geometry import *

# Import ToDSType(bool) extension method
clr.AddReference("RevitNodes")
import Revit
clr.ImportExtensions(Revit.Elements)

# Import DocumentManager and TransactionManager
clr.AddReference("RevitServices")
import RevitServices
from RevitServices.Persistence import DocumentManager
from RevitServices.Transactions import TransactionManager

from System.Collections.Generic import *

# Import RevitAPI
clr.AddReference("RevitAPI")
import Autodesk
from Autodesk.Revit.DB import *

doc = DocumentManager.Instance.CurrentDBDocument
uiapp = DocumentManager.Instance.CurrentUIApplication
app = uiapp.Application

import sys
pyt_path = r'C:\Program Files (x86)\IronPython 2.7\Lib'
sys.path.append(pyt_path)

sheet_views = UnwrapElement(IN[0])
onSheets, allScheds = [], []

# Code
for s in sheet_views:
	onSheets.append(s.ScheduleId)

for n in onSheets:
	sched = doc.GetElement(n)
	allScheds.append(sched)
	
OUT = allScheds
# ----------------------------------------
Schedule_View = Output(get_schedule_view)
