# Dynamo custom node Get SystemType Properties.dyf (Dynamo 1.3.4.6666)
# category: GeniusLoci.System
# Returns the Mechanical or Piping System Type, the system classification, the abbreviation, the system line weight, color, pattern and the system material.

ElementOrSystemType = Input()
systemtype_properties = Python(IN[0]=ElementOrSystemType)
# ---------- systemtype_properties.python (51 lines) ----------
#Alban de Chasteigner 2018
#twitter : @geniusloci_bim
#geniusloci.bim@gmail.com

import clr
clr.AddReference("RevitServices")
import RevitServices
from RevitServices.Persistence import DocumentManager
from RevitServices.Transactions import TransactionManager
doc = DocumentManager.Instance.CurrentDBDocument

clr.AddReference("RevitAPI")
import Autodesk
from Autodesk.Revit.DB import *

clr.AddReference("RevitNodes")
import Revit
clr.ImportExtensions(Revit.Elements)
clr.ImportExtensions(Revit.GeometryConversion)

clr.AddReference('DSCoreNodes')
import DSCore
from DSCore import Color

elements = UnwrapElement(IN[0])
if not hasattr(elements, '__iter__'):
    elements = [elements]

systype,name,classification,abbreviation,lineWeight,lineColor,linePattern,material=[],[],[],[],[],[],[],[]

for elem in elements:
	if isinstance(elem, Autodesk.Revit.DB.ElementType):
		systype=elements
	else:
		try :
			system = elem.get_Parameter(BuiltInParameter.RBS_PIPING_SYSTEM_TYPE_PARAM).AsElementId()
		
		except :
			system = elem.get_Parameter(BuiltInParameter.RBS_DUCT_SYSTEM_TYPE_PARAM).AsElementId()
		systype.append(doc.GetElement(system))

for i in systype :
	name.append(i.ToDSType(True).Name)
	classification.append(i.SystemClassification)
	abbreviation.append(i.Abbreviation)
	lineWeight.append(i.LineWeight)
	lineColor.append(DSCore.Color.ByARGB(255, i.LineColor.Red, i.LineColor.Green, i.LineColor.Blue))
	linePattern.append(doc.GetElement(i.LinePatternId))
	material.append(doc.GetElement(i.MaterialId))

OUT = systype,name,classification,abbreviation,lineWeight,lineColor,linePattern,material
# ----------------------------------------
code_block = CodeBlock(x=systemtype_properties) { x[0]; x[1]; x[2]; x[3]; x[4]; x[5]; x[6]; x[7]; }
SystemType = Output(code_block.out0)
SystemTypeName = Output(code_block.out1)
Classification = Output(code_block.out2)
Abbreviation = Output(code_block.out3)
LineWeight = Output(code_block.out4)
LineColor = Output(code_block.out5)
LinePattern = Output(code_block.out6)
Material = Output(code_block.out7)
