# Dynamo custom node Material Change Image and Edit it.dyf (Dynamo 1.3.3.4651)
# category: GeniusLoci.Material
# Works only in Revit 2018.1 and later.
# The material must already have an assigned texture.
# Change the image and edit its properties.
# (Inputs are converted in metric units.)

Material = Input()
FilePath = Input()
Offset_X = Input()
Offset_Y = Input()
Rotation = Input()
Scale_Widht = Input()
Scale_Height = Input()
ScaleLock = Input(ScaleLock : bool = false)
material_change_image_and_edit = Python(IN[0]=Material, IN[1]=FilePath, IN[2]=Offset_X, IN[3]=Offset_Y, IN[4]=Rotation, IN[5]=Scale_Widht, IN[6]=Scale_Height, IN[7]=ScaleLock)
# ---------- material_change_image_and_edit.python (59 lines) ----------
#Inspired by Boris Shafiro from Autodesk
#https://apidocs.co/apps/revit/2019/2e09391a-6aec-f47f-a4e6-bf354bb8629f.htm

import clr
clr.AddReference('RevitAPI')
from Autodesk.Revit.DB import *
from Autodesk.Revit.DB.Visual import *

clr.AddReference('RevitServices')
import RevitServices
from RevitServices.Persistence import DocumentManager
from RevitServices.Transactions import TransactionManager
doc = DocumentManager.Instance.CurrentDBDocument

def toList(obj):
    if hasattr(obj, '__iter__'): return obj
    else: return [obj]
    
mats = toList(UnwrapElement(IN[0]))
paths = toList(IN[1])
#Convert millimeters to inches
offsetX = IN[2]/25.4
offsetY = IN[3]/25.4
angle = IN[4]
scaleWidht = IN[5]/25.4
scaleHeight = IN[6]/25.4
scaleLock = IN[7]

for mat, path in zip(mats, paths):
	assetElem = doc.GetElement(mat.AppearanceAssetId)
	TransactionManager.Instance.EnsureInTransaction(doc)
	with Visual.AppearanceAssetEditScope(assetElem.Document) as editScope:
		editableAsset = editScope.Start(assetElem.Id)
		BitMapLocation = editableAsset[UnifiedBitmap.UnifiedbitmapBitmap] 
		#AssetProperty String Object
		BitMapLocation.Value = path

		BitmapOffsetX = editableAsset[UnifiedBitmap.TextureRealWorldOffsetX]
		BitmapOffsetX.Value = offsetX

		BitmapOffsetY = editableAsset[UnifiedBitmap.TextureRealWorldOffsetY]
		BitmapOffsetY.Value = offsetY
		
		TextureWAngle = editableAsset[UnifiedBitmap.TextureWAngle]
		TextureWAngle.Value = angle
		
		BitmapscaleX = editableAsset[UnifiedBitmap.TextureRealWorldScaleX]
		BitmapscaleX.Value = scaleWidht

		BitmapScaleY = editableAsset[UnifiedBitmap.TextureRealWorldScaleY]
		BitmapScaleY.Value = scaleHeight

		Scalelock = editableAsset[UnifiedBitmap.TextureScaleLock]
		Scalelock.Value = scaleLock

		editScope.Commit(IFailuresPreprocessor)
	TransactionManager.Instance.TransactionTaskDone()

OUT = mats
# ----------------------------------------
Material_2 = Output(material_change_image_and_edit)  # "Material"
