# Dynamo custom node Material Change Texture Path.dyf (Dynamo 1.3.3.4651)
# category: GeniusLoci.Material
# Works only in Revit 2018.1 and later.
# The material must already have an assigned texture.

Material = Input()
FilePath = Input()
change_picture = Python(IN[0]=Material, IN[1]=FilePath)
# ---------- change_picture.python (35 lines) ----------
#Inspired by Boris Shafiro from Autodesk
#Alban de Chasteigner 2018
#twitter : @geniusloci_bim
#geniusloci.bim@gmail.com

import clr
clr.AddReference('RevitAPI')
from Autodesk.Revit.DB import *
clr.AddReference('RevitServices')
import RevitServices
from RevitServices.Persistence import DocumentManager
from RevitServices.Transactions import TransactionManager
doc = DocumentManager.Instance.CurrentDBDocument

def toList(obj):
    if hasattr(obj, '__iter__'): return obj
    else: return [obj]
    
mats = toList(UnwrapElement(IN[0]))
paths = toList(IN[1])

for mat, path in zip(mats, paths):
	appearanceAssetId = mat.AppearanceAssetId
	assetElem = doc.GetElement(appearanceAssetId)
	TransactionManager.Instance.EnsureInTransaction(doc)
	with Visual.AppearanceAssetEditScope(assetElem.Document) as editScope:
		editableAsset = editScope.Start(assetElem.Id)
		genericDiffuseProperty = editableAsset.FindByName("generic_diffuse")
		connectedAsset = genericDiffuseProperty.GetSingleConnectedAsset()
		bitmapProperty = connectedAsset["unifiedbitmap_Bitmap"]
		bitmapProperty.Value = path
		editScope.Commit(True)
	TransactionManager.Instance.TransactionTaskDone()

OUT = mats
# ----------------------------------------
Material_2 = Output(change_picture)  # "Material"
