# Dynamo custom node Material Set Render Appearance Color.dyf (Dynamo 1.3.3.4651)
# category: GeniusLoci.Material
# Works only in Revit 2018.1 and later.
# Copies the value of the graphic color into the rendering color of the Appearance Asset Element.

Material = Input()
set_appearance_color = Python(IN[0]=Material)
# ---------- set_appearance_color.python (32 lines) ----------
#Inspired by Boris Shafiro from Autodesk
#Alban de Chasteigner 2018
#twitter : @geniusloci_bim
#geniusloci.bim@gmail.com

import clr
clr.AddReference('RevitAPI')
from Autodesk.Revit.DB import *
clr.AddReference('RevitServices')
import RevitServices
from RevitServices.Persistence import DocumentManager
from RevitServices.Transactions import TransactionManager
doc = DocumentManager.Instance.CurrentDBDocument

def tolist(obj):
    if hasattr(obj, '__iter__'): return obj
    else: return [obj]

materials = tolist(UnwrapElement(IN[0]))

for mat in materials :
	appearanceAssetId = mat.AppearanceAssetId
	assetElem = doc.GetElement(appearanceAssetId)
	TransactionManager.Instance.EnsureInTransaction(doc)
	with Visual.AppearanceAssetEditScope(assetElem.Document) as editScope:
		editableAsset = editScope.Start(assetElem.Id)
		genericDiffuseProperty = editableAsset.FindByName("generic_diffuse")
		genericDiffuseProperty.SetValueAsColor(mat.Color)
		editScope.Commit(True)
	TransactionManager.Instance.TransactionTaskDone()

OUT = materials
# ----------------------------------------
Material_2 = Output(set_appearance_color)  # "Material"
