# Dynamo custom node Override FillPattern in View.dyf (Dynamo 1.3.3.4651)
# category: GeniusLoci.Graphics
# Works only in Revit 2019 and later.
# Overrides Fill Pattern of given element in a given view to specified Fill Pattern and color.

Element = Input()
View = Input(View:var[]..[] = Revit.Application.Document.Current.ActiveView)
SurfaceForegroundPatternColor = Input(SurfaceForegroundPatternColor:var[]..[] = DSCore.Color.ByARGB(255,255,255,255))  # Dynamo Color
SurfaceForegroundPattern = Input(SurfaceForegroundPattern:var[]..[]=FillPatternElement.GetByName("<Solid fill>", "Drafting"))
CutForegroundPatternColor = Input(CutForegroundPatternColor:var[]..[] = DSCore.Color.ByARGB(255,255,255,255))  # Dynamo Color
CutForegroundPattern = Input(CutForegroundPattern:var[]..[]=FillPatternElement.GetByName("<Solid fill>", "Drafting"))
python_script = Python(IN[0]=Element, IN[1]=View, IN[2]=SurfaceForegroundPatternColor, IN[3]=SurfaceForegroundPattern, IN[4]=CutForegroundPatternColor, IN[5]=CutForegroundPattern)
# ---------- python_script.python (52 lines) ----------
import clr

#Import the Revit API
clr.AddReference('RevitAPI')
import Autodesk
from Autodesk.Revit.DB import *

#Import DocumentManager and TransactionManager
clr.AddReference('RevitServices')
import RevitServices
from RevitServices.Persistence import DocumentManager
from RevitServices.Transactions import TransactionManager

#Reference the active Document and application
doc = DocumentManager.Instance.CurrentDBDocument
#Start scripting here:
def tolist(obj1):
	if hasattr(obj1,"__iter__"): return obj1
	else: return [obj1]
	
def ConvertColor(e):
	return Autodesk.Revit.DB.Color(e.Red, e.Green, e.Blue)

elems = tolist(UnwrapElement(IN[0]))
views = tolist(UnwrapElement(IN[1]))
surfaceForePatcolors = tolist(ConvertColor(IN[2]))
surfaceForePats = tolist(UnwrapElement(IN[3]))
cutForePatcolors = tolist(ConvertColor(IN[4]))
cutForePats = tolist(UnwrapElement(IN[5]))
output = []

for surfaceForePatcolor, surfaceForePat,cutForePatcolor,cutForePat in zip(surfaceForePatcolors,surfaceForePats,cutForePatcolors,cutForePats):
#Create the OverridesGraphicsSettings
	ogs = OverrideGraphicSettings()
	ogs.SetSurfaceForegroundPatternColor(surfaceForePatcolor)
	ogs.SetSurfaceForegroundPatternId(surfaceForePat.Id)
	ogs.SetSurfaceForegroundPatternVisible(True)
	ogs.SetCutForegroundPatternColor(cutForePatcolor)
	ogs.SetCutForegroundPatternId(cutForePat.Id)
	ogs.SetCutForegroundPatternVisible(True)
#Transaction start:
TransactionManager.Instance.EnsureInTransaction(doc)

for i in views:
	for j in elems:
		output.append(i.SetElementOverrides(j.Id, ogs))	

#Transaction end:
TransactionManager.Instance.TransactionTaskDone()

#Assign your output to the OUT variable.
OUT = elems
# ----------------------------------------
Element_2 = Output(python_script)  # "Element"
