# Dynamo custom node SelectByCategoryAndLevel.dyf (Dynamo 1.3.3.4651)
# category: GeniusLoci.Select
# Select Elements by Category and Level.
# With a document input, use with the Level Collector node to get the level input.
# Inspired by archilab

Level = Input()  # Collected level in active or linked document
Category = Input()
docOrRevitLinkInstance = Input(docOrRevitLinkInstance : var = null)  # Use only if you want to query a linked model
selectByCategoryAndLevel = Python(IN[0]=Level, IN[1]=Category, IN[2]=docOrRevitLinkInstance)
# ---------- selectByCategoryAndLevel.python (60 lines) ----------
#Copyright(c) 2014, Konrad K Sobon
# Grimshaw Architects, http://grimshaw-architects.com/
# Archi-lab, http://wwww.archi-lab.net

# Default imports
import clr
clr.AddReference('ProtoGeometry')
from Autodesk.DesignScript.Geometry import *

# Import RevitAPI
clr.AddReference("RevitAPI")
import Autodesk
from Autodesk.Revit.DB import *

# Import DocumentManager and TransactionManager
clr.AddReference("RevitServices")
import RevitServices
from RevitServices.Persistence import DocumentManager
from RevitServices.Transactions import TransactionManager

# Import ToDSType(bool) extension method
clr.AddReference("RevitNodes")
import Revit
clr.ImportExtensions(Revit.Elements)
clr.ImportExtensions(Revit.GeometryConversion)

#Import Collections
from System.Collections.Generic import *
import System

#The inputs to this node will be stored as a list in the IN variable.
dataEnteringNode = IN

def tolist(x):
    if hasattr(x,'__iter__'): return x
    else : return [x]

levelInput = tolist(UnwrapElement(IN[0]))
cats = tolist(IN[1])
inputdocs = tolist(UnwrapElement(IN[2]))
catlist = []

#Part of script from Clockwork
for inputdoc in inputdocs :
	if inputdoc == None:
		doc = DocumentManager.Instance.CurrentDBDocument
	elif inputdoc.GetType().ToString() == "Autodesk.Revit.DB.Document":
		doc = inputdoc
	elif inputdoc.GetType().ToString() == "Autodesk.Revit.DB.RevitLinkInstance":
		doc = inputdoc.GetLinkDocument()
	else: doc = None


for cat in cats:
	bic = System.Enum.ToObject(BuiltInCategory, cat.Id)
	for levelIn in levelInput :
		levelFilter = ElementLevelFilter(levelIn.Id)
		catlist.append(FilteredElementCollector(doc).WherePasses(levelFilter).OfCategory(bic).ToElements())		
	
OUT=catlist
# ----------------------------------------
Element = Output(selectByCategoryAndLevel)
