# Dynamo custom node Set SubCategory ProjectionLineweight.dyf (Dynamo 1.3.3.4651)
# category: GeniusLoci.Graphics
# Assigns Line Weight, Line Pattern and Line Color to the Projection Lines of the specified subcategory.

Category = Input()
ProjectionLineWeight = Input(ProjectionLineWeight:var[]..[]=1)  # Integer
LinePatternName = Input(LinePatternName:var[]..[]= "Centre")  # String
color = Input(color:var[]..[]= DSCore.Color.ByARGB(0,0,0,0))  # Dynamo Color
python_script = Python(IN[0]=Category, IN[1]=ProjectionLineWeight, IN[2]=LinePatternName, IN[3]=color)
# ---------- python_script.python (41 lines) ----------
#Alban de Chasteigner 2018
#twitter : @geniusloci_bim
#geniusloci.bim@gmail.com

import clr
clr.AddReference('RevitAPI')
import Autodesk
from Autodesk.Revit.DB import *

clr.AddReference("RevitNodes")
import Revit
clr.ImportExtensions(Revit.Elements)

clr.AddReference("RevitServices")
import RevitServices
from RevitServices.Persistence import DocumentManager
from RevitServices.Transactions import TransactionManager

doc = DocumentManager.Instance.CurrentDBDocument
cat = UnwrapElement(IN[0])
subcat = cat.SubCategories
NewlineWeight=IN[1]
linePatternName=IN[2]
listout = []

pattern = Autodesk.Revit.DB.LinePatternElement.GetLinePatternElementByName(doc,linePatternName)

# "Start" the transaction
TransactionManager.Instance.EnsureInTransaction(doc)

for i in subcat:
	weight = i.SetLineWeight(NewlineWeight,GraphicsStyleType.Projection)
	i.LineColor = Color(IN[3].Red, IN[3].Green, IN[3].Blue)
	linePattern = i.SetLinePatternId(pattern.Id,GraphicsStyleType.Projection)
	style = i.GetGraphicsStyle(GraphicsStyleType.Projection)
	listout.append(style)
	
# "End" the transaction
TransactionManager.Instance.TransactionTaskDone()

OUT = listout, NewlineWeight, linePatternName, IN[3]
# ----------------------------------------
code_block = CodeBlock(x=python_script) { x[0]; x[1]; x[2]; x[3]; }
Graphic_Style = Output(code_block.out0)
Line_Weight = Output(code_block.out1)
Line_Pattern = Output(code_block.out2)
Line_Color = Output(code_block.out3)
