# Dynamo custom node SetParameterByName in Document.dyf (Dynamo 1.3.3.4651)
# category: GeniusLoci.Parameter
# Set the element value by name from a specific document.

element = Input(element : var[]..[])
parameterName = Input(parameterName : string[]..[])
value = Input(value : var[]..[])
Document = Input()
python_script = Python(IN[0]=element, IN[1]=parameterName, IN[2]=value, IN[3]=Document)
# ---------- python_script.python (41 lines) ----------
import clr

clr.AddReference("RevitAPI")
import Autodesk
from Autodesk.Revit.DB import *
from Autodesk.Revit.DB.ExternalService import *
from Autodesk.Revit.DB.ExtensibleStorage import *
from System.Collections.Generic import *

clr.AddReference('ProtoGeometry')
from Autodesk.DesignScript.Geometry import *

clr.AddReference("RevitNodes")
import Revit
clr.ImportExtensions(Revit.Elements)
clr.ImportExtensions(Revit.GeometryConversion)

clr.AddReference("RevitServices")
import RevitServices
from RevitServices.Persistence import DocumentManager
from RevitServices.Transactions import TransactionManager
from System.Collections.Generic import *

def tolist(obj1):
	if hasattr(obj1,"__iter__"): return obj1
	else: return [obj1]

elements=IN[0]
parameter_names = IN[1]
values = IN[2]
docs = tolist(IN[3])

for doc in docs:
	t = Transaction(doc,'set')
	t.Start()

for e, v in zip(elements, values):
	e.SetParameterByName(parameter_names,v)
t.Commit()
#Assign your output to the OUT variable.
OUT = elements, doc
# ----------------------------------------
code_block = CodeBlock(x=python_script) { x[0]; x[1]; }
Element = Output(code_block.out0)
Document_2 = Output(code_block.out1)  # "Document"
