# Dynamo custom node Unload RevitLinkInstance.dyf (Dynamo 1.3.3.4651)
# category: GeniusLoci.Import
# Unloads the Revit link provided.
# Based on a Einar Raknes's script.

RevitLinkInstance = Input()
unload_link = Python(IN[0]=RevitLinkInstance)
# ---------- unload_link.python (39 lines) ----------
# Code by Einar Raknes, 2017
import clr
# Import List ( ICollection(ElementId) = List[ElementId]() )
clr.AddReference('System')
from System.Collections.Generic import List

# Import Revit API
clr.AddReference('RevitAPI')
from Autodesk.Revit.DB import *
from Autodesk.Revit.DB.Structure import *

clr.AddReference('RevitAPIUI')
from Autodesk.Revit.UI import *

# Import ToDSType(bool) extension method
clr.AddReference('RevitNodes')
import Revit
clr.ImportExtensions(Revit.GeometryConversion)
clr.ImportExtensions(Revit.Elements)

# Import DocumentManager and TransactionManager
clr.AddReference('RevitServices')
import RevitServices
from RevitServices.Persistence import DocumentManager
from RevitServices.Transactions import TransactionManager

doc = DocumentManager.Instance.CurrentDBDocument
uidoc = DocumentManager.Instance.CurrentUIApplication.ActiveUIDocument
app = DocumentManager.Instance.CurrentUIApplication.Application

linkInst = UnwrapElement(IN[0])

TransactionManager.Instance.ForceCloseTransaction()

for link in linkInst:
	linkType = doc.GetElement(link.GetTypeId())
	linkType.Unload(None)

OUT=linkInst
# ----------------------------------------
RevitLinkInstance_2 = Output(unload_link)  # "RevitLinkInstance"
