# Dynamo custom node Unload RevitLinkType in Document.dyf (Dynamo 1.3.3.4651)
# category: GeniusLoci.Import
# Unloads all Revit links in a document Revit.
# Based on a Ben Osborne's script.

Document = Input()
python_script = Python(IN[0]=Document)
# ---------- python_script.python (35 lines) ----------
#From Ben_Osborne
import clr
clr.AddReference('RevitAPI')
import Autodesk
from Autodesk.Revit.DB import *
from Autodesk.Revit.Attributes import*

clr.AddReference("RevitServices")
import RevitServices
from RevitServices.Persistence import DocumentManager
from RevitServices.Transactions import TransactionManager

clr.AddReference("RevitNodes")
import Revit
clr.ImportExtensions(Revit.Elements)

dataEnteringNode = IN

def tolist(x):
    if hasattr(x,'__iter__'): return x
    else : return [x]

docs = tolist(IN[0])

revitlinktypes=[]
for doc in docs:
    linkcollector=FilteredElementCollector(doc).OfClass(RevitLinkInstance)

TransactionManager.Instance.ForceCloseTransaction()
for link in linkcollector:
	rlt=doc.GetElement(link.GetTypeId())
	revitlinktypes.append(rlt)
	rlt.Unload(None)
	
OUT= docs,revitlinktypes
# ----------------------------------------
code_block = CodeBlock(x=python_script) { x[0]; x[1]; }
Document_2 = Output(code_block.out0)  # "Document"
RevitLinkType = Output(code_block.out1)
