# Dynamo custom node View Properties.dyf (Dynamo 1.3.3.4651)
# category: GeniusLoci.View
# Returns certain properties of given views.

View = Input()
python_script = Python(IN[0]=View)
# ---------- python_script.python (30 lines) ----------
#Inspired by Clockwork

import clr
clr.AddReference('RevitAPI')
from Autodesk.Revit.DB import *

def Name(view):
	if hasattr(view, "Name"): return view.Name
	else: return None

def Scale(view):
	if hasattr(view, "Scale"): return str(view.Scale)
	else: return None

def DetailLevel(view):
	if hasattr(view, "DetailLevel"): return str(view.DetailLevel)
	else: return None

def DisplayStyle(view):
	if hasattr(view, "DisplayStyle"): return str(view.DisplayStyle)
	else: return None
	
def Discipline(view):
	if hasattr(view, "Discipline"): return str(view.Discipline)
	else: return None	

views = UnwrapElement(IN[0])

if isinstance(IN[0], list): OUT = [Name(x) for x in views],[Scale(x) for x in views],[DetailLevel(x) for x in views],[DisplayStyle(x) for x in views],[Discipline(x) for x in views]
else: OUT = Name(views),Scale(views),DetailLevel(views),DisplayStyle(views),Discipline(views)
# ----------------------------------------
code_block = CodeBlock(x=python_script) { x[0]; x[1]; x[2]; x[3]; x[4]; }
View_Name = Output(code_block.out0)
View_Scale = Output(code_block.out1)
Detail_Level = Output(code_block.out2)
Visual_Style = Output(code_block.out3)
Discipline = Output(code_block.out4)
