# Dynamo custom node LunchBox AreaPlan Element Collector.dyf (Dynamo 1.2.0.2690)
# category: LunchBox.Revit.Elements
# Collects AreaPlans from the Revit model

Toggle = Input()
AreaScheme = Input()
python_script = Python(IN[0]=Toggle, IN[1]=AreaScheme)
# ---------- python_script.python (77 lines) ----------
#Copyright(c) 2014, Nathan Miller
# The Proving Ground, http://theprovingground.org

import clr

# Import RevitAPI
clr.AddReference("RevitAPI")
import Autodesk
from Autodesk.Revit.DB import *

# Import DocumentManager and TransactionManager
clr.AddReference("RevitServices")
import RevitServices
from RevitServices.Persistence import DocumentManager
from RevitServices.Transactions import TransactionManager

# Import ToDSType(bool) extension method
clr.AddReference("RevitNodes")
import Revit
clr.ImportExtensions(Revit.Elements)
clr.ImportExtensions(Revit.GeometryConversion)

#The input to this node will be stored in the IN[0] variable.

doc =  DocumentManager.Instance.CurrentDBDocument

toggle = IN[0]
schemeName = IN[1]

output = []
views = []
names = []
elementids = []
uniqueids = []

if toggle == True:

	collector = FilteredElementCollector(doc)
	collector.OfCategory(BuiltInCategory.OST_Views)
	collector.OfClass(View)
 
	famtypeitr = collector.GetElementIdIterator()
	famtypeitr.Reset()

	for item in famtypeitr:
		famtypeID = item
		faminst = doc.GetElement(famtypeID)
		
		if faminst.ViewType == ViewType.AreaPlan:
			if (faminst.AreaScheme.Name == schemeName):
				view = faminst
				name = faminst.Name
				elementid = faminst.Id
				uniqueid = faminst.UniqueId
				
				views.append(view)
				names.append(name)
				elementids.append(elementid)
				uniqueids.append(uniqueid)
			if (schemeName == "*"):
				view = faminst
				name = faminst.Name
				elementid = faminst.Id
				uniqueid = faminst.UniqueId
				
				views.append(view)
				names.append(name)
				elementids.append(elementid)
				uniqueids.append(uniqueid)
        
	output.append(views)
	output.append(names)
	output.append(elementids)
	output.append(uniqueids)
        
#Assign your output to the OUT variable
OUT = output
# ----------------------------------------
number = DoubleInput(0)
getItemAtIndex = List.GetItemAtIndex(list=python_script, index=number)
View = Output(getItemAtIndex)
number_2 = DoubleInput(1)
getItemAtIndex_2 = List.GetItemAtIndex(list=python_script, index=number_2)
Name = Output(getItemAtIndex_2)
number_3 = DoubleInput(2)
getItemAtIndex_3 = List.GetItemAtIndex(list=python_script, index=number_3)
ElementID = Output(getItemAtIndex_3)
number_4 = DoubleInput(3)
getItemAtIndex_4 = List.GetItemAtIndex(list=python_script, index=number_4)
UniqueID = Output(getItemAtIndex_4)
