# Dynamo custom node LunchBox Diagrid Structure.dyf (Dynamo 0.7.5.3566)
# category: LunchBox.Archive.Geometry.Structure
# Creates a diagrid structure on a surface.

Surface = Input()
U = Input()
lunchbox_list_matcher = Custom[LunchBox List Matcher](ListA=Surface, ListB=U)  # Compares a List A against a List B and matches length of List A. If ListA > ListB, ListB will be extended. If ListA < ListB, ListB will be truncated.
V = Input()
lunchbox_list_matcher_2 = Custom[LunchBox List Matcher](ListA=Surface, ListB=V)
TypeBool = Input()
lunchbox_list_matcher_3 = Custom[LunchBox List Matcher](ListA=Surface, ListB=TypeBool)
python_script = Python(IN[0]=lunchbox_list_matcher.ListA, IN[1]=lunchbox_list_matcher.MatchListB, IN[2]=lunchbox_list_matcher_2.MatchListB, IN[3]=lunchbox_list_matcher_3.MatchListB)
# ---------- python_script.python (56 lines) ----------
#Copyright(c) 2014, Nathan Miller
# The Proving Ground, http://theprovingground.org

import clr
clr.AddReference('ProtoGeometry')
from Autodesk.DesignScript.Geometry import *

# Panel division class
class CenterlineDivision:
	
	# divide surface
	def DiagridDivision(self, srf, udiv, vdiv, bool):
		lns = []
	
		ustep = 1.0/udiv
		vstep = 1.0/vdiv

		for i in range(0,int(udiv)+1):
			for j in range(0,int(vdiv)+1):
				
				if (i+j)%2 == bool and i<udiv:
					ptA = srf.PointAtParameter(i*ustep, j*vstep)
					if j>0:
						ptB = srf.PointAtParameter((i+1)*ustep,(j-1)*vstep)
						ln = Line.ByStartPointEndPoint(ptA, ptB)
						lns.append(ln)
					if j<vdiv:
						ptB = srf.PointAtParameter((i+1)*ustep,(j+1)*vstep)
						ln = Line.ByStartPointEndPoint(ptA,ptB)
						lns.append(ln)
		self.lns = lns

#main code here....
srf = IN[0]
udiv = IN[1]
vdiv = IN[2]
bool = IN[3]

ls = []
lns = []
	
for k in range(0, len(srf)):

	s = srf[k]
	u = udiv[k]
	v = vdiv[k]
	b = bool[k]
			
	divide = CenterlineDivision()
	divide.DiagridDivision(s,u,v,b)
					
	ls.append(divide.lns)

lns.append(ls)

OUT = lns
# ----------------------------------------
Centerlines = Output(python_script)
