# Dynamo custom node LunchBox Grid Structure.dyf (Dynamo 0.7.5.3566)
# category: LunchBox.Archive.Geometry.Structure
# Creates a grid wireframe on a surface.

Surface = Input()
U = Input()
lunchbox_list_matcher = Custom[LunchBox List Matcher](ListA=Surface, ListB=U)  # Compares a List A against a List B and matches length of List A. If ListA > ListB, ListB will be extended. If ListA < ListB, ListB will be truncated.
V = Input()
lunchbox_list_matcher_2 = Custom[LunchBox List Matcher](ListA=Surface, ListB=V)
python_script = Python(IN[0]=lunchbox_list_matcher.ListA, IN[1]=lunchbox_list_matcher.MatchListB, IN[2]=lunchbox_list_matcher_2.MatchListB)
# ---------- python_script.python (65 lines) ----------
#Copyright(c) 2014, Nathan Miller
# The Proving Ground, http://theprovingground.org

import clr
clr.AddReference('ProtoGeometry')
from Autodesk.DesignScript.Geometry import *

# Panel division class
class CenterlineDivision:
	
	# divide surface
	def GridDivision(self, srf, udiv, vdiv):
		lnsA = []
		lnsB = []
	
		ustep = 1.0/udiv
		vstep = 1.0/vdiv
	
		for i in range(0,int(udiv)+1):
			for j in range(0,int(vdiv)+1):
				lnB = []
				lnA = []
				
				ptA = srf.PointAtParameter(i*ustep, j*vstep)
				if i<udiv:
					ptB = srf.PointAtParameter((i+1)*ustep, j*vstep)
					lnA.append(ptA)
					lnA.append(ptB)
					
					ln = Line.ByBestFitThroughPoints(lnA)
					lnsA.append(ln)
				if j<vdiv:
					ptB = srf.PointAtParameter(i*ustep, (j+1)*vstep)
					lnB.append(ptA)
					lnB.append(ptB)
					ln = Line.ByBestFitThroughPoints(lnB)
					lnsB.append(ln)
		self.lnsA = lnsA
		self.lnsB = lnsB

#main code here....
srf = IN[0]
udiv = IN[1]
vdiv = IN[2]

lnsA = []
lnsB = []
lns = []
	
for k in range(0, len(srf)):

	s = srf[k]
	u = udiv[k]
	v = vdiv[k]
			
	divide = CenterlineDivision()
	divide.GridDivision(s,u,v)
					
	lnsA.append(divide.lnsA)
	lnsB.append(divide.lnsB)

lns.append(lnsA)
lns.append(lnsB)

OUT = lns
# ----------------------------------------
number = DoubleInput(0)
getItemAtIndex = List.GetItemAtIndex(python_script, number)
Centerlines_A = Output(getItemAtIndex)
number_2 = DoubleInput(1)
getItemAtIndex_2 = List.GetItemAtIndex(python_script, number_2)
Centerlines_B = Output(getItemAtIndex_2)
