# Dynamo custom node LunchBox Isovist.dyf (Dynamo 1.0.0.1180)
# category: LunchBox.Archive.Geometry.Intersection
# Isovist Ray Generation

locationPoint = Input(locationPoint : Geometry)
sortByKey = List.SortByKey()
radius = Input(radius : double)
byCenterPointRadius = Circle.ByCenterPointRadius(centerPoint=locationPoint, radius=radius)
number = DoubleInput(60)
divideCurve = Geometry.Curves.DivideCurve(byCenterPointRadius, number)
flatten = Flatten(divideCurve)
byStartPointEndPoint = Line.ByStartPointEndPoint(startPoint=locationPoint, endPoint=flatten, lacing=CrossProduct)
boundaries = Input(boundaries : Geometry[])
findIntersections = Geometry.Intersection.FindIntersections(byStartPointEndPoint, boundaries)
startPoint = Curve.StartPoint(findIntersections)
number_2 = DoubleInput(1)
flatten_2 = List.Flatten(list=startPoint, amt=number_2)
distanceTo = Geometry.DistanceTo(geometry=locationPoint, other=startPoint)
number_3 = DoubleInput(1)
flatten_3 = List.Flatten(list=distanceTo, amt=number_3)
combine = List.Combine(sortByKey.sorted_list, flatten_2, flatten_3)
number_4 = DoubleInput(0)
getItemAtIndex = List.GetItemAtIndex(index=number_4)
map = List.Map(list=combine, f_x=getItemAtIndex)
removeNulls = Lists.Manage.RemoveNulls(map)
byStartPointEndPoint_2 = Line.ByStartPointEndPoint(startPoint=locationPoint, endPoint=removeNulls)
Rays = Output(byStartPointEndPoint_2)
