# Dynamo custom node LunchBox Placed and Unplaced Rooms.dyf (Dynamo 1.1.0.2094)
# category: LunchBox.Revit.Elements
# Finds placed and unplaced rooms

Toggle = Input()
python_script = Python(IN[0]=Toggle)
# ---------- python_script.python (85 lines) ----------
#Copyright(c) 2015, Nathan Miller
# The Proving Ground, http://theprovingground.org

import clr

# Import RevitAPI
clr.AddReference("RevitAPI")
import Autodesk
from Autodesk.Revit.DB import *

# Import DocumentManager and TransactionManager
clr.AddReference("RevitServices")
import RevitServices
from RevitServices.Persistence import DocumentManager
from RevitServices.Transactions import TransactionManager

# Import ToDSType(bool) extension method
clr.AddReference("RevitNodes")
import Revit
clr.ImportExtensions(Revit.Elements)
clr.ImportExtensions(Revit.GeometryConversion)

import clr
clr.AddReference('ProtoGeometry')
from Autodesk.DesignScript.Geometry import *

#The input to this node will be stored in the IN[0] variable.

doc =  DocumentManager.Instance.CurrentDBDocument
app =  DocumentManager.Instance.CurrentUIApplication.Application

toggle = IN[0]

output = []
placed = []
placedelementids = []
placeduniqueids = []
unplaced = []
unplacedelementids = []
unplaceduniqueids = []

if toggle == True:

	collector = FilteredElementCollector(doc)
	collector.OfCategory(BuiltInCategory.OST_Rooms)
 
	famtypeitr = collector.GetElementIdIterator()
	famtypeitr.Reset()


	for item in famtypeitr:
		elmID = item
		eleminst = doc.GetElement(elmID)
    
		room = eleminst
		level = ''
		for p in room.Parameters:
			if p.Definition.Name == 'Level':			
				level = p.AsValueString()
				if (level is None):
					level = p.AsString()
				if (level is None):
					level = ''
		
		elementid = eleminst.Id.ToString()
		uniqueid = eleminst.UniqueId
		
		if level == '':
			unplaced.append(room)
			unplacedelementids.append(elementid)
			unplaceduniqueids.append(uniqueid)
		else:
			placed.append(room)
			placedelementids.append(elementid)
			placeduniqueids.append(uniqueid)
        
	output.append(placed)
	output.append(placedelementids)
	output.append(placeduniqueids)
	output.append(unplaced)
	output.append(unplacedelementids)
	output.append(unplaceduniqueids)
        
#Assign your output to the OUT variable
OUT = output
# ----------------------------------------
number = DoubleInput(0)
getItemAtIndex = List.GetItemAtIndex(list=python_script, index=number)
Placed_Room = Output(getItemAtIndex)
number_2 = DoubleInput(1)
getItemAtIndex_2 = List.GetItemAtIndex(list=python_script, index=number_2)
Placed_ElementID = Output(getItemAtIndex_2)
number_3 = DoubleInput(2)
getItemAtIndex_3 = List.GetItemAtIndex(list=python_script, index=number_3)
Placed_UniqueID = Output(getItemAtIndex_3)
number_4 = DoubleInput(3)
getItemAtIndex_4 = List.GetItemAtIndex(list=python_script, index=number_4)
Unplaced_Room = Output(getItemAtIndex_4)
number_5 = DoubleInput(4)
getItemAtIndex_5 = List.GetItemAtIndex(list=python_script, index=number_5)
Unplaced_ElementID = Output(getItemAtIndex_5)
number_6 = DoubleInput(5)
getItemAtIndex_6 = List.GetItemAtIndex(list=python_script, index=number_6)
Unplaced_UniqueID = Output(getItemAtIndex_6)
