# Dynamo custom node LunchBox Staggered Grid by Face .dyf "LunchBox Staggered Grid by Face" (Dynamo 0.7.5.3566)
# category: LunchBox.Archive.Geometry.Panel
# Create a Staggered XYZ grid on a face.  The face surface must have an untrimmed UV parameter space.

Surface = Input()
U = Input()
lunchbox_list_matcher = Custom[LunchBox List Matcher](ListA=Surface, ListB=U)  # Compares a List A against a List B and matches length of List A. If ListA > ListB, ListB will be extended. If ListA < ListB, ListB will be truncated.
V = Input()
lunchbox_list_matcher_2 = Custom[LunchBox List Matcher](ListA=Surface, ListB=V)
python_script = Python(IN[0]=lunchbox_list_matcher.ListA, IN[1]=lunchbox_list_matcher.MatchListB, IN[2]=lunchbox_list_matcher_2.MatchListB)
# ---------- python_script.python (150 lines) ----------
#Copyright(c) 2014, Nathan Miller
# The Proving Ground, http://theprovingground.org

import clr
clr.AddReference('ProtoGeometry')
from Autodesk.DesignScript.Geometry import *

# Panel division class
class PanelDivision:
	
	# divide surface
	def StaggeredQuadDivision(self, srf, udiv, vdiv):
		ustep = 1.0/udiv
		vstep = 1.0/vdiv
		
		quads = []
		polys = []
		panels = []
		for i in range(0,int(udiv)):
			for j in range(0,int(vdiv)):
				# Condition 1
				if j%2 == 0:
					ptA = srf.PointAtParameter(i*ustep,j*vstep)
					ptB = srf.PointAtParameter((i+1)*ustep,j*vstep)
					ptC = srf.PointAtParameter((i+1)*ustep,(j+1)*vstep)
					ptD = srf.PointAtParameter(i*ustep,(j+1)*vstep)
					
					quad = []
					#Append to quad
					quad.append(ptA)
					quad.append(ptB)
					quad.append(ptC)
					quad.append(ptD)
					#Append quads
					quads.append(quad)
					
					#polygons
					poly = Polygon.ByPoints(quad)
					polys.append(poly)
				
					#panels
					panel = Surface.ByPerimeterPoints(quad)
					panels.append(panel)
					
				# Condition 2
				if j%2 == 1:
					if i < (udiv-1):
						ptA = srf.PointAtParameter((i+0.5)*ustep,j*vstep)
						ptB = srf.PointAtParameter((i+1.5)*ustep,j*vstep)
						ptC = srf.PointAtParameter((i+1.5)*ustep,(j+1)*vstep)
						ptD = srf.PointAtParameter((i+0.5)*ustep,(j+1)*vstep)
						
						quad = []
						#Append to quad
						quad.append(ptA)
						quad.append(ptB)
						quad.append(ptC)
						quad.append(ptD)
						#Append quads
						quads.append(quad)
						
						#polygons
						poly = Polygon.ByPoints(quad)
						polys.append(poly)
					
						#panels
						panel = Surface.ByPerimeterPoints(quad)
						panels.append(panel)
					
					# Condition 3
					if i == 0:
						ptA = srf.PointAtParameter(i*ustep,j*vstep)
						ptB = srf.PointAtParameter((i+0.5)*ustep,j*vstep)
						ptC = srf.PointAtParameter((i+0.5)*ustep,(j+1)*vstep)
						ptD = srf.PointAtParameter(i*ustep,(j+1)*vstep)
					
						quad = []
						#Append to quad
						quad.append(ptA)
						quad.append(ptB)
						quad.append(ptC)
						quad.append(ptD)
						#Append quads
						quads.append(quad)
						
						#polygons
						poly = Polygon.ByPoints(quad)
						polys.append(poly)
				
						#panels
						panel = Surface.ByPerimeterPoints(quad)
						panels.append(panel)
					
					# Condition 4
					if i == udiv-1:
						ptA = srf.PointAtParameter((i+0.5)*ustep,j*vstep)
						ptB = srf.PointAtParameter((i+1)*ustep,j*vstep)
						ptC = srf.PointAtParameter((i+1)*ustep,(j+1)*vstep)
						ptD = srf.PointAtParameter((i+0.5)*ustep,(j+1)*vstep)
					
						quad = []
						#Append to quad
						quad.append(ptA)
						quad.append(ptB)
						quad.append(ptC)
						quad.append(ptD)
						#Append quads
						quads.append(quad)
						
						#polygons
						poly = Polygon.ByPoints(quad)
						polys.append(poly)
				
						#panels
						panel = Surface.ByPerimeterPoints(quad)
						panels.append(panel)
						
		self.quads = quads
		self.polys = polys
		self.panels = panels

#Main code
srf = IN[0]
udiv = IN[1]
vdiv = IN[2]

quads = []
polys = []
panels = []

for k in range(0, len(srf)):
	s = srf[k]
	u = udiv[k]
	v = vdiv[k]
			
	divide = PanelDivision()
	divide.StaggeredQuadDivision(s,u,v)
					
	quads.append(divide.quads)
	panels.append(divide.panels)
	polys.append(divide.polys)
	

output = []
output.append(quads)
output.append(polys)
output.append(panels)

#Assign your output to the OUT variable
OUT = output
# ----------------------------------------
number = DoubleInput(0)
getItemAtIndex = List.GetItemAtIndex(python_script, number)
Panel_Pts = Output(getItemAtIndex)
number_2 = DoubleInput(1)
getItemAtIndex_2 = List.GetItemAtIndex(python_script, number_2)
Panel_Polys = Output(getItemAtIndex_2)
number_3 = DoubleInput(2)
getItemAtIndex_3 = List.GetItemAtIndex(python_script, number_3)
Panel_Faces = Output(getItemAtIndex_3)
