# Dynamo custom node Analytical.CreateLineBoundaryCondition.dyf (Dynamo 1.0.0.1180)
# category: SteamNodes.Analytical
# Create Line Boundary Condition from Analytical Line

Analytical_Beams = Input()
code_block = CodeBlock(item=Analytical_Beams) { Flatten({item}); }
code_block_2 = CodeBlock { 0; }
python_script = Python(IN[0]=code_block, IN[1]=code_block_2)
# ---------- python_script.python (43 lines) ----------
#python nodes in dynamo 1.0
#proposed by Julien Benoit @jbenoit44 
#http://aecuandme.wordpress.com/
import clr
clr.AddReference('ProtoGeometry')
from Autodesk.DesignScript.Geometry import *
# Import ToDSType(bool) extension method
clr.AddReference("RevitNodes")
import Revit
clr.ImportExtensions(Revit.Elements)
# Import geometry conversion extension methods
clr.ImportExtensions(Revit.GeometryConversion)
# Import DocumentManager and TransactionManager
clr.AddReference("RevitServices")
import RevitServices
from RevitServices.Persistence import DocumentManager
from RevitServices.Transactions import TransactionManager
from System.Collections.Generic import *
# Import RevitAPI
clr.AddReference("RevitAPI")
import Autodesk
from Autodesk.Revit.DB import *
from System.Collections.Generic import *

doc = DocumentManager.Instance.CurrentDBDocument

elt=UnwrapElement(IN[0])

R=float(IN[1])

bc=[]
# Start Transaction
TransactionManager.Instance.EnsureInTransaction(doc)

for e in elt:
	s=Autodesk.Revit.DB.Structure.TranslationRotationValue.Fixed
	a=doc.Create.NewLineBoundaryConditions(e,s,R,s,R,s,R,s,R)
	bc.append(a)

# End Transaction
TransactionManager.Instance.TransactionTaskDone()

OUT =bc
# ----------------------------------------
Output = Output(python_script)  # ""
