# Dynamo custom node Element.3DCropViewTopBaseOffset.dyf (Dynamo 1.0.0.1180)
# category: SteamNodes.Element
# create 3d view for each element and crop view

element = Input()
boundingBox = Element.BoundingBox(element)
minPoint = BoundingBox.MinPoint(boundingBox)
Offset = Input()
code_block = CodeBlock(a=Offset) { -a; }
BaseOffset_Z = Input()
code_block_2 = CodeBlock(a=BaseOffset_Z) { -a; }
byCoordinates = Vector.ByCoordinates(x=code_block, y=code_block, z=code_block_2, lacing=Longest)
add = Point.Add(point=minPoint, vectorToAdd=byCoordinates)
maxPoint = BoundingBox.MaxPoint(boundingBox)
TopOffset_Z = Input()
byCoordinates_2 = Vector.ByCoordinates(x=Offset, y=Offset, z=TopOffset_Z, lacing=Longest)
add_2 = Point.Add(point=maxPoint, vectorToAdd=byCoordinates_2)
python_script = Python(IN[0]=add, IN[1]=add_2)
# ---------- python_script.python (59 lines) ----------
#python nodes in dynamo 1.0
#proposed by Julien Benoit @jbenoit44 
#http://aecuandme.wordpress.com/
import clr
clr.AddReference('ProtoGeometry')
from Autodesk.DesignScript.Geometry import *
# Import ToDSType(bool) extension method
clr.AddReference("RevitNodes")
import Revit
clr.ImportExtensions(Revit.Elements)
# Import geometry conversion extension methods
clr.ImportExtensions(Revit.GeometryConversion)
# Import DocumentManager and TransactionManager
clr.AddReference("RevitServices")
import RevitServices
from RevitServices.Persistence import DocumentManager
from RevitServices.Transactions import TransactionManager
from System.Collections.Generic import *
# Import RevitAPI
clr.AddReference("RevitAPI")
import Autodesk
from Autodesk.Revit.DB import *

doc = DocumentManager.Instance.CurrentDBDocument
uiapp = DocumentManager.Instance.CurrentUIApplication
app = uiapp.Application
uidoc=DocumentManager.Instance.CurrentUIApplication.ActiveUIDocument

Min=[]
Max=[]
viewlist=[]
bbox=[]
for i in IN[0]:
	Min.append(UnwrapElement(i.ToXyz(True)))
for i in IN[1]:
	Max.append(UnwrapElement(i.ToXyz(True)))



# Start Transaction
TransactionManager.Instance.EnsureInTransaction(doc)
activeview=doc.ActiveView
typeid=View.GetTypeId(activeview)

count = 0
while (count < len(Min)):
	b=View3D.CreateIsometric(doc,typeid)
	viewlist.append(b)
	box = app.Create.NewBoundingBoxXYZ()
	box.Min = Min[count]
	box.Max = Max[count]
	bbox.append(box)
	a=View3D.SetSectionBox(b,box)
	count = count + 1
	

# End Transaction
TransactionManager.Instance.TransactionTaskDone()
OUT=bbox,viewlist
# ----------------------------------------
code_block_3 = CodeBlock(a=python_script) { a[0]; a[1]; }
Views = Output(code_block_3.out1)
Bbox = Output(code_block_3.out0)
Refresh_bool = Input()  # "Refresh (bool)"
code_block_4 = CodeBlock(a=Refresh_bool) { a; }
