# Dynamo custom node List.FilterByString.dyf (Dynamo 1.0.0.1180)
# category: SteamNodes.List
# Filter a list by a string match

list = Input()
code_block = CodeBlock(item=list) { Flatten({item}); }
string_from_object = FromObject()
String = Input()
boolean = BoolSelector(true)
contains = String.Contains(searchFor=String, ignoreCase=boolean)
compose = ComposeFunctions(string_from_object, contains)  # "Function.Compose"
filter = List.Filter(code_block, compose)
Match = Output(filter.out0)
Other = Output(filter.out1)
map = List.Map(list=code_block, f_x=compose)
Bool = Output(map)
