# Dynamo custom node List.SortByFunctionGetNmaxvalues.dyf (Dynamo 1.2.0.2690)
# category: SteamNodes.List
# Get N max values from a sorted list

list = Input(list : var[]..[])
Function = Input()
map = List.Map(list=list, f_x=Function)
sortByKey = List.SortByKey(list=list, keys=map)
N = Input()
code_block = CodeBlock(a=N) { -a; }
takeItems = List.TakeItems(list=sortByKey.sorted_list, amount=code_block)
N_Elements = Output(takeItems)
takeItems_2 = List.TakeItems(list=sortByKey.sorted_keys, amount=code_block)
NmaxValues = Output(takeItems_2)
SortedList = Output(sortByKey.sorted_list)
SortedValues = Output(sortByKey.sorted_keys)
