# Dynamo custom node Parts.Genealogy.dyf (Dynamo 1.0.0.1180)
# category: SteamNodes.Parts
# Get Parent, Childs and PartMaker for any Part

Parts = Input()
getparents = Custom[Parts.Getparents](Part_s=Parts)  # Returns parents of selected Parts
Parent_s = Output(getparents)  # "Parent(s)"
setDifference = SetDifference(getparents, Parts)
PartMaker_s = Output(setDifference)  # "PartMaker(s)"
Part_s = Output(Parts)  # "Part(s)"
