# Dynamo custom node PointCloud.GetPointsFromBoxSelection.dyf (Dynamo 1.2.0.2690)
# category: SteamNodes.BETA
# WIP: collects the points from a point cloud instance by using a box shape collector (aka a Revit element such as a Mass). Mass geometry has to be a box (parallel faces).
# The number of points read must range from 1 to 1000000. Default 50000.
# Average Distance is a setting for PC density. Less distance increases the number of points.

Point_Cloud_Instance = Input()
Box = Input()
faces = Element.Faces(Box)
vertices = Topology.Vertices(faces)
pointGeometry = Vertex.PointGeometry(vertices)
byBestFitThroughPoints = Plane.ByBestFitThroughPoints(pointGeometry)
origin = Plane.Origin(byBestFitThroughPoints)
geometry = Element.Geometry(Box)
centroid = Solid.Centroid(geometry)
byTwoPoints = Vector.ByTwoPoints(start=origin, end=centroid, lacing=Longest)
byOriginNormal = Plane.ByOriginNormal(origin=origin, normal=byTwoPoints)
AverageDistance = Input(AverageDistance:double = 0.001)
NumberOfPoints = Input(NumberOfPoints:double = 50000)
python_script = Python(IN[0]=Point_Cloud_Instance, IN[1]=byOriginNormal, IN[2]=AverageDistance, IN[3]=NumberOfPoints)
# ---------- python_script.python (53 lines) ----------
#python nodes in dynamo 1.2
####BETA VERSION#####
#proposed by Julien Benoit @jbenoit44 
#http://aecuandme.wordpress.com/
import clr
clr.AddReference('ProtoGeometry')
from Autodesk.DesignScript.Geometry import *
# Import ToDSType(bool) extension method
clr.AddReference("RevitNodes")
import Revit
clr.ImportExtensions(Revit.Elements)
# Import geometry conversion extension methods
clr.ImportExtensions(Revit.GeometryConversion)
# Import DocumentManager and TransactionManager
clr.AddReference("RevitServices")
import RevitServices
from RevitServices.Persistence import DocumentManager
from RevitServices.Transactions import TransactionManager
from System.Collections.Generic import *
# Import RevitAPI
clr.AddReference("RevitAPI")
import Autodesk
from Autodesk.Revit.DB import *
from Autodesk.Revit.DB.PointClouds import *


doc = DocumentManager.Instance.CurrentDBDocument
uiapp = DocumentManager.Instance.CurrentUIApplication
app = uiapp.Application
uidoc=DocumentManager.Instance.CurrentUIApplication.ActiveUIDocument


planes=[]
for i in IN[1]:
	planes.append(UnwrapElement(i).ToPlane())
Iplanes=List[Autodesk.Revit.DB.Plane](planes)


pcf=PointCloudFilterFactory.CreateMultiPlaneFilter(planes)

averageDistance = IN[2]
numberOfPoints= IN[3]

points = UnwrapElement(IN[0]).GetPoints(pcf, averageDistance, numberOfPoints)
elements=[]
for p in points:
	X=p.X
	Y=p.Y
	Z=p.Z
	elements.append(Point.Create(XYZ(X,Y,Z)).ToProtoType(False))


OUT = elements
# ----------------------------------------
python_script_2 = Python(IN[0]=Point_Cloud_Instance)
# ---------- python_script_2.python (64 lines) ----------
# Thanks for this code goes to:
# Copyright(c) 2016, Konrad K Sobon
# @arch_laboratory, http://archi-lab.net

# Import Element wrapper extension methods
import clr
clr.AddReference("RevitNodes")
import Revit
clr.ImportExtensions(Revit.Elements)
# Import geometry conversion extension methods
clr.ImportExtensions(Revit.GeometryConversion)

# Import DocumentManager and TransactionManager
clr.AddReference("RevitServices")
import RevitServices
from RevitServices.Persistence import DocumentManager
from RevitServices.Transactions import TransactionManager
doc = DocumentManager.Instance.CurrentDBDocument

# Import RevitAPI
clr.AddReference("RevitAPI")
import Autodesk
from Autodesk.Revit.DB import *

import sys
pyt_path = r'C:\Program Files (x86)\IronPython 2.7\Lib'
sys.path.append(pyt_path)

#The inputs to this node will be stored as a list in the IN variable.
dataEnteringNode = IN

def ProcessList(_func, _list):
    return map( lambda x: ProcessList(_func, x) if type(x)==list else _func(x), _list )

def Unwrap(item):
	return UnwrapElement(item)

def GetTransform(e):
	return e.GetTotalTransform().Origin.ToPoint()
def GetBasisX(e):
	return e.GetTotalTransform().BasisX.ToPoint()
def GetBasisY(e):
	return e.GetTotalTransform().BasisY.ToPoint()
def GetBasisZ(e):
	return e.GetTotalTransform().BasisZ.ToPoint()

if isinstance(IN[0], list):
	elements = ProcessList(Unwrap, IN[0])
else:
	elements = [Unwrap(IN[0])]

try:
	errorReport = None
	output = ProcessList(GetTransform, elements),ProcessList(GetBasisX, elements),ProcessList(GetBasisY, elements),ProcessList(GetBasisZ, elements)
except:
	# if error accurs anywhere in the process catch it
	import traceback
	errorReport = traceback.format_exc()

#Assign your output to the OUT variable
if errorReport == None:
	OUT = output
else:
	OUT = errorReport
# ----------------------------------------
flatten = Flatten(python_script_2)
code_block = CodeBlock(a=flatten) { a[0]; a[1].AsVector(); a[2].AsVector(); a[3].AsVector(); }
byOriginVectors = CoordinateSystem.ByOriginVectors(origin=code_block.out0, xAxis=code_block.out1, yAxis=code_block.out2, zAxis=code_block.out3)
transform = Geometry.Transform(python_script, byOriginVectors, lacing=Longest)
Points = Output(transform)
