# Dynamo custom node Tool.CreateRoomAtPointAndLevel.dyf (Dynamo 1.0.0.1180)
# category: SteamNodes.Tool
# create rooms from center points at Level

Point_List = Input()
code_block = CodeBlock(item=Point_List) { Flatten({item}); }
Level = Input()
python_script = Python(IN[0]=code_block, IN[1]=Level)
# ---------- python_script.python (46 lines) ----------
#python nodes in dynamo 1.0
#proposed by Julien Benoit @jbenoit44 
#http://aecuandme.wordpress.com/
import clr
clr.AddReference('ProtoGeometry')
from Autodesk.DesignScript.Geometry import *
# Import ToDSType(bool) extension method
clr.AddReference("RevitNodes")
import Revit
clr.ImportExtensions(Revit.Elements)
# Import geometry conversion extension methods
clr.ImportExtensions(Revit.GeometryConversion)
# Import DocumentManager and TransactionManager
clr.AddReference("RevitServices")
import RevitServices
from RevitServices.Persistence import DocumentManager
from RevitServices.Transactions import TransactionManager
from System.Collections.Generic import *
# Import RevitAPI
clr.AddReference("RevitAPI")
import Autodesk
from Autodesk.Revit.DB import *

doc = DocumentManager.Instance.CurrentDBDocument
uiapp = DocumentManager.Instance.CurrentUIApplication
app = uiapp.Application
uidoc=DocumentManager.Instance.CurrentUIApplication.ActiveUIDocument

uvs =[]
for i in IN[0]:
	uvs.append(UnwrapElement(i).ToXyz())
level=UnwrapElement(IN[1])
roomlist=[]

# Start Transaction
TransactionManager.Instance.EnsureInTransaction(doc)

for item in uvs:
	uv=UV(item.X,item.Y)
	a=doc.Create.NewRoom(level,uv)
	roomlist.append(a)

# End Transaction
TransactionManager.Instance.TransactionTaskDone()

OUT = roomlist
# ----------------------------------------
Room_List = Output(python_script)
