# Dynamo custom node Tool.EraserByName.dyf (Dynamo 1.0.0.1180)
# category: SteamNodes.Tool
# erase things in a list, selected by the name

Things = Input()
code_block = CodeBlock(item=Things) { Flatten({item}); }
name = Element.Name(code_block)
Contains_this_string = Input()
Ignore_Case_bool = Input()  # "Ignore Case (bool)"
contains = String.Contains(str=name, searchFor=Contains_this_string, ignoreCase=Ignore_Case_bool)
filterByBoolMask = List.FilterByBoolMask(list=code_block, mask=contains, lacing=Longest)
python_script = Python(IN[0]=filterByBoolMask.in)
# ---------- python_script.python (48 lines) ----------
#python nodes in dynamo 1.0
#proposed by Julien Benoit @jbenoit44 
#http://aecuandme.wordpress.com/

import clr
clr.AddReference('ProtoGeometry')
from Autodesk.DesignScript.Geometry import *
# Import ToDSType(bool) extension method
clr.AddReference("RevitNodes")
import Revit
clr.ImportExtensions(Revit.Elements)
# Import geometry conversion extension methods
clr.ImportExtensions(Revit.GeometryConversion)
# Import DocumentManager and TransactionManager
clr.AddReference("RevitServices")
import RevitServices
from RevitServices.Persistence import DocumentManager
from RevitServices.Transactions import TransactionManager
from System.Collections.Generic import *
# Import RevitAPI
clr.AddReference("RevitAPI")
import Autodesk
from Autodesk.Revit.DB import *

doc = DocumentManager.Instance.CurrentDBDocument
uiapp = DocumentManager.Instance.CurrentUIApplication
app = uiapp.Application

elt = []
for i in IN[0]:
	elt.append(UnwrapElement(i).Id)

# Start Transaction
TransactionManager.Instance.EnsureInTransaction(doc)


cantdelete=[]
for item in elt:
	try:
		doc.Delete(item)
	except:
		cantdelete.append(item)
		

# End Transaction
TransactionManager.Instance.TransactionTaskDone()
doc.Regenerate()
OUT=cantdelete
# ----------------------------------------
Cant_Delete = Output(python_script)
Not_Matching = Output(filterByBoolMask.out)
