# Dynamo custom node Tool.GetFillPatternTarget.dyf (Dynamo 1.0.0.1180)
# category: SteamNodes.Tool
# Returns the target (drafting-model-none) from a FillPatternElement

FillPatternElements = Input()
code_block = CodeBlock(a=FillPatternElements) { Flatten({a}); }
python_script = Python(IN[0]=code_block)
# ---------- python_script.python (35 lines) ----------
#python nodes in dynamo 1.0
#proposed by Julien Benoit @jbenoit44 
#http://aecuandme.wordpress.com/

#credits to:
# Konrad Sobon
# @arch_laboratory, http://archi-lab.net

import clr
clr.AddReference('ProtoGeometry')
from Autodesk.DesignScript.Geometry import *
import sys
pyt_path = r'C:\Program Files (x86)\IronPython 2.7\Lib'
sys.path.append(pyt_path)
#Les entrées effectuées dans ce noeud sont stockées sous forme de liste dans les variables IN.
FillPatt = []
for i in IN[0]:
	FillPatt.append(UnwrapElement(i))
targets=[]
try:
	errorReport = None
	for f in FillPatt:
		b=f.GetFillPattern()
		targets.append(b.Target)
		
except:
	# if error accurs anywhere in the process catch it
	import traceback
	errorReport = traceback.format_exc()

#Assign your output to the OUT variable
if errorReport == None:
	OUT = targets
else:
	OUT = errorReport
# ----------------------------------------
Targets = Output(python_script)
