# Dynamo custom node Tool.PointComponents.dyf (Dynamo 1.2.0.2690)
# category: SteamNodes.Tool
# X Y Z of points

Points = Input()
X = Point.X(Points)
X_2 = Output(X)  # "X"
Y = Point.Y(Points)
Y_2 = Output(Y)  # "Y"
Z = Point.Z(Points)
Z_2 = Output(Z)  # "Z"
