# Dynamo custom node Tool.RenameAssembly.dyf (Dynamo 1.0.0.1180)
# category: SteamNodes.Tool
# Rename Existing Assembly - doesn't work yet at Assembly creation (transaction related, WIP)
# Beware: same length Lists

Assemblies = Input()
code_block = CodeBlock(a=Assemblies) { Flatten({a}); }
Names = Input()
code_block_2 = CodeBlock(a=Names) { Flatten({a}); }
python_script = Python(IN[0]=code_block, IN[1]=code_block_2)
# ---------- python_script.python (49 lines) ----------
#python nodes in dynamo 1.0
#proposed by Julien Benoit @jbenoit44 
#http://aecuandme.wordpress.com/
import clr
clr.AddReference('ProtoGeometry')
from Autodesk.DesignScript.Geometry import *
# Import ToDSType(bool) extension method
clr.AddReference("RevitNodes")
import Revit
clr.ImportExtensions(Revit.Elements)
# Import geometry conversion extension methods
clr.ImportExtensions(Revit.GeometryConversion)
# Import DocumentManager and TransactionManager
clr.AddReference("RevitServices")
import RevitServices
from RevitServices.Persistence import DocumentManager
from RevitServices.Transactions import TransactionManager
from System.Collections.Generic import *
# Import RevitAPI
clr.AddReference("RevitAPI")
import Autodesk
from Autodesk.Revit.DB import *

doc = DocumentManager.Instance.CurrentDBDocument
uiapp = DocumentManager.Instance.CurrentUIApplication
app = uiapp.Application
uidoc=DocumentManager.Instance.CurrentUIApplication.ActiveUIDocument
#TransactionManager.ForceCloseTransaction()
elt = []
for i in IN[0]:
	elt.append(UnwrapElement(i))
NamesList=UnwrapElement(IN[1])
names=[]
# Start Transaction
TransactionManager.Instance.EnsureInTransaction(doc)

Assemb=[]

for i,n in zip(elt,NamesList):
	i.AssemblyTypeName = n
	Assemb.append(i)
for i in Assemb:
	names.append(i.AssemblyTypeName)
# End Transaction
TransactionManager.Instance.TransactionTaskDone()


#Assign your output to the OUT variable.
OUT = names,Assemb
# ----------------------------------------
code_block_3 = CodeBlock(a=python_script) { a[0]; a[1]; }
uniqueItems = List.UniqueItems(code_block_3.out0)
Unique_Names = Output(uniqueItems)
count = List.Count(code_block_3.out1)
Assemblies_Count = Output(count)
