# Dynamo custom node Tool.RunMe.dyf (Dynamo 1.0.0.1180)
# category: SteamNodes.Tool
# Use Boolean to perform an action

Boolean = Input(Boolean : bool=True)
ThingToDo = Input()
python_script = Python(IN[0]=Boolean, IN[1]=ThingToDo)
# ---------- python_script.python (14 lines) ----------
#python nodes in dynamo 1.0
#proposed by Julien Benoit @jbenoit44 
#http://aecuandme.wordpress.com/
import clr
clr.AddReference('ProtoGeometry')
from Autodesk.DesignScript.Geometry import *
#Les entrées effectuées dans ce noeud sont stockées sous forme de liste dans les variables IN.

bool=IN[0]

if bool == True:
	OUT=IN[1]
else:
	OUT=0
# ----------------------------------------
Result = Output(python_script)
