# Dynamo custom node Tool.Toggle.dyf (Dynamo 1.0.0.1180)
# category: SteamNodes.Tool
# Offers 2 ways for output

Boolean = Input(Boolean:bool=true)
code_block = CodeBlock { 1; }
eq = Boolean == code_block
Function_1 = Input()  # "Function#1"
Function_2 = Input()  # "Function#2"
if_ = If(test=eq, true=Function_1, false=Function_2)
Output = Output(if_)  # ""
