# Dynamo custom node Tool.WeightedAverage.dyf (Dynamo 1.2.0.2690)
# category: SteamNodes.Tool
# Calculate Weigted Average of 2 lists

Weights = Input()
Numbers = Input()
python_script = Python(IN[0]=Weights, IN[1]=Numbers)
# ---------- python_script.python (22 lines) ----------
import clr
clr.AddReference('ProtoGeometry')
from Autodesk.DesignScript.Geometry import *
#The inputs to this node will be stored as a list in the IN variables.
#dataEnteringNode = IN

def moyenne_ponderee (poids, nombre) :
	s = 0
	w = 0
	for p,n in zip (poids, nombre) :	
		s += p*n
		w += p
	return s * 1.0 / w 
	
density = IN[0]
coord = IN[1]
resultat = moyenne_ponderee (density, coord)



#Assign your output to the OUT variable.
OUT = resultat
# ----------------------------------------
WeightedAverage = Output(python_script)
