# Dynamo custom node View.CropView.dyf (Dynamo 1.0.0.1180)
# category: SteamNodes.View
# Crop a 3D view

Views = Input()
code_block = CodeBlock(item=Views) { Flatten({item}); }
python_script = Python(IN[0]=code_block)
# ---------- python_script.python (40 lines) ----------
#python nodes in dynamo 1.0
#proposed by Julien Benoit @jbenoit44 
#http://aecuandme.wordpress.com/
import clr
clr.AddReference('ProtoGeometry')
from Autodesk.DesignScript.Geometry import *
# Import ToDSType(bool) extension method
clr.AddReference("RevitNodes")
import Revit
clr.ImportExtensions(Revit.Elements)
# Import geometry conversion extension methods
clr.ImportExtensions(Revit.GeometryConversion)
# Import DocumentManager and TransactionManager
clr.AddReference("RevitServices")
import RevitServices
from RevitServices.Persistence import DocumentManager
from RevitServices.Transactions import TransactionManager
from System.Collections.Generic import *
# Import RevitAPI
clr.AddReference("RevitAPI")
import Autodesk
from Autodesk.Revit.DB import *

doc = DocumentManager.Instance.CurrentDBDocument
uiapp = DocumentManager.Instance.CurrentUIApplication
app = uiapp.Application
uidoc=DocumentManager.Instance.CurrentUIApplication.ActiveUIDocument

elt = []
for i in IN[0]:
	elt.append(UnwrapElement(i))
#view = UnwrapElement(IN[0])
cropviews=[]
TransactionManager.Instance.EnsureInTransaction(doc)
for i in elt:
	i.CropBoxActive = True
	cropviews.append(i.ToDSType(False))
TransactionManager.Instance.TransactionTaskDone()

OUT = cropviews
# ----------------------------------------
Views_2 = Output(python_script)  # "Views"
