# Dynamo custom node View.GetViewport.dyf (Dynamo 1.0.0.1180)
# category: SteamNodes.View
# Get Vieworts from Views

Sheet = Input()
python_script = Python(IN[0]=Sheet)
# ---------- python_script.python (49 lines) ----------
#python nodes in dynamo 1.0
#proposed by Julien Benoit @jbenoit44 
#http://aecuandme.wordpress.com/
import clr
clr.AddReference('ProtoGeometry')
from Autodesk.DesignScript.Geometry import *
# Import ToDSType(bool) extension method
clr.AddReference("RevitNodes")
import Revit
clr.ImportExtensions(Revit.Elements)
# Import geometry conversion extension methods
clr.ImportExtensions(Revit.GeometryConversion)
# Import DocumentManager and TransactionManager
clr.AddReference("RevitServices")
import RevitServices
from RevitServices.Persistence import DocumentManager
from RevitServices.Transactions import TransactionManager
from System.Collections.Generic import *
# Import RevitAPI
clr.AddReference("RevitAPI")
import Autodesk
from Autodesk.Revit.DB import *

doc = DocumentManager.Instance.CurrentDBDocument
uiapp = DocumentManager.Instance.CurrentUIApplication
app = uiapp.Application
uidoc=DocumentManager.Instance.CurrentUIApplication.ActiveUIDocument

sheets = []
for i in IN[0]:
	sheets.append(UnwrapElement(i))

# Start Transaction
TransactionManager.Instance.EnsureInTransaction(doc)

vplist=[]
for v in sheets:
	vp=[]
	a=v.GetAllViewports()
	for i in a:
		b=doc.GetElement(i)
		vp.append(b)
	vplist.append(vp)
			

# End Transaction
TransactionManager.Instance.TransactionTaskDone()

OUT=vplist
# ----------------------------------------
Viewport_s = Output(python_script)  # "Viewport(s)"
