# Dynamo custom node ViewSchedule.GetColumnWidth.dyf (Dynamo 1.0.0.1180)
# category: SteamNodes.Schedule
# ViewSchedule.GetColumnWidth

ViewSchedule_List = Input()
code_block = CodeBlock(a=ViewSchedule_List) { Flatten({a}); }
python_script = Python(IN[0]=code_block)
# ---------- python_script.python (30 lines) ----------
#python nodes in dynamo 1.0
#proposed by Julien Benoit @jbenoit44 
#http://aecuandme.wordpress.com/
import clr
clr.AddReference('RevitAPI')
from Autodesk.Revit.DB import *

clr.AddReference("RevitServices")
import RevitServices
from RevitServices.Persistence import DocumentManager

doc = DocumentManager.Instance.CurrentDBDocument
viewsch = UnwrapElement(IN[0])
elementlist = list()
viewlist = []
for v in viewsch:
	wid=[]
	a=v.GetTableData()
	b=a.GetSectionData(SectionType.Body)
	c=b.NumberOfColumns
	n=0
	while n <= c-1:
		d=b.GetColumnWidth(n)
		wid.append(d)
		n=n+1
	
	viewlist.append(wid)
	elementlist.append(wid)

OUT = viewlist
# ----------------------------------------
Output = Output(python_script)  # ""
