# Dynamo custom node ViewSchedule.SetColumnWidth.dyf (Dynamo 1.0.0.1180)
# category: SteamNodes.Schedule
# ViewSchedule.SetColumnWidth

Width_list = Input()
ViewSchedule_List = Input()
python_script = Python(IN[0]=Width_list, IN[1]=ViewSchedule_List)
# ---------- python_script.python (52 lines) ----------
#python nodes in dynamo 1.0
#proposed by Julien Benoit @jbenoit44 
#http://aecuandme.wordpress.com/
import clr
clr.AddReference('ProtoGeometry')
from Autodesk.DesignScript.Geometry import *
# Import ToDSType(bool) extension method
clr.AddReference("RevitNodes")
import Revit
clr.ImportExtensions(Revit.Elements)
# Import geometry conversion extension methods
clr.ImportExtensions(Revit.GeometryConversion)
# Import DocumentManager and TransactionManager
clr.AddReference("RevitServices")
import RevitServices
from RevitServices.Persistence import DocumentManager
from RevitServices.Transactions import TransactionManager
from System.Collections.Generic import *
# Import RevitAPI
clr.AddReference("RevitAPI")
import Autodesk
from Autodesk.Revit.DB import *

doc = DocumentManager.Instance.CurrentDBDocument
uiapp = DocumentManager.Instance.CurrentUIApplication
app = uiapp.Application
uidoc=DocumentManager.Instance.CurrentUIApplication.ActiveUIDocument

elt = []
#for i in IN[0]:
#	elt.append(UnwrapElement(i))
widthlist = UnwrapElement(IN[0])
viewsch = UnwrapElement(IN[1])
#elementlist = list()
#viewlist = []

# Start Transaction
TransactionManager.Instance.EnsureInTransaction(doc)
for i,v in enumerate(viewsch):
	wl=widthlist[i]
	a=v.GetTableData()
	b=a.GetSectionData(SectionType.Body)
	c=b.NumberOfColumns
	n=0
	while n <= c-1:
		d=b.SetColumnWidth(n,wl[n])
		n=n+1
doc.Regenerate()
# End Transaction
TransactionManager.Instance.TransactionTaskDone()

OUT = viewsch
# ----------------------------------------
ViewSchedule_List_2 = Output(python_script)  # "ViewSchedule List"
