# Dynamo graph 0.8 align views example.dyn (Dynamo 0.8.2.2113)

categories = Categories("Sheets")
all_elements_of_category = ElementsOfCategory(categories)
code_block = CodeBlock { "Numéro de la feuille"; }
getParameterValueByName = Element.GetParameterValueByName(parameterName=code_block)
sortByKey = SortByKey(all_elements_of_category, getParameterValueByName)
deconstruct = List.Deconstruct(list=sortByKey)
alignSheetViewsFromTemplateSheet = Custom[Tool.AlignSheetViewsFromTemplateSheet](TemplateSheet=deconstruct.first, Sheets=deconstruct.rest)  # Align views and schedules from a sheet template
