# Dynamo custom node Combine by Pattern.dyf (Dynamo 1.2.0.2690)
# category: Archi-lab_Grimshaw.List.List
# Combines two list based on a input pattern of true and false.

False_ = Input(False)
empty = List.Empty()
create = List.Create(False_, empty)
flatten = Flatten(create)
True_ = Input(True)
empty_2 = List.Empty()
create_2 = List.Create(True_, empty_2)
flatten_2 = Flatten(create_2)
Pattern = Input()
empty_3 = List.Empty()
create_3 = List.Create(Pattern, empty_3)
flatten_3 = Flatten(create_3)
python_script = Python(IN[0]=flatten, IN[1]=flatten_2, IN[2]=flatten_3)
# ---------- python_script.python (22 lines) ----------
#Copyright(c) 2015, Konrad K Sobon
# @arch_laboratory, http://archi-lab.net

import clr
clr.AddReference('ProtoGeometry')
from Autodesk.DesignScript.Geometry import *
#The inputs to this node will be stored as a list in the IN variable.
dataEnteringNode = IN

lst_1 = IN[0]
lst_2 = IN[1]
pattern = IN[2]
result = []

for i, j, k in zip(lst_1, lst_2, pattern):
	if k == False:
		result.append(i)
	else:
		result.append(j)

#Assign your output to the OUT variable
OUT = result
# ----------------------------------------
List = Output(python_script)
