# Dynamo custom node Element.IsOfType.dyf (Dynamo 0.9.0.2912)
# category: Archi-lab_Grimshaw.Element Properties.Query
# This nodes yields true or false, checking if input elements are of given Element Type.

Element = Input()
ElementType = Input()
python_script = Python(IN[0]=Element, IN[1]=ElementType)
# ---------- python_script.python (56 lines) ----------
# Copyright(c) 2015, Konrad K Sobon
# @arch_laboratory, http://archi-lab.net

# Import Element wrapper extension methods
import clr
clr.AddReference("RevitNodes")
import Revit
clr.ImportExtensions(Revit.Elements)

# Import RevitAPI
clr.AddReference("RevitAPI")
import Autodesk
from Autodesk.Revit.DB import *

import sys
pyt_path = r'C:\Program Files (x86)\IronPython 2.7\Lib'
sys.path.append(pyt_path)

#The inputs to this node will be stored as a list in the IN variable.
dataEnteringNode = IN

def Unwrap(item):
	return UnwrapElement(item)

def ProcessList(_func, _list):
    return map( lambda x: ProcessList(_func, x) if type(x)==list else _func(x), _list )

if isinstance(IN[0], list):
	elements = ProcessList(Unwrap, IN[0])
else:
	elements = [Unwrap(IN[0])]

elemType = IN[1]

def IsOfType(item, category = elemType):
	if item != None:
		if item.GetType() == category:
			return True
		else:
			return False
	else:
		return False

try:
	errorReport = None
	output = ProcessList(IsOfType, elements)
except:
	# if error accurs anywhere in the process catch it
	import traceback
	errorReport = traceback.format_exc()

#Assign your output to the OUT variable
if errorReport == None:
	OUT = output
else:
	OUT = errorReport
# ----------------------------------------
mask = Output(python_script)
