# Dynamo custom node RoomBoundaries.CleanNulls.dyf (Dynamo 0.9.0.2912)
# category: Archi-lab_Grimshaw.Element Properties.Actions
# This node will take a set of room boundary curves and elements and remove nulls from element list while joining curves to mainatain matching list structure.

Element = Input()
Curve = Input()
python_script = Python(IN[0]=Element, IN[1]=Curve)
# ---------- python_script.python (25 lines) ----------
import clr
import sys
clr.AddReference('ProtoGeometry')
from Autodesk.DesignScript.Geometry import *

from System import Array
from System.Collections.Generic import *

walls = IN[0]
curves = IN[1]


for i, (wList, cList) in enumerate(zip(walls, curves)):
	for j, (wall, curve) in enumerate(zip(wList, cList)):
		if wall == None:
			del walls[i][j]
			# take corresponding curve and join it to next one in order
			# if there is no next one, then use previous
			curveList = [curves[i][j], curves[i][j+1]]
			curveArray = List[Curve](curveList)
			newPolyCurve = PolyCurve.ByJoinedCurves(curveArray)
			curves[i][j+1] = newPolyCurve
			del curves[i][j]

OUT = [walls, curves]
# ----------------------------------------
code_block = CodeBlock(IN=python_script) { IN[0]; IN[1]; }
Element_2 = Output(code_block.out0)  # "Element"
Curve_2 = Output(code_block.out1)  # "Curve"
