# Dynamo custom node 2D Excel List into 1D List with Inline Headings.dyf (Dynamo 1.3.4.6666)
# category: Bakery.Office.Excel
# turns excel table into useful list for word with inline headings

headingList = Input()
nestedDatalists = Input()
sectionSeperator = Input()
rowGap = Input()
python_script = Python(IN[0]=headingList, IN[1]=nestedDatalists, IN[2]=sectionSeperator, IN[3]=rowGap)
# ---------- python_script.python (21 lines) ----------
import clr
clr.AddReference('ProtoGeometry')
from Autodesk.DesignScript.Geometry import *
#The inputs to this node will be stored as a list in the IN variables.
headings = IN[0]
datatwod = IN[1]
seperator = IN[2]
gap = IN[3]
onedlist = []
counter = range(len(headings))


for x in datatwod:
	for y in counter:
		onedlist.append(headings[y])
		onedlist.append(x[y])
		onedlist.append(gap)
	onedlist.append(seperator)

#Assign your output to the OUT variable.
OUT = onedlist
# ----------------------------------------
flatList = Output(python_script)
