# Dynamo custom node Add Most Recent Revision to Sheet.dyf (Dynamo 0.8.2.2371)
# category: Bakery.Revit.Elements.Revision

sheetsIn = Input()
code_block = CodeBlock { true; }
get_all_revisions = Custom[Get All Revisions](RunIt=code_block)  # This node will return all Revisions currently defined in the mode.
lastItem = List.LastItem(get_all_revisions)
add_revisions_to_sheet = Custom[Add Revisions to Sheet](Sheet=sheetsIn, Revision=lastItem, RunIt=code_block)  # This node will add specified revisions to a sheet.
Sheet_Done = Output(add_revisions_to_sheet)
