# Dynamo custom node Add Prefix to Items in String List.dyf (Dynamo 2.3.1.11775)
# category: Bakery.Core.String

stringList = Input(stringList: var[]..[])
watch = Watch(stringList)
code_block = CodeBlock { ""; }
stringPrefix = Input(stringPrefix: var[]..[])
join = String.Join(separator=code_block, string0=stringPrefix)  # unwired: string1
map = List.Map(list=watch, f_x=join)
new_strings = Output(map)
