# Dynamo custom node Add Suffix to Items in String List.dyf (Dynamo 2.3.1.11775)
# category: Bakery.Core.String

stringList = Input(stringList: var[]..[])
watch = Watch(stringList)
code_block = CodeBlock { ""; }
suffix = Input(suffix: var[]..[])
join = String.Join(separator=code_block, string1=suffix)  # unwired: string0
map = List.Map(list=watch, f_x=join)
new_strings = Output(map)
