# Dynamo custom node AddSharedParametersToCategories.dyf (Dynamo 2.12.1.8246)
# category: Bakery.Revit.Parameters
# packages: Bakery 2020.1.14

biglist = Input(biglist: var)
counter = Input(counter: int)
getItemAtIndex = List.GetItemAtIndex(list=biglist, index=counter)
watch = Watch(getItemAtIndex)
code_block = CodeBlock { 1; }
getItemAtIndex_2 = List.GetItemAtIndex(list=watch, index=code_block)
code_block_2 = CodeBlock { 18; }
getItemAtIndex_3 = List.GetItemAtIndex(list=watch, index=code_block_2)

# group: sp param group
watch_2 = Watch(getItemAtIndex_3)

code_block_3 = CodeBlock { 6; }
getItemAtIndex_4 = List.GetItemAtIndex(list=watch, index=code_block_3)
get_parametertype_by_name = Custom[Get ParameterType by Name](searchFor=getItemAtIndex_4)  # package Bakery
watch_3 = Watch(get_parametertype_by_name)

# group: constants
code_block_4 = CodeBlock { 1; }
string = StringInput("Construction")
boolean = BoolSelector(true)

# group: visible
watch_4 = Watch(code_block_4)

categoryIdList = Input(categoryIdList: var[]..[])
watch_5 = Watch(categoryIdList)
firstItem = List.FirstItem(list=watch_5)
get_builtinparametergroup_by = Custom[Get BuiltinParameterGroup by Name](searchFor=string)  # package Bakery
watch_6 = Watch(get_builtinparametergroup_by)

# group: add param using GROUP from sp file
python_script = Python(IN[0]=getItemAtIndex_2, IN[1]=watch_2, IN[2]=watch_3, IN[3]=watch_4, IN[4]=firstItem, IN[5]=watch_6, IN[6]=boolean)  # IronPython2
# ---------- python_script.python (121 lines) ----------
#Copyright(c) 2015, Konrad Sobon
# @arch_laboratory, http://archi-lab.net

import clr
clr.AddReference('ProtoGeometry')
from Autodesk.DesignScript.Geometry import *

# Import DocumentManager and TransactionManager
clr.AddReference("RevitServices")
import RevitServices
from RevitServices.Persistence import DocumentManager
from RevitServices.Transactions import TransactionManager

# Import RevitAPI
clr.AddReference("RevitAPI")
import Autodesk
from Autodesk.Revit.DB import *

doc = DocumentManager.Instance.CurrentDBDocument
uiapp = DocumentManager.Instance.CurrentUIApplication
app = uiapp.Application

from System.Collections.Generic import *

# Import ToDSType(bool) extension method
clr.AddReference("RevitNodes")
import Revit
clr.ImportExtensions(Revit.Elements)
import System
#The inputs to this node will be stored as a list in the IN variable.
dataEnteringNode = IN

_paramName = IN[0]
_groupName = IN[1]
_paramType = IN[2]
_visible = IN[3]
_categoryId = IN[4]
_paramGroup = IN[5]
_instance = IN[6]

def ParamBindingExists(_doc, _paramName, _paramType):
	map = doc.ParameterBindings
	iterator = map.ForwardIterator()
	iterator.Reset()
	while iterator.MoveNext():
		if iterator.Key != None and iterator.Key.Name == _paramName and iterator.Key.ParameterType == _paramType:
			paramExists = True
			break
		else:
			paramExists = False
	return paramExists

def RemoveParamBinding(_doc, _paramName, _paramType):
	map = doc.ParameterBindings
	iterator = map.ForwardIterator()
	iterator.Reset()
	while iterator.MoveNext():
		if iterator.Key != None and iterator.Key.Name == _paramName and iterator.Key.ParameterType == _paramType:
			definition = iterator.Key
			break
	message = None
	if definition != None:
		map.Remove(definition)
		message = "Success"
	return message

def addParam(doc, _paramName, _visible, _instance, _groupName, _paramGroup):
	message = None
	if ParamBindingExists(doc, _paramName, _paramType):
		if not RemoveParamBinding(doc, _paramName, _paramType) == "Success":
			message = "Param Binding Not Removed Successfully"
		else:
			message = None
			
	group = file.Groups.get_Item(_groupName)
	if group == None:
		group = file.Groups.Create(_groupName)
	if group.Definitions.Contains(group.Definitions.Item[_paramName]):
		_def = group.Definitions.Item[_paramName]
	else:
		createOption = ExternalDefinitionCreationOptions(_paramName, _paramType)
		_def = group.Definitions.Create(createOption)
	try:
		bipgroup = _paramGroup#BuiltInParameterGroup.PG_CONSTRAINTS
		param = doc.ParameterBindings.Insert(_def, bind, bipgroup)
	except:
		message = _def, bind, bipgroup
	return message
#"Start" the transaction
TransactionManager.Instance.EnsureInTransaction(doc)

try:
	file = app.OpenSharedParameterFile()
except:
	message = "No Shared Parameter file found."
	pass

builtInCategory = System.Enum.ToObject(BuiltInCategory, _categoryId)
cats = app.Create.NewCategorySet()
cats.Insert(doc.Settings.Categories.get_Item(builtInCategory))
if _instance:
	bind = app.Create.NewInstanceBinding(cats)
else:
	bind = app.Create.NewTypeBinding(cats)


if isinstance(_paramName, list):
	for i, j, k in zip(_paramName, _visible, _instance):
		message = addParam(doc, i, j, k, _groupName, _paramGroup)
else:
	message = addParam(doc, _paramName, _visible, _instance, _groupName, _paramGroup)


# "End" the transaction
TransactionManager.Instance.TransactionTaskDone()

#Assign your output to the OUT variable
if message == None:
	OUT = "Success"
else:
	OUT = message
# ----------------------------------------

OUT = Output(python_script)
