# Dynamo custom node All Directory Contents of Specific Filetype.dyf (Dynamo 2.3.0.5885)
# category: Bakery.Dynamo.ForkedNodes
# from clockwork
# packages: Bakery 2020.1.14

dir = Input(dir: var[]..[])
contentsAll = Custom[Directory.ContentsAll](dir=dir)  # package Bakery; Unlike the built-in node Directory.Contents, this node browses a directory recursively and returns all relevant files contained in subfolders as well.
watch = Watch(contentsAll)
fileExtension = Input(fileExtension: var[]..[])
endsWith = String.EndsWith(str=watch, searchFor=fileExtension)
filterByBoolMask = List.FilterByBoolMask(list=watch, mask=endsWith)
files_found = Output(filterByBoolMask.in)
