# Dynamo custom node All Equal in List.dyf (Dynamo 1.3.2.2480)
# category: Bakery.Core.List
# doing string conversion to solve precision right now, need to fix

sublists = Input()
python_script = Python(IN[0]=sublists)
# ---------- python_script.python (24 lines) ----------
import clr
clr.AddReference('ProtoGeometry')
from Autodesk.DesignScript.Geometry import *
#The inputs to this node will be stored as a list in the IN variables.
pointSublists = IN[0]
bools = []
testvals = []
for z in pointSublists:
	test = len(z)
	ctr = 0
	for x in z:
		if str(x) == str(z[0]):
			ctr = ctr + 1
		else:
			pass
		testvals.append(ctr)
	if test == ctr:
		bools.append(True)
	else:
		bools.append(False)


#Assign your output to the OUT variable.
OUT = bools, testvals
# ----------------------------------------
firstItem = List.FirstItem(python_script)
bools = Output(firstItem)
code_block = CodeBlock { 1; }
getItemAtIndex = List.GetItemAtIndex(list=python_script, index=code_block)
testvals = Output(getItemAtIndex)
