# Dynamo custom node AutoModeller for Civil Data v1.dyf (Dynamo 1.3.0.875)
# category: Bakery.Construction.Civil

WallHeadingOrder = Input()
watch = Watch(WallHeadingOrder)
string = StringInput("Pile Type")
string_2 = StringInput("Cap Floor Type")

# group: Excel Headings
string_3 = StringInput("Wall Type")
string_4 = StringInput("CH Start")
string_5 = StringInput("CH End")
string_6 = StringInput("Side")
string_7 = StringInput("Dynamo Form")
string_8 = StringInput("Pile Cts")
string_9 = StringInput("Pile Cap Thickness")
string_10 = StringInput("Pile Depth")
string_11 = StringInput("Pile Cap Vertical Offset")
string_12 = StringInput("Soil Anchors")
string_13 = StringInput("Soil Anchor Cts")
string_14 = StringInput("Soil Anchor Length")
string_15 = StringInput("Precision")
string_16 = StringInput("Pile Cap Width")
string_17 = StringInput("Pile Diameter")
string_18 = StringInput("Wall ID")
create = List.Create(string_3, string_4, string_5, string_6, string_7, string_8, string_9, string_10, string_11, string_12, string_13, string_14, string_15, string_16, string_17, string_18, string, string_2)

# group: Reformat Excel for Predictability
build_new_order_of_headings_by = Custom[Build New Order of Headings by Search](OriginalHeadingOrder=watch, NewHeadingOrderWildcards=create)
watch_2 = Watch(build_new_order_of_headings_by.newHeadings)
watch_3 = Watch(build_new_order_of_headings_by.indicesMatchDesiredOrder)
watch_4 = Watch(build_new_order_of_headings_by.FalseIfDuplicatesFoundAndRemoved)
watch_5 = Watch(build_new_order_of_headings_by.indices)

# group: offset to column centre
code_block = CodeBlock { 500; }

chainageCsvData = Input(chainageCsvData : var[]..[])

# group: Get Chainage
code_block_2 = CodeBlock { 0; }
getItemAtIndex = List.GetItemAtIndex(list=chainageCsvData, index=code_block_2)

to_float = Custom[To Float](unknown=getItemAtIndex, lacing=Longest)  # converts input object to a float with python
WallData = Input(WallData : var[]..[])
transpose = List.Transpose(WallData)
watch_6 = Watch(transpose)
rowIndex = Input(rowIndex : var[]..[])

# group: reformatted data
code_block_3 = CodeBlock { 1; }
triple_get = Custom[Triple Get](indexList=watch_5, indexToGet=code_block_3, dataSublists=watch_6, rowIndex=rowIndex)
code_block_4 = CodeBlock { 2; }
triple_get_2 = Custom[Triple Get](indexList=watch_5, indexToGet=code_block_4, dataSublists=watch_6, rowIndex=rowIndex)
code_block_5 = CodeBlock { 3; }
triple_get_3 = Custom[Triple Get](indexList=watch_5, indexToGet=code_block_5, dataSublists=watch_6, rowIndex=rowIndex)
code_block_6 = CodeBlock { 12; }
triple_get_4 = Custom[Triple Get](indexList=watch_5, indexToGet=code_block_6, dataSublists=watch_6, rowIndex=rowIndex)
code_block_7 = CodeBlock { 4; }
triple_get_5 = Custom[Triple Get](indexList=watch_5, indexToGet=code_block_7, dataSublists=watch_6, rowIndex=rowIndex)
code_block_8 = CodeBlock { 0; }
triple_get_6 = Custom[Triple Get](indexList=watch_5, indexToGet=code_block_8, dataSublists=watch_6, rowIndex=rowIndex)
code_block_9 = CodeBlock { 9; }
triple_get_7 = Custom[Triple Get](indexList=watch_5, indexToGet=code_block_9, dataSublists=watch_6, rowIndex=rowIndex)
code_block_10 = CodeBlock { 10; }
triple_get_8 = Custom[Triple Get](indexList=watch_5, indexToGet=code_block_10, dataSublists=watch_6, rowIndex=rowIndex)
code_block_11 = CodeBlock { 11; }
triple_get_9 = Custom[Triple Get](indexList=watch_5, indexToGet=code_block_11, dataSublists=watch_6, rowIndex=rowIndex)
code_block_12 = CodeBlock { 6; }
triple_get_10 = Custom[Triple Get](indexList=watch_5, indexToGet=code_block_12, dataSublists=watch_6, rowIndex=rowIndex)
code_block_13 = CodeBlock { 8; }
triple_get_11 = Custom[Triple Get](indexList=watch_5, indexToGet=code_block_13, dataSublists=watch_6, rowIndex=rowIndex)
code_block_14 = CodeBlock { 5; }
triple_get_12 = Custom[Triple Get](indexList=watch_5, indexToGet=code_block_14, dataSublists=watch_6, rowIndex=rowIndex)
code_block_15 = CodeBlock { 7; }
triple_get_13 = Custom[Triple Get](indexList=watch_5, indexToGet=code_block_15, dataSublists=watch_6, rowIndex=rowIndex)

watch_7 = Watch(triple_get)
to_float_2 = Custom[To Float](unknown=watch_7)
watch_8 = Watch(triple_get_2)
to_float_3 = Custom[To Float](unknown=watch_8)
csvHeadingList = Input(csvHeadingList : var[]..[])

# group: Getting points
string_19 = StringInput("FB0J")
string_20 = StringInput("WT0J")
string_21 = StringInput("WT0K")

string_22 = StringInput("FB00")
watch_9 = Watch(triple_get_3)

# group: North or South?
string_23 = StringInput("South")
eq = string_23 == watch_9
boolean_to_int = Custom[Boolean to Int](item=eq)  # 0 false, 1 true

watch_10 = Watch(boolean_to_int)
chooser = Custom[Chooser](zeroItem=string_19, oneItem=string_22, zeroOrOne=watch_10)
watch_11 = Watch(chooser)

# group (continued): Getting points
get_xyz_values_by_string_name = Custom[Get XYZ Values by String Name from Lists](dataList=chainageCsvData, headingList=csvHeadingList, stringName=watch_11)

string_24 = StringInput("WT00")
chooser_2 = Custom[Chooser](zeroItem=string_20, oneItem=string_24, zeroOrOne=watch_10)

# group (continued): Getting points
get_xyz_values_by_string_name_2 = Custom[Get XYZ Values by String Name from Lists](dataList=chainageCsvData, headingList=csvHeadingList, stringName=chooser_2)

string_25 = StringInput("WT01")
chooser_3 = Custom[Chooser](zeroItem=string_21, oneItem=string_25, zeroOrOne=watch_10)

# group (continued): Getting points
get_xyz_values_by_string_name_3 = Custom[Get XYZ Values by String Name from Lists](dataList=chainageCsvData, headingList=csvHeadingList, stringName=chooser_3)

# group: may be redundant
create_2 = List.Create(get_xyz_values_by_string_name.Xvalues, get_xyz_values_by_string_name.Yvalues, get_xyz_values_by_string_name.Zvalues)
create_3 = List.Create(get_xyz_values_by_string_name_2.Xvalues, get_xyz_values_by_string_name_2.Yvalues, get_xyz_values_by_string_name_2.Zvalues)
create_4 = List.Create(get_xyz_values_by_string_name_3.Xvalues, get_xyz_values_by_string_name_3.Yvalues, get_xyz_values_by_string_name_3.Zvalues)
create_5 = List.Create(create_2, create_3, create_4)
unpack_three_sublists = Custom[Unpack Three Sublists](list=create_5)
unpack_three_sublists_2 = Custom[Unpack Three Sublists](list=unpack_three_sublists.one)
unpack_three_sublists_3 = Custom[Unpack Three Sublists](list=unpack_three_sublists.zero)
unpack_three_sublists_4 = Custom[Unpack Three Sublists](list=unpack_three_sublists.two)

get_points_of_interest_using = Custom[Get Points of Interest Using Chainage](ChainageList=to_float, start=to_float_2, end=to_float_3, X_list=unpack_three_sublists_2.zero, Y_list=unpack_three_sublists_2.one, Z_list=unpack_three_sublists_2.two)
watch_12 = Watch(get_points_of_interest_using.NurbsCurve)
get_points_of_interest_using_2 = Custom[Get Points of Interest Using Chainage](ChainageList=to_float, start=to_float_2, end=to_float_3, X_list=unpack_three_sublists_3.zero, Y_list=unpack_three_sublists_3.one, Z_list=unpack_three_sublists_3.two)
watch_13 = Watch(triple_get_4)
watch_14 = Watch(watch_13)

# group: offset lower line by distance
code_block_16 = CodeBlock { -350; }
code_block_17 = CodeBlock { 350; }
chooser_4 = Custom[Chooser](zeroItem=code_block_16, oneItem=code_block_17, zeroOrOne=watch_10)

boolean = BoolSelector(false)
fourFloorLowerFloorType = Input(fourFloorLowerFloorType : FloorType)

# group: helps chooser
string_26 = StringInput("Not this one")

mainHostLevel = Input(mainHostLevel : var[]..[])
watch_15 = Watch(triple_get_5)

# group: fourFloor
string_27 = StringInput("Not this one")
string_28 = StringInput("FourFloor")
eq_2 = watch_15 == string_28
boolean_to_int_2 = Custom[Boolean to Int](item=eq_2)
chooser_5 = Custom[Chooser](zeroItem=string_26, oneItem=mainHostLevel, zeroOrOne=boolean_to_int_2)
watch_16 = Watch(chooser_5)

# group: use parameter
string_29 = StringInput("Comments")

watch_17 = Watch(triple_get_6)
boolean_2 = BoolSelector(true)
fourFloorBankedFloorType = Input(fourFloorBankedFloorType : FloorType)
get_points_of_interest_using_3 = Custom[Get Points of Interest Using Chainage](ChainageList=to_float, start=to_float_2, end=to_float_3, X_list=unpack_three_sublists_4.zero, Y_list=unpack_three_sublists_4.one, Z_list=unpack_three_sublists_4.two)
watch_18 = Watch(get_points_of_interest_using_3.PointList)

# group: re-sample point data
sample_curve_by_divisions = Custom[Sample Curve By Divisions](points=get_points_of_interest_using_2.PointList, divisions=watch_14)
sample_curve_by_divisions_2 = Custom[Sample Curve By Divisions](points=get_points_of_interest_using.PointList, divisions=watch_14)
sample_curve_by_divisions_3 = Custom[Sample Curve By Divisions](points=watch_18, divisions=watch_14)

# group: offset lower
code_block_18 = CodeBlock { -100; }
code_block_19 = CodeBlock { 100; }
offset_points_by_polycurve_and = Custom[Offset Points By PolyCurve and Distance](points=sample_curve_by_divisions.sampled, distanceMayBeNegative=code_block_19)

byPoints = PolyCurve.ByPoints(points=offset_points_by_polycurve_and)
curves = PolyCurve.Curves(byPoints)

# group: offset lower
code_block_20 = CodeBlock { 100; }
code_block_21 = CodeBlock { -100; }

chooser_6 = Custom[Chooser](zeroItem=code_block_20, oneItem=code_block_21, zeroOrOne=watch_10)

# group (continued): offset lower
offset_points_by_polycurve_and_2 = Custom[Offset Points By PolyCurve and Distance](points=sample_curve_by_divisions.sampled, distanceMayBeNegative=chooser_6)

# group: make floors
point_lists_to_shape_edited = Custom[Point Lists to Shape Edited Floors](mainPointList=offset_points_by_polycurve_and_2, offset=chooser_4, useBothPointListsBool=boolean, secondPointList=sample_curve_by_divisions_2.sampled, floorType=fourFloorLowerFloorType, level=watch_16)  # Can use one or two point 'strings'

watch_19 = Watch(point_lists_to_shape_edited)
point_lists_to_shape_edited_2 = Custom[Point Lists to Shape Edited Floors](mainPointList=sample_curve_by_divisions.sampled, offset=chooser_4, useBothPointListsBool=boolean_2, secondPointList=sample_curve_by_divisions_2.sampled, floorType=fourFloorBankedFloorType, level=watch_16)
watch_20 = Watch(point_lists_to_shape_edited_2)
watch_21 = Watch(sample_curve_by_divisions_3.sampled)
fourFloorUpperFloorType = Input(fourFloorUpperFloorType : FloorType)
point_lists_to_shape_edited_3 = Custom[Point Lists to Shape Edited Floors](mainPointList=sample_curve_by_divisions_2.sampled, offset=chooser_4, useBothPointListsBool=boolean_2, secondPointList=watch_21, floorType=fourFloorUpperFloorType, level=watch_16)
watch_22 = Watch(point_lists_to_shape_edited_3)
code_block_22 = CodeBlock { -100; }
offset_point_z_value = Custom[Offset Point Z Value](points=sample_curve_by_divisions_3.sampled, desiredOffset=code_block_22)
watch_23 = Watch(offset_point_z_value)
code_block_23 = CodeBlock { -500; }
code_block_24 = CodeBlock { 500; }
chooser_7 = Custom[Chooser](zeroItem=code_block_23, oneItem=code_block_24, zeroOrOne=watch_10)
boolean_3 = BoolSelector(false)
fourFloorUpperFootingType = Input(fourFloorUpperFootingType : FloorType)
point_lists_to_shape_edited_4 = Custom[Point Lists to Shape Edited Floors](mainPointList=watch_23, offset=chooser_7, useBothPointListsBool=boolean_3, secondPointList=watch_21, floorType=fourFloorUpperFootingType, level=watch_16)
watch_24 = Watch(point_lists_to_shape_edited_4)

# group: FourFloor Elements
setParameterByName = Element.SetParameterByName(element=watch_19, parameterName=string_29, value=watch_17)
setParameterByName_2 = Element.SetParameterByName(element=watch_20, parameterName=string_29, value=watch_17)
setParameterByName_3 = Element.SetParameterByName(element=watch_22, parameterName=string_29, value=watch_17)
setParameterByName_4 = Element.SetParameterByName(element=watch_24, parameterName=string_29, value=watch_17)
create_6 = List.Create(setParameterByName, setParameterByName_2, setParameterByName_3, setParameterByName_4)

create_7 = List.Create(offset_points_by_polycurve_and_2, sample_curve_by_divisions_2.sampled)
watch_25 = Watch(triple_get_7)

# group: add anchors
string_30 = StringInput("Not this one")
string_31 = StringInput("Yes")
eq_3 = watch_25 == string_31
boolean_to_int_3 = Custom[Boolean to Int](item=eq_3)
chooser_8 = Custom[Chooser](zeroItem=string_30, oneItem=create_7, zeroOrOne=boolean_to_int_3)
watch_26 = Watch(chooser_8)

code_block_25 = CodeBlock { 0; }
getItemAtIndex_2 = List.GetItemAtIndex(list=watch_26, index=code_block_25)
flatten = Flatten(getItemAtIndex_2)
code_block_26 = CodeBlock { 1; }
getItemAtIndex_3 = List.GetItemAtIndex(list=watch_26, index=code_block_26)
flatten_2 = Flatten(getItemAtIndex_3)
watch_27 = Watch(triple_get_8)
to_float_4 = Custom[To Float](unknown=watch_27)
structuralFramingLevel = Input(structuralFramingLevel : Level)
structuralFramingType = Input(structuralFramingType : FamilyType)
watch_28 = Watch(triple_get_9)
to_float_5 = Custom[To Float](unknown=watch_28)
place_soil_anchors_at_spacing = Custom[Place Soil Anchors at Spacing](pointList1=flatten, pointList2=flatten_2, spacing=to_float_4, level=structuralFramingLevel, structuralFramingType=structuralFramingType, anchorlength=to_float_5)

# group: Set Type
setParameterByName_5 = Element.SetParameterByName(element=place_soil_anchors_at_spacing.StructuralFraming, parameterName=string_29, value=watch_17)

watch_29 = Watch(get_points_of_interest_using.PointList)
flatten_3 = Flatten(watch_29)
pruneDuplicates = Point.PruneDuplicates(points=flatten_3)
code_block_27 = CodeBlock { 0; }
watch_30 = Watch(get_points_of_interest_using_3.PointList)
flatten_4 = Flatten(watch_30)
pruneDuplicates_2 = Point.PruneDuplicates(points=flatten_4)
string_32 = StringInput("Floors")
code_block_28 = CodeBlock { 17; }
triple_get_14 = Custom[Triple Get](indexList=watch_5, indexToGet=code_block_28, dataSublists=watch_6, rowIndex=rowIndex)

# group: Cap Floor Type
watch_31 = Watch(triple_get_14)

get_type_element_by_category_and = Custom[Get Type Element by Category and Type Name](categoryNameString=string_32, typeNameString=watch_31)
pileLevel = Input(pileLevel : var[]..[])

# group: PileAndCap
string_33 = StringInput("PileAndCap")
eq_4 = watch_15 == string_33
boolean_to_int_4 = Custom[Boolean to Int](item=eq_4)
chooser_9 = Custom[Chooser](zeroItem=string_26, oneItem=pileLevel, zeroOrOne=boolean_to_int_4)

# group: Capping Floor
boolean_4 = BoolSelector(true)
point_lists_to_shape_edited_5 = Custom[Point Lists to Shape Edited Floors](mainPointList=pruneDuplicates, offset=code_block_27, useBothPointListsBool=boolean_4, secondPointList=pruneDuplicates_2, floorType=get_type_element_by_category_and, level=chooser_9)
watch_32 = Watch(point_lists_to_shape_edited_5)

setParameterByName_6 = Element.SetParameterByName(element=watch_32, parameterName=string_29, value=watch_17)
create_8 = List.Create(setParameterByName_6)
deconstructPolyCurve = Geometry.Curves.DeconstructPolyCurve(byPoints)
flatten_5 = Flatten(deconstructPolyCurve)
firstItem = List.FirstItem(sample_curve_by_divisions_2.sampled@L2)
deconstructPoint = Geometry.Points.DeconstructPoint(firstItem)
firstItem_2 = List.FirstItem(deconstructPoint.out2@L1)
firstItem_3 = List.FirstItem(offset_points_by_polycurve_and@L2)
deconstructPoint_2 = Geometry.Points.DeconstructPoint(firstItem_3)
firstItem_4 = List.FirstItem(deconstructPoint_2.out2@L1)
code_block_29 = CodeBlock(x=firstItem_2, y=firstItem_4) { x-y; }
wallLevel = Input(wallLevel : Level)
wallType = Input(wallType : var[]..[])

# group: tapered wall
string_34 = StringInput("TaperedWall--notInUse")
eq_5 = watch_15 == string_34
boolean_to_int_5 = Custom[Boolean to Int](item=eq_5)
chooser_10 = Custom[Chooser](zeroItem=string_26, oneItem=wallType, zeroOrOne=boolean_to_int_5)
watch_33 = Watch(chooser_10)

byCurveAndHeight = Wall.ByCurveAndHeight(curve=flatten_5, height=code_block_29, level=wallLevel, wallType=watch_33, lacing=Longest)
setParameterByName_7 = Element.SetParameterByName(element=byCurveAndHeight, parameterName=string_29, value=watch_17)
watch_34 = Watch(setParameterByName_7)
create_9 = List.Create(watch_34)

# group: oneFloor
string_35 = StringInput("OneFloor")
eq_6 = watch_15 == string_35
boolean_to_int_6 = Custom[Boolean to Int](item=eq_6)
chooser_11 = Custom[Chooser](zeroItem=string_26, oneItem=mainHostLevel, zeroOrOne=boolean_to_int_6)
watch_35 = Watch(chooser_11)

point_lists_to_shape_edited_6 = Custom[Point Lists to Shape Edited Floors](mainPointList=sample_curve_by_divisions.sampled, offset=chooser_4, useBothPointListsBool=boolean_2, secondPointList=sample_curve_by_divisions_2.sampled, floorType=fourFloorBankedFloorType, level=watch_35)
setParameterByName_8 = Element.SetParameterByName(element=point_lists_to_shape_edited_6, parameterName=string_29, value=watch_17)

# group: use parameter
string_36 = StringInput("Mark")

code_block_30 = CodeBlock { 15; }
triple_get_15 = Custom[Triple Get](indexList=watch_5, indexToGet=code_block_30, dataSublists=watch_6, rowIndex=rowIndex)

# group: MARK
watch_36 = Watch(triple_get_15)

setParameterByName_9 = Element.SetParameterByName(element=setParameterByName_8, parameterName=string_36, value=watch_36)

# group: Copy Phase
create_10 = List.Create(create_6, setParameterByName_5, create_8, create_9, setParameterByName_9)
flatten_6 = Flatten(create_10)
removeNulls = Lists.Manage.RemoveNulls(flatten_6)
string_37 = StringInput("CommentLine6")
string_38 = StringInput("beforeCopy")
setParameterByName_10 = Element.SetParameterByName(element=removeNulls, parameterName=string_37, value=string_38)
copy_elements_to_same_place = Custom[Copy Elements To Same Place](elements=setParameterByName_10)
string_39 = StringInput("CommentLine6")
string_40 = StringInput("afterCopy")
setParameterByName_11 = Element.SetParameterByName(element=copy_elements_to_same_place, parameterName=string_39, value=string_40)
setParameterByName_12 = Element.SetParameterByName(element=setParameterByName_11, parameterName=string_36, value=watch_36)

code_block_31 = CodeBlock { 14; }
triple_get_16 = Custom[Triple Get](indexList=watch_5, indexToGet=code_block_31, dataSublists=watch_6, rowIndex=rowIndex)
watch_37 = Watch(triple_get_16)
to_float_6 = Custom[To Float](unknown=watch_37)
code_block_32 = CodeBlock(x=to_float_6) { x/2; }
code_block_33 = CodeBlock { 13; }
triple_get_17 = Custom[Triple Get](indexList=watch_5, indexToGet=code_block_33, dataSublists=watch_6, rowIndex=rowIndex)
watch_38 = Watch(triple_get_17)
to_float_7 = Custom[To Float](unknown=watch_38)
code_block_34 = CodeBlock(x=to_float_7) { x/2; }

# group: not sure why this offset was here
code_block_35 = CodeBlock { u-50; }  # unwired: u
watch_39 = Watch(code_block_34)

code_block_36 = CodeBlock(x=watch_39) { x*-1; }

# group: offset lower line by distance
chooser_12 = Custom[Chooser](zeroItem=watch_39, oneItem=code_block_36, zeroOrOne=watch_10)

watch_40 = Watch(triple_get_10)
watch_41 = Watch(triple_get_11)
code_block_37 = CodeBlock(x=watch_40, o=watch_41) { (x-o)*-1; }
watch_42 = Watch(triple_get_12)
watch_43 = Watch(triple_get_13)
pile_column_layout_tool = Custom[Pile Column Layout Tool](B_startPointOffset=code_block_32, drivingPoints=watch_29, A_offsetToColumnLine=chooser_12, D_topZoffset=code_block_37, C_spacing=watch_42, E_columnLengthZOffset=watch_43)  # uses a list of points and various offsets
string_41 = StringInput("Structural Columns")
code_block_38 = CodeBlock { 16; }
triple_get_18 = Custom[Triple Get](indexList=watch_5, indexToGet=code_block_38, dataSublists=watch_6, rowIndex=rowIndex)

# group: Pile Type
watch_44 = Watch(triple_get_18)

get_type_element_by_category_and_2 = Custom[Get Type Element by Category and Type Name](categoryNameString=string_41, typeNameString=watch_44)

# group: Columns
structural_column_by_curve_in = Custom[Structural Column By Curve In Transaction](curves=pile_column_layout_tool, columnType=get_type_element_by_category_and_2, level=chooser_9)

watch_45 = Watch(structural_column_by_curve_in)
setParameterByName_13 = Element.SetParameterByName(element=watch_45, parameterName=string_29, value=watch_17)
setParameterByName_14 = Element.SetParameterByName(element=setParameterByName_13, parameterName=string_36, value=watch_36)
watch_46 = Watch(setParameterByName_14)
string_42 = StringInput("CommentLine6")
string_43 = StringInput("noCopy")
setParameterByName_15 = Element.SetParameterByName(element=watch_46, parameterName=string_42, value=string_43)
create_11 = List.Create(setParameterByName_12, setParameterByName_15)
flatten_7 = Flatten(create_11)
removeNulls_2 = Lists.Manage.RemoveNulls(flatten_7)
end = Revit.Transaction.Transaction.End(removeNulls_2)
created = Output(end)
watch_47 = Watch(flatten)
watch_48 = Watch(flatten_2)
watch_49 = Watch(getItemAtIndex_2)
