# Dynamo custom node Batch Export Revit Views to IFC.dyf (Dynamo 0.9.2.4472)
# category: Bakery.BIM.IFC

current = Document.Current()
filePath = Document.FilePath(current)
fileName = FilePath.FileName(filePath)
string = StringInput(".")
split = String.Split(fileName, string)
watch = Watch(split)
number = DoubleInput(0)
getItemAtIndex = List.GetItemAtIndex(list=watch, index=number)
string_2 = StringInput("_")
add = getItemAtIndex + string_2  # lacing=Longest
boolean = BoolSelector(false)
views = Custom[Document.Views](toggle=boolean)  # Gets all views in the document - except for 3D view templates (as long as this bug is not fixed: https://github.com/DynamoDS/Dynamo/issues/2970)
watch_2 = Watch(views)
element_name_universal = Custom[Element Name Universal](Element_s=watch_2)  # Modified for 0.8.1
create = List.Create(element_name_universal)
viewPrefix = Input()
startsWith = String.StartsWith(str=create, searchFor=viewPrefix)
filterByBoolMask = List.FilterByBoolMask(list=create, mask=startsWith)
create_2 = List.Create(filterByBoolMask.in)
flatten = Flatten(create_2)
add_2 = add + flatten  # lacing=Longest
flatten_2 = Flatten(startsWith)
filterByBoolMask_2 = List.FilterByBoolMask(list=watch_2, mask=flatten_2)
create_3 = List.Create(add_2, filterByBoolMask_2.in)
list_length_validator = Custom[List Length Validator](listOfLists=create_3)
watch_3 = Watch(list_length_validator)
targetDirectoryPath = Input()
IFCversion = Input(IFCversion : string = "IFC2x3")
boolean_2 = BoolSelector(false)
python_script = Python(IN[0]=targetDirectoryPath, IN[1]=add_2, IN[2]=IFCversion, IN[3]=boolean_2, IN[4]=boolean_2, IN[5]=filterByBoolMask_2.in)
# ---------- python_script.python (85 lines) ----------
#python nodes in dynamo 0.7
#proposed by Nicklas Verdier Østergaard, nvo@niras.dk
#Based on tools.dwf by Julien Benoit @jbenoit44
#http://aecuandme.wordpress.com/
import clr
clr.AddReference('ProtoGeometry')
from Autodesk.DesignScript.Geometry import *
# Import ToDSType(bool) extension method
clr.AddReference("RevitNodes")
import Revit
clr.ImportExtensions(Revit.Elements)
# Import geometry conversion extension methods
clr.ImportExtensions(Revit.GeometryConversion)
# Import DocumentManager and TransactionManager
clr.AddReference("RevitServices")
import RevitServices
from RevitServices.Persistence import DocumentManager
from RevitServices.Transactions import TransactionManager
from System.Collections.Generic import *
# Import RevitAPI
clr.AddReference("RevitAPI")
import Autodesk
from Autodesk.Revit.DB import *

doc = DocumentManager.Instance.CurrentDBDocument
uiapp = DocumentManager.Instance.CurrentUIApplication
app = uiapp.Application
uidoc=DocumentManager.Instance.CurrentUIApplication.ActiveUIDocument

#The inputs to this node will be stored as a list in the IN variable.
#dataEnteringNode = IN

folder=UnwrapElement(IN[0])
name=UnwrapElement(IN[1])
fileversion = IN[2]
wallandcolumnsplitting = IN[3]
exportbasequantities = IN[4]
view = UnwrapElement(IN[5])


#IFCVersion=UnwrapElement(IN[2])

# Start Transaction
TransactionManager.Instance.EnsureInTransaction(doc)
total_export = []

for i,v in enumerate(view):
	options=IFCExportOptions()
	
	#if fileversion != None:
	#	options.FileVersion = fileversion
	if fileversion == "IFC4":
		options.FileVersion = IFCVersion.IFC4
	if fileversion == "IFC2x2":
		options.FileVersion = IFCVersion.IFC2x2
	if fileversion == "IFC2x3":
		options.FileVersion = IFCVersion.IFC2x3
	if fileversion == "IFC2x3":
		options.FileVersion = IFCVersion.IFC2x3CV2
	if fileversion == "IFCBCA":
		options.FileVersion = IFCVersion.IFCBCA
	if fileversion == "IFCCOBIE":
		options.FileVersion = IFCVersion.IFCCOBIE
	if fileversion == "":
		options.FileVersion = IFCVersion.Default
		
		
	options.WallAndColumnSplitting = wallandcolumnsplitting
	options.ExportBaseQuantities = exportbasequantities
	options.FilterViewId = v.Id


#IFCVersion Version = (IFCVersion) Enum.Parse( typeof(IFCVersion), UnwrapElement(IN[2]), true );
#x.FileVersion = IFCVersion.IFC2x3CV2

	c=doc.Export(folder, name[i], options)
	total_export.append(c)

# End Transaction
TransactionManager.Instance.TransactionTaskDone()

if fileversion == "":
	OUT="Default settings used"
else:
	OUT=total_export
# ----------------------------------------
done = Output(python_script)
