# Dynamo custom node Batch Modify Workset of All Elements.dyf (Dynamo 0.9.2.4472)
# category: Bakery.Revit.Document.Worksets
# for all elements in current model

targetWorksetName = Input()
select_workset_by_name = Custom[Select Workset by Name](worksetName=targetWorksetName)
elementsToChange = Input()
watch = Watch(elementsToChange)
setWorkset = Custom[Element.SetWorkset](workset=select_workset_by_name, element=watch)  # Sets the workset of a given element
changedElements = Output(setWorkset.changedElements)
unchangedElements = Output(setWorkset.unchangedElements)
elementsToChange_2 = Output(watch)  # "elementsToChange"
targetWorksetDb = Output(select_workset_by_name)
