# Dynamo custom node Bruteforce Get Parameter Value by Name.dyf (Dynamo 0.8.0.950)
# category: Bakery.Revit.Parameters
# If Element.Parameters shows a value, this node will search for it and return the value or an optional empty value replacement.

element_or_elements = Input()
parameterName = Input()
replaceEmptyValueWith = Input()
bruteforce_get_parameter_via = Custom[Bruteforce Get Parameter via String Split V2](parameterName=parameterName, replaceEmptyWithString=replaceEmptyValueWith)  # BETTER
map = List.Map(list=element_or_elements, f_x=bruteforce_get_parameter_via)
flatten = Flatten(map)
BruteForceValues = Output(flatten)
eq = flatten == replaceEmptyValueWith
watch = Watch(eq)
string = StringInput("None")
eq_2 = flatten == string
watch_2 = Watch(eq_2)
create = List.Create(watch, watch_2)
transpose = List.Transpose(create)
watch_3 = Watch(transpose)
anyFalse = Custom[List.AnyFalse]()  # Returns true if any item in a list of booleans is false.
map_2 = List.Map(list=watch_3, f_x=anyFalse)
filterByBoolMask = List.FilterByBoolMask(list=element_or_elements, mask=map_2)
getParameterValueByName = Element.GetParameterValueByName(parameterName=parameterName)
map_3 = List.Map(list=filterByBoolMask.in, f_x=getParameterValueByName)
TryDynamoGetParameter = Output(map_3)
watch_4 = Watch(flatten)
