# Dynamo custom node Bruteforce Get Parameter via String Split for Single element.dyf (Dynamo 0.8.0.950)
# category: Bakery.Revit.Parameters
# Returns a String. Use ListMap for multiple elements. This node uses Element.Parameters node to get all values, then look for first occurrence of the selected parameter name, then gives that value. Beta... single is faster than the other one.

element = Input()
parameters = Element.Parameters(element)
string_from_array = FromArray(parameters)
string = StringInput(" :")
parameterName = Input()
string_2 = StringInput(" ")
join = String.Join(string, parameterName, string_2)
split = String.Split(string_from_array, join)
number_slider = DoubleSlider(1, range=0..100 step 0.1)
getItemAtIndex = List.GetItemAtIndex(list=split, index=number_slider)
string_3 = StringInput(",")
split_2 = String.Split(getItemAtIndex, string_3)
firstItem = List.FirstItem(split_2)
value = Output(firstItem)
watch = Watch(join)
