# Dynamo custom node Bruteforce Get Two Parameters and Join to One String.dyf (Dynamo 0.8.0.950)
# category: Bakery.Revit.Parameters
# The first value is Element ID. use with List.Map

separator = Input()
elements = Input()
element_ids = Custom[Element Ids](Element_s=elements)  # This node will query an element id that can be used with Revit nodes. Dynamo Element Id node returns integer value.
firstItem = List.FirstItem(element_ids.Rvt_ElementId_s)
string_from_object = FromObject(firstItem)
parameterOne = Input()
replaceEmptyWith = Input()
bruteforce_get_parameter_value = Custom[Bruteforce Get Parameter Value by Name](element_or_elements=elements, parameterName=parameterOne, replaceEmptyValueWith=replaceEmptyWith)  # If Element.Parameters shows a value, this node will search for it and return the value or an optional empty value replacement.
string_from_object_2 = FromObject(bruteforce_get_parameter_value.BruteForceValues)
parameterTwo = Input()
bruteforce_get_parameter_value_2 = Custom[Bruteforce Get Parameter Value by Name](element_or_elements=elements, parameterName=parameterTwo, replaceEmptyValueWith=replaceEmptyWith)
string_from_object_3 = FromObject(bruteforce_get_parameter_value_2.BruteForceValues)
join = String.Join(separator, string_from_object, string_from_object_2, string_from_object_3)
joinedString = Output(join)
watch = Watch(join)
