# Dynamo custom node Build BCF Subfolder from Lists.dyf (Dynamo 2.3.1.11775)
# category: Bakery.BIM.BCF.Helper
# packages: Bakery 2020.1.14

# group: scale factor
code_block = CodeBlock { 1000; }

# group: guid
string = StringInput("73e35309-edc3-1a07-d11c-27200359fb0c")  # graph input

# group: z offset
code_block_2 = CodeBlock { 1.2; }

# group: example comment
string_2 = StringInput("<Comment>https://www.virtualbuiltapp.com/apps/app_rah/index.php?-table=fm_db_browser_view&amp;-limit=30&amp;DB_Tree_Board=DB-2-010-02</Comment>")  # graph input

# group: old for single file
copy_file_to_directory = Custom[Copy File to Directory]()  # package Bakery; unwired: filePath, targetDirString, go

# group: path sep
string_3 = StringInput("\")  # graph input

parentPath = Input(parentPath: var[]..[])

# group: path
watch = Watch(parentPath)

firstItem = List.FirstItem(list=watch)
fromPath = DirectoryObject(path=firstItem)  # "Directory.FromPath"
generatedBcfguidlist = Input(generatedBcfguidlist: var[]..[])
counter = Input(counter: int)
getItemAtIndex = List.GetItemAtIndex(list=generatedBcfguidlist, index=counter)
watch_2 = Watch(getItemAtIndex)

# group: issue guid
string_4 = StringInput("af0894a1-f240-4b50-8eaa-cd95a9a69e6b")  # graph input
watch_3 = Watch(watch_2)

python_script = Python(IN[0]=fromPath, IN[1]=watch_2)
# ---------- python_script.python (42 lines) ----------
import clr
clr.AddReference('ProtoGeometry')
from Autodesk.DesignScript.Geometry import *

# Import RevitAPI
clr.AddReference("RevitAPI")
import Autodesk
from Autodesk.Revit.DB import *

clr.AddReference("RevitServices")
import RevitServices
from RevitServices.Persistence import DocumentManager
from RevitServices.Transactions import TransactionManager

from System.Collections.Generic import *

clr.AddReference('RevitNodes')
import Revit
clr.ImportExtensions(Revit.Elements)
clr.ImportExtensions(Revit.GeometryConversion)

from System import Guid

import System


import sys
pyt_path = r'C:\Program Files (x86)\IronPython 2.7\Lib'
sys.path.append(pyt_path)
import base64
import uuid
     
import os

dirpath = IN[0]
dirname = IN[1]
try:
	os.makedirs(str(dirpath) + "\\" + dirname)
	done=True
except:
	done=False
OUT=done
# ----------------------------------------
watch_4 = Watch(python_script)
string_5 = StringInput("\")  # graph input
switch = Custom[Switch](booleanswitch=watch_4, data=string_5)  # package Bakery
firstItem_2 = List.FirstItem(list=switch)
join = String.Join(separator=firstItem_2, string0=firstItem, string1=watch_2)
watch_5 = Watch(join)
firstItem_3 = List.FirstItem(list=watch_5)

# group: blank separator
string_6 = StringInput("")  # graph input

# group: typical
string_7 = StringInput("<?xml version=\"1.0\" encoding=\"utf-8\"?>\n<VisualizationInfo xmlns:xsd=\"http://www.w3.org/2001/XMLSchema\" xmlns:xsi=\"http://www.w3.org/2001/XMLSchema-instance\" Guid=\"")  # graph input
string_8 = StringInput("\">\n  <Components>\n    <ViewSetupHints SpacesVisible=\"true\" SpaceBoundariesVisible=\"false\" OpeningsVisible=\"false\" />\n    <Selection>\n      <Component IfcGuid=\"")  # graph input
string_9 = StringInput("""">
        <AuthoringToolId>""")  # graph input
string_10 = StringInput("""</AuthoringToolId>
      </Component>
    </Selection>
    <Visibility DefaultVisibility="true">
      <Exceptions />
    </Visibility>
    <Coloring />
  </Components>
  <PerspectiveCamera>""")  # graph input

# group: viewpoint guid
output_one_guid_string = Custom[Output One GUID String]()  # package Bakery

# group: viewpoint guid
string_11 = StringInput("73e35309-edc3-1a07-d11c-27200359fb0c")  # graph input
watch_6 = Watch(output_one_guid_string)

ifcguids = Input(ifcguids: var[]..[])
getItemAtIndex_2 = List.GetItemAtIndex(list=ifcguids, index=counter)
elementIds = Input(elementIds: var[]..[])
getItemAtIndex_3 = List.GetItemAtIndex(list=elementIds, index=counter)
string_from_object = FromObject(obj=getItemAtIndex_3)
watch_7 = Watch(string_from_object)

# group: viewpoint
string_12 = StringInput("""
    <CameraViewPoint>
      <X>""")  # graph input
string_13 = StringInput("""</X>
      <Y>""")  # graph input
string_14 = StringInput("""</Y>
      <Z>""")  # graph input
string_15 = StringInput("""</Z>
    </CameraViewPoint>
    <CameraDirection>
      <X>-0.53661631067048865</X>
      <Y>-0.82370177633930819</Y>
      <Z>-0.183189297661905</Z>
    </CameraDirection>""")  # graph input

xPositions = Input(xPositions: var[]..[])
getItemAtIndex_4 = List.GetItemAtIndex(list=xPositions, index=counter)

# group: to float
python_script_2 = Python(IN[0]=getItemAtIndex_4)
# ---------- python_script_2.python (9 lines) ----------
import clr
clr.AddReference('ProtoGeometry')
from Autodesk.DesignScript.Geometry import *
import math
#The inputs to this node will be stored as a list in the IN variables.
temp = IN[0]
tostr = str(temp)
#Assign your output to the OUT variable.
OUT = float(tostr)
# ----------------------------------------

singleScaleFactor = Input(singleScaleFactor: var[]..[])
yPositions = Input(yPositions: var[]..[])
getItemAtIndex_5 = List.GetItemAtIndex(list=yPositions, index=counter)

# group: to float
python_script_3 = Python(IN[0]=getItemAtIndex_5)  # same code as python_script_2

zPositions = Input(zPositions: var[]..[])
getItemAtIndex_6 = List.GetItemAtIndex(list=zPositions, index=counter)

# group: to float
python_script_4 = Python(IN[0]=getItemAtIndex_6)  # same code as python_script_2

# group: scale
code_block_3 = CodeBlock(x=python_script_2, y=singleScaleFactor) { x/y; }
string_from_object_2 = FromObject(obj=code_block_3)
code_block_4 = CodeBlock(x=python_script_3, y=singleScaleFactor) { x/y; }
string_from_object_3 = FromObject(obj=code_block_4)
code_block_5 = CodeBlock(x=python_script_4, y=singleScaleFactor) { x/y; }

singleZoffset = Input(singleZoffset: var[]..[])
code_block_6 = CodeBlock(n=code_block_5, m=singleZoffset) { n+m; }

# group (continued): scale
string_from_object_4 = FromObject(obj=code_block_6)

join_2 = String.Join(separator=string_6, string0=string_12, string1=string_from_object_2, string2=string_13, string3=string_from_object_3, string4=string_14, string5=string_from_object_4, string6=string_15)
watch_8 = Watch(join_2)
string_16 = StringInput("""
    <CameraUpVector>
      <X>-0.21851449545008386</X>
      <Y>-0.24077888596162672</Y>
      <Z>0.9456621718950553</Z>
    </CameraUpVector>""")  # graph input
string_17 = StringInput("""
    <FieldOfView>85.686271667480469</FieldOfView>
  </PerspectiveCamera>
</VisualizationInfo>""")  # graph input

# group: viewpoint.bcfv
join_3 = String.Join(separator=string_6, string0=string_7, string1=output_one_guid_string, string2=string_8, string3=getItemAtIndex_2, string4=string_9, string5=watch_7, string6=string_10, string7=watch_8, string8=string_16, string9=string_17)
watch_9 = Watch(join_3)

# group: viewpoints
string_18 = StringInput("viewpoint.bcfv")  # graph input
join_4 = String.Join(separator=string_3, string0=firstItem_3, string1=string_18)
watch_10 = Watch(join_4)
writeText = FileSystem.WriteText(filePath=watch_10, text=watch_9)
isNull = Object.IsNull(obj=writeText)

# group: typical
string_19 = StringInput("<?xml version=\"1.0\" encoding=\"utf-8\"?>\n<Markup xmlns:xsd=\"http://www.w3.org/2001/XMLSchema\" xmlns:xsi=\"http://www.w3.org/2001/XMLSchema-instance\">\n  <Header />\n  <Topic Guid=\"")  # graph input
string_20 = StringInput("""" TopicStatus="Open">
    <Title>""")  # graph input
string_21 = StringInput("""</Title>
    <Priority>None</Priority>
    <CreationDate>2019-05-12T01:15:01Z</CreationDate>
    <CreationAuthor>luke.johnson@spotless.com.au</CreationAuthor>
    <ModifiedDate>2019-05-12T01:15:01.7702189Z</ModifiedDate>
    <AssignedTo>luke.johnson@spotless.com.au</AssignedTo>
  </Topic>""")  # graph input
string_22 = StringInput("  <Viewpoints Guid=\"")  # graph input
string_23 = StringInput("""">
    <Viewpoint>viewpoint.bcfv</Viewpoint>
    <Snapshot>snapshot.png</Snapshot>
    <Index>0</Index>
  </Viewpoints>
</Markup>""")  # graph input

titleList = Input(titleList: var[]..[])
getItemAtIndex_7 = List.GetItemAtIndex(list=titleList, index=counter)
string_24 = StringInput("\n  <Comment Guid=\"")  # graph input

# group: comment guid
output_one_guid_string_2 = Custom[Output One GUID String]()

string_25 = StringInput("""">
    <Date>2019-05-24T00:47:09Z</Date>
    <Author>ljohnson@virtualbuilt.com.au</Author>
    <Comment>""")  # graph input
commentList = Input(commentList: var[]..[])
getItemAtIndex_8 = List.GetItemAtIndex(list=commentList, index=counter)
string_26 = StringInput("</Comment>\n    <Viewpoint Guid=\"")  # graph input
join_5 = String.Join(separator=string_6, string0=string_25, string1=getItemAtIndex_8, string2=string_26)
string_27 = StringInput("""" />
  </Comment>
""")  # graph input
join_6 = String.Join(separator=string_6, string0=string_24, string1=output_one_guid_string_2, string2=join_5, string3=watch_6, string4=string_27)
join_7 = String.Join(separator=string_6, string0=string_19, string1=watch_3, string2=string_20, string3=getItemAtIndex_7, string4=string_21, string5=join_6, string6=string_22, string7=watch_6, string8=string_23)
watch_11 = Watch(join_7)

# group: markup.bcf
string_28 = StringInput("markup.bcf")  # graph input
join_8 = String.Join(separator=string_3, string0=firstItem_3, string1=string_28)
watch_12 = Watch(join_8)
writeText_2 = FileSystem.WriteText(filePath=watch_12, text=watch_11)
isNull_2 = Object.IsNull(obj=writeText_2)

snapshotFilePath = Input(snapshotFilePath: var[]..[])
getItemAtIndex_9 = List.GetItemAtIndex(list=snapshotFilePath, index=counter)
watch_13 = Watch(getItemAtIndex_9)
fromPath_2 = FileObject(path=watch_13)  # "File.FromPath"
code_block_7 = CodeBlock(folder=watch_5) { folder + "\\" + "snapshot.png"; }
copyFile = FileSystem.CopyFile(file=fromPath_2, destinationPath=code_block_7, overwrite=watch_4)
watch_14 = Watch(copyFile)
isNull_3 = Object.IsNull(obj=watch_14)
create = List.Create(item0=isNull, item1=isNull_2, item2=isNull_3)
countTrue = List.CountTrue(list=create)
code_block_8 = CodeBlock { 3; }
eq = countTrue == code_block_8
done = Output(eq)

# group: old
string_29 = StringInput("<?xml version=\"1.0\" encoding=\"utf-8\"?>\n<Markup xmlns:xsi=\"http://www.w3.org/2001/XMLSchema-instance\" xmlns:xsd=\"http://www.w3.org/2001/XMLSchema\">\n  <Header />\n  <Topic Guid=\"")  # graph input

# group: old
string_30 = StringInput("<?xml version=\"1.0\" encoding=\"utf-8\"?>\n<VisualizationInfo xmlns:xsi=\"http://www.w3.org/2001/XMLSchema-instance\" xmlns:xsd=\"http://www.w3.org/2001/XMLSchema\" Guid=\"")  # graph input

type = Object.Type(obj=watch_13)
watch_15 = Watch(type)
type_2 = Object.Type(obj=fromPath_2)
watch_16 = Watch(type_2)
watch_17 = Watch(code_block_7)
type_3 = Object.Type()  # unwired: obj
