# Dynamo custom node Built In Name Lister.dyf (Dynamo 1.1.0.2094)
# category: Bakery.Revit.Document.Category
# lists BuiltInNames (Built In Category Names)

current_document = Custom[Current Document]()  # Retrieves Current Document
python_script = Python(IN[0]=current_document)
# ---------- python_script.python (61 lines) ----------
#LSJ

import clr
clr.AddReference('ProtoGeometry')
from Autodesk.DesignScript.Geometry import *

# Import DocumentManager
clr.AddReference("RevitServices")
import RevitServices
from RevitServices.Persistence import DocumentManager

# Import RevitAPI
clr.AddReference("RevitAPI")
import Autodesk

# Import ToDSType(bool) extension method
clr.AddReference("RevitNodes")
import Revit
from Autodesk.Revit.DB import *
clr.ImportExtensions(Revit.Elements)

import System

#The inputs to this node will be stored as a list in the IN variable.
#doc = DocumentManager.Instance.CurrentDBDocument
#uiapp = DocumentManager.Instance.CurrentUIApplication
#app = uiapp.Application
doc = IN[0]

#create workset collector
userCategories = doc.Settings.Categories
#extract workset's name and ids
ids = []
for i in userCategories:
	try:
		ids.append(i.Id.IntegerValue)
	except:
		ids.append(0)
#Assign your output to the OUT variable
builtInNames = []
for x in ids:
	try:
		builtInNames.append(System.Enum.ToObject(BuiltInCategory, x))
	except:
		builtInNames.append("builtInNameFailure")

builtInNameStr = []
for y in builtInNames:
	try:
		builtInNameStr.append(str(y))
	except:
		builtInNameStr.append("stringConversionFailure")

fullenumcats = System.Enum.GetValues(BuiltInCategory)
fullenumcatids = []
for b in fullenumcats:
	try:
		fullenumcatids.append(userCategories.get_Item(b))
	except:
		fullenumcatids.append("enumerated ID failed")
OUT = builtInNames, fullenumcats, fullenumcatids, ids, userCategories, builtInNameStr
# ----------------------------------------
code_block = CodeBlock { 0; }
getItemAtIndex = List.GetItemAtIndex(list=python_script, index=code_block)
builtins = Output(getItemAtIndex)
list_of_view_related_categories = Custom[List of View Related Categories]()
remove_stringlist_from_list_with = Custom[Remove StringList from List with String Conversion](Original_List=getItemAtIndex, single_string_with_line_breaks=list_of_view_related_categories)
builtins_views_removed = Output(remove_stringlist_from_list_with)
code_block_2 = CodeBlock { 1; }
getItemAtIndex_2 = List.GetItemAtIndex(list=python_script, index=code_block_2)
full_enumeration = Output(getItemAtIndex_2)
code_block_3 = CodeBlock { 2; }
getItemAtIndex_3 = List.GetItemAtIndex(list=python_script, index=code_block_3)
full_enumeration_as_categories = Output(getItemAtIndex_3)
code_block_4 = CodeBlock { 3; }
getItemAtIndex_4 = List.GetItemAtIndex(list=python_script, index=code_block_4)
category_Ids = Output(getItemAtIndex_4)
code_block_5 = CodeBlock { 4; }
getItemAtIndex_5 = List.GetItemAtIndex(list=python_script, index=code_block_5)
doc_categories = Output(getItemAtIndex_5)
code_block_6 = CodeBlock { 0; }
gt = code_block_6 > getItemAtIndex_4
filterByBoolMask = List.FilterByBoolMask(list=getItemAtIndex, mask=gt)
nonNegativeNames = Output(filterByBoolMask.out)
code_block_7 = CodeBlock { 5; }
getItemAtIndex_6 = List.GetItemAtIndex(list=python_script, index=code_block_7)
builtins_as_Strings = Output(getItemAtIndex_6)
