# Dynamo custom node CameraDataToPoint.dyf (Dynamo 2.3.0.5885)
# category: Bakery.Construction.Revizto
# takes one camera cell and makes a point
# packages: Rhythm 2017.1.8, Bakery 2020.1.14

ReviztoCameraData = Input(ReviztoCameraData: var[]..[])

# group: unpack position
watch = Watch(ReviztoCameraData)
string = StringInput("\"position\"")
allIndicesOf = String.AllIndicesOf(str=watch, searchFor=string)
firstItem = List.FirstItem(list=allIndicesOf)
string_2 = StringInput("\"position_bind\"")
allIndicesOf_2 = String.AllIndicesOf(str=watch, searchFor=string_2)
firstItem_2 = List.FirstItem(list=allIndicesOf_2)
code_block = CodeBlock(x=firstItem_2, y=firstItem) { x-y; }
substring = String.Substring(str=watch, startIndex=firstItem, length=code_block)

# group: get X
watch_2 = Watch(substring)
string_3 = StringInput("\"x\"")
allIndicesOf_3 = String.AllIndicesOf(str=watch_2, searchFor=string_3)
firstItem_3 = List.FirstItem(list=allIndicesOf_3)
string_4 = StringInput(",")
allIndicesOf_4 = String.AllIndicesOf(str=watch_2, searchFor=string_4)
firstItem_4 = List.FirstItem(list=allIndicesOf_4)
code_block_2 = CodeBlock(x=firstItem_4, y=firstItem_3) { x-y; }
substring_2 = String.Substring(str=watch_2, startIndex=firstItem_3, length=code_block_2)

# group: some necessary scaling
code_block_3 = CodeBlock { -304.8; }
code_block_4 = CodeBlock { -1; }

# group: scale X
string_5 = StringInput(":")
removePriorToCharacter = Custom[String.RemovePriorToCharacter](str=substring_2, Character=string_5)  # package Rhythm; This will remove all characters prior to the input character. Accepts strings.
watch_3 = Watch(removePriorToCharacter)
to_float = Custom[To Float](unknown=watch_3)  # package Bakery; converts input object to a float with python
code_block_5 = CodeBlock(x=to_float, y=code_block_3) { x*y; }

watch_4 = Watch(code_block_5)

# group: negative
code_block_6 = CodeBlock(x=watch_4, y=code_block_4) { x*y; }

# group: string cleanup
length = String.Length(str=string)
length_2 = String.Length(str=string_3)
length_3 = String.Length(str=removePriorToCharacter)
code_block_7 = CodeBlock { 4; }
code_block_8 = CodeBlock(x=length, y=length_2, z=length_3, a=code_block_7) { x+y+z+a; }

# group: remove already used part
code_block_9 = CodeBlock { 0; }
remove = String.Remove(str=watch_2, startIndex=code_block_9, count=code_block_8)
watch_5 = Watch(remove)

# group: get Z
watch_6 = Watch(watch_5)
string_6 = StringInput("\"z\"")
allIndicesOf_5 = String.AllIndicesOf(str=watch_6, searchFor=string_6)
firstItem_5 = List.FirstItem(list=allIndicesOf_5)
string_7 = StringInput("}")
allIndicesOf_6 = String.AllIndicesOf(str=watch_6, searchFor=string_7)
firstItem_6 = List.FirstItem(list=allIndicesOf_6)
code_block_10 = CodeBlock(x=firstItem_6, y=firstItem_5) { x-y; }
substring_3 = String.Substring(str=watch_6, startIndex=firstItem_5, length=code_block_10)

# group: scale Z
string_8 = StringInput(":")
removePriorToCharacter_2 = Custom[String.RemovePriorToCharacter](str=substring_3, Character=string_8)
watch_7 = Watch(removePriorToCharacter_2)
to_float_2 = Custom[To Float](unknown=watch_7)
code_block_11 = CodeBlock(x=to_float_2, y=code_block_3) { x*y; }

# group: Gets Location in relation to Revits origin
surveyPoint = Coordinates.SurveyPoint()
byOrigin = CoordinateSystem.ByOrigin(origin=surveyPoint)

# group: Get project base point data
categories = Categories("OST_ProjectBasePoint")  # graph input
all_elements_of_category = ElementsOfCategory(Category=categories)
code_block_12 = CodeBlock()
# ---------- code_block_12.designscript (2 lines) ----------
["E/W","N/S","Elev",
"Angle to True North"];
# ----------------------------------------
getParameterValueByName = Element.GetParameterValueByName(element=all_elements_of_category, parameterName=code_block_12, lacing=Longest)
code_block_13 = CodeBlock(bp=getParameterValueByName) { bp[0]; bp[1]; bp[2]; bp[3]; }

# group: Rotates coordinate system to match north point rotation.
ZAxis = Vector.ZAxis()
rotate = CoordinateSystem.Rotate(coordinateSystem=byOrigin, origin=surveyPoint, axis=ZAxis, degrees=code_block_13.out3)

# group: This is the location of revits origin 0,0,0
identity = CoordinateSystem.Identity()

# group: gets model origin, converts to survey coordinates and extracts x /y values
code_block_14 = CodeBlock { 0; }
byCoordinates = Point.ByCoordinates(x=code_block_6, y=code_block_11)
transform = Geometry.Transform(geometry=byCoordinates, fromCoordinateSystem=rotate, contextCoordinateSystem=identity)
X = Point.X(point=transform)
code_block_15 = CodeBlock { 1; }
round = Math.Round(number=X, digits=code_block_15)
Y = Point.Y(point=transform)
round_2 = Math.Round(number=Y, digits=code_block_15)
create = List.Create(item0=round, item1=round_2)
flatten = List.Flatten(list=create)

# group: negative
code_block_16 = CodeBlock(x=X, y=code_block_4) { x*y; }

# group: remove already used part
code_block_17 = CodeBlock { 0; }
remove_2 = String.Remove(str=watch_2, startIndex=code_block_17, count=code_block_8)
watch_8 = Watch(remove_2)

# group: get Y
watch_9 = Watch(watch_8)
string_9 = StringInput("\"y\"")
allIndicesOf_7 = String.AllIndicesOf(str=watch_9, searchFor=string_9)
firstItem_7 = List.FirstItem(list=allIndicesOf_7)
string_10 = StringInput(",")
allIndicesOf_8 = String.AllIndicesOf(str=watch_9, searchFor=string_10)
firstItem_8 = List.FirstItem(list=allIndicesOf_8)
code_block_18 = CodeBlock(x=firstItem_8, y=firstItem_7) { x-y; }
substring_4 = String.Substring(str=watch_9, startIndex=firstItem_7, length=code_block_18)

# group: scale Y
string_11 = StringInput(":")
removePriorToCharacter_3 = Custom[String.RemovePriorToCharacter](str=substring_4, Character=string_11)
watch_10 = Watch(removePriorToCharacter_3)
to_float_3 = Custom[To Float](unknown=watch_10)
code_block_19 = CodeBlock(x=to_float_3, y=code_block_3) { x*y; }

# group: negative
code_block_20 = CodeBlock(x=code_block_19, y=code_block_4) { x*y; }

byCoordinates_2 = Point.ByCoordinates(x=code_block_16, y=Y, z=code_block_20)
Point = Output(byCoordinates_2)
