# Dynamo custom node Check Assembly Code Settings.dyf (Dynamo 0.9.1.4062)
# category: Bakery.Revit.Document
# and report bool and path

element_types = ElementTypes("AssemblyCodeTable")
all_elements_of_type = ElementsOfType(element_types)
externalFileReferencePath = Custom[Element.ExternalFileReferencePath](element=all_elements_of_type)  # Returns the full path of an element's external file reference as as string
watch = Watch(externalFileReferencePath)
firstItem = List.FirstItem(watch)
length = String.Length(firstItem)
integer_slider = IntegerSlider(33, range=0..100 step 1)
sub = length - integer_slider
boolean = BoolSelector(true)
slice_string = Custom[Slice String](String_s=firstItem, of_Characters=sub, Left_Right=boolean)  # Slices X number of leading or trailing characters from string (boolean true will slice from left while boolean set to false from right)
watch_2 = Watch(slice_string)
firstItem_2 = List.FirstItem(watch_2)
string = StringInput("UniformatClassifications_2010.txt")
eq = firstItem_2 == string
Is_it_good = Output(eq)  # "Is it good?"
Filename = Output(firstItem_2)
Full_Path = Output(firstItem)
