# Dynamo custom node Check Flex Ducts for Geometry Errors.dyf (Dynamo 0.8.2.2371)
# category: Bakery.Revit.API.MEP

categories = Categories("FlexDuctCurves")
all_elements_of_category = ElementsOfCategory(categories)
flex_duct_geometry_check = Custom[Flex Duct Geometry Check]()
map = List.Map(list=all_elements_of_category, f_x=flex_duct_geometry_check)
watch = Watch(map)
code_block = CodeBlock { null; }
bv_all_indices_of_that_can = Custom[bv All Indices Of that can handle Nulls](list=watch, value=code_block)  # forked from spring nodes
code_block_2 = CodeBlock { true; }
replaceItemAtIndex = Custom[List.ReplaceItemAtIndex](seq=watch, index=bv_all_indices_of_that_can, replacement=code_block_2)  # Replaces the item at a given index (or list of indices) of a list by another item
filterByBoolMask = List.FilterByBoolMask(list=all_elements_of_category, mask=replaceItemAtIndex)
watch_2 = Watch(filterByBoolMask.out)
id = Element.Id(watch_2)
element_Ids = Output(id)
elements = Output(watch_2)
getItemAtIndex = List.GetItemAtIndex(list=all_elements_of_category, index=bv_all_indices_of_that_can)
manual_check_required = Output(getItemAtIndex)
