# Dynamo custom node Check For Instance Parameter and Return Stats.dyf (Dynamo 1.0.0.1180)
# category: Bakery.Revit.Parameters
# check through all elements if a given instance parameter 'exists'

Instance_Parameter = Input()
list_of_model_elements = Custom[List of Model Elements simplified with Annotation removed]()  # also reports categories included and excluded. Only works on Workshared models...
parameterExists = Custom[Element.ParameterExists](param=Instance_Parameter, element=list_of_model_elements.Element_List_without_Annotation)  # Checks if an element contains a parameter of a given name
watch = Watch(parameterExists)
anyTrue = Custom[List.AnyTrue](seq=watch)  # Returns true if any item in a list of booleans is true.
Parameter_in_Project = Output(anyTrue)  # "Parameter in Project?"
countFalse = CountFalse(watch)
Items_without_this_Parameter = Output(countFalse)  # "Items without this Parameter?"
countTrue = CountTrue(watch)
Items_WITH_this_Parameter_available = Output(countTrue)  # "Items WITH this Parameter available?"
getParameterValueByName = Element.GetParameterValueByName(element=list_of_model_elements.Element_List_without_Annotation, parameterName=Instance_Parameter)
flatten = Flatten(getParameterValueByName)
string = StringInput("NULL")
replaceNull = Custom[List.ReplaceNull](seq=flatten, replacement=string)  # Replaces all null values within a given list with a substitute
flat_list_to_list_of_strings = Custom[Flat List to List of Strings](Original_List=replaceNull)  # using python methods. bug:something wrong with long/complicated strings??
string_2 = StringInput("")
create = List.Create(string_2)
removeItemsFromOtherList = Custom[List.RemoveItemsFromOtherList](List_A=flat_list_to_list_of_strings, List_B=create)  # This will take long list A, remove entries that appear in short list B, and give you list C. (JBE List Operations are probably more robust).
Show_Parameter_Data = Output(removeItemsFromOtherList)
count = Count(removeItemsFromOtherList)
Count_of_items_with_actual_values = Output(count)
getParameterOutput = Output(getParameterValueByName)
elementsOut = Output(list_of_model_elements.Element_List_without_Annotation)
