# Dynamo custom node Check Levels Grids on Wrong Workset.dyf (Dynamo 1.3.0.875)
# category: Bakery.Revit.Document.Utility
# only Shared Levels And Grids Allowed

string = StringInput("Workset")
string_2 = StringInput("ShouldntHaveLevelsGrids")
string_3 = StringInput("---Compliant with reqd workset---")
get_worksets = Custom[Get Worksets]()  # Retrieves user worksets from specified document
string_from_object = FromObject(get_worksets.Names)
categories = Categories("Levels")
categories_2 = Categories("Grids")
create = List.Create(categories, categories_2)
all_elements_of_category = ElementsOfCategory(create)
getParameterValueByName = Element.GetParameterValueByName(element=all_elements_of_category)  # unwired: parameterName
flatten = Flatten(getParameterValueByName)
uniqueItems = List.UniqueItems(flatten)
string_from_object_2 = FromObject(uniqueItems)
string_4 = StringInput(".")
split = String.Split(string_from_object_2, string_4)
create_2 = List.Create(split)
flatten_2 = Flatten(create_2)
string_from_object_3 = FromObject(get_worksets.Ids)
bv_if_equal_return_index = Custom[bv If Equal Return Index](listA=flatten_2, listB=string_from_object_3)  # forked
getItemAtIndex = List.GetItemAtIndex(list=string_from_object, index=bv_if_equal_return_index)
string_5 = StringInput("Shared Levels and Grids")
create_3 = List.Create(string_5)
removeItemsFromOtherList = Custom[List.RemoveItemsFromOtherList](List_A=getItemAtIndex, List_B=create_3)  # This will take long list A, remove entries that appear in short list B, and give you list C. (JBE List Operations are probably more robust).
isEmpty = List.IsEmpty(removeItemsFromOtherList)
string_6 = StringInput("---Worksets with Levels or Grids that shouldnt have---")
create_4 = List.Create(string_2, string_3, isEmpty, string_6, removeItemsFromOtherList)
flatten_3 = Flatten(create_4)
flattenedList = Output(flatten_3)
