# Dynamo custom node Check Reference Level Offsets against a Tolerance Input.dyf (Dynamo 1.3.0.875)
# category: Bakery.Revit.Document.Utility

singleElement = Input()
watch = Watch(singleElement)
code_block = CodeBlock { "Reference Level"; }
code_block_2 = CodeBlock { "noValue"; }
bruteforce_get_parameter_via = Custom[Bruteforce Get Parameter via String Split V2](element=watch, parameterName=code_block, replaceEmptyWithString=code_block_2)  # BETTER
code_block_3 = CodeBlock { "End Offset"; }
bruteforce_get_parameter_via_2 = Custom[Bruteforce Get Parameter via String Split V2](element=watch, parameterName=code_block_3, replaceEmptyWithString=code_block_2)
toNumber = String.ToNumber(bruteforce_get_parameter_via_2)
code_block_4 = CodeBlock { "Start Offset"; }
bruteforce_get_parameter_via_3 = Custom[Bruteforce Get Parameter via String Split V2](element=watch, parameterName=code_block_4, replaceEmptyWithString=code_block_2)
toNumber_2 = String.ToNumber(bruteforce_get_parameter_via_3)
min = Math.Min(toNumber, toNumber_2)
OffsetTolerance = Input()
gt = min > OffsetTolerance
id = Element.Id(watch)
code_block_5 = CodeBlock { "ok"; }
boolean_input_to_variable_string = Custom[Boolean Input to Variable String Output](Boolean_In=gt, String_if_True=id, String_if_False=code_block_5)  # you choose what you want to convert true / false to, good for validation
ok_or_ElementID_if_fail = Output(boolean_input_to_variable_string)
