# Dynamo custom node Check Specific Shared Parameter has correct GUID.dyf (Dynamo 0.8.2.2392)
# category: Bakery.Revit.Parameters
# use with List.map

OneElementOrSymbol = Input()
create = List.Create(OneElementOrSymbol)
list_parameter_info_with_shared = Custom[List Parameter Info with Shared Parameter GUIDs](ElementOrTypeList=create)  # works for Element list or Type list
flat_list_to_list_of_strings = Custom[Flat List to List of Strings](Original_List=list_parameter_info_with_shared.SPGuids)  # using python methods
SP_name_as_string = Input()
create_2 = List.Create(SP_name_as_string)
bv_if_equal_return_index = Custom[bv If Equal Return Index](listA=create_2, listB=list_parameter_info_with_shared.SPNames)  # forked
getItemAtIndex = List.GetItemAtIndex(list=flat_list_to_list_of_strings, index=bv_if_equal_return_index)
Benchmark_GUID_value = Input()
eq = getItemAtIndex == Benchmark_GUID_value
pass_is_True = Output(eq)
