# Dynamo custom node Check for IFC Links and Point Clouds.dyf (Dynamo 0.9.1.4062)
# category: Bakery.Revit.Document.Links
# uses element type reporting node

string = StringInput("--Any IFC links?--")
string_2 = StringInput(".ifc")
element_types = ElementTypes("RevitLinkInstance")
string_3 = StringInput("R")
element_type_reporting = Custom[Element Type Reporting](search_element_parameters_for=string_2, Element_Types=element_types, Search_for_Case_ignored=string_3)  # searches element types for strings and gives data
watch = Watch(element_type_reporting.Any_of_these)
string_4 = StringInput("--Any Point Clouds?--")
string_5 = StringInput("Point Cloud")
element_types_2 = ElementTypes("PointCloudInstance")
string_6 = StringInput("P")
element_type_reporting_2 = Custom[Element Type Reporting](search_element_parameters_for=string_5, Element_Types=element_types_2, Search_for_Case_ignored=string_6)
watch_2 = Watch(element_type_reporting_2.Any_of_these)
string_7 = StringInput("--List IFC Links--")
watch_3 = Watch(element_type_reporting.Elements)
string_8 = StringInput("--List Point Clouds--")
watch_4 = Watch(element_type_reporting_2.Elements)
create = List.Create(string, watch, string_4, watch_2, string_7, watch_3, string_8, watch_4)
flatten = Flatten(create)
flat_list_to_list_of_strings = Custom[Flat List to List of Strings](Original_List=flatten)  # using python methods
list_of_str = Output(flat_list_to_list_of_strings)
