# Dynamo custom node Clean Link Name List.dyf (Dynamo 1.3.4.6666)
# category: Bakery.Revit.Document.Links

code_block = CodeBlock { "replacedNull"; }
namelist = Input()
bv_replace_nulls = Custom[bv Replace Nulls](replacement=code_block, seq=namelist)
flat_list_to_list_of_strings = Custom[Flat List to List of Strings](Original_List=bv_replace_nulls)  # using python methods
code_block_2 = CodeBlock { " : "; }
split = String.Split(flat_list_to_list_of_strings, code_block_2)
firstItem = List.FirstItem()  # unwired: arg0
map = List.Map(list=split, f_x=firstItem)
cleaned_names_only = Output(map)
