# Dynamo custom node Clean List of Indices to Remove Negative Values.dyf (Dynamo 0.8.2.2371)
# category: Bakery.Core.List

indices = Input()
code_block = CodeBlock { 0; }
ge = indices >= code_block
filterByBoolMask = List.FilterByBoolMask(list=indices, mask=ge)
cleaned = Output(filterByBoolMask.in)
