# Dynamo custom node Clean String for mysql.dyf (Dynamo 1.2.1.3083)
# category: Bakery.Data.Database

str = Input(str : string)
string = StringInput("'")
string_2 = StringInput("\'")
replace = String.Replace(str=str, searchFor=string, replaceWith=string_2)
str_2 = Output(replace)  # "str"
