# Dynamo custom node Clear Rules from View Filter.dyf (Dynamo 1.1.0.2094)
# category: Bakery.Revit.Views
# wipes rules leaving only category selection

parameterFilterElement = Input()
python_script = Python(IN[0]=parameterFilterElement)
# ---------- python_script.python (30 lines) ----------
#from the forum originally
import clr

clr.AddReference("RevitServices")
import RevitServices
from RevitServices.Persistence import DocumentManager
from RevitServices.Transactions import TransactionManager

doc = DocumentManager.Instance.CurrentDBDocument

clr.AddReference("RevitAPI")
import Autodesk
from Autodesk.Revit.DB import *
import System
from System.Collections.Generic import *

dataEnteringNode = IN

filter = UnwrapElement(IN[0])

TransactionManager.Instance.EnsureInTransaction(doc)

try:
	filter.ClearRules()
except:
	filter = "Sorry, failed. Please check that you have a unique filter name."

TransactionManager.Instance.TransactionTaskDone()

OUT = filter
# ----------------------------------------
withRulesCleared = Output(python_script)
