# Dynamo custom node Collect All Views and View Templates.dyf (Dynamo 1.3.0.875)
# category: Bakery.Revit.Views

empty = List.Empty()
list_all_views = Custom[List All Views]()  # not including sheets
AllViews = Output(list_all_views)
viewTemplate = Custom[View.ViewTemplate](view=list_all_views)  # Returns the view template assigned to a given view (if one is assigned)
watch = Watch(viewTemplate)
ViewTemplates = Output(watch)
flat_list_to_list_of_strings = Custom[Flat List to List of Strings](Original_List=watch)  # using python methods
string = StringInput("[]")
allIndicesOf = List.AllIndicesOf(list=flat_list_to_list_of_strings, item=string)
string_2 = StringInput("None")
allIndicesOf_2 = List.AllIndicesOf(list=flat_list_to_list_of_strings, item=string_2)
create = List.Create(allIndicesOf, allIndicesOf_2)
flatten = Flatten(create)
getItemAtIndex = List.GetItemAtIndex(list=list_all_views, index=flatten)
ViewsWithoutTemplate = Output(getItemAtIndex)
bv_remove_nulls = Custom[bv Remove Nulls](List=watch)  # forked from Lunchbox
uniqueItems = List.UniqueItems(bv_remove_nulls)
create_2 = List.Create(getItemAtIndex, uniqueItems)
flatten_2 = Flatten(create_2)
UniqueViewsAndTemplates = Output(flatten_2)
