# Dynamo custom node Collect Elements by Parameter Value.dyf (Dynamo 1.2.0.2690)
# category: Bakery.Revit.Selection

collect_all_elements_in_model = Custom[Collect All Elements in Model]()  # uses a nested catch-all, then a refined selection by category
watch = Watch(collect_all_elements_in_model.elements)
parameterName = Input(parameterName : string)
getParameterValueByName = Element.GetParameterValueByName(element=watch, parameterName=parameterName)
watch_2 = Watch(getParameterValueByName)
parameterValue = Input()
eq = watch_2 == parameterValue
filterByBoolMask = List.FilterByBoolMask(list=watch, mask=eq)
elements = Output(filterByBoolMask.in)
