# Dynamo custom node Collect Elements in Rooms and Show Detailed List.dyf (Dynamo 0.8.2.2371)
# category: Bakery.Revit.Selection
# Allows you to generate various lists of elements in rooms. Can get two parameters for Rooms, and two for Elements. Based on Family.InRoom work by Konrad, which was built on others.

Elements = Input()
Rooms = Input()
inRooms = Python(IN[0]=Elements, IN[1]=Rooms)  # "Families.InRooms"
# ---------- inRooms.python (53 lines) ----------
#Copyright(c) 2015, Konrad Sobon
# @arch_laboratory, http://archi-lab.net

# This code is based on Family.InRoom node originally created
# by Peter Kompolschek and published on Dynamo blog. Big thanks 
# to Peter for sharing his work so graciously.

import clr
clr.AddReference('ProtoGeometry')
from Autodesk.DesignScript.Geometry import *

# Import DocumentManager and TransactionManager
clr.AddReference("RevitServices")
import RevitServices
from RevitServices.Persistence import DocumentManager
from RevitServices.Transactions import TransactionManager

# Import RevitAPI
clr.AddReference("RevitAPI")
import Autodesk
from Autodesk.Revit.DB import *

doc = DocumentManager.Instance.CurrentDBDocument
uiapp = DocumentManager.Instance.CurrentUIApplication
app = uiapp.Application

from System.Collections.Generic import *

#The inputs to this node will be stored as a list in the IN variable.
def FamiliesInRoom(_room, _families):
	outList = []
	for family in _families:
		try:
			pt = family.Location.Point
		except:
			pt = family.Location.Curve.Origin
		if _room.IsPointInRoom(pt):
			outList.append(family)
	return outList

families = []
for i in IN[0]:
	families.append(UnwrapElement(i))

rooms = []
for i in IN[1]:
	rooms.append(UnwrapElement(i))

outData = [[] for i in range(len(rooms))]
for index, room in enumerate(rooms):
	outData[index].extend(FamiliesInRoom(room, families))

OUT = outData
# ----------------------------------------
SimpleList = Output(inRooms)
cycle = List.Cycle()
count = List.Count(inRooms)
code_block = CodeBlock(a=count) { 0..a; }
count_2 = List.Count()
map = List.Map(list=inRooms, f_x=count_2)
laceShortest = List.LaceShortest(cycle, code_block, map)
getItemAtIndex = List.GetItemAtIndex(list=Rooms, index=laceShortest)
flatten = Flatten(getItemAtIndex)

# group: Matches number of rooms
watch = Watch(inRooms)

flatten_2 = Flatten(watch)
create = List.Create(flatten, flatten_2)
CycledList = Output(create)
element_ids = Custom[Element Ids](Element_s=flatten)  # This node will query an element id that can be used with Revit nodes. Dynamo Element Id node returns integer value.
RoomParameterOne = Input()
getParameterValueByName = Element.GetParameterValueByName(element=flatten, parameterName=RoomParameterOne)
RoomParameterTwo = Input()
getParameterValueByName_2 = Element.GetParameterValueByName(element=flatten, parameterName=RoomParameterTwo)
element_ids_2 = Custom[Element Ids](Element_s=flatten_2)
ElementParameterOne = Input()
getParameterValueByName_3 = Element.GetParameterValueByName(element=flatten_2, parameterName=ElementParameterOne)
ElementParameterTwo = Input()
getParameterValueByName_4 = Element.GetParameterValueByName(element=flatten_2, parameterName=ElementParameterTwo)
create_2 = List.Create(element_ids.Rvt_ElementId_s, getParameterValueByName, getParameterValueByName_2, element_ids_2.Rvt_ElementId_s, getParameterValueByName_3, getParameterValueByName_4)
transpose = List.Transpose(create_2)
DetailedCombinedListForExcel = Output(transpose)
RoomElementIds = Output(element_ids.Rvt_ElementId_s)
RoomParameterOne_2 = Output(getParameterValueByName)  # "RoomParameterOne"
RoomParameterTwo_2 = Output(getParameterValueByName_2)  # "RoomParameterTwo"
ElementIds = Output(element_ids_2.Rvt_ElementId_s)
ElementParameterOne_2 = Output(getParameterValueByName_3)  # "ElementParameterOne"
ElementParameterTwo_2 = Output(getParameterValueByName_4)  # "ElementParameterTwo"
RoomElements = Output(flatten)
ElementsInRooms = Output(flatten_2)
watch_2 = Watch(flatten_2)
