# Dynamo custom node Collect Tag Elements in Specific View and Send Ids to Clipboard.dyf (Dynamo 0.8.1.1942)
# category: Bakery.Revit.Selection

send_IDs_to_Clipboard = Input()
collect_all_tags_in_project = Custom[Collect All Tags in Project]()
show_element_workset_as_internal = Custom[Show Element Workset as Internal db name](Element_s=collect_all_tags_in_project)
element_name_universal = Custom[Element Name Universal](Element_s=show_element_workset_as_internal)  # Modified for 0.8.1
ViewWorksetName = Input()
code_block = CodeBlock { 0; }
getItemAtIndex = List.GetItemAtIndex(list=ViewWorksetName, index=code_block)
eq = element_name_universal == getItemAtIndex  # lacing=Longest
filterByBoolMask = List.FilterByBoolMask(list=collect_all_tags_in_project, mask=eq)
flatten = Flatten(filterByBoolMask.in)
element_ids = Custom[Element Ids](Element_s=flatten)  # This node will query an element id that can be used with Revit nodes. Dynamo Element Id node returns integer value.
string_from_array = FromArray(element_ids.Rvt_ElementId_s)
code_block_2 = CodeBlock { 0; }
code_block_3 = CodeBlock { 1; }
remove = String.Remove(str=string_from_array, startIndex=code_block_2, count=code_block_3)
length = String.Length(remove)
code_block_4 = CodeBlock(x=length) { x-1; }
code_block_5 = CodeBlock { 1; }
remove_2 = String.Remove(str=remove, startIndex=code_block_4, count=code_block_5)
code_block_6 = CodeBlock { "No IDs sent to Clipboard"; }
boolean_input_to_variable_string = Custom[Boolean Input to Variable String Output](Boolean_In=send_IDs_to_Clipboard, String_if_True=remove_2, String_if_False=code_block_6)  # you choose what you want to convert true / false to, good for validation
firstItem = List.FirstItem(boolean_input_to_variable_string)
Pre_clipboard = Output(firstItem)
sendTo = Custom[Clipboard.SendTo](str=firstItem)  # Copies a string to the clipboard. ATTENTION: Will only work with strings and on top of Revit (not in sandbox mode).
After_SendTo_clipboard = Output(sendTo)
Simple_ID_List = Output(remove_2)
