# Dynamo custom node Collect all FamilyInstance using Element Types.dyf (Dynamo 0.8.0.950)
# category: Bakery.Revit.Selection
# should get model family instances

element_types = ElementTypes("FamilyInstance")
all_elements_of_type = ElementsOfType(element_types)
flatten = Flatten(all_elements_of_type)
uniqueItems = List.UniqueItems(flatten)
elements = Output(uniqueItems)
