# Dynamo custom node Collect from Link using Category and Parameter Value.dyf (Dynamo 0.8.0.950)
# category: Bakery.Revit.Selection
# works by name search of single link

link_name_as_String = Input()
Category = Input()
get_elements_in_link_using_name = Custom[Get Elements in Link using Name Search and Category](SearchLinkNames=link_name_as_String, DesiredCategory=Category)  # link name search
watch = Watch(get_elements_in_link_using_name.ElementsFlatList)
firstItem = List.FirstItem(get_elements_in_link_using_name.LinkDocUsed)
element_type_linkedfile = Custom[Element.Type (LinkedFile)](Element_s=watch, Link_Document=firstItem)  # Gets the family type of a given element (if applicable) that is located in a linked project file.
Parameter_name_as_String = Input()
getParameterValueByName = Element.GetParameterValueByName(element=element_type_linkedfile, parameterName=Parameter_name_as_String)
Parameter_Value_as_String = Input()
eq = getParameterValueByName == Parameter_Value_as_String
filterByBoolMask = List.FilterByBoolMask(list=watch, mask=eq)
watch_2 = Watch(filterByBoolMask.in)
items_collected = Output(watch_2)
