# Dynamo custom node Compare View Filters added to Two Views or Templates.dyf (Dynamo 0.8.2.2371)
# category: Bakery.Revit.Views
# takes input from Views dynamo node

ViewOne = Input()
ViewTwo = Input()
create = List.Create(ViewOne, ViewTwo)
flatten = Flatten(create)
list_detailed_view_information = Custom[List Detailed View Information for a List of Views](listofViews=flatten)
watch = Watch(list_detailed_view_information.ViewFiltersApplied)
code_block = CodeBlock { 0; }
getItemAtIndex = List.GetItemAtIndex(list=watch, index=code_block)
code_block_2 = CodeBlock { 1; }
getItemAtIndex_2 = List.GetItemAtIndex(list=watch, index=code_block_2)
remove_list_from_list_by_item = Custom[Remove List from List by Item not Value](ListOfItemsToRemove=getItemAtIndex, ListToRemoveFrom=getItemAtIndex_2)  # remove the items in ListA from the items in ListB and return whats left
watch_2 = Watch(remove_list_from_list_by_item.reducedList)
missingFromViewONE = Output(watch_2)
code_block_3 = CodeBlock { 1; }
getItemAtIndex_3 = List.GetItemAtIndex(list=watch, index=code_block_3)
code_block_4 = CodeBlock { 0; }
getItemAtIndex_4 = List.GetItemAtIndex(list=watch, index=code_block_4)
remove_list_from_list_by_item_2 = Custom[Remove List from List by Item not Value](ListOfItemsToRemove=getItemAtIndex_3, ListToRemoveFrom=getItemAtIndex_4)
watch_3 = Watch(remove_list_from_list_by_item_2.reducedList)
missingFromViewTWO = Output(watch_3)
