# Dynamo custom node Convert List to Comma Delimited String.dyf (Dynamo 0.8.2.2371)
# category: Bakery.Core.String

arr = Input()
string_from_array = FromArray(arr)
code_block = CodeBlock { 0; }
code_block_2 = CodeBlock { 1; }
remove = String.Remove(str=string_from_array, startIndex=code_block, count=code_block_2)
length = String.Length(remove)
code_block_3 = CodeBlock(x=length) { x-1; }
code_block_4 = CodeBlock { 1; }
remove_2 = String.Remove(str=remove, startIndex=code_block_3, count=code_block_4)
str = Output(remove_2)
