# Dynamo custom node Copy Parameters Node for Nesting Process.dyf (Dynamo 0.9.2.4472)
# category: Bakery.Revit.Document.Utility.Nested
# copy param

categories = Categories("PlumbingFixtures")
all_elements_of_category = ElementsOfCategory(categories)
string = StringInput("OriginalElementID")
bv_get_parameter_value_as_string = Custom[bv Get Parameter Value as String](Parameter_Name=all_elements_of_category, Element_s=string)  # forked from Rhythm
length = String.Length(bv_get_parameter_value_as_string)
number_slider = DoubleSlider(0, range=0..100 step 0.1)
eq = length == number_slider
filterByBoolMask = List.FilterByBoolMask(list=all_elements_of_category, mask=eq)
watch = Watch(filterByBoolMask.out)
cycle = List.Cycle()
string_2 = StringInput("OriginalElementID")
bv_get_parameter_value_as_string_2 = Custom[bv Get Parameter Value as String](Parameter_Name=watch, Element_s=string_2)
bv_ids_to_elements = Custom[bv IDs to Elements](ID_s=bv_get_parameter_value_as_string_2)  # forked from CAAD_RWTH
get_element_parameters_and_split = Custom[Get Element Parameters and Split to Names and Values](element=bv_ids_to_elements.Element_s)  # as per title, output is strings
count = List.Count(get_element_parameters_and_split.ParamNames_str)
code_block = CodeBlock(a=count) { 0..a; }
count_2 = List.Count()
map = List.Map(list=get_element_parameters_and_split.ParamNames_str, f_x=count_2)
laceShortest = List.LaceShortest(cycle, code_block, map)
watch_2 = Watch(laceShortest)
flatten = Flatten(watch_2)
getItemAtIndex = List.GetItemAtIndex(list=watch, index=flatten)
flatten_2 = Flatten(get_element_parameters_and_split.ParamNames_str)
getItemAtIndex_2 = List.GetItemAtIndex(list=bv_ids_to_elements.Element_s, index=flatten)
getParameterValueByName = Element.GetParameterValueByName(element=getItemAtIndex_2, parameterName=flatten_2)
setParameterByName = Element.SetParameterByName(element=getItemAtIndex, parameterName=flatten_2, value=getParameterValueByName)
New_Objects = Output(watch)
