# Dynamo custom node Copy Section Box to List of 3D Views.dyf (Dynamo 0.9.1.4062)
# category: Bakery.Revit.Views

getSectionBoxFromThisView = Input()
turnIntoList = Custom[TurnIntoList](unknownItem=getSectionBoxFromThisView)  # Turns an element (or a nested list) into a flat list
setToThese3Dviews = Input()
remove_list_from_list_by_item = Custom[Remove List from List by Item not Value](ListOfItemsToRemove=turnIntoList, ListToRemoveFrom=setToThese3Dviews)  # remove the items in ListA from the items in ListB and return whats left
watch = Watch(remove_list_from_list_by_item.reducedList)
python_script = Python(IN[0]=getSectionBoxFromThisView, IN[1]=watch)
# ---------- python_script.python (58 lines) ----------
#Luke Stanley Johnson for Bakery
import clr
clr.AddReference('ProtoGeometry')
from Autodesk.DesignScript.Geometry import *

# Import ToDSType(bool) extension method
clr.AddReference("RevitNodes")
import Revit
clr.ImportExtensions(Revit.Elements)

# Import DocumentManager and TransactionManager
clr.AddReference("RevitServices")
import RevitServices
from RevitServices.Persistence import DocumentManager
from RevitServices.Transactions import TransactionManager

from System.Collections.Generic import *

# Import RevitAPI
clr.AddReference("RevitAPI")
import Autodesk

doc = DocumentManager.Instance.CurrentDBDocument
uiapp = DocumentManager.Instance.CurrentUIApplication
app = uiapp.Application

#The inputs to this node will be stored as a list in the IN variable.

#viewlistOne = []
#for j in IN[0]:
#	viewlistOne.append(UnwrapElement(j))
	
viewlistTwo = []
for k in IN[1]:
	viewlistTwo.append(UnwrapElement(k))

#sectionboxsource = []
viewsource = UnwrapElement(IN[0])
sectionboxsource = viewsource.GetSectionBox()
#for v in viewlistOne:
#	try:
#		sectionboxsource.append(v.GetSectionBox())
#	except:
#		sectionboxsource.append("No Section Box")

#counter = range(len(viewlistTwo))
TransactionManager.Instance.EnsureInTransaction(doc)
resultlist = []
for i in viewlistTwo:
	try:
		i.SetSectionBox(sectionboxsource)
		resultlist.append("Section Box Set OK")
	except:
		resultlist.append("Section Box Set FAILED")
TransactionManager.Instance.TransactionTaskDone()

#Assign your output to the OUT variable
OUT = viewsource, sectionboxsource, viewlistTwo, resultlist
# ----------------------------------------
code_block = CodeBlock { 2; }
getItemAtIndex = List.GetItemAtIndex(list=python_script, index=code_block)
views_modified = Output(getItemAtIndex)
code_block_2 = CodeBlock { 3; }
getItemAtIndex_2 = List.GetItemAtIndex(list=python_script, index=code_block_2)
success = Output(getItemAtIndex_2)  # "success?"
