# Dynamo custom node Copy Type Parameter to Type Parameter for All Family Types.dyf (Dynamo 0.8.2.2371)
# category: Bakery.Revit.Parameters

get_type_list_for_this_project = Custom[Get Type List for this project]()
flatten = Flatten(get_type_list_for_this_project.uniquified_flat_list)
watch = Watch(flatten)
target_Type_Parameter = Input()
source_Type_Parameter = Input()
getParameterValueByName = Element.GetParameterValueByName(element=watch, parameterName=source_Type_Parameter)
code_block = CodeBlock { ""; }
bv_all_indices_of = Custom[bv All Indices Of](list=getParameterValueByName, indices=code_block)  # forked from Rhythm
write_this_if_no_source_value = Input()
turnIntoList = Custom[Turn Into List](write_this_if_no_source_value)  # Turns an element into a (flat) list
count = Count(bv_all_indices_of)
cycle = List.Cycle(list=turnIntoList, amount=count)
replaceItemAtIndex = Custom[List.ReplaceItemAtIndex](seq=getParameterValueByName, index=bv_all_indices_of, replacement=cycle)  # Replaces the item at a given index (or list of indices) of a list by another item
set_list_of_values_to_list_of = Custom[Set List of Values to List of Elements for One Parameter](elementList=watch, parameterNameAsString=target_Type_Parameter, valuesToSet=replaceItemAtIndex)  # as described
watch_2 = Watch(set_list_of_values_to_list_of)
string = StringInput("Check that you have Target Parameter available...")
replaceNull = Custom[List.ReplaceNull](seq=watch_2, replacement=string)  # Replaces all null values within a given list with a substitute
done = Output(replaceNull)  # "done?"
values_used = Output(replaceItemAtIndex)
type_list_used = Output(watch)
eq = replaceNull == string
filterByBoolMask = List.FilterByBoolMask(list=watch, mask=eq)
failed_types = Output(filterByBoolMask.in)
