# Dynamo custom node Copy Type Parameter to Type Parameter for Elements.dyf (Dynamo 1.1.0.2094)
# category: Bakery.Revit.Parameters

elements = Input()
watch = Watch(elements)
type = Custom[Element.Type](element=watch)  # Gets the family type of a given element (if applicable).
setThisTypeParameter = Input()
getThisTypeParameter = Input()
getParameterValueByName = Element.GetParameterValueByName(element=type, parameterName=getThisTypeParameter)
set_list_of_values_to_list_of = Custom[Set List of Values to List of Elements for One Parameter](elementList=type, parameterNameAsString=setThisTypeParameter, valuesToSet=getParameterValueByName)  # as described
elementsOut = Output(set_list_of_values_to_list_of)
