# Dynamo custom node Create Floors From Rooms v1.dyf (Dynamo 0.8.2.2371)
# category: Bakery.Revit.Elements.Room
# this version uses only the outermost boundary, does not detect cutout or openings (yet)

# group: rooms in
roomList = Input()
watch = Watch(roomList)

# group: Gets the lowest face
get_room_geometry_and_filter_by = Custom[Get Room Geometry and Filter by Level Elevation]()
map = List.Map(list=watch, f_x=get_room_geometry_and_filter_by)

get_indices_of_null_values = Custom[Get Indices of Null Values](list=map)  # needs to be hidden
removeItemAtIndex = List.RemoveItemAtIndex(list=map, indices=get_indices_of_null_values)

# group: gets the outer polycurve if possible
watch_2 = Watch(removeItemAtIndex)
one_face_to_polycurve_outline = Custom[One Face to Polycurve Outline]()
map_2 = List.Map(list=watch_2, f_x=one_face_to_polycurve_outline)
get_indices_of_null_values_2 = Custom[Get Indices of Null Values](list=map_2)

floorTypeToUse = Input()

# group: Get level parameters
level = Custom[Element.Level](Element_s=watch)  # Gets an element's level
match_link_level_with_level_in = Custom[Match Link Level with Level in Host using Elevation]()
map_3 = List.Map(list=level, f_x=match_link_level_with_level_in)

# group: Make floors
removeItemAtIndex_2 = List.RemoveItemAtIndex(list=map_2, indices=get_indices_of_null_values_2)
removeItemAtIndex_3 = List.RemoveItemAtIndex(list=map_3, indices=get_indices_of_null_values_2)
byOutlineTypeAndLevel = Floor.ByOutlineTypeAndLevel(outline=removeItemAtIndex_2, floorType=floorTypeToUse, level=removeItemAtIndex_3)
floors_made = Output(byOutlineTypeAndLevel)
outlines_Used = Output(removeItemAtIndex_2)
levels_Used = Output(removeItemAtIndex_3)

allOutlines = Output(map_2)
roomLevels = Output(level)
allLevels = Output(map_3)
baseFace = Output(map)
roomsIn = Output(roomList)
id = Element.Id(watch)
code_block = CodeBlock { "Number"; }
getParameterValueByName = Element.GetParameterValueByName(element=watch, parameterName=code_block)
code_block_2 = CodeBlock { "Name"; }
getParameterValueByName_2 = Element.GetParameterValueByName(element=watch, parameterName=code_block_2)
create = List.Create(id, getParameterValueByName, getParameterValueByName_2)
transpose = List.Transpose(create)
string_from_array = FromArray()
map_4 = List.Map(list=transpose, f_x=string_from_array)
idStringUnused = Output(map_4)
getItemAtIndex = List.GetItemAtIndex(list=watch, index=get_indices_of_null_values)
remove_list_from_list_by_item = Custom[Remove List from List by Item not Value](ListOfItemsToRemove=getItemAtIndex, ListToRemoveFrom=watch)  # remove the items in ListA from the items in ListB and return whats left

# group: get room number
removeItemAtIndex_4 = List.RemoveItemAtIndex(list=remove_list_from_list_by_item.reducedList, indices=get_indices_of_null_values_2)
code_block_3 = CodeBlock { "Number"; }
getParameterValueByName_3 = Element.GetParameterValueByName(element=removeItemAtIndex_4, parameterName=code_block_3)
parameters_used = Output(getParameterValueByName_3)
count = Count(getParameterValueByName_3)
roomParametersCount = Output(count)

# group: set parameter to new floors
writeInfoToThisInstanceParameter = Input()
set_list_of_values_to_list_of = Custom[Set List of Values to List of Elements for One Parameter](elementList=byOutlineTypeAndLevel, parameterNameAsString=writeInfoToThisInstanceParameter, valuesToSet=getParameterValueByName_3)  # as described
parameter_set = Output(set_list_of_values_to_list_of)

remove_list_from_list_by_item_2 = Custom[Remove List from List by Item not Value](ListOfItemsToRemove=removeItemAtIndex_4, ListToRemoveFrom=watch)
all_failures = Output(remove_list_from_list_by_item_2.reducedList)
geometryFailure = Output(getItemAtIndex)
count_2 = Count(byOutlineTypeAndLevel)
floorsMadeCount = Output(count_2)
