# Dynamo custom node Create Parent Child Dictionary using XML ElementTree.dyf (Dynamo 0.8.2.2371)
# category: Bakery.Data.XML

ElementTree = Input()
python_script = Python(IN[0]=ElementTree)
# ---------- python_script.python (18 lines) ----------
import clr
import sys
clr.AddReference('ProtoGeometry')
from Autodesk.DesignScript.Geometry import *
sys.path.append("C:\Program Files (x86)\IronPython 2.7\Lib")
#from xml.parsers.expat import expat -- can't find this
import xml.etree.ElementTree as ET
#The inputs to this node will be stored as a list in the IN variables.
xmTree = IN[0]

#xmParsed = xmTree.parse(xmlFile)
#root = xmTree.getroot()

parent_map = dict((c, p) for p in xmTree.getiterator() for c in p)
list_key_values = [ [str(k),str(v)] for k, v in parent_map.items() ]

OUT = str(parent_map), list_key_values
#, jsonStr
# ----------------------------------------
code_block = CodeBlock { 0; }
getItemAtIndex = List.GetItemAtIndex(list=python_script, index=code_block)
string_representation = Output(getItemAtIndex)
code_block_2 = CodeBlock { 1; }
getItemAtIndex_2 = List.GetItemAtIndex(list=python_script, index=code_block_2)
list_of_pairs = Output(getItemAtIndex_2)
