# Dynamo custom node Create Worksets for Some Revit Links.dyf (Dynamo 0.9.2.4472)
# category: Bakery.Revit.Document.Worksets
# input clean link names

bv_document_worksets = Custom[bv Document Worksets]()  # clockwork node without the toggle
element_name_universal = Custom[Element Name Universal](Element_s=bv_document_worksets)  # Modified for 0.8.1
cleanLinkNames = Input()
watch = Watch(cleanLinkNames)
remove_list_from_list_by_item = Custom[Remove List from List by Item not Value](ListOfItemsToRemove=element_name_universal, ListToRemoveFrom=watch)  # remove the items in ListA from the items in ListB and return whats left
string = StringInput("")
PrefixIfDesired = Input(PrefixIfDesired : string = "")
join = String.Join(string, PrefixIfDesired)
map = List.Map(list=remove_list_from_list_by_item.reducedList, f_x=join)
create = Custom[Workset.Create](worksetNames=map)  # Creates a workset or worksets from input names.
turnIntoList = Custom[TurnIntoList](unknownItem=create)  # Turns an element (or a nested list) into a flat list
any_null_in_list = Custom[Any Null in List](list=turnIntoList)  # returns boolean true if a null is found
watch_2 = Watch(any_null_in_list)
watch_3 = Watch(create)
isEmpty = List.IsEmpty(watch_3)
string_2 = StringInput("No RVT links in model....")
turnIntoList_2 = Custom[TurnIntoList](unknownItem=string_2)
switch = Custom[Switch](boolean_switch=isEmpty, data=turnIntoList_2)
watch_4 = Watch(switch)
watch_5 = Watch(isEmpty)
string_3 = StringInput("Are worksets enabled?")
turnIntoList_3 = Custom[TurnIntoList](unknownItem=string_3)
switch_2 = Custom[Switch](boolean_switch=any_null_in_list, data=turnIntoList_3)
create_2 = List.Create(switch_2, create, switch)
bv_remove_nulls = Custom[bv Remove Nulls](List=create_2)  # forked from Lunchbox
uniqueItems = List.UniqueItems(bv_remove_nulls)
flatten = Flatten(uniqueItems)
worksetsCreated = Output(flatten)
watch_6 = Watch(switch_2)
