# Dynamo custom node Delete All Elements of Category.dyf (Dynamo 0.9.1.4062)
# category: Bakery.Revit.Elements
# be careful!

Category = Input()
all_elements_of_category = ElementsOfCategory(Category)
eraser = Custom[Tool.Eraser](Element_s=all_elements_of_category)  # Try to delete any element from project
Can_t_delete_Ids = Output(eraser)  # "Can't delete (Ids)"
elementsToDelete = Output(all_elements_of_category)
