# Dynamo custom node Dimension.References.dyf (Dynamo 1.3.0.875)
# category: Bakery.Revit.Elements.Dimension

dimension = Input()
python_script = Python(IN[0]=dimension)
# ---------- python_script.python (45 lines) ----------
#Created by Luke Johnson for Bakery
import clr
clr.AddReference('ProtoGeometry')
from Autodesk.DesignScript.Geometry import *

# Import ToDSType(bool) extension method
clr.AddReference("RevitNodes")
import Revit
clr.ImportExtensions(Revit.Elements)

# Import DocumentManager and TransactionManager
clr.AddReference("RevitServices")
import RevitServices
from RevitServices.Persistence import DocumentManager
from RevitServices.Transactions import TransactionManager


from System.Collections.Generic import *

# Import RevitAPI
clr.AddReference("RevitAPI")
import Autodesk

doc = DocumentManager.Instance.CurrentDBDocument
uiapp = DocumentManager.Instance.CurrentUIApplication
app = uiapp.Application

#The inputs to this node will be stored as a list in the IN variable.
elem = UnwrapElement(IN[0])

#curvenrmls = []
#cnctcs = []

#for y in ctrayelems:
#	curvenrmls.append(y.CurveNormal)
#	cnctcs.append(y.References)
#Assign your output to the OUT variable

refTemp = []
try:
	refTemp = elem.References
except:
	pass

OUT = refTemp
# ----------------------------------------
references = Output(python_script)
python_script_2 = Python(IN[0]=python_script)
# ---------- python_script_2.python (45 lines) ----------
#Created by Luke Johnson for Bakery
import clr
clr.AddReference('ProtoGeometry')
from Autodesk.DesignScript.Geometry import *

# Import ToDSType(bool) extension method
clr.AddReference("RevitNodes")
import Revit
clr.ImportExtensions(Revit.Elements)

# Import DocumentManager and TransactionManager
clr.AddReference("RevitServices")
import RevitServices
from RevitServices.Persistence import DocumentManager
from RevitServices.Transactions import TransactionManager


from System.Collections.Generic import *

# Import RevitAPI
clr.AddReference("RevitAPI")
import Autodesk

doc = DocumentManager.Instance.CurrentDBDocument
uiapp = DocumentManager.Instance.CurrentUIApplication
app = uiapp.Application

#The inputs to this node will be stored as a list in the IN variable.
refTemp = IN[0]
#curvenrmls = []
#cnctcs = []

#for y in ctrayelems:
#	curvenrmls.append(y.CurveNormal)
#	cnctcs.append(y.References)
#Assign your output to the OUT variable

refIds = []
for x in refTemp:
	try:
		refIds.append(x.ElementId)
	except:
		pass

OUT = refIds
# ----------------------------------------
referenceIds = Output(python_script_2)
byID = Custom[Element.ByID](ID_UniqueId=python_script_2)  # Gets the Revit element(s) for a list of IDs (or a single ID)
referenceElements = Output(byID.element)
