# Dynamo custom node Directory.ContentsAll.dyf (Dynamo 1.2.1.3083)
# category: Bakery.Core.Directory

dir = Input(dir : string)
searchString = Input(searchString : string = "*")
python_script = Python(IN[0]=dir, IN[1]=searchString)
# ---------- python_script.python (7 lines) ----------
from System.IO import Directory, SearchOption
dir = IN[0]
searchstring = IN[1]
if Directory.Exists(dir):
	OUT = Directory.GetFiles(dir, searchstring, SearchOption.AllDirectories)
else:
	OUT = list()
# ----------------------------------------
files = Output(python_script)
