# Dynamo custom node Display Parent Child Pairs as Hierarchy.dyf (Dynamo 0.8.2.2392)
# category: Bakery.Core.List

parent_child_sublist_pairs = Input()

# group: interpret dictionary part 1
watch = Watch(parent_child_sublist_pairs)
flatten = Flatten(watch)
string = StringInput("' at ")
split = String.Split(flatten, string)
firstItem = List.FirstItem()
map = List.Map(list=split, f_x=firstItem)
code_block = CodeBlock { 2; }
chop = List.Chop(map, code_block)
uniqueItems = List.UniqueItems(chop)
code_block_2 = CodeBlock { 1; }
getItemAtIndex = List.GetItemAtIndex(index=code_block_2)
groupByKey = GroupByKey(uniqueItems, getItemAtIndex)
code_block_3 = CodeBlock { 1; }
flatten_2 = List.Flatten(list=groupByKey, amt=code_block_3)
code_block_4 = CodeBlock { 1; }
getItemAtIndex_2 = List.GetItemAtIndex(index=code_block_4)
map_2 = List.Map(list=flatten_2, f_x=getItemAtIndex_2)
uniqueItems_2 = List.UniqueItems(map_2)
code_block_5 = CodeBlock { 0; }
getItemAtIndex_3 = List.GetItemAtIndex(index=code_block_5)
map_3 = List.Map(list=flatten_2, f_x=getItemAtIndex_3)
get_children_using_key_value = Custom[Get Children using Key Value list](list=uniqueItems_2, list_2=map_2, list_3=map_3)

watch_2 = Watch(uniqueItems_2)
string_2 = StringInput("")
turn_into_list = Custom[Turn Into List](item=string_2)  # Turns an element into a (flat) list
join = List.Join(watch_2, turn_into_list)
watch_3 = Watch(join)

# group (continued): interpret dictionary part 1
count = Count(watch_3)
code_block_6 = CodeBlock(x=count) { 0..(x-1); }
map_4 = List.Map(list=code_block_6, f_x=get_children_using_key_value)
flatten_3 = Flatten(map_4)
if_equal_return_index_using = Custom[If Equal Return Index using IndexOf](searchForThese=uniqueItems_2, inThisList=flatten_3)

code_block_7 = CodeBlock { -1; }
eq = if_equal_return_index_using == code_block_7
filterByBoolMask = List.FilterByBoolMask(list=uniqueItems_2, mask=eq)
firstItem_2 = List.FirstItem(filterByBoolMask.in)
turn_into_list_2 = Custom[Turn Into List](item=firstItem_2)
watch_4 = Watch(join)
code_block_8 = CodeBlock(X=count) { X-1; }
watch_5 = Watch(map_4)
subnode_for_creating_list = Custom[Subnode for creating list hierarchy by nest level](searchForThese=turn_into_list_2, inThisList=watch_4, replace_unmatched_indices_With=code_block_8, get_from_here=watch_5)
subnode_for_creating_list_2 = Custom[Subnode for creating list hierarchy by nest level](searchForThese=subnode_for_creating_list.flattened, inThisList=watch_4, replace_unmatched_indices_With=code_block_8, get_from_here=watch_5)
subnode_for_creating_list_3 = Custom[Subnode for creating list hierarchy by nest level](searchForThese=subnode_for_creating_list_2.flattened, inThisList=watch_4, replace_unmatched_indices_With=code_block_8, get_from_here=watch_5)
subnode_for_creating_list_4 = Custom[Subnode for creating list hierarchy by nest level](searchForThese=subnode_for_creating_list_3.flattened, inThisList=watch_4, replace_unmatched_indices_With=code_block_8, get_from_here=watch_5)
subnode_for_creating_list_5 = Custom[Subnode for creating list hierarchy by nest level](searchForThese=subnode_for_creating_list_4.flattened, inThisList=watch_4, replace_unmatched_indices_With=code_block_8, get_from_here=watch_5)
subnode_for_creating_list_6 = Custom[Subnode for creating list hierarchy by nest level](searchForThese=subnode_for_creating_list_5.flattened, inThisList=watch_4, replace_unmatched_indices_With=code_block_8, get_from_here=watch_5)
subnode_for_creating_list_7 = Custom[Subnode for creating list hierarchy by nest level](searchForThese=subnode_for_creating_list_6.flattened, inThisList=watch_4, replace_unmatched_indices_With=code_block_8, get_from_here=watch_5)
subnode_for_creating_list_8 = Custom[Subnode for creating list hierarchy by nest level](searchForThese=subnode_for_creating_list_7.flattened, inThisList=watch_4, replace_unmatched_indices_With=code_block_8, get_from_here=watch_5)
create = List.Create(turn_into_list_2, subnode_for_creating_list.resolvable, subnode_for_creating_list_2.resolvable, subnode_for_creating_list_3.resolvable, subnode_for_creating_list_4.resolvable, subnode_for_creating_list_5.resolvable, subnode_for_creating_list_6.resolvable, subnode_for_creating_list_7.resolvable, subnode_for_creating_list_8.resolvable)
code_block_9 = CodeBlock { 1; }
flatten_4 = List.Flatten(list=create, amt=code_block_9)
hierarchy_where_index_is_Level = Output(create)
create_2 = List.Create(turn_into_list_2, subnode_for_creating_list.flattened, subnode_for_creating_list_2.flattened, subnode_for_creating_list_3.flattened, subnode_for_creating_list_4.flattened, subnode_for_creating_list_5.flattened, subnode_for_creating_list_6.flattened, subnode_for_creating_list_7.flattened, subnode_for_creating_list_8.flattened)
flattened_hierarcy = Output(create_2)
unique_elements = Output(uniqueItems_2)
their_children = Output(watch_5)
