# Dynamo custom node Duplicate View and Rename and Isolate Elements.dyf (Dynamo 0.8.1.1942)
# category: Bakery.Revit.Elements

elementsIn = Input()
watch = Watch(elementsIn)
sourceView = Input()
duplicate_view_and_isolate = Custom[Duplicate View and Isolate Elements](elementsIn=watch, sourceViewIn=sourceView)
code_block = CodeBlock { "View Name"; }
firstItem = List.FirstItem(watch)
parameterToNameWith = Input()
getParameterValueByName = Element.GetParameterValueByName(element=firstItem, parameterName=parameterToNameWith)
code_block_2 = CodeBlock { ""; }
eq = getParameterValueByName == code_block_2
code_block_3 = CodeBlock { "empty"; }
boolean_input_to_variable_string = Custom[Boolean Input to Variable String Output](Boolean_In=eq, String_if_True=code_block_3, String_if_False=getParameterValueByName)  # you choose what you want to convert true / false to, good for validation
setParameterByName = Element.SetParameterByName(element=duplicate_view_and_isolate.ViewOut, parameterName=code_block, value=boolean_input_to_variable_string)
done = Output(setParameterByName)
