# Dynamo custom node Dynamo Curves to Revit Curves.dyf (Dynamo 1.2.0.2690)
# category: Bakery.Geometry

curves = Input()
turnIntoList = Custom[TurnIntoList](unknownItem=curves)  # Turns an element (or a nested list) into a flat list
python_script = Python(IN[0]=turnIntoList)
# ---------- python_script.python (23 lines) ----------
import clr
clr.AddReference('RevitAPI')
from Autodesk.Revit.DB import *

clr.AddReference("RevitNodes")
import Revit
clr.ImportExtensions(Revit.GeometryConversion)

clr.AddReference("RevitServices")
import RevitServices
from RevitServices.Persistence import DocumentManager
from RevitServices.Transactions import TransactionManager

doc = DocumentManager.Instance.CurrentDBDocument
curves = UnwrapElement(IN[0])
revitcurves = []
for c in curves:
	try:
		revitcurves.append(c.ToRevitType())
	except:
		pass

OUT = revitcurves
# ----------------------------------------
revitCurves = Output(python_script)
