# Dynamo custom node Element GUID.dyf (Dynamo 1.2.1.3083)
# category: Bakery.Revit.Elements
# also gets normal id

elements = Input()
turnIntoList = Custom[TurnIntoList](unknownItem=elements)  # Turns an element (or a nested list) into a flat list
python_script = Python(IN[0]=turnIntoList)
# ---------- python_script.python (44 lines) ----------
import clr
clr.AddReference('ProtoGeometry')
from Autodesk.DesignScript.Geometry import *

# Import RevitAPI
clr.AddReference("RevitAPI")
import Autodesk
from Autodesk.Revit.DB import *

clr.AddReference("RevitServices")
import RevitServices
from RevitServices.Persistence import DocumentManager
from RevitServices.Transactions import TransactionManager

from System.Collections.Generic import *

clr.AddReference('RevitNodes')
import Revit
clr.ImportExtensions(Revit.Elements)
clr.ImportExtensions(Revit.GeometryConversion)

from System import Guid

import System

import sys
pyt_path = r'C:\Program Files (x86)\IronPython 2.7\Lib'
sys.path.append(pyt_path)

doc = DocumentManager.Instance.CurrentDBDocument
uiapp = DocumentManager.Instance.CurrentUIApplication
app = uiapp.Application

elementsIn = IN[0]

elementIds, guids = [], []
for i in elementsIn:
	try:
		elementIds.append(i.Id)
		guids.append(i.UniqueId)
	except:
		successlist.append("ID list failure")
			
OUT = elementIds, guids
# ----------------------------------------
code_block = CodeBlock { 1; }
getItemAtIndex = List.GetItemAtIndex(list=python_script, index=code_block)
guids = Output(getItemAtIndex)
code_block_2 = CodeBlock { 0; }
getItemAtIndex_2 = List.GetItemAtIndex(list=python_script, index=code_block_2)
ids = Output(getItemAtIndex_2)
