# Dynamo custom node Element Name Universal.dyf (Dynamo 1.1.0.2094)
# category: Bakery.Revit.Elements
# Modified for 0.8.1

Elements = Input()
turnIntoList = Custom[Turn Into List](unknownItem=Elements)  # Turns an element (or a nested list) into a flat list
python_script = Python(IN[0]=turnIntoList)
# ---------- python_script.python (19 lines) ----------
import clr
clr.AddReference('RevitAPI')
from Autodesk.Revit.DB import *

faminsts = IN[0]
elementlist = list()
for item in faminsts:
	try:
		n = UnwrapElement(item).Name
	except:
		n = None
	# Use a built-in property of (wrapped) Dynamo elements for family symbols instead
	if n == None:
		try:
			n = item.Name
		except:
			n = []
	elementlist.append(n)
OUT = elementlist
# ----------------------------------------
returnListOrSingleValue = Custom[ReturnListOrSingleValue](unknownItem=Elements, seq=python_script)  # If the item in input #1 is not a list, only the first item of the list in input #2 will be returned.
Name_s = Output(returnListOrSingleValue)  # "Name(s)"
