# Dynamo custom node Element.CategoryId.dyf (Dynamo 1.2.1.3083)
# category: Bakery.Revit.Document.Category

get_categories = Custom[Get Categories]()  # Lists: Category Name, Category internal api definition, Clean Name (no spaces), Ids
watch = Watch(get_categories.Names)
selectedElement = Input()
category = Custom[Element.Category](element=selectedElement)  # This node will get the input element(s)' categories
firstIndexOf = List.FirstIndexOf(list=watch, item=category)
getItemAtIndex = List.GetItemAtIndex(list=get_categories.Ids, index=firstIndexOf)
categoryId = Output(getItemAtIndex)
