# Dynamo custom node Element.WorksetName.dyf (Dynamo 1.3.0.875)
# category: Bakery.Revit.Document.Worksets
# get the workset name of the element

element = Input(element : var[]..[])
workset = Custom[Element.Workset](element=element)  # Retrieves the workset of a given element
element_name_universal = Custom[Element.Name (Universal)](element=workset)  # Gets an element's name (Dynamo's built-in Name nodes don't work for all element types, e.g. worksets...)
name = Output(element_name_universal)
