# Dynamo custom node Export Element Details and Room Number using Element Input.dyf (Dynamo 0.9.2.4472)
# category: Bakery.Revit.Elements

# group: Inputs
Family_Instance_Element_List = Input()
Room_Elements_RVT_Link_Wildcard_Search = Input()
ExcelFilePath = Input(ExcelFilePath : string)
Family_Instance_Model_Name = Input()

watch = Watch(Family_Instance_Element_List)

# group: Location
location = FamilyInstance.Location(watch)
watch_2 = Watch(location)
string = StringInput("Z Elevation")
deconstructPoint = Geometry.Points.DeconstructPoint(location)
watch_3 = Watch(deconstructPoint.out2)
addItemToFront = List.AddItemToFront(item=string, list=watch_3)
string_2 = StringInput("X")
addItemToFront_2 = List.AddItemToFront(item=string_2, list=deconstructPoint.out0)
string_3 = StringInput("Y")
addItemToFront_3 = List.AddItemToFront(item=string_3, list=deconstructPoint.out1)

# group: Get Rooms
string_4 = StringInput("Rooms")
convert_category_name_to_built = Custom[Convert Category Name to Built In Category Name](categoryName=string_4)  # You must use List.Map to convert list of Category Names to list of Built In Names
get_elements_in_link_using_name = Custom[Get Elements in Link using Name Search and Category](SearchLinkNames=Room_Elements_RVT_Link_Wildcard_Search, DesiredCategoryBuiltInName=convert_category_name_to_built)  # link name search
watch_4 = Watch(get_elements_in_link_using_name.ElementsFlatList)

# group: Get Room
isPointInside = Custom[Room.IsPointInside](room=watch_4)  # Evaluates if a ponti is located inside a given room.
map = List.Map(list=watch_2, f_x=isPointInside)
firstItem = List.FirstItem()
map_2 = List.Map(list=map, f_x=firstItem)
watch_5 = Watch(map_2)
code_block = CodeBlock { true; }
firstIndexOf = List.FirstIndexOf(item=code_block)
map_3 = List.Map(list=watch_5, f_x=firstIndexOf)
watch_6 = Watch(map_3)

anyTrue = Custom[List.AnyTrue]()  # Returns true if any item in a list of booleans is true.
map_4 = List.Map(list=watch_5, f_x=anyTrue)
watch_7 = Watch(map_4)

# group: Element Id
string_5 = StringInput("Element Id")
id = Element.Id(watch)
flat_list_to_list_of_strings = Custom[Flat List to List of Strings](Original_List=id)  # using python methods
addItemToFront_4 = List.AddItemToFront(item=string_5, list=flat_list_to_list_of_strings)

# group: Type
type = Custom[Element.Type](element=watch)  # Gets the family type of a given element (if applicable).
string_6 = StringInput("Family Type")
flat_list_to_list_of_strings_2 = Custom[Flat List to List of Strings](Original_List=type)
addItemToFront_5 = List.AddItemToFront(item=string_6, list=flat_list_to_list_of_strings_2)

# group: Family
string_7 = StringInput("Family Name")
family = FamilyType.Family(type)
flat_list_to_list_of_strings_3 = Custom[Flat List to List of Strings](Original_List=family)
addItemToFront_6 = List.AddItemToFront(item=string_7, list=flat_list_to_list_of_strings_3)

# group: Model name column
string_8 = StringInput("Source RVT")
turnIntoList = Custom[TurnIntoList](unknownItem=Family_Instance_Model_Name)  # Turns an element (or a nested list) into a flat list
count = Count(watch)
cycle = List.Cycle(list=turnIntoList, amount=count)
addItemToFront_7 = List.AddItemToFront(item=string_8, list=cycle)

# group: Room Numbers
string_9 = StringInput("Room Number")
code_block_2 = CodeBlock { "Room not found"; }
code_block_3 = CodeBlock { "Number"; }
getParameterValueByName = Element.GetParameterValueByName(element=watch_4, parameterName=code_block_3)
getItemAtIndex = List.GetItemAtIndex(list=getParameterValueByName, index=watch_6)
watch_8 = Watch(getItemAtIndex)
bv_replace_nulls = Custom[bv Replace Nulls](replacement=code_block_2, seq=watch_8)
addItemToFront_8 = List.AddItemToFront(item=string_9, list=bv_replace_nulls)

# group: Build and Prep for Excel
code_block_4 = CodeBlock { "NULL_REPLACEMENT"; }
create = List.Create(addItemToFront_4, addItemToFront_6, addItemToFront_5, addItemToFront_7, addItemToFront_8, addItemToFront, addItemToFront_2, addItemToFront_3)
watch_9 = Watch(create)
bv_replace_nulls_2 = Custom[bv Replace Nulls](replacement=code_block_4, seq=watch_9)
transpose = List.Transpose(bv_replace_nulls_2)

# group: Write
code_block_5 = CodeBlock { 0; }
code_block_6 = CodeBlock { true; }
writeToFile = Excel.WriteToFile(filePath=ExcelFilePath, sheetName=Room_Elements_RVT_Link_Wildcard_Search, startRow=code_block_5, startCol=code_block_5, data=transpose, overWrite=code_block_6)
TO_EXCEL = Output(writeToFile)
