# Dynamo custom node Export Family and Type Name with One Type Parameter to Excel.dyf (Dynamo 0.8.2.2371)
# category: Bakery.Revit.Elements.Family
# Uses Bumblebee

filePath = Input()
code_block = CodeBlock { "FamilySummary"; }
code_block_2 = CodeBlock { 0; }
elementList = Input()
symbol = FamilyInstance.Symbol(elementList)
uniqueItems = List.UniqueItems(symbol)
typeParameterName = Input()
getParameterValueByName = Element.GetParameterValueByName(element=uniqueItems, parameterName=typeParameterName)
family = FamilySymbol.Family(uniqueItems)
name = Family.Name(family)
name_2 = FamilySymbol.Name(uniqueItems)
create = List.Create(getParameterValueByName, name, name_2)
watch = Watch(create)
transpose = List.Transpose(watch)
code_block_3 = CodeBlock { true; }
writeToFile = Excel.WriteToFile(filePath=filePath, sheetName=code_block, startRow=code_block_2, startCol=code_block_2, data=transpose, overWrite=code_block_3)
done = Output(writeToFile)
