# Dynamo custom node Export Linked Tag Values to Excel by Sheet.dyf (Dynamo 0.8.2.2371)
# category: Bakery.Revit.Elements.Tag

tagElements = Input(tagElements : var[]..[])
oneSheetNumber = Input()
watch = Watch(oneSheetNumber)
get_elements_tagged_on_sheet = Custom[Get Elements Tagged on Sheet](tagElements=tagElements, sheetNumber=watch)
watch_2 = Watch(get_elements_tagged_on_sheet.not_a_Linked_Tag)
tag_text = Custom[Tag Text](Tag=watch_2)  # This node will retireve a text content of a tag.
string = StringInput("e:\temp\")
code_block = CodeBlock { ""; }
excelFilePrefixIncludingDrive = Input(excelFilePrefixIncludingDrive : string = "C:\tempexport")
string_2 = StringInput(".xlsx")
join = String.Join(code_block, excelFilePrefixIncludingDrive, watch, string_2)
turnIntoList = Custom[TurnIntoList](watch)  # Turns an element (or a nested list) into a flat list
watch_3 = Watch(get_elements_tagged_on_sheet.LinkedElementList)
symbol = FamilyInstance.Symbol(watch_3)
TypeParameterName = Input(TypeParameterName : string)
getParameterValueByName = Element.GetParameterValueByName(element=symbol, parameterName=TypeParameterName)
uniqueItems = List.UniqueItems(getParameterValueByName)
sort = List.Sort(uniqueItems)
count = Count(sort)
cycle = List.Cycle(list=turnIntoList, amount=count)
create = List.Create(cycle, sort)
transpose = List.Transpose(create)
write_to_excel_using_only_data = Custom[Write to Excel using only Data and File Path Inputs](filePath=join, data=transpose)  # will overwrite and use Sheet1
SentToExcel = Output(write_to_excel_using_only_data)
