# Dynamo custom node Export To NWC with List Inputs.dyf (Dynamo 1.3.3.4651)
# category: Bakery.Construction.Navisworks
# this one for single view

directoryPath = Input()
fileName = Input()
NavisworksExportOptions = Input()
python_script = Python(IN[0]=directoryPath, IN[1]=fileName, IN[2]=NavisworksExportOptions)
# ---------- python_script.python (52 lines) ----------
import clr
clr.AddReference('ProtoGeometry')
from Autodesk.DesignScript.Geometry import *
# Import ToDSType(bool) extension method
clr.AddReference("RevitNodes")
import Revit
clr.ImportExtensions(Revit.Elements)
# Import geometry conversion extension methods
clr.ImportExtensions(Revit.GeometryConversion)
# Import DocumentManager and TransactionManager
clr.AddReference("RevitServices")
import RevitServices
from RevitServices.Persistence import DocumentManager
from RevitServices.Transactions import TransactionManager
from System.Collections.Generic import *
# Import RevitAPI
clr.AddReference("RevitAPI")
import Autodesk
from Autodesk.Revit.DB import *

doc = DocumentManager.Instance.CurrentDBDocument
uiapp = DocumentManager.Instance.CurrentUIApplication
app = uiapp.Application
uidoc=DocumentManager.Instance.CurrentUIApplication.ActiveUIDocument

#view = []
#for i in IN[0]:
#	views.append(UnwrapElement(i))
try:
	folder=UnwrapElement(IN[0])
except:
	folder=IN[0]
try:
	name=UnwrapElement(IN[1])
except:
	name=IN[1]
try:
	exportoptionbldr=UnwrapElement(IN[2])
except:
	exportoptionbldr=IN[2]
success = []
for x in range(len(name)):
	try:
		c=doc.Export(folder[x],name[x],exportoptionbldr[x])
	except:
		c="not sure"
	success.append(c)

# End Transaction
#TransactionManager.Instance.TransactionTaskDone()

OUT=success
# ----------------------------------------
done = Output(python_script)
