# Dynamo custom node ExtendLineforSplitting.dyf (Dynamo 2.3.1.11775)
# category: Bakery.ZZ

inputCurve = Input(inputCurve: var[]..[])
watch = Watch(inputCurve)
distance = Input(distance: var[]..[])
watch_2 = Watch(distance)
startPoint = Curve.StartPoint(curve=watch)
extend = Curve.Extend(curve=watch, distance=watch_2, pickSide=startPoint)
endPoint = Curve.EndPoint(curve=watch)
extend_2 = Curve.Extend(curve=extend, distance=watch_2, pickSide=endPoint)
extrude = Curve.Extrude(curve=extend_2, distance=watch_2)
Surface = Output(extrude)
