# Dynamo custom node Filter Element List by Parameter Value Wildcard Search.dyf (Dynamo 0.9.1.4062)
# category: Bakery.Core.List

elementList = Input()
parameterName = Input(parameterName : string)
getParameterValueByName = Element.GetParameterValueByName(element=elementList, parameterName=parameterName)
watch = Watch(getParameterValueByName)
searchValue = Input()
filter_one_list_by_string_search = Custom[Filter One List by String Search in Another List](SearchThisList=watch, searchFor=searchValue, FilterThisList=elementList)
elementsContainingValue = Output(filter_one_list_by_string_search.Matching)
