# Dynamo custom node Filter Element List by Revit Z Value.dyf (Dynamo 1.0.0.1180)
# category: Bakery.Revit.Elements

revitXyzPointListFeet = Input()
comma_separated_revit_data_to = Custom[Comma Separated Revit Data to XYZ Values](item=revitXyzPointListFeet, lacing=Longest)
convert_between_units = DynamoConvert(comma_separated_revit_data_to.Z, conversionMetric=Length, conversionFrom=Feet, conversionTo=Millimeters)
watch = Watch(convert_between_units)
compareBenchmarkMM = Input()
eq = convert_between_units == compareBenchmarkMM
filterByBoolMask = List.FilterByBoolMask(list=comma_separated_revit_data_to.Z, mask=eq)
mmZvaluesNotMatching = Output(filterByBoolMask.out)
elementList = Input()
filterByBoolMask_2 = List.FilterByBoolMask(list=elementList, mask=eq)
elementsNotMatching = Output(filterByBoolMask_2.out)
