# Dynamo custom node Filter Element List by Type Parameter Value.dyf (Dynamo 0.8.0.950)
# category: Bakery.Revit.Elements

elementList = Input()
type = Custom[Element.Type](Element_s=elementList)  # Gets the family type of a given element (if applicable).
TypeParameterName = Input()
getParameterValueByName = Element.GetParameterValueByName(element=type, parameterName=TypeParameterName)
TypeParameterValue = Input()
eq = getParameterValueByName == TypeParameterValue
filterByBoolMask = List.FilterByBoolMask(list=elementList, mask=eq)
watch = Watch(filterByBoolMask.in)
filteredList = Output(watch)
