# Dynamo custom node Filter Elements by Family Name.dyf (Dynamo 1.0.0.1180)
# category: Bakery.Revit.Elements

elementList = Input()
watch = Watch(elementList)
familyNameString = Input()
parentFamily = Custom[Element.ParentFamily](element=watch)  # This node retrieces the parent family name for each input element.
eq = familyNameString == parentFamily  # lacing=Longest
filterByBoolMask = List.FilterByBoolMask(list=watch, mask=eq)
matchingElements = Output(filterByBoolMask.in)
