# Dynamo custom node Filter Elements by Intersection with Element.dyf (Dynamo 0.8.2.2371)
# category: Bakery.Revit.Elements
# uses Element.Geometry and Geometry.DoesIntersect

elements_to_filter = Input()
watch = Watch(elements_to_filter)
one_element_to_check_intersection = Input()
geometry = Element.Geometry(one_element_to_check_intersection)
flatten = Flatten(geometry)
firstItem = List.FirstItem(flatten)
element_location_points = Input()
watch_2 = Watch(element_location_points)
doesIntersect = Geometry.DoesIntersect(geometry=firstItem, other=watch_2)
filterByBoolMask = List.FilterByBoolMask(list=watch, mask=doesIntersect)
element_ids = Custom[Element Ids](Element_s=filterByBoolMask.in)  # This node will query an element id that can be used with Revit nodes. Dynamo Element Id node returns integer value.
element_Ids_that_Intersect = Output(element_ids.Rvt_ElementId_s)
element_GUIDs_that_Intersect = Output(element_ids.GUID_s)
elements_that_Intersect = Output(filterByBoolMask.in)
elements_NOT_intersecting = Output(filterByBoolMask.out)
Geometry_DoesIntersect_bool_results = Output(doesIntersect)
