# Dynamo custom node Filter Elements by Workset Name.dyf (Dynamo 0.9.2.4472)
# category: Bakery.Revit.Document.Worksets

collect_all_elements_in_model = Custom[Collect All Elements in Model faster]()  # does not report count or categories
worksetNameString = Input()
filter_element_list_by_workset = Custom[Filter Element List by Workset Name](element=collect_all_elements_in_model.extendedElementList, y=worksetNameString)
matching = Output(filter_element_list_by_workset)
