# Dynamo custom node Filter Family Instances by View Specific Property.dyf (Dynamo 1.0.0.1180)
# category: Bakery.Revit.Elements

familyInstances = Input()
watch = Watch(familyInstances)
get_family_instance_properties = Custom[Get Family Instance Properties](familyInstances=watch)
filterByBoolMask = List.FilterByBoolMask(list=watch, mask=get_family_instance_properties.viewSpecific)
nonViewSpecific = Output(filterByBoolMask.out)
isViewSpecific = Output(filterByBoolMask.in)
