# Dynamo custom node Filter One List by String Search in Another List.dyf (Dynamo 0.9.2.4472)
# category: Bakery.Core.List

FilterThisList = Input()
SearchThisList = Input()
searchFor = Input(searchFor : string)
boolean = BoolSelector(true)
contains = String.Contains(str=SearchThisList, searchFor=searchFor, ignoreCase=boolean)
filterByBoolMask = List.FilterByBoolMask(list=FilterThisList, mask=contains)
Matching = Output(filterByBoolMask.in)
unMatched = Output(filterByBoolMask.out)
