# Dynamo custom node Find Characters in Square Brackets and Merge to String.dyf (Dynamo 1.1.0.2094)
# category: Bakery.Core.String

code_block = CodeBlock { ""; }
string = StringInput("\[(.*?)\]")
str = Input(str : string)
findRegularExpression = Custom[String.FindRegularExpression](RegEx=string, str=str)  # Returns all occurences of a regular expression within a string (or list of strings). The syntax for regular expressions is explained at http://ironpython-test.readthedocs.org/en/latest/howto/regex.html
code_block_2 = CodeBlock { 1; }
dropItems = List.DropItems(list=findRegularExpression, amount=code_block_2)
join = String.Join(code_block, dropItems)
firstItem = List.FirstItem(join)
str_2 = Output(firstItem)  # "str"
