# Dynamo custom node Find Sheets and Views Where an Element is Visible.dyf (Dynamo 0.8.2.2392)
# category: Bakery.Revit.Views
# doesn't work yet

views = Input()
turn_into_list = Custom[Turn Into List](item=views)  # Turns an element into a (flat) list
python_script = Python(IN[0]=turn_into_list)
# ---------- python_script.python (34 lines) ----------
#LSJ

import clr
clr.AddReference('ProtoGeometry')
from Autodesk.DesignScript.Geometry import *

# Import DocumentManager
clr.AddReference("RevitServices")
import RevitServices
from RevitServices.Persistence import DocumentManager

# Import RevitAPI
clr.AddReference("RevitAPI")
import Autodesk

# Import ToDSType(bool) extension method
clr.AddReference("RevitNodes")
import Revit
from Autodesk.Revit.DB import *
clr.ImportExtensions(Revit.Elements)

import System

views = UnwrapElement(IN[0])

elementlist = []
doc = DocumentManager.Instance.CurrentDBDocument

for view in views:
	collector = FilteredElementCollector(doc, view.Id)
	elementlist.append(collector.ToElements())

#Assign your output to the OUT variable
OUT = elementlist
# ----------------------------------------
out = Output(python_script)
bv_elements_to_ids = Custom[bv Elements to IDs](Element_s=python_script)  # forked from CAAD_RWTH
element = Input()
bv_elements_to_ids_2 = Custom[bv Elements to IDs](Element_s=element)
firstItem = List.FirstItem(bv_elements_to_ids_2.ID_s)
containsItem = List.ContainsItem(item=firstItem)
map = List.Map(list=bv_elements_to_ids.ID_s, f_x=containsItem)
contains_Element_bool = Output(map)  # "contains Element? bool"
filterByBoolMask = List.FilterByBoolMask(list=turn_into_list, mask=map)
found_in_Views = Output(filterByBoolMask.in)
element_name_universal = Custom[Element Name Universal](Element_s=filterByBoolMask.in)  # Modified for 0.8.1
found_in_Views_names = Output(element_name_universal)  # "found in Views (names)"
