# Dynamo custom node Flip Facing Orientation.dyf (Dynamo 0.9.1.4062)
# category: Bakery.Revit.Elements

ElementsIn = Input()
turnIntoList = Custom[Turn Into List](unknownItem=ElementsIn)  # Turns an element (or a nested list) into a flat list
python_script = Python(IN[0]=turnIntoList)
# ---------- python_script.python (23 lines) ----------
import clr
clr.AddReference('RevitAPI')
from Autodesk.Revit.DB import *

clr.AddReference("RevitServices")
import RevitServices
from RevitServices.Persistence import DocumentManager
from RevitServices.Transactions import TransactionManager

doc = DocumentManager.Instance.CurrentDBDocument
faminstances = IN[0]
elementlist = list()

TransactionManager.Instance.EnsureInTransaction(doc)
for item in faminstances:
#	try:
		item.Mirror()
		elementlist.append(item)
#	except:
#		elementlist.append(list())
TransactionManager.Instance.TransactionTaskDone()
		
OUT = elementlist
# ----------------------------------------
Element_s = Output(python_script)  # "Element(s)"
