# Dynamo custom node Get All Revit Links as Element List.dyf (Dynamo 0.9.2.4472)
# category: Bakery.Revit.Document.Links

get_linked_rvt_documents = Custom[Get Linked RVT Documents]()
element_ids = Custom[Element Ids](Element_s=get_linked_rvt_documents.Link_Instance)  # This node will query an element id that can be used with Revit nodes. Dynamo Element Id node returns integer value.
bv_ids_to_elements = Custom[bv IDs to Elements](ID_s=element_ids.Rvt_ElementId_s)  # forked from CAAD_RWTH
RevitLinkElements = Output(bv_ids_to_elements.Element_s)
