# Dynamo custom node Get BCF files from unzipped BCFZIP.dyf (Dynamo 1.3.0.875)
# category: Bakery.ZZ

path = Input()
fromPath = DirectoryObject(path)  # "Directory.FromPath"
contents = Directory.Contents(fromPath)
sort = List.Sort(contents.out1)
fromPath_2 = DirectoryObject(sort)  # "Directory.FromPath"
contents_2 = Directory.Contents(fromPath_2)
flatten = Flatten(contents_2)
string = StringInput(".bcf")
contains = String.Contains(str=flatten, searchFor=string)
filterByBoolMask = List.FilterByBoolMask(list=flatten, mask=contains)
flatlist = Output(filterByBoolMask.in)
