# Dynamo custom node Get Categories from Elements.dyf (Dynamo 1.0.0.1180)
# category: Bakery.Revit.Document.Category
# "List Unique Categories Present in Set of Elements" is better. This one uses Blackbox Get.CategoryName and Get Categories (designed to use document category list)

Elements = Input()
bv_get_category_name = Custom[bv Get Category Name](Elements=Elements)  # forked from Blackbox
uniqueItems = List.UniqueItems(bv_get_category_name)
CategoriesPresent = Output(uniqueItems)
convert_category_name_to_built = Custom[Convert Category Name to Built In Category Name](categoryNameOrNames=uniqueItems)  # You must use List.Map to convert list of Category Names to list of Built In Names
BuiltIn = Output(convert_category_name_to_built)
