# Dynamo custom node Get Categories with Builtins.dyf (Dynamo 1.3.0.875)
# category: Bakery.Revit.Document.Category
# Lists: Category Names, internal api definition, Built In Category Names, Ids

python_script = Python()
# ---------- python_script.python (58 lines) ----------
import clr
clr.AddReference('ProtoGeometry')
from Autodesk.DesignScript.Geometry import *

# Import DocumentManager
clr.AddReference("RevitServices")
import RevitServices
from RevitServices.Persistence import DocumentManager

# Import RevitAPI
clr.AddReference("RevitAPI")
import Autodesk

# Import ToDSType(bool) extension method
clr.AddReference("RevitNodes")
import Revit
from Autodesk.Revit.DB import *
clr.ImportExtensions(Revit.Elements)

import System

#The inputs to this node will be stored as a list in the IN variable.
#doc = DocumentManager.Instance.CurrentDBDocument
uiapp = DocumentManager.Instance.CurrentUIApplication
app = uiapp.Application
doc = DocumentManager.Instance.CurrentDBDocument

#create workset collector
userCategories = doc.Settings.Categories
#extract workset's name and ids
names, ids, builtInNames = [], [], []
for i in userCategories:
	try:
		names.append(i.Name)
	except:
		names.append("failure")
	try:
		ids.append(i.Id.IntegerValue)
	except:
		ids.append("failure")
	try:
		tempID = i.Id.IntegerValue
	except:
		tempID = "failure"
	try:
		builtInNames.append(System.Enum.ToObject(BuiltInCategory, tempID))
	except:
		builtInNames.append("failure")

builtInNameStr = []
for y in builtInNames:
	try:
		builtInNameStr.append(str(y))
	except:
		builtInNameStr.append("stringConversionFailure")

#Assign your output to the OUT variable
OUT = userCategories, names, ids, builtInNameStr, builtInNames
# ----------------------------------------
number = DoubleInput(1)
getItemAtIndex = List.GetItemAtIndex(list=python_script, index=number)
Names = Output(getItemAtIndex)
number_2 = DoubleInput(0)
getItemAtIndex_2 = List.GetItemAtIndex(list=python_script, index=number_2)
Categories = Output(getItemAtIndex_2)
number_3 = DoubleInput(3)
getItemAtIndex_3 = List.GetItemAtIndex(list=python_script, index=number_3)
BuiltinName = Output(getItemAtIndex_3)
number_4 = DoubleInput(2)
getItemAtIndex_4 = List.GetItemAtIndex(list=python_script, index=number_4)
Ids = Output(getItemAtIndex_4)
number_5 = DoubleInput(3)
getItemAtIndex_5 = List.GetItemAtIndex(list=python_script, index=number_5)
BuiltinNameStrings = Output(getItemAtIndex_5)
