# Dynamo custom node Get Categories.dyf (Dynamo 2.3.0.5885)
# category: Bakery.Revit.Document.Category
# Lists: Category Name, Category internal api definition, Clean Name (no spaces), Ids
# packages: archi-lab.net 2016.12.7

current_document = Custom[Current Document]()  # package archi-lab.net; Retrieves Current Document
python_script = Python(IN[0]=current_document)
# ---------- python_script.python (39 lines) ----------
#LSJ

import clr
clr.AddReference('ProtoGeometry')
from Autodesk.DesignScript.Geometry import *

# Import DocumentManager
clr.AddReference("RevitServices")
import RevitServices
from RevitServices.Persistence import DocumentManager

# Import RevitAPI
clr.AddReference("RevitAPI")
import Autodesk

# Import ToDSType(bool) extension method
clr.AddReference("RevitNodes")
import Revit
from Autodesk.Revit.DB import *
clr.ImportExtensions(Revit.Elements)

import System

#The inputs to this node will be stored as a list in the IN variable.
#doc = DocumentManager.Instance.CurrentDBDocument
uiapp = DocumentManager.Instance.CurrentUIApplication
app = uiapp.Application
doc = IN[0]

#create workset collector
userCategories = doc.Settings.Categories
#extract workset's name and ids
names, ids, clean = [], [], []
for i in userCategories:
	names.append(i.Name)
	ids.append(i.Id.IntegerValue)
	clean.append(i.Name.replace(' ', ''))		
#Assign your output to the OUT variable
OUT = userCategories, names, ids, clean
# ----------------------------------------
number = DoubleInput(1)  # graph input
getItemAtIndex = List.GetItemAtIndex(list=python_script, index=number)
Names = Output(getItemAtIndex)
number_2 = DoubleInput(0)  # graph input
getItemAtIndex_2 = List.GetItemAtIndex(list=python_script, index=number_2)
Categories = Output(getItemAtIndex_2)
number_3 = DoubleInput(3)  # graph input
getItemAtIndex_3 = List.GetItemAtIndex(list=python_script, index=number_3)
CleanName = Output(getItemAtIndex_3)
number_4 = DoubleInput(2)  # graph input
getItemAtIndex_4 = List.GetItemAtIndex(list=python_script, index=number_4)
Ids = Output(getItemAtIndex_4)
