# Dynamo custom node Get Characters at Start of Strings.dyf (Dynamo 1.0.0.1180)
# category: Bakery.Core.String

code_block = CodeBlock { "NULL_REPLACED"; }
listOfStrings = Input()
watch = Watch(listOfStrings)
charactersToKeep = Input()
length = String.Length(watch)
code_block_2 = CodeBlock(x=length, y=charactersToKeep) { x-y; }
watch_2 = Watch(code_block_2)
remove = String.Remove(str=watch, startIndex=charactersToKeep, count=watch_2)
watch_3 = Watch(remove)
bv_replace_nulls = Custom[bv Replace Nulls](replacement=code_block, seq=watch_3)  # Python version
watch_4 = Watch(bv_replace_nulls)
stringsOut = Output(watch_4)
