# Dynamo custom node Get Column as List from Excel.dyf (Dynamo 0.8.2.2371)
# category: Bakery.Office.Excel

ExcelFilePath = Input()
fromPath = FileObject(ExcelFilePath)  # "File.FromPath"
sheetName = Input(sheetName : string)
readFromFile = Excel.ReadFromFile(file=fromPath, sheetName=sheetName)
firstItem = List.FirstItem(readFromFile)
columnName = Input(columnName : var)
firstIndexOf = List.FirstIndexOf(list=firstItem, item=columnName)
getItemAtIndex = List.GetItemAtIndex(index=firstIndexOf)
map = List.Map(list=readFromFile, f_x=getItemAtIndex)
watch = Watch(map)
RemoveColumnHeading = Input(RemoveColumnHeading : bool = True)
code_block = CodeBlock { 1; }
code_block_2 = CodeBlock { 0; }
if_ = If(test=RemoveColumnHeading, true=code_block, false=code_block_2)
dropItems = List.DropItems(list=watch, amount=if_)
list = Output(dropItems)
