# Dynamo custom node Get Connector XYZ Lists from Elements.dyf (Dynamo 1.3.4.6666)
# category: Bakery.Revit.API.MEP

elementz = Input()
python_script = Python(IN[0]=elementz)
# ---------- python_script.python (87 lines) ----------
#Created by Luke Johnson for Bakery
import clr
clr.AddReference('ProtoGeometry')
from Autodesk.DesignScript.Geometry import *

# Import ToDSType(bool) extension method
clr.AddReference("RevitNodes")
import Revit
clr.ImportExtensions(Revit.Elements)

# Import DocumentManager and TransactionManager
clr.AddReference("RevitServices")
import RevitServices
from RevitServices.Persistence import DocumentManager
from RevitServices.Transactions import TransactionManager


from System.Collections.Generic import *

# Import RevitAPI
clr.AddReference("RevitAPI")
import Autodesk

doc = DocumentManager.Instance.CurrentDBDocument
uiapp = DocumentManager.Instance.CurrentUIApplication
app = uiapp.Application

#The inputs to this node will be stored as a list in the IN variable.
ctrayelems = UnwrapElement(IN[0])

#curvenrmls = []
cnctmgr = []

for y in ctrayelems:
#	curvenrmls.append(y.CurveNormal)
	try:
		cnctmgr.append(y.ConnectorManager)
	except:
		try:
			cnctmgr.append(y.MEPModel.ConnectorManager)
		except:
			cnctmgr.append(None)
#Assign your output to the OUT variable
connectors = []
for cm in cnctmgr:
	cmlist = []
	try:
		for x in cm.Connectors:
			cmlist.append(x)
		connectors.append(cmlist)
	except:
		connectors.append(None)

firstconnector = []
for cts in connectors:
	try:
		firstconnector.append(cts[0])
	except:
		firstconnector.append(None)

fcorigin = []
for fc in firstconnector:
	try:
		fcorigin.append(str(fc.Origin))
	except:
		fcorigin.append(None)
fcsplits = []
for fco in fcorigin:
	try:
		stripped = fco[1:-1]
		fcsplits.append(stripped.split(', '))
	except:
		fcsplits.append(None)
scaled = []
for lst in fcsplits:
	scalesub = []
	try:
		for sub in lst:
			try:
				scalesub.append(float(sub)*304.8)
			except:
				pass
	except:
		scalesub.append(None)
	scaled.append(scalesub)

OUT = scaled
# ----------------------------------------
code_block = CodeBlock { 2; }
getItemAtIndex = List.GetItemAtIndex(list=python_script@L2, index=code_block)
zList = Output(getItemAtIndex)
code_block_2 = CodeBlock { 0; }
getItemAtIndex_2 = List.GetItemAtIndex(list=python_script@L2, index=code_block_2)
xList = Output(getItemAtIndex_2)
code_block_3 = CodeBlock { 1; }
getItemAtIndex_3 = List.GetItemAtIndex(list=python_script@L2, index=code_block_3)
yList = Output(getItemAtIndex_3)
