# Dynamo custom node Get Element Room parameter from API.dyf (Dynamo 0.8.0.950)
# category: Bakery.Revit.Parameters

Elements = Input()
Phase_string = Input()  # "Phase [string]"
python_GetRoomsFromElements = Python(IN[0]=Elements, IN[1]=Phase_string)
# ---------- python_GetRoomsFromElements.python (65 lines) ----------
#Copyright(c) 2014, Case-Inc Jason Andersen, j.andersen@case-inc.com

# Default imports
import clr
# Import RevitAPI
clr.AddReference("RevitAPI")
import Autodesk
from Autodesk.Revit.DB import *
import System.Collections.Generic
from System.Collections.Generic import List
# Import DocumentManager and TransactionManager
clr.AddReference("RevitServices")
import RevitServices
from RevitServices.Persistence import DocumentManager
from RevitServices.Transactions import TransactionManager
# Import ToDSType(bool) extension method
clr.AddReference("RevitNodes")
import Revit
clr.ImportExtensions(Revit.Elements)
doc =  DocumentManager.Instance.CurrentDBDocument
app =  DocumentManager.Instance.CurrentUIApplication.Application

#phase coming in
elementz = IN[0]
phaseProject = IN[1]

phase = []
collector = FilteredElementCollector(doc)
phase_collector = collector.OfClass(Phase)

for i in phase_collector:
	if i.Name == phaseProject:
  		phase = i
  	else:
 		print("Phase not found")

#unwrapelements
elements = []
for i in elementz:
    elements.append(UnwrapElement(i))

#variables
output = []
roomelems = []
elemNotInRooms = []

#work
failure = 'failed'
for f in elements:
	fi = (f)
	fs = fi.Symbol
	fm = fi.Symbol.Family
	room = fi.Room[phase]

	if room != None:
		roomelems.append(room)
	else:
		roomelems.append(failure)
		continue
	
output.append(roomelems)
output.append(elemNotInRooms)
	
#Assign your output to the OUT variable
OUT = roomelems
# ----------------------------------------
Room_Elements = Output(python_GetRoomsFromElements)
