# Dynamo custom node Get Elements Tagged on Sheet.dyf (Dynamo 0.8.2.2371)
# category: Bakery.Revit.Elements.Tag

tagElements = Input()
ownerView = Custom[Element.OwnerView](element=tagElements)  # Gets the owner view of a given Revit element (if possible)
code_block = CodeBlock { "Sheet Number"; }
getParameterValueByName = Element.GetParameterValueByName(element=ownerView, parameterName=code_block)
uniqueItems = List.UniqueItems(getParameterValueByName)
sheetNumber = Input()
firstIndexOf = List.FirstIndexOf(list=uniqueItems, item=sheetNumber)
getItemAtIndex = List.GetItemAtIndex(list=uniqueItems, index=firstIndexOf)
filter_one_list_by_string_search = Custom[Filter One List by String Search in Another List](SearchThisList=getParameterValueByName, searchFor=getItemAtIndex, FilterThisList=tagElements)
watch = Watch(filter_one_list_by_string_search.Matching)
get_tagged_linked_element_id = Custom[Get Tagged Linked Element Id](Tags=filter_one_list_by_string_search.Matching)
get_actual_elements_from_linked = Custom[Get Actual Elements from Linked Tag Ids](tagInfoList=get_tagged_linked_element_id)  # very slow for the elements...
watch_2 = Watch(get_actual_elements_from_linked.Link_Actual_Elements)
not_a_Linked_Tag = Output(get_actual_elements_from_linked.not_a_Linked_Tag)
watch_3 = Watch(get_actual_elements_from_linked.Link_Element_Ids)
watch_4 = Watch(get_actual_elements_from_linked.Link_Docs)
get_elements_from_documents_by = Custom[Get Elements from Documents by Id](elementIdList=watch_3, docList=watch_4)  # requires 1:1 input
LinkedElementList = Output(get_elements_from_documents_by)
