# Dynamo custom node Get Elements and Types for Certain Categories in Links.dyf (Dynamo 0.8.2.2371)
# category: Bakery.Revit.Document.Links

list = Input()
convert_category_name_to_built = Custom[Convert Category Name to Built In Category Name]()
map = List.Map(list=list, f_x=convert_category_name_to_built)
flatten = Flatten(map)
SearchLinkNames = Input(SearchLinkNames : var[]..[])
get_elements_in_link_using_name = Custom[Get Elements in Link using Name Search and Category](SearchLinkNames=SearchLinkNames)  # link name search
map_2 = List.Map(list=flatten, f_x=get_elements_in_link_using_name.ElementsFlatList)
flatten_2 = Flatten(map_2)
Elements = Output(flatten_2)
count = Count(flatten_2)
integer_slider = IntegerSlider(1, range=0..100 step 1)
sub = count - integer_slider
code_block = CodeBlock(a=sub) { 0..a; }
map_3 = List.Map(list=flatten, f_x=get_elements_in_link_using_name.chopped_Link_List)
flatten_3 = Flatten(map_3)
map_4 = List.Map(list=flatten, f_x=get_elements_in_link_using_name.list_of_Lengths)
flatten_4 = Flatten(map_4)
cycle_entries_of_one_list_by = Custom[Cycle Entries of one List by List of Lengths](listToCycle=flatten_3, listOfLengths=flatten_4)
flatten_5 = Flatten(cycle_entries_of_one_list_by)
element_type_for_linked_file = Custom[Element Type for Linked File Large Lists](list=flatten_2, list_2=flatten_5)
map_5 = List.Map(list=code_block, f_x=element_type_for_linked_file)
flatten_6 = Flatten(map_5)
Types = Output(flatten_6)
