# Dynamo custom node Get Elements from Documents by Id.dyf (Dynamo 0.8.2.2371)
# category: Bakery.Revit.Selection
# requires 1:1 input

docList = Input()
elementIdList = Input()
count = Count(elementIdList)
code_block = CodeBlock(x=count) { 0..(x-1); }
python_script = Python(IN[0]=docList, IN[1]=elementIdList, IN[2]=code_block)
# ---------- python_script.python (42 lines) ----------
#Copyright(c) 2015, Konrad K Sobon
# @arch_laboratory, http://archi-lab.net

import clr
clr.AddReference('ProtoGeometry')
from Autodesk.DesignScript.Geometry import *

# Import DocumentManager and TransactionManager
clr.AddReference("RevitServices")
import RevitServices
from RevitServices.Persistence import DocumentManager
from RevitServices.Transactions import TransactionManager

doc = DocumentManager.Instance.CurrentDBDocument
uiapp = DocumentManager.Instance.CurrentUIApplication
app = uiapp.Application

# Import RevitAPI
clr.AddReference("RevitAPI")
import Autodesk
from Autodesk.Revit.DB import *

#The inputs to this node will be stored as a list in the IN variable.
docIn = IN[0]
elemId = IN[1]
counter = IN[2]

result = []
#apply lineweight override to elements in an input list
for k in counter:
	try:
		elem = docIn[k].GetElement(elemId[k])
		result.append(elem)
	except:
		result.append("failure")
	

# "End" the transaction
TransactionManager.Instance.TransactionTaskDone()

#Assign your output to the OUT variable
OUT = result
# ----------------------------------------
elementList = Output(python_script)
