# Dynamo custom node Get Elements in Link using Name Search and Category.dyf (Dynamo 0.8.2.2392)
# category: Bakery.Revit.Selection
# link name search

get_linked_rvt_documents = Custom[Get Linked RVT Documents]()
watch = Watch(get_linked_rvt_documents.Link_Doc)
watch_2 = Watch(get_linked_rvt_documents.Link_Name)
watch_3 = Watch(watch_2)
flat_list_to_list_of_strings = Custom[Flat List to List of Strings](Original_List=watch_3)  # using python methods
SearchLinkNames = Input()
boolean = BoolSelector(true)
contains = String.Contains(str=flat_list_to_list_of_strings, searchFor=SearchLinkNames, ignoreCase=boolean)
filterByBoolMask = List.FilterByBoolMask(list=watch, mask=contains)
watch_4 = Watch(filterByBoolMask.in)
bv_remove_nulls = Custom[bv Remove Nulls](List=watch_4)  # forked from Lunchbox
DesiredCategoryBuiltInName = Input()
turn_into_list = Custom[Turn Into List](item=DesiredCategoryBuiltInName)  # Turns an element into a list
firstItem = List.FirstItem(turn_into_list)
get_elements_from_link_document = Custom[Get Elements from Link Document Using Category](builtInName=firstItem)
map = List.Map(list=bv_remove_nulls, f_x=get_elements_from_link_document)
watch_5 = Watch(map)
flatten = Flatten(watch_5)
ElementsFlatList = Output(flatten)
filterByBoolMask_2 = List.FilterByBoolMask(list=watch_3, mask=contains)
uniqueItems = List.UniqueItems(filterByBoolMask_2.in)
LinksUsed = Output(uniqueItems)
uniqueItems_2 = List.UniqueItems(watch_4)
LinkDocUsed = Output(uniqueItems_2)
watch_6 = Watch(get_linked_rvt_documents.Link_Instance)
filterByBoolMask_3 = List.FilterByBoolMask(list=watch_6, mask=contains)
watch_7 = Watch(filterByBoolMask_3.in)
LinkInstance = Output(watch_7)
watch_8 = Watch(firstItem)
count = Count()
map_2 = List.Map(list=watch_5, f_x=count)
watch_9 = Watch(map_2)
watch_10 = Watch(bv_remove_nulls)
code_block = CodeBlock { 1; }
chop = List.Chop(watch_10, code_block)
chopped_Link_List = Output(chop)
flatten_2 = Flatten(map_2)
list_of_Lengths = Output(flatten_2)
