# Dynamo custom node Get Family List for this project.dyf (Dynamo 0.8.2.2371)
# category: Bakery.Revit.Elements.Family

python_script = Python()
# ---------- python_script.python (20 lines) ----------
#Made by Marc Tavenier @marctavenier
import clr
clr.AddReference('RevitAPI')
from Autodesk.Revit.DB import *

clr.AddReference('RevitServices')
import RevitServices
from RevitServices.Persistence import DocumentManager

#The inputs to this node will be stored as a list in the IN variable.
dataEnteringNode = IN

elementlist = []
doc = DocumentManager.Instance.CurrentDBDocument

collector = FilteredElementCollector(doc).OfClass(Family)
elementlist = collector.ToElements()

#Assign your output to the OUT variable
OUT = elementlist
# ----------------------------------------
Elements = Output(python_script)
