# Dynamo custom node Get From Sublists using matching List of Indices.dyf (Dynamo 0.8.2.2371)
# category: Bakery.Core.List

lists_with_sublists = Input()
watch = Watch(lists_with_sublists)
count = Count(watch)
code_block = CodeBlock(x=count) { 0..(x-1); }
list_of_indices = Input()
subnode_to_get_index_from = Custom[Subnode to get index from sublist](list=watch, list_2=list_of_indices)
map = List.Map(list=code_block, f_x=subnode_to_get_index_from)
mapped = Output(map)
