# Dynamo custom node Get Host Pipe ID from Pipe Insulation.dyf (Dynamo 0.8.2.2311)
# category: Bakery.Revit.Elements.Systems
# takes a list of elements (such as Pipe Insulations) and returns a list of their Hosts. Works for a variety of element types, not just Pipes :)

Element_s = Input()  # "Element(s)"
turn_into_list = Custom[Turn Into List](item=Element_s)  # Turns an element (or a nested list) into a flat list
python_script = Python(IN[0]=turn_into_list)
# ---------- python_script.python (23 lines) ----------
import clr
clr.AddReference('RevitAPI')
from Autodesk.Revit.DB import *

clr.AddReference("RevitServices")
import RevitServices
from RevitServices.Persistence import DocumentManager
from RevitServices.Transactions import TransactionManager

doc = DocumentManager.Instance.CurrentDBDocument
faminsts = UnwrapElement(IN[0])
elementlist = list()
faillist = list()
sourcelist = list()
for item in faminsts:
	sourcelist.append(doc.GetElement(item.HostElementId))
#	try:
#		param = item.HostElementId()
#		elementlist.append(param)
#	except:
#		faillist.append(item)
#OUT = (elementlist,faillist)
OUT = sourcelist
# ----------------------------------------
out = Output(python_script)
