# Dynamo custom node Get Indices of Null Values.dyf (Dynamo 0.8.2.2371)
# category: Bakery.Core.List
# .

list = Input()
code_block = CodeBlock { null; }
bv_all_indices_of_that_can = Custom[bv All Indices Of that can handle Nulls](list=list, value=code_block)  # forked from spring nodes
indices = Output(bv_all_indices_of_that_can)
