# Dynamo custom node Get Link Names and Link Docs by Name Search.dyf (Dynamo 0.8.2.2371)
# category: Bakery.Revit.Document.Links

get_linked_rvt_documents = Custom[Get Linked RVT Documents]()
searchFor = Input(searchFor : string)
filter_one_list_by_string_search = Custom[Filter One List by String Search in Another List](SearchThisList=get_linked_rvt_documents.Link_Name, searchFor=searchFor, FilterThisList=get_linked_rvt_documents.Link_Name)
turnIntoList = Custom[TurnIntoList](filter_one_list_by_string_search.Matching)  # Turns an element (or a nested list) into a flat list
watch = Watch(turnIntoList)
watch_2 = Watch(watch)
long_link_names = Output(watch_2)
clean_link_name_list = Custom[Clean Link Name List](name_list=watch_2)
cleaned_link_names = Output(clean_link_name_list)
get_link_document_from_link_name = Custom[Get Link Document from Link Name](searchFor=clean_link_name_list)
link_docs = Output(get_link_document_from_link_name)
