# Dynamo custom node Get List of Elements at OriginalNestingLevel.dyf (Dynamo 0.8.2.2392)
# category: Bakery.Revit.Document.Utility.Nested
# sdf

OriginalNestLevelStr = Input()
collect_all_familyinstance_using = Custom[Collect all FamilyInstance using Element Types]()  # should get model family instances
string = StringInput("OriginalNestingLevel")
bv_get_parameter_value_as_string = Custom[bv Get Parameter Value as String](Element_s=collect_all_familyinstance_using, Parameter_Name=string)  # forked from Rhythm
flatten = Flatten(bv_get_parameter_value_as_string)
eq = OriginalNestLevelStr == flatten
watch = Watch(eq)
filterByBoolMask = List.FilterByBoolMask(list=collect_all_familyinstance_using, mask=eq)
categories = Categories("PlumbingFixtures")
isOfCategory = Custom[Element.IsOfCategory](element_s=filterByBoolMask.in, Category=categories)  # Checks whether an element is of a specified category
watch_2 = Watch(isOfCategory)
filterByBoolMask_2 = List.FilterByBoolMask(list=filterByBoolMask.in, mask=isOfCategory)
watch_3 = Watch(filterByBoolMask_2.in)
Of_Selected_Category = Output(watch_3)
watch_4 = Watch(filterByBoolMask_2.out)
Of_Other_Category = Output(watch_4)
