# Dynamo custom node Get Matching Items from List with String Conversion.dyf (Dynamo 0.8.2.2371)
# category: Bakery.Core.List

search_and_get_from_this_list = Input()
single_string_with_line_breaks = Input()
convert_string_with_line_breaks = Custom[Convert String with Line Breaks into List of Strings](string=single_string_with_line_breaks)
flat_list_to_list_of_strings = Custom[Flat List to List of Strings](Original_List=search_and_get_from_this_list)  # using python methods
if_equal_return_index_using = Custom[If Equal Return Index using IndexOf](searchForThese=convert_string_with_line_breaks, inThisList=flat_list_to_list_of_strings)
getItemAtIndex = List.GetItemAtIndex(list=search_and_get_from_this_list, index=if_equal_return_index_using)
found_items = Output(getItemAtIndex)
