# Dynamo custom node Get Open Worksets.dyf (Dynamo 0.8.2.2371)
# category: Bakery.Revit.Document.Worksets
# as sorted list

get_worksets_with_all_properties = Custom[Get Worksets with all Properties]()  # based on Konrad's, added some more properties of Worksets
filterByBoolMask = List.FilterByBoolMask(list=get_worksets_with_all_properties.Names, mask=get_worksets_with_all_properties.IsOpen)
sort = List.Sort(filterByBoolMask.in)
openWorksets = Output(sort)
