# Dynamo custom node Get Parents for Parts from Host and One Linked Document.dyf (Dynamo 0.9.2.4472)
# category: Bakery.Revit.Elements.Parts
# can be extended to handle multiple links

partList = Input(partList : var[]..[])
get_linkelementids_from_parts = Custom[Get LinkElementIds from Parts](partList=partList)
allParents = Output(get_linkelementids_from_parts.allParents)
get_link_instance_and_element = Custom[Get Link Instance and Element Ids from LinkElementId Object](LinkElementIds=get_linkelementids_from_parts.firstParentLinkElementId)
LinkInstanceIds = Output(get_link_instance_and_element.LinkInstanceIds)
code_block = CodeBlock { "No Parent found"; }
searchLinkNamesFor = Input()
get_link_document_from_link_name = Custom[Get Link Document from Link Name](searchFor=searchLinkNamesFor)
get_linked_elements_by_id_and = Custom[Get Linked Elements by Id and Doc](elementIdList=get_link_instance_and_element.LinkedElementIds, oneLinkDoc=get_link_document_from_link_name)
watch = Watch(get_linked_elements_by_id_and.foundElements)
current_document = Custom[Current Document]()  # Retrieves Current Document
get_linked_elements_by_id_and_2 = Custom[Get Linked Elements by Id and Doc](elementIdList=get_link_instance_and_element.HostElementIds, oneLinkDoc=current_document)
watch_2 = Watch(get_linked_elements_by_id_and_2.foundElements)
two_lists_into_one_replacing = Custom[Two Lists into One Replacing Nulls with Backup Values](primary_list_to_clean=watch, backup_list_used_for_null_replacement=watch_2)
watch_3 = Watch(two_lists_into_one_replacing)
bv_replace_nulls = Custom[bv Replace Nulls](replacement=code_block, seq=watch_3)
parentList = Output(bv_replace_nulls)
