# Dynamo custom node Get Points from MEP Element List.dyf (Dynamo 0.8.2.2371)
# category: Bakery.Revit.API.MEP
# works for flex ducts

elementsIn = Input()
turnIntoList = Custom[TurnIntoList](elementsIn)  # Turns an element (or a nested list) into a flat list
python_script = Python(IN[0]=turnIntoList)
# ---------- python_script.python (49 lines) ----------
import clr
import sys
clr.AddReference('ProtoGeometry')
from Autodesk.DesignScript.Geometry import *

pyt_path = r'C:\Program Files (x86)\IronPython 2.7\Lib'
sys.path.append(pyt_path)

# Import Element wrapper extension methods
clr.AddReference("RevitNodes")
import Revit
clr.ImportExtensions(Revit.Elements)

# Import DocumentManager and TransactionManager
clr.AddReference("RevitServices")
import RevitServices
from RevitServices.Persistence import DocumentManager
from RevitServices.Transactions import TransactionManager

doc = DocumentManager.Instance.CurrentDBDocument
uiapp = DocumentManager.Instance.CurrentUIApplication
app = uiapp.Application

# Import RevitAPI
clr.AddReference("RevitAPI")
import Autodesk
from Autodesk.Revit.DB import *
import System
flexElems = UnwrapElement(IN[0])
flexPoints, startTans, EndTans, diams = [], [], [], []
for f in flexElems:
	try:
		flexPoints.append(f.Points)
	except:
		flexPoints.append("point failure")
	try:
		startTans.append(f.StartTangent)
	except:
		startTans.append("start tangent failure")
	try:
		EndTans.append(f.EndTangent)
	except:
		EndTans.append("end tangent failure")
	try:
		diams.append(f.Diameter)
	except:
		diams.append("diameter failure")
#Assign your output to the OUT variable.
OUT = flexElems, flexPoints, startTans, EndTans, diams
# ----------------------------------------
code_block = CodeBlock { 0; }
getItemAtIndex = List.GetItemAtIndex(list=python_script, index=code_block)
elementsOut = Output(getItemAtIndex)
code_block_2 = CodeBlock { 1; }
getItemAtIndex_2 = List.GetItemAtIndex(list=python_script, index=code_block_2)
Point_data_from_Revit_API = Output(getItemAtIndex_2)
code_block_3 = CodeBlock { 1; }
scale_factor = Input()
code_block_4 = CodeBlock(x=code_block_3, y=scale_factor) { x/y; }
sublists_of_point_values_to = Custom[Sublists of Point Values to Sublists of Points](divide_by_this_for_scale=code_block_4, list_with_sublists=getItemAtIndex_2)
actual_Point_Geometry = Output(sublists_of_point_values_to)
code_block_5 = CodeBlock { 2; }
getItemAtIndex_3 = List.GetItemAtIndex(list=python_script, index=code_block_5)
Start_Tangents = Output(getItemAtIndex_3)
code_block_6 = CodeBlock { 3; }
getItemAtIndex_4 = List.GetItemAtIndex(list=python_script, index=code_block_6)
End_Tangents = Output(getItemAtIndex_4)
code_block_7 = CodeBlock { 4; }
getItemAtIndex_5 = List.GetItemAtIndex(list=python_script, index=code_block_7)
code_block_8 = CodeBlock(z=scale_factor, i=getItemAtIndex_5) { z*i; }
Diameters = Output(code_block_8)
