# Dynamo custom node Get Points of Interest Using Chainage.dyf (Dynamo 1.3.0.875)
# category: Bakery.Construction.Civil

X_list = Input()

# group: x
watch = Watch(X_list)

ChainageList = Input()
watch_2 = Watch(ChainageList)
start = Input()
watch_3 = Watch(start)
firstIndexOf = List.FirstIndexOf(list=watch_2, item=watch_3)
end = Input()
watch_4 = Watch(end)
firstIndexOf_2 = List.FirstIndexOf(list=watch_2, item=watch_4)
code_block = CodeBlock(p=firstIndexOf, z=firstIndexOf_2) { p..z; }
getItemAtIndex = List.GetItemAtIndex(list=watch, index=code_block)
watch_5 = Watch(getItemAtIndex)
Y_list = Input()
getItemAtIndex_2 = List.GetItemAtIndex(list=Y_list, index=code_block)
watch_6 = Watch(getItemAtIndex_2)
Z_list = Input()
getItemAtIndex_3 = List.GetItemAtIndex(list=Z_list, index=code_block)
watch_7 = Watch(getItemAtIndex_3)
create = List.Create(watch_5, watch_6, watch_7)
watch_8 = Watch(create)
create_2 = List.Create(watch_8)
convert_between_units = DynamoConvert(create_2, conversionMetric=Length, conversionFrom=Meters, conversionTo=Millimeters)
sublists_of_coordinates_to = Custom[Sublists of Coordinates to Points](big_list=convert_between_units)
PointList = Output(sublists_of_coordinates_to)
code_block_2 = CodeBlock { 0; }
get_sublist_and_make_curve = Custom[Get Sublist and Make Curve](list=sublists_of_coordinates_to, index=code_block_2)
NurbsCurve = Output(get_sublist_and_make_curve.NurbsCurve)  # "NurbsCurve_"
startIndex = Output(firstIndexOf)
endIndex = Output(firstIndexOf_2)
