# Dynamo custom node Get Revit Link File Path Information.dyf (Dynamo 0.8.2.2371)
# category: Bakery.Revit.Document.Links
# for current doc

get_external_file_references_and = Custom[Get External File References and Details]()  # including date modified
flat_list_to_list_of_strings = Custom[Flat List to List of Strings](Original_List=get_external_file_references_and.referenceType)  # using python methods
code_block = CodeBlock { "RevitLink"; }
eq = flat_list_to_list_of_strings == code_block
filterByBoolMask = List.FilterByBoolMask(list=get_external_file_references_and.path_as_human_readable, mask=eq)
PathToFile = Output(filterByBoolMask.in)
filterByBoolMask_2 = List.FilterByBoolMask(list=get_external_file_references_and.PathTypes, mask=eq)
PathType = Output(filterByBoolMask_2.in)
