# Dynamo custom node Get Revit Link Names from an Element List.dyf (Dynamo 1.2.1.3083)
# category: Bakery.Revit.Document.Links

ElementList = Input()

# group: all elements in active view
watch = Watch(ElementList)

category = Custom[Element.Category](element=watch)  # This node will get the input element(s)' categories
code_block = CodeBlock { "RVT Links"; }
eq = category == code_block
filterByBoolMask = List.FilterByBoolMask(list=watch, mask=eq)
name = Element.Name(filterByBoolMask.in)
get_pure_filename_from_revit = Custom[Get Pure Filename from Revit Link Name String](LinkNames=name)
RevitLinkNames = Output(get_pure_filename_from_revit)
