# Dynamo custom node Get Sheet Element from View.dyf (Dynamo 0.9.2.4472)
# category: Bakery.Revit.Views

views = Input()
code_block = CodeBlock { "Sheet Number"; }
getParameterValueByName = Element.GetParameterValueByName(element=views, parameterName=code_block)
code_block_2 = CodeBlock { false; }
bv_collector_for_sheets = Custom[bv Collector for Sheets](NameOrNumber=code_block_2)  # forked from spring nodes
map = List.Map(list=getParameterValueByName, f_x=bv_collector_for_sheets.exact_match)
flatten = Flatten(map)
long_list = Output(flatten)
sheet_numbers = Output(getParameterValueByName)
string = StringInput("---")
eq = string == getParameterValueByName
filterByBoolMask = List.FilterByBoolMask(list=views, mask=eq)
views_on_sheets = Output(filterByBoolMask.out)
filterByBoolMask_2 = List.FilterByBoolMask(list=flatten, mask=eq)
sheet_elements = Output(filterByBoolMask_2.out)
