# Dynamo custom node Get Starting View Details.dyf (Dynamo 0.9.1.4062)
# category: Bakery.Revit.Views
# like name etc

python_script = Python()
# ---------- python_script.python (34 lines) ----------
#LSJ

import clr
clr.AddReference('ProtoGeometry')
from Autodesk.DesignScript.Geometry import *

# Import DocumentManager
clr.AddReference("RevitServices")
import RevitServices
from RevitServices.Persistence import DocumentManager

# Import RevitAPI
clr.AddReference("RevitAPI")
import Autodesk

# Import ToDSType(bool) extension method
clr.AddReference("RevitNodes")
import Revit
from Autodesk.Revit.DB import *
clr.ImportExtensions(Revit.Elements)

import System

#The inputs to this node will be stored as a list in the IN variable.
#doc = DocumentManager.Instance.CurrentDBDocument
uiapp = DocumentManager.Instance.CurrentUIApplication
app = uiapp.Application
doc = DocumentManager.Instance.CurrentDBDocument

#create workset collector
#userCategories = doc.Settings.Categories

strtview = doc.StartingViewSettings.GetStartingViewSettings()
OUT = strtview
# ----------------------------------------
param = Output(python_script)
