# Dynamo custom node Get Transform CoordinateSystem from Link Instance.dyf (Dynamo 1.1.0.2094)
# category: Bakery.Revit.Document.Links

linkInstance = Input()
python_script = Python(IN[0]=linkInstance)
# ---------- python_script.python (40 lines) ----------
#Copyright(c) 2016, Dimitar Venkov
# @5devene, dimitar.ven@gmail.com
#original design by Julien Benoit, @jbenoit44
# http://aecuandme.wordpress.com/

import clr
clr.AddReference('ProtoGeometry')
from Autodesk.DesignScript.Geometry import *

clr.AddReference("RevitNodes")
import Revit
clr.ImportExtensions(Revit.Elements)
clr.ImportExtensions(Revit.GeometryConversion)

clr.AddReference("RevitAPI")
import Autodesk
from Autodesk.Revit.DB import FilteredElementCollector, ElementCategoryFilter, XYZ

def tolist(obj1):
	if hasattr(obj1,"__iter__"): return obj1
	else: return [obj1]
def output1(l1):
	if len(l1) == 1: return l1[0]
	else: return l1

Link1 = UnwrapElement(tolist(IN[0]))
#Cat1 = UnwrapElement(IN[1])
elements, transforms, revittf = [], [], []

for i in xrange(len(Link1)):
	LinkDoc = Link1[i].GetLinkDocument()
#	fec = FilteredElementCollector(LinkDoc).OfCategoryId(Cat1.Id).WhereElementIsNotElementType()
#	fec1 = [e.ToDSType(True) for e in fec]
#	elements.append(fec1)
	tf1 = Link1[i].GetTransform()
	revittf.append(tf1)
	cs1 = CoordinateSystem.ByOriginVectors(tf1.Origin.ToPoint(True),
	tf1.BasisX.ToVector(True), tf1.BasisY.ToVector(True), tf1.BasisZ.ToVector(True))
	transforms.append(cs1)
OUT = output1(transforms), output1(revittf)
# ----------------------------------------
code_block = CodeBlock { 0; }
getItemAtIndex = List.GetItemAtIndex(list=python_script, index=code_block)
transformCS = Output(getItemAtIndex)
code_block_2 = CodeBlock { 1; }
getItemAtIndex_2 = List.GetItemAtIndex(list=python_script, index=code_block_2)
revitTransform = Output(getItemAtIndex_2)
