# Dynamo custom node Get Transform Properties from Revit Transform Object.dyf (Dynamo 1.0.0.1180)
# category: Bakery.Revit.Elements.Properties

revitTransformObjects = Input()
turnIntoList = Custom[TurnIntoList](unknownItem=revitTransformObjects)  # Turns an element (or a nested list) into a flat list
python_script = Python(IN[0]=turnIntoList)
# ---------- python_script.python (56 lines) ----------
#By Luke Johnson for Bakery
import clr
clr.AddReference('ProtoGeometry')
from Autodesk.DesignScript.Geometry import *

# Import ToDSType(bool) extension method
clr.AddReference("RevitNodes")
import Revit
clr.ImportExtensions(Revit.Elements)

# Import DocumentManager and TransactionManager
clr.AddReference("RevitServices")
import RevitServices
from RevitServices.Persistence import DocumentManager
from RevitServices.Transactions import TransactionManager


from System.Collections.Generic import *

# Import RevitAPI
clr.AddReference("RevitAPI")
import Autodesk

doc = DocumentManager.Instance.CurrentDBDocument
uiapp = DocumentManager.Instance.CurrentUIApplication
app = uiapp.Application

#The inputs to this node will be stored as a list in the IN variable.
PCtransforms = UnwrapElement(IN[0])
transformBasisY = []
transformOrigin = []
transformScale = []
transformBasisX = []
transformBasisZ = []
transformIsTran = []
vectTranX = []
vectTranY = []
vectTranZ = []
determinants = []
isconformals = []
hasreflections = []
for y in PCtransforms:
	transformBasisY.append(y.BasisY)
	transformOrigin.append(y.Origin)
	transformScale.append(y.Scale)
	transformBasisX.append(y.BasisX)
	transformBasisZ.append(y.BasisZ)
	transformIsTran.append(y.IsTranslation)
	vectTranX.append(y.OfVector(y.BasisX))
	vectTranY.append(y.OfVector(y.BasisY))
	vectTranZ.append(y.OfVector(y.BasisZ))
	determinants.append(y.Determinant)
	isconformals.append(y.IsConformal)
	hasreflections.append(y.HasReflection)
#Assign your output to the OUT variable
OUT = PCtransforms, transformOrigin, transformScale, transformBasisX, transformBasisY, transformBasisZ, transformIsTran, vectTranX, vectTranY, vectTranZ, determinants, isconformals, hasreflections
# ----------------------------------------
code_block = CodeBlock { 0; }
getItemAtIndex = List.GetItemAtIndex(list=python_script, index=code_block)
transforms = Output(getItemAtIndex)
code_block_2 = CodeBlock { 1; }
getItemAtIndex_2 = List.GetItemAtIndex(list=python_script, index=code_block_2)
origin = Output(getItemAtIndex_2)
code_block_3 = CodeBlock { 2; }
getItemAtIndex_3 = List.GetItemAtIndex(list=python_script, index=code_block_3)
scale = Output(getItemAtIndex_3)
code_block_4 = CodeBlock { 3; }
getItemAtIndex_4 = List.GetItemAtIndex(list=python_script, index=code_block_4)
basisX = Output(getItemAtIndex_4)
code_block_5 = CodeBlock { 4; }
getItemAtIndex_5 = List.GetItemAtIndex(list=python_script, index=code_block_5)
basisY = Output(getItemAtIndex_5)
code_block_6 = CodeBlock { 5; }
getItemAtIndex_6 = List.GetItemAtIndex(list=python_script, index=code_block_6)
basisZ = Output(getItemAtIndex_6)
code_block_7 = CodeBlock { 6; }
getItemAtIndex_7 = List.GetItemAtIndex(list=python_script, index=code_block_7)
isTransform = Output(getItemAtIndex_7)  # "isTransform?"
code_block_8 = CodeBlock { 7; }
getItemAtIndex_8 = List.GetItemAtIndex(list=python_script, index=code_block_8)
vectorX = Output(getItemAtIndex_8)
code_block_9 = CodeBlock { 8; }
getItemAtIndex_9 = List.GetItemAtIndex(list=python_script, index=code_block_9)
vectorY = Output(getItemAtIndex_9)
code_block_10 = CodeBlock { 9; }
getItemAtIndex_10 = List.GetItemAtIndex(list=python_script, index=code_block_10)
vectorZ = Output(getItemAtIndex_10)
code_block_11 = CodeBlock { 10; }
getItemAtIndex_11 = List.GetItemAtIndex(list=python_script, index=code_block_11)
determinants = Output(getItemAtIndex_11)
code_block_12 = CodeBlock { 11; }
getItemAtIndex_12 = List.GetItemAtIndex(list=python_script, index=code_block_12)
IsConformal = Output(getItemAtIndex_12)  # "IsConformal?"
code_block_13 = CodeBlock { 12; }
getItemAtIndex_13 = List.GetItemAtIndex(list=python_script, index=code_block_13)
HasReflection = Output(getItemAtIndex_13)  # "HasReflection?"
