# Dynamo custom node Get Transform Properties of Elements.dyf (Dynamo 1.0.0.1180)
# category: Bakery.Revit.Elements.Properties

# group: vect tran at basisZ
elementsIn = Input()
python_script = Python(IN[0]=elementsIn)
# ---------- python_script.python (55 lines) ----------
#Created by DPS Design, dpsdesign.org
import clr
clr.AddReference('ProtoGeometry')
from Autodesk.DesignScript.Geometry import *

# Import ToDSType(bool) extension method
clr.AddReference("RevitNodes")
import Revit
clr.ImportExtensions(Revit.Elements)

# Import DocumentManager and TransactionManager
clr.AddReference("RevitServices")
import RevitServices
from RevitServices.Persistence import DocumentManager
from RevitServices.Transactions import TransactionManager


from System.Collections.Generic import *

# Import RevitAPI
clr.AddReference("RevitAPI")
import Autodesk

doc = DocumentManager.Instance.CurrentDBDocument
uiapp = DocumentManager.Instance.CurrentUIApplication
app = uiapp.Application

#The inputs to this node will be stored as a list in the IN variable.
PointCloudInstanceElements = UnwrapElement(IN[0])
PCtransforms = []
PClocations = []
for x in PointCloudInstanceElements:
	PCtransforms.append(x.GetTotalTransform())
	PClocations.append(x.Location)
transformBasisY = []
transformOrigin = []
transformScale = []
transformBasisX = []
transformBasisZ = []
transformIsTran = []
vectTranX = []
vectTranY = []
vectTranZ = []
for y in PCtransforms:
	transformBasisY.append(y.BasisY)
	transformOrigin.append(y.Origin)
	transformScale.append(y.Scale)
	transformBasisX.append(y.BasisX)
	transformBasisZ.append(y.BasisZ)
	transformIsTran.append(y.IsTranslation)
	vectTranX.append(y.OfVector(y.BasisX))
	vectTranY.append(y.OfVector(y.BasisY))
	vectTranZ.append(y.OfVector(y.BasisZ))
#Assign your output to the OUT variable
OUT = PCtransforms, transformOrigin, transformScale, PClocations, transformBasisX, transformBasisY, transformBasisZ, transformIsTran, vectTranX, vectTranY, vectTranZ
# ----------------------------------------
code_block = CodeBlock { 8; }
getItemAtIndex = List.GetItemAtIndex(list=python_script, index=code_block)
vectorBasisX = Output(getItemAtIndex)
code_block_2 = CodeBlock { 9; }
getItemAtIndex_2 = List.GetItemAtIndex(list=python_script, index=code_block_2)
vectorBasisY = Output(getItemAtIndex_2)
code_block_3 = CodeBlock { 10; }
getItemAtIndex_3 = List.GetItemAtIndex(list=python_script, index=code_block_3)
watch = Watch(getItemAtIndex_3)
vectorBasisZ = Output(watch)
code_block_4 = CodeBlock { 0; }
getItemAtIndex_4 = List.GetItemAtIndex(list=python_script, index=code_block_4)
revitTransforms = Output(getItemAtIndex_4)
code_block_5 = CodeBlock { 1; }
getItemAtIndex_5 = List.GetItemAtIndex(list=python_script, index=code_block_5)
transformOrigins = Output(getItemAtIndex_5)
code_block_6 = CodeBlock { 2; }
getItemAtIndex_6 = List.GetItemAtIndex(list=python_script, index=code_block_6)
transformScales = Output(getItemAtIndex_6)
code_block_7 = CodeBlock { 3; }
getItemAtIndex_7 = List.GetItemAtIndex(list=python_script, index=code_block_7)
transformLocations = Output(getItemAtIndex_7)
code_block_8 = CodeBlock { 4; }
getItemAtIndex_8 = List.GetItemAtIndex(list=python_script, index=code_block_8)
transformBasisX = Output(getItemAtIndex_8)
code_block_9 = CodeBlock { 5; }
getItemAtIndex_9 = List.GetItemAtIndex(list=python_script, index=code_block_9)
transformBasisY = Output(getItemAtIndex_9)
code_block_10 = CodeBlock { 6; }
getItemAtIndex_10 = List.GetItemAtIndex(list=python_script, index=code_block_10)
transformBasisZ = Output(getItemAtIndex_10)
code_block_11 = CodeBlock { 7; }
getItemAtIndex_11 = List.GetItemAtIndex(list=python_script, index=code_block_11)
IsTranslation = Output(getItemAtIndex_11)  # "IsTranslation?"
