# Dynamo custom node Get Type Element by Category and Type Name.dyf (Dynamo 1.2.0.2690)
# category: Bakery.Revit.Elements.Family

get_type_list_for_this_project = Custom[Get Type List for this project]()
create = List.Create(get_type_list_for_this_project.FamilySymbols, get_type_list_for_this_project.System_Types)
flatten = Flatten(create)
bv_get_category_name = Custom[bv Get Category Name](Elements=flatten)  # forked from Blackbox
categoryNameString = Input()
filter_one_list_by_string_search = Custom[Filter One List by String Search in Another List](SearchThisList=bv_get_category_name, searchFor=categoryNameString, FilterThisList=flatten)
element_name_universal = Custom[Element Name Universal](Elements=filter_one_list_by_string_search.Matching)  # Modified for 0.8.1
typeNameString = Input()
allIndicesOf = List.AllIndicesOf(list=element_name_universal, item=typeNameString)
firstItem = List.FirstItem(allIndicesOf)
getItemAtIndex = List.GetItemAtIndex(list=filter_one_list_by_string_search.Matching, index=firstItem)
item = Output(getItemAtIndex)
