# Dynamo custom node Get Type Parameter for Tagged Linked Element.dyf (Dynamo 0.8.2.2371)
# category: Bakery.Revit.Elements.Tag
# and show empty tags

linkTagElement = Input()
code_block = CodeBlock { 0; }
create = List.Create(code_block)
linkedElementList = Input()
watch = Watch(linkedElementList)
count = Count(watch)
code_block_2 = CodeBlock(x=count) { 0..(x-1); }
docList = Input(docList : var[]..[])
element_type_for_linked_file = Custom[Element Type for Linked File Large Lists](elementList=watch, docList=docList)
map = List.Map(list=code_block_2, f_x=element_type_for_linked_file)
flatten = Flatten(map)
watch_2 = Watch(flatten)
parameterName = Input(parameterName : string)
getParameterValueByName = Element.GetParameterValueByName(element=watch_2, parameterName=parameterName)
length = String.Length(getParameterValueByName)
bv_if_equal_return_index = Custom[bv If Equal Return Index](listA=create, listB=length)  # forked
watch_3 = Watch(bv_if_equal_return_index)
getItemAtIndex = List.GetItemAtIndex(list=linkTagElement, index=watch_3)
emptyTagElement = Output(getItemAtIndex)
get_linked_rvt_documents = Custom[Get Linked RVT Documents]()
getItemAtIndex_2 = List.GetItemAtIndex(list=docList, index=watch_3)
watch_4 = Watch(getItemAtIndex_2)
bv_if_equal_return_index_2 = Custom[bv If Equal Return Index](listA=watch_4, listB=get_linked_rvt_documents.Link_Doc)
getItemAtIndex_3 = List.GetItemAtIndex(list=get_linked_rvt_documents.Link_Name, index=bv_if_equal_return_index_2)
referencingThisLink = Output(getItemAtIndex_3)
getItemAtIndex_4 = List.GetItemAtIndex(list=watch, index=watch_3)
emptyLinkedElement = Output(getItemAtIndex_4)
getItemAtIndex_5 = List.GetItemAtIndex(list=watch_2, index=watch_3)
emptyLinkedElementType = Output(getItemAtIndex_5)
id = Element.Id(getItemAtIndex_4)
emptyLinkedElementId = Output(id)
paramValues = Output(getParameterValueByName)
