# Dynamo custom node Get View Discipline Name by Code.dyf (Dynamo 1.2.0.2690)
# category: Bakery.Revit.Views

enumerate_view_discipline = Custom[Enumerate View Discipline]()
ViewDisciplineCode = Input()
turnIntoList = Custom[TurnIntoList](unknownItem=ViewDisciplineCode)  # Turns an element (or a nested list) into a flat list
flat_list_to_list_of_strings = Custom[Flat List to List of Strings](Original_List=turnIntoList)  # using python methods
flat_list_to_list_of_strings_2 = Custom[Flat List to List of Strings](Original_List=enumerate_view_discipline.HashCodes)
if_equal_return_index_using = Custom[If Equal Return Index using IndexOf](searchForThese=flat_list_to_list_of_strings, inThisList=flat_list_to_list_of_strings_2)
getItemAtIndex = List.GetItemAtIndex(list=enumerate_view_discipline.ViewDiscipline, index=if_equal_return_index_using)
item = Output(getItemAtIndex)
