# Dynamo custom node Get View Template for View.dyf (Dynamo 0.8.2.2392)
# category: Bakery.Revit.Views
# doesn't really work

element_types = ElementTypes("ViewPlan")
all_elements_of_type = ElementsOfType(element_types)
viewIn = Input()
code_block = CodeBlock { "View Template"; }
bruteforce_get_parameter_values = Custom[Bruteforce Get Parameter Values when Multiple Entries](element=viewIn, parameterName=code_block)
watch = Watch(bruteforce_get_parameter_values.ValueAsStr)
element_name_universal = Custom[Element Name Universal](Element_s=all_elements_of_type)  # Modified for 0.8.1
bv_if_equal_return_index = Custom[bv If Equal Return Index](listA=watch, listB=element_name_universal)  # forked
getItemAtIndex = List.GetItemAtIndex(list=all_elements_of_type, index=bv_if_equal_return_index)
viewTemplate = Output(getItemAtIndex)
