# Dynamo custom node Get XYZ Values by String Name from Lists.dyf (Dynamo 1.2.0.2831)
# category: Bakery.Construction.Civil

dataList = Input()
watch = Watch(dataList)
headingList = Input()
stringName = Input()
firstIndexOf = List.FirstIndexOf(list=headingList, item=stringName)
getItemAtIndex = List.GetItemAtIndex(list=watch, index=firstIndexOf)
Xvalues = Output(getItemAtIndex)
code_block = CodeBlock(N=firstIndexOf) { N+1; }
getItemAtIndex_2 = List.GetItemAtIndex(list=watch, index=code_block)
Yvalues = Output(getItemAtIndex_2)
code_block_2 = CodeBlock(N=code_block) { N+1; }
getItemAtIndex_3 = List.GetItemAtIndex(list=watch, index=code_block_2)
Zvalues = Output(getItemAtIndex_3)
