# Dynamo custom node GetElementsContaining-LSJ.dyf "GetElementsContaining" (Dynamo 1.2.0.2690)
# category: Bakery.Revit.Elements
# This node search the selected element type for a inputvalue(string) and returns a list of the elements containing the given input.

Element_Types = Input()
all_elements_of_type = ElementsOfType(Element_Types)
toString = ToString()  # unwired: arg0
map = List.Map(list=all_elements_of_type, f_x=toString)
Search_for_Case_ignored = Input()  # "Search for (Case ignored)"
boolean = BoolSelector(true)
contains = String.Contains(searchFor=Search_for_Case_ignored, ignoreCase=boolean)  # unwired: str
map_2 = List.Map(list=map, f_x=contains)
filterByBoolMask = List.FilterByBoolMask(list=all_elements_of_type, mask=map_2)
list = Output(filterByBoolMask.in)
