# Dynamo custom node ImageSettings Fit Direction Type.dyf (Dynamo 0.8.1.1942)
# category: Bakery.Revit.Image

python_script = Python()
# ---------- python_script.python (21 lines) ----------
#Copyright(c) 2015, Konrad Sobon
# @arch_laboratory, http://archi-lab.net

import clr
clr.AddReference('ProtoGeometry')
from Autodesk.DesignScript.Geometry import *

# Import DocumentManager and TransactionManager
clr.AddReference("RevitServices")
import RevitServices
from RevitServices.Persistence import DocumentManager
from RevitServices.Transactions import TransactionManager

# Import RevitAPI
clr.AddReference("RevitAPI")
import Autodesk
from Autodesk.Revit.DB import *
import System

#Assign your output to the OUT variable
OUT = System.Enum.GetValues(FitDirectionType)
# ----------------------------------------
