# Dynamo custom node Indexes of Duplicate Items.dyf (Dynamo 1.3.4.6666)
# category: Bakery.Core.List
# lists the indexes of any item that has a duplicate or multiple occurrence in a list (pythonic)

list = Input()
python_script = Python(IN[0]=list)
# ---------- python_script.python (24 lines) ----------
import clr
clr.AddReference('ProtoGeometry')
from Autodesk.DesignScript.Geometry import *
#The inputs to this node will be stored as a list in the IN variables.
listWithDups = IN[0]
def list_duplicates(seq):
    seen = set()
    seen_add = seen.add
    return [idx for idx,item in enumerate(seq) if item in seen or seen_add(item)]

latterdups = list_duplicates(listWithDups)
dupvals = []
for z in latterdups:
	dupvals.append(listWithDups[z])
	
unqdupvals=set(dupvals)
firstones = []
for i in unqdupvals:
	firstones.append(listWithDups.index(i))

allduplicated = firstones + latterdups

#Assign your output to the OUT variable.
OUT = allduplicated
# ----------------------------------------
indexesWhenMultiple = Output(python_script)
