# Dynamo custom node InitialiseNewSP.dyf (Dynamo 2.12.1.8246)
# category: Bakery.Revit.Parameters

listParamNames = Input(listParamNames: var[]..[])
listElems = Input(listElems: var)
counter = Input(counter: int)
getItemAtIndex = List.GetItemAtIndex(list=listElems, index=counter)
defaultValue = Input(defaultValue: var)
setParameterByName = Element.SetParameterByName(element=getItemAtIndex, value=defaultValue)  # unwired: parameterName
map = List.Map(list=listParamNames, function=setParameterByName)
list = Output(map)
