# Dynamo custom node Inplace Family Check Faster.dyf (Dynamo 0.8.1.1942)
# category: Bakery.Revit.Elements.Family

List_of_Elements = Input()
flatten = Flatten(List_of_Elements)
is_family_instance_inplace = Custom[Is Family Instance InPlace](oneInstance=flatten)  # takes FamilyInstance, returns bool
create = List.Create(is_family_instance_inplace)
flatten_2 = Flatten(create)
anyTrue = Custom[List.AnyTrue](seq=flatten_2)  # Returns true if any item in a list of booleans is true.
Any_Inplace_families = Output(anyTrue)  # "Any Inplace families?"
