# Dynamo custom node Iterate through BCF files and Get Combined List.dyf (Dynamo 0.8.2.2392)
# category: Bakery.BIM.BCF

file_list = Input()
watch = Watch(file_list)
count = Count(watch)
code_block = CodeBlock(x=count) { 0..(x-1)..2; }
subnode_to_iterate_unzipped_bcf = Custom[subnode to Iterate unzipped BCF structure for information](list=watch)
map = List.Map(list=code_block, f_x=subnode_to_iterate_unzipped_bcf)
sublist_per_issue = Output(map)
