# Dynamo custom node Iterate through XML ElementTree.dyf (Dynamo 0.8.2.2371)
# category: Bakery.Data.XML

ElementTree = Input()
python_script = Python(IN[0]=ElementTree)
# ---------- python_script.python (16 lines) ----------
import clr
import sys
clr.AddReference('ProtoGeometry')
from Autodesk.DesignScript.Geometry import *
sys.path.append("C:\Program Files (x86)\IronPython 2.7\Lib")
#from xml.parsers.expat import expat -- can't find this
import xml.etree.ElementTree as ET
#The inputs to this node will be stored as a list in the IN variables.
xmTree = IN[0]

#xmParsed = xmTree.parse(xmlFile)
#root = xmTree.getroot()
iterelemlist = []
for elem in xmTree.iter():
	iterelemlist.append(elem)
OUT = iterelemlist
# ----------------------------------------
xml_elements = Output(python_script)
