# Dynamo custom node Join Two single Strings to One single String.dyf (Dynamo 0.8.0.950)
# category: Bakery.Core.String
# use with list.map

separator = Input()
stringA = Input()
stringB = Input()
join = String.Join(separator, stringA, stringB)
joinedString = Output(join)
