# Dynamo custom node LastItem Pythonic.dyf (Dynamo 1.2.1.3083)
# category: Bakery.Core.List

listOfLists = Input()
python_script = Python(IN[0]=listOfLists)
# ---------- python_script.python (12 lines) ----------
import clr
clr.AddReference('ProtoGeometry')
from Autodesk.DesignScript.Geometry import *
#The inputs to this node will be stored as a list in the IN variables.
dataEnteringNode = IN[0]
takeitems = []
for x in dataEnteringNode:
	lastitem=len(x)-1
	takeitems.append(x[lastitem])

#Assign your output to the OUT variable.
OUT = takeitems
# ----------------------------------------
lastitems = Output(python_script)
