# Dynamo custom node Linear Search List with Shift Indices and Count Summary.dyf (Dynamo 0.8.2.2371)
# category: Bakery.Core.List

in_this_list = Input()
watch = Watch(in_this_list)
find_this = Input()
bv_all_indices_of_that_can = Custom[bv All Indices Of that can handle Nulls](list=watch, value=find_this)  # forked from spring nodes
shift_indices = Input()
code_block = CodeBlock(x=bv_all_indices_of_that_can, y=shift_indices) { x+y; }
add = bv_all_indices_of_that_can + shift_indices  # lacing=Longest
getItemAtIndex = List.GetItemAtIndex(list=watch, index=add)
items = Output(getItemAtIndex)
uniqueItems = List.UniqueItems(getItemAtIndex)
unique_values = Output(uniqueItems)
count = Count(uniqueItems)
code_block_2 = CodeBlock(x=count) { 0..(x-1); }
subnode_for_filtering_lists_by = Custom[subnode for Filtering Lists by List](main_list=getItemAtIndex, uniques=uniqueItems)
map = List.Map(list=code_block_2, f_x=subnode_for_filtering_lists_by)
watch_2 = Watch(map)
count_2 = Count()
map_2 = List.Map(list=watch_2, f_x=count_2)
counts = Output(map_2)
