# Dynamo custom node Linked Filled Region Boundaries to Curves.dyf (Dynamo 0.9.2.4472)
# category: Bakery.Revit.Document.Links

linkDocumentName_string = Input()
string = StringInput("Detail Items")
string_2 = StringInput("FilledRegionType")
viewNameInLink = Input(viewNameInLink : var[]..[])
get_view_dependent_elements_from = Custom[Get View Dependent Elements from Linked Document](linkDocumentName_string=linkDocumentName_string, categoryName=string, typeName=string_2, viewNameInLink=viewNameInLink)
watch = Watch(get_view_dependent_elements_from)
filled_region_boundary_curves = Custom[Filled Region Boundary Curves](Filled_Region=watch)  # This node will get the boundary curves for a filled region.
flatten = Flatten(filled_region_boundary_curves)
curves = Output(flatten)
