# Dynamo custom node Links and Imports in View or Model.dyf (Dynamo 1.3.0.875)
# category: Bakery.Revit.Document.Imports
# separates into view based and model based dwgs or imports

linksAndImports = Custom[Document.LinksAndImports]()  # Gets all linked and imported files in the document. NOTE: Does *not* retrieve linked Revit files.
create = List.Create(linksAndImports.links, linksAndImports.imports)
flatten = Flatten(create)
element_name_universal = Custom[Element.Name (Universal)](element=flatten)  # Gets an element's name (Dynamo's built-in Name nodes don't work for all element types, e.g. worksets...)
ownerView = Custom[Element.OwnerView](element=flatten)  # Gets the owner view of a given Revit element (if possible)
watch = Watch(ownerView)
flat_list_to_list_of_strings = Custom[Flat List to List of Strings](Original_List=watch)  # using python methods
length = String.Length(flat_list_to_list_of_strings)
code_block = CodeBlock { 2; }
eq = length == code_block
filterByBoolMask = List.FilterByBoolMask(list=flatten, mask=eq)
modelBasedImports = Output(filterByBoolMask.in)
viewBasedImports = Output(filterByBoolMask.out)
string = StringInput("Name")
getParameterValueByName = Element.GetParameterValueByName(element=filterByBoolMask.in, parameterName=string)
modelBasedImportNames = Output(getParameterValueByName)
string_2 = StringInput("Name")
getParameterValueByName_2 = Element.GetParameterValueByName(element=filterByBoolMask.out, parameterName=string_2)
viewBasedImportNames = Output(getParameterValueByName_2)
