# Dynamo custom node List Detailed View Information for a List of Views.dyf (Dynamo 0.8.2.2371)
# category: Bakery.Revit.Views

listofViews = Input()
turn_into_list = Custom[Turn Into List](item=listofViews)  # Turns an element into a list
list_view_filter_information_for = Custom[List View Filter Information for View or Template]()  # use with List.Map
map = List.Map(list=turn_into_list, f_x=list_view_filter_information_for)
watch = Watch(map)
code_block = CodeBlock { 0; }
getItemAtIndex = List.GetItemAtIndex(index=code_block, lacing=Longest)
map_2 = List.Map(list=watch, f_x=getItemAtIndex)
ViewNames = Output(map_2)
code_block_2 = CodeBlock { 1; }
getItemAtIndex_2 = List.GetItemAtIndex(index=code_block_2, lacing=Longest)
map_3 = List.Map(list=watch, f_x=getItemAtIndex_2)
AreViewFiltersApplied = Output(map_3)  # "AreViewFiltersApplied?"
code_block_3 = CodeBlock { 2; }
getItemAtIndex_3 = List.GetItemAtIndex(index=code_block_3, lacing=Longest)
map_4 = List.Map(list=watch, f_x=getItemAtIndex_3)
ViewFiltersApplied = Output(map_4)
code_block_4 = CodeBlock { 3; }
getItemAtIndex_4 = List.GetItemAtIndex(index=code_block_4, lacing=Longest)
map_5 = List.Map(list=watch, f_x=getItemAtIndex_4)
ViewFilterIds = Output(map_5)
code_block_5 = CodeBlock { 4; }
getItemAtIndex_5 = List.GetItemAtIndex(index=code_block_5, lacing=Longest)
map_6 = List.Map(list=watch, f_x=getItemAtIndex_5)
FilterEntities = Output(map_6)
code_block_6 = CodeBlock { 5; }
getItemAtIndex_6 = List.GetItemAtIndex(index=code_block_6, lacing=Longest)
map_7 = List.Map(list=watch, f_x=getItemAtIndex_6)
AreFiltersHidden = Output(map_7)
code_block_7 = CodeBlock { 6; }
getItemAtIndex_7 = List.GetItemAtIndex(index=code_block_7, lacing=Longest)
map_8 = List.Map(list=watch, f_x=getItemAtIndex_7)
FilterOverrideElements = Output(map_8)
