# Dynamo custom node List Duct and Pipe Related Elements.dyf (Dynamo 0.8.1.1942)
# category: Bakery.Revit.Elements.Systems

list_of_duct_and_pipe_categories = Custom[List of Duct and Pipe Categories as Built in names]()  # can be fed into "Select based on a single builtin name" node
select_based_on_a_single_builtin = Custom[Select based on a single builtin name]()  # asdf
map = List.Map(list=list_of_duct_and_pipe_categories, f_x=select_based_on_a_single_builtin)
flatten = Flatten(map)
count = List.Count(flatten)
count_2 = Output(count)  # "count"
elements = Output(flatten)
