# Dynamo custom node List Parameter Info with Shared Parameter GUIDs.dyf (Dynamo 0.8.2.2392)
# category: Bakery.Revit.Parameters
# works for Element list or Type list

ElementOrTypeList = Input()
defs = Python(IN[0]=ElementOrTypeList)
# ---------- defs.python (30 lines) ----------
import clr
# Import RevitAPI
clr.AddReference("RevitAPI")
import Autodesk
from Autodesk.Revit.DB import *
# Import DocumentManager and TransactionManager
clr.AddReference("RevitServices")
import RevitServices
from RevitServices.Persistence import DocumentManager
from RevitServices.Transactions import TransactionManager
# Import ToDSType(bool) extension method
clr.AddReference("RevitNodes")
import Revit
clr.ImportExtensions(Revit.Elements)
doc =  DocumentManager.Instance.CurrentDBDocument
app =  DocumentManager.Instance.CurrentUIApplication.Application

#The input to this node will be stored in the IN[0] variable.
elementz = IN[0]
        
elements = []
for e in elementz:
    elements.append(UnwrapElement(e))
    
paramD = []
for item in elements:
	paramD.append(item.Parameters)
    
#Assign your output to the OUT variable
OUT = paramD
# ----------------------------------------
flatten = Flatten(defs)
ParameterDefs = Output(flatten)
getParams = Python(IN[0]=ElementOrTypeList)
# ---------- getParams.python (37 lines) ----------
import clr
# Import RevitAPI
clr.AddReference("RevitAPI")
import Autodesk
from Autodesk.Revit.DB import *
# Import DocumentManager and TransactionManager
clr.AddReference("RevitServices")
import RevitServices
from RevitServices.Persistence import DocumentManager
from RevitServices.Transactions import TransactionManager
# Import ToDSType(bool) extension method
clr.AddReference("RevitNodes")
import Revit
from System import Guid
clr.ImportExtensions(Revit.Elements)
doc =  DocumentManager.Instance.CurrentDBDocument
app =  DocumentManager.Instance.CurrentUIApplication.Application

#The input to this node will be stored in the IN[0] variable.
elementz = IN[0]
        
elements = []
for e in elementz:
    elements.append(UnwrapElement(e))
    
paramShared = []
paramNames = []
paramGu = []
for item in elements:
    for x in item.Parameters:
   			paramShared.append(x.IsShared)
   			paramNames.append(x.Definition.Name)
   			if x.IsShared:
   				paramGu.append(x.GUID)

#Assign your output to the OUT variable
OUT = paramShared, paramNames, paramGu
# ----------------------------------------
code_block = CodeBlock { 2; }
getItemAtIndex = List.GetItemAtIndex(list=getParams, index=code_block)
SPGuids = Output(getItemAtIndex)
code_block_2 = CodeBlock { 1; }
getItemAtIndex_2 = List.GetItemAtIndex(list=getParams, index=code_block_2)
ParameterNames = Output(getItemAtIndex_2)
code_block_3 = CodeBlock { 0; }
getItemAtIndex_3 = List.GetItemAtIndex(list=getParams, index=code_block_3)
IsShared = Output(getItemAtIndex_3)
filterByBoolMask = List.FilterByBoolMask(list=getItemAtIndex_2, mask=getItemAtIndex_3)
SPNames = Output(filterByBoolMask.in)
bv_if_equal_return_index = Custom[bv If Equal Return Index](listA=filterByBoolMask.in, listB=getItemAtIndex_2)  # forked
getItemAtIndex_4 = List.GetItemAtIndex(list=flatten, index=bv_if_equal_return_index)
SpDefs = Output(getItemAtIndex_4)
