# Dynamo custom node List Revit Link Instances Visible in Active View.dyf (Dynamo 0.8.2.2371)
# category: Bakery.Revit.Selection

all_elements_in_active_view = ElementsInView()
get_revit_link_names_from_an = Custom[Get Revit Link Names from an Element List](ElementList=all_elements_in_active_view)
get_pure_filename_from_revit = Custom[Get Pure Filename from Revit Link Name String](LinkNames=get_revit_link_names_from_an)
LinkNames = Output(get_pure_filename_from_revit)
