# Dynamo custom node List Sectors for Given Elements.dyf (Dynamo 0.8.2.2371)
# category: Bakery.Revit.Elements
# uses a model with 'floors' and comments parameter

elements_to_check = Input()
watch = Watch(elements_to_check)
location = FamilyInstance.Location(watch)
sector_bounding_floor_elements = Input()
parameter_name_to_get = Input()
check_point_intersects_geometry = Custom[Check Point Intersects Geometry and Get Revit Parameter](element_list=sector_bounding_floor_elements, parameter_name_to_get=parameter_name_to_get)
map = List.Map(list=location, f_x=check_point_intersects_geometry.Parameter_value)
flatten = Flatten(map)
watch_2 = Watch(map)
map_2 = List.Map(list=location, f_x=check_point_intersects_geometry.Level)
firstItem = List.FirstItem()
map_3 = List.Map(list=map_2, f_x=firstItem)
firstItem_2 = List.FirstItem()
map_4 = List.Map(list=map, f_x=firstItem_2)
code_block = CodeBlock { " "; }
string = StringInput(" Sector")
join = String.Join(code_block, string)
map_5 = List.Map(list=map_4, f_x=join)
create = List.Create(map_3, map_5)
transpose = List.Transpose(create)
code_block_2 = CodeBlock { "---"; }
mergeSublists = Custom[List.MergeSublists](List=transpose, Character=code_block_2)  # This will merge all sublists with or without a character between the strings.
Level_and_Sector = Output(mergeSublists)
flatten_2 = Flatten(map_2)
watch_3 = Watch(map_2)
count = Count()
map_6 = List.Map(list=map_2, f_x=count)
duplicate_results_present_if_greater_tha = Output(map_6)  # "duplicate results present if greater than 1"
