# Dynamo custom node List View Filter Information for View or Template.dyf (Dynamo 0.8.2.2371)
# category: Bakery.Revit.Views
# use with List.Map

View_s = Input()  # "View(s)"
turn_into_list = Custom[Turn Into List](item=View_s)  # Turns an element (or a nested list) into a flat list
python_script = Python(IN[0]=turn_into_list)
# ---------- python_script.python (40 lines) ----------
import clr
clr.AddReference('RevitAPI')
from Autodesk.Revit.DB import *

clr.AddReference("RevitServices")
import RevitServices
from RevitServices.Persistence import DocumentManager

doc = DocumentManager.Instance.CurrentDBDocument
views = UnwrapElement(IN[0])
elementlist = list()

collector = FilteredElementCollector(doc)
filters = collector.OfClass(FilterElement).ToElements()
viewNameList = list()
filterList = []
filterIdList = []
filterEntities = []
filtersHidden = []
filterOverrides = []
filterOverridesCutFillColor = []
for view in views:
	try:
		viewNameList.append(view.Name)
		thisfilter = False
		for filter in filters:
			if view.IsFilterApplied(filter.Id):
				thisfilter = True
				filterList.append(filter.Name)
				filterIdList.append(filter.Id)
				filterEntities.append(filter)
				filtersHidden.append(view.GetFilterVisibility(filter.Id))
				filterOverrides.append(view.GetFilterOverrides(filter.Id))
		if thisfilter:
			elementlist.append(True)
		else:
			elementlist.append(False)
	except:
		elementlist.append(False)
OUT = viewNameList, elementlist, filterList, filterIdList, filterEntities, filtersHidden, filterOverrides
# ----------------------------------------
oneOutput = Output(python_script)
