# Dynamo custom node List Views and View Templates v2.dyf (Dynamo 0.9.1.4062)
# category: Bakery.Revit.Views
# uses other nodes, null handling

string = StringInput("ViewsAndTemplates_NumberOfViews")
get_standard_views_as_single = Custom[Get Standard Views as single list]()
flatten = Flatten(get_standard_views_as_single)
count = Count(flatten)
watch = Watch(count)
string_2 = StringInput("---Number WITHOUT Templates not inc. Schedules---")
element_name_universal = Custom[Element Name Universal](Element_s=flatten)  # Modified for 0.8.1
view_templates_for_view_list = Custom[View Templates for View List](View_s=flatten)
flat_list_to_list_of_strings = Custom[Flat List to List of Strings](Original_List=view_templates_for_view_list)  # using python methods
length = String.Length(flat_list_to_list_of_strings)
code_block = CodeBlock { 2; }
gt = length > code_block
filterByBoolMask = List.FilterByBoolMask(list=element_name_universal, mask=gt)
count_2 = Count(filterByBoolMask.out)
string_3 = StringInput("---Failed for these types---")
string_4 = StringInput("---join---")
code_block_2 = CodeBlock { "OLD"; }
string_5 = StringInput("---Missing View Template List starts now---")
join = String.Join(string_4, code_block_2, string_5)
watch_2 = Watch(filterByBoolMask.out)
code_block_3 = CodeBlock { "NO VIEW TEMPLATE"; }
create = List.Create(code_block_3)
cycle = List.Cycle(list=create, amount=count_2)
watch_3 = Watch(cycle)
create_2 = List.Create(watch_2, watch_3)
transpose = List.Transpose(create_2)
number_slider = DoubleSlider(2, range=0..100 step 0.1)
filterBySublistLength = Custom[List.FilterBySublistLength](seq=transpose, length=number_slider)  # Filters out all sublists that do not have the specified length
create_3 = List.Create(string, watch, string_2, count_2, string_3, join, filterBySublistLength.in)
flatten_2 = Flatten(create_3)
chop = List.Chop(list=flatten_2, lengths=number_slider)
Combined_List = Output(chop)
countTrue = CountTrue(gt)
watch_4 = Watch(countTrue)
filterByBoolMask_2 = List.FilterByBoolMask(list=view_templates_for_view_list, mask=gt)
watch_5 = Watch(filterByBoolMask_2.in)
filterByBoolMask_3 = List.FilterByBoolMask(list=flatten, mask=gt)
watch_6 = Watch(filterByBoolMask_3.in)
