# Dynamo custom node List of Categories Used in a Linked Revit File.dyf (Dynamo 1.1.0.2094)
# category: Bakery.Revit.Document.Links
# this will take a link Name (without extension) and query it for categories containing elements

built_in_name_lister = Custom[Built In Name Lister]()  # lists BuiltInNames (Built In Category Names)
watch = Watch(built_in_name_lister.builtins_as_Strings)
linkName = Input()
get_link_document_from_link_name = Custom[Get Link Document from Link Name](searchFor=linkName)
super_collect_elements_from = Custom[Super Collect Elements from Document](builtInNameList=watch, DOC=get_link_document_from_link_name)  # tries to collect elements from all builtin categories
found_Category_Names = Output(super_collect_elements_from.found_Category_Names)
