# Dynamo custom node List of Duct and Pipe Categories as Built in names.dyf (Dynamo 0.8.1.1942)
# category: Bakery.Revit.Elements.Systems
# can be fed into "Select based on a single builtin name" node

built_in_name_lister = Custom[Built In Name Lister]()  # simply lists builtin category names
flat_list_to_list_of_strings = Custom[Flat List to List of Strings](Original_List=built_in_name_lister)  # using python methods
code_block = CodeBlock { "duct"; }
code_block_2 = CodeBlock { true; }
contains = String.Contains(str=flat_list_to_list_of_strings, searchFor=code_block, ignoreCase=code_block_2)
filterByBoolMask = List.FilterByBoolMask(list=built_in_name_lister, mask=contains)
watch = Watch(filterByBoolMask.in)
flat_list_to_list_of_strings_2 = Custom[Flat List to List of Strings](Original_List=built_in_name_lister)
code_block_3 = CodeBlock { "pipe"; }
code_block_4 = CodeBlock { true; }
contains_2 = String.Contains(str=flat_list_to_list_of_strings_2, searchFor=code_block_3, ignoreCase=code_block_4)
filterByBoolMask_2 = List.FilterByBoolMask(list=built_in_name_lister, mask=contains_2)
watch_2 = Watch(filterByBoolMask_2.in)
create = List.Create(watch, watch_2)
flatten = Flatten(create)
nameList = Output(flatten)
