# Dynamo custom node List of Model Elements simplified.dyf (Dynamo 1.0.0.1180)
# category: Bakery.Revit.Selection
# uses familyinstance select now, so doesn't include system families

collect_all_familyinstance_using = Custom[Collect all FamilyInstance using Element Types]()  # should get model family instances
flatten = Flatten(collect_all_familyinstance_using)
type = FamilyInstance.Type(flatten)
List_of_Types_symbols = Output(type)  # "List of Types (symbols)"
Element_List = Output(flatten)
