# Dynamo custom node List the View Worksets of All Tags in Project.dyf (Dynamo 1.2.1.3083)
# category: Bakery.Revit.Elements.Tag
# in other words, tell you what views they can be found in...

collect_all_tags_in_project = Custom[Collect All Tags in Project]()
show_element_workset_as_internal = Custom[Show Element Workset as Internal db name](Element_s=collect_all_tags_in_project)
element_name_universal = Custom[Element Name Universal](Elements=show_element_workset_as_internal)  # Modified for 0.8.1
uniqueItems = List.UniqueItems(element_name_universal)
TagsInTheseViews = Output(uniqueItems)
