# Dynamo custom node List.RemoveItemsFromOtherList.dyf (Dynamo 0.8.0.950)
# category: Bakery.Core.List
# This will take long list A, remove entries that appear in short list B, and give you list C. (JBE List Operations are probably more robust).

List_A = Input()
turn_into_list = Custom[Turn Into List](item=List_A)  # Turns an element (or a nested list) into a flat list
List_B = Input()
turn_into_list_2 = Custom[Turn Into List](item=List_B)
python_script = Python(IN[0]=turn_into_list, IN[1]=turn_into_list_2)
# ---------- python_script.python (6 lines) ----------
listA = IN[0]
listB = IN[1]

listC = [x for x in listA if x not in listB]

OUT = listC
# ----------------------------------------
flatten = Flatten(python_script)
Output = Output(flatten)  # ""
