# Dynamo custom node Load Selection Set as Elements.dyf (Dynamo 0.8.1.1942)
# category: Bakery.Revit.Elements

SelectionSet_s = Input()  # "SelectionSet(s)"
turn_into_list = Custom[Turn Into List](item=SelectionSet_s)  # Turns an element (or a nested list) into a flat list
python_script = Python(IN[0]=turn_into_list)
# ---------- python_script.python (17 lines) ----------
import clr
clr.AddReference('RevitAPI')
from Autodesk.Revit.DB import *

clr.AddReference("RevitServices")
import RevitServices
from RevitServices.Persistence import DocumentManager

doc = DocumentManager.Instance.CurrentDBDocument
items = UnwrapElement(IN[0])
elementlist = list()
for item in items:
	selsetmembers = list()
	for member in item.GetElementIds():
		selsetmembers.append(doc.GetElement(member))
	elementlist.append(selsetmembers)
OUT = elementlist
# ----------------------------------------
Elements = Output(python_script)
