# Dynamo custom node MEP Elements to Geometry using NURBS.dyf (Dynamo 0.8.2.2371)
# category: Bakery.Revit.API.MEP

diameter_list = Input()
watch = Watch(diameter_list)
code_block = CodeBlock { 10; }
points_sublists = Input()
start_vector_list_from_revit = Input()
revit_vector_parameter_to_dynamo = Custom[Revit Vector Parameter to Dynamo Vector Element]()
map = List.Map(list=start_vector_list_from_revit, f_x=revit_vector_parameter_to_dynamo)
end_vector_list_from_revit = Input()
revit_vector_parameter_to_dynamo_2 = Custom[Revit Vector Parameter to Dynamo Vector Element]()
map_2 = List.Map(list=end_vector_list_from_revit, f_x=revit_vector_parameter_to_dynamo_2)
point_and_tangent_lists_to_nurbs = Custom[Point and Tangent Lists to Nurbs and Polycurves](point_sublists=points_sublists, start_vector_list=map, end_vector_list=map_2)
two_lists_into_one_replacing = Custom[Two Lists into One Replacing Nulls with Backup Values](primary_list_to_clean=point_and_tangent_lists_to_nurbs.nurbs_curves_using_tangents, backup_list_used_for_null_replacement=point_and_tangent_lists_to_nurbs.polycurves)
watch_2 = Watch(two_lists_into_one_replacing)
list_of_curves_to_point_based = Custom[List of Curves to Point based NURBs Curves](divisor=code_block, list=watch_2)
watch_3 = Watch(list_of_curves_to_point_based.nurbscurves)
nurbs_curve_and_diameter_list_to = Custom[NURBS Curve and Diameter List to NURBS Surfaces](diameter_list=watch, curve_list=watch_3)
watch_4 = Watch(nurbs_curve_and_diameter_list_to.nurbs_surfaces)
watch_5 = Watch(nurbs_curve_and_diameter_list_to.simple_lofts)
two_lists_into_one_replacing_2 = Custom[Two Lists into One Replacing Nulls with Backup Values](primary_list_to_clean=watch_4, backup_list_used_for_null_replacement=watch_5)
watch_6 = Watch(two_lists_into_one_replacing_2)
watch_7 = Watch(nurbs_curve_and_diameter_list_to.simple_nurbs)
two_lists_into_one_replacing_3 = Custom[Two Lists into One Replacing Nulls with Backup Values](primary_list_to_clean=watch_6, backup_list_used_for_null_replacement=watch_7)
geometries = Output(two_lists_into_one_replacing_3)
