# Dynamo custom node Make Points From Point Cloud File.dyf (Dynamo 1.2.1.3083)
# category: Bakery.Construction.PointCloud

path = Input(path : var[]..[])
takeEveryNthItem = Input(takeEveryNthItem : var[]..[])
reduce_text_file_data = Custom[Reduce Text File Data](path=path, takeEveryNthItem=takeEveryNthItem)
flat_list_to_list_of_strings = Custom[Flat List to List of Strings](Original_List=reduce_text_file_data.reducedList)  # using python methods
Delimiter = Input()
Yindex = Input(Yindex : int)
Zindex = Input(Zindex : int)
Xindex = Input(Xindex : int)
parse_xyz_from_delimited_string = Custom[Parse XYZ from Delimited String List](data=flat_list_to_list_of_strings, separater=Delimiter, Yindex=Yindex, Zindex=Zindex, Xindex=Xindex)
number = DoubleInput(1)
mul = parse_xyz_from_delimited_string.Xvalues * number
mul_2 = parse_xyz_from_delimited_string.Yvalues * number
mul_3 = parse_xyz_from_delimited_string.Zvalues * number
byCoordinates = Point.ByCoordinates(x=mul, y=mul_2, z=mul_3)
Points = Output(byCoordinates)
