# Dynamo custom node Nearest X and Y Walls for a Point.dyf (Dynamo 1.3.2.2480)
# category: Bakery.Revit.Elements.Dimension

xAlignedWalls = Input()

# group: x Walls
watch = Watch(xAlignedWalls)

location = Custom[Element.Location](element=watch)  # Returns the location of an element as an XYZ (or if it's line-based the start and end point of the line), along with some booleans to help filtering the results. Use this for some element types (e.g. walls or lines) that do not work with the built-in Get Family Instance Location node.
watch_2 = Watch(location.curveEndpoints)
flatten = Flatten(watch_2)
X = Point.X(flatten)
onePoint = Input()
watch_3 = Watch(onePoint)
X_2 = Point.X(watch_3)
closest_value = Custom[Closest Value](value=X_2, listOfDoubles=X)  # uses double to int reduction
getItemAtIndex = List.GetItemAtIndex(list=X, index=closest_value)
X_3 = Point.X(watch_2)
eq = getItemAtIndex == X_3@L2
anyTrue = Custom[List.AnyTrue](seq=eq)  # Returns true if any item in a list of booleans is true.
filterByBoolMask = List.FilterByBoolMask(list=watch, mask=anyTrue)
firstItem = List.FirstItem(filterByBoolMask.in)
yAlignedWalls = Input()

# group: y Walls
watch_4 = Watch(yAlignedWalls)

location_2 = Custom[Element.Location](element=watch_4)
watch_5 = Watch(location_2.curveEndpoints)
flatten_2 = Flatten(watch_5)
Y = Point.Y(flatten_2)
Y_2 = Point.Y(watch_3)
closest_value_2 = Custom[Closest Value](value=Y_2, listOfDoubles=Y)
getItemAtIndex_2 = List.GetItemAtIndex(list=Y, index=closest_value_2)
Y_3 = Point.Y(watch_5)
eq_2 = getItemAtIndex_2 == Y_3@L2
anyTrue_2 = Custom[List.AnyTrue](seq=eq_2)
filterByBoolMask_2 = List.FilterByBoolMask(list=watch_4, mask=anyTrue_2)
firstItem_2 = List.FirstItem(filterByBoolMask_2.in)
create = List.Create(firstItem, firstItem_2)
nearestWallsXthenY = Output(create)
