# Dynamo custom node Offset Horizontal Faces and Thicken Solid.dyf (Dynamo 1.3.2.2480)
# category: Bakery.Geometry

topology = Input()
faces = Topology.Faces(topology)
vertices = Face.Vertices(faces)
pointGeometry = Vertex.PointGeometry(vertices)
Z = Point.Z(pointGeometry)
all_equal_in_list = Custom[All Equal in List](sublists=Z)
watch = Watch(all_equal_in_list)
filterByBoolMask = List.FilterByBoolMask(list=faces, mask=watch)
watch_2 = Watch(filterByBoolMask.in)
one_face_to_polycurve_outline = Custom[One Face to Polycurve Outline]()  # unwired: oneface
map = List.Map(list=watch_2, f_x=one_face_to_polycurve_outline)
deconstructPolyCurve = Geometry.Curves.DeconstructPolyCurve(map)
watch_3 = Watch(deconstructPolyCurve.out1)
firstItem = List.FirstItem(watch_3)
distance = Input(distance : double)
watch_4 = Watch(distance)
offset_point_z_value = Custom[Offset Point Z Value](points=firstItem, desiredOffset=watch_4)
code_block = CodeBlock { true; }
byPoints = PolyCurve.ByPoints(points=offset_point_z_value, connectLastToFirst=code_block)
lastItem = List.LastItem(watch_3)
code_block_2 = CodeBlock(x=watch_4) { x*-1; }
offset_point_z_value_2 = Custom[Offset Point Z Value](points=lastItem, desiredOffset=code_block_2)
byPoints_2 = PolyCurve.ByPoints(points=offset_point_z_value_2, connectLastToFirst=code_block)
create = List.Create(byPoints, byPoints_2)
byLoft = Solid.ByLoft(create)
Solid = Output(byLoft)
surfaceGeometry = Face.SurfaceGeometry(watch_2)
offset = Surface.Offset(surfaceGeometry)
curves = PolyCurve.Curves()  # unwired: arg0
