# Dynamo custom node Percentage of False Values in Sublists.dyf (Dynamo 1.0.0.1180)
# category: Bakery.Core.List

nestedBooleans = Input()
watch = Watch(nestedBooleans)
countFalse = CountFalse()
map = List.Map(list=watch, f_x=countFalse)
watch_2 = Watch(map)
count = Count()
map_2 = List.Map(list=watch, f_x=count)
watch_3 = Watch(map_2)
get_percentage_as_string_given = Custom[Get Percentage as String given Value and Total](partialList=watch_2, totalList=watch_3)
percentageOfFalse = Output(get_percentage_as_string_given)
