# Dynamo custom node Point Sublists to DirectShape Ruled Loft Vertical Guide Curves.dyf (Dynamo 1.2.0.2831)
# category: Bakery.Construction.Civil

pointSublists = Input(pointSublists : var[]..[])
zOffsetCanBeNegative = Input(zOffsetCanBeNegative : var[]..[])
precision = Input(precision : var[]..[])
sampled_ruled_lofts_between_two = Custom[Sampled Ruled Lofts Between Two Point Lists](pointList=pointSublists, zOffsetCanBeNegative=zOffsetCanBeNegative, numberOfDivisions=precision)
watch = Watch(sampled_ruled_lofts_between_two)
categories = Categories("GenericModel")
uuid_guid_generator_for_lists = Custom[UUID GUID Generator for Lists](list=watch)  # just makes a new GUID for every item in a list, has no relationship to item or element itself
byGeometry = DirectShape.ByGeometry(geometry=watch, category=categories, name=uuid_guid_generator_for_lists.uuidsAsStrings)
DirectShape = Output(byGeometry)
