# Dynamo custom node Popup Message Box.dyf (Dynamo 1.3.0.875)
# category: Bakery.Dynamo.UI
# from Dynamo Player samples

message = Input()
hyperlink = Input()
python_script = Python(IN[0]=message, IN[1]=hyperlink)
# ---------- python_script.python (15 lines) ----------
#This script pops up a dialog box with a message from the previous node.
import clr
clr.AddReference('RevitAPIUI')

from Autodesk.Revit.UI import TaskDialog

mainText = IN[0]
footerText = IN[1]

messagePop = TaskDialog("Dynamo Player")
messagePop.MainContent = mainText + "\n\n" + "<a href=\"http://dynamobim.org/ \">" + footerText + "</a>";

OUT = "Success!"

messagePop.Show()
# ----------------------------------------
OUT = Output(python_script)
