# Dynamo custom node Read Room Numbers and Location Points to Excel.dyf (Dynamo 0.9.2.4472)
# category: Bakery.Revit.Elements.Room

excelPathAsString = Input()
string = StringInput("Sheet1")
code_block = CodeBlock { 0; }
read_excel_into_lists = Custom[Read Excel Into Lists](path=excelPathAsString, sheetName=string, dropRows=code_block)
watch = Watch(read_excel_into_lists.data)
transpose = List.Transpose(watch)
code_block_2 = CodeBlock { 0; }
getItemAtIndex = List.GetItemAtIndex(list=transpose, index=code_block_2)
roomNumbers = Output(getItemAtIndex)
code_block_3 = CodeBlock { 1; }
getItemAtIndex_2 = List.GetItemAtIndex(list=transpose, index=code_block_3)
str2Pt = Custom[Str2Pt](str=getItemAtIndex_2)  # De-serilize a Revit parameter string into a geometric point.
point_s = Output(str2Pt)  # "point(s)"
