# Dynamo custom node Read Text from File Path.dyf (Dynamo 0.8.2.2371)
# category: Bakery.Core

path = Input()
fromPath = FileObject(path)  # "File.FromPath"
readText = File.ReadText(fromPath)
str = Output(readText)
