# Dynamo custom node Remove List from List by Item not Value.dyf (Dynamo 0.8.0.950)
# category: Bakery.Core.List
# remove the items in ListA from the items in ListB and return whats left

ListOfItemsToRemove = Input()
ListToRemoveFrom = Input()
python_script = Python(IN[0]=ListOfItemsToRemove, IN[1]=ListToRemoveFrom)
# ---------- python_script.python (13 lines) ----------
listA = IN[0]
listB = IN[1]
unmatched = []

#listC = [x for x in listA if x not in listB]
for x in range(len(listA)):
#	s = set(listA)
	if listA[x] in listB:
		listB.remove(listA[x])
	else:
		unmatched.append(listA[x])

OUT = [listB, unmatched]
# ----------------------------------------
code_block = CodeBlock { 0; }
getItemAtIndex = List.GetItemAtIndex(list=python_script, index=code_block)
reducedList = Output(getItemAtIndex)
code_block_2 = CodeBlock { 1; }
getItemAtIndex_2 = List.GetItemAtIndex(list=python_script, index=code_block_2)
unmatched = Output(getItemAtIndex_2)
