# Dynamo custom node Remove StringList from List with String Conversion.dyf (Dynamo 0.8.2.2371)
# category: Bakery.Core.String

Original_List = Input()
single_string_with_line_breaks = Input()
convert_string_with_line_breaks = Custom[Convert String with Line Breaks into List of Strings](string=single_string_with_line_breaks)
flat_list_to_list_of_strings = Custom[Flat List to List of Strings](Original_List=Original_List)  # using python methods
bv_all_indices_of = Custom[bv All Indices Of](list=flat_list_to_list_of_strings)  # forked from Rhythm
map = List.Map(list=convert_string_with_line_breaks, f_x=bv_all_indices_of)
flatten = Flatten(map)
removeItemAtIndex = List.RemoveItemAtIndex(list=Original_List, indices=flatten)
reduced_list = Output(removeItemAtIndex)
