# Dynamo custom node Remove Trailing Double Quote if Present.dyf (Dynamo 1.3.3.4651)
# category: Bakery.Core.String

listOfStrings = Input()
python_script = Python(IN[0]=listOfStrings)
# ---------- python_script.python (21 lines) ----------
import clr
clr.AddReference('ProtoGeometry')
from Autodesk.DesignScript.Geometry import *
#The inputs to this node will be stored as a list in the IN variables.
somethings = IN[0]
strings = []
for x in somethings:
	strings.append(str(x))
newstr = []
lens=[]
for s in strings:
	lens.append(len(s))
	if s[(len(s)-1)]=='"':
		endlen=(len(s)-1)
		temp=s[0:endlen]
		newstr.append(temp)
	else:
		newstr.append(s)

#Assign your output to the OUT variable.
OUT = newstr
# ----------------------------------------
newStrings = Output(python_script)
