# Dynamo custom node RemovePriorToChar.dyf (Dynamo 2.3.1.11775)
# category: Bakery.Core.String
# bakery mod

stringValue = Input(stringValue: string)
watch = Watch(stringValue)
searchFor = Input(searchFor: string)
ignoreCase = Input(ignoreCase: bool)
indexOf = String.IndexOf(str=watch, searchFor=searchFor, ignoreCase=ignoreCase)
code_block = CodeBlock(in1=indexOf) { in2=in1; in2*-1-1; }
code_block_2 = CodeBlock { 0; }
eq = code_block.in2 == code_block_2
if_ = If(test=eq, true=code_block_2, false=code_block.out1)
remove = String.Remove(str=watch, startIndex=code_block.in2, count=if_)
modified = Output(remove)
