# Dynamo custom node Rename All Elements by Adding Prefix.dyf (Dynamo 1.3.0.875)
# category: Bakery.Revit.Document.Utility
# Send any wrapped element to this node to add the desired prefix to its name

ElementsOrTypes = Input()
watch = Watch(ElementsOrTypes)
element_name_universal = Custom[Element Name Universal](Elements=watch)  # Modified for 0.8.1
stringPrefix = Input()
add_prefix_to_items_in_string = Custom[Add Prefix to Items in String List](string_list=element_name_universal, prefix=stringPrefix)
watch_2 = Watch(add_prefix_to_items_in_string)
setName = Custom[Element.SetName](element=watch, name=watch_2)  # Gets the name of a given Revit element
Done = Output(setName.Success)
