# Dynamo custom node Replace Item if True.dyf (Dynamo 1.3.3.4651)
# category: Bakery.Core.List
# takes two lists, plus a boolean list. If the boolean list says True, list1 item is replaced by list2 item

booleanlist = Input(booleanlist : var[])
code_block = CodeBlock { true; }
allIndicesOf = List.AllIndicesOf(list=booleanlist, item=code_block)
indicesReplaced = Output(allIndicesOf)
list1 = Input()
turnIntoList = Custom[TurnIntoList](unknownItem=list1)  # Turns an element (or a nested list) into a flat list
list2 = Input()
turnIntoList_2 = Custom[TurnIntoList](unknownItem=list2)
getItemAtIndex = List.GetItemAtIndex(list=turnIntoList_2, index=allIndicesOf)
replaceItemAtIndex = Custom[List.ReplaceItemAtIndex](seq=turnIntoList, index=allIndicesOf, replacement=getItemAtIndex)  # Replaces the item at a given index (or list of indices) of a list by another item
newList = Output(replaceItemAtIndex)
