# Dynamo custom node Replace Point Z Value.dyf (Dynamo 2.3.0.5885)
# category: Bakery.Geometry

points = Input(points: var[]..[])
watch = Watch(points)
X = Point.X(point=watch)
Y = Point.Y(point=watch)
desiredZvalue = Input(desiredZvalue: var[]..[])
count = List.Count(list=X)
cycle = List.Cycle(list=desiredZvalue, amount=count)
byCoordinates = Point.ByCoordinates(x=X, y=Y, z=cycle)
Pointz = Output(byCoordinates)
