# Dynamo custom node Replace Single Space with Underscore.dyf (Dynamo 1.3.2.2480)
# category: Bakery.Core.String

str = Input(str : string)
string = StringInput(" ")
string_2 = StringInput("_")
replace = String.Replace(str=str, searchFor=string, replaceWith=string_2)
str_2 = Output(replace)  # "str"
