# Dynamo custom node Report on Detail Lines and Detail Groups.dyf (Dynamo 0.9.1.4062)
# category: Bakery.Revit.Document.Utility

string = StringInput("DetailElements")
string_2 = StringInput("---Detail Lines in Views and Sheets---")
categories = Categories("Lines")
all_elements_of_category = ElementsOfCategory(categories)
workset = Custom[Element.Workset](element=all_elements_of_category)  # Retrieves the workset of a given element
element_name_universal = Custom[Element.Name (Universal)](element=workset)  # Gets an element's name (Dynamo's built-in Name nodes don't work for all element types, e.g. worksets...)
string_3 = StringInput("View")
boolean = BoolSelector(true)
contains = String.Contains(str=element_name_universal, searchFor=string_3, ignoreCase=boolean)
filterByBoolMask = List.FilterByBoolMask(list=all_elements_of_category, mask=contains)
count = Count(filterByBoolMask.in)
string_4 = StringInput("Sheet")
boolean_2 = BoolSelector(true)
contains_2 = String.Contains(str=element_name_universal, searchFor=string_4, ignoreCase=boolean_2)
filterByBoolMask_2 = List.FilterByBoolMask(list=all_elements_of_category, mask=contains_2)
count_2 = Count(filterByBoolMask_2.in)
add = count + count_2
string_5 = StringInput("---Count of Detail Lines in Views---")
string_6 = StringInput("---Count of Detail Lines on Sheets--")
string_7 = StringInput("---Count of Detail Groups---")
get_all_detail_groups = Custom[Get All Detail Groups]()  # This node will retrieve all instances of Detail Groups in the model.
count_3 = Count(get_all_detail_groups.Groups)
create = List.Create(string, string_2, add, string_5, count, string_6, count_2, string_7, count_3)
combinedSummary = Output(create)
watch = Watch(filterByBoolMask.in)
