# Dynamo custom node Report on Groups.dyf (Dynamo 0.9.1.4062)
# category: Bakery.Revit.Document.Utility

string = StringInput("GroupSummary")
string_2 = StringInput("---No Groups if True---")
list_groups = Custom[List Groups]()
watch = Watch(list_groups)
watch_2 = Watch(watch)
isEmpty = List.IsEmpty(watch_2)
string_3 = StringInput("---Number of Groups---")
flat_list_to_list_of_strings = Custom[Flat List to List of Strings](Original_List=watch)  # using python methods
count = List.Count(flat_list_to_list_of_strings)
string_4 = StringInput("---Group List---")
create = List.Create(string, string_2, isEmpty, string_3, count, string_4, flat_list_to_list_of_strings)
flatten = Flatten(create)
flatList = Output(flatten)
