# Dynamo custom node Revit Model Cleaner.dyf (Dynamo 2.3.0.5885)
# category: Bakery.Revit.Document.Utility
# packages: Bakery 2020.1.14

RevitLinks = Input(RevitLinks: var[]..[])
get_all_revit_links_as_element = Custom[Get All Revit Links as Element List]()  # package Bakery
switch = Custom[Switch](booleanswitch=RevitLinks, data=get_all_revit_links_as_element)  # package Bakery
Groups = Input(Groups: var[]..[])
list_groups = Custom[List Groups]()  # package Bakery
switch_2 = Custom[Switch](booleanswitch=Groups, data=list_groups.groupElements)
Viewz = Input(Viewz: var[]..[])
list_all_views = Custom[List All Views]()  # package Bakery; not including sheets
switch_3 = Custom[Switch](booleanswitch=Viewz, data=list_all_views)
Sheets = Input(Sheets: var[]..[])
categories = Categories("OST_Sheets")  # graph input
all_elements_of_category = ElementsOfCategory(Category=categories)
watch = Watch(all_elements_of_category)
switch_4 = Custom[Switch](booleanswitch=Sheets, data=watch)
Links = Input(Links: var[]..[])
python_script = Python()
# ---------- python_script.python (21 lines) ----------
import clr
clr.AddReference('RevitAPI')
from Autodesk.Revit.DB import *
import Autodesk

clr.AddReference("RevitServices")
import RevitServices
from RevitServices.Persistence import DocumentManager

doc = DocumentManager.Instance.CurrentDBDocument
# need to learn how to implement LINQ here...
collector = FilteredElementCollector(doc)
impinst = collector.OfClass(ImportInstance).ToElements()
linkedlist = list()
importlist = list()
for item in impinst:
	if item.IsLinked:
		linkedlist.append(item)
	else:
		importlist.append(item)
OUT = (linkedlist,importlist)
# ----------------------------------------
code_block = CodeBlock(seq=python_script) { seq[0]; seq[1]; }
watch_2 = Watch(code_block.out0)
switch_5 = Custom[Switch](booleanswitch=Links, data=watch_2)
Imports = Input(Imports: var[]..[])
python_script_2 = Python()  # same code as python_script
code_block_2 = CodeBlock(seq=python_script_2) { seq[0]; seq[1]; }
watch_3 = Watch(code_block_2.out1)
switch_6 = Custom[Switch](booleanswitch=Imports, data=watch_3)
Inplacefamilies = Input(Inplacefamilies: var[]..[])
report_on_inplace_families = Custom[Report on Inplace Families]()  # package Bakery
watch_4 = Watch(report_on_inplace_families.inplace_families)
switch_7 = Custom[Switch](booleanswitch=Inplacefamilies, data=watch_4)
Unusedfamilies = Input(Unusedfamilies: var[]..[])
unused_families = Custom[Unused Families]()  # package Bakery
watch_5 = Watch(unused_families)
switch_8 = Custom[Switch](booleanswitch=Unusedfamilies, data=watch_5)
ExternalReferences = Input(ExternalReferences: var[]..[])
get_external_file_references_and = Custom[Get External File References and Details]()  # package Bakery; including date modified
watch_6 = Watch(get_external_file_references_and.asElements)
switch_9 = Custom[Switch](booleanswitch=ExternalReferences, data=watch_6)
create = List.Create(item0=switch, item1=switch_2, item2=switch_3, item3=switch_4, item4=switch_5, item5=switch_6, item6=switch_7, item7=switch_8, item8=switch_9)
flatten = List.Flatten(list=create)
Elements_collected = Output(flatten)
Delete = Input(Delete: var[]..[])
switch_10 = Custom[Switch](booleanswitch=Delete, data=flatten)
Tried_to_delete = Output(switch_10)
bv_erase_or_delete_from_model = Custom[bv Erase or Delete from Model](Elementz=switch_10)  # package Bakery; forked from SteamNodes
Failed_to_delete = Output(bv_erase_or_delete_from_model)
boolean = BoolSelector(true)  # graph input; frozen
linksAndImports = Custom[Document.LinksAndImports](toggle=boolean)  # Gets all linked and imported files in the document. NOTE: Does *not* retrieve linked Revit files.
boolean_2 = BoolSelector(true)  # graph input; frozen
linksAndImports_2 = Custom[Document.LinksAndImports](toggle=boolean_2)
importCSV = Data.ImportCSV()  # unwired: filePath
imports = Output(code_block_2.out1)
