# Dynamo custom node Rotate Families Around Origin by Angle.dyf (Dynamo 0.8.0.950)
# category: Bakery.Revit.Elements.Family
# this will take Family Instance and angles as list inputs, and rotate Families around their origin. Outputs provide feedback on information used.

FamilyElement = Input()
element_ids = Custom[Element Ids](Element_s=FamilyElement)  # This node will query an element id that can be used with Revit nodes. Dynamo Element Id node returns integer value.
flatten = Flatten(element_ids.Id_String_s)
location = FamilyInstance.Location(FamilyElement)
X = Point.X(location)
Y = Point.Y(location)
number = DoubleInput(-2000)
sum = Math.Sum(number)
byCoordinates = Point.ByCoordinates(x=X, y=Y, z=sum)
byStartPointEndPoint = Line.ByStartPointEndPoint(startPoint=location, endPoint=byCoordinates)
DegreesToRotate = Input()
degreesToRadians = Math.DegreesToRadians(DegreesToRotate)
rotate_family = Custom[Rotate Family](ElementId=flatten, Axis=byStartPointEndPoint, Angle=degreesToRadians)  # This node will rotate a family in Revit around a given axis by supplied angle (in radians). Please remember that every time you run your definition it will rotate family by given angle every time.
RotatedItems = Output(rotate_family)
InstanceOriginPoint = Output(location)
Ids = Output(flatten)
AxisUsed = Output(byStartPointEndPoint)
PointProjectedToMakeAxis = Output(byCoordinates)
