# Dynamo custom node Sample Two Curves to a Loft.dyf (Dynamo 1.2.0.2831)
# category: Bakery.Geometry

curve1 = Input(curve1 : Curve)
smoothnessDivisions = Input(smoothnessDivisions : int)
curve2 = Input(curve2 : Curve)

# group: sample two nurbs and make surface loft
code_block = CodeBlock(x=smoothnessDivisions) { 0..1..(1/x); }
pointAtParameter = Curve.PointAtParameter(curve=curve1, param=code_block)
code_block_2 = CodeBlock(x=smoothnessDivisions) { 0..1..(1/x); }
pointAtParameter_2 = Curve.PointAtParameter(curve=curve2, param=code_block_2)
byStartPointEndPoint = Line.ByStartPointEndPoint(startPoint=pointAtParameter, endPoint=pointAtParameter_2)
byLoft = Surface.ByLoft(byStartPointEndPoint)

Surface = Output(byLoft)
