# Dynamo custom node Sampled Ruled Lofts Between Two Point Lists.dyf (Dynamo 1.2.0.2831)
# category: Bakery.Geometry

pointList = Input()
create_nurbscurves_from_sublists = Custom[Create NurbsCurves from Sublists of Points](pointSublists=pointList)
numberOfDivisions = Input()
code_block = CodeBlock(z=numberOfDivisions) { 0..1..(1/z); }
pointAtParameter = Curve.PointAtParameter(curve=create_nurbscurves_from_sublists.validOutputCurvesOnly, param=code_block, lacing=CrossProduct)
zOffsetCanBeNegative = Input()
offset_point_z_value = Custom[Offset Point Z Value](points=pointList@L2, desiredOffset=zOffsetCanBeNegative)
watch = Watch(offset_point_z_value)
create_nurbscurves_from_sublists_2 = Custom[Create NurbsCurves from Sublists of Points](pointSublists=watch)
pointAtParameter_2 = Curve.PointAtParameter(curve=create_nurbscurves_from_sublists_2.validOutputCurvesOnly, param=code_block, lacing=CrossProduct)
byStartPointEndPoint = Line.ByStartPointEndPoint(startPoint=pointAtParameter@L2, endPoint=pointAtParameter_2@L2, lacing=Longest)
byRuledLoft = Surface.ByRuledLoft(byStartPointEndPoint@L2)
Surface = Output(byRuledLoft)
