# Dynamo custom node Scale Solid by Centroid and Z.dyf (Dynamo 1.3.2.2480)
# category: Bakery.Geometry

oneSolid = Input()
centroid = Solid.Centroid(oneSolid)
byOriginNormal = Plane.ByOriginNormal(origin=centroid)
code_block = CodeBlock { 1; }
zamount = Input(zamount : double)
scale = Geometry.Scale(arg1=byOriginNormal, arg2=code_block, arg3=code_block, arg4=zamount)  # unwired: arg0
Geom = Output(scale)
