# Dynamo custom node Search One List Based on Second and Get from Third v2.dyf (Dynamo 0.8.2.2371)
# category: Bakery.Core.List
# no null replacement, faster

getFromThisList = Input(getFromThisList : var[]..[])
searchForThese = Input(searchForThese : var[]..[])
inThisList = Input(inThisList : var[]..[])
if_equal_return_index_using = Custom[If Equal Return Index using IndexOf](searchForThese=searchForThese, inThisList=inThisList)
getItemAtIndex = List.GetItemAtIndex(list=getFromThisList, index=if_equal_return_index_using)
items = Output(getItemAtIndex)
