# Dynamo custom node Search Tags and Get Values from XML Lists.dyf (Dynamo 0.8.2.2371)
# category: Bakery.Data.XML

get_names_from = Input()
search_these_tags = Input()
search_for = Input()
bv_all_indices_of = Custom[bv All Indices Of](list=search_these_tags, indices=search_for)  # forked from Rhythm

# group: tags
getItemAtIndex = List.GetItemAtIndex(list=get_names_from, index=bv_all_indices_of)

matching_attributes = Output(getItemAtIndex)
get_values_from = Input()

# group: values
getItemAtIndex_2 = List.GetItemAtIndex(list=get_values_from, index=bv_all_indices_of)

matching_values = Output(getItemAtIndex_2)
watch = Watch()
