# Dynamo custom node Search for Generic Annotation on Sheet and Copy Id to Clipboard.dyf (Dynamo 1.3.0.875)
# category: Bakery.Revit.Views.Sheet
# uses Workset to get Sheet, file must be workshared

categories = Categories("GenericAnnotation")
all_elements_of_category = ElementsOfCategory(categories)
watch = Watch(all_elements_of_category)
workset = Custom[Element.Workset](element=watch)  # Retrieves the workset of a given element
element_name_universal = Custom[Element Name Universal](Elements=workset)  # Modified for 0.8.1
searchFor = Input(searchFor : string)
contains = String.Contains(str=element_name_universal, searchFor=searchFor)
filterByBoolMask = List.FilterByBoolMask(list=watch, mask=contains)
watch_2 = Watch(filterByBoolMask.in)
send_element_ids_to_clipboard = Custom[Send Element IDs to Clipboard](elementList=watch_2)  # Can be pasted into Select by ID
done = Output(send_element_ids_to_clipboard)
