# Dynamo custom node Search for Type Parameter Value in List of Elements and Return Elements.dyf (Dynamo 0.8.2.2371)
# category: Bakery.Revit.Parameters

elementList = Input()
watch = Watch(elementList)
symbol = FamilyInstance.Symbol(watch)
typeParameterValue = Input()
string_search_all_element = Custom[String Search All Element.Parameters for a Single Element](searchFor=typeParameterValue)
map = List.Map(list=symbol, f_x=string_search_all_element.Any_Found)
filterByBoolMask = List.FilterByBoolMask(list=watch, mask=map)
valueFoundInTheseElements = Output(filterByBoolMask.in)
