# Dynamo custom node Select Elements including Nested by Category.dyf (Dynamo 0.9.1.4062)
# category: Bakery.Revit.Selection
# and report as list and number of items

Selection_Set_Name = Input()
Category = Input()
all_elements_of_category = ElementsOfCategory(Category)
byElements = Custom[SelectionSet.ByElements](Name=Selection_Set_Name, elements=all_elements_of_category)  # Creates a selections set of the given elements. Note that if a selection set of the given name already exists in the model, its contents will be replaced. Also, if the selection set is already applied as a view filter, the view filter will have to be manually updated in the visibility / graphic overrides.
feedback = Output(byElements)
create = List.Create(all_elements_of_category)
flatten = Flatten(create)
count = List.Count(flatten)
Number_of_Elements = Output(count)
Flat_List_of_Elements = Output(flatten)
