# Dynamo custom node Select Family Definition in Link by Wildcard.dyf (Dynamo 1.2.1.3083)
# category: Bakery.Revit.Document.Links
# search link name and family names

searchLinkNames = Input()
get_link_document_from_link_name = Custom[Get Link Document from Link Name](searchFor=searchLinkNames)
get_family_list_for_document = Custom[Get Family List for Document](doc=get_link_document_from_link_name)
element_name_universal = Custom[Element Name Universal](Elements=get_family_list_for_document)  # Modified for 0.8.1
toUpper = String.ToUpper(element_name_universal)
searchFamilyNamesInLink = Input()
toUpper_2 = String.ToUpper(searchFamilyNamesInLink)
contains = String.Contains(str=toUpper, searchFor=toUpper_2)
filterByBoolMask = List.FilterByBoolMask(list=get_family_list_for_document, mask=contains)
FamiliesFound = Output(filterByBoolMask.in)
get_all_family_instances_from = Custom[Get All Family Instances From Link Doc](linkdoc=get_link_document_from_link_name)
flatten = Flatten(get_all_family_instances_from)
get_family_from_element = Custom[Get Family from Element](oneElement=flatten)  # working now
element_name_universal_2 = Custom[Element Name Universal](Elements=get_family_from_element)
toUpper_3 = String.ToUpper(element_name_universal_2)
contains_2 = String.Contains(str=toUpper_3, searchFor=toUpper_2)
filterByBoolMask_2 = List.FilterByBoolMask(list=get_all_family_instances_from, mask=contains_2)
InstancesFound = Output(filterByBoolMask_2.in)
python_script = Python(IN[0]=filterByBoolMask.in, IN[1]=get_link_document_from_link_name)
# ---------- python_script.python (33 lines) ----------
import clr
clr.AddReference('ProtoGeometry')
from Autodesk.DesignScript.Geometry import *

# Import DocumentManager and TransactionManager
clr.AddReference("RevitServices")
import RevitServices
from RevitServices.Persistence import DocumentManager

doc = IN[1]

#The inputs to this node will be stored as a list in the IN variables.
if isinstance(IN[0], list):
	toggle = 0
	family = UnwrapElement(IN[0])
else:
	toggle = 1
	family = [UnwrapElement(IN[0])]

listout = []
for fam in family:
	ids = fam.GetFamilySymbolIds()
	types = []
	for i in ids:
		type = doc.GetElement(i)
		types.append(type)
	listout.append(types)

#Assign your output to the OUT variable.
if toggle == 0:
	OUT = listout
else:
	OUT = types
# ----------------------------------------
TypesFound = Output(python_script)
