# Dynamo custom node Select based on a single builtin name.dyf (Dynamo 2.6.2.15705)
# category: Bakery.Revit.Selection
# use with List.Map for input of Built In Name list

builtinName = Input(builtinName: var[]..[])
python_script = Python(IN[0]=builtinName)
# ---------- python_script.python (36 lines) ----------
#LSJ

import clr
clr.AddReference('ProtoGeometry')
from Autodesk.DesignScript.Geometry import *

# Import DocumentManager
clr.AddReference("RevitServices")
import RevitServices
from RevitServices.Persistence import DocumentManager

# Import RevitAPI
clr.AddReference("RevitAPI")
import Autodesk

# Import ToDSType(bool) extension method
clr.AddReference("RevitNodes")
import Revit
from Autodesk.Revit.DB import *
clr.ImportExtensions(Revit.Elements)

import System

builtInName = IN

#The inputs to this node will be stored as a list in the IN variable.
doc = DocumentManager.Instance.CurrentDBDocument
uiapp = DocumentManager.Instance.CurrentUIApplication
app = uiapp.Application

listed = []
try:
	listed.append(FilteredElementCollector(doc).WhereElementIsNotElementType().OfCategory(builtInName[0]).ToElements())
except:
	pass
OUT = listed
# ----------------------------------------
elements = Output(python_script)
