# Dynamo custom node Send Element ID to Clipboard.dyf (Dynamo 1.1.0.2094)
# category: Bakery.Revit.Clipboard
# for single element

element = Input(element : Element)
id = Element.Id(element)
string_from_object = FromObject(id)
sendTo = Custom[Clipboard.SendTo](str=string_from_object)  # Copies a string to the clipboard.
str = Output(sendTo)
