# Dynamo custom node Send List to Clipboard as Single Line Breaked String.dyf (Dynamo 1.2.1.3083)
# category: Bakery.Core.String

original_list = Input()
convert_list_into_list_of = Custom[Convert List into List of Strings with Line Breaks](OriginalList=original_list)
bv_send_to_clipboard_from_revit = Custom[bv Send to Clipboard from Revit](str=convert_list_into_list_of)
to_clipboard = Output(bv_send_to_clipboard_from_revit)
