# Dynamo custom node Set Design Option For List of Views by Parameter Value.dyf (Dynamo 0.8.2.2371)
# category: Bakery.Revit.Views
# matches the DesignOption to the parameter value

viewList = Input()
watch = Watch(viewList)
parameterNameToUse = Input(parameterNameToUse : string)
getParameterValueByName = Element.GetParameterValueByName(element=watch, parameterName=parameterNameToUse)
code_block = CodeBlock { ""; }
eq = getParameterValueByName == code_block
filterByBoolMask = List.FilterByBoolMask(list=watch, mask=eq)
watch_2 = Watch(filterByBoolMask.out)
DesignOptionSetName = Input(DesignOptionSetName : var[]..[])
set_design_option_by_view = Custom[Set Design Option by View Parameter](parameterToUse=parameterNameToUse, DesignOptionSetName=DesignOptionSetName)  # uses a view parameter and sets the design option using that value
map = List.Map(list=watch_2, f_x=set_design_option_by_view)
success = Output(map)  # "success?"
