# Dynamo custom node Set Design Option by View Parameter.dyf (Dynamo 0.8.2.2371)
# category: Bakery.Revit.Views
# uses a view parameter and sets the design option using that value

viewIn = Input()
watch = Watch(viewIn)
DesignOptionSetName = Input()
parameterToUse = Input()
getParameterValueByName = Element.GetParameterValueByName(element=watch, parameterName=parameterToUse)
get_design_option_element_by_set = Custom[Get Design Option Element by Set Name and Option Name](DesignOptionSetName=DesignOptionSetName, DesignOptionName=getParameterValueByName)
setDesignOption = Custom[View.SetDesignOption](View_s=watch, DesignOptions_s=get_design_option_element_by_set)  # Sets the view to a given design option. PLEASE NOTE: This node is kind of hacky. It does not use the design option settings in the visibility / graphic overrides. Instead it sets the view property "Visible in Option" to *one* specific design option - which also means that the symbolic representation of this view is only visible in views that display the given design options.
watch_2 = Watch(setDesignOption.Success)
DidItWork = Output(watch_2)
