# Dynamo custom node Set Discipline Property for Views.dyf (Dynamo 1.2.0.2690)
# category: Bakery.Revit.Views

Views = Input()
turnIntoList = Custom[Turn Into List](unknownItem=Views)  # Turns an element (or a nested list) into a flat list
watch = Watch(turnIntoList)
string = StringInput("Discipline")
ViewDiscipline = Input()
get_view_discipline_code_by_name = Custom[Get View Discipline Code By Name](ViewDiscipline=ViewDiscipline)
watch_2 = Watch(get_view_discipline_code_by_name)
count = Count(watch)
cycle = List.Cycle(list=watch_2, amount=count)
set_list_of_values_to_list_of = Custom[Set List of Values to List of Elements for One Parameter](elementList=watch, parameterNameAsString=string, valuesToSet=cycle)  # as described
ViewsModified = Output(set_list_of_values_to_list_of)
