# Dynamo custom node Set Visible RVT Links to Parameter for Current View.dyf (Dynamo 0.8.2.2371)
# category: Bakery.Revit.Parameters

inputActiveViewAsElement = Input()
targetParameter = Input()
AllElementsInActiveView = Input()
get_revit_link_names_from_an = Custom[Get Revit Link Names from an Element List](ElementList=AllElementsInActiveView)
watch = Watch(get_revit_link_names_from_an)
sort = List.Sort(watch)
string_from_array = FromArray(sort)
code_block = CodeBlock { ","; }
string = StringInput("\n")
replace = String.Replace(str=string_from_array, searchFor=code_block, replaceWith=string)
remove_first_and_last_characters = Custom[Remove First and Last Characters from String](stringIn=replace)
setParameterByName = Element.SetParameterByName(element=inputActiveViewAsElement, parameterName=targetParameter, value=remove_first_and_last_characters)
done = Output(setParameterByName)
LinkNames = Output(remove_first_and_last_characters)
