# Dynamo custom node Set Workset By Name For Elements.dyf (Dynamo 1.2.0.2690)
# category: Bakery.Revit.Document.Worksets

worksets = Custom[Document.Worksets]()  # Returns all Worksets in the current document
watch = Watch(worksets)
element_name_universal = Custom[Element Name Universal](Elements=watch)  # Modified for 0.8.1
worksetName = Input()
firstIndexOf = List.FirstIndexOf(list=element_name_universal, item=worksetName)
getItemAtIndex = List.GetItemAtIndex(list=watch, index=firstIndexOf)
elements = Input()
watch_2 = Watch(elements)
setWorkset = Custom[Element.SetWorkset](workset=getItemAtIndex, element=watch_2)  # Sets the workset of a given element
changedElements = Output(setWorkset.changedElements)
