# Dynamo custom node Show List of Revit Links that are never visible on Sheets.dyf (Dynamo 0.8.2.2371)
# category: Bakery.Revit.Views

report_rvt_links_visible_in = Custom[Report RVT Links Visible in Views on Sheets]()
flatten = Flatten(report_rvt_links_visible_in.rvtLinksVisible)
uniqueItems = List.UniqueItems(flatten)
get_all_revit_links_as_element = Custom[Get All Revit Links as Element List]()
uniqueItems_2 = List.UniqueItems(get_all_revit_links_as_element)
remove_list_from_list_by_item = Custom[Remove List from List by Item not Value](ListOfItemsToRemove=uniqueItems, ListToRemoveFrom=uniqueItems_2)  # remove the items in ListA from the items in ListB and return whats left
isEmpty = List.IsEmpty(remove_list_from_list_by_item.reducedList)
ifFalseThenThereAreUnneededLinks = Output(isEmpty)
watch = Watch(remove_list_from_list_by_item.reducedList)
UnnecessaryLinkInstances = Output(watch)
element_name_universal = Custom[Element Name Universal](Element_s=watch)  # Modified for 0.8.1
UnnecessaryLinkNames = Output(element_name_universal)
