# Dynamo custom node Start View Validation and Info.dyf (Dynamo 0.9.1.4062)
# category: Bakery.Revit.Views
# 1) is there start view set? 2) type 3) name

code_block = CodeBlock { true; }
startingView = Custom[Document.StartingView](toggle=code_block)  # Retrieves the starting view of a Project file. Returns null if no starting view is set.
string = StringInput("Not Set")
replaceNull = Custom[List.ReplaceNull](seq=startingView, replacement=string)  # Replaces all null values within a given list with a substitute
string_from_object = FromObject(replaceNull)
eq = string_from_object == string
type = Custom[View.Type](view=startingView)  # Returns the type of a given view
string_2 = StringInput("Not Set")
replaceNull_2 = Custom[List.ReplaceNull](seq=type, replacement=string_2)
name = Family.Name(startingView)
string_3 = StringInput("Not Set")
replaceNull_3 = Custom[List.ReplaceNull](seq=name, replacement=string_3)
create = List.Create(eq, replaceNull_2, replaceNull_3, replaceNull)
flatten = Flatten(create)
Start_View_Details = Output(flatten)
watch = Watch(eq)
