# Dynamo custom node Subnode to create point from one XYZ sublist.dyf (Dynamo 0.8.2.2392)
# category: Bakery.Geometry.Helper

list = Input(list : var[]..[])
integer_slider = IntegerSlider(0, range=0..100 step 1)
getItemAtIndex = List.GetItemAtIndex(list=list, index=integer_slider)
integer_slider_2 = IntegerSlider(1, range=0..100 step 1)
getItemAtIndex_2 = List.GetItemAtIndex(list=list, index=integer_slider_2)
integer_slider_3 = IntegerSlider(2, range=0..100 step 1)
getItemAtIndex_3 = List.GetItemAtIndex(list=list, index=integer_slider_3)
byCoordinates = Point.ByCoordinates(x=getItemAtIndex, y=getItemAtIndex_2, z=getItemAtIndex_3)
Point = Output(byCoordinates)
