# Dynamo custom node Summary of Empty Parameter by Category.dyf (Dynamo 1.0.0.1180)
# category: Bakery.Revit.Parameters

FamilyInstanceList = Input()
watch = Watch(FamilyInstanceList)
parameterName = Input(parameterName : string)
getParameterValueByName = Element.GetParameterValueByName(element=watch, parameterName=parameterName)
code_block = CodeBlock(x=getParameterValueByName) { x==""; }
watch_2 = Watch(code_block)
get_family_instance_properties = Custom[Get Family Instance Properties](familyInstances=watch)
element_name_universal = Custom[Element Name Universal](Element_s=get_family_instance_properties.categoryObject)  # Modified for 0.8.1
groupByKey = List.GroupByKey(list=watch_2, keys=element_name_universal)
watch_3 = Watch(groupByKey.unique_keys)
categoriesPresent = Output(watch_3)
percentage_of_false_values_in = Custom[Percentage of False Values in Sublists](nestedBooleans=groupByKey.groups)
percentageNotBlank = Output(percentage_of_false_values_in)
