# Dynamo custom node Summary of System Related Elements.dyf (Dynamo 0.8.1.1942)
# category: Bakery.Revit.Elements.Systems
# provides some statistics

elementList = Input()
get_system_related_properties_of = Custom[Get System Related Properties of Element]()  # use with List.Map
map = List.Map(list=elementList, f_x=get_system_related_properties_of.System_Classification)
System_Classifications = Output(map)
uniqueItems = List.UniqueItems(map)
sort = List.Sort(uniqueItems)
System_Classifications_unique = Output(sort)  # "System Classifications (unique)"
map_2 = List.Map(list=elementList, f_x=get_system_related_properties_of.System_Name)
System_Names = Output(map_2)
map_3 = List.Map(list=elementList, f_x=get_system_related_properties_of.System_Type)
System_Types = Output(map_3)
