# Dynamo custom node Super Collect Elements from Document.dyf (Dynamo 1.3.2.2480)
# category: Bakery.Revit.Selection
# tries to collect elements from all builtin categories

builtInNameList = Input()
DOC = Input()
python_script = Python(IN[0]=builtInNameList, IN[1]=DOC)
# ---------- python_script.python (47 lines) ----------
#LSJ

import clr
clr.AddReference('ProtoGeometry')
from Autodesk.DesignScript.Geometry import *

# Import DocumentManager
clr.AddReference("RevitServices")
import RevitServices
from RevitServices.Persistence import DocumentManager

# Import RevitAPI
clr.AddReference("RevitAPI")
import Autodesk

# Import ToDSType(bool) extension method
clr.AddReference("RevitNodes")
import Revit
from Autodesk.Revit.DB import *
clr.ImportExtensions(Revit.Elements)

import System

builtInNames = IN[0]
docToUse = IN[1]

#The inputs to this node will be stored as a list in the IN variable.
doc = docToUse
uiapp = DocumentManager.Instance.CurrentUIApplication
app = uiapp.Application

listed = []
countelems = []
boolfil = []
for i in builtInNames:
	try:
		listed.append(FilteredElementCollector(doc).WhereElementIsNotElementType().OfCategory(i).ToElements())
	except:
		listed.append("Category_failure")
for c in listed:
	countelems.append(len(c))
for z in countelems:
	if z == 0:
		boolfil.append(False)
	else:
		boolfil.append(True)
OUT = listed, countelems, boolfil
# ----------------------------------------
code_block = CodeBlock { 1; }
getItemAtIndex = List.GetItemAtIndex(list=python_script, index=code_block)
all_category_element_counts = Output(getItemAtIndex)
code_block_2 = CodeBlock { 0; }
getItemAtIndex_2 = List.GetItemAtIndex(list=python_script, index=code_block_2)
all_category_elements = Output(getItemAtIndex_2)
code_block_3 = CodeBlock { 2; }
getItemAtIndex_3 = List.GetItemAtIndex(list=python_script, index=code_block_3)
watch = Watch(getItemAtIndex_3)
filterByBoolMask = List.FilterByBoolMask(list=getItemAtIndex_2, mask=watch)
found_elements_only = Output(filterByBoolMask.in)
filterByBoolMask_2 = List.FilterByBoolMask(list=builtInNameList, mask=watch)
found_builtInNames = Output(filterByBoolMask_2.in)
true_if_elements_found = Output(watch)
watch_2 = Watch(filterByBoolMask_2.in)
flat_list_to_list_of_strings = Custom[Flat List to List of Strings](Original_List=watch_2)  # using python methods
convert_builtin_category_name_to = Custom[Convert Builtin Category Name to Normal Name]()  # unwired: builtInNameStrings
map = List.Map(list=flat_list_to_list_of_strings, f_x=convert_builtin_category_name_to)
flatten = Flatten(map)
found_CategoryNames = Output(flatten)
flatten_2 = Flatten(filterByBoolMask.in)
elements_flat_list = Output(flatten_2)
python_output = Output(python_script)
