# Dynamo custom node To Float.dyf "CameraDataToPoint" (Dynamo 2.3.1.11775)
# category: Bakery.Construction.Revizto
# takes one camera cell and makes a point

ReviztoCameraData = Input(ReviztoCameraData: var[]..[])

# group: unpack position
watch = Watch(ReviztoCameraData)
string = StringInput("\"position\"")
allIndicesOf = String.AllIndicesOf(str=watch, searchFor=string)
firstItem = List.FirstItem(list=allIndicesOf)
string_2 = StringInput("\"position_bind\"")
allIndicesOf_2 = String.AllIndicesOf(str=watch, searchFor=string_2)
firstItem_2 = List.FirstItem(list=allIndicesOf_2)
code_block = CodeBlock(x=firstItem_2, y=firstItem) { x-y; }
substring = String.Substring(str=watch, startIndex=firstItem, length=code_block)

# group: get X
watch_2 = Watch(substring)
string_3 = StringInput("\"x\"")
allIndicesOf_3 = String.AllIndicesOf(str=watch_2, searchFor=string_3)
firstItem_3 = List.FirstItem(list=allIndicesOf_3)
string_4 = StringInput(",")
allIndicesOf_4 = String.AllIndicesOf(str=watch_2, searchFor=string_4)
firstItem_4 = List.FirstItem(list=allIndicesOf_4)
code_block_2 = CodeBlock(x=firstItem_4, y=firstItem_3) { x-y; }
substring_2 = String.Substring(str=watch_2, startIndex=firstItem_3, length=code_block_2)

# group: scale X
string_5 = StringInput(":")

boolean = BoolSelector(false)

# group: remove prior to char
watch_3 = Watch(substring_2)
indexOf = String.IndexOf(str=watch_3, searchFor=string_5, ignoreCase=boolean)
code_block_3 = CodeBlock(in1=indexOf) { in2=in1; in2*-1-1; }
code_block_4 = CodeBlock { 0; }
eq = code_block_3.in2 == code_block_4
if_ = If(test=eq, true=code_block_4, false=code_block_3.out1)
remove = String.Remove(str=watch_3, startIndex=code_block_3.in2, count=if_)

# group (continued): scale X
watch_4 = Watch(remove)

# group: to float
python_script = Python(IN[0]=watch_4)
# ---------- python_script.python (9 lines) ----------
import clr
clr.AddReference('ProtoGeometry')
from Autodesk.DesignScript.Geometry import *
import math
#The inputs to this node will be stored as a list in the IN variables.
temp = IN[0]
tostr = str(temp)
#Assign your output to the OUT variable.
OUT = float(tostr)
# ----------------------------------------

watch_5 = Watch(python_script)

# group: some necessary scaling
code_block_5 = CodeBlock { -304.8; }
code_block_6 = CodeBlock { -1; }

# group: scaling to mm
code_block_7 = CodeBlock(x=watch_5, y=code_block_5) { x*y; }

watch_6 = Watch(code_block_7)

# group: negative x
code_block_8 = CodeBlock(x=watch_6, y=code_block_6) { x*y; }

watch_7 = Watch(code_block_8)

# group: string cleanup
length = String.Length(str=string)
length_2 = String.Length(str=string_3)
length_3 = String.Length(str=watch_4)
code_block_9 = CodeBlock { 4; }
code_block_10 = CodeBlock(x=length, y=length_2, z=length_3, a=code_block_9) { x+y+z+a; }

# group: remove already used part
code_block_11 = CodeBlock { 0; }
remove_2 = String.Remove(str=watch_2, startIndex=code_block_11, count=code_block_10)
watch_8 = Watch(remove_2)

# group: get Z
watch_9 = Watch(watch_8)
string_6 = StringInput("\"z\"")
allIndicesOf_5 = String.AllIndicesOf(str=watch_9, searchFor=string_6)
firstItem_5 = List.FirstItem(list=allIndicesOf_5)
string_7 = StringInput("}")
allIndicesOf_6 = String.AllIndicesOf(str=watch_9, searchFor=string_7)
firstItem_6 = List.FirstItem(list=allIndicesOf_6)
code_block_12 = CodeBlock(x=firstItem_6, y=firstItem_5) { x-y; }
substring_3 = String.Substring(str=watch_9, startIndex=firstItem_5, length=code_block_12)

# group: remove prior to char
watch_10 = Watch(substring_3)
indexOf_2 = String.IndexOf(str=watch_10, searchFor=string_5, ignoreCase=boolean)
code_block_13 = CodeBlock(in1=indexOf_2) { in2=in1; in2*-1-1; }
code_block_14 = CodeBlock { 0; }
eq_2 = code_block_13.in2 == code_block_14
if_2 = If(test=eq_2, true=code_block_14, false=code_block_13.out1)
remove_3 = String.Remove(str=watch_10, startIndex=code_block_13.in2, count=if_2)

# group: scale Z
watch_11 = Watch(remove_3)

# group: to float
python_script_2 = Python(IN[0]=watch_11)  # same code as python_script

# group (continued): scale Z
code_block_15 = CodeBlock(x=python_script_2, y=code_block_5) { x*y; }

watch_12 = Watch(code_block_15)

# group: Gets Location in relation to Revits origin
surveyPoint = Coordinates.SurveyPoint()
byOrigin = CoordinateSystem.ByOrigin(origin=surveyPoint)

watch_13 = Watch(byOrigin)
watch_14 = Watch(surveyPoint)

# group: Get project base point data
categories = Categories("OST_ProjectBasePoint")  # graph input
all_elements_of_category = ElementsOfCategory(Category=categories)
code_block_16 = CodeBlock()
# ---------- code_block_16.designscript (2 lines) ----------
["E/W","N/S","Elev",
"Angle to True North"];
# ----------------------------------------
getParameterValueByName = Element.GetParameterValueByName(element=all_elements_of_category, parameterName=code_block_16, lacing=Longest)
code_block_17 = CodeBlock(bp=getParameterValueByName) { bp[0]; bp[1]; bp[2]; bp[3]; }

watch_15 = Watch(code_block_17.out3)

# group: Rotates coordinate system to match north point rotation.
ZAxis = Vector.ZAxis()
rotate = CoordinateSystem.Rotate(coordinateSystem=watch_13, origin=watch_14, axis=ZAxis, degrees=watch_15)

# group: This is the location of revits origin 0,0,0
identity = CoordinateSystem.Identity()

watch_16 = Watch(identity)

# group: gets model origin, converts to survey coordinates and extracts x /y values
byCoordinates = Point.ByCoordinates(x=watch_7, y=watch_12)
transform = Geometry.Transform(geometry=byCoordinates, fromCoordinateSystem=rotate, contextCoordinateSystem=watch_16)
X = Point.X(point=transform)
Y = Point.Y(point=transform)

watch_17 = Watch(X)

# group: negative
code_block_18 = CodeBlock(x=watch_17, y=code_block_6) { x*y; }

watch_18 = Watch(code_block_18)
watch_19 = Watch(Y)

# group: remove already used part
code_block_19 = CodeBlock { 0; }
remove_4 = String.Remove(str=watch_2, startIndex=code_block_19, count=code_block_10)
watch_20 = Watch(remove_4)

# group: get Y
watch_21 = Watch(watch_20)
string_8 = StringInput("\"y\"")
allIndicesOf_7 = String.AllIndicesOf(str=watch_21, searchFor=string_8)
firstItem_7 = List.FirstItem(list=allIndicesOf_7)
string_9 = StringInput(",")
allIndicesOf_8 = String.AllIndicesOf(str=watch_21, searchFor=string_9)
firstItem_8 = List.FirstItem(list=allIndicesOf_8)
code_block_20 = CodeBlock(x=firstItem_8, y=firstItem_7) { x-y; }
substring_4 = String.Substring(str=watch_21, startIndex=firstItem_7, length=code_block_20)

# group: remove prior to char
watch_22 = Watch(substring_4)
indexOf_3 = String.IndexOf(str=watch_22, searchFor=string_5, ignoreCase=boolean)
code_block_21 = CodeBlock(in1=indexOf_3) { in2=in1; in2*-1-1; }
code_block_22 = CodeBlock { 0; }
eq_3 = code_block_21.in2 == code_block_22
if_3 = If(test=eq_3, true=code_block_22, false=code_block_21.out1)
remove_5 = String.Remove(str=watch_22, startIndex=code_block_21.in2, count=if_3)

# group: scale Y
watch_23 = Watch(remove_5)

# group: to float
python_script_3 = Python(IN[0]=watch_23)  # same code as python_script

# group (continued): scale Y
code_block_23 = CodeBlock(x=python_script_3, y=code_block_5) { x*y; }

# group: negative y
code_block_24 = CodeBlock(x=code_block_23, y=code_block_6) { x*y; }

watch_24 = Watch(code_block_24)
byCoordinates_2 = Point.ByCoordinates(x=watch_18, y=watch_19, z=watch_24)
Point = Output(byCoordinates_2)

# group: negative y
code_block_25 = CodeBlock(x=code_block_15, y=code_block_6) { x*y; }
