# Dynamo custom node To Int with Replacement.dyf (Dynamo 1.3.4.6666)
# category: Bakery.Core.Math

listIn = Input()
replacementValue = Input()
python_script = Python(IN[0]=listIn, IN[1]=replacementValue)
# ---------- python_script.python (17 lines) ----------
import clr
clr.AddReference('ProtoGeometry')
from Autodesk.DesignScript.Geometry import *
#The inputs to this node will be stored as a list in the IN variables.
dataEnteringNode = IN[0]
replace = IN[1]
intlist = []
for x in dataEnteringNode:
	try:
		if int(x)>0:
			intlist.append(int(x))
		else:
			intlist.append(replace)
	except:
		intlist.append(replace)
#Assign your output to the OUT variable.
OUT = intlist
# ----------------------------------------
ints = Output(python_script)
