# Dynamo custom node Translate Points on Curve by Average Vector.dyf (Dynamo 1.2.0.2690)
# category: Bakery.Construction.Civil

points = Input()
curve = Input()
parameterAtPoint = Curve.ParameterAtPoint(curve=curve, point=points)
normalAtParameter = Curve.NormalAtParameter(curve=curve, param=parameterAtPoint)
flat_list_to_list_of_strings = Custom[Flat List to List of Strings](Original_List=normalAtParameter@L2)  # using python methods
string = StringInput(" = -")
contains = String.Contains(str=flat_list_to_list_of_strings, searchFor=string, lacing=Longest)
flatten = Flatten(contains)
filterByBoolMask = List.FilterByBoolMask(list=normalAtParameter, mask=flatten)
average = Custom[Vector.Average](vectors=filterByBoolMask.out)  # Determines the average vector of a list of vectors
distanceMayBeNegative = Input()
translate = Geometry.Translate(geometry=points, direction=average, distance=distanceMayBeNegative)
Geometry = Output(translate)
