# Dynamo custom node Transpose Data within Excel Sheet.dyf (Dynamo 0.8.0.706)
# category: Bakery.Office.Excel
# uses same excel sheet

Excel_file_path = Input()
write = Input()
number_slider = DoubleSlider(0, range=0..100 step 0.1)
fromPath = FileObject(Excel_file_path)  # "File.FromPath"
read = Input()
readFromFile = Excel.ReadFromFile(fromPath, read)
transpose = List.Transpose(readFromFile)
writeToFile = Excel.WriteToFile(Excel_file_path, write, number_slider, number_slider, transpose)
