# Dynamo custom node Two Lists into One Replacing Nulls with Backup Values.dyf (Dynamo 0.8.2.2371)
# category: Bakery.Core.List

primary_list_to_clean = Input()
watch = Watch(primary_list_to_clean)
code_block = CodeBlock { null; }
bv_all_indices_of_that_can = Custom[bv All Indices Of that can handle Nulls](list=watch, value=code_block)  # forked from spring nodes
backup_list_used_for_null_replacement = Input()
watch_2 = Watch(backup_list_used_for_null_replacement)
getItemAtIndex = List.GetItemAtIndex(list=watch_2, index=bv_all_indices_of_that_can)
replaceItemAtIndex = Custom[List.ReplaceItemAtIndex](seq=watch, index=bv_all_indices_of_that_can, replacement=getItemAtIndex)  # Replaces the item at a given index (or list of indices) of a list by another item
cleaned_list = Output(replaceItemAtIndex)
