# Dynamo custom node Unpack Dimension Values from String.dyf (Dynamo 0.9.2.4472)
# category: Bakery.Revit.API.MEP
# part of penetration family workflow

singleString = Input()
string_from_object = FromObject(singleString)
trimLeadingWhitespace = String.TrimLeadingWhitespace(string_from_object)
string = StringInput(" ")
boolean = BoolSelector(true)
bv_remove_from_string_after = Custom[bv Remove from String after Character](str=trimLeadingWhitespace, Character=string, ignoreCase=boolean)  # forked from Rhythm
string_2 = StringInput("+")
boolean_2 = BoolSelector(true)
bv_remove_from_string_after_2 = Custom[bv Remove from String after Character](str=bv_remove_from_string_after, Character=string_2, ignoreCase=boolean_2)
string_3 = StringInput("?")
boolean_3 = BoolSelector(true)
bv_remove_from_string_after_3 = Custom[bv Remove from String after Character](str=bv_remove_from_string_after_2, Character=string_3, ignoreCase=boolean_3)
string_4 = StringInput("F")
boolean_4 = BoolSelector(true)
bv_remove_from_string_after_4 = Custom[bv Remove from String after Character](str=bv_remove_from_string_after_3, Character=string_4, ignoreCase=boolean_4)
watch = Watch(bv_remove_from_string_after_4)

# group: diameter
string_5 = StringInput("d")
boolean_5 = BoolSelector(true)
endsWith = String.EndsWith(watch, string_5, boolean_5)
watch_2 = Watch(endsWith)
removeAfterGivenCharacter = Custom[String.RemoveAfterGivenCharacter](str=watch, Character=string_5, ignoreCase=boolean_5)  # This will move all characters at and after the given character.
turnIntoList = Custom[TurnIntoList](unknownItem=removeAfterGivenCharacter)  # Turns an element (or a nested list) into a flat list
switch = Custom[Switch](boolean_switch=watch_2, data=turnIntoList)
firstItem = List.FirstItem(switch)
watch_3 = Watch(firstItem)

to_float = Custom[To Float](unknown=watch)  # converts input object to a float with python
watch_4 = Watch(to_float)
replaceNulls = Lists.Manage.ReplaceNulls(watch_3, watch_4)
replaceNullsWith = Input()
replaceNulls_2 = Lists.Manage.ReplaceNulls(replaceNulls, replaceNullsWith)
watch_5 = Watch(replaceNulls_2)
to_float_2 = Custom[To Float](unknown=watch_5)
diameter = Output(to_float_2)

# group: width and height
string_6 = StringInput("x")
split = String.Split(watch, string_6)
string_7 = StringInput("X")
split_2 = String.Split(watch, string_7)
create = List.Create(split, split_2)
count = Count(split)
count_2 = Count(split_2)
create_2 = List.Create(count, count_2)
code_block = CodeBlock { 2; }
eq = create_2 == code_block
filterByBoolMask = List.FilterByBoolMask(list=create, mask=eq)
flatten = Flatten(filterByBoolMask.in)
watch_6 = Watch(flatten)

code_block_2 = CodeBlock { 0; }
getItemAtIndex = List.GetItemAtIndex(list=watch_6, index=code_block_2)
replaceNulls_3 = Lists.Manage.ReplaceNulls(getItemAtIndex, replaceNullsWith)
to_float_3 = Custom[To Float](unknown=replaceNulls_3)
width = Output(to_float_3)
code_block_3 = CodeBlock { 1; }
getItemAtIndex_2 = List.GetItemAtIndex(list=watch_6, index=code_block_3)
replaceNulls_4 = Lists.Manage.ReplaceNulls(getItemAtIndex_2, replaceNullsWith)
to_float_4 = Custom[To Float](unknown=replaceNulls_4)
height = Output(to_float_4)
watch_7 = Watch(getItemAtIndex_2)
watch_8 = Watch(getItemAtIndex)
watch_9 = Watch(replaceNulls_4)
cleanedString = Output(watch)
code_block_4 = CodeBlock(x=to_float_2, y=to_float_3, z=to_float_4) { x+y+z; }
to_float_5 = Custom[To Float](unknown=replaceNullsWith)
code_block_5 = CodeBlock(k=to_float_5) { k*3; }
eq_2 = code_block_4 == code_block_5
boolean_to_int = Custom[Boolean to Int](item=eq_2)  # 0 false, 1 true
dimensionFailureIfOne = Output(boolean_to_int)
code_block_6 = CodeBlock(y=to_float_3, z=to_float_4) { y+z; }
code_block_7 = CodeBlock(k=to_float_5) { k*2; }
eq_3 = code_block_6 == code_block_7
boolean_to_int_2 = Custom[Boolean to Int](item=eq_3)
UseDiameterIfOne = Output(boolean_to_int_2)
