# Dynamo custom node Unpack Three Sublists.dyf (Dynamo 1.2.0.2831)
# category: Bakery.Core.List

list = Input(list : var[]..[])
code_block = CodeBlock { 0; }
getItemAtIndex = List.GetItemAtIndex(list=list, index=code_block)
zero = Output(getItemAtIndex)
code_block_2 = CodeBlock { 2; }
getItemAtIndex_2 = List.GetItemAtIndex(list=list, index=code_block_2)
two = Output(getItemAtIndex_2)
code_block_3 = CodeBlock { 1; }
getItemAtIndex_3 = List.GetItemAtIndex(list=list, index=code_block_3)
one = Output(getItemAtIndex_3)
