# Dynamo custom node Unused Families.dyf (Dynamo 0.9.2.4472)
# category: Bakery.Revit.Elements.Family

# group: Get Placed instances and types
collect_all_familyinstance_using = Custom[Collect all FamilyInstance using Element Types]()  # should get model family instances
type = FamilyInstance.Type(collect_all_familyinstance_using)
flatten = Flatten(type)

# group: Get family types in project
get_family_list_for_this_project = Custom[Get Family List for this project]()
types = Family.Types(get_family_list_for_this_project)
flatten_2 = Flatten(types)

# group: Remove the placed ones...
remove_list_from_list_by_item = Custom[Remove List from List by Item not Value](ListOfItemsToRemove=flatten, ListToRemoveFrom=flatten_2)  # remove the items in ListA from the items in ListB and return whats left

watch = Watch(remove_list_from_list_by_item.reducedList)

# group: Get parent families
family = FamilyType.Family(watch)
uniqueItems = List.UniqueItems(family)

elements = Output(uniqueItems)
