# Dynamo custom node Useful Text Note Properties.dyf (Dynamo 1.0.0.1180)
# category: Bakery.Revit.Elements.Properties

Element_s = Input()  # "Element(s)"
turnIntoList = Custom[Turn Into List](unknownItem=Element_s)  # Turns an element (or a nested list) into a flat list
python_script = Python(IN[0]=turnIntoList)
# ---------- python_script.python (13 lines) ----------
import clr
clr.AddReference('RevitAPI')
from Autodesk.Revit.DB import *

textnotes = UnwrapElement(IN[0])
elementlist, coords = [], []
for item in textnotes:
	try:
		elementlist.append(item.Text)
		coords.append(item.Coord)
	except:
		elementlist.append(list())
OUT = elementlist, coords
# ----------------------------------------
code_block = CodeBlock { 0; }
getItemAtIndex = List.GetItemAtIndex(list=python_script, index=code_block)
Text_s = Output(getItemAtIndex)  # "Text(s)"
code_block_2 = CodeBlock { 1; }
getItemAtIndex_2 = List.GetItemAtIndex(list=python_script, index=code_block_2)
Coords = Output(getItemAtIndex_2)
ownerView = Custom[Element.OwnerView](element=turnIntoList)  # Gets the owner view of a given Revit element (if possible)
OwnerView = Output(ownerView)
