# Dynamo custom node View Statistics.dyf (Dynamo 0.8.1.1942)
# category: Bakery.Revit.Document
# some key view details

get_all_views = Custom[Get All Views]()  # This node will query all views in the model and return them based on category
create = List.Create(get_all_views.Renderings)
create_2 = List.Create(get_all_views.Pressure_Loss_Reports)
create_3 = List.Create(get_all_views.Panel_Schedules)
create_4 = List.Create(get_all_views.Walkthroughs)
create_5 = List.Create(get_all_views.Elevations)
create_6 = List.Create(get_all_views.Drafting_Views)
create_7 = List.Create(get_all_views.Undefined_Views)
create_8 = List.Create(get_all_views.Details)
create_9 = List.Create(get_all_views.Loads_Reports)
create_10 = List.Create(get_all_views.Cost_Reports)
create_11 = List.Create(get_all_views.Legends)
create_12 = List.Create(get_all_views.3D_Views)
create_13 = List.Create(get_all_views.Column_Schedules)
create_14 = List.Create(get_all_views.Internal_Views)
create_15 = List.Create(get_all_views.Sections)
create_16 = List.Create(get_all_views.Ceiling_Plans)
create_17 = List.Create(get_all_views.Floor_Plans)
create_18 = List.Create(get_all_views.Area_Plans)
create_19 = List.Create(get_all_views.Engineering_Plans)
create_20 = List.Create(get_all_views.Reports)
create_21 = List.Create(create, create_2, create_3, create_4, create_5, create_6, create_7, create_8, create_9, create_10, create_11, create_12, create_13, create_14, create_15, create_16, create_17, create_18, create_19, create_20)
flatten = Flatten(create_21)
count = List.Count(flatten)
Total_Number_of_Views_excluding_Schedule = Output(count)  # "Total Number of Views excluding Schedules"
create_22 = List.Create(get_all_views.Schedules)
flatten_2 = Flatten(create_22)
count_2 = List.Count(flatten_2)
Total_Number_of_Schedules = Output(count_2)
element_name_universal = Custom[Element.Name (Universal)](Element_s=flatten)  # Gets an element's name (Dynamo's built-in Name nodes don't work for all element types, e.g. worksets...)
List_of_View_Names = Output(element_name_universal)
element_name_universal_2 = Custom[Element.Name (Universal)](Element_s=flatten_2)
List_of_All_Schedules = Output(element_name_universal_2)
watch = Watch(element_name_universal_2)
flat_list_to_list_of_strings = Custom[Flat List to List of Strings](Original_List=watch)  # using python methods
code_block = CodeBlock { "Revision Schedule"; }
code_block_2 = CodeBlock { true; }
contains = String.Contains(str=flat_list_to_list_of_strings, searchFor=code_block, ignoreCase=code_block_2)
watch_2 = Watch(contains)
filterByBoolMask = List.FilterByBoolMask(list=flatten_2, mask=watch_2)
count_3 = List.Count(filterByBoolMask.out)
Num_Schedules_excluding_Revision_Schedul = Output(count_3)  # "Num Schedules excluding Revision Schedules"
List_of_Normal_Schedules = Output(filterByBoolMask.out)
List_of_Views_as_Elements = Output(flatten)
