# Dynamo custom node Wait Then Passthrough.dyf (Dynamo 1.2.1.3083)
# category: Bakery.Dynamo.Flow

anyData = Input()
secondsToWait = Input()
python_script = Python(IN[0]=anyData, IN[1]=secondsToWait)
# ---------- python_script.python (14 lines) ----------
import clr
clr.AddReference('ProtoGeometry')
from Autodesk.DesignScript.Geometry import *
#The inputs to this node will be stored as a list in the IN variable.
import time

dataEnteringNode = IN
data = IN[0]
sec = IN[1]

time.sleep(sec)

#Assign your output to the OUT variable
OUT = data
# ----------------------------------------
anyData_2 = Output(python_script)  # "anyData"
