# Dynamo custom node Write Empty Linked Tag Information to Excel.dyf (Dynamo 0.8.2.2371)
# category: Bakery.Revit.Elements.Tag

filePath = Input(filePath : string)
sheetName = Input(sheetName : string)
code_block = CodeBlock { 0; }
code_block_2 = CodeBlock { "Tag Ids"; }
elems = Input()
watch = Watch(elems)
id = Element.Id(watch)
addItemToFront = List.AddItemToFront(item=code_block_2, list=id)
code_block_3 = CodeBlock { "Found In View"; }
ownerView = Custom[Element.OwnerView](element=watch)  # Gets the owner view of a given Revit element (if possible)
addItemToFront_2 = List.AddItemToFront(item=code_block_3, list=ownerView)
code_block_4 = CodeBlock { "On Sheet Number"; }
code_block_5 = CodeBlock { "Sheet Number"; }
getParameterValueByName = Element.GetParameterValueByName(element=ownerView, parameterName=code_block_5)
addItemToFront_3 = List.AddItemToFront(item=code_block_4, list=getParameterValueByName)
code_block_6 = CodeBlock { "Ref This Link"; }
linkNames = Input()
watch_2 = Watch(linkNames)
addItemToFront_4 = List.AddItemToFront(item=code_block_6, list=watch_2)
code_block_7 = CodeBlock { "Type"; }
types = Input()
watch_3 = Watch(types)
addItemToFront_5 = List.AddItemToFront(item=code_block_7, list=watch_3)
code_block_8 = CodeBlock { "Element Ids in Link"; }
elemInfo = Input()
watch_4 = Watch(elemInfo)
addItemToFront_6 = List.AddItemToFront(item=code_block_8, list=watch_4)
create = List.Create(addItemToFront, addItemToFront_2, addItemToFront_3, addItemToFront_4, addItemToFront_5, addItemToFront_6)
transpose = List.Transpose(create)
writeToFile = Excel.WriteToFile(filePath=filePath, sheetName=sheetName, startRow=code_block, startCol=code_block, data=transpose)
data = Output(writeToFile)
