# Dynamo custom node Write Room Numbers and Location Points to Excel.dyf (Dynamo 0.9.2.4472)
# category: Bakery.Revit.Elements.Room

filePath = Input(filePath : string)
SearchLinkNamesForRooms = Input(SearchLinkNamesForRooms : var[]..[])

# group: Get Room and Room Number
string = StringInput("Rooms")
convert_category_name_to_built = Custom[Convert Category Name to Built In Category Name](categoryNameOrNames=string)  # You must use List.Map to convert list of Category Names to list of Built In Names
get_elements_in_link_using_name = Custom[Get Elements in Link using Name Search and Category](SearchLinkNames=SearchLinkNamesForRooms, DesiredCategoryBuiltInName=convert_category_name_to_built)  # link name search
watch = Watch(get_elements_in_link_using_name.ElementsFlatList)
string_2 = StringInput("Number")
getParameterValueByName = Element.GetParameterValueByName(element=watch, parameterName=string_2)
watch_2 = Watch(getParameterValueByName)

# group: Room locations
watch_3 = Watch(watch)
location = Custom[Element.Location](element=watch_3)  # Returns the location of an element as an XYZ (or if it's line-based the start and end point of the line), along with some booleans to help filtering the results. Use this for some element types (e.g. walls or lines) that do not work with the built-in Get Family Instance Location node.

pt2Str = Custom[Pt2Str](point=location.points)  # Serilize a geometry point to a string for use in Revit parameters

# group (continued): Room locations
watch_4 = Watch(pt2Str)

# group: Room locations to Excel
string_3 = StringInput("Room Number")
flat_list_to_list_of_strings = Custom[Flat List to List of Strings](Original_List=watch_2)  # using python methods
addItemToFront = List.AddItemToFront(item=string_3, list=flat_list_to_list_of_strings)
string_4 = StringInput("Room Location Point")
flat_list_to_list_of_strings_2 = Custom[Flat List to List of Strings](Original_List=watch_4)
addItemToFront_2 = List.AddItemToFront(item=string_4, list=flat_list_to_list_of_strings_2)
create = List.Create(addItemToFront, addItemToFront_2)
transpose = List.Transpose(create)
write_to_excel_using_only_data = Custom[Write to Excel using only Data and File Path Inputs](filePath=filePath, data=transpose)  # will overwrite and use Sheet1

done = Output(write_to_excel_using_only_data)
