# Dynamo custom node Write SQL File From Data.dyf (Dynamo 1.3.3.4651)
# category: Bakery.Data.Database

data = Input()
columnNameList = Input()
databaseName = Input()
tableName = Input()
switch = Input()
directoryPath = Input()
SQL_filename_part1 = Input()
SQL_filename_part2 = Input()
python_script = Python(IN[0]=data, IN[1]=columnNameList, IN[2]=databaseName, IN[3]=tableName, IN[4]=switch, IN[5]=directoryPath, IN[6]=SQL_filename_part1, IN[7]=SQL_filename_part2)
# ---------- python_script.python (171 lines) ----------
import clr
#clr.AddReference('ProtoGeometry')
#from Autodesk.DesignScript.Geometry import *

# Import RevitAPI
#clr.AddReference("RevitAPI")
#import Autodesk
#from Autodesk.Revit.DB import *

#clr.AddReference("RevitServices")
#import RevitServices
#from RevitServices.Persistence import DocumentManager
#from RevitServices.Transactions import TransactionManager

#from System.Collections.Generic import *

#clr.AddReference('RevitNodes')
#import Revit
#clr.ImportExtensions(Revit.Elements)
#clr.ImportExtensions(Revit.GeometryConversion)

from System import Guid

import System
from System.IO import Directory, Path

import sys
pyt_path = r'C:\Program Files (x86)\IronPython 2.7\Lib'
sys.path.append(pyt_path)

import os
import datetime, time

#doc = DocumentManager.Instance.CurrentDBDocument
#uiapp = DocumentManager.Instance.CurrentUIApplication
#app = uiapp.Application

debugmode = IN[4]
namepartOne = IN[6]
namepartTwo = IN[7]

def SplitterBIP(instring):
	stringlist = instring.split(" - ")
	firstout = stringlist[0]
	return firstout

def DoubleBackslashes(instring):
	fixedstring = instring.Replace("\\", r"\\")
	return fixedstring

def EscapeStringQuotes(instring):

	escapedstring = instring.Replace("'", r"\'")
	escapedstring = escapedstring.Replace('"', r'\"')
	escapedstring = escapedstring.Replace('á', r'a')
	escapedstring = escapedstring.Replace('‐', r'-')
	escapedstring = escapedstring.Replace('°', r'd')
	escapedstring = escapedstring.Replace('Ø', r'dia.')
	escapedstring = escapedstring.Replace('×', r'x')
	escapedstring = escapedstring.Replace('±', r'tol.')
	#escapedstring = escapedstring.Replace('-', r'-')
	escapedstring = escapedstring.Replace('–', r'-')
	escapedstring = escapedstring.Replace('®', '')
	escapedstring = escapedstring.Replace('Ã', '')
	escapedstring = escapedstring.Replace('—', r'-')
	escapedstring = escapedstring.Replace('ø', r'dia.')
#	escapedstring = escapedstring.Replace(' ', r' ')
	escapedstring = escapedstring.Replace('﻿', '')
	escapedstring = escapedstring.Replace(' ', ' ')
	escapedstring = escapedstring.Replace(' ', ' ')
	escapedstring = escapedstring.Replace(' ', ' ')
	escapedstring = escapedstring.Replace(' ', ' ')
	escapedstring = escapedstring.Replace(' ', ' ')
	escapedstring = escapedstring.Replace(' ', ' ')
	escapedstring = escapedstring.Replace(' ', ' ')
#	escapedstring = escapedstring.Replace(' ', ' ')
#	escapedstring = escapedstring.Replace(' ', ' ')
#	escapedstring = escapedstring.Replace(u'\U+0020', ' ')
#	escapedstring = escapedstring.Replace('​', ' ')
#	escapedstring = escapedstring.Replace(' ', ' ')
	escapedstring = escapedstring.Replace('É', r'E')
#	escapedstring = escapedstring.Replace('é', r'e')​​
	try:
		escapedstring.decode('utf-8')
	except:
		escapedstring = "StringConversionFailure"
	return escapedstring

t = time.localtime()
timestamp = time.strftime('%b-%d-%Y_%H%M', t)

outerlist = []

mydbname = IN[2]
mytablename = IN[3]
mycolumnlist = IN[1]
debugmode = IN[4]
outdir = IN[5]
mydatalists = IN[0]
successlist = []

longlist = []
for mydatalist in mydatalists:
	columnstringlist = '`' + ('`, `'.join(mycolumnlist)) + '`'
	datastringlist = []
	for i in mydatalist:
		temp = EscapeStringQuotes(str(i))
		datastringlist.append("'%s'" % temp)
	datastringlistq = ', '.join(datastringlist)
	joinlist = []
	joinlist.append("INSERT IGNORE INTO ")
	joinlist.append(mydbname)
	joinlist.append(".")
	joinlist.append(mytablename)
	joinlist.append(" (")
	joinlist.append(columnstringlist)
	joinlist.append(") VALUES (")
	joinlist.append(datastringlistq)
	joinlist.append(");")
	joined = ''.join(joinlist)
	longlist.append(joined)
	
#DECODE TEST FOR WEIRD CHARACTERS
decodetest = []
for d in longlist:
	try:
		d.decode('utf-8')
	except:
		decodetest.append(d)
		successlist.append(decodetest)
		with open(outfile, 'w') as f:
			f.write(d)
#OUT = decodetest
try:
	stringoutput = '\n'.join(x.decode('utf-8') for x in longlist)
except:
	successlist.append("string join failure")
	outerlist.append(successlist)

errorlogger = []
try:
	stringoutput = "\n".join(map(str, longlist))
except:
	stringoutput = "Data join has failed, likely due to a decode error"
	errorlogger.append("Decode error")
	successlist.append(errorlogger)
	successlist.append("string join failure number two")
	outerlist.append(successlist)

dirlist = []
dirlist.append(str(outdir))
dirlist.append("\\")
dirlist.append(namepartOne)
dirlist.append("_")
dirlist.append(namepartTwo)
dirlist.append("_")
dirlist.append(timestamp)
dirlist.append(".sql")
outfile = ''.join(map(str, dirlist))
stringdebug = []
if debugmode:
	with open(outfile, 'w') as f:
		f.write(stringoutput)
	successlist.append("The SQL file was written")
else:
	stringdebug.append(stringoutput)

outerlist.append(successlist)
outerlist.append(longlist)

OUT = outerlist
# ----------------------------------------
done = Output(python_script)
