# Dynamo custom node Write Shared Parameter Check to Excel.dyf (Dynamo 0.8.2.2371)
# category: Bakery.Revit.Parameters

filePath = Input(filePath : string)
sheetName = Input(sheetName : string)
code_block = CodeBlock { 0; }
searchForSP = Input(searchForSP : var[]..[])
GUIDinStringNode = Input(GUIDinStringNode : var[]..[])
boolean = BoolSelector(true)
check_project_shared_parameter = Custom[Check Project Shared Parameter against benchmark GUID](searchForSP=searchForSP, GUIDinStringNode=GUIDinStringNode, TrueForType=boolean)  # and report results
string = StringInput("---If True then FAIL---")
string_2 = StringInput("---List of GUIDs---")
string_3 = StringInput("---GUID should be this---")
create = List.Create(check_project_shared_parameter.colHeading, string, check_project_shared_parameter.ifTrueThenFAIL, string_2, check_project_shared_parameter.listOfGuids, string_3, GUIDinStringNode)
flatten = Flatten(create)
string_4 = StringInput("NULL VALUE")
replaceNull = Custom[List.ReplaceNull](list=flatten, replacement=string_4)  # Replaces all null values within a given list with a substitute
code_block_2 = CodeBlock { true; }
writeToFile = Excel.WriteToFile(filePath=filePath, sheetName=sheetName, startRow=code_block, startCol=code_block, data=replaceNull, overWrite=code_block_2)
data = Output(writeToFile)
