# Dynamo custom node XPATH Expression Find for Element Tree.dyf (Dynamo 0.9.1.4062)
# category: Bakery.Data.XML

ElementTree = Input()
XPATH = Input()
python_script = Python(IN[0]=ElementTree, IN[1]=XPATH)
# ---------- python_script.python (58 lines) ----------
import clr
import sys
clr.AddReference('ProtoGeometry')
from Autodesk.DesignScript.Geometry import *
sys.path.append("C:\Program Files (x86)\IronPython 2.7\Lib")
#from xml.parsers.expat import expat -- can't find this
import xml.etree.ElementTree as ET
#The inputs to this node will be stored as a list in the IN variables.
xmTree = IN[0]
xpathstr = IN[1]

#xmParsed = xmTree.parse(xmlFile)
#root = xmTree.getroot()
try:
	root = xmTree.getroot()
except:
	root = xmTree

xpathfound = root.findall(xpathstr)
#xparentstr = xpathstr + "/.."
#xparentfound = root.findall(xpathstr+"/..")
xtags, xtext, xcountattrib, xattrib, xattvals, xcountiter, xitertags, xitervals, xparents = [], [], [], [], [], [], [], [], []
for x in xpathfound:
	xtags.append(x.tag)
	if x.text:
		try:
			xtext.append(x.text)
		except:
			xtext.append("_none_")
	else:
		xtext.append("_none_")
	if x.keys():
		xcountattrib.append(len(x.items()))
		for name, value in x.items():
			xattrib.append(name)
			xattvals.append(value)
#PARENT CODE BELOW IS TOO SLOW
#			try:
#				xparents.append(root.find(xpathstr + "/" + name + "/.."))
#			except:
#				xparents.append("no parent found")
	else:
		xcountattrib.append(1)
		xattrib.append("_none_")
		xattvals.append("_none_")

#THIS METHOD NOT GREAT
#	if x.iter():
#		xcountiter.append(len(x.iter()))
#		for name, value in x.iter():
#			xitertags.append(name)
#			xitervals.append(value)
#for y in xparentfound:
#	xparents.append(y.tag)

OUT = root, str(root), xpathfound, xtags, xtext, xcountattrib, xattrib, xattvals
#, xparents 
#, xparentfound#, xparents#, xcountiter, xitertags, xitervals
# ----------------------------------------
code_block = CodeBlock { 0; }
getItemAtIndex = List.GetItemAtIndex(list=python_script, index=code_block)
root_element = Output(getItemAtIndex)
code_block_2 = CodeBlock { 1; }
getItemAtIndex_2 = List.GetItemAtIndex(list=python_script, index=code_block_2)
root_element_as_string = Output(getItemAtIndex_2)
code_block_3 = CodeBlock { 2; }
getItemAtIndex_3 = List.GetItemAtIndex(list=python_script, index=code_block_3)
found_elements = Output(getItemAtIndex_3)
code_block_4 = CodeBlock { 3; }
getItemAtIndex_4 = List.GetItemAtIndex(list=python_script, index=code_block_4)
tag = Output(getItemAtIndex_4)
code_block_5 = CodeBlock { 4; }
getItemAtIndex_5 = List.GetItemAtIndex(list=python_script, index=code_block_5)
text = Output(getItemAtIndex_5)
code_block_6 = CodeBlock { 5; }
getItemAtIndex_6 = List.GetItemAtIndex(list=python_script, index=code_block_6)
attrib_count = Output(getItemAtIndex_6)
code_block_7 = CodeBlock { 6; }
getItemAtIndex_7 = List.GetItemAtIndex(list=python_script, index=code_block_7)
bv_list_chop_by_lengths = Custom[bv List Chop by Lengths](list=getItemAtIndex_7, lengths=getItemAtIndex_6)
attrib_names = Output(bv_list_chop_by_lengths)
code_block_8 = CodeBlock { 7; }
getItemAtIndex_8 = List.GetItemAtIndex(list=python_script, index=code_block_8)
bv_list_chop_by_lengths_2 = Custom[bv List Chop by Lengths](list=getItemAtIndex_8, lengths=getItemAtIndex_6)
attrib_values = Output(bv_list_chop_by_lengths_2)
string = StringInput("\"parent Python code disabled for speed\"")
parents = Output(string)
code_block_9 = CodeBlock { 8; }
getItemAtIndex_9 = List.GetItemAtIndex(list=python_script, index=code_block_9)
bv_list_chop_by_lengths_3 = Custom[bv List Chop by Lengths](list=getItemAtIndex_9, lengths=getItemAtIndex_6)

# group: Parent code disabled for speed
watch = Watch(bv_list_chop_by_lengths_3)
