# Dynamo custom node bv Collector for Viewports.dyf (Dynamo 0.8.2.2371)
# category: Bakery.Dynamo.ForkedNodes
# forked from Rhythm

# group: We collect all of the viewports and query all parameters
categories = Categories("Viewports")
all_elements_of_category = ElementsOfCategory(categories)

RunMe = Input(RunMe : bool = false)
bv_filter_list_by_mask = Custom[bv Filter List by Mask](list=all_elements_of_category, boolean=RunMe)  # can be used as a toggle switch to output empty list with false
watch = Watch(bv_filter_list_by_mask.in)
Elements = Output(watch)

# group (continued): We collect all of the viewports and query all parameters
parameters = Element.Parameters(watch)
string_from_object = FromObject(parameters)

# group: Here we begin to filter out the duplicated vie name parameter.
uniqueItems = List.UniqueItems()
map = List.Map(list=string_from_object, f_x=uniqueItems)
code_block = CodeBlock { "View Name"; }
contains = String.Contains(str=map, searchFor=code_block)
filterByBoolMask = List.FilterByBoolMask(list=map, mask=contains)
flatten = Flatten(filterByBoolMask.in)
code_block_2 = CodeBlock { ": "; false; }

bv_remove_from_string_prior_to = Custom[bv Remove from String Prior to Character](str=flatten, Character=code_block_2.out0, ignoreCase=code_block_2.out1)  # forked from Rhythm

# group: This gets title on sheet to help filter out in the future.
code_block_3 = CodeBlock { "Title on Sheet"; }
getParameterValueByName = Element.GetParameterValueByName(element=watch, parameterName=code_block_3)
code_block_4 = CodeBlock { "test"; }
code_block_5 = CodeBlock { ""; }
eq = _ == code_block_5
replaceByCondition = Replace(getParameterValueByName, code_block_4, eq)
code_block_6 = CodeBlock { 2; }
cycle = List.Cycle(amount=code_block_6)
map_2 = List.Map(list=replaceByCondition, f_x=cycle)
flatten_2 = Flatten(map_2)
code_block_7 = CodeBlock { {"","test"}; }
count = List.Count(getParameterValueByName)
code_block_8 = CodeBlock(a=count) { a; }
cycle_2 = List.Cycle(list=code_block_7, amount=code_block_8)
eq_2 = flatten_2 == cycle_2
filterByBoolMask_2 = List.FilterByBoolMask(list=flatten_2, mask=eq_2)

# group: We finally have the actual view names of each view. Instead of a mixture of title on sheet/ view name
trimWhitespace = String.TrimWhitespace(bv_remove_from_string_prior_to)
eq_3 = trimWhitespace == filterByBoolMask_2.out
filterByBoolMask_3 = List.FilterByBoolMask(list=trimWhitespace, mask=eq_3)

ViewNames = Output(filterByBoolMask_3.out)
code_block_9 = CodeBlock { "Scale Value    1:"; }
getParameterValueByName_2 = Element.GetParameterValueByName(element=watch, parameterName=code_block_9)
ViewScale_1 = Output(getParameterValueByName_2)  # "ViewScale 1:x"
TitleOnSheet = Output(getParameterValueByName)
