# Dynamo custom node bv Create Element View.dyf (Dynamo 0.8.2.2371)
# category: Bakery.Dynamo.ForkedNodes
# for structural, from RevitBeyondBim

# group: INPUT VALUES
Revit_Elements = Input()
geometry = Element.Geometry(Revit_Elements)
flatten = Flatten(geometry)
# note: X defines the length direction of the section view
X_vector = Input()
# note: Y defines the width direction of the section view
Y_vector = Input()
# note: Distance between object countours and section crop region
CropRegionOffset = Input(CropRegionOffset:double)
ViewDepth = Input(ViewDepth:double)
Viewname = Input()

# group: APPLY CS AND WORKPLANE
centroid = Solid.Centroid(flatten)
# note: Defines the coordinate system for the direction of the section view.
# This is taken in the centroid of the solid geometry to be able to define negative and positive values for the min/max point
# Top view:
# X=length axis element
# Y=normal at length axis
# Front view:
# X=length axis element
# Y=Global Z axis
# Cross section view:
# X=normal axis element
# Y=Global Z axis
byOriginVectors = CoordinateSystem.ByOriginVectors(origin=centroid, xAxis=X_vector, yAxis=Y_vector, lacing=Longest)
# note: Generate a plane at the solid center which is orientated to the view cs. This plane is used to detect the boundaries of the section view.
byOriginXAxisYAxis = Plane.ByOriginXAxisYAxis(centroid, X_vector, Y_vector, lacing=Longest)

# group: DETECT SECTION BOUNDARY CURVES AND WORKPOINTS
intersect = Geometry.Intersect(geometry=flatten, other=byOriginXAxisYAxis, lacing=Longest)
# note: Detect the perimeter curves of the cutting surface at the solid centroid
flatten_2 = Flatten(intersect)
perimeterCurves = Surface.PerimeterCurves(flatten_2)
byJoinedCurves = PolyCurve.ByJoinedCurves(perimeterCurves)
code_block = CodeBlock(x=CropRegionOffset) { {x,-x}; }
# note: Apply the offset on the cutting surface perimeter curves.
offset = Curve.Offset(curve=byJoinedCurves, distance=code_block, lacing=CrossProduct)
isNull = Object.IsNull(offset)
# note: If the offset value exceeds the half-width of the surface, then it generates a "null" value for the generated polycurve.
# This might return an error in the Curve.Offset node. To filter out the "null" values, the List.FilterByBoolMask is used.
filterByBoolMask = List.FilterByBoolMask(list=offset, mask=isNull)
length = Curve.Length()
# note: Get the external polycurve of the offsetted polycurves.
maximumItemByKey = MaximumItemByKey(arg1=length)
map = List.Map(list=filterByBoolMask.out, f_x=maximumItemByKey)
# note: Get the single curves and their starting point to define the min and max boundary values
explode = Geometry.Explode(map)
startPoint = Curve.StartPoint(explode)

# group: TRANSLATE TO WCS FOR minPoint / maxPoint Calc
identity = CoordinateSystem.Identity()
transform = Geometry.Transform(contextCoordinateSystem=identity)
# note: As Point.X and Point.Y only work according to global WCS, the curves are transformed from the solid.centroid to the WCS in order to define the MinPoint and MaxPoint of the cut surface (offset values already included)
combine = List.Combine(transform, startPoint, byOriginVectors)
X = Point.X(combine)
minimumItem = List.MinimumItem(X)
Y = Point.Y(combine)
minimumItem_2 = List.MinimumItem(Y)
maximumItem = List.MaximumItem(X)
maximumItem_2 = List.MaximumItem(Y)

# group: CREATE SECTION VIEW ACCORDING BOUNDING BOX
code_block_2 = CodeBlock(CropRegionOffset=CropRegionOffset, ViewDepth=ViewDepth)
# ---------- code_block_2.designscript (7 lines) ----------
//Z value calculation
//in accordance with the
//Centroid point
//Startingpoint of sectionview
-CropRegionOffset;
//Relative depth of sectionview
ViewDepth-CropRegionOffset;
# ----------------------------------------
byCoordinates = Point.ByCoordinates(x=minimumItem, y=minimumItem_2, z=code_block_2.out0)
byCoordinates_2 = Point.ByCoordinates(x=maximumItem, y=maximumItem_2, z=code_block_2.out1)
byCoordinateSystemMinPointMaxPoint = SectionView.ByCoordinateSystemMinPointMaxPoint(byOriginVectors, byCoordinates, byCoordinates_2)
# note: The section view is created according the CS, defined by the centroid and the given section view direction.
# The minPoint / maxPoint is defined by the local oriented bounding box + offset of the element.
code_block_3 = CodeBlock { "View Name"; }
setParameterByName = Element.SetParameterByName(element=byCoordinateSystemMinPointMaxPoint, parameterName=code_block_3, value=Viewname)
SectionView = Output(setParameterByName)
