# Dynamo custom node bv Document Worksets.dyf (Dynamo 0.9.2.4472)
# category: Bakery.Dynamo.ForkedNodes
# clockwork node without the toggle

code_block = CodeBlock { true; }
python_script = Python(IN[0]=code_block)
# ---------- python_script.python (12 lines) ----------
import clr
clr.AddReference('RevitAPI')
from Autodesk.Revit.DB import *
import Autodesk

clr.AddReference("RevitServices")
import RevitServices
from RevitServices.Persistence import DocumentManager

doc = DocumentManager.Instance.CurrentDBDocument
collector = FilteredWorksetCollector(doc)
OUT = collector.ToWorksets()
# ----------------------------------------
worksets = Output(python_script)
