# Dynamo custom node bv IDs to Elements.dyf (Dynamo 2.6.2.15705)
# category: Bakery.Dynamo.ForkedNodes
# forked from CAAD_RWTH
# packages: Clockwork for Dynamo 2.x 2.3.0

IDs = Input(IDs: var[]..[])
byID = Custom[Element.ByID](IdOrUniqueId=IDs)  # package Clockwork for Dynamo 2.x; Gets the Revit element(s) for a list of IDs (or a single ID); unwired: docOrRevitLinkInstance
Elementz = Output(byID)
