# Dynamo custom node bv List.RemoveEmpty.dyf (Dynamo 1.2.1.3083)
# category: Bakery.Dynamo.ForkedNodes

list = Input()
isEmpty = List.IsEmpty()  # unwired: arg0
map = List.Map(list=list, f_x=isEmpty)
filterByBoolMask = List.FilterByBoolMask(list=list, mask=map)
list_2 = Output(filterByBoolMask.out)  # "list"
