# Dynamo custom node bv Merge Sublists with a separator.dyf (Dynamo 2.12.1.8246)
# category: Bakery.ZZ
# forked from Rhythm, has problems with string like }---{

listin = Input(listin: var[]..[])
Character = Input(Character: var[]..[])
python_script = Python(IN[0]=listin, IN[1]=Character)  # IronPython2
# ---------- python_script.python (3 lines) ----------
initial = IN[0]
result = map(IN[1].join, initial)
OUT=result
# ----------------------------------------
OUT = Output(python_script)
