# Dynamo custom node bv Remove Nulls.dyf (Dynamo 2.3.0.5885)
# category: Bakery.Dynamo.ForkedNodes
# forked from Lunchbox

data = Input(data: var[]..[])
python_script = Python(IN[0]=data)
# ---------- python_script.python (23 lines) ----------
# Copyright (c) 2014, Nathan Miller
# The Proving Ground, http://TheProvingGround.org

# Default imports
import clr
clr.AddReference('ProtoGeometry')
from Autodesk.DesignScript.Geometry import *

#The input to this node will be stored in the IN[0] variable.
list = IN[0]

cleanlist = []
for i in list:
	if hasattr(i, "__iter__"):
		for ii in i:
			if not (i is None):
				cleanlist.append(i)	
	else:
		if not (i is None):
			cleanlist.append(i)	

#Assign your output to the OUT variable
OUT = cleanlist
# ----------------------------------------
Cleaned = Output(python_script)
