# Dynamo custom node bv Select Linked Elements.dyf (Dynamo 1.0.0.1180)
# category: Bakery.Dynamo.ForkedNodes
# Dimitar original code. I modded with a Try/Except because it was failing on me.

refresh = Input(refresh:bool = true)
python_script = Python(IN[0]=refresh)
# ---------- python_script.python (34 lines) ----------
#Copyright(c) 2016, Dimitar Venkov
# @5devene, dimitar.ven@gmail.com

import clr

clr.AddReference("RevitAPIUI")
from  Autodesk.Revit.UI import *

clr.AddReference("RevitServices")
import RevitServices
from RevitServices.Persistence import DocumentManager
doc = DocumentManager.Instance.CurrentDBDocument
uidoc=DocumentManager.Instance.CurrentUIApplication.ActiveUIDocument

clr.AddReference("RevitNodes")
import Revit
clr.ImportExtensions(Revit.Elements)

sel1 = uidoc.Selection
ot1 = Selection.ObjectType.Element
ot2 = Selection.ObjectType.LinkedElement
li_ref = sel1.PickObject(ot1, "Select a link instance first.")
el_ref = sel1.PickObjects(ot2, "Select the linked elements and press Finish.")
Link1 = doc.GetElement(li_ref.ElementId)
LinkDoc = Link1.GetLinkDocument()
Lel_id = [r1.LinkedElementId for r1 in el_ref]
elementset = []
failed = []
for id1 in Lel_id:
	try:
		elementset.append(LinkDoc.GetElement(id1).ToDSType(True))
	except:
		failed.append(id1)
OUT = elementset, failed
# ----------------------------------------
firstItem = List.FirstItem(python_script)
element_s = Output(firstItem)  # "element(s)"
lastItem = List.LastItem(python_script)
failedIds = Output(lastItem)
