# Dynamo custom node mysql Add Columns to Table.dyf (Dynamo 1.2.1.3083)
# category: Bakery.Data.Database

list = Input()
string = StringInput("ALTER TABLE zzxkr_dbName_zzxkr.zzxkr_tableName_zzxkr ADD COLUMN zxkr_Column_zxkr VARCHAR(200)")
string_2 = StringInput("zzxkr_dbName_zzxkr")
dbName = Input(dbName : string)
replace = String.Replace(str=string, searchFor=string_2, replaceWith=dbName)
string_3 = StringInput("zzxkr_tableName_zzxkr")
tableName = Input(tableName : string)
replace_2 = String.Replace(str=replace, searchFor=string_3, replaceWith=tableName)
string_4 = StringInput("zxkr_Column_zxkr")
replace_3 = String.Replace(str=replace_2, searchFor=string_4)  # unwired: replaceWith
map = List.Map(list=list, f_x=replace_3)
watch = Watch(map)
falseForTextOnly = Input()
switch = Custom[Switch](boolean_switch=watch, data=falseForTextOnly)
ConnectionString = Input(ConnectionString : string)
boolean = BoolSelector(true)
mySQL_Command = Database.Command.MySQL_Command(ConnectionString, boolean)  # unwired: arg2
map_2 = List.Map(list=switch, f_x=mySQL_Command)
mapped = Output(map_2)
SQLinstructions = Output(watch)
