# Dynamo custom node mysql Insert Data into New Row.dyf (Dynamo 0.9.1.4062)
# category: Bakery.Data.Database

code_block = CodeBlock { ""; }
string = StringInput("USE `firstmodelexport`;\nINSERT INTO `firstmodelexport`.`elemids2` (`zxkr_Column_zxkr`) VALUES (\"")
string_2 = StringInput("zxkr_Column_zxkr")
ColumnName = Input()
replace = String.Replace(str=string, searchFor=string_2, replaceWith=ColumnName)
dataPiece = Input()
string_3 = StringInput("\");")
join = String.Join(code_block, replace, dataPiece, string_3)
toGoToDb = Output(join)
