# Dynamo custom node subnode to Iterate unzipped BCF structure for information.dyf (Dynamo 1.3.0.875)
# category: Bakery.BIM.BCF.Helper

list = Input(list : var[]..[])
counter = Input()
watch = Watch(counter)
getItemAtIndex = List.GetItemAtIndex(list=list, index=watch)
read_file_path_to_elementtree = Custom[Read File Path to ElementTree with UTF8 roundtrip](filePath=getItemAtIndex)  # to clean unsupported characters...
string = StringInput("./Topic/Title")
xpath_expression_find_for = Custom[XPATH Expression Find for Element Tree](ElementTree=read_file_path_to_elementtree, XPATH=string)
watch_2 = Watch(xpath_expression_find_for.text)
firstItem = List.FirstItem(watch_2)
string_2 = StringInput("./Topic/AssignedTo")
xpath_expression_find_for_2 = Custom[XPATH Expression Find for Element Tree](ElementTree=read_file_path_to_elementtree, XPATH=string_2)
watch_3 = Watch(xpath_expression_find_for_2.text)
firstItem_2 = List.FirstItem(watch_3)
code_block = CodeBlock(x=watch) { x+1; }
getItemAtIndex_2 = List.GetItemAtIndex(list=list, index=code_block)
read_file_path_to_elementtree_2 = Custom[Read File Path to ElementTree with UTF8 roundtrip](filePath=getItemAtIndex_2)
string_3 = StringInput("./Components/Component/AuthoringToolId")
xpath_expression_find_for_3 = Custom[XPATH Expression Find for Element Tree](ElementTree=read_file_path_to_elementtree_2, XPATH=string_3)
string_4 = StringInput("./Topic")
string_5 = StringInput("Guid")
get_attribute_from_elementtree = Custom[Get Attribute from ElementTree by Name](ElementTree=read_file_path_to_elementtree, XPATHscope=string_4, Attribute_Name=string_5)
firstItem_3 = List.FirstItem(get_attribute_from_elementtree)
create = List.Create(firstItem, firstItem_2, xpath_expression_find_for_3.text, firstItem_3)
list_2 = Output(create)  # "list"
