# Dynamo custom node subnode to Make Forms from Flex Duct via NURBS.dyf (Dynamo 0.8.2.2371)
# category: Bakery.Geometry.Helper

points = Input()
counter = Input()
getItemAtIndex = List.GetItemAtIndex(list=points, index=counter)
startTans = Input()
getItemAtIndex_2 = List.GetItemAtIndex(list=startTans, index=counter)
comma_separated_revit_data_to = Custom[Comma Separated Revit Data to XYZ Values](item=getItemAtIndex_2)
byCoordinates = Vector.ByCoordinates(x=comma_separated_revit_data_to.X, y=comma_separated_revit_data_to.Y, z=comma_separated_revit_data_to.Z)
endTans = Input()
getItemAtIndex_3 = List.GetItemAtIndex(list=endTans, index=counter)
comma_separated_revit_data_to_2 = Custom[Comma Separated Revit Data to XYZ Values](item=getItemAtIndex_3)
byCoordinates_2 = Vector.ByCoordinates(x=comma_separated_revit_data_to_2.X, y=comma_separated_revit_data_to_2.Y, z=comma_separated_revit_data_to_2.Z)
byPointsTangents = NurbsCurve.ByPointsTangents(getItemAtIndex, byCoordinates, byCoordinates_2)
watch = Watch(byPointsTangents)
nurbs_using_tangents = Output(watch)
byPoints = PolyCurve.ByPoints(points=getItemAtIndex)
polycurves_by_points = Output(byPoints)
byPointsTangents_2 = NurbsCurve.ByPointsTangents(getItemAtIndex, byCoordinates, byCoordinates_2)
bspline_nurbs_using_tangents = Output(byPointsTangents_2)
