# Dynamo custom node subnode to Search List for One String Match.dyf (Dynamo 0.9.2.4472)
# category: Bakery.Core.List.Helper

oneItem = Input()
watch = Watch(oneItem)
item = Output(watch)
searchThisList = Input(searchThisList : var[]..[])
code_block = CodeBlock { true; }
contains = String.Contains(searchFor=oneItem, ignoreCase=code_block)
map = List.Map(list=searchThisList, f_x=contains)
watch_2 = Watch(map)
code_block_2 = CodeBlock { true; }
firstIndexOf = List.FirstIndexOf(list=watch_2, item=code_block_2)
watch_3 = Watch(firstIndexOf)
index = Output(watch_3)
code_block_3 = CodeBlock { "MatchNotFound"; }
getItemAtIndex = List.GetItemAtIndex(list=searchThisList, index=watch_3)
bv_replace_nulls = Custom[bv Replace Nulls](replacement=code_block_3, seq=getItemAtIndex)
found_in = Output(bv_replace_nulls)
