# Dynamo custom node 3DView To BoundingBox.dyf (Dynamo 1.3.3.4651)
# category: GeniusLoci.View
# Extract section boxes from desired 3D views, and convert them into bounding box element.
# Based on Amy Williams's script.

n3DView = Input(3DView)
get_section_box_from_this_view = Python(IN[0]=n3DView)
# ---------- get_section_box_from_this_view.python (73 lines) ----------
#From Amy Williams
#https://forum.dynamobim.com/t/bounding-box-of-section-box-min-max-pts-z-values-dont-correspond-with-model-elevation/15776

import clr
clr.AddReference('ProtoGeometry')
from Autodesk.DesignScript.Geometry import *

# Import ToDSType(bool) extension method
clr.AddReference("RevitNodes")
import Revit
clr.ImportExtensions(Revit.Elements)

# Import DocumentManager and TransactionManager
clr.AddReference("RevitServices")
import RevitServices
from RevitServices.Persistence import DocumentManager
from RevitServices.Transactions import TransactionManager

from System.Collections.Generic import *

# Import RevitAPI
clr.AddReference("RevitAPI")
import Autodesk
from Autodesk.Revit.DB import *

clr.ImportExtensions(Revit.GeometryConversion)

doc = DocumentManager.Instance.CurrentDBDocument
uiapp = DocumentManager.Instance.CurrentUIApplication
app = uiapp.Application

#The inputs to this node will be stored as a list in the IN variable.

def ProcessList(_func, _list):
    return map( lambda x: ProcessList(_func, x) if type(x)==list else _func(x), _list )

def Unwrap(item):
    return UnwrapElement(item)

if isinstance(IN[0], list):
    views = ProcessList(Unwrap, IN[0])
else:
    views = [Unwrap(IN[0])]

TransactionManager.Instance.EnsureInTransaction(doc)

viewlist = []
sectionboxes = []

for view in views:
    viewlist.append(view)
    sectionbox = view.GetSectionBox()
    transform = sectionbox.Transform
    sboxoriginx = transform.Origin.X
    sboxoriginy = transform.Origin.Y
    sboxoriginz = transform.Origin.Z
    minx = sectionbox.Min.X + sboxoriginx
    maxx = sectionbox.Max.X + sboxoriginx
    miny = sectionbox.Min.Y + sboxoriginy
    maxy = sectionbox.Max.Y + sboxoriginy
    minz = sectionbox.Min.Z + sboxoriginz
    maxz = sectionbox.Max.Z + sboxoriginz
    bbox = BoundingBoxXYZ()
    bbox.Min = XYZ((minx), (miny), (minz))
    bbox.Max = XYZ((maxx), (maxy), (maxz))
    tsectionbox = bbox.ToProtoType()
    sectionboxes.append(tsectionbox)


TransactionManager.Instance.TransactionTaskDone()

#Assign your output to the OUT variable
OUT = views, sectionboxes
# ----------------------------------------
code_block = CodeBlock(seq=get_section_box_from_this_view) { seq[0]; seq[1]; }
Views = Output(code_block.out0)
BoundingBox = Output(code_block.out1)
