# Dynamo custom node Duplicate AppearanceAssetElement.dyf (Dynamo 1.3.3.4651)
# category: GeniusLoci.Material
# Works only in Revit 2018.1 and later.
# Duplicate an Appearance Asset Element.

AppearanceAssetElement = Input()
Name = Input()  # String
duplicateAssetElements = Python(IN[0]=AppearanceAssetElement, IN[1]=Name)
# ---------- duplicateAssetElements.python (26 lines) ----------
#Alban de Chasteigner 2018
#twitter : @geniusloci_bim
#geniusloci.bim@gmail.com

import clr
clr.AddReference('RevitAPI')
from Autodesk.Revit.DB import *
clr.AddReference('RevitServices')
import RevitServices
from RevitServices.Persistence import DocumentManager
from RevitServices.Transactions import TransactionManager
doc = DocumentManager.Instance.CurrentDBDocument

def toList(obj):
    if hasattr(obj, '__iter__'): return obj
    else: return [obj]
    
assetElems = toList(UnwrapElement(IN[0]))
assetElemNames = toList(IN[1])
duplicateAssetElements=[]
TransactionManager.Instance.EnsureInTransaction(doc)
for assetElem,assetElemName in zip(assetElems,assetElemNames):
	duplicateAssetElement = assetElem.Duplicate(assetElemName)
	duplicateAssetElements.append(duplicateAssetElement)
TransactionManager.Instance.TransactionTaskDone()
OUT = duplicateAssetElements
# ----------------------------------------
AppearanceAsset = Output(duplicateAssetElements)
