# Dynamo custom node Element Reference.dyf (Dynamo 1.3.4.6666)
# category: GeniusLoci.Reference
# Gets a reference of a geometric object.

Element = Input()
python_script = Python(IN[0]=Element)
# ---------- python_script.python (21 lines) ----------
import clr
clr.AddReference('RevitServices')
import RevitServices
from RevitServices.Persistence import DocumentManager
from RevitServices.Transactions import TransactionManager
doc = DocumentManager.Instance.CurrentDBDocument

clr.AddReference('RevitAPI')
from Autodesk.Revit.DB import *
from Autodesk.Revit.DB.Structure import *

elements = UnwrapElement(IN[0])
if not hasattr(elements, '__iter__'):
	elements = [elements]

ref=[]

for element in elements:
	ref.append(Reference(element))
	
OUT=ref
# ----------------------------------------
Reference = Output(python_script)
