# Dynamo custom node Export DWG.dyf (Dynamo 1.3.3.4651)
# category: GeniusLoci.Export
# Export views to DWG file with export setup.
# From archilab

DirectoryPath = Input()
views = Input()  # As list
Filenames = Input()  # As list
RunIt = Input(RunIt:bool=false)
Exportsetup = Input()  # ExportDWGSetting's name as list
export_dwg = Python(IN[0]=DirectoryPath, IN[1]=views, IN[2]=Filenames, IN[3]=RunIt, IN[4]=Exportsetup)
# ---------- export_dwg.python (81 lines) ----------
# Copyright(c) 2016, Konrad K Sobon
# @arch_laboratory, http://archi-lab.net

# Import Element wrapper extension methods
import clr
clr.AddReference("RevitNodes")
import Revit
clr.ImportExtensions(Revit.Elements)

# Import DocumentManager and TransactionManager
clr.AddReference("RevitServices")
import RevitServices
from RevitServices.Persistence import DocumentManager
doc = DocumentManager.Instance.CurrentDBDocument

# Import RevitAPI
clr.AddReference("RevitAPI")
import Autodesk
from Autodesk.Revit.DB import *

import System
from System.Collections.Generic import *

import sys
pyt_path = r'C:\Program Files (x86)\IronPython 2.7\Lib'
sys.path.append(pyt_path)

#The inputs to this node will be stored as a list in the IN variable.
dataEnteringNode = IN

def ProcessList(_func, _list):
    return map( lambda x: ProcessList(_func, x) if type(x)==list else _func(x), _list )

def ProcessParallelLists(_func, *lists):
	return map( lambda *xs: ProcessParallelLists(_func, *xs) if all(type(x) is list for x in xs) else _func(*xs), *lists )

def Unwrap(item):
	return UnwrapElement(item)

folderPath = IN[0]

if isinstance(IN[1], list):
	views = ProcessList(Unwrap, IN[1])
else:
	views = list(Unwrap(IN[1]))

if isinstance(IN[2], list):
	names = IN[2]
else:
	names = list(IN[2])

RunIt = IN[3]

Predef = IN[4]

def ExportDwg(name, view, folder = folderPath):
	options = DWGExportOptions()
	options = options.GetPredefinedOptions(doc, Predef[0])
	views = List[ElementId]()
	views.Add(view.Id)
	result = doc.Export(folder, name, views, options)
	return result

if RunIt:
	try:
		errorReport = None
		# run export
		ProcessParallelLists(ExportDwg, names, views)
		
	except:
		# if error accurs anywhere in the process catch it
		import traceback
		errorReport = traceback.format_exc()
else:
	errorReport = "Please set the RunIt to True!"

#Assign your output to the OUT variable
if errorReport == None:
	OUT = "Success"
else:
	OUT = errorReport
# ----------------------------------------
Succeed = Output(export_dwg)
