# Dynamo custom node FilenameToFilePaths.dyf (Dynamo 1.3.3.4651)
# category: GeniusLoci.Printing
# Add directory and .pdf extension to filenames.

Directory_Path = Input()
Filenames = Input()  # Filenames as list
code_block = CodeBlock(Directorypath=Directory_Path, Filename=Filenames) { Directorypath+"\\"+Filename+".pdf"; }
FilePaths = Output(code_block)
