# Dynamo custom node Get 3D views.dyf (Dynamo 1.3.3.4651)
# category: GeniusLoci.View
# Retrieves the 3D views in the active or given document.

docOrRevitLinkInstance = Input(docOrRevitLinkInstance : var = null)  # Use only if you want to query a linked model
python_script = Python(IN[0]=docOrRevitLinkInstance)
# ---------- python_script.python (49 lines) ----------
#Copyright(c) 2015, Konrad Sobon
# @arch_laboratory, http://archi-lab.net

import clr
clr.AddReference('ProtoGeometry')
from Autodesk.DesignScript.Geometry import *

# Import DocumentManager and TransactionManager
clr.AddReference("RevitServices")
import RevitServices
from RevitServices.Persistence import DocumentManager
from RevitServices.Transactions import TransactionManager

# Import RevitAPI
clr.AddReference("RevitAPI")
import Autodesk
from Autodesk.Revit.DB import *

from System.Collections.Generic import *

# Import ToDSType(bool) extension method
clr.AddReference("RevitNodes")
import Revit
clr.ImportExtensions(Revit.Elements)

#Part of script from Clockwork
inputdoc = UnwrapElement(IN[0])
if inputdoc == None:
	doc = DocumentManager.Instance.CurrentDBDocument
elif inputdoc.GetType().ToString() == "Autodesk.Revit.DB.RevitLinkInstance":
	doc = inputdoc.GetLinkDocument()
elif inputdoc.GetType().ToString() == "Autodesk.Revit.DB.Document":
	doc = inputdoc
else: doc = None

#collect all views in the model
views = FilteredElementCollector(doc).OfClass(View).ToElements()

#sort views into separate lists based on view type
threeD = []
for i in views:
	if not i.IsTemplate:
		if i.ViewType == ViewType.ThreeD:
			threeD.append(i.ToDSType(True))
		else:
			continue

#Assign your output to the OUT variable
OUT = threeD
# ----------------------------------------
n3D_views = Output(python_script)  # "3D views"
