# Dynamo custom node Get Phase Filter Presentation.dyf (Dynamo 1.3.3.4651)
# category: GeniusLoci.Phase
# Get Phase Filter Status Presentation.

Phase_Filter = Input()
get_phase_presentation = Python(IN[0]=Phase_Filter)
# ---------- get_phase_presentation.python (39 lines) ----------
#Alban de Chasteigner 2018
import clr
# Import Element wrapper extension methods
clr.AddReference('RevitNodes')
import Revit
clr.ImportExtensions(Revit.Elements)

# Import DocumentManager and TransactionManager
clr.AddReference('RevitServices')
import RevitServices
from RevitServices.Persistence import DocumentManager
doc = DocumentManager.Instance.CurrentDBDocument

# Import RevitAPI
clr.AddReference('RevitAPI')
import Autodesk
from Autodesk.Revit.DB import *

def tolist(obj1):
	if hasattr(obj1,'__iter__'): return obj1
	else: return [obj1]

#The inputs to this node will be stored as a list in the IN variables.
phases = UnwrapElement(tolist(IN[0]))
new=[]
existing=[]
demolished=[]
temporary=[]
for phase in phases :
	news=phase.GetPhaseStatusPresentation(ElementOnPhaseStatus.New)
	new.append(news)
	existings=phase.GetPhaseStatusPresentation(ElementOnPhaseStatus.Existing)
	existing.append(existings)
	demolisheds=phase.GetPhaseStatusPresentation(ElementOnPhaseStatus.Demolished)
	demolished.append(demolisheds)
	temporaries=phase.GetPhaseStatusPresentation(ElementOnPhaseStatus.Temporary)
	temporary.append(temporaries)
#Assign your output to the OUT variable.
OUT = new,existing,demolished,temporary
# ----------------------------------------
Phase_Presentation = Output(get_phase_presentation)
