# Dynamo custom node Get Phase Filter.dyf (Dynamo 1.3.3.4651)
# category: GeniusLoci.Phase
# Get available Phase Filters

get_phase_filter = Python()
# ---------- get_phase_filter.python (22 lines) ----------
#Alban de Chasteigner 2018
import clr
# Import Element wrapper extension methods
clr.AddReference('RevitNodes')
import Revit
clr.ImportExtensions(Revit.Elements)

# Import DocumentManager and TransactionManager
clr.AddReference('RevitServices')
import RevitServices
from RevitServices.Persistence import DocumentManager
doc = DocumentManager.Instance.CurrentDBDocument

# Import RevitAPI
clr.AddReference('RevitAPI')
import Autodesk
from Autodesk.Revit.DB import *

#The inputs to this node will be stored as a list in the IN variables.
phases = FilteredElementCollector(doc).OfClass(PhaseFilter).ToElements()
#Assign your output to the OUT variable.
OUT = phases
# ----------------------------------------
Phase_Filter = Output(get_phase_filter)
code_block = CodeBlock(e=get_phase_filter) { e.Name; }
Names = Output(code_block)
