# Dynamo custom node Get View By Name.dyf (Dynamo 1.3.3.4651)
# category: GeniusLoci.View
# Collect views by given name in the active or given document.
# Based on a Daniel Woodcock's script.

ViewName = Input()
DoesContain = Input(DoesContain:bool=false)
docOrRevitLinkInstance = Input(docOrRevitLinkInstance : var = null)  # Use only if you want to query a linked model
# note: From Daniel Woodcock
get_view_by_name = Python(IN[0]=ViewName, IN[1]=DoesContain, IN[2]=docOrRevitLinkInstance)
# ---------- get_view_by_name.python (57 lines) ----------
#For more information refer to RBG Wiki or email me (ctrl + click link): daniel.woodcock@robertbird.com

import clr
clr.AddReference("RevitNodes")
import Revit
clr.ImportExtensions(Revit.Elements)

# Import DocumentManager and TransactionManager
clr.AddReference("RevitServices")
import RevitServices
from RevitServices.Persistence import DocumentManager

# Import RevitAPI
clr.AddReference("RevitAPI")
import Autodesk
from Autodesk.Revit.DB import *

import System
from System.Collections.Generic import *

import sys
pyt_path = r'C:\Program Files (x86)\IronPython 2.7\Lib'
sys.path.append(pyt_path)

#Part of script from Clockwork
inputdoc = UnwrapElement(IN[2])
if inputdoc == None:
	doc = DocumentManager.Instance.CurrentDBDocument
elif inputdoc.GetType().ToString() == "Autodesk.Revit.DB.RevitLinkInstance":
	doc = inputdoc.GetLinkDocument()
elif inputdoc.GetType().ToString() == "Autodesk.Revit.DB.Document":
	doc = inputdoc
else: doc = None

def tolist(obj1):
	if hasattr(obj1,"__iter__"): return obj1
	else: return [obj1]

names = tolist(IN[0])
cont = tolist(IN[1])
cont = cont[0]
outList = []

fec = FilteredElementCollector(doc).OfClass(View)
for view in fec:
	v = UnwrapElement(view)
	if not v.IsTemplate:
		for name in names:
			if cont:
				if name in v.Name:
					outList.append(v)
					break
			else:
				if v.Name == name:
					outList.append(v)
					break
OUT = outList
# ----------------------------------------
Views = Output(get_view_by_name)
