# Dynamo custom node GetSurroundingElements in Document.dyf (Dynamo 1.3.3.4651)
# category: GeniusLoci.Element
# Get Surrounding Elements by Categories, group them as List. Tolerance distance available in linked document.
# From SteamNodes

Element = Input()
code_block = CodeBlock(item=Element) { Flatten({item}); }
ElementCheck = Input()
code_block_2 = CodeBlock(item=ElementCheck) { Flatten({item}); }
Tolerance = Input(Tolerance:double=0)
Document = Input()
# note: From SteamNodes
modified_tool = Python(IN[0]=code_block, IN[1]=code_block_2, IN[2]=Tolerance, IN[3]=Document)  # "Modified Tool.GetSurroundingElements"
# ---------- modified_tool.python (58 lines) ----------
#python nodes in dynamo 1.0
#proposed by Julien Benoit @jbenoit44 
#http://aecuandme.wordpress.com/
import clr
clr.AddReference('ProtoGeometry')
from Autodesk.DesignScript.Geometry import *
# Import ToDSType(bool) extension method
clr.AddReference("RevitNodes")
import Revit
clr.ImportExtensions(Revit.Elements)
# Import geometry conversion extension methods
clr.ImportExtensions(Revit.GeometryConversion)
# Import DocumentManager and TransactionManager
clr.AddReference("RevitServices")
import RevitServices
from RevitServices.Persistence import DocumentManager
from RevitServices.Transactions import TransactionManager
from System.Collections.Generic import *
# Import RevitAPI
clr.AddReference("RevitAPI")
import Autodesk
from Autodesk.Revit.DB import *
import itertools
import operator
doc = DocumentManager.Instance.CurrentDBDocument
activeV=doc.ActiveView

linkeddoc = IN[3]

host = []
finst=[]
finstID=[]
for i in IN[0]:
	host.append(UnwrapElement(i))
for i in IN[1]:
	finst.append(UnwrapElement(i))
for i in IN[1]:
	finstID.append(UnwrapElement(i).Id)	

superset=[]
hloop=[]

for h in host:
	collection = List[ElementId](finstID)
	collector=FilteredElementCollector(linkeddoc,collection)
	a=h.BoundingBox[activeV]
	c=Outline (a.Min,a.Max)
	d=BoundingBoxIntersectsFilter(c,float(IN[2]))
	e=collector.WherePasses(d).ToElements()
	setlist=[]
	hostlist=[]
	hostlist.append(h)
	setlist.append(e)
	all_lists = [hostlist,setlist]
	c=reduce(operator.add, all_lists)
	superset.append(c)
		
OUT=superset
# ----------------------------------------
code_block_3 = CodeBlock(modified_tool) { t2 = DSCore.List.Flatten(t3<1L>, 1); t4 = DSCore.List.Count(t2<1L>); t5 = t4 > 1; }
filterByBoolMask = List.FilterByBoolMask(list=code_block_3.t2, mask=code_block_3.t5)
Set_of_elements = Output(filterByBoolMask.in)
