# Dynamo custom node Material Set Appearance Asset Element.dyf (Dynamo 1.3.3.4651)
# category: GeniusLoci.Material
# Set the Appearance Asset Element of the given material.

Material = Input()
AppearanceAssetElement = Input()
set_material_appearanceasset = Python(IN[0]=Material, IN[1]=AppearanceAssetElement)
# ---------- set_material_appearanceasset.python (33 lines) ----------
#Alban de Chasteigner 2018
#twitter : @geniusloci_bim
#geniusloci.bim@gmail.com

import clr
clr.AddReference('RevitAPI')
from Autodesk.Revit.DB import *

clr.AddReference("RevitNodes")
import Revit
clr.ImportExtensions(Revit.Elements)

clr.AddReference("RevitServices")
import RevitServices
from RevitServices.Persistence import DocumentManager
from RevitServices.Transactions import TransactionManager

def toList(obj):
    if hasattr(obj, '__iter__'): return obj
    else: return [obj]
    
doc = DocumentManager.Instance.CurrentDBDocument
mats = toList(UnwrapElement(IN[0]))
assetElements = toList(UnwrapElement(IN[1]))
appearanceAssetIds=[]

TransactionManager.Instance.EnsureInTransaction(doc)
for mat,assetElement in zip(mats,assetElements):
	mat.AppearanceAssetId = assetElement.Id
	appearanceAssetIds.append(assetElement.Id)
TransactionManager.Instance.TransactionTaskDone()

OUT = mats
# ----------------------------------------
Material_2 = Output(set_material_appearanceasset)  # "Material"
