# Dynamo custom node Material Set Render Color.dyf (Dynamo 1.3.3.4651)
# category: GeniusLoci.Material
# Works only in Revit 2018.1 and later.
# Set the rendering color in the Appearance Asset Element of the given material.

Material = Input()
color = Input(color:var[]..[]= DSCore.Color.ByARGB(0,0,0,0))  # Dynamo Color
AssetProperty = Input(AssetProperty:var[]..[]="generic_diffuse")  # String
set_render_color = Python(IN[0]=Material, IN[1]=color, IN[2]=AssetProperty)
# ---------- set_render_color.python (37 lines) ----------
#Inspired by Boris Shafiro from Autodesk
#Alban de Chasteigner 2018
#twitter : @geniusloci_bim
#geniusloci.bim@gmail.com

import clr
clr.AddReference('RevitAPI')
from Autodesk.Revit.DB import *
clr.AddReference('RevitServices')
import RevitServices
from RevitServices.Persistence import DocumentManager
from RevitServices.Transactions import TransactionManager
doc = DocumentManager.Instance.CurrentDBDocument

def toList(obj):
    if hasattr(obj, '__iter__'): return obj
    else: return [obj]
    
mats = toList(UnwrapElement(IN[0]))
colors = toList(IN[1])
assetProperty = IN[2]

def ToRevitColor(dynamoColor):
	return Color(dynamoColor.Red, dynamoColor.Green, dynamoColor.Blue)

for mat, color in zip(mats, colors):
	appearanceAssetId = mat.AppearanceAssetId
	assetElem = doc.GetElement(appearanceAssetId)
	TransactionManager.Instance.EnsureInTransaction(doc)
	with Visual.AppearanceAssetEditScope(assetElem.Document) as editScope:
		editableAsset = editScope.Start(assetElem.Id)
		genericDiffuseProperty = editableAsset.FindByName(assetProperty)
		genericDiffuseProperty.SetValueAsColor(ToRevitColor(color))
		editScope.Commit(True)
	TransactionManager.Instance.TransactionTaskDone()

OUT = mats
# ----------------------------------------
Material_2 = Output(set_render_color)  # "Material"
