# Dynamo custom node New Create Material.dyf (Dynamo 1.3.3.4651)
# category: GeniusLoci.Material
# Works only in Revit 2019 and later.
# Create new materials or overwrite properties of existing materials.
# Inspired by Dynamo Forum.

Name = Input(Name:string[]..[])
color = Input(color:var[]..[]= DSCore.Color.ByARGB(255,255,255,255))  # Dynamo Color
SurfaceForegroundPattern = Input(SurfaceForegroundPattern:var[]..[]="<Solid fill>")  # String
SurfacePatternTarget = Input(SurfacePatternTarget:var[]..[]="Drafting")  # String = Drafting or Model
SurfaceForegroundPatternColor = Input(SurfaceForegroundPatternColor:var[]..[] = DSCore.Color.ByARGB(255,255,255,255))  # Dynamo Color
CutForegroundPattern = Input(CutForegroundPattern:var[]..[]="<Solid fill>")  # String
CutForegroundPatternColor = Input(CutForegroundPatternColor:var[]..[] = DSCore.Color.ByARGB(255,255,255,255))  # Dynamo Color
Transparency = Input(Transparency:var[]..[]=0)  # Integer
create_material = Python(IN[0]=Name, IN[1]=color, IN[2]=SurfaceForegroundPattern, IN[3]=SurfacePatternTarget, IN[4]=SurfaceForegroundPatternColor, IN[5]=CutForegroundPattern, IN[6]=CutForegroundPatternColor, IN[7]=Transparency)
# ---------- create_material.python (84 lines) ----------
# by GregX, David Dória, archilab and Alban de Chasteigner
import clr
clr.AddReference('RevitAPI')
from Autodesk.Revit.DB import *
clr.AddReference('RevitServices')
import RevitServices
from RevitServices.Persistence import DocumentManager
from RevitServices.Transactions import TransactionManager
doc = DocumentManager.Instance.CurrentDBDocument

def toList(obj):
    if hasattr(obj, '__iter__'): return obj
    else: return [obj]

names = toList(IN[0])
colors = toList(IN[1])
surfPat = toList(IN[2])
targets = toList(IN[3])
surfPatCl = toList(IN[4])
cutPat = toList(IN[5])
cutPatCl = toList(IN[6])
transparency = toList(IN[7])
fillPatTargets=[]

for target in targets :
	if target == "Drafting":
		fillPatTarget = FillPatternTarget.Drafting
	else:
		fillPatTarget = FillPatternTarget.Model
	fillPatTargets.append(fillPatTarget)

#New materials OUT list
newMaterials = []
#Overwritten materials OUT list
ovwMaterials = []

def ToRevitColor(dynamoColor):
	return Color(dynamoColor.Red, dynamoColor.Green, dynamoColor.Blue)

#Iterate through the input names list
for n, cl, sp, tar, spC, cp, cpC, trans in zip(names,colors,surfPat,fillPatTargets,surfPatCl,cutPat,cutPatCl,transparency):
	#Check if the material with the specified name already exists
	if Material.IsNameUnique(doc,n):
		#If name is unique, create material
		TransactionManager.Instance.EnsureInTransaction(doc)
		new_mat_id = Material.Create(doc, n)
		new_mat = doc.GetElement(new_mat_id)

		new_mat.SurfaceForegroundPatternId = FillPatternElement.GetFillPatternElementByName(doc,tar,sp).Id
		
		new_mat.SurfaceForegroundPatternColor = ToRevitColor(spC)
		
		new_mat.CutForegroundPatternId = FillPatternElement.GetFillPatternElementByName(doc, FillPatternTarget.Drafting,cp).Id
		
		new_mat.CutForegroundPatternColor = ToRevitColor(cpC)
		new_mat.Color = ToRevitColor(cl)
		new_mat.Transparency = trans

		TransactionManager.Instance.TransactionTaskDone()
		newMaterials.append(new_mat)
	else:
		#If it already exists, collect it and modify it
		TransactionManager.Instance.EnsureInTransaction(doc)
		namePar = ParameterValueProvider(ElementId(BuiltInParameter.MATERIAL_NAME))
		fRule = FilterStringRule(namePar,FilterStringEquals(),n, True)
		filter = ElementParameterFilter(fRule)
		exist_mat = FilteredElementCollector(doc).OfClass(Material).WherePasses(filter).ToElements()
		#Iteration is necessary because the output of exist_mat is invariably a list
		for em in exist_mat:
			#Modify the Material Properties and Parameters
			em.SurfaceForegroundPatternId = FillPatternElement.GetFillPatternElementByName(doc,tar,sp).Id
			
			em.SurfaceForegroundPatternColor = ToRevitColor(spC)
			
			em.CutForegroundPatternId = FillPatternElement.GetFillPatternElementByName(doc, FillPatternTarget.Drafting,cp).Id
			
			em.CutForegroundPatternColor = ToRevitColor(cpC)
			em.Color = ToRevitColor(cl)
			em.Transparency = trans
			
			ovwMaterials.append(em)
		TransactionManager.Instance.TransactionTaskDone()
		
OUT = newMaterials, ovwMaterials
# ----------------------------------------
code_block = CodeBlock(item=create_material) { DSCore.List.Flatten(item,-1); }
Material = Output(code_block)
