# Dynamo custom node New View Get Color of Filter.dyf (Dynamo 1.3.3.4651)
# category: GeniusLoci.Graphics
# Works only in Revit 2019 and later.
# Get the view filter and its colors from the given view.

View = Input()
get_colors_of_filters = Python(IN[0]=View)
# ---------- get_colors_of_filters.python (93 lines) ----------
#Based on a Thomas Mahon's script
#Alban de Chasteigner 2018
#twitter : @geniusloci_bim
#geniusloci.bim@gmail.com

import clr
clr.AddReference('ProtoGeometry')
from Autodesk.DesignScript.Geometry import *

clr.AddReference('DSCoreNodes')
import DSCore
from DSCore import Color

#Import ToDSType(bool) extension method
clr.AddReference("RevitNodes")
import Revit
clr.ImportExtensions(Revit.Elements)

# Import geometry conversion extension methods
clr.ImportExtensions(Revit.GeometryConversion)

# Import DocumentManager and TransactionManager
clr.AddReference("RevitServices")
import RevitServices
from RevitServices.Persistence import DocumentManager
from RevitServices.Transactions import TransactionManager
from System.Collections.Generic import *

# Import RevitAPI
clr.AddReference("RevitAPI")
import Autodesk
from Autodesk.Revit.DB import *

doc = DocumentManager.Instance.CurrentDBDocument
uiapp = DocumentManager.Instance.CurrentUIApplication
app = uiapp.Application

def toRvtId(_id):
	if isinstance(_id, int) or isinstance(_id, str):
		id = ElementId(int(_id))
		return id
	elif isinstance(_id, ElementId):
		return _id

def tolist(obj1):
	if hasattr(obj1,"__iter__"): return obj1
	else: return [obj1]

views = tolist(UnwrapElement(IN[0]))

surForList,surBacList,cutForList,cutBacList,elements,elementName = [],[],[],[],[],[]

for v in views:
	filters = v.GetFilters() # Get all the filter ids
	rgbList,rgbsurBacList,rgbCutList,rgbCutBacList = [],[],[],[]
	for f in filters:
		elements.append(doc.GetElement(toRvtId(f)).ToDSType(True))
		filterObject = v.GetFilterOverrides(f)
		col = filterObject.SurfaceForegroundPatternColor
		if col.IsValid:
			rgb = DSCore.Color.ByARGB(255, col.Red, col.Green, col.Blue)
		else:
			rgb = None
		rgbList.Add(rgb)

		surBacCol = filterObject.SurfaceBackgroundPatternColor
		if surBacCol.IsValid:
			rgbSurBac = DSCore.Color.ByARGB(255, surBacCol.Red, surBacCol.Green, surBacCol.Blue)
		else:
			rgbSurBac = None
		rgbsurBacList.Add(rgbSurBac)
	
		cut = filterObject.CutForegroundPatternColor
		if cut.IsValid:
			rgbcut = DSCore.Color.ByARGB(255, cut.Red, cut.Green, cut.Blue)
		else:
			rgbcut = None
		rgbCutList.Add(rgbcut)

		cutBac = filterObject.CutBackgroundPatternColor
		if cutBac.IsValid:
			rgbCutBac = DSCore.Color.ByARGB(255, cutBac.Red, cutBac.Green, cutBac.Blue)
		else:
			rgbCutBac = None
		rgbCutBacList.Add(rgbCutBac)
	surForList.Add(rgbList)
	surBacList.Add(rgbsurBacList)
	cutForList.Add(rgbCutList)
	cutBacList.Add(rgbCutBacList)
	for element in elements:
		elementName.append(element.Name)
		
OUT = surForList[0],surBacList[0],cutForList[0],cutBacList[0],elements, elementName
# ----------------------------------------
code_block = CodeBlock(x=get_colors_of_filters) { x[0]; x[1]; x[2]; x[3]; x[4]; x[5]; }
SurfaceForegroundPatternColor = Output(code_block.out0)
SurfaceBackgroundPatternColor = Output(code_block.out1)
CutForegroundPatternColor = Output(code_block.out2)
CutBackgroundPatternColor = Output(code_block.out3)
ViewFilter = Output(code_block.out4)
ViewFilter_Name = Output(code_block.out5)
