# Dynamo custom node Print PDF (multiple formats).dyf (Dynamo 1.3.3.4651)
# category: GeniusLoci.Printing
# This node will allow you to initiate a printing routine from a set of views/sheets, filename, printer name, print settings with many formats and print range.
# Use MergePDFs node to combine files.
# From archilab.

Views = Input()
PrintRange = Input()
boolean = BoolSelector(true)
PrinterName = Input()
PrintSetting = Input()  # As many printsettings as views
FilePaths = Input()  # As many filepaths as views Must include : Directory + name + .pdf extension
RunIt = Input(RunIt:bool=false)
python_script = Python(IN[0]=Views, IN[1]=PrintRange, IN[2]=boolean, IN[3]=PrinterName, IN[4]=PrintSetting, IN[5]=FilePaths, IN[6]=RunIt)
# ---------- python_script.python (169 lines) ----------
#Copyright(c) 2015, Konrad K Sobon
# @arch_laboratory, http://archi-lab.net
# Revised by viktor_kuzev
# Revised by Michael Park
# Revised by Alban de Chasteigner

import clr
clr.AddReference('ProtoGeometry')
from Autodesk.DesignScript.Geometry import *

# Import Element wrapper extension methods
clr.AddReference("RevitNodes")
import Revit
clr.ImportExtensions(Revit.Elements)

# Import geometry conversion extension methods
clr.ImportExtensions(Revit.GeometryConversion)

# Import DocumentManager and TransactionManager
clr.AddReference("RevitServices")
import RevitServices
from RevitServices.Persistence import DocumentManager
from RevitServices.Transactions import TransactionManager

doc = DocumentManager.Instance.CurrentDBDocument
uiapp = DocumentManager.Instance.CurrentUIApplication
app = uiapp.Application

# Import RevitAPI
clr.AddReference("RevitAPI")
import Autodesk
from Autodesk.Revit.DB import *

import sys
pyt_path = r'C:\Program Files (x86)\IronPython 2.7\Lib'
sys.path.append(pyt_path)
import System

# The inputs to this node will be stored as a list in the IN variable.
dataEnteringNode = IN

sheets = IN[0]
pRange = System.Enum.Parse(Autodesk.Revit.DB.PrintRange, IN[1])
combined = IN[2]
printerName = IN[3]
printSettings = IN[4]
filePath = IN[5]
runIt = IN[6]

if isinstance(filePath, list):
	s_length = len(sheets)
	fp_length = len(filePath)
	if len(sheets) == len(filePath):
		pass
	else:
		filePath = filePath * (s_length / fp_length)
		if len(filePath) == len(sheets):
			pass
		else:
			OUT = "Filepaths and Sheets weren't the same length"
			exit()

elif isinstance(filePath, str):
	filepath = [filepath] * len(sheets)

if isinstance(sheets, list):
	viewSheets = []
	for i in sheets:
		viewSheets.append(UnwrapElement(i))
else:
	viewSheets = UnwrapElement(sheets)

if isinstance(printSettings, list):
	printSetting = []
	for i in printSettings:
		printSetting.append(UnwrapElement(i))
else:
	printSetting = UnwrapElement(printSettings)

TransactionManager.Instance.EnsureInTransaction(doc)
printManager = doc.PrintManager		
printSetup = printManager.PrintSetup
printManager.SelectNewPrintDriver(printerName)
if isinstance(printSettings, list):
	printSetup.CurrentPrintSetting = printSetting[0]
else:
	printSetup.CurrentPrintSetting = printSetting
printManager.Apply()
TransactionManager.Instance.TransactionTaskDone()

def PrintView(doc, sheet, pRange, printerName, combined, filePath, printSetting):
	# create view set
	viewSet = ViewSet()
	viewSet.Insert(sheet)
	# determine print range
	printManager = doc.PrintManager
	printManager.PrintRange = pRange
	printManager.Apply()
	# make new view set current
	viewSheetSetting = printManager.ViewSheetSetting
	viewSheetSetting.CurrentViewSheetSet.Views = viewSet
	# set printer
	printManager.SelectNewPrintDriver(printerName)
	printManager.Apply()
	# set combined and print to file
	if printManager.IsVirtual:
		printManager.CombinedFile = combined
		printManager.Apply()
		printManager.PrintToFile = True
		printManager.Apply()
	else:
		printManager.CombinedFile = combined
		printManager.Apply()
		printManager.PrintToFile = False
		printManager.Apply()
	# set file path
	printManager.PrintToFileName = filePath
	printManager.Apply()
	# apply print setting
	try:
		printSetup = printManager.PrintSetup
		printSetup.CurrentPrintSetting = printSetting
		printManager.Apply()
	except:
		pass
	# save settings and submit print
	TransactionManager.Instance.EnsureInTransaction(doc)
	viewSheetSetting.SaveAs("tempSetName")
	printManager.Apply()
	printManager.SubmitPrint()
	viewSheetSetting.Delete()
	TransactionManager.Instance.TransactionTaskDone()

	return True


try:
	viewSets = FilteredElementCollector(doc).OfClass(ViewSheetSet)
	for i in viewSets:
		if i.Name == "tempSetName":
			TransactionManager.Instance.EnsureInTransaction(doc)
			doc.Delete(i.Id)
			TransactionManager.Instance.ForceCloseTransaction()
		else:
			continue

	errorReport = None
	message = "Success"
	if runIt:
		if isinstance(viewSheets, list) and isinstance(printSetting, list):
			for i, j, fp in zip(viewSheets, printSetting, filePath):
				PrintView(doc, i, pRange, printerName, combined, fp, j)
		elif isinstance(viewSheets, list) and not isinstance(printSetting, list):
			for i, fp in zip(viewSheets, filePath):
				PrintView(doc, i, pRange, printerName, combined, fp, printSetting)
		elif not isinstance(viewSheets, list) and not isinstance(printSetting, list):
			PrintView(doc, viewSheets, pRange, printerName, combined, filePath[0], printSetting)
	else:
		message = "Set RunIt to True"
except:
	# if error accurs anywhere in the process catch it
	import traceback
	errorReport = traceback.format_exc()

# Assign your output to the OUT variable
if errorReport is None:
	OUT = message
else:
	OUT = errorReport
# ----------------------------------------
Succeed = Output(python_script)
