# Dynamo custom node SelectByCategory in Document.dyf (Dynamo 1.3.3.4651)
# category: GeniusLoci.Select
# Collect elements by category in a linked or open document in the background.

Category = Input()
docOrRevitLinkInstance = Input(docOrRevitLinkInstance : var[]..[] = null)  # Use only if you want to query a linked model
selectByCategory = Python(IN[0]=Category, IN[1]=docOrRevitLinkInstance)
# ---------- selectByCategory.python (53 lines) ----------
# Default imports
import clr
clr.AddReference('ProtoGeometry')
from Autodesk.DesignScript.Geometry import *

# Import RevitAPI
clr.AddReference("RevitAPI")
import Autodesk
from Autodesk.Revit.DB import *

# Import DocumentManager and TransactionManager
clr.AddReference("RevitServices")
import RevitServices
from RevitServices.Persistence import DocumentManager
from RevitServices.Transactions import TransactionManager

# Import ToDSType(bool) extension method
clr.AddReference("RevitNodes")
import Revit
clr.ImportExtensions(Revit.Elements)
clr.ImportExtensions(Revit.GeometryConversion)

#Import Collections
from System.Collections.Generic import *
import System

#The inputs to this node will be stored as a list in the IN variable.
dataEnteringNode = IN

def tolist(x):
    if hasattr(x,'__iter__'): return x
    else : return [x]

cats = tolist(IN[0])
inputdocs = tolist(UnwrapElement(IN[1]))
catlist = []

#Part of script from Clockwork
for inputdoc in inputdocs :
	if inputdoc == None:
		doc = DocumentManager.Instance.CurrentDBDocument
	elif inputdoc.GetType().ToString() == "Autodesk.Revit.DB.Document":
		doc = inputdoc
	elif inputdoc.GetType().ToString() == "Autodesk.Revit.DB.RevitLinkInstance":
		doc = inputdoc.GetLinkDocument()
	else: doc = None


for cat in cats:
	bic = System.Enum.ToObject(BuiltInCategory, cat.Id)
	catlist.append(FilteredElementCollector(doc).WhereElementIsNotElementType().OfCategory(bic).ToElements())
	
OUT=catlist
# ----------------------------------------
Element = Output(selectByCategory)
