# Dynamo custom node SelectByCategoryAndView.dyf (Dynamo 1.3.3.4651)
# category: GeniusLoci.Select
# Collects elements by Category and View in the given document.
# The transform CS is returned only with a LinkInstance input.

view = Input()  # View of given document
Category = Input()
docOrRevitLinkInstance = Input(docOrRevitLinkInstance : var[] = null)  # Use only if you want to query a linked model
selectByCategoryAndView = Python(IN[0]=view, IN[1]=Category, IN[2]=docOrRevitLinkInstance)
# ---------- selectByCategoryAndView.python (48 lines) ----------
#Alban de Chasteigner 2018
#twitter : @geniusloci_bim
#geniusloci.bim@gmail.com

import clr
clr.AddReference('RevitAPI')
from Autodesk.Revit.DB import *
clr.AddReference('System')
from System.Collections.Generic import List
clr.AddReference('RevitNodes')
import Revit
clr.ImportExtensions(Revit.Elements)
clr.ImportExtensions(Revit.GeometryConversion)
clr.AddReference('RevitServices')
import RevitServices
from RevitServices.Persistence import DocumentManager
from RevitServices.Transactions import TransactionManager

def tolist(x):
    if hasattr(x,'__iter__'): return x
    else : return [x]

views = tolist(UnwrapElement(IN[0]))
cats = tolist(UnwrapElement(IN[1]))
inputdocs = tolist(UnwrapElement(IN[2]))
transforms = []

for inputdoc in inputdocs :
	if inputdoc == None:
		doc = DocumentManager.Instance.CurrentDBDocument
	elif inputdoc.GetType().ToString() == "Autodesk.Revit.DB.Document":
		doc = inputdoc
	elif inputdoc.GetType().ToString() == "Autodesk.Revit.DB.RevitLinkInstance":
		doc = inputdoc.GetLinkDocument()
		transforms.append(inputdoc.GetTotalTransform().ToCoordinateSystem(1))
	else: 
		transforms.append(None)

linkedEl = []
elements = []

for view in views:
	for cat in cats:
		collector = FilteredElementCollector(doc,view.Id).OfCategoryId(cat.Id).ToElements()
		linkedEl.append(collector)
	elements.append(linkedEl)

OUT = elements[0],transforms
# ----------------------------------------
code_block = CodeBlock(x=selectByCategoryAndView) { x[0]; x[1]; }
Elements = Output(code_block.out0)
Transform = Output(code_block.out1)
