# Dynamo custom node SynchronizeWithCentral in Document.dyf (Dynamo 1.3.3.4651)
# category: GeniusLoci.Document
# Synchronizes a workshared model with the central model with the choice of the Revit document.
# From Clockwork

relinquishProjectStandardWorksets = Input(relinquishProjectStandardWorksets : bool = false)
relinquishViewWorksets = Input(relinquishViewWorksets : bool = false)
relinquishFamilyWorksets = Input(relinquishFamilyWorksets : bool = false)
relinquishUserCreatedWorksets = Input(relinquishUserCreatedWorksets : bool = true)
relinquishBorrowedElements = Input(relinquishBorrowedElements : bool = false)
compactCentralModel = Input(compactCentralModel : bool = false)
saveLocalFileBeforeSync = Input(saveLocalFileBeforeSync : bool = false)
saveLocalFileAfterSync = Input(saveLocalFileAfterSync : bool = false)
comment = Input(comment : string = "")
runMe = Input(runMe : bool = true)
Document = Input()
# note: From Clockwork
python_script = Python(IN[0]=relinquishProjectStandardWorksets, IN[1]=relinquishViewWorksets, IN[2]=relinquishFamilyWorksets, IN[3]=relinquishUserCreatedWorksets, IN[4]=relinquishBorrowedElements, IN[5]=compactCentralModel, IN[6]=saveLocalFileBeforeSync, IN[7]=saveLocalFileAfterSync, IN[8]=comment, IN[9]=runMe, IN[10]=Document)
# ---------- python_script.python (42 lines) ----------
import clr
clr.AddReference('RevitAPI')
from Autodesk.Revit.DB import *

clr.AddReference("RevitServices")
import RevitServices
from RevitServices.Persistence import DocumentManager
from RevitServices.Transactions import TransactionManager

relStandardWS = IN[0]
relViewWS = IN[1]
relFamWS = IN[2]
relUserWS = IN[3]
relCheckedOutElems = IN[4]
compact = IN[5]
saveLocalBefore = IN[6]
saveLocalAfter = IN[7]
comment = IN[8]
runme = IN[9]

if runme:
	doc = IN[10]
	tOptions = TransactWithCentralOptions()
	rOptions = RelinquishOptions(False)
	rOptions.StandardWorksets = relStandardWS
	rOptions.ViewWorksets = relViewWS
	rOptions.FamilyWorksets = relFamWS
	rOptions.UserWorksets = relUserWS
	rOptions.CheckedOutElements = relCheckedOutElems
	sOptions = SynchronizeWithCentralOptions()
	sOptions.SetRelinquishOptions(rOptions)
	sOptions.Compact = compact
	sOptions.SaveLocalBefore = saveLocalBefore
	sOptions.SaveLocalAfter = saveLocalAfter
	sOptions.Comment = comment
	TransactionManager.Instance.ForceCloseTransaction()
	try:
		doc.SynchronizeWithCentral(tOptions, sOptions)
		OUT = True,doc
	except:
		OUT = False,doc
else: OUT = False,doc
# ----------------------------------------
code_block = CodeBlock(x=python_script) { x[0]; x[1]; }
success = Output(code_block.out0)
Document_2 = Output(code_block.out1)  # "Document"
