# Dynamo custom node Wall CompoundStructureLayersLocation.dyf (Dynamo 1.3.4.6666)
# category: GeniusLoci.CompoundStructure
# Get the wall layers location lines.

Wall = Input()
getLocation = Element.GetLocation(Wall)
# note: Clockwork
orientation = Python(IN[0]=Wall)  # "Wall.Orientation"
# ---------- orientation.python (28 lines) ----------
import clr
clr.AddReference('RevitAPI')
from Autodesk.Revit.DB import *

clr.AddReference("RevitNodes")
import Revit
clr.ImportExtensions(Revit.Elements)
clr.ImportExtensions(Revit.GeometryConversion)

def WallOrientation(wall):
	loc = wall.Location
	flipped = False
	if hasattr(loc, "Curve"):
		lcurve = loc.Curve
		if hasattr(wall, "Flipped"): flipped = wall.Flipped
		if str(type(lcurve)) == "Autodesk.Revit.DB.Line":
			if flipped: return wall.Orientation.ToVector().Reverse()
			else: return wall.Orientation.ToVector()
		else:
			direction = (lcurve.GetEndPoint(1) - lcurve.GetEndPoint(0)).Normalize()
			if flipped: return XYZ.BasisZ.CrossProduct(direction).ToVector().Reverse()
			else: return XYZ.BasisZ.CrossProduct(direction).ToVector()
	else: return None

walls = UnwrapElement(IN[0])

if isinstance(IN[0], list): OUT = [WallOrientation(x) for x in walls]
else: OUT = WallOrientation(walls)
# ----------------------------------------
elementType = Element.ElementType(Wall)
structureLayersWidths = Python(IN[0]=elementType)
# ---------- structureLayersWidths.python (38 lines) ----------
import clr
clr.AddReference('RevitAPI')
from Autodesk.Revit.DB import *

clr.AddReference("RevitNodes")
import Revit
clr.ImportExtensions(Revit.Elements)

# Import DocumentManager and TransactionManager
clr.AddReference('RevitServices')
import RevitServices
from RevitServices.Persistence import DocumentManager
doc = DocumentManager.Instance.CurrentDBDocument

UIunit = Document.GetUnits(doc).GetFormatOptions(UnitType.UT_Length).DisplayUnits

items = UnwrapElement(IN[0])

if not hasattr(items, '__iter__'):
	items = [items]

elemwidth,elemfunc = [],[]

for item in items:
	try:
		counter = 0
		layerwidth,layerfunc = [],[]
		compstruc = item.GetCompoundStructure()
		num = compstruc.LayerCount
		while counter < num:
			layerwidth.append(UnitUtils.ConvertFromInternalUnits((compstruc.GetLayerWidth(counter)),UIunit))
			layerfunc.append(compstruc.GetLayerFunction(counter))
			counter += 1
	except:
		pass
	elemwidth.append(layerwidth)
	elemfunc.append(layerfunc)
OUT = elemwidth,elemfunc
# ----------------------------------------
code_block = CodeBlock(x=structureLayersWidths) { x[0]; x[1]; }
sum_previous = Python(IN[0]=code_block.out0)
# ---------- sum_previous.python (13 lines) ----------
#By salvatoredragotta
datas=IN[0]
Incrementals=[]
for data in datas :
	Incremental=[]
	Incremental.append(data[0])
	i=0
	while i <len(data)-1:
		result=(Incremental[i]+data[i+1])
		Incremental.append(result)
		i +=1
	Incrementals.append(Incremental)
OUT=Incrementals
# ----------------------------------------
code_block_2 = CodeBlock(wallcurves=getLocation, direction=orientation, width=code_block.out0, addition=sum_previous) { wallcurves.Translate(direction,(Math.Sum(width)/2-(addition-(width/2)))); }
Curves = Output(code_block_2)
Functions = Output(code_block.out1)
