# Dynamo custom node LunchBox Quad Grid by Face.dyf (Dynamo 0.7.5.3566)
# category: LunchBox.Archive.Geometry.Panel
# Create a quadrangular XYZ grid on a face.  The face surface must have an untrimmed UV parameter space.

Surface = Input()
U = Input()
lunchbox_list_matcher = Custom[LunchBox List Matcher](ListA=Surface, ListB=U)  # Compares a List A against a List B and matches length of List A. If ListA > ListB, ListB will be extended. If ListA < ListB, ListB will be truncated.
V = Input()
lunchbox_list_matcher_2 = Custom[LunchBox List Matcher](ListA=Surface, ListB=V)
python_script = Python(IN[0]=lunchbox_list_matcher.ListA, IN[1]=lunchbox_list_matcher.MatchListB, IN[2]=lunchbox_list_matcher_2.MatchListB)
# ---------- python_script.python (77 lines) ----------
#Copyright(c) 2014, Nathan Miller
# The Proving Ground, http://theprovingground.org

import clr
clr.AddReference('ProtoGeometry')
from Autodesk.DesignScript.Geometry import *

# Panel division class
class PanelDivision:
	
	# divide surface
	def QuadDivision(self, srf, udiv, vdiv):
		panels = []
		polys = []
		quads = []
	
		ustep = 1.0/udiv
		vstep = 1.0/vdiv
		for i in range(0,int(udiv)):
			for j in range(0,int(vdiv)):
				quad = []
				#XYZ Quads
				myXYZA = srf.PointAtParameter(i*ustep, j*vstep)
				myXYZB = srf.PointAtParameter((i+1)*ustep,j*vstep)
				myXYZC = srf.PointAtParameter((i+1)*ustep,(j+1)*vstep)
				myXYZD = srf.PointAtParameter(i*ustep,(j+1)*vstep)
				#Append to quad
				quad.append(myXYZA)
				quad.append(myXYZB)
				quad.append(myXYZC)
				quad.append(myXYZD)
				#Append quads
				quads.append(quad)
				
				#polygons
				poly = Polygon.ByPoints(quad)
				polys.append(poly)
				
				#panels
				panel = Surface.ByPerimeterPoints(quad)
				panels.append(panel)
				
		self.quads = quads
		self.polys = polys
		self.panels = panels


#main code here....

srf = IN[0]
	
udiv = IN[1]
vdiv = IN[2]
	
panels = []
polys = []
quads = []
	
for k in range(0, len(srf)):
	s = srf[k]
	u = udiv[k]
	v = vdiv[k]
			
	divide = PanelDivision()
	divide.QuadDivision(s,u,v)
					
	quads.append(divide.quads)
	panels.append(divide.panels)
	polys.append(divide.polys)
			
output = []
output.append(quads)
output.append(polys)
output.append(panels)
	
#Assign your output to the OUT variable
OUT = output
# ----------------------------------------
number = DoubleInput(0)
getItemAtIndex = List.GetItemAtIndex(python_script, number)
Panel_Pts = Output(getItemAtIndex)
number_2 = DoubleInput(1)
getItemAtIndex_2 = List.GetItemAtIndex(python_script, number_2)
Panel_Polys = Output(getItemAtIndex_2)
number_3 = DoubleInput(2)
getItemAtIndex_3 = List.GetItemAtIndex(python_script, number_3)
Panel_Faces = Output(getItemAtIndex_3)
