# Dynamo custom node LunchBox Triangle Grid by Face.dyf (Dynamo 0.7.5.3566)
# category: LunchBox.Archive.Geometry.Panel
# Create a Triangular XYZ grid on a face.  The face surface must have an untrimmed UV parameter space.

Surface = Input()
U = Input()
lunchbox_list_matcher = Custom[LunchBox List Matcher](ListA=Surface, ListB=U)  # Compares a List A against a List B and matches length of List A. If ListA > ListB, ListB will be extended. If ListA < ListB, ListB will be truncated.
V = Input()
lunchbox_list_matcher_2 = Custom[LunchBox List Matcher](ListA=Surface, ListB=V)
python_script = Python(IN[0]=lunchbox_list_matcher.ListA, IN[1]=lunchbox_list_matcher.MatchListB, IN[2]=lunchbox_list_matcher_2.MatchListB)
# ---------- python_script.python (92 lines) ----------
#Copyright(c) 2014, Nathan Miller
# The Proving Ground, http://theprovingground.org

import clr
clr.AddReference('ProtoGeometry')
from Autodesk.DesignScript.Geometry import *

# Panel division class
class PanelDivision:
	
	# divide surface
	def TriDivision(self, srf, udiv, vdiv):
		ustep = 1.0/udiv
		vstep = 1.0/vdiv
		
		tris = []
		polys = []
		panels = []
		for i in range(0,int(udiv)):
			for j in range(0,int(vdiv)):
			
				triA = []
				triB = []
				
				#XYZ Tris A
				myXYZ1A = srf.PointAtParameter(i*ustep, j*vstep)
				myXYZ1B = srf.PointAtParameter((i+1)*ustep,j*vstep)
				myXYZ1C = srf.PointAtParameter((i+1)*ustep,(j+1)*vstep)
				
				#XYZ Tris B
				myXYZ2A = srf.PointAtParameter((i+1)*ustep,(j+1)*vstep)
				myXYZ2B = srf.PointAtParameter(i*ustep,(j+1)*vstep)
				myXYZ2C = srf.PointAtParameter(i*ustep, j*vstep)
				
				#Append to tri
				triA.append(myXYZ1A)
				triA.append(myXYZ1B)
				triA.append(myXYZ1C)
		
				triB.append(myXYZ2A)
				triB.append(myXYZ2B)
				triB.append(myXYZ2C)
				
				#Append tris
				tris.append(triA)
				tris.append(triB)
				
				#Polygons
				polyA = Polygon.ByPoints(triA)
				polyB = Polygon.ByPoints(triB)
				polys.append(polyA)
				polys.append(polyB)
				
				#Panels
				panelA = Surface.ByPerimeterPoints(triA)
				panelB = Surface.ByPerimeterPoints(triB)
				panels.append(panelA)
				panels.append(panelB)
				
		self.tris = tris
		self.polys = polys
		self.panels = panels

#Main code
srf = IN[0]
udiv = IN[1]
vdiv = IN[2]

tris = []
polys = []
panels = []

for k in range(0, len(srf)):
	s = srf[k]
	u = udiv[k]
	v = vdiv[k]
			
	divide = PanelDivision()
	divide.TriDivision(s,u,v)
					
	tris.append(divide.tris)
	panels.append(divide.panels)
	polys.append(divide.polys)
	

output = []
output.append(tris)
output.append(polys)
output.append(panels)

#Assign your output to the OUT variable
OUT = output
# ----------------------------------------
number = DoubleInput(0)
getItemAtIndex = List.GetItemAtIndex(python_script, number)
Panel_Pts = Output(getItemAtIndex)
number_2 = DoubleInput(1)
getItemAtIndex_2 = List.GetItemAtIndex(python_script, number_2)
Panel_Polys = Output(getItemAtIndex_2)
number_3 = DoubleInput(2)
getItemAtIndex_3 = List.GetItemAtIndex(python_script, number_3)
Panel_Faces = Output(getItemAtIndex_3)
