# Dynamo custom node Document.BackgroundOpen.dyf (Dynamo 1.2.1.3083)
# category: Rhythm.Revit.Application.Document
# This will open the input Revit files in the background.

filePath = Input()  # Path of the file you want to open in the background
code_block = CodeBlock(item=filePath) { Flatten({item}); }
open_documents = Python(IN[0]=code_block)
# ---------- open_documents.python (37 lines) ----------
import clr
clr.AddReference('ProtoGeometry')
from Autodesk.DesignScript.Geometry import *

# Import Element wrapper extension methods
clr.AddReference("RevitNodes")
import Revit
clr.ImportExtensions(Revit.Elements)

# Import geometry conversion extension methods
clr.ImportExtensions(Revit.GeometryConversion)

# Import DocumentManager and TransactionManager
clr.AddReference("RevitServices")
import RevitServices
from RevitServices.Persistence import DocumentManager
from RevitServices.Transactions import TransactionManager

doc = DocumentManager.Instance.CurrentDBDocument
uiapp = DocumentManager.Instance.CurrentUIApplication
app = uiapp.Application

# Import RevitAPI
clr.AddReference("RevitAPI")
import Autodesk
from Autodesk.Revit.DB import *

items = IN[0]

typelist = list()
for i in items:
	try:
		typelist.append(app.OpenDocumentFile(i))
	except:
		typelist.append(list())
		
OUT = typelist
# ----------------------------------------
clean = Custom[Output.Clean](input=open_documents)  # This will return a single value or list from one input.
Document = Output(clean)
