# Dynamo custom node Get DYF Dependencies through Recursion v1.dyf (Dynamo 1.2.1.3083)
# category: RollingPin.General
# slow to run, repeats for 4 levels deep

path_to_DYF = Input()
path_To_Package_Folder = Input()
get_dyf_dependencies_for_one_dyf = Custom[Get DYF Dependencies for One DYF File](path_to_DYF_or_DYN=path_to_DYF, path_To_Package_Folder=path_To_Package_Folder)  # also works for DYN files
watch = Watch(get_dyf_dependencies_for_one_dyf.files)
get_dyf_dependencies_for_one_dyf_2 = Custom[Get DYF Dependencies for One DYF File](path_To_Package_Folder=path_To_Package_Folder)  # unwired: path_to_DYF_or_DYN
map = List.Map(list=get_dyf_dependencies_for_one_dyf.files, f_x=get_dyf_dependencies_for_one_dyf_2.files)
watch_2 = Watch(map)
flatten = Flatten(watch_2)
get_dyf_dependencies_for_one_dyf_3 = Custom[Get DYF Dependencies for One DYF File](path_To_Package_Folder=path_To_Package_Folder)  # unwired: path_to_DYF_or_DYN
map_2 = List.Map(list=flatten, f_x=get_dyf_dependencies_for_one_dyf_3.files)
watch_3 = Watch(map_2)
flatten_2 = Flatten(watch_3)
get_dyf_dependencies_for_one_dyf_4 = Custom[Get DYF Dependencies for One DYF File](path_To_Package_Folder=path_To_Package_Folder)  # unwired: path_to_DYF_or_DYN
map_3 = List.Map(list=flatten_2, f_x=get_dyf_dependencies_for_one_dyf_4.files)
watch_4 = Watch(map_3)
flatten_3 = Flatten(watch_4)
get_dyf_dependencies_for_one_dyf_5 = Custom[Get DYF Dependencies for One DYF File](path_To_Package_Folder=path_To_Package_Folder)  # unwired: path_to_DYF_or_DYN
map_4 = List.Map(list=flatten_3, f_x=get_dyf_dependencies_for_one_dyf_5.files)
watch_5 = Watch(map_4)
flatten_4 = Flatten(watch_5)
create = List.Create(watch, flatten, flatten_2, flatten_3, flatten_4)
flatten_5 = Flatten(create)
uniqueItems = List.UniqueItems(flatten_5)
filesToTransmit = Output(uniqueItems)
