# Dynamo custom node List Nested Node Nicknames for Folder.dyf (Dynamo 1.2.1.3083)
# category: RollingPin.General

string = StringInput("File Name")
dir_string = Input()
string_2 = StringInput(".dyf")
all_directory_contents_of = Custom[All Directory Contents of Specific Filetype](dir_string=dir_string, file_extension_string_like_txt=string_2)
boolean = BoolSelector(false)
fileName = FilePath.FileName(all_directory_contents_of, boolean)
addItemToFront = List.AddItemToFront(item=string, list=fileName)
string_3 = StringInput("File Path")
addItemToFront_2 = List.AddItemToFront(item=string_3, list=all_directory_contents_of)

# group: Nicknames
string_4 = StringInput("Custom Nodes")
show_dependency_nodes_for_one = Custom[Show Dependency Nodes for one DYF]()  # used with List.Map for a folder of them; unwired: path_to_DYF
map = List.Map(list=all_directory_contents_of, f_x=show_dependency_nodes_for_one)
watch = Watch(map)
merge_sublists_to_strings = Custom[Merge Sublists to Strings](list=watch)
watch_2 = Watch(merge_sublists_to_strings)
addItemToFront_3 = List.AddItemToFront(item=string_4, list=watch_2)

show_dependency_ids_for_one_dyf = Custom[Show Dependency Ids for one DYF]()  # unwired: path_to_DYF

# group: Nicknames
string_5 = StringInput("IDs")
map_2 = List.Map(list=all_directory_contents_of, f_x=show_dependency_ids_for_one_dyf)
watch_3 = Watch(map_2)
merge_sublists_to_strings_2 = Custom[Merge Sublists to Strings](list=watch_3)
watch_4 = Watch(merge_sublists_to_strings_2)
addItemToFront_4 = List.AddItemToFront(item=string_5, list=watch_4)

create = List.Create(addItemToFront, addItemToFront_2, addItemToFront_3, addItemToFront_4)
list = Output(create)
files = Output(all_directory_contents_of)
nodes_referenced_by_file = Output(watch)
