# Dynamo custom node Area.CreateFromPlanCircuit.dyf (Dynamo 1.0.0.1180)
# category: SteamNodes.Area
# Place new Areas in Plan Circuit

# note: From SpringNodes
python_script = Python()
# ---------- python_script.python (15 lines) ----------
#Copyright(c) 2015, Dimitar Venkov
# @5devene, dimitar.ven@gmail.com

import clr

clr.AddReference("RevitServices")
import RevitServices
from RevitServices.Persistence import DocumentManager
doc = DocumentManager.Instance.CurrentDBDocument

clr.AddReference("RevitNodes")
import Revit
clr.ImportExtensions(Revit.Elements)

OUT = doc.ActiveView.ToDSType(True)
# ----------------------------------------
code_block = CodeBlock(item=python_script) { Flatten({item}); }
# note: From Clockwork
python_script_2 = Python(IN[0]=code_block)
# ---------- python_script_2.python (27 lines) ----------
import clr
clr.AddReference('RevitAPI')
from Autodesk.Revit.DB import *

clr.AddReference("RevitNodes")
import Revit
clr.ImportExtensions(Revit.Elements)

clr.AddReference("RevitServices")
import RevitServices
from RevitServices.Persistence import DocumentManager

doc = DocumentManager.Instance.CurrentDBDocument
faminsts = UnwrapElement(IN[0])
elementlist = list()
for item in faminsts:
	try:	
		elementlist.append(doc.GetElement(item.LevelId).ToDSType(True))
	except:
		try:
			elementlist.append(item.Level.ToDSType(True))
		except:
			try:
				elementlist.append(item.GenLevel.ToDSType(True))
			except:
				elementlist.append(list())
OUT = elementlist
# ----------------------------------------
code_block_2 = CodeBlock(a=python_script_2) { a[0]; }
get_plan_circuit = Python(IN[0]=code_block_2)
# ---------- get_plan_circuit.python (51 lines) ----------
#python nodes in dynamo 0.9
#proposed by Julien Benoit @jbenoit44 
#http://aecuandme.wordpress.com/
import clr
clr.AddReference('ProtoGeometry')
from Autodesk.DesignScript.Geometry import *
# Import ToDSType(bool) extension method
clr.AddReference("RevitNodes")
import Revit
clr.ImportExtensions(Revit.Elements)
# Import geometry conversion extension methods
clr.ImportExtensions(Revit.GeometryConversion)
# Import DocumentManager and TransactionManager
clr.AddReference("RevitServices")
import RevitServices
from RevitServices.Persistence import DocumentManager
from RevitServices.Transactions import TransactionManager
from System.Collections.Generic import *
# Import RevitAPI
clr.AddReference("RevitAPI")
import Autodesk
from Autodesk.Revit.DB import *

doc = DocumentManager.Instance.CurrentDBDocument
uiapp = DocumentManager.Instance.CurrentUIApplication
app = uiapp.Application
uidoc=DocumentManager.Instance.CurrentUIApplication.ActiveUIDocument



level=UnwrapElement(IN[0])
#phase=IN[1]
#cir=[]
points=[]
#rooms=UnwrapElement(IN[2])

phases=doc.Phases
# Start Transaction
TransactionManager.Instance.EnsureInTransaction(doc)

PT =doc.get_PlanTopology(level)
circuits=PT.Circuits
a=circuits.Size
for p in circuits:
	points.append(p.GetPointInside())

				
				
# End Transaction
TransactionManager.Instance.TransactionTaskDone()
OUT =points
# ----------------------------------------
code_block_3 = CodeBlock(item=get_plan_circuit) { Flatten({item}); }
create_areas_from_uvs = Python(IN[0]=code_block_3, IN[1]=python_script)
# ---------- create_areas_from_uvs.python (45 lines) ----------
#python nodes in dynamo 1.0
#proposed by Julien Benoit @jbenoit44 
#http://aecuandme.wordpress.com/
import clr
clr.AddReference('ProtoGeometry')
from Autodesk.DesignScript.Geometry import *
# Import ToDSType(bool) extension method
clr.AddReference("RevitNodes")
import Revit
clr.ImportExtensions(Revit.Elements)
# Import geometry conversion extension methods
clr.ImportExtensions(Revit.GeometryConversion)
# Import DocumentManager and TransactionManager
clr.AddReference("RevitServices")
import RevitServices
from RevitServices.Persistence import DocumentManager
from RevitServices.Transactions import TransactionManager
from System.Collections.Generic import *
# Import RevitAPI
clr.AddReference("RevitAPI")
import Autodesk
from Autodesk.Revit.DB import *

doc = DocumentManager.Instance.CurrentDBDocument
uiapp = DocumentManager.Instance.CurrentUIApplication
app = uiapp.Application
uidoc=DocumentManager.Instance.CurrentUIApplication.ActiveUIDocument

uvs =[]
for i in IN[0]:
	uvs.append(UnwrapElement(i))
view=UnwrapElement(IN[1])
roomlist=[]

# Start Transaction
TransactionManager.Instance.EnsureInTransaction(doc)

for item in uvs:
	a=doc.Create.NewArea(view,item)
	roomlist.append(a)

# End Transaction
TransactionManager.Instance.TransactionTaskDone()

OUT = roomlist
# ----------------------------------------
Areas = Output(create_areas_from_uvs)
