# Dynamo custom node Element.IsTagged.dyf (Dynamo 1.0.0.1180)
# category: SteamNodes.Element
# Checks if all Elements are tagged in the project

Tags_of_Category = Input()
code_block = CodeBlock(item=Tags_of_Category) { Flatten({item}); }
python_script = Python(IN[0]=code_block)
# ---------- python_script.python (50 lines) ----------
#python nodes in dynamo 1.0
#proposed by Julien Benoit @jbenoit44 
#http://aecuandme.wordpress.com/
import clr
clr.AddReference('ProtoGeometry')
from Autodesk.DesignScript.Geometry import *
# Import ToDSType(bool) extension method
clr.AddReference("RevitNodes")
import Revit
clr.ImportExtensions(Revit.Elements)
# Import geometry conversion extension methods
clr.ImportExtensions(Revit.GeometryConversion)
# Import DocumentManager and TransactionManager
clr.AddReference("RevitServices")
import RevitServices
from RevitServices.Persistence import DocumentManager
from RevitServices.Transactions import TransactionManager
from System.Collections.Generic import *
# Import RevitAPI
clr.AddReference("RevitAPI")
import Autodesk
from Autodesk.Revit.DB import *

doc = DocumentManager.Instance.CurrentDBDocument
uiapp = DocumentManager.Instance.CurrentUIApplication
app = uiapp.Application
uidoc=DocumentManager.Instance.CurrentUIApplication.ActiveUIDocument

elt = []
for i in IN[0]:
	elt.append(UnwrapElement(i))

ids, tags = [], []

# Start Transaction
#TransactionManager.Instance.EnsureInTransaction(doc)


for i in elt:
	if i.TaggedLocalElementId.IntegerValue != -1:
		ids.append(i.TaggedLocalElementId)
		tags.append(i)
	else:
		continue
		

# End Transaction
#TransactionManager.Instance.TransactionTaskDone()

OUT = ids, tags
# ----------------------------------------
code_block_2 = CodeBlock(a=python_script) { a[0]; a[1]; }
Tag_s_ID = Output(code_block_2.out1)  # "Tag's ID"
Elements_of_Category = Input()
code_block_3 = CodeBlock(item=Elements_of_Category) { Flatten({item}); }
uniqueItems = List.UniqueItems(code_block_2.out0)
python_script_2 = Python(IN[0]=code_block_3)
# ---------- python_script_2.python (24 lines) ----------
#python nodes in dynamo 1.0
#proposed by Julien Benoit @jbenoit44 
#http://aecuandme.wordpress.com/
import clr
clr.AddReference('ProtoGeometry')
from Autodesk.DesignScript.Geometry import *
# Import RevitAPI
clr.AddReference('RevitAPI')
import Autodesk
#The inputs to this node will be stored as a list in the IN variable.
dataEnteringNode = IN

elements = []
for i in IN[0]:
    elements.append(UnwrapElement(i))

elementIds, idString, guid = [], [], []
for i in elements:
    elementIds.append(i.Id)
    idString.append(i.Id.ToString())
    guid.append(i.UniqueId)
    
#Assign your output to the OUT variable
OUT = elementIds, idString, guid
# ----------------------------------------
code_block_4 = CodeBlock(OUT=python_script_2) { OUT[0]; }
containsItem = List.ContainsItem(list=uniqueItems, item=code_block_4)
filterByBoolMask = List.FilterByBoolMask(list=code_block_3, mask=containsItem)
Untagged_Element_s = Output(filterByBoolMask.out)  # "Untagged Element(s)"
Tagged_Element_s = Output(filterByBoolMask.in)  # "Tagged Element(s)"
