# Dynamo custom node Element.SelectInView.dyf (Dynamo 1.2.0.2690)
# category: SteamNodes.Element
# Select the input elements in active view. Disconnect / Connect to refresh.

Element = Input()
code_block = CodeBlock(item=Element) { Flatten({item}); }
python_script = Python(IN[0]=code_block)
# ---------- python_script.python (39 lines) ----------
#python nodes in dynamo 1.0
#proposed by Julien Benoit @jbenoit44 
#http://aecuandme.wordpress.com/
import clr
clr.AddReference('ProtoGeometry')
from Autodesk.DesignScript.Geometry import *
# Import ToDSType(bool) extension method
clr.AddReference("RevitNodes")
import Revit
clr.ImportExtensions(Revit.Elements)
# Import geometry conversion extension methods
clr.ImportExtensions(Revit.GeometryConversion)
# Import DocumentManager and TransactionManager
clr.AddReference("RevitServices")
import RevitServices
from RevitServices.Persistence import DocumentManager
from RevitServices.Transactions import TransactionManager
from System.Collections.Generic import *
import System.Object
# Import RevitAPI
clr.AddReference("RevitAPI")
import Autodesk
from Autodesk.Revit.DB import *

doc = DocumentManager.Instance.CurrentDBDocument
uiapp = DocumentManager.Instance.CurrentUIApplication
app = uiapp.Application
uidoc=DocumentManager.Instance.CurrentUIApplication.ActiveUIDocument

input = UnwrapElement(IN[0])
elt=[]
for i in input:
	elt.append(i.Id)

collection = List[ElementId](elt)

uidoc.Selection.SetElementIds(collection)

OUT = input,collection
# ----------------------------------------
code_block_2 = CodeBlock(a=python_script) { a[0]; a[1]; }
Element_s = Output(code_block_2.out0)  # "Element(s)"
Id_s = Output(code_block_2.out1)  # "Id(s)"
Refresh_Boolean = Input()  # "Refresh(Boolean)"
