# Dynamo custom node List.Operations.dyf (Dynamo 1.0.0.1180)
# category: SteamNodes.List
# List A-B / List Intersection / List symmetric difference

List_A = Input()
List_B = Input()
python_script = Python(IN[0]=List_A, IN[1]=List_B)
# ---------- python_script.python (20 lines) ----------
#python nodes in dynamo 1.0
#proposed by Julien Benoit @jbenoit44 
#http://aecuandme.wordpress.com/
import clr
clr.AddReference('ProtoGeometry')
from Autodesk.DesignScript.Geometry import *

listA = IN[0]
listB = IN[1]

if len(listA) > len(listB):
	a=list(set(listA).difference(set(listB)))
else:
	a=list(set(listB).difference(set(listA)))

b=list(set(listA).intersection(set(listB)))

c=list(set(listA).symmetric_difference(set(listB)))

OUT = a,b,c
# ----------------------------------------
code_block = CodeBlock { 0; 1; 2; }
getItemAtIndex = List.GetItemAtIndex(list=python_script, index=code_block.out1)
flatten = Flatten(getItemAtIndex)
Intersection = Output(flatten)
getItemAtIndex_2 = List.GetItemAtIndex(list=python_script, index=code_block.out0)
flatten_2 = Flatten(getItemAtIndex_2)
A_B = Output(flatten_2)  # "A-B"
getItemAtIndex_3 = List.GetItemAtIndex(list=python_script, index=code_block.out2)
flatten_3 = Flatten(getItemAtIndex_3)
Symmetric_Difference = Output(flatten_3)
