# Dynamo custom node Parts.IsFromLinkedElement.dyf (Dynamo 1.0.0.1180)
# category: SteamNodes.Parts
# Check if Parts are derived from linked elements

Parts = Input()
code_block = CodeBlock(item=Parts) { Flatten({item}); }
python_script = Python(IN[0]=code_block)
# ---------- python_script.python (42 lines) ----------
#python nodes in dynamo 1.0
#proposed by Julien Benoit @jbenoit44 
#http://aecuandme.wordpress.com/
import clr
clr.AddReference('ProtoGeometry')
from Autodesk.DesignScript.Geometry import *
# Import ToDSType(bool) extension method
clr.AddReference("RevitNodes")
import Revit
clr.ImportExtensions(Revit.Elements)
# Import geometry conversion extension methods
clr.ImportExtensions(Revit.GeometryConversion)
# Import DocumentManager and TransactionManager
clr.AddReference("RevitServices")
import RevitServices
from RevitServices.Persistence import DocumentManager
from RevitServices.Transactions import TransactionManager
from System.Collections.Generic import *
# Import RevitAPI
clr.AddReference("RevitAPI")
import Autodesk
from Autodesk.Revit.DB import *

doc = DocumentManager.Instance.CurrentDBDocument
uiapp = DocumentManager.Instance.CurrentUIApplication
app = uiapp.Application
uidoc=DocumentManager.Instance.CurrentUIApplication.ActiveUIDocument

elt = []
for i in IN[0]:
	elt.append(UnwrapElement(i))
bool=[]
# Start Transaction
TransactionManager.Instance.EnsureInTransaction(doc)
for p  in elt:
	bool.append(PartUtils.IsPartDerivedFromLink(p))
		

# End Transaction
TransactionManager.Instance.TransactionTaskDone()

OUT=bool
# ----------------------------------------
Booleans = Output(python_script)
