# Dynamo custom node Schedule.GetCalculatedValues.dyf (Dynamo 1.0.0.1180)
# category: SteamNodes.Schedule
# Get Schedule Calculated Values from name input

ViewSchedule_List = Input()
code_block = CodeBlock(Item=ViewSchedule_List) { Flatten({Item}); }
Calc_Val_Name_string = Input()  # "Calc. Val. Name (string)"
python_script = Python(IN[0]=code_block, IN[1]=Calc_Val_Name_string)
# ---------- python_script.python (59 lines) ----------
#python nodes in dynamo 1.0
#proposed by Julien Benoit @jbenoit44 
#http://aecuandme.wordpress.com/
import clr
clr.AddReference('ProtoGeometry')
from Autodesk.DesignScript.Geometry import *
# Import ToDSType(bool) extension method
clr.AddReference("RevitNodes")
import Revit
clr.ImportExtensions(Revit.Elements)
# Import geometry conversion extension methods
clr.ImportExtensions(Revit.GeometryConversion)
# Import DocumentManager and TransactionManager
clr.AddReference("RevitServices")
import RevitServices
from RevitServices.Persistence import DocumentManager
from RevitServices.Transactions import TransactionManager
from System.Collections.Generic import *
# Import RevitAPI
clr.AddReference("RevitAPI")
import Autodesk
from Autodesk.Revit.DB import *

doc = DocumentManager.Instance.CurrentDBDocument
uiapp = DocumentManager.Instance.CurrentUIApplication
app = uiapp.Application
uidoc=DocumentManager.Instance.CurrentUIApplication.ActiveUIDocument

views = []
for i in IN[0]:
	views.append(UnwrapElement(i))

values=[]
name=IN[1]

# Start Transaction
TransactionManager.Instance.EnsureInTransaction(doc)
for v in views:
	value=[]
	for i in range(100):
		try:
			b=SectionType.Body
			a=v.GetCellText(b,0,i)
		except:
			0
		if a == IN[1]:
			try:
				for n in range(2000):
					c=SectionType.Body
					d=v.GetCellText(b,n,i)
					value.append(d)
			except:
				0		
	values.append(value)
	
# End Transaction
TransactionManager.Instance.TransactionTaskDone()

OUT=values
# ----------------------------------------
isEmpty = List.IsEmpty()
map = List.Map(list=python_script, f_x=isEmpty)
filterByBoolMask = List.FilterByBoolMask(list=python_script, mask=map)
deconstruct = List.Deconstruct()
map_2 = List.Map(list=filterByBoolMask.out, f_x=deconstruct.first)
Header_s = Output(map_2)  # "Header(s)"
# note: If same Calc val is found in multiple schedule, it will be returned as list of list.
map_3 = List.Map(list=filterByBoolMask.out, f_x=deconstruct.rest)
Value_s = Output(map_3)  # "Value(s)"
