# Dynamo custom node Tool.AssemblyViews.dyf (Dynamo 1.0.0.1180)
# category: SteamNodes.Tool
# Create Sheet and Views for Assembly instances

Assembly_List = Input()
code_block = CodeBlock(item=Assembly_List) { Flatten({item}); }
Ortho3D = Input(Ortho3D: bool=true)
PlanView = Input(PlanView : bool=true)
ElevationTop = Input(ElevationTop: bool=true)
ElevationBottom = Input(ElevationBottom: bool=true)
ElevationLeft = Input(ElevationLeft: bool=true)
ElevationRight = Input(ElevationRight  : bool=true)
ElevationFront = Input(ElevationFront: bool=true)
ElevationBack = Input(ElevationBack: bool=true)
PartList = Input(PartList : bool=true)
DetailSectionA = Input(DetailSectionA : bool=true)
DetailSectionB = Input(DetailSectionB : bool=true)
CreateSheet = Input(CreateSheet : bool=true)
TitleBlockType = Input()
python_script = Python(IN[0]=code_block, IN[1]=Ortho3D, IN[2]=PlanView, IN[3]=ElevationTop, IN[4]=ElevationBottom, IN[5]=ElevationLeft, IN[6]=ElevationRight, IN[7]=ElevationFront, IN[8]=ElevationBack, IN[9]=PartList, IN[10]=DetailSectionA, IN[11]=DetailSectionB, IN[12]=CreateSheet, IN[13]=TitleBlockType)
# ---------- python_script.python (91 lines) ----------
#python nodes in dynamo 1.0
#proposed by Julien Benoit @jbenoit44 
#http://aecuandme.wordpress.com/
import clr
clr.AddReference('ProtoGeometry')
from Autodesk.DesignScript.Geometry import *
# Import ToDSType(bool) extension method
clr.AddReference("RevitNodes")
import Revit
clr.ImportExtensions(Revit.Elements)
# Import geometry conversion extension methods
clr.ImportExtensions(Revit.GeometryConversion)
# Import DocumentManager and TransactionManager
clr.AddReference("RevitServices")
import RevitServices
from RevitServices.Persistence import DocumentManager
from RevitServices.Transactions import TransactionManager
from System.Collections.Generic import *
# Import RevitAPI
clr.AddReference("RevitAPI")
import Autodesk
from Autodesk.Revit.DB import *

doc = DocumentManager.Instance.CurrentDBDocument
uiapp = DocumentManager.Instance.CurrentUIApplication
app = uiapp.Application
uidoc=DocumentManager.Instance.CurrentUIApplication.ActiveUIDocument

elt = []
for i in IN[0]:
	elt.append(UnwrapElement(i).Id)
	
tb=UnwrapElement(IN[13]).Id
	
catid=doc.GetElement(elt[0]).Category.Id
	
collection=List[ElementId](elt)
viewlist=[]
schedlist=[]
sheetlist=[]
# Start Transaction
TransactionManager.Instance.EnsureInTransaction(doc)
for a in elt:
	views=[]
	if IN[1] == 1:
		v=AssemblyViewUtils.Create3DOrthographic(doc,a)
		views.append(v)
	if IN[2] == 1:	
		ds2=AssemblyViewUtils.CreateDetailSection(doc,a,AssemblyDetailViewOrientation.HorizontalDetail)
		views.append(ds2)
	if IN[3] == 1:	
		ds3=AssemblyViewUtils.CreateDetailSection(doc,a,AssemblyDetailViewOrientation.ElevationTop)
		views.append(ds3)
	if IN[4] == 1:	
		ds4=AssemblyViewUtils.CreateDetailSection(doc,a,AssemblyDetailViewOrientation.ElevationBottom)
		views.append(ds4)
	if IN[5] == 1:	
		ds5=AssemblyViewUtils.CreateDetailSection(doc,a,AssemblyDetailViewOrientation.ElevationLeft)
		views.append(ds5)
	if IN[6] == 1:	
		ds6=AssemblyViewUtils.CreateDetailSection(doc,a,AssemblyDetailViewOrientation.ElevationRight)
		views.append(ds6)
	if IN[7] == 1:	
		ds7=AssemblyViewUtils.CreateDetailSection(doc,a,AssemblyDetailViewOrientation.ElevationFront)
		views.append(ds7)
	if IN[8] == 1:	
		ds8=AssemblyViewUtils.CreateDetailSection(doc,a,AssemblyDetailViewOrientation.ElevationBack)
		views.append(ds8)
	if IN[9] == 1:	
		ds9=AssemblyViewUtils.CreatePartList(doc,a)
		views.append(ds9)
	if IN[10] == 1:	
		ds10=AssemblyViewUtils.CreateDetailSection(doc,a,AssemblyDetailViewOrientation.DetailSectionA)
		views.append(ds10)
	if IN[11] == 1:	
		ds11=AssemblyViewUtils.CreateDetailSection(doc,a,AssemblyDetailViewOrientation.DetailSectionB)
		views.append(ds11)
	viewlist.append(views)
	if IN[12] == 1:
		sh=AssemblyViewUtils.CreateSheet(doc,a,tb)
		for v in views:
			if Viewport.CanAddViewToSheet(doc,sh.Id,v.Id) == 1:
				Viewport.Create(doc,sh.Id,v.Id,XYZ(0,0,0))
			else:
				ScheduleSheetInstance.Create(doc,sh.Id,v.Id,XYZ(0,0,0))
		sheetlist.append(sh)
doc.Regenerate()
# End Transaction
TransactionManager.Instance.TransactionTaskDone()

OUT=viewlist,sheetlist
# ----------------------------------------
code_block_2 = CodeBlock(a=python_script) { a[0]; a[1]; }
List_of_View_s = Output(code_block_2.out0)  # "List of View(s)"
Sheet_s = Output(code_block_2.out1)  # "Sheet(s)"
