# Dynamo custom node Tool.CreateEmptySheet.dyf (Dynamo 1.0.0.1180)
# category: SteamNodes.Tool
# Add the amount of sheets from titleblock type. numbers and names are set from lists

Type_TitleBlock = Input()  # "Type [TitleBlock]"
List_SheetNames = Input()  # "List [SheetNames]"
count = Count(List_SheetNames)
List_SheetNumbers = Input()  # "List [SheetNumbers]"
count_2 = Count(List_SheetNumbers)
eq = count == count_2
max = Math.Max(value1=count, value2=count_2)
if_ = If(test=eq, true=count, false=max)
ofRepeatedItem = List.OfRepeatedItem(item=Type_TitleBlock, amount=if_)
code_block = CodeBlock(item=ofRepeatedItem) { Flatten({item}); }
python_script = Python(IN[0]=code_block, IN[1]=List_SheetNames, IN[2]=List_SheetNumbers)
# ---------- python_script.python (70 lines) ----------
#python nodes in dynamo 1.0
#proposed by Julien Benoit @jbenoit44 
#http://aecuandme.wordpress.com/

#Credits for Traceback:
# Copyright(c) 2015, Konrad K Sobon
# @arch_laboratory, http://archi-lab.net

import clr
clr.AddReference('ProtoGeometry')
from Autodesk.DesignScript.Geometry import *
# Import ToDSType(bool) extension method
clr.AddReference("RevitNodes")
import Revit
clr.ImportExtensions(Revit.Elements)
# Import geometry conversion extension methods
clr.ImportExtensions(Revit.GeometryConversion)
# Import DocumentManager and TransactionManager
clr.AddReference("RevitServices")
import RevitServices
from RevitServices.Persistence import DocumentManager
from RevitServices.Transactions import TransactionManager
from System.Collections.Generic import *
# Import RevitAPI
clr.AddReference("RevitAPI")
import Autodesk
from Autodesk.Revit.DB import *

import sys
pyt_path = r'C:\Program Files (x86)\IronPython 2.7\Lib'
sys.path.append(pyt_path)

doc = DocumentManager.Instance.CurrentDBDocument
uiapp = DocumentManager.Instance.CurrentUIApplication
app = uiapp.Application
uidoc=DocumentManager.Instance.CurrentUIApplication.ActiveUIDocument

elt = []
names=[]
numbers=[]
sheets=[]
for i in IN[0]:
	elt.append(UnwrapElement(i).Id)
for i in IN[1]:
	names.append(UnwrapElement(i))
for i in IN[2]:
	numbers.append(UnwrapElement(i))

# Start Transaction
TransactionManager.Instance.EnsureInTransaction(doc)
for i,n,u in zip(elt,names,numbers):
	try:
		errorReport = None
		a=ViewSheet.Create(doc,i)
		a.ViewName=n
		a.SheetNumber=u
		sheets.append(a.ToDSType(False))
	except:
		# if error accurs anywhere in the process catch it
		import traceback
		errorReport = traceback.format_exc()

# End Transaction
TransactionManager.Instance.TransactionTaskDone()

#Assign your output to the OUT variable
if errorReport == None:
	OUT = sheets
else:
	OUT = errorReport,sheets
# ----------------------------------------
Sheets = Output(python_script)
Refresh = Input(Refresh:bool)
code_block_2 = CodeBlock(a=Refresh) { a; }
