# Dynamo custom node Tool.CropViewFromRoomShapeWithOffset.dyf (Dynamo 1.2.0.2690)
# category: SteamNodes.Tool
# Crop the floor plan view according to the room shape with an offset value.

Room = Input()
rooms = CodeBlock(item=Room) { Flatten({item}); }
finishBoundary = Room.FinishBoundary(rooms)
firstItem = List.FirstItem(finishBoundary@L3)
byJoinedCurves = PolyCurve.ByJoinedCurves(firstItem@L2)
Offset = Input(Offset:double=200)
code_block = CodeBlock { 0; }
offset = PolyCurve.Offset(byJoinedCurves, Offset, code_block)
explode = Geometry.Explode(offset)
FloorPlanView = Input()
floor_plan = CodeBlock(item=FloorPlanView) { Flatten({item}); }
RunMe = Input(RunMe:bool)
python_script = Python(IN[0]=explode, IN[1]=floor_plan, IN[2]=RunMe, IN[3]=rooms)
# ---------- python_script.python (70 lines) ----------
#python nodes in dynamo 1.2
#proposed by Julien Benoit @jbenoit44 
#http://aecuandme.wordpress.com/
import clr
clr.AddReference('ProtoGeometry')
from Autodesk.DesignScript.Geometry import *

# Import Element wrapper extension methods
clr.AddReference("RevitNodes")
import Revit
clr.ImportExtensions(Revit.Elements)

# Import geometry conversion extension methods
clr.ImportExtensions(Revit.GeometryConversion)

# Import DocumentManager and TransactionManager
clr.AddReference("RevitServices")
import RevitServices
from RevitServices.Persistence import DocumentManager
from RevitServices.Transactions import TransactionManager

doc = DocumentManager.Instance.CurrentDBDocument
uiapp = DocumentManager.Instance.CurrentUIApplication
app = uiapp.Application

# Import RevitAPI
clr.AddReference("RevitAPI")
import Autodesk
from Autodesk.Revit.DB import *

import System
import math
from System import Array
from System.Collections.Generic import *

looplist=[]
vp=[]
rm=[]
for list in IN[0]:
	loop=[]
	for c in list:
		loop.append(UnwrapElement(c).ToRevitType())
	ILoop=List[Curve](loop)
	CL=CurveLoop.Create(ILoop)
	looplist.append(CL)
for i in IN[1]:	
	vp.append(UnwrapElement(i))
for i in IN[3]:	
	rm.append(UnwrapElement(i))
	
RunMe=IN[2]
if RunMe:
	# Start Transaction
	TransactionManager.Instance.EnsureInTransaction(doc)
	for l,v in zip(looplist,vp):
		#assign CurveLoop to the CropBox of the view
		v.CropBoxActive =True
		cropManager = v.GetCropRegionShapeManager()
		if cropManager.IsValidObject and cropManager.IsCropRegionShapeValid(l):					
			cropManager.SetCropShape(l)
		else:
			print 'Not Allowed to manage Crop for ' + v.Name + ' :-(' 
			v.CropBoxActive = False
	# End Transaction
	TransactionManager.Instance.TransactionTaskDone()
	doc.Regenerate()
else:
	OUT = "Run Me set to False"
#Assign your output to the OUT variable.
OUT = IN[1]
# ----------------------------------------
FloorPlanView_2 = Output(python_script)  # "FloorPlanView"
