# Dynamo custom node Tool.GetLineStyleByName.dyf (Dynamo 1.0.0.1180)
# category: SteamNodes.Tool
# Collects LineStyle from string.contains

empty = List.Empty()
python_script = Python(IN[0]=empty)
# ---------- python_script.python (43 lines) ----------
#python nodes in dynamo 1.0
#proposed by Julien Benoit @jbenoit44 
#http://aecuandme.wordpress.com/
import clr
clr.AddReference('ProtoGeometry')
from Autodesk.DesignScript.Geometry import *
# Import ToDSType(bool) extension method
clr.AddReference("RevitNodes")
import Revit
clr.ImportExtensions(Revit.Elements)
# Import geometry conversion extension methods
clr.ImportExtensions(Revit.GeometryConversion)
# Import DocumentManager and TransactionManager
clr.AddReference("RevitServices")
import RevitServices
from RevitServices.Persistence import DocumentManager
from RevitServices.Transactions import TransactionManager
from System.Collections.Generic import *
# Import RevitAPI
clr.AddReference("RevitAPI")
import Autodesk
from Autodesk.Revit.DB import *

doc = DocumentManager.Instance.CurrentDBDocument
uiapp = DocumentManager.Instance.CurrentUIApplication
app = uiapp.Application
uidoc=DocumentManager.Instance.CurrentUIApplication.ActiveUIDocument
TransactionManager.Instance.EnsureInTransaction(doc)

elt = []
list=[]
a=UnwrapElement(IN[0])
a=doc.Settings.Categories.get_Item(BuiltInCategory.OST_Lines)
b=a.SubCategories

for i in b:
	c=i.Name.ToString()
	list.append(c)
	
# End Transaction
TransactionManager.Instance.TransactionTaskDone()

OUT = b,list
# ----------------------------------------
code_block = CodeBlock(list=python_script) { list[0]; list[1]; }
Contains_String = Input()
IgnoreCase = Input(IgnoreCase : bool = true)
contains = String.Contains(str=code_block.out1, searchFor=Contains_String, ignoreCase=IgnoreCase)
filterByBoolMask = List.FilterByBoolMask(list=code_block.out0, mask=contains)
LineStyle_Internal = Output(filterByBoolMask.in)  # "LineStyle (Internal)"
filterByBoolMask_2 = List.FilterByBoolMask(list=code_block.out1, mask=contains)
LineStyle_Name = Output(filterByBoolMask_2.in)  # "LineStyle(Name)"
All_LineStyle = Output(code_block.out0)
sort = List.Sort(code_block.out1)
All_LS_Names = Output(sort)
