# Dynamo custom node Tool.IntersectionChecker.dyf (Dynamo 1.2.1.3083)
# category: SteamNodes.Tool
# Checks if elements have a geometrical intersection. The result is a list of list, with First Element is checked against the others.

join = List.Join()  # unwired: arg0, arg1
# note: Element A will be checked against B elements and the result is returned with A as first element of a list, then intersecting elements.
Element_A = Input()
code_block = CodeBlock(item=Element_A) { Flatten({item}); }
geometry = Element.Geometry(code_block)
flatten = Flatten(geometry)
Element_B = Input()
code_block_2 = CodeBlock(item=Element_B) { Flatten({item}); }
geometry_2 = Element.Geometry(code_block_2)
doesIntersect = Geometry.DoesIntersect(other=geometry_2)  # unwired: geometry
map = List.Map(list=flatten, f_x=doesIntersect)
allFalse = AllFalse()  # unwired: arg0
map_2 = List.Map(f_x=allFalse)  # unwired: list
map_3 = List.Map(list=map, f_x=map_2)
filterByBoolMask = List.FilterByBoolMask(list=code_block_2)  # unwired: mask
map_4 = List.Map(list=map_3, f_x=filterByBoolMask.in)
combine = List.Combine(join, code_block, map_4)
A_B_elements = Output(combine)  # "A + B elements"
deconstruct = List.Deconstruct()  # unwired: list
map_5 = List.Map(list=combine, f_x=deconstruct.first)
A = Output(map_5)
map_6 = List.Map(list=combine, f_x=deconstruct.rest)
Intersecting_Elements = Output(map_6)
