# Dynamo custom node Tool.PhysicalBeamToAnalytical.dyf (Dynamo 1.0.0.1180)
# category: SteamNodes.Tool
# **MANUAL MODE ONLY**
# Move Physical Beam to his Analytical model location

StructuralFraming = Input()
code_block = CodeBlock(item=StructuralFraming) { Flatten({item}); }
python_script = Python(IN[0]=code_block)
# ---------- python_script.python (50 lines) ----------
#python nodes in dynamo 1.0
#proposed by Julien Benoit @jbenoit44 
#http://aecuandme.wordpress.com/
import clr
clr.AddReference('ProtoGeometry')
from Autodesk.DesignScript.Geometry import *
# Import ToDSType(bool) extension method
clr.AddReference("RevitNodes")
import Revit
clr.ImportExtensions(Revit.Elements)
# Import geometry conversion extension methods
clr.ImportExtensions(Revit.GeometryConversion)
# Import DocumentManager and TransactionManager
clr.AddReference("RevitServices")
import RevitServices
from RevitServices.Persistence import DocumentManager
from RevitServices.Transactions import TransactionManager
from System.Collections.Generic import *
# Import RevitAPI
clr.AddReference("RevitAPI")
import Autodesk
from Autodesk.Revit.DB import *

doc = DocumentManager.Instance.CurrentDBDocument
uiapp = DocumentManager.Instance.CurrentUIApplication
app = uiapp.Application
uidoc=DocumentManager.Instance.CurrentUIApplication.ActiveUIDocument


AM = []
elt = []
curves=[]
for i in IN[0]:
	elt.append(UnwrapElement(i).Id.IntegerValue)


# Start Transaction
TransactionManager.Instance.EnsureInTransaction(doc)

for e in elt:
	id=ElementId(e+1)
	AM.append(doc.GetElement(id))
	curves.append(doc.GetElement(id).GetCurve())
	#AM.append(i.GetAnalyticalModel())
		

# End Transaction
TransactionManager.Instance.TransactionTaskDone()

OUT=AM,curves
# ----------------------------------------
code_block_2 = CodeBlock(a=python_script) { a[0]; a[1]; }
python_script_2 = Python(IN[0]=code_block_2.out0)
# ---------- python_script_2.python (27 lines) ----------
#python nodes in dynamo 1.0
#proposed by Julien Benoit @jbenoit44 
#http://aecuandme.wordpress.com/
# Default imports
import clr
clr.AddReference('RevitAPI')
clr.AddReference('RevitAPIUI')
from Autodesk.Revit.DB import *
import Autodesk
import sys
import clr
path = r'C:\Autodesk\Dynamo\Core'
exec_path = r'C:\Autodesk\Dynamo\Core\dll'
sys.path.append(path)
sys.path.append(exec_path)
clr.AddReference('LibGNet')
from Autodesk.LibG import *

#The input to this node will be stored in the IN[0] variable.
elt=[]
for i in IN[0]:
	elt.append(UnwrapElement(i))
for item in elt:
	if item.IsManuallyAdjusted() == True:
		a=item.ResetManualAdjustment()
#Assign your output to the OUT variable
OUT = elt
# ----------------------------------------
Analytical = Output(python_script_2)
python_script_3 = Python(IN[0]=code_block, IN[1]=code_block_2.out1)
# ---------- python_script_3.python (45 lines) ----------
#python nodes in dynamo 1.0
#proposed by Julien Benoit @jbenoit44 
#http://aecuandme.wordpress.com/
import clr
clr.AddReference('ProtoGeometry')
from Autodesk.DesignScript.Geometry import *
# Import ToDSType(bool) extension method
clr.AddReference("RevitNodes")
import Revit
clr.ImportExtensions(Revit.Elements)
# Import geometry conversion extension methods
clr.ImportExtensions(Revit.GeometryConversion)
# Import DocumentManager and TransactionManager
clr.AddReference("RevitServices")
import RevitServices
from RevitServices.Persistence import DocumentManager
from RevitServices.Transactions import TransactionManager
from System.Collections.Generic import *
# Import RevitAPI
clr.AddReference("RevitAPI")
import Autodesk
from Autodesk.Revit.DB import *

doc = DocumentManager.Instance.CurrentDBDocument
uiapp = DocumentManager.Instance.CurrentUIApplication
app = uiapp.Application
uidoc=DocumentManager.Instance.CurrentUIApplication.ActiveUIDocument

lines = IN[1]
elt = []

for i in IN[0]:
	elt.append(UnwrapElement(i))

# Start Transaction
TransactionManager.Instance.EnsureInTransaction(doc)

for e,l in zip(elt,lines):
	a=e.Location
	a.Curve=l

# End Transaction
TransactionManager.Instance.TransactionTaskDone()

OUT=elt
# ----------------------------------------
Physical = Output(python_script_3)
