# Dynamo custom node Tool.UnusedTypes.dyf (Dynamo 1.0.0.1180)
# category: SteamNodes.Tool
# collects unused types in model before deletion

Category = Input()
code_block = CodeBlock(a=Category) { Flatten({a}); }
python_script = Python(IN[0]=code_block)
# ---------- python_script.python (23 lines) ----------
#python nodes in dynamo 1.0
#proposed by Julien Benoit @jbenoit44 
#http://aecuandme.wordpress.com/
import System
import clr
clr.AddReference('RevitAPI')
from Autodesk.Revit.DB import *

clr.AddReference("RevitServices")
import RevitServices
from RevitServices.Persistence import DocumentManager

doc = DocumentManager.Instance.CurrentDBDocument
cats = IN[0]

elementlist = []
for item in cats:
	collector = FilteredElementCollector(doc)
	collector.OfClass(FamilySymbol)
	bic = System.Enum.ToObject(BuiltInCategory, item.Id)
	collector.OfCategory(bic)
	elementlist.append(collector.ToElements())
OUT =collector.ToElements()
# ----------------------------------------
all_elements_of_category = ElementsOfCategory(Category)
type = FamilyInstance.Type(all_elements_of_category)
uniqueItems = List.UniqueItems(type)
setDifference = SetDifference(python_script, uniqueItems)
List = Output(setDifference)
