# Dynamo custom node Get Rooms by Level.dyf (Dynamo 1.2.0.2690)
# category: Archi-lab_Grimshaw.Selection.Select
# Filters Rooms by level.

Level = Input()
Exclude_Unplaced = Input()  # "Exclude Unplaced?"
python_script = Python(IN[0]=Level, IN[1]=Exclude_Unplaced)
# ---------- python_script.python (74 lines) ----------
#Copyright(c) 2014, Konrad K Sobon
# Grimshaw Architects, http://grimshaw-architects.com/
# Archi-lab, http://wwww.archi-lab.net

# Default imports
import clr
clr.AddReference('ProtoGeometry')
from Autodesk.DesignScript.Geometry import *

# Import RevitAPI
clr.AddReference("RevitAPI")
import Autodesk
from Autodesk.Revit.DB import *

# Import DocumentManager and TransactionManager
clr.AddReference("RevitServices")
import RevitServices
from RevitServices.Persistence import DocumentManager
from RevitServices.Transactions import TransactionManager

# Import ToDSType(bool) extension method
clr.AddReference("RevitNodes")
import Revit
clr.ImportExtensions(Revit.Elements)
clr.ImportExtensions(Revit.GeometryConversion)

#Import Collections
from System.Collections.Generic import *

#The inputs to this node will be stored as a list in the IN variable.
dataEnteringNode = IN

doc =  DocumentManager.Instance.CurrentDBDocument
app =  DocumentManager.Instance.CurrentUIApplication.Application
levelInput = IN[0]
filterToggle = IN[1]
roomNames, validRooms = [], []

collector = FilteredElementCollector(doc)
levelFilter = ElementLevelFilter(UnwrapElement(levelInput).Id)

areaFilter = AreaFilter()
areaExcludes = collector.WherePasses(areaFilter).ToElements()
areaExcludes = list(areaExcludes)

element_set = ElementSet()
excludes = List[ElementId]()
if len(areaExcludes) == 0:
	logicalFilter = levelFilter
else:
	for i in areaExcludes:
		element_set.Insert(i)
		elemIter = element_set.ForwardIterator()
		elemIter.Reset()
		while elemIter.MoveNext():
			curElem = elemIter.Current
			excludes.Add(curElem.Id)
	filter = ExclusionFilter(excludes)
	logicalFilter = LogicalAndFilter(levelFilter, filter)

bip = BuiltInParameter.ROOM_NAME
if filterToggle == False:
	allRoomsOnLevel = FilteredElementCollector(doc).OfClass(Autodesk.Revit.DB.SpatialElement).WherePasses(logicalFilter).ToElements()
	for i in allRoomsOnLevel:
		roomNames.append(i.get_Parameter(bip).AsString())
	OUT = allRoomsOnLevel, roomNames
else:
	allRoomsOnLevel = FilteredElementCollector(doc).OfClass(Autodesk.Revit.DB.SpatialElement).WherePasses(logicalFilter).ToElements()
	for i in allRoomsOnLevel:
		if i.Area != 0:
			validRooms.append(i)
	for i in validRooms:
		roomNames.append(i.get_Parameter(bip).AsString())
	OUT = validRooms, roomNames
# ----------------------------------------
number = DoubleInput(1)
getItemAtIndex = List.GetItemAtIndex(list=python_script, index=number)
Room_Name_s = Output(getItemAtIndex)  # "Room Name(s)"
number_2 = DoubleInput(0)
getItemAtIndex_2 = List.GetItemAtIndex(list=python_script, index=number_2)
Room_s = Output(getItemAtIndex_2)  # "Room(s)"
