# Dynamo custom node Legend Settings.dyf (Dynamo 0.7.5.3566)
# category: Archi-lab_Grimshaw.Analysis
# This node sets all settings for the Legend display with Analysis Visualization Framework of Revit.

Show_Legend = Input()
Show_Units = Input()
Show_Name = Input()
Heading_Text_Type_Id = Input()
Body_Text_Type_Id = Input()
Show_Data_Description = Input()
Rounding = Input()
Graph_Height = Input()
Graph_Width = Input()
Graph_Steps = Input()
python_script = Python(IN[0]=Show_Legend, IN[1]=Show_Units, IN[2]=Show_Name, IN[3]=Heading_Text_Type_Id, IN[4]=Body_Text_Type_Id, IN[5]=Show_Data_Description, IN[6]=Rounding, IN[7]=Graph_Height, IN[8]=Graph_Width, IN[9]=Graph_Steps)
# ---------- python_script.python (58 lines) ----------
#Copyright(c) 2015, Konrad K Sobon
# @arch_laboratory, http://archi-lab.net

import clr
clr.AddReference('ProtoGeometry')
from Autodesk.DesignScript.Geometry import *

# Import DocumentManager and TransactionManager
clr.AddReference("RevitServices")
import RevitServices
from RevitServices.Persistence import DocumentManager
from RevitServices.Transactions import TransactionManager

# Import RevitAPI
clr.AddReference("RevitAPI")
import Autodesk
from Autodesk.Revit.DB import *
from Autodesk.Revit.DB.Analysis import *

doc = DocumentManager.Instance.CurrentDBDocument
uiapp = DocumentManager.Instance.CurrentUIApplication
app = uiapp.Application

#The inputs to this node will be stored as a list in the IN variable.
dataEnteringNode = IN

showLegend = IN[0]
showUnits = IN[1]
showName = IN[2]
headingTextTypeId = IN[3]
bodyTextTypeId = IN[4]
dataDescription = IN[5]
rounding = IN[6]
height = IN[7]
width = IN[8]
steps = IN[9]

#define legend settings
legendSettings = AnalysisDisplayLegendSettings()
if showLegend:
	legendSettings.ShowLegend = True
	#heading
	legendSettings.ShowUnits = showUnits
	legendSettings.ShowDataName = showName
	legendSettings.HeadingTextTypeId = headingTextTypeId[0]
	#body
	legendSettings.TextTypeId = bodyTextTypeId[0]
	legendSettings.ShowDataDescription = dataDescription
	legendSettings.Rounding = rounding
	#color range
	legendSettings.ColorRangeHeight = height
	legendSettings.ColorRangeWidth = width
	legendSettings.NumberOfSteps = steps
else:
	legendSettings.ShowLegend = False

#Assign your output to the OUT variable
OUT = legendSettings
# ----------------------------------------
Legend_Settings = Output(python_script)
