# Dynamo custom node Rename Files.dyf (Dynamo 0.9.2.4472)
# category: Archi-lab_Grimshaw.Printing
# This node will use an "identifier" to pick out files from a supplied directory to rename files to a new name supplied. Please make sure to match list lengths of identifier and new name inputs.

DirectoryPath = Input(DirectoryPath:string="")
Identifiers = Input(Identifiers:string="")
NewNames = Input(NewNames:string="")
RunIt = Input(RunIt:bool=false)
python_script = Python(IN[0]=DirectoryPath, IN[1]=Identifiers, IN[2]=NewNames, IN[3]=RunIt)
# ---------- python_script.python (40 lines) ----------
# Copyright(c) 2016, Konrad Sobon
# @arch_laboratory, http://archi-lab.net

import sys
pyt_path = r'C:\Program Files (x86)\IronPython 2.7\Lib'
sys.path.append(pyt_path)

import os

filePath = IN[0]
identifiers = IN[1]
newNames = IN[2]
RunIt = IN[3]

files = os.listdir(filePath)

if RunIt:
	try:
		errorReport = None
		for file in files:
			currentFileName = filePath + "\\" + file
		
			for i, j in zip(identifiers, newNames):
				newFileName = filePath + "\\" + j
	
				if i in file and currentFileName != newFileName:
					os.rename(currentFileName, newFileName)
	except:
		# if error accurs anywhere in the process catch it
		import traceback
		errorReport = traceback.format_exc()
else:
	errorReport = "Set RunMe to True."

#Assign your output to the OUT variable
if errorReport == None:
	OUT = sheets
else:
	OUT = errorReport
	
# ----------------------------------------
OUT = Output(python_script)
