# Dynamo custom node String From List.dyf (Dynamo 0.9.2.4472)
# category: Archi-lab_Grimshaw.Strings
# This node will take an input of a list or nested list and then join each element in a list with a given seperator while adding a suffix.

List = Input()
Suffix = Input()
Seperator = Input()
python_script = Python(IN[0]=List, IN[1]=Suffix, IN[2]=Seperator)
# ---------- python_script.python (17 lines) ----------
#Copyright(c) 2015, Konrad Sobon
# @arch_laboratory, http://archi-lab.net

import clr
clr.AddReference('ProtoGeometry')
from Autodesk.DesignScript.Geometry import *
#The inputs to this node will be stored as a list in the IN variable.
dataEnteringNode = IN
fileExtension = IN[1]
underscore = IN[2]

newString = []
for i in IN[0]:
	newString.append(underscore.join(i) + fileExtension)
	
#Assign your output to the OUT variable
OUT = newString
# ----------------------------------------
OUT = Output(python_script)
