# Dynamo custom node Survey Point.dyf (Dynamo 1.2.0.2690)
# category: Archi-lab_Grimshaw.Selection.Select
# This node will retrieve a Survey Point from a Revit model.

python_script = Python()  # unwired: IN[0]
# ---------- python_script.python (33 lines) ----------
# Copyright(c) 2016, Konrad Sobon
# @arch_laboratory, http://archi-lab.net

import clr
clr.AddReference('ProtoGeometry')
from Autodesk.DesignScript.Geometry import *

# Import DocumentManager and TransactionManager
clr.AddReference("RevitServices")
import RevitServices
from RevitServices.Persistence import DocumentManager
doc = DocumentManager.Instance.CurrentDBDocument

# Import RevitAPI
clr.AddReference("RevitAPI")
import Autodesk
from Autodesk.Revit.DB import *

#The inputs to this node will be stored as a list in the IN variable.
dataEnteringNode = IN
inPoints = IN[0]

surveyPoints = FilteredElementCollector(doc).OfCategory(BuiltInCategory.OST_SharedBasePoint).ToElements()

bipEW = BuiltInParameter.BASEPOINT_EASTWEST_PARAM
bipNS = BuiltInParameter.BASEPOINT_NORTHSOUTH_PARAM
bipElev = BuiltInParameter.BASEPOINT_ELEVATION_PARAM

eastWest = surveyPoints[0].get_Parameter(bipEW).AsDouble()
northSouth = surveyPoints[0].get_Parameter(bipNS).AsDouble()
elev = surveyPoints[0].get_Parameter(bipElev).AsDouble()

OUT = Autodesk.DesignScript.Geometry.Point.ByCoordinates(eastWest, northSouth, elev)
# ----------------------------------------
Point = Output(python_script)
