# Dynamo graph BIM 360 Path Harvesting Tool.dyn (Dynamo 1.3.3.4651)

current_document = Custom[Current Document]()  # Retrieves Current Document

# group: revit external reference types
python_script = Python(IN[0]=current_document)
# ---------- python_script.python (101 lines) ----------
import clr
clr.AddReference('ProtoGeometry')
from Autodesk.DesignScript.Geometry import *

# Import DocumentManager and TransactionManager
clr.AddReference("RevitServices")
import RevitServices
from RevitServices.Persistence import DocumentManager
from RevitServices.Transactions import TransactionManager

from System.Collections.Generic import *

# Import RevitAPI
clr.AddReference("RevitAPI")
import Autodesk
from Autodesk.Revit.DB import *
from Autodesk.Revit.DB.Analysis import *

doc = DocumentManager.Instance.CurrentDBDocument
uiapp = DocumentManager.Instance.CurrentUIApplication
app = uiapp.Application

# Import ToDSType(bool) extension method
clr.AddReference("RevitNodes")
import Revit
clr.ImportExtensions(Revit.Elements)

import sys
sys.path.append("C:\Program Files (x86)\IronPython 2.7\Lib")
import json

#The inputs to this node will be stored as a list in the IN variable.
docElem = IN[0]
linkresource = ExternalResourceTypes.BuiltInExternalResourceTypes.RevitLink
resourcerefs = ExternalResourceUtils.GetAllExternalResourceReferences(docElem, linkresource)
resourcelems = []
for x in resourcerefs:	
	resourcelems.append(docElem.GetElement(x))
infos, shortnames, versionstatus, insessionpaths, serverids, versions = [], [], [], [], [], []
#for f in fileref:
#	erefs.append(ExternalFileUtils.GetExternalFileReference(docElem, f))
#
#for e in erefs:
#	paths.append(ExternalFileReference.GetAbsolutePath(e))
#	erefType.append(e.ExternalFileReferenceType)
#	erefPath.append(e.PathType)
#for s in paths:
#	pstr.append(ModelPathUtils.ConvertModelPathToUserVisiblePath(s))
pathtypes, unwraps, eresrefs = [], [], []
for z in resourcelems:
	try:
		pathtypes.append(z.PathType)
	except:
		pathtypes.append("NotLocal")
	try:
		unwraps.append(UnwrapElement(z))
		eresrefs.append(temp)
	except:
		eresrefs.append("NotResource")
data = []
for u in unwraps:
	data.append(u.GetExternalResourceReference(linkresource))

class dummy(object):
	def ToString(self):
		return 'container'
container = dummy()

sdicts = []

for y in data:
#	infos.append(ExternalResourceReference.GetReferenceInformation(y))
	dictinfo = ExternalResourceReference.GetReferenceInformation(y)
	container.dictinfo = dictinfo
	infos.append(container)
	shortnames.append(ExternalResourceReference.GetResourceShortDisplayName(y))
	versionstatus.append(ExternalResourceReference.GetResourceVersionStatus(y))
	insessionpaths.append(y.InSessionPath)
	serverids.append(y.ServerId)
	versions.append(y.Version)
	sdicts.append(json.dumps(dict(dictinfo)))
#	dicts.append(dict(dictinfo))

builtInTypeMark = BuiltInParameter.ALL_MODEL_TYPE_NAME
#Cycle through all Family Element Types
TypeNames = []
for k in unwraps:
	paramtemp = ""
	try:
		for param in k.Parameters:
			tempkey = k.get_Parameter(builtInTypeMark)
			paramtemp = tempkey.AsString()
			if paramtemp == '0':
				paramtemp = ""
			if paramtemp is None:
				paramtemp = ""
	except:
		paramtemp = "" 
	TypeNames.append(paramtemp)
TransactionManager.Instance.TransactionTaskDone()
OUT = resourcerefs, resourcelems, pathtypes, unwraps, data, eresrefs, infos, shortnames, versionstatus, insessionpaths, serverids, versions, sdicts, TypeNames
# ----------------------------------------

watch = Watch(python_script)

# group: reference information
code_block = CodeBlock { 6; }
getItemAtIndex = List.GetItemAtIndex(list=watch, index=code_block)

watch_2 = Watch(getItemAtIndex)

# group: reference information
code_block_2 = CodeBlock { 12; }
getItemAtIndex_2 = List.GetItemAtIndex(list=watch, index=code_block_2)

watch_3 = Watch(getItemAtIndex_2)
python_script_2 = Python(IN[0]=watch_3)
# ---------- python_script_2.python (45 lines) ----------
import clr
clr.AddReference('ProtoGeometry')
from Autodesk.DesignScript.Geometry import *

# Import DocumentManager and TransactionManager
clr.AddReference("RevitServices")
import RevitServices
from RevitServices.Persistence import DocumentManager
from RevitServices.Transactions import TransactionManager

from System.Collections.Generic import *

# Import RevitAPI
clr.AddReference("RevitAPI")
import Autodesk
from Autodesk.Revit.DB import *
from Autodesk.Revit.DB.Analysis import *

doc = DocumentManager.Instance.CurrentDBDocument
uiapp = DocumentManager.Instance.CurrentUIApplication
app = uiapp.Application

# Import ToDSType(bool) extension method
clr.AddReference("RevitNodes")
import Revit
clr.ImportExtensions(Revit.Elements)

import _ast

import sys
sys.path.append("C:\Program Files (x86)\IronPython 2.7\Lib")
import json

#The inputs to this node will be stored as a list in the IN variable.

incoming = IN[0]

des = []
for x in incoming:
	des.append(json.loads((x)))
newdicts = []
for y in des:
	newdicts.append(Dictionary[str, str](y))

OUT = newdicts
# ----------------------------------------
watch_4 = Watch(python_script_2)

# group: paths
code_block_3 = CodeBlock { 9; }
getItemAtIndex_3 = List.GetItemAtIndex(list=watch, index=code_block_3)

# group: filter by cloud only
string = StringInput("BIM 360://")
eq = getItemAtIndex_3 == string

# group: serverids
code_block_4 = CodeBlock { 10; }
getItemAtIndex_4 = List.GetItemAtIndex(list=watch, index=code_block_4)

startsWith = String.StartsWith(str=getItemAtIndex_3, searchFor=string)
watch_5 = Watch(startsWith)

# group: SERVER IDS
filterByBoolMask = List.FilterByBoolMask(list=getItemAtIndex_4, mask=watch_5)
watch_6 = Watch(filterByBoolMask.in)

# group: versions
code_block_5 = CodeBlock { 11; }
getItemAtIndex_5 = List.GetItemAtIndex(list=watch, index=code_block_5)

# group: VERSIONS
filterByBoolMask_2 = List.FilterByBoolMask(list=getItemAtIndex_5, mask=watch_5)
watch_7 = Watch(filterByBoolMask_2.in)

# group: PATHS
filterByBoolMask_3 = List.FilterByBoolMask(list=getItemAtIndex_3, mask=watch_5)
watch_8 = Watch(filterByBoolMask_3.in)

# group: JSON
filterByBoolMask_4 = List.FilterByBoolMask(list=watch_3, mask=watch_5)
watch_9 = Watch(filterByBoolMask_4.in)

# group: reference information
code_block_6 = CodeBlock { 13; }
getItemAtIndex_6 = List.GetItemAtIndex(list=watch, index=code_block_6)

# group: NAMES
filterByBoolMask_5 = List.FilterByBoolMask(list=getItemAtIndex_6, mask=watch_5)
watch_10 = Watch(filterByBoolMask_5.in)

# group: WRITE BIM 360 DATA TO DB OR EXCEL
create = List.Create(watch_6, watch_7, watch_8, watch_9, watch_10)
transpose = List.Transpose(create)
