# Dynamo graph BIM 360 Path Reloader.dyn (Dynamo 1.3.3.4651)

current_document = Custom[Current Document]()  # Retrieves Current Document

# group: revit external reference types
python_script = Python(IN[0]=current_document)
# ---------- python_script.python (101 lines) ----------
import clr
clr.AddReference('ProtoGeometry')
from Autodesk.DesignScript.Geometry import *

# Import DocumentManager and TransactionManager
clr.AddReference("RevitServices")
import RevitServices
from RevitServices.Persistence import DocumentManager
from RevitServices.Transactions import TransactionManager

from System.Collections.Generic import *

# Import RevitAPI
clr.AddReference("RevitAPI")
import Autodesk
from Autodesk.Revit.DB import *
from Autodesk.Revit.DB.Analysis import *

doc = DocumentManager.Instance.CurrentDBDocument
uiapp = DocumentManager.Instance.CurrentUIApplication
app = uiapp.Application

# Import ToDSType(bool) extension method
clr.AddReference("RevitNodes")
import Revit
clr.ImportExtensions(Revit.Elements)

import sys
sys.path.append("C:\Program Files (x86)\IronPython 2.7\Lib")
import json

#The inputs to this node will be stored as a list in the IN variable.
docElem = IN[0]
linkresource = ExternalResourceTypes.BuiltInExternalResourceTypes.RevitLink
resourcerefs = ExternalResourceUtils.GetAllExternalResourceReferences(docElem, linkresource)
resourcelems = []
for x in resourcerefs:	
	resourcelems.append(docElem.GetElement(x))
infos, shortnames, versionstatus, insessionpaths, serverids, versions = [], [], [], [], [], []
#for f in fileref:
#	erefs.append(ExternalFileUtils.GetExternalFileReference(docElem, f))
#
#for e in erefs:
#	paths.append(ExternalFileReference.GetAbsolutePath(e))
#	erefType.append(e.ExternalFileReferenceType)
#	erefPath.append(e.PathType)
#for s in paths:
#	pstr.append(ModelPathUtils.ConvertModelPathToUserVisiblePath(s))
pathtypes, unwraps, eresrefs = [], [], []
for z in resourcelems:
	try:
		pathtypes.append(z.PathType)
	except:
		pathtypes.append("NotLocal")
	try:
		unwraps.append(UnwrapElement(z))
		eresrefs.append(temp)
	except:
		eresrefs.append("NotResource")
data = []
for u in unwraps:
	data.append(u.GetExternalResourceReference(linkresource))

class dummy(object):
	def ToString(self):
		return 'container'
container = dummy()

sdicts = []

for y in data:
#	infos.append(ExternalResourceReference.GetReferenceInformation(y))
	dictinfo = ExternalResourceReference.GetReferenceInformation(y)
	container.dictinfo = dictinfo
	infos.append(container)
	shortnames.append(ExternalResourceReference.GetResourceShortDisplayName(y))
	versionstatus.append(ExternalResourceReference.GetResourceVersionStatus(y))
	insessionpaths.append(y.InSessionPath)
	serverids.append(y.ServerId)
	versions.append(y.Version)
	sdicts.append(json.dumps(dict(dictinfo)))
#	dicts.append(dict(dictinfo))

builtInTypeMark = BuiltInParameter.ALL_MODEL_TYPE_NAME
#Cycle through all Family Element Types
TypeNames = []
for k in unwraps:
	paramtemp = ""
	try:
		for param in k.Parameters:
			tempkey = k.get_Parameter(builtInTypeMark)
			paramtemp = tempkey.AsString()
			if paramtemp == '0':
				paramtemp = ""
			if paramtemp is None:
				paramtemp = ""
	except:
		paramtemp = "" 
	TypeNames.append(paramtemp)
TransactionManager.Instance.TransactionTaskDone()
OUT = resourcerefs, resourcelems, pathtypes, unwraps, data, eresrefs, infos, shortnames, versionstatus, insessionpaths, serverids, versions, sdicts, TypeNames
# ----------------------------------------

watch = Watch(python_script)
code_block = CodeBlock { 1; }
getItemAtIndex = List.GetItemAtIndex(list=watch, index=code_block)
code_block_2 = CodeBlock { 2; }
getItemAtIndex_2 = List.GetItemAtIndex(list=watch, index=code_block_2)
string = StringInput("NotLocal")
eq = getItemAtIndex_2 == string
filterByBoolMask = List.FilterByBoolMask(list=getItemAtIndex, mask=eq)
watch_2 = Watch(filterByBoolMask.out)

# group: get data from VirtualBuiltApp
watch_3 = Watch()  # unwired: arg0

# group: mapping
code_block_3 = CodeBlock { 7; }
getItemAtIndex_3 = List.GetItemAtIndex(list=watch_3@L2, index=code_block_3)

# group: reference information
code_block_4 = CodeBlock { 13; }
getItemAtIndex_4 = List.GetItemAtIndex(list=watch, index=code_block_4)

filterByBoolMask_2 = List.FilterByBoolMask(list=getItemAtIndex_4, mask=eq)
watch_4 = Watch(filterByBoolMask_2.out)
if_equal_return_index_using = Custom[If Equal Return Index using IndexOf](searchForThese=getItemAtIndex_3, inThisList=watch_4)
getItemAtIndex_5 = List.GetItemAtIndex(list=watch_2, index=if_equal_return_index_using)
watch_5 = Watch(getItemAtIndex_5)
code_block_5 = CodeBlock { null; }
eq_2 = watch_5 == code_block_5
filterByBoolMask_3 = List.FilterByBoolMask(list=watch_5, mask=eq_2)

# group: unpack
code_block_6 = CodeBlock { 1; }
getItemAtIndex_6 = List.GetItemAtIndex(list=watch_3@L2, index=code_block_6)
code_block_7 = CodeBlock { 4; }
getItemAtIndex_7 = List.GetItemAtIndex(list=watch_3@L2, index=code_block_7)
code_block_8 = CodeBlock { 2; }
getItemAtIndex_8 = List.GetItemAtIndex(list=watch_3@L2, index=code_block_8)
code_block_9 = CodeBlock { 8; }
getItemAtIndex_9 = List.GetItemAtIndex(list=watch_3@L2, index=code_block_9)

watch_6 = Watch(getItemAtIndex_6)
filterByBoolMask_4 = List.FilterByBoolMask(list=watch_6, mask=eq_2)
watch_7 = Watch(filterByBoolMask_4.out)
watch_8 = Watch(getItemAtIndex_7)
filterByBoolMask_5 = List.FilterByBoolMask(list=watch_8, mask=eq_2)
watch_9 = Watch(filterByBoolMask_5.out)
watch_10 = Watch(getItemAtIndex_8)
filterByBoolMask_6 = List.FilterByBoolMask(list=watch_10, mask=eq_2)
watch_11 = Watch(filterByBoolMask_6.out)
watch_12 = Watch(getItemAtIndex_9)
filterByBoolMask_7 = List.FilterByBoolMask(list=watch_12, mask=eq_2)
watch_13 = Watch(filterByBoolMask_7.out)
create = List.Create(watch_7, watch_9, watch_11, watch_13)

# group: create references
python_script_2 = Python(IN[0]=create)
# ---------- python_script_2.python (64 lines) ----------
import clr
clr.AddReference('ProtoGeometry')
from Autodesk.DesignScript.Geometry import *

# Import DocumentManager and TransactionManager
clr.AddReference("RevitServices")
import RevitServices
from RevitServices.Persistence import DocumentManager
from RevitServices.Transactions import TransactionManager

from System.Collections.Generic import *
from System import Guid

# Import RevitAPI
clr.AddReference("RevitAPI")
import Autodesk
from Autodesk.Revit.DB import *
from Autodesk.Revit.DB.Analysis import *

doc = DocumentManager.Instance.CurrentDBDocument
uiapp = DocumentManager.Instance.CurrentUIApplication
app = uiapp.Application

# Import ToDSType(bool) extension method
clr.AddReference("RevitNodes")
import Revit
clr.ImportExtensions(Revit.Elements)

import _ast

import sys
sys.path.append("C:\Program Files (x86)\IronPython 2.7\Lib")
import json

#The inputs to this node will be stored as a list in the IN variable.
alldata = IN[0]

serverIdsIn = alldata[0]
referencesInfo = alldata[1]
versionsInfo = alldata[2]
sessionsPathIn = alldata[3]

des = []
for x in referencesInfo:
	des.append(json.loads((x)))
newdicts = []
for y in des:
	newdicts.append(Dictionary[str, str](y))

serverGuids = []
for g in serverIdsIn:
	tempguid = Guid(g)
	serverGuids.append(tempguid)

newrefs = []
for z in range(len(referencesInfo)):
	serverIdIn = serverGuids[z]
	referenceInfo = newdicts[z]
	versionInfo = versionsInfo[z]
	sessionPathIn = sessionsPathIn[z]
	tempRef = ExternalResourceReference(serverIdIn, referenceInfo, versionInfo, sessionPathIn)
	newrefs.append(tempRef)

OUT = newrefs
# ----------------------------------------

# group: links and new refs from cloud
watch_14 = Watch(filterByBoolMask_3.out)
watch_15 = Watch(python_script_2)

turnIntoList = Custom[TurnIntoList](unknownItem=watch_14)  # Turns an element (or a nested list) into a flat list
turnIntoList_2 = Custom[TurnIntoList](unknownItem=watch_15)

# group: apply reference reload
python_script_3 = Python(IN[0]=turnIntoList, IN[1]=turnIntoList_2)
# ---------- python_script_3.python (66 lines) ----------
import clr
clr.AddReference('ProtoGeometry')
from Autodesk.DesignScript.Geometry import *

# Import DocumentManager and TransactionManager
clr.AddReference("RevitServices")
import RevitServices
from RevitServices.Persistence import DocumentManager
from RevitServices.Transactions import TransactionManager

from System.Collections.Generic import *

# Import RevitAPI
clr.AddReference("RevitAPI")
import Autodesk
from Autodesk.Revit.DB import *
from Autodesk.Revit.DB.Analysis import *

doc = DocumentManager.Instance.CurrentDBDocument
uiapp = DocumentManager.Instance.CurrentUIApplication
app = uiapp.Application

# Import ToDSType(bool) extension method
clr.AddReference("RevitNodes")
import Revit
clr.ImportExtensions(Revit.Elements)

#The inputs to this node will be stored as a list in the IN variable.
filesToChange = UnwrapElement(IN[0])
newCloudPaths = IN[1]
try:
	TransactionManager.Instance.ForceCloseTransaction()
except:
	pass
defaultconfig = WorksetConfiguration()
success = []

for l in range(len(newCloudPaths)):
	successlist = []
	try:
		TransactionManager.Instance.ForceCloseTransaction()
		successlist.append("Transaction closed for loading of link")
	except:
		successlist.append("Transaction could not be closed and link could not be loaded")
		pass	
	fileToChange = UnwrapElement(filesToChange[l])
	try:
		fileToChange.Unload()
		successlist.append("Preflight Unload SUCCESS")
	except:
		successlist.append("Preflight Unload FAILED")
	try:
		newCloudPath = newCloudPaths[l]
		reloaded = fileToChange.LoadFrom(newCloudPath, defaultconfig)
		successlist.append(reloaded.LoadResult)
		TransactionManager.Instance.ForceCloseTransaction()
	except:
		successlist.append("Failure, not top level link or workset closed")
	try:
		fileToChange.Unload(None);
		successlist.append("Unloaded Successfully")
	except:
		successlist.append("Could not unload")
	success.append(successlist)

OUT = success
# ----------------------------------------

watch_16 = Watch(python_script_3)
list_length_validator = Custom[List Length Validator](listOfLists=create)
