# Dynamo graph Section From Line V2 (Nick Culley).dyn (Dynamo 1.3.2.2480)

categories = Categories("Lines")
all_elements_of_category = ElementsOfCategory(categories)
code_block = CodeBlock { "Line Style"; }
getParameterValueByName = Element.GetParameterValueByName(element=all_elements_of_category, parameterName=code_block)
name = Element.Name(getParameterValueByName)
code_block_2 = CodeBlock { "XXX - WALL ELEVATION TEMP"; }
allIndicesOf = List.AllIndicesOf(list=name, item=code_block_2)
getItemAtIndex = List.GetItemAtIndex(list=all_elements_of_category, index=allIndicesOf)
geometry = Element.Geometry(getItemAtIndex)
flip_section = BoolSelector(false)
code_block_3 = CodeBlock { -90; 90; }
if_ = If(test=flip_section, true=code_block_3.out0, false=code_block_3.out1)

# group: Sections from lines
code_block_4 = CodeBlock { 0.5; }
pointAtParameter = Curve.PointAtParameter(curve=geometry, param=code_block_4)
normalAtParameter = Curve.NormalAtParameter(curve=geometry, param=code_block_4)
code_block_5 = CodeBlock { Vector.ZAxis(); }
byOriginVectors = CoordinateSystem.ByOriginVectors(origin=pointAtParameter, xAxis=normalAtParameter, yAxis=code_block_5)
rotate = CoordinateSystem.Rotate(coordinateSystem=byOriginVectors, origin=pointAtParameter, axis=code_block_5, degrees=if_)
flatten = Flatten(rotate)
length = Curve.Length(geometry)
flatten_2 = Flatten(length)
code_block_6 = CodeBlock(b1=flatten_2) { {-b1/2,b1/2}; {0,500}; }

code_block_7 = CodeBlock { -100; }
count = List.Count(geometry)
cycle = List.Cycle(list=code_block_7, amount=count, lacing=Longest)
flatten_3 = Flatten(cycle)
code_block_8 = CodeBlock(a=flatten_2) { a/2; }
create = List.Create(flatten_3, code_block_8)

# group (continued): Sections from lines
byCoordinates = Point.ByCoordinates(x=code_block_6.out0, y=create, z=code_block_6.out1, lacing=Longest)
code_block_9 = CodeBlock(p=byCoordinates) { p[0]; p[1]; }
byCoordinateSystemMinPointMaxPoint = SectionView.ByCoordinateSystemMinPointMaxPoint(flatten, code_block_9.out0, code_block_9.out1)
