# Dynamo custom node Add Suffix to Items in String List.dyf (Dynamo 1.3.0.875)
# category: Bakery.Core.String

string_list = Input()
watch = Watch(string_list)
code_block = CodeBlock { ""; }
suffix = Input()
join = String.Join(code_block, arg2=suffix)  # unwired: arg1
map = List.Map(list=watch, f_x=join)
new_strings = Output(map)
