# Dynamo custom node All Directory Contents of Specific Filetype.dyf (Dynamo 1.2.1.3083)
# category: Bakery.Dynamo.ForkedNodes
# from clockwork

dir_string = Input()
contentsAll = Custom[Directory.ContentsAll](directoryPath=dir_string)  # Unlike the built-in node Directory.Contents, this node browses a directory recursively and returns all relevant files contained in subfolders as well.
watch = Watch(contentsAll)
file_extension_string_like_txt = Input()  # "file extension string like .txt"
endsWith = String.EndsWith(watch, file_extension_string_like_txt)
filterByBoolMask = List.FilterByBoolMask(list=watch, mask=endsWith)
files_found = Output(filterByBoolMask.in)
