# Dynamo custom node All Sheet Names to Upper Case.dyf (Dynamo 1.2.0.2831)
# category: Bakery.Revit.Views.Sheet

element_types = ElementTypes("ViewSheet")
all_elements_of_type = ElementsOfType(element_types)
code_block = CodeBlock { "Sheet Name"; }
getParameterValueByName = Element.GetParameterValueByName(element=all_elements_of_type, parameterName=code_block)
toUpper = String.ToUpper(getParameterValueByName)
setParameterByName = Element.SetParameterByName(element=all_elements_of_type, parameterName=code_block, value=toUpper)
renamed = Output(setParameterByName)
