# Dynamo custom node All The Ids.dyf (Dynamo 1.3.4.6666)
# category: Bakery.Revit.Elements
# Element Id, Unique Id, Dwf Guid, IfcGuid

elementList = Input()
turnIntoList = Custom[TurnIntoList](unknownItem=elementList)  # Turns an element (or a nested list) into a flat list

# group: dwf and ifc guids!!!
python_script = Python(IN[0]=turnIntoList)
# ---------- python_script.python (53 lines) ----------
import clr
clr.AddReference('ProtoGeometry')
from Autodesk.DesignScript.Geometry import *

# Import RevitAPI
clr.AddReference("RevitAPI")
import Autodesk
from Autodesk.Revit.DB import *

clr.AddReference('RevitAPIIFC')
from Autodesk.Revit.DB.IFC import *

clr.AddReference("RevitServices")
import RevitServices
from RevitServices.Persistence import DocumentManager
from RevitServices.Transactions import TransactionManager

from System.Collections.Generic import *

clr.AddReference('RevitNodes')
import Revit
clr.ImportExtensions(Revit.Elements)
clr.ImportExtensions(Revit.GeometryConversion)

from System import Guid

import System


import sys
pyt_path = r'C:\Program Files (x86)\IronPython 2.7\Lib'
sys.path.append(pyt_path)
import base64
import uuid

doc = DocumentManager.Instance.CurrentDBDocument
uiapp = DocumentManager.Instance.CurrentUIApplication
app = uiapp.Application
uidoc=DocumentManager.Instance.CurrentUIApplication.ActiveUIDocument

e=IN[0]

elementIds, uniqueIds, DwfGuids, IfcGuids, successlist = [], [], [], [], []
for i in e:
	try:
		elementIds.append(i.Id)
		uniqueIds.append(i.UniqueId)
		DwfGuids.append(str(ExportUtils.GetExportId(doc, ElementId(i.Id))))
		IfcGuids.append(ExporterIFCUtils.CreateSubElementGUID (UnwrapElement(i),0))
		successlist.append("Success")
	except:
		successlist.append("Failure")
OUT = elementIds, uniqueIds, DwfGuids, IfcGuids, successlist
# ----------------------------------------

code_block = CodeBlock { 0; }

# group: element Id
getItemAtIndex = List.GetItemAtIndex(list=python_script, index=code_block)

elementIds = Output(getItemAtIndex)
code_block_2 = CodeBlock { 1; }

# group: unique Id
getItemAtIndex_2 = List.GetItemAtIndex(list=python_script, index=code_block_2)

uniqueIds = Output(getItemAtIndex_2)
code_block_3 = CodeBlock { 2; }

# group: export Guid
getItemAtIndex_3 = List.GetItemAtIndex(list=python_script, index=code_block_3)

dwfGuids = Output(getItemAtIndex_3)
code_block_4 = CodeBlock { 3; }

# group: IfcGuid
getItemAtIndex_4 = List.GetItemAtIndex(list=python_script, index=code_block_4)

ifcGuids = Output(getItemAtIndex_4)
code_block_5 = CodeBlock { 4; }
getItemAtIndex_5 = List.GetItemAtIndex(list=python_script, index=code_block_5)
success = Output(getItemAtIndex_5)
