# Dynamo custom node AutoModeller for Civil Data v1.dyf (Dynamo 1.2.0.2690)
# category: Bakery.Civil

WallHeadingOrder = Input()
watch = Watch(WallHeadingOrder)
string = StringInput("Side")
string_2 = StringInput("Dynamo Form")
string_3 = StringInput("Pile Cts")
string_4 = StringInput("Pile Cap Thickness")
string_5 = StringInput("Pile Depth")
string_6 = StringInput("Pile Cap Vertical Offset")
string_7 = StringInput("Soil Anchors")
string_8 = StringInput("Soil Anchor Cts")
string_9 = StringInput("Soil Anchor Length")
string_10 = StringInput("Precision")
string_11 = StringInput("Pile Cap Width")
string_12 = StringInput("Pile Diameter")
string_13 = StringInput("Wall ID")

# group: Excel Column Search
string_14 = StringInput("Wall Type")
string_15 = StringInput("CH Start")
string_16 = StringInput("CH End")
create = List.Create(string_14, string_15, string_16, string, string_2, string_3, string_4, string_5, string_6, string_7, string_8, string_9, string_10, string_11, string_12, string_13)

# group: Reformat Excel for Predictability
build_new_order_of_headings_by = Custom[Build New Order of Headings by Search](OriginalHeadingOrder=watch, NewHeadingOrderWildcards=create)
watch_2 = Watch(build_new_order_of_headings_by.newHeadings)
watch_3 = Watch(build_new_order_of_headings_by.indicesMatchDesiredOrder)
watch_4 = Watch(build_new_order_of_headings_by.FalseIfDuplicatesFoundAndRemoved)
watch_5 = Watch(build_new_order_of_headings_by.indices)

# group: offset to column centre
code_block = CodeBlock { 500; }

chainageCsvData = Input(chainageCsvData : var[]..[])

# group: Get Chainage
code_block_2 = CodeBlock { 0; }
getItemAtIndex = List.GetItemAtIndex(list=chainageCsvData, index=code_block_2)

to_float = Custom[To Float](unknown=getItemAtIndex, lacing=Longest)  # converts input object to a float with python
WallData = Input(WallData : var[]..[])
transpose = List.Transpose(WallData)
watch_6 = Watch(transpose)
rowIndex = Input(rowIndex : var[]..[])

# group: reformatted data
code_block_3 = CodeBlock { 1; }
triple_get = Custom[Triple Get](indexList=watch_5, indexToGet=code_block_3, dataSublists=watch_6, rowIndex=rowIndex)
code_block_4 = CodeBlock { 2; }
triple_get_2 = Custom[Triple Get](indexList=watch_5, indexToGet=code_block_4, dataSublists=watch_6, rowIndex=rowIndex)
code_block_5 = CodeBlock { 3; }
triple_get_3 = Custom[Triple Get](indexList=watch_5, indexToGet=code_block_5, dataSublists=watch_6, rowIndex=rowIndex)
code_block_6 = CodeBlock { 12; }
triple_get_4 = Custom[Triple Get](indexList=watch_5, indexToGet=code_block_6, dataSublists=watch_6, rowIndex=rowIndex)
code_block_7 = CodeBlock { 9; }
triple_get_5 = Custom[Triple Get](indexList=watch_5, indexToGet=code_block_7, dataSublists=watch_6, rowIndex=rowIndex)
code_block_8 = CodeBlock { 5; }
triple_get_6 = Custom[Triple Get](indexList=watch_5, indexToGet=code_block_8, dataSublists=watch_6, rowIndex=rowIndex)
code_block_9 = CodeBlock { 6; }
triple_get_7 = Custom[Triple Get](indexList=watch_5, indexToGet=code_block_9, dataSublists=watch_6, rowIndex=rowIndex)
code_block_10 = CodeBlock { 8; }
triple_get_8 = Custom[Triple Get](indexList=watch_5, indexToGet=code_block_10, dataSublists=watch_6, rowIndex=rowIndex)
code_block_11 = CodeBlock { 7; }
triple_get_9 = Custom[Triple Get](indexList=watch_5, indexToGet=code_block_11, dataSublists=watch_6, rowIndex=rowIndex)
code_block_12 = CodeBlock { 4; }
triple_get_10 = Custom[Triple Get](indexList=watch_5, indexToGet=code_block_12, dataSublists=watch_6, rowIndex=rowIndex)
code_block_13 = CodeBlock { 0; }
triple_get_11 = Custom[Triple Get](indexList=watch_5, indexToGet=code_block_13, dataSublists=watch_6, rowIndex=rowIndex)
code_block_14 = CodeBlock { 10; }
triple_get_12 = Custom[Triple Get](indexList=watch_5, indexToGet=code_block_14, dataSublists=watch_6, rowIndex=rowIndex)
code_block_15 = CodeBlock { 11; }
triple_get_13 = Custom[Triple Get](indexList=watch_5, indexToGet=code_block_15, dataSublists=watch_6, rowIndex=rowIndex)

watch_7 = Watch(triple_get)
to_float_2 = Custom[To Float](unknown=watch_7)
watch_8 = Watch(triple_get_2)
to_float_3 = Custom[To Float](unknown=watch_8)
csvHeadingList = Input(csvHeadingList : var[]..[])

# group: Getting points
string_17 = StringInput("FB0J")
string_18 = StringInput("WT0J")
string_19 = StringInput("WT0K")

string_20 = StringInput("FB00")
watch_9 = Watch(triple_get_3)

# group: North or South?
string_21 = StringInput("South")
eq = string_21 == watch_9
boolean_to_int = Custom[Boolean to Int](item=eq)  # 0 false, 1 true

watch_10 = Watch(boolean_to_int)
chooser = Custom[Chooser](zeroItem=string_17, oneItem=string_20, zeroOrOne=watch_10)
watch_11 = Watch(chooser)

# group (continued): Getting points
get_xyz_values_by_string_name = Custom[Get XYZ Values by String Name from Lists](dataList=chainageCsvData, headingList=csvHeadingList, stringName=watch_11)

string_22 = StringInput("WT00")
chooser_2 = Custom[Chooser](zeroItem=string_18, oneItem=string_22, zeroOrOne=watch_10)

# group (continued): Getting points
get_xyz_values_by_string_name_2 = Custom[Get XYZ Values by String Name from Lists](dataList=chainageCsvData, headingList=csvHeadingList, stringName=chooser_2)

string_23 = StringInput("WT01")
chooser_3 = Custom[Chooser](zeroItem=string_19, oneItem=string_23, zeroOrOne=watch_10)

# group (continued): Getting points
get_xyz_values_by_string_name_3 = Custom[Get XYZ Values by String Name from Lists](dataList=chainageCsvData, headingList=csvHeadingList, stringName=chooser_3)

# group: may be redundant
create_2 = List.Create(get_xyz_values_by_string_name.Xvalues, get_xyz_values_by_string_name.Yvalues, get_xyz_values_by_string_name.Zvalues)
create_3 = List.Create(get_xyz_values_by_string_name_2.Xvalues, get_xyz_values_by_string_name_2.Yvalues, get_xyz_values_by_string_name_2.Zvalues)
create_4 = List.Create(get_xyz_values_by_string_name_3.Xvalues, get_xyz_values_by_string_name_3.Yvalues, get_xyz_values_by_string_name_3.Zvalues)
create_5 = List.Create(create_2, create_3, create_4)
unpack_three_sublists = Custom[Unpack Three Sublists](list=create_5)
unpack_three_sublists_2 = Custom[Unpack Three Sublists](list=unpack_three_sublists.one)
unpack_three_sublists_3 = Custom[Unpack Three Sublists](list=unpack_three_sublists.zero)
unpack_three_sublists_4 = Custom[Unpack Three Sublists](list=unpack_three_sublists.two)

get_points_of_interest_using = Custom[Get Points of Interest Using Chainage](ChainageList=to_float, start=to_float_2, end=to_float_3, X_list=unpack_three_sublists_2.zero, Y_list=unpack_three_sublists_2.one, Z_list=unpack_three_sublists_2.two)
watch_12 = Watch(triple_get_4)
watch_13 = Watch(watch_12)
code_block_16 = CodeBlock { 13; }
triple_get_14 = Custom[Triple Get](indexList=watch_5, indexToGet=code_block_16, dataSublists=watch_6, rowIndex=rowIndex)
watch_14 = Watch(triple_get_14)
to_float_4 = Custom[To Float](unknown=watch_14)
code_block_17 = CodeBlock(x=to_float_4) { x/2; }
code_block_18 = CodeBlock(u=code_block_17) { u-50; }
watch_15 = Watch(code_block_18)
code_block_19 = CodeBlock(x=watch_15) { x*-1; }

# group: offset lower line by distance
chooser_4 = Custom[Chooser](zeroItem=watch_15, oneItem=code_block_19, zeroOrOne=watch_10)

watch_16 = Watch(get_points_of_interest_using.NurbsCurve)
get_points_of_interest_using_2 = Custom[Get Points of Interest Using Chainage](ChainageList=to_float, start=to_float_2, end=to_float_3, X_list=unpack_three_sublists_3.zero, Y_list=unpack_three_sublists_3.one, Z_list=unpack_three_sublists_3.two)
watch_17 = Watch(triple_get_5)
code_block_20 = CodeBlock { 1; }
code_block_21 = CodeBlock { 14; }
triple_get_15 = Custom[Triple Get](indexList=watch_5, indexToGet=code_block_21, dataSublists=watch_6, rowIndex=rowIndex)
watch_18 = Watch(triple_get_15)
to_float_5 = Custom[To Float](unknown=watch_18)
code_block_22 = CodeBlock(x=to_float_5) { x/2; }
watch_19 = Watch(triple_get_6)
watch_20 = Watch(watch_19)
to_float_6 = Custom[To Float](unknown=watch_20)
watch_21 = Watch(triple_get_7)
watch_22 = Watch(triple_get_8)
code_block_23 = CodeBlock(x=watch_21, o=watch_22) { (x-o)*-1; }
watch_23 = Watch(triple_get_9)
code_block_24 = CodeBlock(z=watch_23) { z*-1; }

# group: offset lower line by distance
code_block_25 = CodeBlock { -350; }
code_block_26 = CodeBlock { 350; }
chooser_5 = Custom[Chooser](zeroItem=code_block_25, oneItem=code_block_26, zeroOrOne=watch_10)

boolean = BoolSelector(false)
fourFloorLowerFloorType = Input(fourFloorLowerFloorType : FloorType)
string_24 = StringInput("Not this one")
mainHostLevel = Input(mainHostLevel : var[]..[])
watch_24 = Watch(triple_get_10)

# group: fourFloor
string_25 = StringInput("Not this one")
string_26 = StringInput("FourFloor")
eq_2 = watch_24 == string_26
boolean_to_int_2 = Custom[Boolean to Int](item=eq_2)
chooser_6 = Custom[Chooser](zeroItem=string_24, oneItem=mainHostLevel, zeroOrOne=boolean_to_int_2)
watch_25 = Watch(chooser_6)

# group: use parameter
string_27 = StringInput("Comments")

watch_26 = Watch(triple_get_11)

# group: use parameter
string_28 = StringInput("Mark")

code_block_27 = CodeBlock { 15; }
triple_get_16 = Custom[Triple Get](indexList=watch_5, indexToGet=code_block_27, dataSublists=watch_6, rowIndex=rowIndex)
watch_27 = Watch(triple_get_16)
boolean_2 = BoolSelector(true)
fourFloorBankedFloorType = Input(fourFloorBankedFloorType : FloorType)
get_points_of_interest_using_3 = Custom[Get Points of Interest Using Chainage](ChainageList=to_float, start=to_float_2, end=to_float_3, X_list=unpack_three_sublists_4.zero, Y_list=unpack_three_sublists_4.one, Z_list=unpack_three_sublists_4.two)

# group: re-sample point data
sample_curve_by_divisions = Custom[Sample Curve By Divisions](points=get_points_of_interest_using.Points, divisions=watch_13)
sample_curve_by_divisions_2 = Custom[Sample Curve By Divisions](points=get_points_of_interest_using_2.Points, divisions=watch_13)
sample_curve_by_divisions_3 = Custom[Sample Curve By Divisions](points=get_points_of_interest_using_3.Points, divisions=watch_13)

offset_points_by_polycurve_and = Custom[Offset Points By PolyCurve and Distance](points=sample_curve_by_divisions.sampled, distanceMayBeNegative=chooser_4)
watch_28 = Watch(offset_points_by_polycurve_and)
firstItem = List.FirstItem(watch_28)

# group: offset lower
code_block_28 = CodeBlock { 100; }
code_block_29 = CodeBlock { -100; }

chooser_7 = Custom[Chooser](zeroItem=code_block_28, oneItem=code_block_29, zeroOrOne=watch_10)

# group (continued): offset lower
offset_points_by_polycurve_and_2 = Custom[Offset Points By PolyCurve and Distance](points=sample_curve_by_divisions_2.sampled, distanceMayBeNegative=chooser_7)

create_6 = List.Create(offset_points_by_polycurve_and_2, sample_curve_by_divisions.sampled)

# group: add anchors
string_29 = StringInput("Not this one")
string_30 = StringInput("Yes")
eq_3 = watch_17 == string_30
boolean_to_int_3 = Custom[Boolean to Int](item=eq_3)
chooser_8 = Custom[Chooser](zeroItem=string_29, oneItem=create_6, zeroOrOne=boolean_to_int_3)
watch_29 = Watch(chooser_8)

getItemAtIndex_2 = List.GetItemAtIndex(list=watch_29, index=code_block_20)
byControlPoints = NurbsCurve.ByControlPoints(getItemAtIndex_2)
length = Curve.Length(byControlPoints)
byControlPoints_2 = NurbsCurve.ByControlPoints(watch_28)
pointAtSegmentLength = Curve.PointAtSegmentLength(curve=byControlPoints_2, segmentLength=code_block_22)
firstItem_2 = List.FirstItem(pointAtSegmentLength@L2)
firstItem_3 = List.FirstItem(firstItem_2)
pointsAtSegmentLengthFromPoint = Curve.PointsAtSegmentLengthFromPoint(byControlPoints_2, firstItem_3, to_float_6)
offset_point_z_value = Custom[Offset Point Z Value](points=pointsAtSegmentLengthFromPoint, desiredOffset=code_block_23)
offset_point_z_value_2 = Custom[Offset Point Z Value](points=offset_point_z_value, desiredOffset=code_block_24)
byStartPointEndPoint = Line.ByStartPointEndPoint(startPoint=offset_point_z_value_2, endPoint=offset_point_z_value)
columnByCurve = StructuralFraming.ColumnByCurve(curve=byStartPointEndPoint)  # frozen; unwired: level, structuralColumnType

# group: offset lower
code_block_30 = CodeBlock { -100; }
code_block_31 = CodeBlock { 100; }
offset_points_by_polycurve_and_3 = Custom[Offset Points By PolyCurve and Distance](points=sample_curve_by_divisions_2.sampled, distanceMayBeNegative=code_block_31)

byPoints = PolyCurve.ByPoints(points=offset_points_by_polycurve_and_3)
curves = PolyCurve.Curves(byPoints)

# group: make floors
point_lists_to_shape_edited = Custom[Point Lists to Shape Edited Floors](mainPointList=offset_points_by_polycurve_and_2, offset=chooser_5, useBothPointListsBool=boolean, secondPointList=sample_curve_by_divisions.sampled, floorType=fourFloorLowerFloorType, level=watch_25)  # Can use one or two point 'strings'

watch_30 = Watch(point_lists_to_shape_edited)
setParameterByName = Element.SetParameterByName(element=watch_30, parameterName=string_27, value=watch_26)
setParameterByName_2 = Element.SetParameterByName(element=setParameterByName, parameterName=string_28, value=watch_27)
point_lists_to_shape_edited_2 = Custom[Point Lists to Shape Edited Floors](mainPointList=sample_curve_by_divisions_2.sampled, offset=chooser_5, useBothPointListsBool=boolean_2, secondPointList=sample_curve_by_divisions.sampled, floorType=fourFloorBankedFloorType, level=watch_25)
watch_31 = Watch(point_lists_to_shape_edited_2)
setParameterByName_3 = Element.SetParameterByName(element=watch_31, parameterName=string_27, value=watch_26)
setParameterByName_4 = Element.SetParameterByName(element=setParameterByName_3, parameterName=string_28, value=watch_27)
watch_32 = Watch(sample_curve_by_divisions_3.sampled)
fourFloorUpperFloorType = Input(fourFloorUpperFloorType : FloorType)
point_lists_to_shape_edited_3 = Custom[Point Lists to Shape Edited Floors](mainPointList=sample_curve_by_divisions.sampled, offset=chooser_5, useBothPointListsBool=boolean_2, secondPointList=watch_32, floorType=fourFloorUpperFloorType, level=watch_25)
watch_33 = Watch(point_lists_to_shape_edited_3)
setParameterByName_5 = Element.SetParameterByName(element=watch_33, parameterName=string_27, value=watch_26)
setParameterByName_6 = Element.SetParameterByName(element=setParameterByName_5, parameterName=string_28, value=watch_27)
code_block_32 = CodeBlock { -100; }
offset_point_z_value_3 = Custom[Offset Point Z Value](points=sample_curve_by_divisions_3.sampled, desiredOffset=code_block_32)
watch_34 = Watch(offset_point_z_value_3)
code_block_33 = CodeBlock { -500; }
code_block_34 = CodeBlock { 500; }
chooser_9 = Custom[Chooser](zeroItem=code_block_33, oneItem=code_block_34, zeroOrOne=watch_10)
boolean_3 = BoolSelector(false)
fourFloorUpperFootingType = Input(fourFloorUpperFootingType : FloorType)
point_lists_to_shape_edited_4 = Custom[Point Lists to Shape Edited Floors](mainPointList=watch_34, offset=chooser_9, useBothPointListsBool=boolean_3, secondPointList=watch_32, floorType=fourFloorUpperFootingType, level=watch_25)
watch_35 = Watch(point_lists_to_shape_edited_4)
setParameterByName_7 = Element.SetParameterByName(element=watch_35, parameterName=string_27, value=watch_26)
setParameterByName_8 = Element.SetParameterByName(element=setParameterByName_7, parameterName=string_28, value=watch_27)
create_7 = List.Create(setParameterByName_2, setParameterByName_4, setParameterByName_6, setParameterByName_8)
code_block_35 = CodeBlock { 0; }
getItemAtIndex_3 = List.GetItemAtIndex(list=watch_29, index=code_block_35)
byControlPoints_3 = NurbsCurve.ByControlPoints(getItemAtIndex_3)
length_2 = Curve.Length(byControlPoints_3)
watch_36 = Watch(triple_get_12)
to_float_7 = Custom[To Float](unknown=watch_36)
watch_37 = Watch(to_float_7)
code_block_36 = CodeBlock(x=length_2, y=watch_37) { 1/(x/y); }
code_block_37 = CodeBlock(x=code_block_36) { 0..1..x; }
pointAtParameter = Curve.PointAtParameter(curve=byControlPoints_3, param=code_block_37)
pointAtParameter_2 = Curve.PointAtParameter(curve=byControlPoints, param=code_block_37)
byStartPointEndPoint_2 = Line.ByStartPointEndPoint(startPoint=pointAtParameter, endPoint=pointAtParameter_2)
length_3 = Curve.Length(byStartPointEndPoint_2)
code_block_38 = CodeBlock(x=length_3, y=watch_37) { 1/(x/y); }
code_block_39 = CodeBlock(x=code_block_38) { 0..1..x; }
code_block_40 = CodeBlock { 1; }
dropItems = List.DropItems(list=code_block_39@@L2, amount=code_block_40)
pointAtParameter_3 = Curve.PointAtParameter(curve=byStartPointEndPoint_2, param=dropItems)
normalAtParameter = Curve.NormalAtParameter(curve=byStartPointEndPoint_2, param=dropItems)
direction = Line.Direction(byStartPointEndPoint_2)
code_block_41 = CodeBlock { 90; }
rotate = Vector.Rotate(normalAtParameter, direction, code_block_41)
watch_38 = Watch(triple_get_13)
to_float_8 = Custom[To Float](unknown=watch_38)
byStartPointDirectionLength = Line.ByStartPointDirectionLength(startPoint=pointAtParameter_3, direction=rotate, length=to_float_8)
watch_39 = Watch(byStartPointDirectionLength)
structuralFramingType = Input(structuralFramingType : FamilyType)
beamByCurve = StructuralFraming.BeamByCurve(curve=watch_39, level=mainHostLevel, structuralFramingType=structuralFramingType)
setParameterByName_9 = Element.SetParameterByName(element=beamByCurve, parameterName=string_27, value=watch_26)
setParameterByName_10 = Element.SetParameterByName(element=setParameterByName_9, parameterName=string_28, value=watch_27)

# group: DEPTH
watch_40 = Watch(watch_21)

# group: Floor type chooser
floor_types = FloorTypes("DF500")
floor_types_2 = FloorTypes("DF1000")
create_8 = List.Create(floor_types, floor_types_2)
to_float_9 = Custom[To Float](unknown=watch_40)
turnIntoList = Custom[TurnIntoList](unknownItem=to_float_9)  # Turns an element (or a nested list) into a flat list
code_block_42 = CodeBlock { "Default Thickness"; }
getParameterValueByName = Element.GetParameterValueByName(element=floor_types, parameterName=code_block_42)
to_float_10 = Custom[To Float](unknown=getParameterValueByName)
code_block_43 = CodeBlock { "Default Thickness"; }
getParameterValueByName_2 = Element.GetParameterValueByName(element=floor_types_2, parameterName=code_block_43)
to_float_11 = Custom[To Float](unknown=getParameterValueByName_2)
create_9 = List.Create(to_float_10, to_float_11)
bv_if_equal_return_index = Custom[bv If Equal Return Index](listA=turnIntoList, listB=create_9)  # forked
getItemAtIndex_4 = List.GetItemAtIndex(list=create_8, index=bv_if_equal_return_index)

firstItem_4 = List.FirstItem(getItemAtIndex_4)
pileLevel = Input(pileLevel : var[]..[])

# group: PileAndCap
string_31 = StringInput("PileAndCap")
eq_4 = watch_24 == string_31
boolean_to_int_4 = Custom[Boolean to Int](item=eq_4)
chooser_10 = Custom[Chooser](zeroItem=string_24, oneItem=pileLevel, zeroOrOne=boolean_to_int_4)

# group: wip - pad
boolean_4 = BoolSelector(true)
point_lists_to_shape_edited_5 = Custom[Point Lists to Shape Edited Floors](mainPointList=sample_curve_by_divisions.sampled, offset=chooser_5, useBothPointListsBool=boolean_4, secondPointList=sample_curve_by_divisions_3.sampled, floorType=firstItem_4, level=chooser_10)
watch_41 = Watch(point_lists_to_shape_edited_5)

setParameterByName_11 = Element.SetParameterByName(element=watch_41, parameterName=string_27, value=watch_26)
setParameterByName_12 = Element.SetParameterByName(element=setParameterByName_11, parameterName=string_28, value=watch_27)
structuralColumnType = Input(structuralColumnType : FamilyType)
structural_column_by_curve_in = Custom[Structural Column By Curve In Transaction](curves=byStartPointEndPoint, columnType=structuralColumnType, level=chooser_10)
watch_42 = Watch(structural_column_by_curve_in)
setParameterByName_13 = Element.SetParameterByName(element=watch_42, parameterName=string_27, value=watch_26)
setParameterByName_14 = Element.SetParameterByName(element=setParameterByName_13, parameterName=string_28, value=watch_27)
create_10 = List.Create(setParameterByName_12, setParameterByName_14)
deconstructPolyCurve = Geometry.Curves.DeconstructPolyCurve(byPoints)
flatten = Flatten(deconstructPolyCurve)
firstItem_5 = List.FirstItem(sample_curve_by_divisions.sampled@L2)
deconstructPoint = Geometry.Points.DeconstructPoint(firstItem_5)
firstItem_6 = List.FirstItem(deconstructPoint.out2@L1)
firstItem_7 = List.FirstItem(offset_points_by_polycurve_and_3@L2)
deconstructPoint_2 = Geometry.Points.DeconstructPoint(firstItem_7)
firstItem_8 = List.FirstItem(deconstructPoint_2.out2@L1)
code_block_44 = CodeBlock(x=firstItem_6, y=firstItem_8) { x-y; }
wallLevel = Input(wallLevel : Level)
wallType = Input(wallType : var[]..[])

# group: tapered wall
string_32 = StringInput("TaperedWall--notInUse")
eq_5 = watch_24 == string_32
boolean_to_int_5 = Custom[Boolean to Int](item=eq_5)
chooser_11 = Custom[Chooser](zeroItem=string_24, oneItem=wallType, zeroOrOne=boolean_to_int_5)
watch_43 = Watch(chooser_11)

byCurveAndHeight = Wall.ByCurveAndHeight(curve=flatten, height=code_block_44, level=wallLevel, wallType=watch_43, lacing=Longest)
setParameterByName_15 = Element.SetParameterByName(element=byCurveAndHeight, parameterName=string_27, value=watch_26)
setParameterByName_16 = Element.SetParameterByName(element=setParameterByName_15, parameterName=string_28, value=watch_27)
watch_44 = Watch(setParameterByName_16)
create_11 = List.Create(watch_44)

# group: oneFloor
string_33 = StringInput("OneFloor")
eq_6 = watch_24 == string_33
boolean_to_int_6 = Custom[Boolean to Int](item=eq_6)
chooser_12 = Custom[Chooser](zeroItem=string_24, oneItem=mainHostLevel, zeroOrOne=boolean_to_int_6)
watch_45 = Watch(chooser_12)

point_lists_to_shape_edited_6 = Custom[Point Lists to Shape Edited Floors](mainPointList=sample_curve_by_divisions_2.sampled, offset=chooser_5, useBothPointListsBool=boolean_2, secondPointList=sample_curve_by_divisions.sampled, floorType=fourFloorBankedFloorType, level=watch_45)
setParameterByName_17 = Element.SetParameterByName(element=point_lists_to_shape_edited_6, parameterName=string_27, value=watch_26)
setParameterByName_18 = Element.SetParameterByName(element=setParameterByName_17, parameterName=string_28, value=watch_27)
create_12 = List.Create(create_7, setParameterByName_10, create_10, create_11, setParameterByName_18)
flatten_2 = Flatten(create_12)
removeNulls = Lists.Manage.RemoveNulls(flatten_2)
string_34 = StringInput("CommentLine6")
string_35 = StringInput("beforeCopy")
setParameterByName_19 = Element.SetParameterByName(element=removeNulls, parameterName=string_34, value=string_35)
copy_elements_to_same_place = Custom[Copy Elements To Same Place](elements=setParameterByName_19)
string_36 = StringInput("CommentLine6")
string_37 = StringInput("afterCopy")
setParameterByName_20 = Element.SetParameterByName(element=copy_elements_to_same_place, parameterName=string_36, value=string_37)
end = Revit.Transaction.Transaction.End(setParameterByName_20)
created = Output(end)
