# Dynamo custom node Batch Change Model Paths.dyf (Dynamo 1.2.1.3083)
# category: Bakery.Revit.Document.Links
# run from a federated file with links with links

filepathobjects = Input()
watch = Watch(filepathobjects)
counter = Input()
watch_2 = Watch(counter)
getItemAtIndex = List.GetItemAtIndex(list=watch, index=watch_2)
fileNameList = Input()
filePathsWithQuotes = Input()
pathResolution = Input()
GoForIt = Input()
getItemAtIndex_2 = List.GetItemAtIndex(list=watch, index=watch_2)
TrueForLoad = Input()

# group: read current transmission data
python_script = Python(IN[0]=getItemAtIndex, IN[1]=fileNameList, IN[2]=filePathsWithQuotes, IN[3]=pathResolution, IN[4]=GoForIt, IN[5]=getItemAtIndex_2, IN[6]=TrueForLoad)
# ---------- python_script.python (130 lines) ----------
import clr
clr.AddReference('ProtoGeometry')
from Autodesk.DesignScript.Geometry import *

# Import RevitAPI
clr.AddReference("RevitAPI")
import Autodesk
from Autodesk.Revit.DB import *

clr.AddReference("RevitServices")
import RevitServices
from RevitServices.Persistence import DocumentManager
from RevitServices.Transactions import TransactionManager

from System.Collections.Generic import *

clr.AddReference('RevitNodes')
import Revit
clr.ImportExtensions(Revit.Elements)
clr.ImportExtensions(Revit.GeometryConversion)

from System import Guid

import System

import sys
pyt_path = r'C:\Program Files (x86)\IronPython 2.7\Lib'
sys.path.append(pyt_path)

import os.path

doc = DocumentManager.Instance.CurrentDBDocument
uiapp = DocumentManager.Instance.CurrentUIApplication
app = uiapp.Application

tempvalue = IN[0]
approvedFilenames = IN[1]
approvedFilepaths = IN[2]
targetfilepath = IN[5]
boolsetting = IN[6]

def stripquotes(string):
	string = string[1:-1]
	return string

transData = TransmissionData.ReadTransmissionData(tempvalue)
erefids = transData.GetAllExternalFileReferenceIds()
refdata = []
for x in erefids:
	refdata.append(transData.GetDesiredReferenceData(x))

currentpaths, currenterefType, currenterefPath, pstr = [], [], [], []

for e in refdata:
	currentpaths.append(ExternalFileReference.GetAbsolutePath(e))
	currenterefType.append(e.ExternalFileReferenceType)
	currenterefPath.append(e.PathType)
for s in currentpaths:
	pstr.append(ModelPathUtils.ConvertModelPathToUserVisiblePath(s))
	
filenames = []
for p in pstr:
	templist = os.path.split(p)
	filenames.append(templist[1])
	
newpath = []
indices = []
failpath = []
origcounter = 0
matchrefs = []
newpathtypes, newbools = [], []
pathtypevar = IN[3]
for f in filenames:
	tempindex = approvedFilenames.index(f) if f in approvedFilenames else -1
	indices.append(tempindex)
	if tempindex == -1:
		failpath.append(origcounter)
		pass
	else:
		newpath.append(ModelPathUtils.ConvertUserVisiblePathToModelPath(stripquotes(approvedFilepaths[tempindex])))
		matchrefs.append(erefids[origcounter])
		newpathtypes.append(pathtypevar)
		newbools.append(boolsetting)
	origcounter = origcounter + 1

currentfilepathstring=ModelPathUtils.ConvertModelPathToUserVisiblePath(targetfilepath)
elementcount = len(erefids)
hostfile = currentfilepathstring * elementcount
currentdata = []
#currentdata.append(transData)
currentdata.append(hostfile)
currentdata.append(erefids)
currentdata.append(refdata)
currentdata.append(currentpaths)
currentdata.append(currenterefType)
currentdata.append(currenterefPath)
currentdata.append(pstr)
currentdata.append(filenames)

newdata = []
newdata.append(indices)
newdata.append(newpath)
newdata.append(matchrefs)
newdata.append(newpathtypes)
newdata.append(newbools)

setlength = len(newpath)
setcounter = range(setlength)
successreport = []
setdata = IN[4]
if setdata:
	for s in setcounter:
		try:
			transData.SetDesiredReferenceData(matchrefs[s], newpath[s], newpathtypes[s], newbools[s])
			successreport.append("Success setting data")
		except:
			successreport.append("Failure setting data")
else:
	successreport.append("You need to set the switch to True")

if setdata:
	try:
		transData.IsTransmitted = True
		transData.WriteTransmissionData(targetfilepath, transData)
		successreport.append("Success WRITING data")
	except:
		successreport.append("Failure WRITING data")
		
#Assign your output to the OUT variable.
OUT = successreport, currentdata, newdata
# ----------------------------------------

oneOutput = Output(python_script)
