# Dynamo custom node Batch Modify Workset of All Elements.dyf (Dynamo 0.9.1.4062)
# category: Bakery.Worksets
# for all elements in current model

targetWorksetName = Input()
select_workset_by_name = Custom[Select Workset by Name](worksetName=targetWorksetName)
collect_all_elements_in_model = Custom[Collect All Elements in Model faster]()  # does not report count or categories
workset = Custom[Element.Workset](element=collect_all_elements_in_model.extendedElementList)  # Retrieves the workset of a given element
element_name_universal = Custom[Element Name Universal](Element_s=workset)  # Modified for 0.8.1
currentWorksetName = Input()
eq = element_name_universal == currentWorksetName
filterByBoolMask = List.FilterByBoolMask(list=collect_all_elements_in_model.extendedElementList, mask=eq)
watch = Watch(filterByBoolMask.in)
setWorkset = Custom[Element.SetWorkset](workset=select_workset_by_name, element=watch)  # Sets the workset of a given element
changedElements = Output(setWorkset.changedElements)
unchangedElements = Output(setWorkset.unchangedElements)
elementsToChange = Output(filterByBoolMask.in)
targetWorksetDb = Output(select_workset_by_name)
