# Dynamo custom node Bruteforce Get Parameter Values when Multiple Entries.dyf (Dynamo 0.8.2.2371)
# category: Bakery.Revit.Parameters

element = Input()
parameters = Element.Parameters(element)
string_from_object = FromObject()
map = List.Map(list=parameters, f_x=string_from_object)
string = StringInput(" :")
parameterName = Input()
string_2 = StringInput(" ")
join = String.Join(string, parameterName, string_2)
code_block = CodeBlock { true; }
contains = String.Contains(searchFor=join, ignoreCase=code_block)
map_2 = List.Map(list=map, f_x=contains)
filterByBoolMask = List.FilterByBoolMask(list=parameters, mask=map_2)
string_from_object_2 = FromObject()
map_3 = List.Map(list=filterByBoolMask.in, f_x=string_from_object_2)
length = String.Length(map_3)
length_2 = String.Length(join)
gt = length > length_2
filterByBoolMask_2 = List.FilterByBoolMask(list=filterByBoolMask.in, mask=gt)
string_from_object_3 = FromObject(filterByBoolMask_2.in)
split = String.Split(string_from_object_3, join)
code_block_2 = CodeBlock { 0; }
getItemAtIndex = List.GetItemAtIndex(list=split, index=code_block_2)
ValueAsStr = Output(getItemAtIndex)
watch = Watch(split)
lineItem = Output(filterByBoolMask_2.in)
