# Dynamo custom node Build BCF Subfolder from Lists.dyf (Dynamo 1.3.4.6666)
# category: Bakery.BIM.BCF.Helper

# group: guid
string = StringInput("73e35309-edc3-1a07-d11c-27200359fb0c")

# group: example comment
string_2 = StringInput("<Comment>https://www.virtualbuiltapp.com/apps/app_rah/index.php?-table=fm_db_browser_view&amp;-limit=30&amp;DB_Tree_Board=DB-2-010-02</Comment>")

# group: path sep
string_3 = StringInput("\")

parentPath = Input()

# group: path
watch = Watch(parentPath)

firstItem = List.FirstItem(watch)
fromPath = DirectoryObject(firstItem)  # "Directory.FromPath"
generatedBcfguidlist = Input()
counter = Input(counter : int)
getItemAtIndex = List.GetItemAtIndex(list=generatedBcfguidlist, index=counter)
watch_2 = Watch(getItemAtIndex)

# group: issue guid
string_4 = StringInput("af0894a1-f240-4b50-8eaa-cd95a9a69e6b")
watch_3 = Watch(watch_2)

python_script = Python(IN[0]=fromPath, IN[1]=watch_2)
# ---------- python_script.python (42 lines) ----------
import clr
clr.AddReference('ProtoGeometry')
from Autodesk.DesignScript.Geometry import *

# Import RevitAPI
clr.AddReference("RevitAPI")
import Autodesk
from Autodesk.Revit.DB import *

clr.AddReference("RevitServices")
import RevitServices
from RevitServices.Persistence import DocumentManager
from RevitServices.Transactions import TransactionManager

from System.Collections.Generic import *

clr.AddReference('RevitNodes')
import Revit
clr.ImportExtensions(Revit.Elements)
clr.ImportExtensions(Revit.GeometryConversion)

from System import Guid

import System


import sys
pyt_path = r'C:\Program Files (x86)\IronPython 2.7\Lib'
sys.path.append(pyt_path)
import base64
import uuid
     
import os

dirpath = IN[0]
dirname = IN[1]
try:
	os.makedirs(str(dirpath) + "\\" + dirname)
	done=True
except:
	done=False
OUT=done
# ----------------------------------------
string_5 = StringInput("\")
switch = Custom[Switch](boolean_switch=python_script, data=string_5)
firstItem_2 = List.FirstItem(switch)
join = String.Join(firstItem_2, firstItem, watch_2)
watch_4 = Watch(join)
firstItem_3 = List.FirstItem(watch_4)

# group: blank separator
string_6 = StringInput("")

# group: typical
string_7 = StringInput("<?xml version=\"1.0\" encoding=\"utf-8\"?>\n<VisualizationInfo xmlns:xsi=\"http://www.w3.org/2001/XMLSchema-instance\" xmlns:xsd=\"http://www.w3.org/2001/XMLSchema\" Guid=\"")
string_8 = StringInput("\">\n  <Components>\n    <ViewSetupHints SpacesVisible=\"true\" SpaceBoundariesVisible=\"false\" OpeningsVisible=\"false\" />\n    <Selection>\n      <Component IfcGuid=\"")
string_9 = StringInput("""">
        <AuthoringToolId>""")
string_10 = StringInput("""</AuthoringToolId>
      </Component>
    </Selection>
    <Visibility DefaultVisibility="true">
      <Exceptions />
    </Visibility>
    <Coloring />
  </Components>
  <PerspectiveCamera>""")

# group: viewpoint guid
output_one_guid_string = Custom[Output One GUID String]()

# group: viewpoint guid
string_11 = StringInput("73e35309-edc3-1a07-d11c-27200359fb0c")
watch_5 = Watch(output_one_guid_string)

ifcguids = Input()
getItemAtIndex_2 = List.GetItemAtIndex(list=ifcguids, index=counter)
elementIds = Input()
getItemAtIndex_3 = List.GetItemAtIndex(list=elementIds, index=counter)
string_from_object = FromObject(getItemAtIndex_3)
watch_6 = Watch(string_from_object)

# group: viewpoint
string_12 = StringInput("""
    <CameraViewPoint>
      <X>""")
string_13 = StringInput("""</X>
      <Y>""")
string_14 = StringInput("""</Y>
      <Z>""")
string_15 = StringInput("""</Z>
    </CameraViewPoint>
    <CameraDirection>
      <X>-0.53661631067048865</X>
      <Y>-0.82370177633930819</Y>
      <Z>-0.183189297661905</Z>
    </CameraDirection>""")

xPositions = Input()
getItemAtIndex_4 = List.GetItemAtIndex(list=xPositions, index=counter)

# group: scale factor
code_block = CodeBlock { 1000; }

yPositions = Input()
getItemAtIndex_5 = List.GetItemAtIndex(list=yPositions, index=counter)
zPositions = Input()
getItemAtIndex_6 = List.GetItemAtIndex(list=zPositions, index=counter)

# group: scale
to_float = Custom[To Float](unknown=getItemAtIndex_4)  # converts input object to a float with python
code_block_2 = CodeBlock(x=to_float, y=code_block) { x/y; }
string_from_object_2 = FromObject(code_block_2)
to_float_2 = Custom[To Float](unknown=getItemAtIndex_5)
code_block_3 = CodeBlock(x=to_float_2, y=code_block) { x/y; }
string_from_object_3 = FromObject(code_block_3)
to_float_3 = Custom[To Float](unknown=getItemAtIndex_6)
code_block_4 = CodeBlock(x=to_float_3, y=code_block) { x/y; }

# group: z offset
code_block_5 = CodeBlock { 1.2; }

code_block_6 = CodeBlock(n=code_block_4, m=code_block_5) { n+m; }

# group (continued): scale
string_from_object_4 = FromObject(code_block_6)

join_2 = String.Join(string_6, string_12, string_from_object_2, string_13, string_from_object_3, string_14, string_from_object_4, string_15)
watch_7 = Watch(join_2)
string_16 = StringInput("""
    <CameraUpVector>
      <X>-0.21851449545008386</X>
      <Y>-0.24077888596162672</Y>
      <Z>0.9456621718950553</Z>
    </CameraUpVector>""")
string_17 = StringInput("""
    <FieldOfView>85.686271667480469</FieldOfView>
  </PerspectiveCamera>
</VisualizationInfo>""")

# group: viewpoint.bcfv
join_3 = String.Join(string_6, string_7, output_one_guid_string, string_8, getItemAtIndex_2, string_9, watch_6, string_10, watch_7, string_16, string_17)
watch_8 = Watch(join_3)

# group: viewpoints
string_18 = StringInput("viewpoint.bcfv")
join_4 = String.Join(string_3, firstItem_3, string_18)
watch_9 = Watch(join_4)
writeText = File.WriteText(watch_9, watch_8)
isNull = Object.IsNull(writeText)

# group: typical
string_19 = StringInput("<?xml version=\"1.0\" encoding=\"utf-8\"?>\n<Markup xmlns:xsi=\"http://www.w3.org/2001/XMLSchema-instance\" xmlns:xsd=\"http://www.w3.org/2001/XMLSchema\">\n  <Header />\n  <Topic Guid=\"")
string_20 = StringInput("""" TopicStatus="Open">
    <Title>""")
string_21 = StringInput("""</Title>
    <Priority>None</Priority>
    <CreationDate>2019-05-12T01:15:01Z</CreationDate>
    <CreationAuthor>luke.johnson@spotless.com.au</CreationAuthor>
    <ModifiedDate>2019-05-12T01:15:01.7702189Z</ModifiedDate>
    <AssignedTo>luke.johnson@spotless.com.au</AssignedTo>
  </Topic>""")
string_22 = StringInput("  <Viewpoints Guid=\"")
string_23 = StringInput("""">
    <Viewpoint>viewpoint.bcfv</Viewpoint>
    <Snapshot>snapshot.png</Snapshot>
    <Index>0</Index>
  </Viewpoints>
</Markup>""")

titleList = Input()
getItemAtIndex_7 = List.GetItemAtIndex(list=titleList, index=counter)
string_24 = StringInput("\n  <Comment Guid=\"")

# group: comment guid
output_one_guid_string_2 = Custom[Output One GUID String]()

string_25 = StringInput("""">
    <Date>2019-05-24T00:47:09Z</Date>
    <Author>ljohnson@virtualbuilt.com.au</Author>
    <Comment>""")
commentList = Input()
getItemAtIndex_8 = List.GetItemAtIndex(list=commentList, index=counter)
string_26 = StringInput("</Comment>\n    <Viewpoint Guid=\"")
join_5 = String.Join(string_6, string_25, getItemAtIndex_8, string_26)
string_27 = StringInput("""" />
  </Comment>
""")
join_6 = String.Join(string_6, string_24, output_one_guid_string_2, join_5, watch_5, string_27)
join_7 = String.Join(string_6, string_19, watch_3, string_20, getItemAtIndex_7, string_21, join_6, string_22, watch_5, string_23)
watch_10 = Watch(join_7)

# group: markup.bcf
string_28 = StringInput("markup.bcf")
join_8 = String.Join(string_3, firstItem_3, string_28)
watch_11 = Watch(join_8)
writeText_2 = File.WriteText(watch_11, watch_10)
isNull_2 = Object.IsNull(writeText_2)

# group: snapshot.png
file_path = Filename("Common_Resource\snapshot.png")
watch_12 = Watch(file_path)
copy_file_to_directory = Custom[Copy File to Directory](filePath=watch_12, targetDirString=join, go=python_script)
isNull_3 = Object.IsNull(copy_file_to_directory)

create = List.Create(isNull, isNull_2, isNull_3)
countTrue = CountTrue(create)
code_block_7 = CodeBlock { 3; }
eq = countTrue == code_block_7
done = Output(eq)
