# Dynamo custom node Build NW Search String v1.dyf (Dynamo 0.9.1.4062)
# category: Bakery.Construction.Navisworks

code_block = CodeBlock { ""; }
string = StringInput("""<condition test="equals" flags="74">
              <category>
                <name internal="LcRevitData_Element">Element</name>
              </category>
              <property>
                <name internal="LcRevitPropertyElementId">Id</name>
              </property>
              <value>
                <data type="int32">""")
input = Input()
string_from_object = FromObject(input)
string_2 = StringInput("""</data>
              </value>
            </condition>""")
join = String.Join(code_block, string, string_from_object, string_2)
str = Output(join)
