# Dynamo custom node Build New Order of Headings by Search.dyf (Dynamo 0.9.2.4472)
# category: Bakery.Core.List

NewHeadingOrderWildcards = Input()
toUpper = String.ToUpper(NewHeadingOrderWildcards)
OriginalHeadingOrder = Input()
flat_list_to_list_of_strings = Custom[Flat List to List of Strings](Original_List=OriginalHeadingOrder)  # using python methods
toUpper_2 = String.ToUpper(flat_list_to_list_of_strings)

# group: Case sensitive
wildcard_string_search_one_list = Custom[Wildcard String Search One List in Another List (Faster)](searchForTheseFragments=toUpper, insideStringsInThisList=toUpper_2)  # uses straight Python not String.Contains

keep_first_matching_result_after = Custom[Keep First Matching Result After Search](foundSearchItems=wildcard_string_search_one_list.SearchItems, originalSearchList=toUpper, searchResults=wildcard_string_search_one_list.foundInThese)
watch = Watch(keep_first_matching_result_after)
newHeadings = Output(watch)
bv_all_indices_of_that_can = Custom[bv All Indices Of that can handle Nulls](list=toUpper_2, value=watch)  # forked from spring nodes
watch_2 = Watch(bv_all_indices_of_that_can)

# group: Get from
firstItem = List.FirstItem()
map = List.Map(list=watch_2, f_x=firstItem)
watch_3 = Watch(map)

create = List.Create(NewHeadingOrderWildcards, watch_3)
list_length_validator = Custom[List Length Validator](listOfLists=create)
indicesMatchDesiredOrder = Output(list_length_validator)
create_2 = List.Create(wildcard_string_search_one_list.foundInThese, watch)
list_length_validator_2 = Custom[List Length Validator](listOfLists=create_2)
FalseIfDuplicatesFoundAndRemoved = Output(list_length_validator_2)
indices = Output(watch_3)
