# Dynamo custom node Built In Name Lister (mclothier@virtualbuilt.com.au).dyf "Built In Name Lister" (Dynamo 0.9.1.4062)
# category: Bakery.Categories
# lists BuiltInNames (Built In Category Names)

python_script = Python()
# ---------- python_script.python (53 lines) ----------
#LSJ

import clr
clr.AddReference('ProtoGeometry')
from Autodesk.DesignScript.Geometry import *

# Import DocumentManager
clr.AddReference("RevitServices")
import RevitServices
from RevitServices.Persistence import DocumentManager

# Import RevitAPI
clr.AddReference("RevitAPI")
import Autodesk

# Import ToDSType(bool) extension method
clr.AddReference("RevitNodes")
import Revit
from Autodesk.Revit.DB import *
clr.ImportExtensions(Revit.Elements)

import System

#The inputs to this node will be stored as a list in the IN variable.
#doc = DocumentManager.Instance.CurrentDBDocument
uiapp = DocumentManager.Instance.CurrentUIApplication
app = uiapp.Application
doc = DocumentManager.Instance.CurrentDBDocument

#create workset collector
userCategories = doc.Settings.Categories
#extract workset's name and ids
ids = []
for i in userCategories:
	try:
		ids.append(i.Id.IntegerValue)
	except:
		ids.append(0)
#Assign your output to the OUT variable
builtInNames = []
for x in ids:
	try:
		builtInNames.append(System.Enum.ToObject(BuiltInCategory, x))
	except:
		builtInNames.append("Name failed")
fullenumcats = System.Enum.GetValues(BuiltInCategory)
fullenumcatids = []
for y in fullenumcats:
	try:
		fullenumcatids.append(userCategories.get_Item(y))
	except:
		fullenumcatids.append("ID failed")
OUT = builtInNames, fullenumcats, fullenumcatids, ids
# ----------------------------------------
code_block = CodeBlock { 0; }
getItemAtIndex = List.GetItemAtIndex(list=python_script, index=code_block)
builtins = Output(getItemAtIndex)
string = StringInput("""OST_Views
OST_Sheets
OST_Sections
OST_Elev""")
remove_stringlist_from_list_with = Custom[Remove StringList from List with String Conversion](Original_List=getItemAtIndex, single_string_with_line_breaks=string)
builtins_views_removed = Output(remove_stringlist_from_list_with)
code_block_2 = CodeBlock { 1; }
getItemAtIndex_2 = List.GetItemAtIndex(list=python_script, index=code_block_2)
full_enumeration = Output(getItemAtIndex_2)
code_block_3 = CodeBlock { 2; }
getItemAtIndex_3 = List.GetItemAtIndex(list=python_script, index=code_block_3)
full_enumeration_as_categories = Output(getItemAtIndex_3)
code_block_4 = CodeBlock { 3; }
getItemAtIndex_4 = List.GetItemAtIndex(list=python_script, index=code_block_4)
category_Ids = Output(getItemAtIndex_4)
