# Dynamo custom node Built In Name Lister.dyf (Dynamo 0.8.2.2371)
# category: Bakery.Categories
# lists BuiltInNames (Built In Category Names)

python_script = Python()
# ---------- python_script.python (41 lines) ----------
#LSJ

import clr
clr.AddReference('ProtoGeometry')
from Autodesk.DesignScript.Geometry import *

# Import DocumentManager
clr.AddReference("RevitServices")
import RevitServices
from RevitServices.Persistence import DocumentManager

# Import RevitAPI
clr.AddReference("RevitAPI")
import Autodesk

# Import ToDSType(bool) extension method
clr.AddReference("RevitNodes")
import Revit
from Autodesk.Revit.DB import *
clr.ImportExtensions(Revit.Elements)

import System

#The inputs to this node will be stored as a list in the IN variable.
#doc = DocumentManager.Instance.CurrentDBDocument
uiapp = DocumentManager.Instance.CurrentUIApplication
app = uiapp.Application
doc = DocumentManager.Instance.CurrentDBDocument

#create workset collector
userCategories = doc.Settings.Categories
#extract workset's name and ids
ids = []
for i in userCategories:
	ids.append(i.Id.IntegerValue)
#Assign your output to the OUT variable
builtInNames = []
for x in ids:
	builtInNames.append(System.Enum.ToObject(BuiltInCategory, x))

OUT = builtInNames
# ----------------------------------------
builtins = Output(python_script)
string = StringInput("""OST_Views
OST_Sheets
OST_Sections
OST_Elev""")
remove_stringlist_from_list_with = Custom[Remove StringList from List with String Conversion](Original_List=python_script, single_string_with_line_breaks=string)
views_removed = Output(remove_stringlist_from_list_with)
