# Dynamo custom node Change Value If Matches.dyf (Dynamo 0.9.2.4472)
# category: Bakery.Core.Logic

originalValue = Input()
ifMatchingThis = Input()
replaceWithThis = Input()
python_script = Python(IN[0]=originalValue, IN[1]=ifMatchingThis, IN[2]=replaceWithThis)
# ---------- python_script.python (13 lines) ----------
import clr
clr.AddReference('ProtoGeometry')
from Autodesk.DesignScript.Geometry import *
#The inputs to this node will be stored as a list in the IN variables.
inputvalue = IN[0]
comparewith = IN[1]
replacement = IN[2]
#Assign your output to the OUT variable.
if inputvalue == comparewith:
	changedvalue = replacement
else:
	changedvalue = inputvalue
OUT = changedvalue
# ----------------------------------------
newValueOrOriginal = Output(python_script)
