# Dynamo custom node Check Common Items between Two Lists and Get From One.dyf (Dynamo 0.9.2.4472)
# category: Bakery.Core.List

in_this_and_get_from_this = Input()
searchForThese = Input(searchForThese : var[]..[])

# group: first cross-check
watch = Watch(in_this_and_get_from_this)
if_equal_return_index_using = Custom[If Equal Return Index using IndexOf](searchForThese=searchForThese, inThisList=watch)
getItemAtIndex = List.GetItemAtIndex(list=watch, index=if_equal_return_index_using)

bv_remove_nulls = Custom[bv Remove Nulls](List=getItemAtIndex)  # forked from Lunchbox

# group (continued): first cross-check
watch_2 = Watch(bv_remove_nulls)

clean_output = Output(watch_2)
clean_list_of_indices_to_remove = Custom[Clean List of Indices to Remove Negative Values](indices=if_equal_return_index_using)
cleaned_indices = Output(clean_list_of_indices_to_remove)
