# Dynamo custom node Check DYF folder for Dependencies in Package Folders.dyf (Dynamo 1.2.1.3083)
# category: Bakery.Standalone.DynamoMgmt

Directory_Path = Input(Directory Path : var[]..[])
string = StringInput("Index")
summary_and_node_search_for_a = Custom[Summary and Node Search for a Folder of DYFs](Directory_Path=Directory_Path, node_name_to_search_for=string)  # can search for a node and tell you what file it is in
watch = Watch(summary_and_node_search_for_a.which_file_contains_the_reference)
path_To_Package_Folder = Input(path To Package Folder : var[]..[])
string_2 = StringInput("Index")
report_dynamo_package_details_by = Custom[Report Dynamo Package Details by Folder](path_To_Package_Folder=path_To_Package_Folder, searchFor=string_2)

# group: outputs
watch_2 = Watch(report_dynamo_package_details_by.combined_List_of_dyfs_with_Parent_Folder_Path)
watch_3 = Watch(report_dynamo_package_details_by.Packages_Found)
watch_4 = Watch(report_dynamo_package_details_by.package_name_for_dyfs_without_Nulls)
watch_5 = Watch(report_dynamo_package_details_by.dyfs_found_without_Nulls)
watch_6 = Watch(report_dynamo_package_details_by.dyfs_Containing_Search_String)
watch_7 = Watch(report_dynamo_package_details_by.packages_where_Dyfs_Match_Search)

watch_8 = Watch(report_dynamo_package_details_by.fileListWithNulls)
writeToExcelFilePath = Input()
string_3 = StringInput("nodeList")
code_block = CodeBlock { 0; }

# group: Find Dependencies
string_4 = StringInput("\dyf\")
split = String.Split(summary_and_node_search_for_a.all_file_names, string_4)
lastItem = List.LastItem()  # unwired: arg0
map = List.Map(list=split, f_x=lastItem)
string_5 = StringInput(".dyf")
split_2 = String.Split(map, string_5)
flatten = Flatten(split_2)
uniqueItems = List.UniqueItems(flatten)
remove_list_from_list_by_item = Custom[Remove List from List by Item not Value](ListOfItemsToRemove=uniqueItems, ListToRemoveFrom=summary_and_node_search_for_a.unique_nodes_referenced)  # remove the items in ListA from the items in ListB and return whats left

# group: REFERENCED BY PACKAGE
watch_9 = Watch(remove_list_from_list_by_item.reducedList)

string_6 = StringInput(".dyf")
split_3 = String.Split(watch_5, string_6)
flatten_2 = Flatten(split_3)
if_equal_return_index_using = Custom[If Equal Return Index using IndexOf](searchForThese=watch_9, inThisList=flatten_2)
getItemAtIndex = List.GetItemAtIndex(list=watch_4, index=if_equal_return_index_using)
get_indices_of_null_values = Custom[Get Indices of Null Values](list=getItemAtIndex)  # needs to be hidden

# group: Packages these are from
removeItemAtIndex = List.RemoveItemAtIndex(list=getItemAtIndex, indices=get_indices_of_null_values)

# group: Node referenced in the package
removeItemAtIndex_2 = List.RemoveItemAtIndex(list=watch_9, indices=get_indices_of_null_values)

create = List.Create(removeItemAtIndex, removeItemAtIndex_2)
code_block_2 = CodeBlock { 0; }
code_block_3 = CodeBlock { true; }
sortListOfLists = Custom[List.SortListOfLists](seq=create, sortIndex=code_block_2, caseInsensitive=code_block_3, orderDescending=code_block_3)  # Sorts a list of lists by one of its sublists

# group: Matched list
transpose = List.Transpose(sortListOfLists)

code_block_4 = CodeBlock { true; }
writeToFile = Excel.WriteToFile(filePath=writeToExcelFilePath, sheetName=string_3, startRow=code_block, startCol=code_block, data=transpose, overWrite=code_block_4)
excel_done = Output(writeToFile)
dyfs = Output(watch_6)
packages = Output(watch_7)
