# Dynamo custom node Check For Type Parameter and Return Stats.dyf (Dynamo 0.9.1.4062)
# category: Bakery.Revit.Parameters
# will check for a given parameter against all available types in document

Type_Parameter_Name = Input()
list_of_model_elements = Custom[List of Model Elements simplified with Annotation removed]()  # also reports categories included and excluded. Only works on Workshared models...
type = Custom[Element.Type](element=list_of_model_elements.Element_List_without_Annotation)  # Gets the family type of a given element (if applicable).
uniqueItems = List.UniqueItems(type)
parameterExists = Custom[Element.ParameterExists](param=Type_Parameter_Name, element=uniqueItems)  # Checks if an element contains a parameter of a given name
watch = Watch(parameterExists)
anyTrue = Custom[List.AnyTrue](seq=watch)  # Returns true if any item in a list of booleans is true.
Parameter_in_Project = Output(anyTrue)  # "Parameter in Project?"
countFalse = CountFalse(watch)
Types_Without_this_Parameter_added = Output(countFalse)  # "Types Without this Parameter added?"
countTrue = CountTrue(watch)
Types_With_this_parameter_available = Output(countTrue)  # "Types With this parameter available?"
watch_2 = Watch(type)
getParameterValueByName = Element.GetParameterValueByName(element=uniqueItems, parameterName=Type_Parameter_Name)
string = StringInput("NULL")
replaceNull = Custom[List.ReplaceNull](seq=getParameterValueByName, replacement=string)  # Replaces all null values within a given list with a substitute
flat_list_to_list_of_strings = Custom[Flat List to List of Strings](Original_List=replaceNull)  # using python methods
string_2 = StringInput("")
create = List.Create(string_2)
removeItemsFromOtherList = Custom[List.RemoveItemsFromOtherList](List_A=flat_list_to_list_of_strings, List_B=create)  # This will take long list A, remove entries that appear in short list B, and give you list C. (JBE List Operations are probably more robust).
Show_Parameter_Data = Output(removeItemsFromOtherList)
count = List.Count(removeItemsFromOtherList)
Count_of_items_with_actual_values = Output(count)
filterByBoolMask = List.FilterByBoolMask(list=uniqueItems, mask=parameterExists)
List_of_Types_with_Parameter_Missing = Output(filterByBoolMask.out)
uniqueItems_2 = List.UniqueItems(removeItemsFromOtherList)
List_of_Unique_Values_used = Output(uniqueItems_2)
eq = flat_list_to_list_of_strings == string_2
watch_3 = Watch(eq)
filterByBoolMask_2 = List.FilterByBoolMask(list=uniqueItems, mask=watch_3)
family = FamilyType.Family(filterByBoolMask_2.in)
flat_list_to_list_of_strings_2 = Custom[Flat List to List of Strings](Original_List=family)
flat_list_to_list_of_strings_3 = Custom[Flat List to List of Strings](Original_List=filterByBoolMask_2.in)
create_2 = List.Create(flat_list_to_list_of_strings_2, flat_list_to_list_of_strings_3)
transpose = List.Transpose(create_2)
string_3 = StringInput("---")
mergeSublists = Custom[List.MergeSublists](List=transpose, Character=string_3)  # This will merge all sublists with or without a character between the strings.
List_of_Types_with_Data_Missing = Output(mergeSublists)
