# Dynamo custom node Check for Compliant 3D View.dyf (Dynamo 1.3.0.875)
# category: Bakery.Revit.Document.Utility

string = StringInput("Compliant3DView")
string_2 = StringInput("---AnyLocked3D---")
get_all_views = Custom[Get All Views]()  # This node will query all views in the model and return them based on category
isLocked = Custom[View3D.IsLocked](view3d=get_all_views.3D_Views)  # Checks if a given view is locked
watch = Watch(isLocked)
anyTrue = Custom[List.AnyTrue](seq=watch)  # Returns true if any item in a list of booleans is true.
string_3 = StringInput("---NoLocked3DAndWF---")
watch_2 = Watch(get_all_views.3D_Views)
filterByBoolMask = List.FilterByBoolMask(list=watch_2, mask=watch)
watch_3 = Watch(filterByBoolMask.in)
get_shading_mode_from_views = Custom[Get Shading Mode from Views](View_s=watch_3)  # using built in parameter name
watch_4 = Watch(get_shading_mode_from_views)
string_4 = StringInput("Wireframe")
equals = Equals(get_shading_mode_from_views, string_4)
filterByBoolMask_2 = List.FilterByBoolMask(list=watch_4, mask=equals)
isEmpty = List.IsEmpty(filterByBoolMask_2.in)
string_5 = StringInput("---ListLocked3DAndWF---")
filterByBoolMask_3 = List.FilterByBoolMask(list=watch_3, mask=equals)
string_6 = StringInput("---ListLocked3D---")
create = List.Create(string, string_2, anyTrue, string_3, isEmpty, string_5, filterByBoolMask_3.in, string_6, watch_3)
flatten = Flatten(create)
flatList = Output(flatten)
