# Dynamo custom node Check for SetParameter Nulls and Report Info on Elements.dyf (Dynamo 0.8.2.2392)
# category: Bakery.Office.Excel

ExcelfilePath = Input(ExcelfilePath : string)
sheetName = Input()
code_block = CodeBlock { 0; }
getElemsFromThisList = Input()
checkThisForNulls = Input()
code_block_2 = CodeBlock { null; }
bv_all_indices_of_that_can = Custom[bv All Indices Of that can handle Nulls](list=checkThisForNulls, value=code_block_2)  # forked from spring nodes
watch = Watch(bv_all_indices_of_that_can)
getItemAtIndex = List.GetItemAtIndex(list=getElemsFromThisList, index=watch)

# group: Failed for
watch_2 = Watch(getItemAtIndex)

flat_list_to_list_of_strings = Custom[Flat List to List of Strings](Original_List=watch_2)  # using python methods
code_block_3 = CodeBlock { true; }
writeToFile = Excel.WriteToFile(filePath=ExcelfilePath, sheetName=sheetName, startRow=code_block, startCol=code_block, data=flat_list_to_list_of_strings, overWrite=code_block_3)
count = Count(watch)
Any_Failure = Output(count)  # "Any Failure?"
bv_get_category_name = Custom[bv Get Category Name](Elements=watch_2)  # forked from Blackbox
uniqueItems = List.UniqueItems(bv_get_category_name)
Categories_that_failed = Output(uniqueItems)
