# Dynamo custom node Civil Data to Direct Shape Guide Curves.dyf (Dynamo 1.2.0.2690)
# category: Bakery.Construction.Civil

csvPath = Input(csvPath : var[]..[])
read_civil_csv_into_lists = Custom[Read Civil CSV Into Lists](csvPath=csvPath)

# group: Headings match data
count = Count(read_civil_csv_into_lists.mergedHeaders)
count_2 = Count(read_civil_csv_into_lists.dataRows)
code_block = CodeBlock(x=count, y=count_2) { x==y; }
watch = Watch(code_block)

code_block_2 = CodeBlock { 1; }
dropItems = List.DropItems(list=read_civil_csv_into_lists.mergedHeaders, amount=code_block_2)
code_block_3 = CodeBlock { 1; }

# group: Detect last Z value
code_block_4 = CodeBlock { "Z"; }
nullAllIndicesOf = Custom[Springs.NullAllIndicesOf](list=read_civil_csv_into_lists.mergedHeaders, value=code_block_4)  # list all of the indices of a list that match the specified value. Capable of handling null values, part of the SmartCopyMonitor workflow.
lastItem = List.LastItem(nullAllIndicesOf)

code_block_5 = CodeBlock(x=count, d=code_block_3, y=lastItem) { (x-d-y)*-1; }
dropItems_2 = List.DropItems(list=dropItems, amount=code_block_5)
dropItems_3 = List.DropItems(list=read_civil_csv_into_lists.dataRows, amount=code_block_3)

# group: Data Rows without Chainage
watch_2 = Watch(dropItems_3)

dropItems_4 = List.DropItems(list=watch_2, amount=code_block_5)

# group: Headings match data
count_3 = Count(dropItems_2)
count_4 = Count(dropItems_4)
code_block_6 = CodeBlock(x=count_3, y=count_4) { x==y; }
watch_3 = Watch(code_block_6)

code_block_7 = CodeBlock { 3; }
chop = List.Chop(list=dropItems_4, lengths=code_block_7)

# group: freeze point for main splines
watch_4 = Watch(chop)

convert_between_units = DynamoConvert(watch_4, conversionMetric=Length, conversionFrom=Meters, conversionTo=Millimeters)
sublists_of_coordinates_to = Custom[Sublists of Coordinates to Points](big_list=convert_between_units)

# group: freeze point for Guide Curves
watch_5 = Watch(sublists_of_coordinates_to)

zOffsetCanBeNegative = Input(zOffsetCanBeNegative : var[]..[])
precision = Input(precision : var[]..[])
point_sublists_to_directshape = Custom[Point Sublists to DirectShape Ruled Loft Vertical Guide Curves](pointSublists=watch_5, zOffsetCanBeNegative=zOffsetCanBeNegative, precision=precision)
DirectShape = Output(point_sublists_to_directshape)
allPoints = Output(sublists_of_coordinates_to)
