# Dynamo custom node Clean Link Name List.dyf (Dynamo 0.9.2.4472)
# category: Bakery.Revit.Document.Links

code_block = CodeBlock { "replacedNull"; }
name_list = Input()
bv_replace_nulls = Custom[bv Replace Nulls](replacement=code_block, seq=name_list)
flat_list_to_list_of_strings = Custom[Flat List to List of Strings](Original_List=bv_replace_nulls)  # using python methods
code_block_2 = CodeBlock { " : "; }
split = String.Split(flat_list_to_list_of_strings, code_block_2)
firstItem = List.FirstItem()
map = List.Map(list=split, f_x=firstItem)
cleaned_names_only = Output(map)
