# Dynamo custom node Clean SQL Output Filename.dyf (Dynamo 1.2.1.3083)
# category: Bakery.Data.Database

listOfSqls = Input()
watch = Watch(listOfSqls)
string = StringInput(".rvt_")
split = String.Split(arg1=string)  # unwired: arg0
map = List.Map(list=watch, f_x=split)
firstItem = List.FirstItem()  # unwired: arg0
map_2 = List.Map(list=map, f_x=firstItem)
string_2 = StringInput("")
string_3 = StringInput(".rvt")
join = String.Join(string_2, arg2=string_3)  # unwired: arg1
map_3 = List.Map(list=map_2, f_x=join)
rvtFileNamesWithRvt = Output(map_3)
lastItem = List.LastItem()  # unwired: arg0
map_4 = List.Map(list=map, f_x=lastItem)
code_block = CodeBlock { 4; }
remove_chars_from_end_of_single = Custom[Remove Chars from End of Single String](charsToRemove=code_block)  # use list.map for multiple; unwired: oneString
map_5 = List.Map(list=map_4, f_x=remove_chars_from_end_of_single)
crawlKeys = Output(map_5)
rvtFileNamesWithoutRvt = Output(map_2)
