# Dynamo custom node Collect All Tags in Project.dyf (Dynamo 0.8.2.2371)
# category: Bakery.Revit.Elements.Tag

get_categories_with_builtins = Custom[Get Categories with Builtins]()  # get category names and ids
watch = Watch(get_categories_with_builtins.Names)
code_block = CodeBlock { "Tags"; }
contains = String.Contains(str=watch, searchFor=code_block)
filterByBoolMask = List.FilterByBoolMask(list=get_categories_with_builtins.Builtin_Name, mask=contains)
watch_2 = Watch(filterByBoolMask.in)
select_based_on_a_single_builtin = Custom[Select based on a single builtin name]()  # use with List.Map for more than one
map = List.Map(list=watch_2, f_x=select_based_on_a_single_builtin)
flatten = Flatten(map)
listOfTagElements = Output(flatten)
