# Dynamo custom node Collect All View Crop Boxes in Document.dyf (Dynamo 0.8.2.2371)
# category: Bakery.Revit.Views

python_script = Python()
# ---------- python_script.python (32 lines) ----------
#LSJ

import clr
clr.AddReference('ProtoGeometry')
from Autodesk.DesignScript.Geometry import *

# Import DocumentManager
clr.AddReference("RevitServices")
import RevitServices
from RevitServices.Persistence import DocumentManager

# Import RevitAPI
clr.AddReference("RevitAPI")
import Autodesk

# Import ToDSType(bool) extension method
clr.AddReference("RevitNodes")
import Revit
from Autodesk.Revit.DB import *
clr.ImportExtensions(Revit.Elements)

import System

#The inputs to this node will be stored as a list in the IN variable.
#doc = DocumentManager.Instance.CurrentDBDocument
uiapp = DocumentManager.Instance.CurrentUIApplication
app = uiapp.Application
doc = DocumentManager.Instance.CurrentDBDocument

elements = FilteredElementCollector(doc).OfCategory(BuiltInCategory.OST_Viewers)

OUT = [z.ToDSType(True) for z in elements]
# ----------------------------------------
OST_Viewer_elements = Output(python_script)
element_name_universal = Custom[Element.Name (Universal)](element=python_script)  # Gets an element's name (Dynamo's built-in Name nodes don't work for all element types, e.g. worksets...)
names = Output(element_name_universal)
