# Dynamo custom node Collect Elements By Workset Name.dyf (Dynamo 1.2.1.3083)
# category: Bakery.Revit.Document.Worksets

get_worksets_with_all_properties = Custom[Get Worksets with all Properties]()  # based on Konrad's, added some more properties of Worksets
nameString = Input()
indexOf = IndexOf(get_worksets_with_all_properties.Names, nameString)
getItemAtIndex = List.GetItemAtIndex(list=get_worksets_with_all_properties.Ids, index=indexOf)
get_elements_by_workset_id = Custom[Get Elements By Workset Id](WORKSETID=getItemAtIndex)
elements = Output(get_elements_by_workset_id)
