# Dynamo custom node Collect Elements from List of Category Names.dyf (Dynamo 0.8.1.1942)
# category: Bakery.Revit.Selection

categoryNameList = Input()
convert_category_name_to_built = Custom[Convert Category Name to Built In Category Name]()  # You must use List.Map to convert list of Category Names to list of Built In Names
map = List.Map(list=categoryNameList, f_x=convert_category_name_to_built)
flatten = Flatten(map)
select_based_on_a_single_builtin = Custom[Select based on a single builtin name]()  # asdf
map_2 = List.Map(list=flatten, f_x=select_based_on_a_single_builtin)
flatten_2 = Flatten(map_2)
count = List.Count(flatten_2)
count_2 = Output(count)  # "count"
elements = Output(flatten_2)
