# Dynamo custom node Common Architectural Model Categories.dyf (Dynamo 1.1.0.2094)
# category: Bakery.Revit.Document.Category

string = StringInput("""Areas
Casework
Ceilings
Columns
Curtain Grids
Curtain Panels
Curtain Systems
Curtain Wall Mullions
Detail Items
Dimensions
Doors
Electrical Equipment
Elevations
Entourage
Filled region
Floors
Furniture
Generic Models
Grids
Guide Grid
Levels
Lighting Fixtures
Lines
Masking Region
Mass
Matchline
Materials
Parking
Parts
Plan Region
Planting
Plumbing Fixtures
Point Clouds
Project Information
Railings
Ramps
Raster Images
Reference Lines
Reference Planes
Revision Clouds
Roofs
Rooms
Schedule Graphics
Scope Boxes
Section Boxes
Section Line
Sections
Shaft Openings
Sheets
Site
Specialty Equipment
Stairs
Text Notes
Topography
Viewports
Walls
Windows""")
convert_string_with_line_breaks = Custom[Convert String with Line Breaks into List of Strings](string=string)
desiredNames = Output(convert_string_with_line_breaks)
get_categories = Custom[Get Categories]()  # Lists: Category Name, Category internal api definition, Clean Name (no spaces), Ids
bv_if_equal_return_index = Custom[bv If Equal Return Index](listA=convert_string_with_line_breaks, listB=get_categories.Names)  # forked
getItemAtIndex = List.GetItemAtIndex(list=get_categories.Names, index=bv_if_equal_return_index)
matchedNames = Output(getItemAtIndex)
getItemAtIndex_2 = List.GetItemAtIndex(list=get_categories.Categories, index=bv_if_equal_return_index)
categoryObjects = Output(getItemAtIndex_2)
