# Dynamo custom node Compare Contents of Two Directories.dyf (Dynamo 1.2.0.2690)
# category: Bakery.Standalone

dirOne = Input(dirOne : string)
contentsAll = Custom[Directory.ContentsAll](directoryPath=dirOne)  # Unlike the built-in node Directory.Contents, this node browses a directory recursively and returns all relevant files contained in subfolders as well.
fileName = FilePath.FileName(contentsAll)
dirTwo = Input(dirTwo : string)
contentsAll_2 = Custom[Directory.ContentsAll](directoryPath=dirTwo)
fileName_2 = FilePath.FileName(contentsAll_2)
compare_two_lists_by_item_and = Custom[Compare Two Lists by Item and Return Item Differences](listONE=fileName, listTWO=fileName_2)
in_dirTwo_but_not_in_dirOne = Output(compare_two_lists_by_item_and.inListTWObutNotInListOne)
in_dirOne_but_not_in_dirTwo = Output(compare_two_lists_by_item_and.inListONEbutNotInListTwo)
operations = Custom[List.Operations](List_A=fileName, List_B=fileName_2)  # List A-B / List Intersection / List symmetric difference
watch = Watch(operations.Intersection)
sort = List.Sort(watch)
in_both = Output(sort)
