# Dynamo custom node Compare Two Line Breaked Strings and Return Differences.dyf (Dynamo 0.8.2.2371)
# category: Bakery.Core.String

stringOne = Input()
convert_string_with_line_breaks = Custom[Convert String with Line Breaks into List of Strings](string=stringOne)
stringTwo = Input()
convert_string_with_line_breaks_2 = Custom[Convert String with Line Breaks into List of Strings](string=stringTwo)
compare_two_lists_by_item_and = Custom[Compare Two Lists by Item and Return Item Differences](listONE=convert_string_with_line_breaks, listTWO=convert_string_with_line_breaks_2)
inStringTWObutNotInListOne = Output(compare_two_lists_by_item_and.inListTWObutNotInListOne)
inStringONEbutNotInListTwo = Output(compare_two_lists_by_item_and.inListONEbutNotInListTwo)
