# Dynamo custom node Compare Two Lists by Item and Return Item Differences.dyf (Dynamo 0.8.2.2371)
# category: Bakery.Core.List

listONE = Input()

# group: ListOne
watch = Watch(listONE)

listTWO = Input()

# group: ListTwo
watch_2 = Watch(listTWO)

remove_list_from_list_by_item = Custom[Remove List from List by Item not Value](ListOfItemsToRemove=watch, ListToRemoveFrom=watch_2)  # remove the items in ListA from the items in ListB and return whats left

# group: Extras in List Two
watch_3 = Watch(remove_list_from_list_by_item.reducedList)

inListTWObutNotInListOne = Output(watch_3)
remove_list_from_list_by_item_2 = Custom[Remove List from List by Item not Value](ListOfItemsToRemove=watch_2, ListToRemoveFrom=watch)

# group: Extras in List One
watch_4 = Watch(remove_list_from_list_by_item_2.reducedList)

inListONEbutNotInListTwo = Output(watch_4)
count = Count(watch_4)
count_2 = Count(watch_3)
code_block = CodeBlock(x=count, y=count_2) { x+y; }
code_block_2 = CodeBlock { 1; }
lt = code_block < code_block_2
same = Output(lt)  # "same?"
