# Dynamo custom node Convert .NET Guid to IFC Guid.dyf (Dynamo 1.3.4.6666)
# category: Bakery.BIM.IFC

python_script = Python()  # unwired: IN[0]
# ---------- python_script.python (159 lines) ----------
import clr
clr.AddReference('ProtoGeometry')
from Autodesk.DesignScript.Geometry import *
#The inputs to this node will be stored as a list in the IN variables.
from System import *
from System.Diagnostics import *

class IfcGuid(object):
	""" <summary>
	 Conversion methods between an IFC 
	 encoded GUID string and a .NET GUID.
	 This is a translation of the C code 
	 found here: 
	 http://www.iai-tech.org/ifc/IFC2x3/TC1/html/index.htm
	 </summary>
	"""
	def __init__(self):
		""" <summary>
		 Conversion methods between an IFC 
		 encoded GUID string and a .NET GUID.
		 This is a translation of the C code 
		 found here: 
		 http://www.iai-tech.org/ifc/IFC2x3/TC1/html/index.htm
		 </summary>
		""" # <summary>
		# The replacement table
		# </summary>
		self._base64Chars = Array[Char](('0', '1', '2', '3', '4', '5', '6', '7', '8', '9', 'A', 'B', 'C', 'D', 'E', 'F', 'G', 'H', 'I', 'J', 'K', 'L', 'M', 'N', 'O', 'P', 'Q', 'R', 'S', 'T', 'U', 'V', 'W', 'X', 'Y', 'Z', 'a', 'b', 'c', 'd', 'e', 'f', 'g', 'h', 'i', 'j', 'k', 'l', 'm', 'n', 'o', 'p', 'q', 'r', 's', 't', 'u', 'v', 'w', 'x', 'y', 'z', '_', '$'))

	def cv_to_64(self, number, result, start, len):
		""" <summary>
		 Conversion of an integer into characters 
		 with base 64 using the table base64Chars
		 </summary>
		 <param name="number">The number to convert</param>
		 <param name="result">The result char array to write to</param>
		 <param name="start">The position in the char array to start writing</param>
		 <param name="len">The length to write</param>
		 <returns></returns>
		"""
		Debug.Assert(len <= 4)
		act = number
		nDigits = len
		iDigit = 0
		while iDigit < nDigits:
			result[start + len - iDigit - 1] = self._base64Chars[(act % 64)]
			act /= 64
			iDigit += 1
		Debug.Assert(act == 0, "Logic failed, act was not null: " + act.ToString())
		return 

	cv_to_64 = staticmethod(cv_to_64)

	def cv_from_64(self, str, start, len):
		""" <summary>
		 The reverse function to calculate 
		 the number from the characters
		 </summary>
		 <param name="str">The char array to convert from</param>
		 <param name="start">Position in array to start read</param>
		 <param name="len">The length to read</param>
		 <returns>The calculated nuber</returns>
		"""
		res = 0
		Debug.Assert(len <= 4)
		i = 0
		while i < len:
			index = -1
			j = 0
			while j < 64:
				if self._base64Chars[j] == str[start + i]:
					index = j
					break
				j += 1
			Debug.Assert(index >= 0)
			res = res * 64 + (index)
			i += 1
		return res

	cv_from_64 = staticmethod(cv_from_64)

	def FromIfcGUID(self, guid):
		""" <summary>
		 Reconstruction of the GUID 
		 from an IFC GUID string (base64)
		 </summary>
		 <param name="guid">The GUID string to convert. Must be 22 characters long</param>
		 <returns>GUID correspondig to the string</returns>
		"""
		Debug.Assert(len(guid) == 22, "Input string must not be longer that 22 chars")
		num = Array.CreateInstance(UInt32, 6)
		str = guid.ToCharArray()
		n = 2
		pos = 0
		i = 0
		while i < 6:
			num[i] = IfcGuid.cv_from_64(self, str, pos, n)
			pos += n
			n = 4
			i += 1
		a = ((num[0] * 16777216 + num[1]))
		b = (num[2] / 256)
		c = ((num[2] % 256) * 256 + num[3] / 65536)
		d = Array.CreateInstance(Byte, 8)
		d[0] = Convert.ToByte((num[3] / 256) % 256)
		d[1] = Convert.ToByte(num[3] % 256)
		d[2] = Convert.ToByte(num[4] / 65536)
		d[3] = Convert.ToByte((num[4] / 256) % 256)
		d[4] = Convert.ToByte(num[4] % 256)
		d[5] = Convert.ToByte(num[5] / 65536)
		d[6] = Convert.ToByte((num[5] / 256) % 256)
		d[7] = Convert.ToByte(num[5] % 256)
		return Guid(a, b, c, d)

	FromIfcGUID = staticmethod(FromIfcGUID)

	def ToIfcGuid(self, guid):
		""" <summary>
		 Conversion of a GUID to a string 
		 representing the GUID 
		 </summary>
		 <param name="guid">The GUID to convert</param>
		 <returns>IFC (base64) encoded GUID string</returns>
		"""
		num = Array.CreateInstance(UInt32, 6)
		str = Array.CreateInstance(Char, 22)
		b = guid.ToByteArray()
		# Creation of six 32 Bit integers from the components of the GUID structure
		num[0] = (BitConverter.ToUInt32(b, 0) / 16777216)
		num[1] = (BitConverter.ToUInt32(b, 0) % 16777216)
		num[2] = (BitConverter.ToUInt16(b, 4) * 256 + BitConverter.ToUInt16(b, 6) / 256)
		num[3] = ((BitConverter.ToUInt16(b, 6) % 256) * 65536 + b[8] * 256 + b[9])
		num[4] = (b[10] * 65536 + b[11] * 256 + b[12])
		num[5] = (b[13] * 65536 + b[14] * 256 + b[15])
		# Conversion of the numbers into a system using a base of 64
		n = 2
		pos = 0
		i = 0
		while i < 6:
			IfcGuid.cv_to_64(self, num[i], str, pos, n)
#			IfcGuid.cv_to_64(num[i], , pos, n)
			pos += n
			n = 4
			i += 1
		return String(str)

	ToIfcGuid = staticmethod(ToIfcGuid)

#converted code above
listIn = IN[0]
listed = []
for x in listIn:
	try:
		ifctemp = IfcGuid()
		listed.append(ifctemp.ToIfcGuid(ifctemp, x))
	except:
		listed.append("Conversion failure")
#Assign your output to the OUT variable.
OUT = listed
# ----------------------------------------
NET_Guids = Input()
turnIntoList = Custom[TurnIntoList](unknownItem=NET_Guids)  # Turns an element (or a nested list) into a flat list
python_script_2 = Python(IN[0]=turnIntoList)
# ---------- python_script_2.python (171 lines) ----------
#import clr
import clr
clr.AddReference('ProtoGeometry')
from Autodesk.DesignScript.Geometry import *
#The inputs to this node will be stored as a list in the IN variables.
from System import *
from System.Diagnostics import *
#from System import Array
from System.Guid import NewGuid, ToByteArray
#from System import Array, Byte
#bytes(Guid.NewGuid().ToByteArray())

class IfcGuid(object):
	""" <summary>
	 Conversion methods between an IFC 
	 encoded GUID string and a .NET GUID.
	 This is a translation of the C code 
	 found here: 
	 http://www.iai-tech.org/ifc/IFC2x3/TC1/html/index.htm
	 </summary>
	"""
	def __init__(self):
		""" <summary>
		 Conversion methods between an IFC 
		 encoded GUID string and a .NET GUID.
		 This is a translation of the C code 
		 found here: 
		 http://www.iai-tech.org/ifc/IFC2x3/TC1/html/index.htm
		 </summary>
		""" # <summary>
		# The replacement table
		# </summary>
		self._base64Chars = Array[Char](('0', '1', '2', '3', '4', '5', '6', '7', '8', '9', 'A', 'B', 'C', 'D', 'E', 'F', 'G', 'H', 'I', 'J', 'K', 'L', 'M', 'N', 'O', 'P', 'Q', 'R', 'S', 'T', 'U', 'V', 'W', 'X', 'Y', 'Z', 'a', 'b', 'c', 'd', 'e', 'f', 'g', 'h', 'i', 'j', 'k', 'l', 'm', 'n', 'o', 'p', 'q', 'r', 's', 't', 'u', 'v', 'w', 'x', 'y', 'z', '_', '$'))

	def cv_to_64(self, number, result, start, len):
		""" <summary>
		 Conversion of an integer into characters 
		 with base 64 using the table base64Chars
		 </summary>
		 <param name="number">The number to convert</param>
		 <param name="result">The result char array to write to</param>
		 <param name="start">The position in the char array to start writing</param>
		 <param name="len">The length to write</param>
		 <returns></returns>
		"""
		Debug.Assert(len <= 4)
		act = number
		nDigits = len
		iDigit = 0
		while iDigit < nDigits:
			result[start + len - iDigit - 1] = self._base64Chars[(act % 64)]
			act /= 64
			iDigit += 1
		Debug.Assert(act == 0, "Logic failed, act was not null: " + act.ToString())
		return 

	cv_to_64 = staticmethod(cv_to_64)

	def cv_from_64(self, str, start, len):
		""" <summary>
		 The reverse function to calculate 
		 the number from the characters
		 </summary>
		 <param name="str">The char array to convert from</param>
		 <param name="start">Position in array to start read</param>
		 <param name="len">The length to read</param>
		 <returns>The calculated nuber</returns>
		"""
		res = 0
		Debug.Assert(len <= 4)
		i = 0
		while i < len:
			index = -1
			j = 0
			while j < 64:
				if self._base64Chars[j] == str[start + i]:
					index = j
					break
				j += 1
			Debug.Assert(index >= 0)
			res = res * 64 + (index)
			i += 1
		return res

	cv_from_64 = staticmethod(cv_from_64)

	def FromIfcGUID(self, guid):
		""" <summary>
		 Reconstruction of the GUID 
		 from an IFC GUID string (base64)
		 </summary>
		 <param name="guid">The GUID string to convert. Must be 22 characters long</param>
		 <returns>GUID correspondig to the string</returns>
		"""
		Debug.Assert(len(guid) == 22, "Input string must not be longer that 22 chars")
		num = Array.CreateInstance(UInt32, 6)
		str = guid.ToCharArray()
		n = 2
		pos = 0
		i = 0
		while i < 6:
			num[i] = IfcGuid.cv_from_64(self, str, pos, n)
			pos += n
			n = 4
			i += 1
		a = ((num[0] * 16777216 + num[1]))
		b = (num[2] / 256)
		c = ((num[2] % 256) * 256 + num[3] / 65536)
		d = Array.CreateInstance(Byte, 8)
		d[0] = Convert.ToByte((num[3] / 256) % 256)
		d[1] = Convert.ToByte(num[3] % 256)
		d[2] = Convert.ToByte(num[4] / 65536)
		d[3] = Convert.ToByte((num[4] / 256) % 256)
		d[4] = Convert.ToByte(num[4] % 256)
		d[5] = Convert.ToByte(num[5] / 65536)
		d[6] = Convert.ToByte((num[5] / 256) % 256)
		d[7] = Convert.ToByte(num[5] % 256)
		return Guid(a, b, c, d)

	FromIfcGUID = staticmethod(FromIfcGUID)

	def ToIfcGuid(self, guid):
		""" <summary>
		 Conversion of a GUID to a string 
		 representing the GUID 
		 </summary>
		 <param name="guid">The GUID to convert</param>
		 <returns>IFC (base64) encoded GUID string</returns>
		"""
		num = Array.CreateInstance(UInt32, 6)
		str = Array.CreateInstance(Char, 22)
#		b = Array.CreateInstance(System.Byte, 2048)
#		b = Array.ToByteArray(guid)
#		b = string_to_bytearr()
		z = Guid(guid)
		b = ToByteArray(z)
#		b = bytearray(guid, 'utf8')		
#		def b(string):
#			return Array[Byte](ord(c) for c in string)
		# Creation of six 32 Bit integers from the components of the GUID structure
		num[0] = (BitConverter.ToUInt32(b, 0) / 16777216)
		num[1] = (BitConverter.ToUInt32(b, 0) % 16777216)
		num[2] = (BitConverter.ToUInt16(b, 4) * 256 + BitConverter.ToUInt16(b, 6) / 256)
		num[3] = ((BitConverter.ToUInt16(b, 6) % 256) * 65536 + b[8] * 256 + b[9])
		num[4] = (b[10] * 65536 + b[11] * 256 + b[12])
		num[5] = (b[13] * 65536 + b[14] * 256 + b[15])
		# Conversion of the numbers into a system using a base of 64
		n = 2
		pos = 0
		i = 0
		while i < 6:
			IfcGuid.cv_to_64(self, num[i], str, pos, n)
#			IfcGuid.cv_to_64(num[i], , pos, n)
			pos += n
			n = 4
			i += 1
		return String(str)

	ToIfcGuid = staticmethod(ToIfcGuid)

#converted code above
listIn = IN[0]
listed = []
for x in listIn:
	try:
		ifctemp = IfcGuid()
		listed.append(ifctemp.ToIfcGuid(ifctemp, x))
	except:
		listed.append("Conversion failure")
#Assign your output to the OUT variable.
OUT = listed
# ----------------------------------------
watch = Watch(python_script_2)
find_characters_in_square = Custom[Find Characters in Square Brackets and Merge to String](str=watch)
IFC_Guids = Output(find_characters_in_square)
log = Output(watch)
