# Dynamo custom node Convert Builtin Category Name to Normal Name.dyf (Dynamo 1.1.0.2094)
# category: Bakery.Revit.Document.Category

get_categories_with_builtins = Custom[Get Categories with Builtins]()  # Lists: Category Names, internal api definition, Built In Category Names, Ids
builtInNameStrings = Input()
turnIntoList = Custom[TurnIntoList](unknownItem=builtInNameStrings)  # Turns an element (or a nested list) into a flat list
bv_if_equal_return_index = Custom[bv If Equal Return Index](listA=turnIntoList, listB=get_categories_with_builtins.Builtin_Name_Strings)  # forked
getItemAtIndex = List.GetItemAtIndex(list=get_categories_with_builtins.Names, index=bv_if_equal_return_index)
categoryName = Output(getItemAtIndex)
