# Dynamo custom node Convert Category Name to Built In Category Name.dyf (Dynamo 0.9.2.4472)
# category: Bakery.Revit.Document.Category
# You must use List.Map to convert list of Category Names to list of Built In Names

get_categories_with_builtins = Custom[Get Categories with Builtins]()  # Lists: Category Names, internal api definition, Built In Category Names, Ids
categoryNameOrNames = Input()
turnIntoList = Custom[TurnIntoList](unknownItem=categoryNameOrNames)  # Turns an element (or a nested list) into a flat list
bv_if_equal_return_index = Custom[bv If Equal Return Index](listA=turnIntoList, listB=get_categories_with_builtins.Names)  # forked
getItemAtIndex = List.GetItemAtIndex(list=get_categories_with_builtins.Builtin_Name, index=bv_if_equal_return_index)
builtInName = Output(getItemAtIndex)
