# Dynamo custom node Convert List into List of Strings with Line Breaks.dyf (Dynamo 0.8.2.2371)
# category: Bakery.Strings

Original_List = Input(Original List : var[]..[])
flat_list_to_list_of_strings = Custom[Flat List to List of Strings](Original_List=Original_List)  # using python methods
string_from_array = FromArray(flat_list_to_list_of_strings)
string = StringInput(",")
string_2 = StringInput("\n")
replace = String.Replace(str=string_from_array, searchFor=string, replaceWith=string_2)
code_block = CodeBlock { 0; }
code_block_2 = CodeBlock { 1; }
remove = String.Remove(str=replace, startIndex=code_block, count=code_block_2)
length = String.Length(remove)
code_block_3 = CodeBlock(x=length) { x-1; }
code_block_4 = CodeBlock { 1; }
remove_2 = String.Remove(str=remove, startIndex=code_block_3, count=code_block_4)
str = Output(remove_2)
