# Dynamo custom node Copy Parameter to Parameter in List of Elements.dyf (Dynamo 0.8.2.2392)
# category: Bakery.Revit.Parameters
# has to have a Text parameter as the target

elementList = Input()
watch = Watch(elementList)
targetParameter = Input()
create = List.Create(targetParameter)
count = Count(watch)
cycle = List.Cycle(list=create, amount=count)
flatten = Flatten(cycle)
sourceParameter = Input()
bv_get_parameter_value_as_string = Custom[bv Get Parameter Value as String](Element_s=watch, Parameter_Name=sourceParameter)  # forked from Rhythm
flat_list_to_list_of_strings = Custom[Flat List to List of Strings](Original_List=bv_get_parameter_value_as_string)  # using python methods
setParameterByName = Element.SetParameterByName(element=watch, parameterName=flatten, value=flat_list_to_list_of_strings)
feedback = Output(setParameterByName)
