# Dynamo custom node Copy Property to Parameter for List of Elements.dyf (Dynamo 0.8.0.950)
# category: Bakery.Revit.Parameters
# Uses bruteforce get parameter which works for Worksets etc

listOfElements = Input()
create = List.Create(listOfElements)
flatten = Flatten(create)
targetParameterAsString = Input()
turn_into_list = Custom[Turn Into List](item=targetParameterAsString)  # Turns an element into a (flat) list
count = List.Count(flatten)
cycle = List.Cycle(list=turn_into_list, amount=count)
flat_list_to_list_of_strings = Custom[Flat List to List of Strings](Original_List=cycle)  # using python methods
sourcePropertyAsString = Input()
string = StringInput("empty")
bruteforce_get_parameter_value = Custom[Bruteforce Get Parameter Value by Name](element_or_elements=flatten, parameterName=sourcePropertyAsString, replaceEmptyValueWith=string)  # If Element.Parameters shows a value, this node will search for it and return the value or an optional empty value replacement.
flatten_2 = Flatten(bruteforce_get_parameter_value.BruteForceValues)
flat_list_to_list_of_strings_2 = Custom[Flat List to List of Strings](Original_List=flatten_2)
setParameterByName = Element.SetParameterByName(element=flatten, parameterName=flat_list_to_list_of_strings, value=flat_list_to_list_of_strings_2)
