# Dynamo custom node Copy Workset Name to Target Parameter.dyf (Dynamo 0.8.2.2371)
# category: Bakery.Revit.Parameters
# uses archi-lab

elementList = Input()
watch = Watch(elementList)
targetParameter = Input()
workset = Custom[Element.Workset](element=watch)  # Retrieves the workset of a given element
element_name_universal = Custom[Element Name Universal](Element_s=workset)  # Modified for 0.8.1
flat_list_to_list_of_strings = Custom[Flat List to List of Strings](Original_List=element_name_universal)  # using python methods
set_list_of_values_to_list_of = Custom[Set List of Values to List of Elements for One Parameter](elementList=watch, parameterNameAsString=targetParameter, valuesToSet=flat_list_to_list_of_strings)  # as described
elementsOut = Output(set_list_of_values_to_list_of)
