# Dynamo custom node Copy to Level and Delete.dyf (Dynamo 1.2.0.2831)
# category: Bakery.Revit.Elements
# combined Clockwork and SteamNodes code

element = Input()
turnIntoList = Custom[TurnIntoList](unknownItem=element)  # Turns an element (or a nested list) into a flat list
firstItem = List.FirstItem(turnIntoList)
level = Custom[Element.Level](element=firstItem)  # Gets an element's level
views = Custom[Level.Views](level=level)  # Returns all views associated with a given level
level_2 = Input(level : Level)
views_2 = Custom[Level.Views](level=level_2)
python_script = Python(IN[0]=turnIntoList, IN[1]=views.firstView, IN[2]=views_2.firstView)
# ---------- python_script.python (35 lines) ----------
import clr
from System.Collections.Generic import *
clr.AddReference('RevitAPI')
from Autodesk.Revit.DB import *
import Autodesk

clr.AddReference("RevitNodes")
import Revit
clr.ImportExtensions(Revit.Elements)

clr.AddReference("RevitServices")
import RevitServices
from RevitServices.Persistence import DocumentManager
from RevitServices.Transactions import TransactionManager

doc = DocumentManager.Instance.CurrentDBDocument
wrapped = IN[0]
items = UnwrapElement(wrapped)
source_view = UnwrapElement(IN[1])
target_view = UnwrapElement(IN[2])

ids = list()
for item in items:
	ids.append(item.Id)	
itemlist = List[ElementId](ids)

TransactionManager.Instance.EnsureInTransaction(doc)
newitems = ElementTransformUtils.CopyElements(source_view,itemlist,target_view, None, None)
TransactionManager.Instance.TransactionTaskDone()

elementlist = list()
for item in newitems:
	elementlist.append(doc.GetElement(item).ToDSType(False))

OUT = elementlist, wrapped
# ----------------------------------------
code_block = CodeBlock { 0; }
getItemAtIndex = List.GetItemAtIndex(list=python_script, index=code_block)
newElements = Output(getItemAtIndex)
code_block_2 = CodeBlock { 1; }
getItemAtIndex_2 = List.GetItemAtIndex(list=python_script, index=code_block_2)
eraser = Custom[Tool.Eraser](Element_s=getItemAtIndex_2)  # Try to delete any element from project
cantDelete = Output(eraser)
