# Dynamo custom node Create Floors From Rooms v2.dyf (Dynamo 0.8.2.2371)
# category: Bakery.Revit.Elements.Room

roomList = Input()
watch = Watch(roomList)

# group: Boundary Curves Try
get_boundary_curves_from_room = Custom[Get Boundary Curves from Room List](rooms=watch)
watch_2 = Watch(get_boundary_curves_from_room.boundaryCurves)
curvesUsed = Output(watch_2)

# group: Get Levels from Curves
polycurve_to_nearest_revit_level = Custom[Polycurve to Nearest Revit Level by Elevation](polycurves=watch_2)
levelsUsed = Output(polycurve_to_nearest_revit_level)

# group: Try Making Floors
floorType = Input(floorType : FloorType)
byOutlineTypeAndLevel = Floor.ByOutlineTypeAndLevel(outlineCurves=watch_2, floorType=floorType, level=polycurve_to_nearest_revit_level)
floorsMade = Output(byOutlineTypeAndLevel)

failed_to_find_boundary = Output(get_boundary_curves_from_room.failed)

# group: ROOM LIST - curve failures removed
removeItemAtIndex = List.RemoveItemAtIndex(list=watch, indices=get_boundary_curves_from_room.failureIndices)

# group: Get floor creation failures
get_indices_of_null_values = Custom[Get Indices of Null Values](list=byOutlineTypeAndLevel)  # needs to be hidden
getItemAtIndex = List.GetItemAtIndex(list=removeItemAtIndex, index=get_indices_of_null_values)

# group: ROOM get parameters
removeItemAtIndex_2 = List.RemoveItemAtIndex(list=removeItemAtIndex, indices=get_indices_of_null_values)
code_block = CodeBlock { "Number"; }
getParameterValueByName = Element.GetParameterValueByName(element=removeItemAtIndex_2, parameterName=code_block)
parameterFromRoomElement = Output(getParameterValueByName)

# group: FLOOR set parameters
code_block_2 = CodeBlock { "Comments"; }
set_list_of_values_to_list_of = Custom[Set List of Values to List of Elements for One Parameter](elementList=byOutlineTypeAndLevel, parameterNameAsString=code_block_2, valuesToSet=getParameterValueByName)  # as described
parametersSet = Output(set_list_of_values_to_list_of)

# group: FAILURE ROOMS -passed on
create = List.Create(get_boundary_curves_from_room.failed, getItemAtIndex)
flatten = Flatten(create)
rooms_passed_to_geometry_method = Output(flatten)

# group: v1 info
create_floors_from_rooms_v1 = Custom[Create Floors From Rooms v1](roomList=flatten, floorTypeToUse=floorType, writeInfoToThisInstanceParameter=code_block_2)  # this version uses only the outermost boundary, does not detect cutout or openings (yet)
v1_still_failed = Output(create_floors_from_rooms_v1.all_failures)
v1_succeeded_with_geometry_method = Output(create_floors_from_rooms_v1.floors_made)
v1_floors_made = Output(create_floors_from_rooms_v1.floorsMadeCount)
v1_parameters_used = Output(create_floors_from_rooms_v1.roomParametersCount)

# group: FLOORS made clean list
removeItemAtIndex_3 = List.RemoveItemAtIndex(list=byOutlineTypeAndLevel, indices=get_indices_of_null_values)
floorsMadeNoNulls = Output(removeItemAtIndex_3)
