# Dynamo custom node Create Floors from Rooms v5.dyf (Dynamo 0.8.2.2371)
# category: Bakery.Revit.Elements.Room

roomList = Input(roomList : var[]..[])
rooms_to_closed_polycurves = Custom[Rooms to Closed Polycurves without Nulls](roomList=roomList)
watch = Watch(rooms_to_closed_polycurves.cleaned_Room_List)
floorType = Input(floorType : FloorType)
level = Input(level : Level)
byOutlineTypeAndLevel = Floor.ByOutlineTypeAndLevel(outlineCurves=rooms_to_closed_polycurves.closed_Polycurves, floorType=floorType, level=level)
watch_2 = Watch(byOutlineTypeAndLevel)
watch_3 = Watch(rooms_to_closed_polycurves.room_Numbers)

# group: clean and set param
code_block = CodeBlock { null; }
bv_all_indices_of_that_can = Custom[bv All Indices Of that can handle Nulls](list=watch_2, value=code_block)  # forked from spring nodes
removeItemAtIndex = List.RemoveItemAtIndex(list=watch_2, indices=bv_all_indices_of_that_can)
string = StringInput("Comments")
removeItemAtIndex_2 = List.RemoveItemAtIndex(list=watch_3, indices=bv_all_indices_of_that_can)
set_list_of_values_to_list_of = Custom[Set List of Values to List of Elements for One Parameter](elementList=removeItemAtIndex, parameterNameAsString=string, valuesToSet=removeItemAtIndex_2)  # as described

floors_made = Output(set_list_of_values_to_list_of)
