# Dynamo custom node Create GUID Filename Key for Linked Element.dyf (Dynamo 1.2.1.3083)
# category: Bakery.Data.Database

string = StringInput("---")
linkedElement = Input()
watch = Watch(linkedElement)
element_ids = Custom[Element Ids](Element_s=watch)  # This node will query an element id that can be used with Revit nodes. Dynamo Element Id node returns integer value.
firstItem = List.FirstItem(element_ids.GUID_s)
element_document_parent_link = Custom[Element.Document Parent Link](Element=watch)
join = String.Join(string, firstItem, element_document_parent_link)
LinkCode = Output(join)
