# Dynamo custom node Create Navisworks Search Set XML for Element Ids.dyf (Dynamo 0.9.1.4062)
# category: Bakery.Construction.Navisworks

OutputFilePathForXml = Input()
elementIdList = Input(elementIdList : var[]..[])
build_nw_search_string_v1 = Custom[Build NW Search String v1]()
map = List.Map(list=elementIdList, f_x=build_nw_search_string_v1)
create = List.Create(map)

# group: header and footer
code_block = CodeBlock { ""; }
string = StringInput("""<?xml version="1.0" encoding="UTF-8" ?>

<exchange xmlns:xsi="http://www.w3.org/2001/XMLSchema-instance" xsi:noNamespaceSchemaLocation="http://download.autodesk.com/us/navisworks/schemas/nw-exchange-12.0.xsd">
  <selectionsets>
    <viewfolder name="Revit Element Id Search" guid="2e23618a-ac82-4cfd-84b2-b72e4e5deb16">
      <selectionset name="Multiple Element Ids" guid="7d9883e2-5286-40f6-8186-817edb6870c8">
        <findspec mode="all" disjoint="0">
          <conditions>""")
code_block_2 = CodeBlock { ""; }
bv_merge_sublists_with_a = Custom[bv Merge Sublists with a separator](List=create, Character=code_block_2)  # forked from Rhythm
firstItem = List.FirstItem(bv_merge_sublists_with_a)
string_2 = StringInput("""          </conditions>
          <locator>/</locator>
        </findspec>
      </selectionset>
    </viewfolder>
  </selectionsets>
</exchange>""")
join = String.Join(code_block, string, firstItem, string_2)

writeToFile = CSV.WriteToFile(OutputFilePathForXml, join)
done = Output(join)
