# Dynamo custom node Create NurbsCurves from Sublists of Points.dyf (Dynamo 1.2.0.2831)
# category: Bakery.Geometry

pointSublists = Input()
watch = Watch(pointSublists)

# group: Generate curves in Dynamo
count = Count(watch)
code_block = CodeBlock(x=count) { 0..(x-1); }
get_sublist_and_make_curve = Custom[Get Sublist and Make Curve](list=watch)  # unwired: index
map = List.Map(list=code_block, f_x=get_sublist_and_make_curve.NurbsCurve)
map_2 = List.Map(list=code_block, f_x=get_sublist_and_make_curve.item)

inputSublistCount = Output(count)
AllOutputCurves = Output(map)
dataMissingBool = Output(map_2)
code_block_2 = CodeBlock { null; }
nullAllIndicesOf = Custom[Springs.NullAllIndicesOf](list=map, value=code_block_2)  # list all of the indices of a list that match the specified value. Capable of handling null values, part of the SmartCopyMonitor workflow.
failureIndices = Output(nullAllIndicesOf)
removeItemAtIndex = List.RemoveItemAtIndex(list=map, indices=nullAllIndicesOf)
validOutputCurvesOnly = Output(removeItemAtIndex)
