# Dynamo custom node Create Parts for Linked Elements.dyf (Dynamo 1.0.0.1180)
# category: Bakery.Revit.Elements.Parts
# currently does not handle multiple instances of Link

linkedElementList = Input()
watch = Watch(linkedElementList)
linkDocumentList_sameLength = Input()
watch_2 = Watch(linkDocumentList_sameLength)
get_linked_rvt_documents = Custom[Get Linked RVT Documents]()
if_equal_return_index_using = Custom[If Equal Return Index using IndexOf](searchForThese=linkDocumentList_sameLength, inThisList=get_linked_rvt_documents.Link_Doc)
getItemAtIndex = List.GetItemAtIndex(list=get_linked_rvt_documents.Link_Instance_Id, index=if_equal_return_index_using)
watch_3 = Watch(getItemAtIndex)
count = Count(watch)
code_block = CodeBlock(x=count) { 0..x-1; }
python_script = Python(IN[0]=watch, IN[1]=watch_2, IN[2]=watch_3, IN[3]=code_block)
# ---------- python_script.python (45 lines) ----------
import clr
clr.AddReference('ProtoGeometry')
from Autodesk.DesignScript.Geometry import *
# Import ToDSType(bool) extension method
clr.AddReference("RevitNodes")
import Revit
clr.ImportExtensions(Revit.Elements)
# Import geometry conversion extension methods
clr.ImportExtensions(Revit.GeometryConversion)
# Import DocumentManager and TransactionManager
clr.AddReference("RevitServices")
import RevitServices
from RevitServices.Persistence import DocumentManager
from RevitServices.Transactions import TransactionManager
from System.Collections.Generic import *
# Import RevitAPI
clr.AddReference("RevitAPI")
import Autodesk
from Autodesk.Revit.DB import *

doc = DocumentManager.Instance.CurrentDBDocument
uiapp = DocumentManager.Instance.CurrentUIApplication
app = uiapp.Application
elemlist = UnwrapElement(IN[0])
docs = UnwrapElement(IN[1])
instId = IN[2]
counter = IN[3]
result = []
for z in counter:
	y = LinkElementId(instId[z], elemlist[z].Id)
	Ids = []
	Ids.append(y)
	IDS = List[Autodesk.Revit.DB.LinkElementId](Ids)
	TransactionManager.Instance.EnsureInTransaction(doc)
#created = []
	try:
		a=PartUtils.CreateParts(doc,IDS)
		result.append(True)
	except:
		result.append(False)

	TransactionManager.Instance.TransactionTaskDone()
#TransactionManager.Instance.ForceCloseTransaction()

OUT = result
# ----------------------------------------
Parts_created = Output(python_script)  # "Parts created?"
