# Dynamo custom node Create View Filter.dyf (Dynamo 1.1.0.2094)
# category: Bakery.Revit.Views
# uses Contains rule

categories = Input()
turnIntoList = Custom[TurnIntoList](unknownItem=categories)  # Turns an element (or a nested list) into a flat list
builtInParameterName = Input()
equalsValue = Input()
newFilterName = Input()
python_script = Python(IN[0]=turnIntoList, IN[1]=builtInParameterName, IN[2]=equalsValue, IN[3]=newFilterName)
# ---------- python_script.python (58 lines) ----------
#from the forum originally
import clr

clr.AddReference("RevitServices")
import RevitServices
from RevitServices.Persistence import DocumentManager
from RevitServices.Transactions import TransactionManager

doc = DocumentManager.Instance.CurrentDBDocument

clr.AddReference("RevitAPI")
import Autodesk
from Autodesk.Revit.DB import *
import System
from System.Collections.Generic import *

dataEnteringNode = IN

def GetBuiltInParam(paramName):
	builtInParams = System.Enum.GetValues(BuiltInParameter)
	test = []
	for i in builtInParams:
		if i.ToString() == paramName:
			test.append(i)
			break
		else:
			continue
	return test [0]

cats = IN[0]
paramName = IN[1]
pValue = IN[2]
filName = IN[3]
#clearRules = IN[4]
#view = UnwrapElement(IN[4])

TransactionManager.Instance.EnsureInTransaction(doc)

catList = []
for i in cats:
	catList.append(ElementId(i.Id))

typedCatList = List[ElementId](catList)

bip = GetBuiltInParam(paramName)

rules = []

rules.append(ParameterFilterRuleFactory.CreateContainsRule(ElementId(bip), pValue, 0.001))

try:
	filter = ParameterFilterElement.Create(doc, filName, typedCatList, rules)
except:
	filter = "Sorry, failed. Please check that you have a unique filter name."

TransactionManager.Instance.TransactionTaskDone()

OUT = filter
# ----------------------------------------
parameterFilterElement = Output(python_script)
