# Dynamo custom node Create Worksets for Revit Link Filenames.dyf (Dynamo 1.2.1.3083)
# category: Bakery.Revit.Document.Worksets

bv_document_worksets = Custom[bv Document Worksets]()  # clockwork node without the toggle
element_name_universal = Custom[Element Name Universal](Elements=bv_document_worksets)  # Modified for 0.8.1
get_linked_rvt_documents = Custom[Get Linked RVT Documents]()
clean_link_name_list = Custom[Clean Link Name List](name_list=get_linked_rvt_documents.Link_Name)
watch = Watch(clean_link_name_list)
remove_list_from_list_by_item = Custom[Remove List from List by Item not Value](ListOfItemsToRemove=element_name_universal, ListToRemoveFrom=watch)  # remove the items in ListA from the items in ListB and return whats left
string = StringInput("")
PrefixIfDesired = Input(PrefixIfDesired : string = "")
join = String.Join(string, PrefixIfDesired)  # unwired: arg2
map = List.Map(list=remove_list_from_list_by_item.reducedList, f_x=join)
uniqueItems = List.UniqueItems(map)
create = Custom[Workset.Create](worksetNames=uniqueItems)  # Creates a workset or worksets from input names.
turnIntoList = Custom[TurnIntoList](unknownItem=create)  # Turns an element (or a nested list) into a flat list
any_null_in_list = Custom[Any Null in List](list=turnIntoList)  # returns boolean true if a null is found
string_2 = StringInput("Are worksets enabled?")
turnIntoList_2 = Custom[TurnIntoList](unknownItem=string_2)
switch = Custom[Switch](boolean_switch=any_null_in_list, data=turnIntoList_2)
watch_2 = Watch(create)
isEmpty = List.IsEmpty(watch_2)
string_3 = StringInput("No RVT links in model....")
turnIntoList_3 = Custom[TurnIntoList](unknownItem=string_3)
switch_2 = Custom[Switch](boolean_switch=isEmpty, data=turnIntoList_3)
create_2 = List.Create(switch, create, switch_2)
bv_remove_nulls = Custom[bv Remove Nulls](List=create_2)  # forked from Lunchbox
uniqueItems_2 = List.UniqueItems(bv_remove_nulls)
flatten = Flatten(uniqueItems_2)
worksetsCreated = Output(flatten)
watch_3 = Watch(switch)
watch_4 = Watch(any_null_in_list)
watch_5 = Watch(switch_2)
watch_6 = Watch(isEmpty)
