# Dynamo custom node Created 3D Cropped View for List.Map.dyf (Dynamo 1.3.0.875)
# category: Bakery.Dynamo.ForkedNodes
# originally from steamnodes

# group: need to refactor for single operation?
element = Input()
boundingBox = Element.BoundingBox(element)
minPoint = BoundingBox.MinPoint(boundingBox)
code_block = CodeBlock { 50; }
code_block_2 = CodeBlock(a=code_block) { -a; }
byCoordinates = Vector.ByCoordinates(x=code_block_2, y=code_block_2, z=code_block_2)
add = Point.Add(point=minPoint, vectorToAdd=byCoordinates)
maxPoint = BoundingBox.MaxPoint(boundingBox)
byCoordinates_2 = Vector.ByCoordinates(x=code_block, y=code_block, z=code_block)
add_2 = Point.Add(point=maxPoint, vectorToAdd=byCoordinates_2)
python_script = Python(IN[0]=add, IN[1]=add_2)
# ---------- python_script.python (59 lines) ----------
#python nodes in dynamo 1.0
#proposed by Julien Benoit @jbenoit44 
#http://aecuandme.wordpress.com/
import clr
clr.AddReference('ProtoGeometry')
from Autodesk.DesignScript.Geometry import *
# Import ToDSType(bool) extension method
clr.AddReference("RevitNodes")
import Revit
clr.ImportExtensions(Revit.Elements)
# Import geometry conversion extension methods
clr.ImportExtensions(Revit.GeometryConversion)
# Import DocumentManager and TransactionManager
clr.AddReference("RevitServices")
import RevitServices
from RevitServices.Persistence import DocumentManager
from RevitServices.Transactions import TransactionManager
from System.Collections.Generic import *
# Import RevitAPI
clr.AddReference("RevitAPI")
import Autodesk
from Autodesk.Revit.DB import *

doc = DocumentManager.Instance.CurrentDBDocument
uiapp = DocumentManager.Instance.CurrentUIApplication
app = uiapp.Application
uidoc=DocumentManager.Instance.CurrentUIApplication.ActiveUIDocument

Min=[]
Max=[]
viewlist=[]
bbox=[]
for i in IN[0]:
	Min.append(UnwrapElement(i.ToXyz(True)))
for i in IN[1]:
	Max.append(UnwrapElement(i.ToXyz(True)))



# Start Transaction
TransactionManager.Instance.EnsureInTransaction(doc)
activeview=doc.ActiveView
typeid=View.GetTypeId(activeview)

count = 0
while (count < len(Min)):
	b=View3D.CreateIsometric(doc, typeid)
	viewlist.append(b)
	box = app.Create.NewBoundingBoxXYZ()
	box.Min = Min[count]
	box.Max = Max[count]
	bbox.append(box)
	a=View3D.SetSectionBox(b,box)
	count = count + 1
	

# End Transaction
TransactionManager.Instance.TransactionTaskDone()
OUT=viewlist
# ----------------------------------------
Views = Output(python_script)  # "Views_"
