# Dynamo custom node Cycle Entries of one List by List of Lengths.dyf (Dynamo 0.8.2.2371)
# category: Bakery.Core.List

listToCycle = Input()
code_block = CodeBlock { 1; }
chop = List.Chop(listToCycle, code_block)
listOfLengths = Input()
cycle = List.Cycle(list=chop, amount=listOfLengths, lacing=Longest)
listWithLengths = Output(cycle)
