# Dynamo custom node Cycle One Item Into List to Match Length of Other List.dyf (Dynamo 0.8.2.2371)
# category: Bakery.Core.List

OneItemToCycle = Input()
turn_into_list = Custom[Turn Into List](item=OneItemToCycle)  # Turns an element into a list
ListToMatchLength = Input()
count = Count(ListToMatchLength)
cycle = List.Cycle(list=turn_into_list, amount=count)
ListMatchedLength = Output(cycle)
