# Dynamo custom node Dimension to Detail Line Endpoints.dyf (Dynamo 1.3.2.2480)
# category: Bakery.Revit.Elements.Dimension

detailLines = Input()
watch = Watch(detailLines)
curves = Element.Curves(watch)
offsetDist = Input(offsetDist : double)

# group: from Wombat
smartOffset = WombatDynamo.Curve.SmartOffset(curves, offsetDist)

flatten = Flatten(smartOffset)
python_script = Python(IN[0]=watch, IN[1]=flatten)
# ---------- python_script.python (53 lines) ----------
import clr
clr.AddReference('RevitAPI')
from Autodesk.Revit.DB import *

clr.AddReference("RevitNodes")
import Revit
clr.ImportExtensions(Revit.Elements)
clr.ImportExtensions(Revit.GeometryConversion)

clr.AddReference("RevitServices")
import RevitServices
from RevitServices.Persistence import DocumentManager
from RevitServices.Transactions import TransactionManager

doc = DocumentManager.Instance.CurrentDBDocument

if isinstance(IN[0], list):
	lines = []
	for i in IN[0]:
		lines.append(UnwrapElement(i))
else:
	lines = [UnwrapElement(IN[0])]

#get the curves to dimension
crvs = []

for line in lines:
	crvs.append(line.GeometryCurve)


if isinstance(IN[1], list):
	linea = []
	for i in IN[1]:
		linea.append(UnwrapElement(i).ToRevitType())
else:
	linea = [UnwrapElement(IN[1]).ToRevitType()]


TransactionManager.Instance.EnsureInTransaction(doc)


for i in range (0,len(linea)):
	ref = ReferenceArray()
	#get the end points of the lines
	ref.Append(crvs[i].GetEndPointReference(0))
	ref.Append(crvs[i].GetEndPointReference(1))
	dim = doc.Create.NewDimension(doc.ActiveView, linea[i], ref)



TransactionManager.Instance.TransactionTaskDone()

OUT = linea
# ----------------------------------------
OUT = Output(python_script)
