# Dynamo custom node Document Design Options.dyf (Dynamo 0.8.2.2371)
# category: Bakery.Revit.Document
# taken originally from Clockwork

python_script = Python()
# ---------- python_script.python (13 lines) ----------
import clr
clr.AddReference('RevitAPI')
from Autodesk.Revit.DB import *
import Autodesk

clr.AddReference("RevitServices")
import RevitServices
from RevitServices.Persistence import DocumentManager

doc = DocumentManager.Instance.CurrentDBDocument
collector = FilteredElementCollector(doc)
desopts = collector.OfClass(DesignOption).ToElements()
OUT = desopts
# ----------------------------------------
document_design_option_sets = Custom[Document Design Option Sets](DesignOption_s=python_script)  # taken originally from Clockwork
watch = Watch(document_design_option_sets)
isEmpty = List.IsEmpty(watch)
if_ = If(test=isEmpty, true=watch, false=watch)
create = List.Create(python_script, if_)
code_block = CodeBlock { 1; }
groupListOfListsByKey = Custom[List.GroupListOfListsByKey](list=create, key_index=code_block)  # Groups a list of lists by one of its keys
transpose = List.Transpose(groupListOfListsByKey)
code_block_2 = CodeBlock(seq=transpose) { seq[1]; }
flatten = Flatten(code_block_2)
uniqueItems = List.UniqueItems(flatten)
DesignOptionSets = Output(uniqueItems)
firstItem = List.FirstItem(transpose)
DesignOptions = Output(firstItem)
