# Dynamo custom node Does this Document Contain Category.dyf (Dynamo 1.2.0.2690)
# category: Bakery.Revit.Document.Category
# This iterates all BuiltInNames searching for elements on those categories. output CategoryList shows categories in this document.

builtInNames = Input()
select_based_on_a_single_builtin = Custom[Select based on a single builtin name]()  # asdf; unwired: builtinName
map = List.Map(list=builtInNames, f_x=select_based_on_a_single_builtin)
firstItem = List.FirstItem()  # unwired: arg0
map_2 = List.Map(list=map, f_x=firstItem)
firstItem_2 = List.FirstItem()  # unwired: arg0
map_3 = List.Map(list=map_2, f_x=firstItem_2)
flatten = Flatten(map_3)
sampleSet = Output(flatten)
code_block = CodeBlock { false; }
clean = List.Clean(list=map_3, preserveIndices=code_block)
category = Custom[Element.Category]()  # This node will get the input element(s)' categories; unwired: element
map_4 = List.Map(list=clean, f_x=category)
flatten_2 = Flatten(map_4)
uniqueItems = List.UniqueItems(flatten_2)
code_block_2 = CodeBlock { "None"; }
create = List.Create(code_block_2)
removeItemsFromOtherList = Custom[List.RemoveItemsFromOtherList](List_A=uniqueItems, List_B=create)  # This will take long list A, remove entries that appear in short list B, and give you list C. (JBE List Operations are probably more robust).
sort = List.Sort(removeItemsFromOtherList)
CategoryList = Output(sort)
