# Dynamo custom node Duplicate View and Isolate Elements.dyf (Dynamo 0.8.2.2392)
# category: Bakery.Elements

elementsIn = Input()
watch = Watch(elementsIn)
bv_elements_to_ids = Custom[bv Elements to IDs](Element_s=watch)  # forked from CAAD_RWTH
current_document = Custom[Current Document]()  # Retrieves Current Document
id_to_element = Custom[Id to Element](Id_s=bv_elements_to_ids.ID_s, Doc=current_document)  # Selects elements in a model from id input (ElementId, string, integer or GUID)
red = Custom[Color.Red]()  # Returns the colour red.
overrideColorInView = Element.OverrideColorInView(element=id_to_element, color=red)
sourceViewIn = Input()
duplicate = Custom[View.Duplicate](View_s=sourceViewIn)  # Duplicates a given view
isolate_in_view = Custom[Isolate in View](Elements=overrideColorInView, View=duplicate)  # This node will take input of elements and a view to isolate selected elements in a view.
done = Output(isolate_in_view)
watch_2 = Watch(id_to_element)
ViewOut = Output(duplicate)
