# Dynamo custom node Duplicate View and Rename and Isolate for System Types.dyf (Dynamo 0.8.1.1942)
# category: Bakery.Revit.Elements

elementsIn = Input()
watch = Watch(elementsIn)
sourceView = Input()
duplicate_view_and_isolate = Custom[Duplicate View and Isolate Elements](elementsIn=watch, sourceViewIn=sourceView)
code_block = CodeBlock { "View Name"; }
firstItem = List.FirstItem(watch)
code_block_2 = CodeBlock { "System Type"; }
getParameterValueByName = Element.GetParameterValueByName(element=firstItem, parameterName=code_block_2)
systemParam = Input()
getParameterValueByName_2 = Element.GetParameterValueByName(element=getParameterValueByName, parameterName=systemParam)
code_block_3 = CodeBlock { ""; }
eq = getParameterValueByName_2 == code_block_3
code_block_4 = CodeBlock { "empty"; }
boolean_input_to_variable_string = Custom[Boolean Input to Variable String Output](Boolean_In=eq, String_if_True=code_block_4, String_if_False=getParameterValueByName_2)  # you choose what you want to convert true / false to, good for validation
setParameterByName = Element.SetParameterByName(element=duplicate_view_and_isolate.ViewOut, parameterName=code_block, value=boolean_input_to_variable_string)
done = Output(setParameterByName)
watch_2 = Watch(getParameterValueByName)
watch_3 = Watch(boolean_input_to_variable_string)
watch_4 = Watch(duplicate_view_and_isolate.ViewOut)
watch_5 = Watch(duplicate_view_and_isolate.done)
