# Dynamo custom node Element Type Reporting.dyf (Dynamo 0.9.1.4062)
# category: Bakery.Report
# searches element types for strings and gives data

Element_Types = Input()
Search_for_Case_ignored = Input()  # "Search for (Case ignored)"
getElementsContaining = Custom[GetElementsContaining](Element_Types=Element_Types, Search_for_Case_ignored=Search_for_Case_ignored)  # This node search the selected element type for a inputvalue(string) and returns a list of the elements containing the given input.
parameters = Element.Parameters(getElementsContaining)
string_from_object = FromObject(parameters)
search_element_parameters_for = Input()
contains = String.Contains(str=string_from_object, searchFor=search_element_parameters_for)
flatten = Flatten(contains)
count = List.Count(flatten)
chop = List.Chop(list=contains, lengths=count)
boolean = BoolSelector(true)
create = List.Create(boolean)
flat_list_to_list_of_strings = Custom[Flat List to List of Strings](Original_List=create)  # using python methods
flat_list_to_list_of_strings_2 = Custom[Flat List to List of Strings](Original_List=flatten)
if_equal_return_index = Custom[If Equal Return Index](listA=flat_list_to_list_of_strings, listB=flat_list_to_list_of_strings_2)  # If element in list A is equal to an element in list B then return index from list B.
anyTrue = Custom[List.AnyTrue](seq=contains)  # Returns true if any item in a list of booleans is true.
Any_of_these = Output(anyTrue)  # "Any of these?"
string = StringInput("Family and Type")
getParameterValueByName = Element.GetParameterValueByName(element=getElementsContaining, parameterName=string)
boolean_2 = BoolSelector(true)
create_2 = List.Create(boolean_2)
sublistsContain = Custom[List.SublistsContain](seq=contains, item=boolean)  # Looks for an item in each sublist of a given list and returns true/false for each sublist.
if_equal_return_index_2 = Custom[If Equal Return Index](listA=create_2, listB=sublistsContain)
getItemAtIndex = List.GetItemAtIndex(list=getParameterValueByName, index=if_equal_return_index_2)
Elements = Output(getItemAtIndex)
watch = Watch(parameters)
