# Dynamo custom node Element Type for Linked File Element Lists.dyf (Dynamo 0.8.2.2371)
# category: Bakery.Revit.Document.Links

Element_s = Input()  # "Element(s)"
turn_into_list = Custom[Turn Into List](item=Element_s)  # Turns an element (or a nested list) into a flat list
Link_Document = Input()
python_script = Python(IN[0]=turn_into_list, IN[1]=Link_Document)
# ---------- python_script.python (13 lines) ----------
import clr
clr.AddReference('RevitAPI')
from Autodesk.Revit.DB import *

items = UnwrapElement(IN[0])
doc = UnwrapElement(IN[1])
typelist = list()
for item in items:
	try: 
		typelist.append(doc.GetElement(item.GetTypeId()))
	except:
		typelist.append(list())
OUT = typelist
# ----------------------------------------
Type_s = Output(python_script)  # "Type(s)"
