# Dynamo custom node Element Type for Linked File Large Lists.dyf (Dynamo 0.8.2.2371)
# category: Bakery.Revit.Document.Links

counter = Input()
elementList = Input()
getItemAtIndex = List.GetItemAtIndex(list=elementList)
map = List.Map(list=counter, f_x=getItemAtIndex)
docList = Input()
getItemAtIndex_2 = List.GetItemAtIndex(list=docList)
map_2 = List.Map(list=counter, f_x=getItemAtIndex_2)
create = List.Create(map, map_2)
code_block = CodeBlock { 0; }
getItemAtIndex_3 = List.GetItemAtIndex(index=code_block)
map_3 = List.Map(list=create, f_x=getItemAtIndex_3)
code_block_2 = CodeBlock { 0; }
getItemAtIndex_4 = List.GetItemAtIndex(list=map_3, index=code_block_2)
code_block_3 = CodeBlock { 1; }
getItemAtIndex_5 = List.GetItemAtIndex(list=map_3, index=code_block_3)
element_type_for_linked_file = Custom[Element Type for Linked File Element Lists](Element_s=getItemAtIndex_4, Link_Document=getItemAtIndex_5)
Type_s = Output(element_type_for_linked_file)  # "Type(s)"
