# Dynamo custom node Enumerate Structural Types.dyf (Dynamo 1.2.1.3083)
# category: Bakery.Revit.Application.Enums

python_script = Python()
# ---------- python_script.python (19 lines) ----------
import clr
clr.AddReference('ProtoGeometry')
from Autodesk.DesignScript.Geometry import *

# Import DocumentManager and TransactionManager
clr.AddReference("RevitServices")
import RevitServices
from RevitServices.Persistence import DocumentManager
from RevitServices.Transactions import TransactionManager

# Import RevitAPI
clr.AddReference("RevitAPI")
import Autodesk
from Autodesk.Revit.DB import *
from Autodesk.Revit.DB import Structure
import System

#Assign your output to the OUT variable
OUT = System.Enum.GetValues(Autodesk.Revit.DB.Structure.StructuralType)
# ----------------------------------------
