# Dynamo custom node Export Element Details and Room Number using Element Input.dyf (Dynamo 0.8.2.2371)
# category: Bakery.Elements

code_block = CodeBlock { "Level1cef"; }
Family_Instance_Element_List = Input()
watch = Watch(Family_Instance_Element_List)
location = FamilyInstance.Location(watch)
watch_2 = Watch(location)
Room_Elements_RVT_Link_Wildcard_Search = Input()
string = StringInput("Rooms")
convert_category_name_to_built = Custom[Convert Category Name to Built In Category Name](categoryName=string)  # You must use List.Map to convert list of Category Names to list of Built In Names
get_elements_in_link_using_name = Custom[Get Elements in Link using Name Search and Category](SearchLinkNames=Room_Elements_RVT_Link_Wildcard_Search, DesiredCategoryBuiltInName=convert_category_name_to_built)  # link name search
watch_3 = Watch(get_elements_in_link_using_name.ElementsFlatList)
isPointInside = Custom[Room.IsPointInside](room=watch_3)  # Evaluates if a ponti is located inside a given room.
map = List.Map(list=watch_2, f_x=isPointInside)
firstItem = List.FirstItem()
map_2 = List.Map(list=map, f_x=firstItem)
watch_4 = Watch(map_2)
anyTrue = Custom[List.AnyTrue]()  # Returns true if any item in a list of booleans is true.
map_3 = List.Map(list=watch_4, f_x=anyTrue)
watch_5 = Watch(map_3)
ExcelFilePath = Input(ExcelFilePath : string)
code_block_2 = CodeBlock { 0; }
string_2 = StringInput("Element Id")
id = Element.Id(watch)
flat_list_to_list_of_strings = Custom[Flat List to List of Strings](Original_List=id)  # using python methods
addItemToFront = List.AddItemToFront(item=string_2, list=flat_list_to_list_of_strings)
string_3 = StringInput("Family Name")
type = Custom[Element.Type](element=watch)  # Gets the family type of a given element (if applicable).
family = FamilySymbol.Family(type)
flat_list_to_list_of_strings_2 = Custom[Flat List to List of Strings](Original_List=family)
addItemToFront_2 = List.AddItemToFront(item=string_3, list=flat_list_to_list_of_strings_2)
string_4 = StringInput("Family Type")
flat_list_to_list_of_strings_3 = Custom[Flat List to List of Strings](Original_List=type)
addItemToFront_3 = List.AddItemToFront(item=string_4, list=flat_list_to_list_of_strings_3)
string_5 = StringInput("Source RVT")
Family_Instance_Model_Name = Input()
turnIntoList = Custom[TurnIntoList](Family_Instance_Model_Name)  # Turns an element (or a nested list) into a flat list
count = Count(watch)
cycle = List.Cycle(list=turnIntoList, amount=count)
addItemToFront_4 = List.AddItemToFront(item=string_5, list=cycle)
string_6 = StringInput("Room Number")
code_block_3 = CodeBlock { "Number"; }
getParameterValueByName = Element.GetParameterValueByName(element=watch_3, parameterName=code_block_3)
code_block_4 = CodeBlock { true; }
firstIndexOf = List.FirstIndexOf(item=code_block_4)
map_4 = List.Map(list=watch_4, f_x=firstIndexOf)
watch_6 = Watch(map_4)
getItemAtIndex = List.GetItemAtIndex(list=getParameterValueByName, index=watch_6)
watch_7 = Watch(getItemAtIndex)
code_block_5 = CodeBlock { "Room not found"; }
replaceNulls = Lists.Manage.ReplaceNulls(watch_7, code_block_5)
addItemToFront_5 = List.AddItemToFront(item=string_6, list=replaceNulls)
string_7 = StringInput("Z Elevation")
deconstructPoint = Geometry.Points.DeconstructPoint(location)
watch_8 = Watch(deconstructPoint.out2)
addItemToFront_6 = List.AddItemToFront(item=string_7, list=watch_8)
string_8 = StringInput("X")
addItemToFront_7 = List.AddItemToFront(item=string_8, list=deconstructPoint.out0)
string_9 = StringInput("Y")
addItemToFront_8 = List.AddItemToFront(item=string_9, list=deconstructPoint.out1)
create = List.Create(addItemToFront, addItemToFront_2, addItemToFront_3, addItemToFront_4, addItemToFront_5, addItemToFront_6, addItemToFront_7, addItemToFront_8)
watch_9 = Watch(create)
code_block_6 = CodeBlock { "NULL_REPLACEMENT"; }
replaceNulls_2 = Lists.Manage.ReplaceNulls(watch_9, code_block_6)
transpose = List.Transpose(replaceNulls_2)
code_block_7 = CodeBlock { true; }
writeToFile = Excel.WriteToFile(filePath=ExcelFilePath, sheetName=Room_Elements_RVT_Link_Wildcard_Search, startRow=code_block_2, startCol=code_block_2, data=transpose, overWrite=code_block_7)
TO_EXCEL = Output(writeToFile)
