# Dynamo custom node Export Family and Type Name with One Type Parameter to Excel.dyf (Dynamo 0.8.0.950)
# category: Bakery.Families
# Uses Bumblebee

filePath = Input()
code_block = CodeBlock { true; }
code_block_2 = CodeBlock { "FamilySummary"; }
code_block_3 = CodeBlock { "A1"; }
elementList = Input()
symbol = FamilyInstance.Symbol(elementList)
uniqueItems = List.UniqueItems(symbol)
typeParameterName = Input()
getParameterValueByName = Element.GetParameterValueByName(element=uniqueItems, parameterName=typeParameterName)
family = FamilySymbol.Family(uniqueItems)
name = Family.Name(family)
name_2 = FamilySymbol.Name(uniqueItems)
create = List.Create(getParameterValueByName, name, name_2)
watch = Watch(create)
bb_data = Custom[BB Data](SheetName=code_block_2, Origin=code_block_3, Data=watch)  # This node is a building block for different modes of writing to Excel files. You can combines this node into a list to write to multiple sheets or use just one to write to a single sheet.
write_excel = Custom[Write Excel](FilePath=filePath, RunIt=code_block, ByColumn=code_block, BBData=bb_data)  # This node will write data to Excel file and based on how your BBData nodes are structured it will either override the exsting file, create a new one and write a single worksheet or write multiple worksheets.
