# Dynamo custom node Export Views to Navisworks NWC.dyf (Dynamo 1.1.0.2094)
# category: Bakery.BETA
# this node needs work - need to define view scope and set up the list cycling http://www.revitapidocs.com/2016/3a7ffc07-bd02-39c2-1846-865973db8d7f.htm

Views_as_List = Input()
code_block = CodeBlock(item=Views_as_List) { Flatten({item}); }
Path_as_string = Input()
Filename = Input(Filename : string)
python_script = Python(IN[0]=code_block, IN[1]=Path_as_string, IN[2]=Filename)
# ---------- python_script.python (49 lines) ----------
import clr
clr.AddReference('ProtoGeometry')
from Autodesk.DesignScript.Geometry import *
# Import ToDSType(bool) extension method
clr.AddReference("RevitNodes")
import Revit
clr.ImportExtensions(Revit.Elements)
# Import geometry conversion extension methods
clr.ImportExtensions(Revit.GeometryConversion)
# Import DocumentManager and TransactionManager
clr.AddReference("RevitServices")
import RevitServices
from RevitServices.Persistence import DocumentManager
from RevitServices.Transactions import TransactionManager
from System.Collections.Generic import *
# Import RevitAPI
clr.AddReference("RevitAPI")
import Autodesk
from Autodesk.Revit.DB import *

doc = DocumentManager.Instance.CurrentDBDocument
uiapp = DocumentManager.Instance.CurrentUIApplication
app = uiapp.Application
uidoc=DocumentManager.Instance.CurrentUIApplication.ActiveUIDocument

views = []
for i in IN[0]:
	views.append(UnwrapElement(i))
	
folder=UnwrapElement(IN[1])
name=UnwrapElement(IN[2])

# Start Transaction
TransactionManager.Instance.EnsureInTransaction(doc)

a=ViewSet()
for v in views:
	b= a.Insert(v)
	
x=NavisworksExportOptions()

c=doc.Export(folder,name,a,x)



# End Transaction
TransactionManager.Instance.TransactionTaskDone()

OUT=c
# ----------------------------------------
Succeed = Output(python_script)
