# Dynamo custom node Export to NWC subnode for list map.dyf (Dynamo 1.3.3.4651)
# category: Bakery.Construction.Navisworks

targetDirectory = Input()
string_from_object = FromObject(targetDirectory)
string = StringInput("\")
concat = String.Concat(string_from_object, string)
oneView = Input()
watch = Watch(oneView)

# group: generate view name
element_name_universal = Custom[Element Name Universal](Elements=watch)  # Modified for 0.8.1

enumerate_navisworksexportscope = Custom[Enumerate NavisworksExportScope]()
code_block = CodeBlock { 1; }
getItemAtIndex = List.GetItemAtIndex(list=enumerate_navisworksexportscope, index=code_block)
enumerate_navisworkscoordinates = Custom[Enumerate NavisworksCoordinates]()  # for export nwc node
code_block_2 = CodeBlock { 1; }
getItemAtIndex_2 = List.GetItemAtIndex(list=enumerate_navisworkscoordinates, index=code_block_2)
boolean = BoolSelector(true)
boolean_2 = BoolSelector(true)
boolean_3 = BoolSelector(true)
boolean_4 = BoolSelector(true)
boolean_5 = BoolSelector(false)
navisworksexportoptions_builder = Custom[NavisworksExportOptions Builder](oneView=watch, exportScope=getItemAtIndex, exportCoordinates=getItemAtIndex_2, exportLinks=boolean, exportParts=boolean_2, ConvertElementProperties=boolean_3, exportElementIds=boolean_4, DivideFileIntoLevels=boolean_5)
export_to_nwc = Custom[Export To NWC](directoryPathString=concat, fileName=element_name_universal, NavisworksExportOptions=navisworksexportoptions_builder)  # this one for single view
done = Output(export_to_nwc)
