# Dynamo custom node Extract Nested Families from Parent Families.dyf (Dynamo 0.9.1.4062)
# category: Bakery.Families
# with category filter

list_of_model_elements = Custom[List of Model Elements simplified]()  # uses familyinstance select now
nestedFamily = Custom[Get.NestedFamily](Elements=list_of_model_elements.Element_List)  # This node uses the SuperComponent and SubComponets properties of Revit API to organize the elements into lists based on there make-up. I haven't tested multiple nested families but have found it helpfull esp. on Doors, Plumbing Fixtures, & Casework to find out which family is nested in which parent
uniqueItems = List.UniqueItems(nestedFamily.Parent_Family)
watch = Watch(uniqueItems)
type = Custom[Element.Type](element=uniqueItems)  # Gets the family type of a given element (if applicable).
uniqueItems_2 = List.UniqueItems(type)
all_elements_of_family_type = ElementsOfFamilyType(uniqueItems_2)
flatten = Flatten(all_elements_of_family_type)
subComponents = Custom[FamilyInstance.SubComponents](familyInstance=flatten)  # Retrieves all subcomponents of a given family instance
flatten_2 = Flatten(subComponents)
categories = Categories("PlumbingFixtures")
isOfCategory = Custom[Element.IsOfCategory](element=flatten_2, category=categories)  # Checks whether an element is of a specified category
filterByBoolMask = List.FilterByBoolMask(list=flatten_2, mask=isOfCategory)
type_2 = FamilyInstance.Type(filterByBoolMask.in)
flatten_3 = Flatten(type_2)
location = FamilyInstance.Location(filterByBoolMask.in)
flatten_4 = Flatten(location)
level = Custom[Element.Level](element=filterByBoolMask.in)  # Gets an element's level
flatten_5 = Flatten(level)
byPointAndLevel = FamilyInstance.ByPointAndLevel(familyType=flatten_3, point=flatten_4, level=flatten_5)
flatten_6 = Flatten(filterByBoolMask.in)
get_element_position_rotate = Custom[Get Element Position Rotate Mirror](List_of_elements=flatten_6)  # details to various outputs
watch_2 = Watch(get_element_position_rotate.Rotation)
rotate_families_around_origin_by = Custom[Rotate Families Around Origin by Angle](FamilyElement=byPointAndLevel, DegreesToRotate=watch_2)  # this will take Family Instance and angles as list inputs, and rotate Families around their origin. Outputs provide feedback on information used.
boolean = BoolSelector(true)
eq = get_element_position_rotate.Is_Mirrorred == boolean
filterByBoolMask_2 = List.FilterByBoolMask(list=byPointAndLevel, mask=eq)
flipFacingOrientation = Custom[FamilyInstance.FlipFacingOrientation](familyInstance=filterByBoolMask_2.in)  # Flips the facing orientation of a given family instance
List_to_Copy_From = Output(filterByBoolMask.in)
Newly_Created_Instances = Output(byPointAndLevel)
Parent_Family_List = Output(uniqueItems)
watch_3 = Watch()
location_2 = FamilyInstance.Location(filterByBoolMask.in)
flatten_7 = Flatten(location_2)
watch_4 = Watch(flatten_7)
watch_5 = Watch(subComponents)
