# Dynamo custom node Extract Specific Tag Entries from XML as Unique List.dyf (Dynamo 0.8.2.2371)
# category: Bakery.Data.XML

filePath = Input()
openingStringOfTag = Input()
closingString = Input()

# group: CONVERT TO A 'BRACKET' and make unique node for xmls BAKERY.XML
fromPath = FileObject(filePath)  # "File.FromPath"
readText = File.ReadText(fromPath)
split = String.Split(readText, openingStringOfTag)
code_block = CodeBlock { 1; }
dropItems = List.DropItems(amount=code_block)
firstItem = List.FirstItem()
code_block_2 = CodeBlock { 0; }
code_block_3 = CodeBlock { 1; }

map = List.Map(list=split, f_x=dropItems)

# group (continued): CONVERT TO A 'BRACKET' and make unique node for xmls BAKERY.XML
split_2 = String.Split(map, closingString)
map_2 = List.Map(list=split_2, f_x=firstItem)

firstItem_2 = List.FirstItem()
map_3 = List.Map(list=map_2, f_x=firstItem_2)

# group (continued): CONVERT TO A 'BRACKET' and make unique node for xmls BAKERY.XML
remove = String.Remove(str=map_3, startIndex=code_block_2, count=code_block_3)
remove_empty_strings_from_list = Custom[Remove Empty Strings from List](listOfStrings=remove)
uniqueItems = List.UniqueItems(remove_empty_strings_from_list)

unique_list = Output(uniqueItems)
watch = Watch(remove)
not_cleaned = Output(remove)
