# Dynamo custom node FamilyInstance.ByGeometry for List.Map.dyf (Dynamo 1.3.0.875)
# category: Bakery.Revit.Dynamo.Helpers

itemIn = Input()
watch = Watch(itemIn)
family_template_path = Input()
code_block = CodeBlock { 0; }
code_block_2 = CodeBlock { 999999; }
random = Math.Random(code_block, code_block_2)
string_from_object = FromObject(random)
category = Input()
code_block_3 = CodeBlock { "Default"; }
byGeometry = Custom[FamilyInstance.ByGeometry](geometry=watch, familyTemplatePath=family_template_path, familyName=string_from_object, category=category, materialName=code_block_3)  # "Springs.FamilyInstance.ByGeometry"; You must provide a valid family template path that will be used for all input geometry objects. The project units(and not the templates) will be used to determine the size of the output geometry. The provided category will be used only if the family template supports it. If not, the default template category will be used instead. Likewise, the family material(provided as a string) will be set only if a material with that name exists in the template. If not, the default material will be used instead ("By Category"). For void cuts, the material settings will be ignored. The output is the resulting family and an instance aligned according to the project document's origin. The node expects a unique family name for each geometry object. The rest of the input lists will be processed as if the node lacing is set to longest.; unwired: subcategoryName
instance = Output(byGeometry.instance)
