# Dynamo custom node Filter Element List by Parameter Value.dyf (Dynamo 0.8.2.2392)
# category: Bakery.Revit.Parameters

elementList = Input()
parameterName = Input()
getParameterValueByName = Element.GetParameterValueByName(element=elementList, parameterName=parameterName)
bv_remove_nulls = Custom[bv Remove Nulls](List=getParameterValueByName)  # forked from Lunchbox
parameterValue = Input()
eq = bv_remove_nulls == parameterValue
filterByBoolMask = List.FilterByBoolMask(list=elementList, mask=eq)
watch = Watch(filterByBoolMask.in)
filteredList = Output(watch)
