# Dynamo custom node Filter Element List by Workset Name.dyf (Dynamo 0.9.2.4472)
# category: Bakery.Revit.Document.Worksets

elementList = Input()
workset = Custom[Element.Workset](element=elementList)  # Retrieves the workset of a given element
element_name_universal = Custom[Element Name Universal](Element_s=workset)  # Modified for 0.8.1
worksetName = Input()
eq = element_name_universal == worksetName
filterByBoolMask = List.FilterByBoolMask(list=elementList, mask=eq)
in_ = Output(filterByBoolMask.in)  # "in"
