# Dynamo custom node Filter Elements by Intersection with Specific Linked Floor Element.dyf (Dynamo 0.8.2.2371)
# category: Bakery.Revit.Elements

SearchLinkNames_for_Floors = Input()
code_block = CodeBlock { "Floors"; }
convert_category_name_to_built = Custom[Convert Category Name to Built In Category Name](categoryName=code_block)  # You must use List.Map to convert list of Category Names to list of Built In Names
get_elements_in_link_using_name = Custom[Get Elements in Link using Name Search and Category](SearchLinkNames=SearchLinkNames_for_Floors, DesiredCategoryBuiltInName=convert_category_name_to_built)  # link name search
watch = Watch(get_elements_in_link_using_name.ElementsFlatList)
code_block_2 = CodeBlock { "Comments"; }
getParameterValueByName = Element.GetParameterValueByName(element=watch, parameterName=code_block_2)
floor_comments_equals = Input()
bv_all_indices_of_that_can = Custom[bv All Indices Of that can handle Nulls](list=getParameterValueByName, value=floor_comments_equals)  # forked from spring nodes
getItemAtIndex = List.GetItemAtIndex(list=watch, index=bv_all_indices_of_that_can)
level = Custom[Element.Level](element=getItemAtIndex)  # Gets an element's level
element_name_universal = Custom[Element Name Universal](Element_s=level)  # Modified for 0.8.1
floor_level_name_as_string = Input()
bv_all_indices_of_that_can_2 = Custom[bv All Indices Of that can handle Nulls](list=element_name_universal, value=floor_level_name_as_string)
getItemAtIndex_2 = List.GetItemAtIndex(list=getItemAtIndex, index=bv_all_indices_of_that_can_2)
firstItem = List.FirstItem(getItemAtIndex_2)
element_location_points = Input()
elements_to_filter = Input()
filter_elements_by_intersection = Custom[Filter Elements by Intersection with Element](one_element_to_check_intersection=firstItem, element_location_points=element_location_points, elements_to_filter=elements_to_filter)  # uses Element.Geometry and Geometry.DoesIntersect
element_Ids_that_Intersect = Output(filter_elements_by_intersection.element_Ids_that_Intersect)
element_GUIDs_that_Intersect = Output(filter_elements_by_intersection.element_GUIDs_that_Intersect)
elements_that_Intersect = Output(filter_elements_by_intersection.elements_that_Intersect)
elements_NOT_intersecting = Output(filter_elements_by_intersection.elements_NOT_intersecting)
Geometry_DoesIntersect_bool_results = Output(filter_elements_by_intersection.Geometry_DoesIntersect_bool_results)
