# Dynamo custom node Filter Floors by Comments and Level and Make Section Box View.dyf (Dynamo 0.8.2.2371)
# category: Bakery.Revit.Views

list_of_Floors = Input()
code_block = CodeBlock { "Comments"; }
getParameterValueByName = Element.GetParameterValueByName(element=list_of_Floors, parameterName=code_block)
Comments_equals = Input()
eq = getParameterValueByName == Comments_equals
filterByBoolMask = List.FilterByBoolMask(list=list_of_Floors, mask=eq)
watch = Watch(filterByBoolMask.in)
level = Custom[Element.Level](element=watch)  # Gets an element's level
flat_list_to_list_of_strings = Custom[Flat List to List of Strings](Original_List=level)  # using python methods
Level_name_contains = Input()
contains = String.Contains(str=flat_list_to_list_of_strings, searchFor=Level_name_contains)
filterByBoolMask_2 = List.FilterByBoolMask(list=watch, mask=contains)
firstItem = List.FirstItem(filterByBoolMask_2.in)
geometry = Element.Geometry(firstItem)
Offset = Input(Offset : var[]..[])
element_create_3d_cropped_view = Custom[Element.Create 3D Cropped view](element=geometry, Offset=Offset)  # create 3d view for each element and crop view
Views = Output(element_create_3d_cropped_view.Views)
