# Dynamo custom node Filter Items in List by String Contains and Return List and Unmatched.dyf (Dynamo 0.8.2.2392)
# category: Bakery.Core.List
# the two lists are items that contain the string, and everything that is left

ListOfStringItems = Input()
turn_into_list = Custom[Turn Into List](item=ListOfStringItems)  # Turns an element (or a nested list) into a flat list
searchForString = Input()
contains = String.Contains(str=turn_into_list, searchFor=searchForString)
filterByBoolMask = List.FilterByBoolMask(list=turn_into_list, mask=contains)
watch = Watch(filterByBoolMask.in)
remove_list_from_list_by_item = Custom[Remove List from List by Item not Value](ListOfItemsToRemove=watch, ListToRemoveFrom=turn_into_list)  # remove the items in ListA from the items in ListB and return whats left
allTheRest = Output(remove_list_from_list_by_item.reducedList)
itemsThatContainString = Output(filterByBoolMask.in)
unmatched = Output(remove_list_from_list_by_item.unmatched)
