# Dynamo custom node Filter List By Removing Certain Category Names.dyf (Dynamo 1.2.1.3083)
# category: Bakery.Revit.Document.Category

items = Input()
bv_get_category_name = Custom[bv Get Category Name](Elements=items)  # forked from Blackbox
singleStringWithLineBreaks = Input()
convert_string_with_line_breaks = Custom[Convert String with Line Breaks into List of Strings](string=singleStringWithLineBreaks)
if_equal_return_index = Custom[If Equal Return Index](listA=convert_string_with_line_breaks, listB=bv_get_category_name)
removeItemAtIndex = List.RemoveItemAtIndex(list=bv_get_category_name, indices=if_equal_return_index)
reducedCategoryNameList = Output(removeItemAtIndex)
indicesToRemove = Output(if_equal_return_index)
removeItemAtIndex_2 = List.RemoveItemAtIndex(list=items, indices=if_equal_return_index)
reducedItemList = Output(removeItemAtIndex_2)
