# Dynamo custom node Filter List by List.dyf (Dynamo 1.1.0.2094)
# category: Bakery.Core.List
# filters a source list by a list of 'approved' values, and gives those that pass the test

sourceListToFilter = Input()
sourceValueList = Input()
approvedListOfValues = Input()

# group: Filter by Categories
eq = sourceValueList == approvedListOfValues  # lacing=CrossProduct
watch = Watch(eq)
anyTrue = Custom[List.AnyTrue](seq=watch)  # Returns true if any item in a list of booleans is true.
filterByBoolMask = List.FilterByBoolMask(list=sourceListToFilter, mask=anyTrue)

itemsMatchingApprovedValues = Output(filterByBoolMask.in)
