# Dynamo custom node Filter One List by String Search in Another List.dyf (Dynamo 0.8.2.2371)
# category: Bakery.Lists

FilterThisList = Input()
SearchThisList = Input()
searchFor = Input(searchFor : string)
contains = String.Contains(str=SearchThisList, searchFor=searchFor)
filterByBoolMask = List.FilterByBoolMask(list=FilterThisList, mask=contains)
Matching = Output(filterByBoolMask.in)
unMatched = Output(filterByBoolMask.out)
