# Dynamo custom node Filter Sublist Items by Values and Replace if None Found.dyf (Dynamo 0.8.2.2371)
# category: Bakery.Core.List

list_with_sublists = Input()
watch = Watch(list_with_sublists)
filter_by_these_values = Input()
nullAllIndicesOf = Custom[NullAllIndicesOf](value=filter_by_these_values)  # list all of the indices of a list that match the specified value. Capable of handling null values, part of the SmartCopyMonitor workflow.
map = List.Map(list=watch, f_x=nullAllIndicesOf)
flatten = Flatten()
map_2 = List.Map(list=map, f_x=flatten)
watch_2 = Watch(map_2)
get_from_sublists_using_matching = Custom[Get From Sublists using matching List of Indices](lists_with_sublists=watch, list_of_indices=watch_2)
watch_3 = Watch(get_from_sublists_using_matching)
firstItem = List.FirstItem()
map_3 = List.Map(list=watch_3, f_x=firstItem)
replacement_if_not_found = Input()
replaceNull = Custom[List.ReplaceNull](seq=map_3, replacement=replacement_if_not_found)  # Replaces all null values within a given list with a substitute
first_matching_occurrences = Output(replaceNull)
