# Dynamo custom node Filter Views with Two Criteria and Return Views.dyf (Dynamo 0.8.2.2371)
# category: Bakery.Revit.Views

viewListIn = Input()
watch = Watch(viewListIn)
flat_list_to_list_of_strings = Custom[Flat List to List of Strings](Original_List=watch)  # using python methods
ViewNameIncludingThisString = Input()
code_block = CodeBlock { true; }
contains = String.Contains(str=flat_list_to_list_of_strings, searchFor=ViewNameIncludingThisString, ignoreCase=code_block)
filterByBoolMask = List.FilterByBoolMask(list=watch, mask=contains)
watch_2 = Watch(filterByBoolMask.in)
flat_list_to_list_of_strings_2 = Custom[Flat List to List of Strings](Original_List=filterByBoolMask.in)
AndThisString = Input()
code_block_2 = CodeBlock { true; }
contains_2 = String.Contains(str=flat_list_to_list_of_strings_2, searchFor=AndThisString, ignoreCase=code_block_2)
filterByBoolMask_2 = List.FilterByBoolMask(list=filterByBoolMask.in, mask=contains_2)
viewListOut = Output(filterByBoolMask_2.in)
