# Dynamo custom node Filter a List by Comparison with Benchmark Date.dyf (Dynamo 1.3.0.875)
# category: Bakery.Core.DateTime

list_One_to_Filter = Input()
benchmark_date = Input()
list_of_dates_to_compare = Input()
python_script = Python(IN[0]=benchmark_date, IN[1]=list_of_dates_to_compare)
# ---------- python_script.python (12 lines) ----------
import clr
from datetime import datetime, date
clr.AddReference('ProtoGeometry')
from Autodesk.DesignScript.Geometry import *
#The inputs to this node will be stored as a list in the IN variables.
dateNow = IN[0]
dateOther = IN[1]
dateComps = []
for x in dateOther:
	dateComps.append(dateNow > x)
#Assign your output to the OUT variable.
OUT = dateComps
# ----------------------------------------
filterByBoolMask = List.FilterByBoolMask(list=list_One_to_Filter, mask=python_script)
list_One_Other = Output(filterByBoolMask.in)
list_Two_to_Filter = Input()
filterByBoolMask_2 = List.FilterByBoolMask(list=list_Two_to_Filter, mask=python_script)
list_Two_Other = Output(filterByBoolMask_2.in)
watch = Watch(filterByBoolMask_2.out)
list_Two_Newer = Output(watch)
watch_2 = Watch(filterByBoolMask.out)
list_One_Newer = Output(watch_2)
