# Dynamo custom node Find Empty Worksets and List Names.dyf (Dynamo 0.9.1.4062)
# category: Bakery.Worksets
# search through given elements for empty worksets

get_worksets = Custom[Get Worksets]()  # Retrieves user worksets from specified document
collect_all_elements_in_model = Custom[Collect All Elements in Model faster]()  # does not report count or categories
get_all_revit_links_as_element = Custom[Get All Revit Links as Element List]()
join = List.Join(collect_all_elements_in_model, get_all_revit_links_as_element)
workset = Custom[Element.Workset](element=join)  # Retrieves the workset of a given element
element_name_universal = Custom[Element.Name (Universal)](element=workset)  # Gets an element's name (Dynamo's built-in Name nodes don't work for all element types, e.g. worksets...)
uniqueItems = List.UniqueItems(element_name_universal)
removeItemsFromOtherList = Custom[List.RemoveItemsFromOtherList](List_A=get_worksets.Names, List_B=uniqueItems)  # This will take long list A, remove entries that appear in short list B, and give you list C. (JBE List Operations are probably more robust).
watch = Watch(removeItemsFromOtherList)
EmptyWorksets = Output(removeItemsFromOtherList)
