# Dynamo custom node Find Nearest Revit Level for a Given Z value.dyf (Dynamo 1.3.2.2480)
# category: Bakery.Geometry

categories = Categories("Levels")
all_elements_of_category = ElementsOfCategory(categories)
z_value = Input()
elevation = Level.Elevation(all_elements_of_category)
closest_value = Custom[Closest Value](value=z_value, listOfDoubles=elevation)  # uses double to int reduction
getItemAtIndex = List.GetItemAtIndex(list=all_elements_of_category, index=closest_value)
nearestLevel = Output(getItemAtIndex)
