# Dynamo custom node Find Pipe Insulation on Workset - Get Host Pipes - Save to Selection.dyf (Dynamo 0.8.2.2371)
# category: Bakery.Revit.Elements.Systems

string = StringInput("Workset")
categories = Categories("PipeInsulations")
all_elements_of_category = ElementsOfCategory(categories)
get_worksets = Custom[Get Worksets]()  # Retrieves user worksets from specified document
searchForWorkset = Input()
create = List.Create(searchForWorkset)
bv_if_equal_return_index = Custom[bv If Equal Return Index](listA=create, listB=get_worksets.Names)  # forked
getItemAtIndex = List.GetItemAtIndex(list=get_worksets.Ids, index=bv_if_equal_return_index)
flat_list_to_list_of_strings = Custom[Flat List to List of Strings](Original_List=getItemAtIndex)  # using python methods
getParameterValueByName = Element.GetParameterValueByName(element=all_elements_of_category)
flat_list_to_list_of_strings_2 = Custom[Flat List to List of Strings](Original_List=getParameterValueByName)
bv_if_equal_return_index_2 = Custom[bv If Equal Return Index](listA=flat_list_to_list_of_strings, listB=flat_list_to_list_of_strings_2)
getItemAtIndex_2 = List.GetItemAtIndex(list=all_elements_of_category, index=bv_if_equal_return_index_2)
PipeInsulationsOnThisWorkset = Output(getItemAtIndex_2)
SaveToSelectionSet = Input()
get_host_pipe_id_from_pipe = Custom[Get Host Pipe ID from Pipe Insulation](Element_s=getItemAtIndex_2)  # takes a list of elements (such as Pipe Insulations) and returns a list of their Hosts
byElements = Custom[SelectionSet.ByElements](Name=SaveToSelectionSet, Element_s=get_host_pipe_id_from_pipe)  # Creates a selection set of the given elements. Note that if a selection set of the given name already exists in the model, its contents will be replaced. Also, if the selection set is already applied as a view filter, the view filter will have to be manually updated in the visibility / graphic overrides.
SelectionSet = Output(byElements)
