# Dynamo custom node Find Worksets that contain Revit Link Instances.dyf (Dynamo 0.8.0.950)
# category: Bakery.Revit.Selection
# Audit

get_documents = Custom[Get Documents]()  # Queries all linked Revit files and retrieves their Name, LinkInstance and Document properties.
watch = Watch(get_documents.Link_Instance)
workset = Custom[Element.Workset](Element_s=watch)  # Retrieves the workset of a given element
element_name_universal = Custom[Element.Name (Universal)](Element_s=workset)  # Gets an element's name (Dynamo's built-in Name nodes don't work for all element types, e.g. worksets...)
uniqueItems = List.UniqueItems(element_name_universal)
WorksetNames = Output(uniqueItems)
