# Dynamo custom node First Three Rows into a Single Header List.dyf (Dynamo 1.2.0.2690)
# category: Bakery.Construction.Civil
# this climbs from row 3 to row 1 replacing nulls

list = Input(list : var[]..[])
code_block = CodeBlock { 2; }
getItemAtIndex = List.GetItemAtIndex(list=list, index=code_block, lacing=Longest)
watch = Watch(getItemAtIndex)
trimLeadingWhitespace = String.TrimLeadingWhitespace(watch)
watch_2 = Watch(trimLeadingWhitespace)
code_block_2 = CodeBlock { 1; }
getItemAtIndex_2 = List.GetItemAtIndex(list=list, index=code_block_2, lacing=Longest)
watch_3 = Watch(getItemAtIndex_2)
trimLeadingWhitespace_2 = String.TrimLeadingWhitespace(watch_3)
two_lists_into_one_replacing = Custom[Two Lists into One Replacing Nulls with Backup Values](primary_list_to_clean=watch_2, backup_list_used_for_null_replacement=trimLeadingWhitespace_2)
code_block_3 = CodeBlock { 0; }
getItemAtIndex_3 = List.GetItemAtIndex(list=list, index=code_block_3, lacing=Longest)
watch_4 = Watch(getItemAtIndex_3)
trimLeadingWhitespace_3 = String.TrimLeadingWhitespace(watch_4)
two_lists_into_one_replacing_2 = Custom[Two Lists into One Replacing Nulls with Backup Values](primary_list_to_clean=two_lists_into_one_replacing, backup_list_used_for_null_replacement=trimLeadingWhitespace_3)
cleaned_list = Output(two_lists_into_one_replacing_2)
