# Dynamo custom node Flat List to List of Strings.dyf (Dynamo 0.9.1.4062)
# category: Bakery.Core.List
# using python methods

Original_List = Input()
python_script = Python(IN[0]=Original_List)
# ---------- python_script.python (15 lines) ----------
import clr
clr.AddReference('ProtoGeometry')
from Autodesk.DesignScript.Geometry import *
#The inputs to this node will be stored as a list in the IN variable.
dataEnteringNode = IN

stringList = []
for x in dataEnteringNode[0]:
	try:
		tempString = str(x)
	except:
		tempString = "stringConversionFailed"
	stringList.append(tempString)
#Assign your output to the OUT variable
OUT = stringList
# ----------------------------------------
List_of_Strings = Output(python_script)
