# Dynamo custom node Flatten List and Replace Null with NULL VALUE.dyf (Dynamo 0.8.2.2371)
# category: Bakery.Lists

list = Input(list : var[]..[])
flatten = Flatten(list)
string = StringInput("NULL VALUE")
replaceNull = Custom[List.ReplaceNull](list=flatten, replacement=string)  # Replaces all null values within a given list with a substitute
list_2 = Output(replaceNull)  # "list"
