# Dynamo custom node Generate Family--Type Name String From Types.dyf (Dynamo 1.2.1.3083)
# category: Bakery.Revit.Elements.Family

familyTypeList = Input()

# group: Make Unique Id
flatten = Flatten(familyTypeList)
family = FamilyType.Family(flatten)
name = Element.Name(family)
name_2 = Element.Name(flatten)
create = List.Create(name, name_2)
transpose = List.Transpose(create)
code_block = CodeBlock { "---"; }

Types = Output(flatten)
Families = Output(family)
bv_merge_sublists_with_a = Custom[bv Merge Sublists with a separator](List=transpose, Character=code_block)  # forked from Rhythm
watch = Watch(bv_merge_sublists_with_a)
Family_Type_string = Output(watch)  # "Family---Type string"
