# Dynamo custom node Geometry to Watertight Mesh.dyf (Dynamo 0.8.2.2371)
# category: Bakery.Geometry
# uses MeshToolkit

inputGeometry = Input()
byGeometry = Autodesk.Dynamo.MeshToolkit.Mesh.ByGeometry(inputGeometry)
makeWatertight = Autodesk.Dynamo.MeshToolkit.Mesh.MakeWatertight(byGeometry)
watertight_mesh = Output(makeWatertight)
