# Dynamo custom node Get Actual Elements from Linked Tag Ids.dyf (Dynamo 0.8.2.2371)
# category: Bakery.Revit.Elements.Tag
# very slow for the elements...

tagInfoList = Input()
code_block = CodeBlock { 2; }
getItemAtIndex = List.GetItemAtIndex(index=code_block)
map = List.Map(list=tagInfoList, f_x=getItemAtIndex)
get_link_document_from_link = Custom[Get Link Document from Link Instance Id]()
map_2 = List.Map(list=map, f_x=get_link_document_from_link)
firstItem = List.FirstItem(map_2)
code_block_2 = CodeBlock { 1; }
getItemAtIndex_2 = List.GetItemAtIndex(index=code_block_2)
map_3 = List.Map(list=tagInfoList, f_x=getItemAtIndex_2)
firstItem_2 = List.FirstItem(map_3)
isNull = Object.IsNull(map_2)
filterByBoolMask = List.FilterByBoolMask(list=tagInfoList, mask=isNull)
code_block_3 = CodeBlock { 3; }
getItemAtIndex_3 = List.GetItemAtIndex(index=code_block_3)
map_4 = List.Map(list=filterByBoolMask.in, f_x=getItemAtIndex_3)
not_a_Linked_Tag = Output(map_4)
Link_Tags_Used = Output(filterByBoolMask.out)
filterByBoolMask_2 = List.FilterByBoolMask(list=map_3, mask=isNull)
watch = Watch(filterByBoolMask_2.out)
Link_Element_Ids = Output(watch)
filterByBoolMask_3 = List.FilterByBoolMask(list=map_2, mask=isNull)
watch_2 = Watch(filterByBoolMask_3.out)
Link_Docs = Output(watch_2)
code_block_4 = CodeBlock { 3; }
getItemAtIndex_4 = List.GetItemAtIndex(index=code_block_4)
map_5 = List.Map(list=tagInfoList, f_x=getItemAtIndex_4)
filterByBoolMask_4 = List.FilterByBoolMask(list=map_5, mask=isNull)
Link_Tag_Elements_Used = Output(filterByBoolMask_4.out)
get_elements_from_documents_by = Custom[Get Elements from Documents by Id](elementIdList=watch, docList=watch_2)  # requires 1:1 input
Link_Actual_Elements = Output(get_elements_from_documents_by)
