# Dynamo custom node Get All Pipe Connector Information.dyf (Dynamo 1.2.1.3083)
# category: Bakery.Revit.API.MEP

PipeElements = Input()
get_connectormanager = Custom[Get ConnectorManager](elements=PipeElements)  # Get the connector manager object from Revit
connectorManagers = Output(get_connectormanager)
get_connectors_from = Custom[Get Connectors from ConnectorManager](connectorManagerObject=get_connectormanager)
connectors = Output(get_connectors_from)
get_connector_origin = Custom[Get Connector.Origin]()  # unwired: connectors
map = List.Map(list=get_connectors_from, f_x=get_connector_origin)
comma_separated_point_value_to = Custom[Comma Separated Point Value to Point Object](obj=map@@L2)
originPoints = Output(comma_separated_point_value_to)
get_connector_coordinatesystem = Custom[Get Connector.CoordinateSystem]()  # unwired: connectors
map_2 = List.Map(list=get_connectors_from, f_x=get_connector_coordinatesystem)
coordinateSystems = Output(map_2)
location = Custom[Element.Location](element=PipeElements)  # Returns the location of an element as an XYZ (or if it's line-based the start and end point of the line), along with some booleans to help filtering the results. Use this for some element types (e.g. walls or lines) that do not work with the built-in Get Family Instance Location node.
curveEndPoints = Output(location.curveEndpoints)
curves = Output(location.curves)
sortPointsAlongCurve = Geometry.Points.SortPointsAlongCurve(comma_separated_point_value_to, location.curves)
sortedPoints = Output(sortPointsAlongCurve)
code_block = CodeBlock { 0; }
getItemAtIndex = List.GetItemAtIndex(index=code_block)  # unwired: list
map_3 = List.Map(list=location.curveEndpoints, f_x=getItemAtIndex)
startPoints = Output(map_3)
code_block_2 = CodeBlock { 1; }
getItemAtIndex_2 = List.GetItemAtIndex(index=code_block_2)  # unwired: list
map_4 = List.Map(list=location.curveEndpoints, f_x=getItemAtIndex_2)
endPoints = Output(map_4)
