# Dynamo custom node Get All Revit Links as Element List.dyf (Dynamo 0.8.2.2371)
# category: LSJ

get_linked_rvt_documents = Custom[Get Linked RVT Documents]()
element_ids = Custom[Element Ids](Element_s=get_linked_rvt_documents.Link_Instance)  # This node will query an element id that can be used with Revit nodes. Dynamo Element Id node returns integer value.
current_document = Custom[Current Document]()  # Retrieves Current Document
id_to_element = Custom[Id to Element](Id_s=element_ids.Rvt_ElementId_s, Doc=current_document)  # Selects elements in a model from id input (ElementId, string, integer or GUID)
RevitLinkElements = Output(id_to_element)
