# Dynamo custom node Get Attribute from ElementTree by Name.dyf (Dynamo 0.8.2.2371)
# category: Bakery.Data.XML

ElementTree = Input(ElementTree : var[]..[])
XPATHscope = Input(XPATHscope : string = ".")
xpath_expression_find_for = Custom[XPATH Expression Find for Element Tree](ElementTree=ElementTree, XPATH=XPATHscope)
Attribute_Name = Input()
turnIntoList = Custom[TurnIntoList](Attribute_Name)  # Turns an element (or a nested list) into a flat list
firstItem = List.FirstItem(xpath_expression_find_for.attrib_names)
watch = Watch(firstItem)
if_equal_return_index_using = Custom[If Equal Return Index using IndexOf](searchForThese=turnIntoList, inThisList=watch)
getItemAtIndex = List.GetItemAtIndex(index=if_equal_return_index_using)
map = List.Map(list=xpath_expression_find_for.attrib_values, f_x=getItemAtIndex)
code_block = CodeBlock { 1; }
flatten = List.Flatten(list=map, amt=code_block)
Attribute_Values = Output(flatten)
