# Dynamo custom node Get BCF Data from unzipped BCFZIP folder.dyf (Dynamo 0.8.2.2371)
# category: Bakery.BIM.BCF

path = Input(path : var[]..[])
get_bcf_files_from_unzipped = Custom[Get BCF files from unzipped BCFZIP](path=path)
iterate_through_bcf_files_and = Custom[Iterate through BCF files and Get Combined List](file_list=get_bcf_files_from_unzipped)
sublist_per_issue = Output(iterate_through_bcf_files_and)
files_list = Output(get_bcf_files_from_unzipped)
