# Dynamo custom node Get Boundary Curve for One Room by Perimeter.dyf (Dynamo 0.8.2.2371)
# category: Bakery.Geometry

room = Input()
watch = Watch(room)
rooms_to_polycurves = Custom[Rooms to PolyCurves](roomList=watch)
firstItem = List.FirstItem(rooms_to_polycurves)
code_block = CodeBlock { "Perimeter"; }
getParameterValueByName = Element.GetParameterValueByName(element=watch, parameterName=code_block)
round = Math.Round(getParameterValueByName)
flatten = Flatten(rooms_to_polycurves)
length = Curve.Length(flatten)
round_2 = Math.Round(length)
if_equal_return_index_using = Custom[If Equal Return Index using IndexOf](searchForThese=round, inThisList=round_2)
getItemAtIndex = List.GetItemAtIndex(list=firstItem, index=if_equal_return_index_using)
firstItem_2 = List.FirstItem(firstItem)
replaceNulls = Lists.Manage.ReplaceNulls(getItemAtIndex, firstItem_2)
polycurve = Output(replaceNulls)
