# Dynamo custom node Get BuiltinParameterGroup by Name.dyf (Dynamo 1.2.1.3083)
# category: Bakery.Revit.Parameters

enumerate_parameter_groups = Custom[Enumerate Parameter Groups]()
flat_list_to_list_of_strings = Custom[Flat List to List of Strings](Original_List=enumerate_parameter_groups)  # using python methods
searchFor = Input(searchFor : string)
filter_one_list_by_string_search = Custom[Filter One List by String Search in Another List](SearchThisList=flat_list_to_list_of_strings, searchFor=searchFor, FilterThisList=enumerate_parameter_groups)
firstItem = List.FirstItem(filter_one_list_by_string_search.Matching)
item = Output(firstItem)
