# Dynamo custom node Get Categories from Elements.dyf (Dynamo 0.8.2.2392)
# category: Bakery.Categories
# "List Unique Categories Present in Set of Elements" is better. This one uses Blackbox Get.CategoryName and Get Categories (designed to use document category list)

get_categories = Custom[Get Categories]()  # get category names and ids
watch = Watch(get_categories.Clean_Name)
Elements = Input()
bv_get_category_name = Custom[bv Get Category Name](Elements=Elements)  # forked from Blackbox
uniqueItems = List.UniqueItems(bv_get_category_name)
CategoriesPresent = Output(uniqueItems)
watch_2 = Watch(get_categories.Names)
watch_3 = Watch(get_categories.Categories)
string_from_object = FromObject(watch_3)
string = StringInput(".")
split = String.Split(string_from_object, string)
flatten = Flatten(split)
string_from_object_2 = FromObject(uniqueItems)
bv_if_equal_return_index = Custom[bv If Equal Return Index](listA=flatten, listB=string_from_object_2)  # forked
getItemAtIndex = List.GetItemAtIndex(list=watch_2, index=bv_if_equal_return_index)
BuiltIn = Output(getItemAtIndex)
