# Dynamo custom node Get Characters at End of Strings.dyf (Dynamo 1.0.0.1180)
# category: Bakery.Core.String

listOfStrings = Input()
watch = Watch(listOfStrings)
code_block = CodeBlock { 0; }
length = String.Length(watch)
endingCharactersToKeep = Input()
code_block_2 = CodeBlock(x=length, y=endingCharactersToKeep) { x-y; }
watch_2 = Watch(code_block_2)
remove = String.Remove(str=watch, startIndex=code_block, count=watch_2)
strings = Output(remove)
