# Dynamo custom node Get Checkout Status with Time Trigger.dyf (Dynamo 0.8.2.2371)
# category: Bakery.Revit.Elements

current_document = Custom[Current Document]()  # Retrieves Current Document
updater = Input()
pause = Thread.Pause(current_document, updater)
python_script = Python(IN[0]=pause)
# ---------- python_script.python (45 lines) ----------
#Copyright(c) 2015, Konrad Sobon
# @arch_laboratory, http://archi-lab.net

import clr
clr.AddReference('ProtoGeometry')
from Autodesk.DesignScript.Geometry import *

# Import DocumentManager
clr.AddReference("RevitServices")
import RevitServices
from RevitServices.Persistence import DocumentManager

# Import RevitAPI
clr.AddReference("RevitAPI")
import Autodesk

# Import ToDSType(bool) extension method
clr.AddReference("RevitNodes")
import Revit
from Autodesk.Revit.DB import *
clr.ImportExtensions(Revit.Elements)

#The inputs to this node will be stored as a list in the IN variable.
#doc = DocumentManager.Instance.CurrentDBDocument
uiapp = DocumentManager.Instance.CurrentUIApplication
app = uiapp.Application
doc = UnwrapElement(IN[0])

#create workset collector
allElems = FilteredElementCollector(doc).WhereElementIsNotElementType().ToElementIds()
#extract workset's name and ids
ids, checkoutStat = [], []
for i in allElems:
	try:
		checkoutStat.append(WorksharingUtils.GetCheckoutStatus(doc, i))
	except:
		checkoutStat.append("unknown checkout status")
#	names.append(i.Name)
#	ids.append(i.Id)
#	wsIsOpens.append(i.IsOpen)
#	wsIsVis.append(i.IsVisibleByDefault)
#	wsIsDefault.append(i.IsDefaultWorkset)
	
#Assign your output to the OUT variable
OUT = allElems, checkoutStat
# ----------------------------------------
code_block = CodeBlock { 0; }
getItemAtIndex = List.GetItemAtIndex(list=python_script, index=code_block)
element_Ids = Output(getItemAtIndex)
code_block_2 = CodeBlock { 1; }
getItemAtIndex_2 = List.GetItemAtIndex(list=python_script, index=code_block_2)
checkout_status = Output(getItemAtIndex_2)
