# Dynamo custom node Get Crop Box List from View List.dyf (Dynamo 0.8.2.2371)
# category: Bakery.Revit.Views

collect_all_view_crop_boxes_in = Custom[Collect All View Crop Boxes in Document]()
watch = Watch(collect_all_view_crop_boxes_in.names)
viewList = Input(viewList : var[]..[])
element_name_universal = Custom[Element.Name (Universal)](element=viewList)  # Gets an element's name (Dynamo's built-in Name nodes don't work for all element types, e.g. worksets...)
check_common_items_between_two = Custom[Check Common Items between Two Lists and Get From One](in_this_and_get_from_this=watch, searchForThese=element_name_universal)
watch_2 = Watch(check_common_items_between_two.cleaned_indices)
getItemAtIndex = List.GetItemAtIndex(list=collect_all_view_crop_boxes_in.OST_Viewer_elements, index=watch_2)
crop_boundary_elements = Output(getItemAtIndex)
