# Dynamo custom node Get DYF Dependencies for One DYF File.dyf (Dynamo 1.2.1.3083)
# category: Bakery.Standalone.DynamoMgmt
# also works for DYN files

path_to_DYF_or_DYN = Input()
show_dependency_nodes_for_one = Custom[Show Dependency Nodes for one DYF](path_to_DYF=path_to_DYF_or_DYN)  # used with List.Map for a folder of them
watch = Watch(show_dependency_nodes_for_one)

# group: REFERENCED BY PACKAGE
watch_2 = Watch(watch)

all_dependencies = Output(watch_2)
path_To_Package_Folder = Input()
string = StringInput("Index")
report_dynamo_package_details_by = Custom[Report Dynamo Package Details by Folder](path_To_Package_Folder=path_To_Package_Folder, searchFor=string)

# group: outputs
watch_3 = Watch(report_dynamo_package_details_by.package_name_for_dyfs_without_Nulls)
watch_4 = Watch(report_dynamo_package_details_by.dyfs_found_without_Nulls)

string_2 = StringInput(".dyf")
split = String.Split(watch_4, string_2)
flatten = Flatten(split)
if_equal_return_index_using = Custom[If Equal Return Index using IndexOf](searchForThese=watch_2, inThisList=flatten)
getItemAtIndex = List.GetItemAtIndex(list=watch_3, index=if_equal_return_index_using)
get_indices_of_null_values = Custom[Get Indices of Null Values](list=getItemAtIndex)  # needs to be hidden

# group: Node referenced in the package
removeItemAtIndex = List.RemoveItemAtIndex(list=watch_2, indices=get_indices_of_null_values)

custom_nodes = Output(removeItemAtIndex)

# group: Packages these are from
removeItemAtIndex_2 = List.RemoveItemAtIndex(list=getItemAtIndex, indices=get_indices_of_null_values)

packages = Output(removeItemAtIndex_2)
watch_5 = Watch(report_dynamo_package_details_by.cleaned_path_list)
getItemAtIndex_2 = List.GetItemAtIndex(list=watch_5, index=if_equal_return_index_using)

# group: FILES
removeItemAtIndex_3 = List.RemoveItemAtIndex(list=getItemAtIndex_2, indices=get_indices_of_null_values)

files = Output(removeItemAtIndex_3)
