# Dynamo custom node Get Date for Given Number of Days in the Past.dyf (Dynamo 1.3.0.875)
# category: Bakery.Core.DateTime

Number_of_days_ago = Input()
python_script = Python(IN[0]=Number_of_days_ago)
# ---------- python_script.python (10 lines) ----------
import clr
from datetime import date, datetime, timedelta
clr.AddReference('ProtoGeometry')
from Autodesk.DesignScript.Geometry import *
#The inputs to this node will be stored as a list in the IN variables.
minusDays = IN[0]
d = datetime.today() - timedelta(days=minusDays)
#dx = datetime.datetime.combine(d, datetime.time())
#Assign your output to the OUT variable.
OUT = d
# ----------------------------------------
string_from_object = FromObject(python_script)
fromString = DateTime.FromString(string_from_object)
dateTime_dynamo_friendly = Output(fromString)
as_String = Output(string_from_object)
from_Python = Output(python_script)
