# Dynamo custom node Get Details from One TransmissionData.dyf (Dynamo 1.2.1.3083)
# category: Bakery.Revit.API

IN_0 = Input()  # "IN[0]"
python_script = Python(IN[0]=IN_0)
# ---------- python_script.python (62 lines) ----------
import clr
clr.AddReference('ProtoGeometry')
from Autodesk.DesignScript.Geometry import *

# Import RevitAPI
clr.AddReference("RevitAPI")
import Autodesk
from Autodesk.Revit.DB import *

clr.AddReference("RevitServices")
import RevitServices
from RevitServices.Persistence import DocumentManager
from RevitServices.Transactions import TransactionManager

from System.Collections.Generic import *

clr.AddReference('RevitNodes')
import Revit
clr.ImportExtensions(Revit.Elements)
clr.ImportExtensions(Revit.GeometryConversion)

from System import Guid

import System

import sys
pyt_path = r'C:\Program Files (x86)\IronPython 2.7\Lib'
sys.path.append(pyt_path)

import os.path

doc = DocumentManager.Instance.CurrentDBDocument
uiapp = DocumentManager.Instance.CurrentUIApplication
app = uiapp.Application

outerlist = []
transData = IN[0]
#transData = TransmissionData.ReadTransmissionData(check)

erefids = transData.GetAllExternalFileReferenceIds()
refdata = []
for x in erefids:
	refdata.append(transData.GetDesiredReferenceData(x))

currentpaths, currenterefType, currenterefPath, pstr = [], [], [], []

for e in refdata:
	currentpaths.append(ExternalFileReference.GetAbsolutePath(e))
	currenterefType.append(e.ExternalFileReferenceType)
	currenterefPath.append(e.PathType)
for s in currentpaths:
	pstr.append(ModelPathUtils.ConvertModelPathToUserVisiblePath(s))
	
filenames = []
for p in pstr:
	templist = os.path.split(p)
	filenames.append(templist[1])
	
outerlist.append(pstr)
outerlist.append(filenames)
outerlist.append(currenterefPath)
OUT = outerlist
# ----------------------------------------
OUT = Output(python_script)
