# Dynamo custom node Get Element from Doc using Element Id.dyf (Dynamo 0.8.2.2371)
# category: Bakery.Revit.Document.Links
# slow way to go

linkdoc = Input(linkdoc : var[]..[])
get_all_family_instances_from = Custom[Get All Family Instances From Link Doc](linkdoc=linkdoc)
AllElements = Output(get_all_family_instances_from)

# group: ALL!
watch = Watch(get_all_family_instances_from)

id = Element.Id(watch)
elementId = Input()
bv_all_indices_of_that_can = Custom[bv All Indices Of that can handle Nulls](list=id, value=elementId)  # forked from spring nodes
flatten = Flatten(bv_all_indices_of_that_can)
getItemAtIndex = List.GetItemAtIndex(list=watch, index=flatten)
Matching = Output(getItemAtIndex)
