# Dynamo custom node Get ElementTree object from XML File Path.dyf (Dynamo 0.8.2.2392)
# category: Bakery.Data.XML
# this may break with utf8

xml_File_Path = Input()
python_script = Python(IN[0]=xml_File_Path)
# ---------- python_script.python (24 lines) ----------
import clr
import sys
sys.path.append("C:\Program Files (x86)\IronPython 2.7\Lib")
#from xml.parsers.expat import expat -- can't find this
import xml.etree.ElementTree as ET
import json
from io import StringIO, BytesIO
#import os
#import datetime
clr.AddReference('ProtoGeometry')
from Autodesk.DesignScript.Geometry import *
#The inputs to this node will be stored as a list in the IN variables.
#tree = ElementTree()
xmlFile = IN[0]
#xmlObj = IN[1]
#xmStr = str(xmlFile)
#xmlparser.ParseFile(xmlObj) - needs expat
#tree.parse(xmStr)
#parser = ElementTree.XMLParser(ns_clean=True)
xmTree = ET()
xmParsed = xmTree.parse(xmlFile)
#root = xmTree.getroot()

OUT = xmTree
# ----------------------------------------
ElementTree = Output(python_script)
watch = Watch(xml_File_Path)
