# Dynamo custom node Get Elements By Workset Id.dyf (Dynamo 1.2.1.3083)
# category: Bakery.Revit.Document.Worksets

WORKSETID = Input()
python_script = Python(IN[0]=WORKSETID)
# ---------- python_script.python (39 lines) ----------
import clr
clr.AddReference('ProtoGeometry')
from Autodesk.DesignScript.Geometry import *

# Import RevitAPI
clr.AddReference("RevitAPI")
import Autodesk
from Autodesk.Revit.DB import *

clr.AddReference("RevitServices")
import RevitServices
from RevitServices.Persistence import DocumentManager
from RevitServices.Transactions import TransactionManager

from System.Collections.Generic import *

clr.AddReference('RevitNodes')
import Revit
clr.ImportExtensions(Revit.Elements)
clr.ImportExtensions(Revit.GeometryConversion)

from System import Guid

import System

import sys
pyt_path = r'C:\Program Files (x86)\IronPython 2.7\Lib'
sys.path.append(pyt_path)

import os.path

doc = DocumentManager.Instance.CurrentDBDocument
uiapp = DocumentManager.Instance.CurrentUIApplication
app = uiapp.Application

worksetId = IN[0]
worksetFilter = ElementWorksetFilter(worksetId)
collector = FilteredElementCollector(doc).WherePasses(worksetFilter).ToElements()
OUT = collector
# ----------------------------------------
elements = Output(python_script)
