# Dynamo custom node Get Elements Parameter List and Show Unique Values.dyf (Dynamo 0.8.0.950)
# category: Bakery.Revit.Parameters
# designed to work with Revit Links and return the link name

elementList = Input()
parameterToGet = Input()
code_block = CodeBlock { "noValue"; }
bruteforce_get_parameter_value = Custom[Bruteforce Get Parameter Value by Name](element_or_elements=elementList, parameterName=parameterToGet, replaceEmptyValueWith=code_block)  # If Element.Parameters shows a value, this node will search for it and return the value or an optional empty value replacement.
code_block_2 = CodeBlock { ": "; }
split = String.Split(arg1=code_block_2)
map = List.Map(list=bruteforce_get_parameter_value.BruteForceValues, f_x=split)
lastItem = List.LastItem()
map_2 = List.Map(list=map, f_x=lastItem)
flatten = Flatten(map_2)
sort = List.Sort(flatten)
uniqueItems = List.UniqueItems(sort)
uniqueValues = Output(uniqueItems)
