# Dynamo custom node Get Elements Related by Constraint.dyf (Dynamo 1.3.0.875)
# category: Bakery.Revit.Elements.Dimension

all_constraints_in_current = Custom[All Constraints in Current Document]()
references = Custom[Dimension.References]()  # unwired: dimension
map = List.Map(list=all_constraints_in_current, f_x=references.referenceElements)
watch = Watch(map)
id = Element.Id(watch)
element = Input()
watch_2 = Watch(element)
id_2 = Element.Id(watch_2)
get_indices_where_sublists = Custom[Get Indices Where Sublists Contain Item](listWithSublists=id, itemToFindInSublist=id_2)
getItemAtIndex = List.GetItemAtIndex(list=watch, index=get_indices_where_sublists)
watch_3 = Watch(getItemAtIndex)
elementSets = Output(watch_3)
flatten = Flatten(watch_3)
turnIntoList = Custom[TurnIntoList](unknownItem=watch_2)  # Turns an element (or a nested list) into a flat list
removeListFromList = Custom[RemoveListFromList](List_A=flatten, List_B=turnIntoList)  # This node essentially "subtracts" the contents of List B from List A to produce a new list with the unique items.
relatedElementsOnly = Output(removeListFromList)
getItemAtIndex_2 = List.GetItemAtIndex(list=all_constraints_in_current, index=get_indices_where_sublists)
constraints = Output(getItemAtIndex_2)
