# Dynamo custom node Get Elements from Link Document Using Category.dyf (Dynamo 0.8.2.2371)
# category: Bakery.Revit.Selection

Link_Document = Input()
builtInName = Input()
python_script = Python(IN[0]=Link_Document, IN[1]=builtInName)
# ---------- python_script.python (39 lines) ----------
#python nodes in dynamo 0.7
#proposed by Julien Benoit @jbenoit44 
#http://aecuandme.wordpress.com/
import System
import clr
clr.AddReference('ProtoGeometry')
from Autodesk.DesignScript.Geometry import *
# Import ToDSType(bool) extension method
clr.AddReference("RevitNodes")
import Revit
clr.ImportExtensions(Revit.Elements)
# Import geometry conversion extension methods
clr.ImportExtensions(Revit.GeometryConversion)
# Import DocumentManager and TransactionManager
clr.AddReference("RevitServices")
import RevitServices
from RevitServices.Persistence import DocumentManager
from RevitServices.Transactions import TransactionManager
from System.Collections.Generic import *
# Import RevitAPI
clr.AddReference("RevitAPI")
import Autodesk
from Autodesk.Revit.DB import *

doc = DocumentManager.Instance.CurrentDBDocument
uiapp = DocumentManager.Instance.CurrentUIApplication
app = uiapp.Application
uidoc=DocumentManager.Instance.CurrentUIApplication.ActiveUIDocument

LinkDoc=IN[0]
BuiltIn = IN[1]
#BuiltIn = System.Enum.ToObject(BuiltInCategory, cat.Id)

collector = FilteredElementCollector(LinkDoc)
filter = ElementCategoryFilter(BuiltIn)
list=collector.WherePasses(filter).WhereElementIsNotElementType().ToElements()


OUT = list
# ----------------------------------------
Element_s = Output(python_script)  # "Element(s)"
