# Dynamo custom node Get Elements in Links For Multiple Categories.dyf (Dynamo 0.8.2.2371)
# category: Bakery.Revit.Selection
# takes list of category names and a link name wildcard

listOfCategoryNames = Input(listOfCategoryNames : var[]..[])
flatten = Flatten(listOfCategoryNames)
string_from_object = FromObject(flatten)
convert_category_name_to_built = Custom[Convert Category Name to Built In Category Name]()  # You must use List.Map to convert list of Category Names to list of Built In Names
map = List.Map(list=string_from_object, f_x=convert_category_name_to_built)
flatten_2 = Flatten(map)
SearchLinkNames = Input(SearchLinkNames : var[]..[])
get_elements_in_link_using_name = Custom[Get Elements in Link using Name Search and Category](SearchLinkNames=SearchLinkNames)  # link name search
map_2 = List.Map(list=flatten_2, f_x=get_elements_in_link_using_name.ElementsFlatList)
watch = Watch(map_2)
mappedList = Output(watch)
flatten_3 = Flatten(watch)
ElementsFlatList = Output(flatten_3)
