# Dynamo custom node Get External File References and Details.dyf (Dynamo 0.8.2.2371)
# category: Bakery.Links
# including date modified

current_document = Custom[Current Document]()  # Retrieves Current Document
python_script = Python(IN[0]=current_document)
# ---------- python_script.python (43 lines) ----------
import clr
clr.AddReference('ProtoGeometry')
from Autodesk.DesignScript.Geometry import *

# Import DocumentManager and TransactionManager
clr.AddReference("RevitServices")
import RevitServices
from RevitServices.Persistence import DocumentManager
from RevitServices.Transactions import TransactionManager

from System.Collections.Generic import *

# Import RevitAPI
clr.AddReference("RevitAPI")
import Autodesk
from Autodesk.Revit.DB import *
from Autodesk.Revit.DB.Analysis import *

doc = DocumentManager.Instance.CurrentDBDocument
uiapp = DocumentManager.Instance.CurrentUIApplication
app = uiapp.Application

# Import ToDSType(bool) extension method
clr.AddReference("RevitNodes")
import Revit
clr.ImportExtensions(Revit.Elements)

#The inputs to this node will be stored as a list in the IN variable.
docElem = IN[0]

fileref = ExternalFileUtils.GetAllExternalFileReferences(docElem)
erefs, paths, pstr, erefType, erefPath = [], [], [], [], []
for f in fileref:
	erefs.append(ExternalFileUtils.GetExternalFileReference(docElem, f))

for e in erefs:
	paths.append(ExternalFileReference.GetAbsolutePath(e))
	erefType.append(e.ExternalFileReferenceType)
	erefPath.append(e.PathType)
for s in paths:
	pstr.append(ModelPathUtils.ConvertModelPathToUserVisiblePath(s))

OUT = fileref, erefs, paths, pstr, erefType, erefPath
# ----------------------------------------
code_block = CodeBlock { 0; }
getItemAtIndex = List.GetItemAtIndex(list=python_script, index=code_block)
externalReferenceIds = Output(getItemAtIndex)
code_block_2 = CodeBlock { 1; }
getItemAtIndex_2 = List.GetItemAtIndex(list=python_script, index=code_block_2)
externalReferenceObjects = Output(getItemAtIndex_2)
code_block_3 = CodeBlock { 2; }
getItemAtIndex_3 = List.GetItemAtIndex(list=python_script, index=code_block_3)
filePathObjects = Output(getItemAtIndex_3)
id_to_element = Custom[Id to Element](Id_s=getItemAtIndex, Doc=current_document)  # Selects elements in a model from id input (ElementId, string, integer or GUID)
asElements = Output(id_to_element)
code_block_4 = CodeBlock { "Type Name"; }
getParameterValueByName = Element.GetParameterValueByName(element=id_to_element, parameterName=code_block_4)
typeNames = Output(getParameterValueByName)
code_block_5 = CodeBlock { 3; }
getItemAtIndex_4 = List.GetItemAtIndex(list=python_script, index=code_block_5)
path_as_human_readable = Output(getItemAtIndex_4)
get_date_modified_from_file_path = Custom[Get Date Modified From File Path List](filePathList=getItemAtIndex_4)  # list of paths to files
datesModified = Output(get_date_modified_from_file_path)
code_block_6 = CodeBlock { 4; }
getItemAtIndex_5 = List.GetItemAtIndex(list=python_script, index=code_block_6)
referenceType = Output(getItemAtIndex_5)
code_block_7 = CodeBlock { 5; }
getItemAtIndex_6 = List.GetItemAtIndex(list=python_script, index=code_block_7)
PathTypes = Output(getItemAtIndex_6)
