# Dynamo custom node Get Family and Type List for Project.dyf (Dynamo 1.2.1.3083)
# category: Bakery.Revit.Elements.Family

# group: Grab Types
get_family_list_for_this_project = Custom[Get Family List for this project]()
types = Family.Types(get_family_list_for_this_project)

generate_family_type_name_string = Custom[Generate Family--Type Name String From Types](familyTypeList=types)
watch = Watch(generate_family_type_name_string.Types)
Type_List = Output(watch)
Family_Type_string = Output(generate_family_type_name_string.Family_Type_string)  # "Family---Type string"
Family_List = Output(generate_family_type_name_string.Families)
