# Dynamo custom node Get Family from Element.dyf (Dynamo 0.8.1.1942)
# category: Bakery.Revit.Elements.Family
# NOT WORKING

oneElement = Input()
symbol = FamilyInstance.Symbol(oneElement)
family = FamilySymbol.Family(symbol)
Family = Output(family)
