# Dynamo custom node Get File Size and Date Modified using RVT Link Filename.dyf (Dynamo 0.8.2.2371)
# category: Bakery.Revit.Document.Links

listOfFilenames = Input()
watch = Watch(listOfFilenames)
flat_list_to_list_of_strings = Custom[Flat List to List of Strings](Original_List=watch)  # using python methods
filenames = Output(flat_list_to_list_of_strings)
get_external_file_references_and = Custom[Get External File References and Details]()  # including date modified
if_equal_return_index_using = Custom[If Equal Return Index using IndexOf](searchForThese=watch, inThisList=get_external_file_references_and.typeNames)
getItemAtIndex = List.GetItemAtIndex(list=get_external_file_references_and.datesModified, index=if_equal_return_index_using)
watch_2 = Watch(getItemAtIndex)
flat_list_to_list_of_strings_2 = Custom[Flat List to List of Strings](Original_List=watch_2)
dates_modified = Output(flat_list_to_list_of_strings_2)
getItemAtIndex_2 = List.GetItemAtIndex(list=get_external_file_references_and.path_as_human_readable, index=if_equal_return_index_using)
get_file_sizes_from_file_path = Custom[Get File Sizes from File Path List](filePathList=getItemAtIndex_2)
string_from_object = FromObject(get_file_sizes_from_file_path.fileSizesInBytes)
toNumber = String.ToNumber(string_from_object)
code_block = CodeBlock(x=toNumber) { x/1024; }
list_of_float_double_to_list_of = Custom[List of float double to list of Int](double=code_block)  # no decimals
string_from_object_2 = FromObject(list_of_float_double_to_list_of)
string = StringInput(" ")
code_block_2 = CodeBlock { "KB"; }
join = String.Join(string, arg2=code_block_2, lacing=Longest)
map = List.Map(list=string_from_object_2, f_x=join)
watch_3 = Watch(map)
flat_list_to_list_of_strings_3 = Custom[Flat List to List of Strings](Original_List=watch_3)
file_sizes_in_KB = Output(flat_list_to_list_of_strings_3)
