# Dynamo custom node Get Filename List From File Path List.dyf (Dynamo 1.2.1.3083)
# category: Bakery.Core.String

listOfPaths = Input()
string = StringInput("\")
split = String.Split(listOfPaths, string)
lastItem = List.LastItem()  # unwired: arg0
map = List.Map(list=split, f_x=lastItem)
fileNameList = Output(map)
