# Dynamo custom node Get First Line of One File.dyf (Dynamo 1.2.1.3083)
# category: Bakery.Core

file = Input(file : var)
readText = File.ReadText(file)
convert_string_with_line_breaks = Custom[Convert String with Line Breaks into List of Strings](string=readText)
firstItem = List.FirstItem(convert_string_with_line_breaks)
item = Output(firstItem)
