# Dynamo custom node Get Floor Type By Thickness.dyf (Dynamo 1.2.0.2690)
# category: Bakery.Revit.Elements.Family

string = StringInput("Floors")
get_system_type_list_by_category = Custom[Get System Type List by Category Name](categoryName=string)  # takes category name as string
watch = Watch(get_system_type_list_by_category)
code_block = CodeBlock { "Default Thickness"; }
getParameterValueByName = Element.GetParameterValueByName(element=watch, parameterName=code_block)
thickness = Input()
bv_all_indices_of = Custom[bv All Indices Of](list=getParameterValueByName, indices=thickness)  # forked from Rhythm
firstItem = List.FirstItem(bv_all_indices_of)
getItemAtIndex = List.GetItemAtIndex(list=watch, index=firstItem)
floorType = Output(getItemAtIndex)
