# Dynamo custom node Get Grids and Save to Selection Set.dyf (Dynamo 0.9.2.4472)
# category: Bakery.Revit.Selection

get_current_model_datum = Custom[Get Current Model Datum Information]()  # including base points, grids, levels
watch = Watch(get_current_model_datum.grid_elements)
currentGridElements = Output(watch)
selectionSetName = Input(selectionSetName : string)
byElements = Custom[SelectionSet.ByElements](Name=selectionSetName, elements=watch)  # Creates a selection set of the given elements. Note that if a selection set of the given name already exists in the model, its contents will be replaced. Also, if the selection set is already applied as a view filter, the view filter will have to be manually updated in the visibility / graphic overrides. DO ***NOT*** USE IN AUTOMATIC MODE!
newSelectionSet = Output(byElements)
