# Dynamo custom node Get Imported Object Styles.dyf (Dynamo 0.9.1.4062)
# category: Bakery.Revit.Document.Imports
# original code by Konrad

code_block = CodeBlock { "Imports in Families"; true; }
code_block_2 = CodeBlock { ".dwg"; false; }
code_block_3 = CodeBlock()
# ---------- code_block_3.designscript (45 lines) ----------
"import clr
clr.AddReference('ProtoGeometry')
from Autodesk.DesignScript.Geometry import *

clr.AddReference('RevitServices')
import RevitServices
from RevitServices.Persistence import DocumentManager

clr.AddReference('RevitAPI')
import Autodesk
from Autodesk.Revit.DB import *

doc = DocumentManager.Instance.CurrentDBDocument

dataEnteringNode = IN
catName = IN[0]
nameEquals = IN[1]

gStyles = FilteredElementCollector(doc).OfClass(GraphicsStyle).ToElements()

if nameEquals:
 for i in gStyles:
  if i.GraphicsStyleCategory.Name == str(catName):
   gStyleCategory = i.GraphicsStyleCategory
   break
  else:
   continue
 gStyleSubCategories = gStyleCategory.SubCategories
 gStyleSubCategoriesList = []
 for i in gStyleSubCategories:
  gStyleSubCategoriesList.append(i.Name)
 OUT = gStyleSubCategoriesList
else:
 gStyleCategoryList = []
 for i in gStyles:
  if str(catName) in i.GraphicsStyleCategory.Name:
   gStyleCategoryList.append(i.GraphicsStyleCategory)
 gStyleSubCategories = []
 for i in gStyleCategoryList:
  gStyleSubCategories.append(i.SubCategories)
 gStyleSubCategoriesList = [[] for i in range(0, len(gStyleSubCategories))]
 for index, item in enumerate(gStyleSubCategories):
  for j in item:
   gStyleSubCategoriesList[index].append(j.Name)
 OUT = gStyleSubCategoriesList";
# ----------------------------------------
Search_for = Input()
False_for_catch_more = Input()
python_script_from_string = PythonStringNode(script=code_block_3, IN[0]=Search_for, IN[1]=False_for_catch_more)
watch = Watch(python_script_from_string)
list = Output(python_script_from_string)
code_block_4 = CodeBlock { "ARCH3"; false; }
