# Dynamo custom node Get Info from a Linked Element Tag.dyf (Dynamo 0.8.2.2371)
# category: Bakery.Revit.Elements.Tag
# use with List.Map

oneLinkTag = Input()
python_script = Python(IN[0]=oneLinkTag)
# ---------- python_script.python (31 lines) ----------
#Copyright(c) 2015, Konrad K Sobon
# @arch_laboratory, http://archi-lab.net

import clr
clr.AddReference('ProtoGeometry')
from Autodesk.DesignScript.Geometry import *

# Import DocumentManager and TransactionManager
clr.AddReference("RevitServices")
import RevitServices
from RevitServices.Persistence import DocumentManager
from RevitServices.Transactions import TransactionManager

doc = DocumentManager.Instance.CurrentDBDocument
uiapp = DocumentManager.Instance.CurrentUIApplication
app = uiapp.Application

# Import RevitAPI
clr.AddReference("RevitAPI")
import Autodesk
from Autodesk.Revit.DB import *

#The inputs to this node will be stored as a list in the IN variable.
elt = IN[0]
temp = UnwrapElement(elt)
tei = temp.TaggedElementId
tel = tei.LinkedElementId
teinst = tei.LinkInstanceId
elteq = elt

OUT = tei, tel, teinst, elteq
# ----------------------------------------
tagProps = Output(python_script)
