# Dynamo custom node Get Link Document from Link Name.dyf (Dynamo 0.8.2.2371)
# category: Bakery.Links

get_linked_rvt_documents = Custom[Get Linked RVT Documents]()
code_block = CodeBlock { "replacedNull"; }
replaceNulls = Lists.Manage.ReplaceNulls(get_linked_rvt_documents.Link_Doc, code_block)
clean_link_name_list = Custom[Clean Link Name List](name_list=get_linked_rvt_documents.Link_Name)
searchFor = Input(searchFor : string)
startsWith = String.StartsWith(str=clean_link_name_list, searchFor=searchFor)
watch = Watch(startsWith)
code_block_2 = CodeBlock { true; }
firstIndexOf = List.FirstIndexOf(list=watch, item=code_block_2)
getItemAtIndex = List.GetItemAtIndex(list=replaceNulls, index=firstIndexOf)
watch_2 = Watch(getItemAtIndex)
firstItem = List.FirstItem(watch_2)
item = Output(firstItem)
