# Dynamo custom node Get Link Instance by Name.dyf (Dynamo 1.2.1.3083)
# category: Bakery.Revit.Document.Links

get_linked_rvt_documents = Custom[Get Linked RVT Documents]()
clean_link_name_list = Custom[Clean Link Name List](name_list=get_linked_rvt_documents.Link_Name)
shortNameExt = Input()
bv_all_indices_of = Custom[bv All Indices Of](list=clean_link_name_list, indices=shortNameExt)  # forked from Rhythm
firstItem = List.FirstItem(bv_all_indices_of)
getItemAtIndex = List.GetItemAtIndex(list=get_linked_rvt_documents.Link_Instance, index=firstItem)
item = Output(getItemAtIndex)
