# Dynamo custom node Get Linked Element Type from Mapped doc element lists.dyf (Dynamo 0.8.2.2371)
# category: Bakery.Revit.Document.Links

mapped_element_list_divided_by_doc = Input()
watch = Watch(mapped_element_list_divided_by_doc)
flatten = Flatten(watch)
watch_2 = Watch(flatten)
count = Count(watch_2)
code_block = CodeBlock(x=count) { 0..(x-1); }
list_of_link_docs = Input()
count_2 = List.Count()
map = List.Map(list=watch, f_x=count_2)
cycle_entries_of_one_list_by = Custom[Cycle Entries of one List by List of Lengths](listToCycle=list_of_link_docs, listOfLengths=map)
flatten_2 = Flatten(cycle_entries_of_one_list_by)
element_type_for_linked_file = Custom[Element Type for Linked File Large Lists](elementList=watch_2, docList=flatten_2)
map_2 = List.Map(list=code_block, f_x=element_type_for_linked_file)
flatten_3 = Flatten(map_2)
flatted_type_list = Output(flatten_3)
