# Dynamo custom node Get Linked Element from Element Id and Doc.dyf (Dynamo 0.8.2.2371)
# category: Bakery.Links

Link_Name_string = Input()
watch = Watch(Link_Name_string)
get_link_document_from_link_name = Custom[Get Link Document from Link Name](searchFor=watch)
Document = Output(get_link_document_from_link_name)
get_all_family_instances_from = Custom[Get All Family Instances From Link Doc](linkdoc=get_link_document_from_link_name)

# group: ALL!
watch_2 = Watch(get_all_family_instances_from)

id = Element.Id(watch_2)
Element_Ids = Input()
bv_all_indices_of_that_can = Custom[bv All Indices Of that can handle Nulls](list=id, value=Element_Ids)  # forked from spring nodes
flatten = Flatten(bv_all_indices_of_that_can)
getItemAtIndex = List.GetItemAtIndex(list=watch_2, index=flatten)
Element = Output(getItemAtIndex)
location = FamilyInstance.Location(getItemAtIndex)
Point = Output(location)

# group: STARTED GETTING SYSTEM FAMILIES
string = StringInput("Air Terminals")
create = List.Create(string)
convert_category_name_to_built = Custom[Convert Category Name to Built In Category Name](categoryName=create)  # You must use List.Map to convert list of Category Names to list of Built In Names
get_elements_from_link_document = Custom[Get Elements from Link Document Using Category](Link_Document=get_link_document_from_link_name)
map = List.Map(list=convert_category_name_to_built, f_x=get_elements_from_link_document)
flatten_2 = Flatten(map)
create_2 = List.Create(get_all_family_instances_from, flatten_2)
flatten_3 = Flatten(create_2)
