# Dynamo custom node Get Linked Elements by Id and Doc.dyf (Dynamo 0.8.2.2371)
# category: Bakery.Revit.Document.Links

elementIdList = Input()
watch = Watch(elementIdList)
oneLinkDoc = Input()
python_script = Python(IN[0]=elementIdList, IN[1]=oneLinkDoc)
# ---------- python_script.python (61 lines) ----------
#python nodes in dynamo 0.7
#proposed by Julien Benoit @jbenoit44 
#http://aecuandme.wordpress.com/
import clr
clr.AddReference('ProtoGeometry')
from Autodesk.DesignScript.Geometry import *

# Import ToDSType(bool) extension method
clr.AddReference("RevitNodes")
import Revit
clr.ImportExtensions(Revit.Elements)

# Import DocumentManager and TransactionManager
clr.AddReference("RevitServices")
import RevitServices
from RevitServices.Persistence import DocumentManager
from RevitServices.Transactions import TransactionManager

from System.Collections.Generic import *

# Import RevitAPI
clr.AddReference("RevitAPI")
import Autodesk

doc = IN[1]
#doc = DocumentManager.Instance.CurrentDBDocument
uiapp = DocumentManager.Instance.CurrentUIApplication
app = uiapp.Application

#The inputs to this node will be stored as a list in the IN variable.
dataEnteringNode = IN

#unwrap all elements to use with API
elementIds = IN[0]

elementlist = list()
faillist = list()
failIdlist = list()
for item in elementIds:
	try:
		elementlist.append(doc.GetElement(item))
	except:
		#faillist.append(str(item) + " --- No matching element found for this id")
		elementlist.append(item)
		failIdlist.append(item)
#    for source in item:#    .GetSourceElementIds():
#        sourcelist.append(source)
        
#    if len(sourcelist) < 2:
#       elementlist.append(sourcelist[0])
#   else:
#        elementlist.append(sourcelist)



# "End" the transaction
#TransactionManager.Instance.TransactionTaskDone()


#Assign your output to the OUT variable
OUT = elementlist, failIdlist
# ----------------------------------------
firstItem = List.FirstItem(python_script)
watch_2 = Watch(firstItem)
lastItem = List.LastItem(python_script)
watch_3 = Watch(lastItem)
bv_all_indices_of_that_can = Custom[bv All Indices Of that can handle Nulls](list=watch_2, value=watch_3)  # forked from spring nodes
code_block = CodeBlock { null; }
bv_all_indices_of_that_can_2 = Custom[bv All Indices Of that can handle Nulls](list=watch_2, value=code_block)
create = List.Create(bv_all_indices_of_that_can, bv_all_indices_of_that_can_2)
flatten = Flatten(create)
removeItemAtIndex = List.RemoveItemAtIndex(list=watch, indices=flatten)
foundIds = Output(removeItemAtIndex)
foundElements = Output(watch_2)
getItemAtIndex = List.GetItemAtIndex(list=watch, index=flatten)
failedIds = Output(getItemAtIndex)
removeItemAtIndex_2 = List.RemoveItemAtIndex(list=watch_2, indices=flatten)
foundElementsCleaned = Output(removeItemAtIndex_2)
