# Dynamo custom node Get List of Linked Elements from Id and Doc.dyf (Dynamo 0.8.2.2371)
# category: Bakery.Links

element_ID_list = Input()
counter = Input()
getItemAtIndex = List.GetItemAtIndex(list=element_ID_list, index=counter)
link_doc_list = Input()
getItemAtIndex_2 = List.GetItemAtIndex(list=link_doc_list, index=counter)
get_linked_element_from_element = Custom[Get Linked Element from Element Id and Doc](oneElemId=getItemAtIndex, oneDoc=getItemAtIndex_2)
element = Output(get_linked_element_from_element)
