# Dynamo custom node Get List of Open Revit Documents.dyf (Dynamo 0.9.1.4062)
# category: Bakery.Application (BETA)
# BETA!! crashes next dynamo instance. https://github.com/DynamoDS/Dynamo/issues/6083

python_script = Python()
# ---------- python_script.python (60 lines) ----------
#LSJ

import clr
#clr.AddReference('ProtoGeometry')
#from Autodesk.DesignScript.Geometry import *

# Import DocumentManager
clr.AddReference("RevitServices")
#import RevitServices
from RevitServices.Persistence import DocumentManager
#from RevitServices.Transactions import TransactionManager

# Import RevitAPI
#clr.AddReference("RevitAPI")
#import Autodesk

# Import ToDSType(bool) extension method
#clr.AddReference("RevitNodes")
#import Revit
#from Autodesk.Revit.DB import *
#clr.ImportExtensions(Revit.Elements)

#import System

#The inputs to this node will be stored as a list in the IN variable.
#doc = docToUse
#uiapp = DocumentManager.Instance.CurrentUIApplication
doc = DocumentManager.Instance.CurrentDBDocument
app = DocumentManager.Instance.CurrentUIApplication.Application

#TransactionManager.Instance.EnsureInTransaction(doc)
docList = app.Documents
for z in app.Documents:
	try:
		Dispose(z)
	except:
		pass
stringlist = []
pathlist = []
for d in docList:
	try:
		stringlist.append(d.Title)
	except:
		stringlist.append("Title not found")
for e in docList:
	try:
		pathlist.append(d.PathName)
	except:
		pathlist.append("Path not found")
#TransactionManager.Instance.TransactionTaskDone()
try:
	Dispose(app)
except:
	pass
try:
	Dispose(doc)
except:
	pass
OUT = docList, stringlist, pathlist#.DocumentSet
del docList
# ----------------------------------------
code_block = CodeBlock(list=python_script) { list[0]; }
doc_objects = Output(code_block)
code_block_2 = CodeBlock(list=python_script) { list[1]; }
Titles = Output(code_block_2)
code_block_3 = CodeBlock(list=python_script) { list[2]; }
Path_Names = Output(code_block_3)
