# Dynamo custom node Get Location Point and add Z offset.dyf (Dynamo 0.8.2.2392)
# category: Bakery.Revit.Elements

element = Input(element : var[]..[])
location = Custom[Element.Location](element=element)  # Returns the location of an element as an XYZ (or if it's line-based the start and end point of the line), along with some booleans to help filtering the results. Use this for some element types (e.g. walls or lines) that do not work with the built-in Get Family Instance Location node.
watch = Watch(location.points)
deconstructPoint = Geometry.Points.DeconstructPoint(watch)
watch_2 = Watch(deconstructPoint.out2)
z_offset = Input()
code_block = CodeBlock(x=watch_2, o=z_offset) { x+o; }
byCoordinates = Point.ByCoordinates(x=deconstructPoint.out0, y=deconstructPoint.out1, z=code_block)
Point = Output(byCoordinates)
