# Dynamo custom node Get Open Worksets and Write to View Parameter.dyf (Dynamo 0.8.2.2371)
# category: Bakery.Revit.Document

InputViewAsElement = Input()
targetParameter = Input()
get_open_worksets = Custom[Get Open Worksets]()  # as sorted list
watch = Watch(get_open_worksets)
string_from_array = FromArray(watch)
code_block = CodeBlock { ","; }
string = StringInput("\n")
replace = String.Replace(str=string_from_array, searchFor=code_block, replaceWith=string)
remove_first_and_last_characters = Custom[Remove First and Last Characters from String](stringIn=replace)
setParameterByName = Element.SetParameterByName(element=InputViewAsElement, parameterName=targetParameter, value=remove_first_and_last_characters)
done = Output(setParameterByName)
watch_2 = Watch(replace)
