# Dynamo custom node Get Parameter Value from Bounding Element.dyf (Dynamo 0.9.2.4472)
# category: Bakery.Revit.Elements

oneItem = Input()
bv_remove_nulls = Custom[bv Remove Nulls](List=oneItem)  # forked from Lunchbox
watch = Watch(bv_remove_nulls)
code_block = CodeBlock { "Number"; }
getParameterValueByName = Element.GetParameterValueByName(element=watch, parameterName=code_block)
from_list_of_bounding_elements = Input()
watch_2 = Watch(from_list_of_bounding_elements)
parameter_to_get = Input()
getParameterValueByName_2 = Element.GetParameterValueByName(element=watch_2, parameterName=parameter_to_get)
watch_3 = Watch(getParameterValueByName_2)
geometry = Element.Geometry(watch_2)
byGeometry = BoundingBox.ByGeometry(geometry)
location = Custom[Element.Location](element=watch)  # Returns the location of an element as an XYZ (or if it's line-based the start and end point of the line), along with some booleans to help filtering the results. Use this for some element types (e.g. walls or lines) that do not work with the built-in Get Family Instance Location node.
firstItem = List.FirstItem(location.points)
watch_4 = Watch(firstItem)
deconstructPoint = Geometry.Points.DeconstructPoint(watch_4)
watch_5 = Watch(deconstructPoint.out2)
code_block_2 = CodeBlock(x=watch_5) { x+1750; }
byCoordinates = Point.ByCoordinates(x=deconstructPoint.out0, y=deconstructPoint.out1, z=code_block_2)
firstItem_2 = List.FirstItem(byCoordinates)
contains = BoundingBox.Contains(byGeometry, firstItem_2, lacing=Longest)
code_block_3 = CodeBlock { true; }
firstIndexOf = List.FirstIndexOf(list=contains, item=code_block_3)
getItemAtIndex = List.GetItemAtIndex(list=watch_3, index=firstIndexOf)
item = Output(getItemAtIndex)
