# Dynamo custom node Get Parameter Value from First Item in List.dyf (Dynamo 0.9.1.4062)
# category: Bakery.Revit.Parameters
# takes parameter name and an element list, also checks if original list was empty

InputList = Input()
flatten = Flatten(InputList)
firstItem = List.FirstItem(flatten)
ParamName = Input()
getParameterValueByName = Element.GetParameterValueByName(element=firstItem, parameterName=ParamName)
watch = Watch(getParameterValueByName)
Desired_Param_Value_may_fail = Output(watch)  # "Desired Param Value (may fail)"
parameters = Element.Parameters(firstItem)
watch_2 = Watch(parameters)
Parameters_available = Output(watch_2)
count = List.Count(flatten)
number_slider = DoubleSlider(0, range=0..100 step 0.1)
eq = count == number_slider
string = StringInput("List was Empty")
string_2 = StringInput("List was Not Empty")
boolean_input_to_variable_string = Custom[Boolean Input to Variable Datatype Output](Boolean_In=eq, String_if_True=string, String_if_False=string_2)  # "Boolean Input to Variable String Output"; you choose what you want to convert true / false to, good for validation
watch_3 = Watch(boolean_input_to_variable_string)
Empty_Check = Output(watch_3)
eq_2 = boolean_input_to_variable_string == string
string_3 = StringInput("No Elements")
type = Custom[Element.Type](element=firstItem)  # Gets the family type of a given element (if applicable).
name = Family.Name(type)
boolean_input_to_variable_string_2 = Custom[Boolean Input to Variable Datatype Output](Boolean_In=eq_2, String_if_True=string_3, String_if_False=name)  # "Boolean Input to Variable String Output"
watch_4 = Watch(boolean_input_to_variable_string_2)
As_Family = Output(watch_4)
string_4 = StringInput("No Elements")
watch_5 = Watch(name)
boolean_input_to_variable_string_3 = Custom[Boolean Input to Variable Datatype Output](Boolean_In=eq_2, String_if_True=string_4, String_if_False=watch_5)  # "Boolean Input to Variable String Output"
watch_6 = Watch(boolean_input_to_variable_string_3)
Parameter_Value_validated = Output(watch_6)  # "Parameter Value (validated)"
watch_7 = Watch()
