# Dynamo custom node Get Percentage as String given Value and Total.dyf (Dynamo 0.8.2.2371)
# category: Bakery.Math

code_block = CodeBlock { " "; }
get_percentage_for_this = Input()
total = Input()
code_block_2 = CodeBlock(x=get_percentage_for_this, y=total) { x/y*100; }
turn_into_list = Custom[Turn Into List](item=code_block_2)  # Turns an element into a (flat) list
list_of_float_double_to_list_of = Custom[List of float double to list of Int](double=turn_into_list)  # no decimals
firstItem = List.FirstItem(list_of_float_double_to_list_of)
string_from_object = FromObject(firstItem)
code_block_3 = CodeBlock { "%"; }
join = String.Join(code_block, string_from_object, code_block_3)
percentage_as_string = Output(join)
