# Dynamo custom node Get Pure Filename from Revit Link Name String.dyf (Dynamo 0.8.2.2371)
# category: Bakery.Revit.Document.Links

LinkNames = Input()
code_block = CodeBlock { " : "; }
split = String.Split(LinkNames, code_block)
firstItem = List.FirstItem()
map = List.Map(list=split, f_x=firstItem)
watch = Watch(map)
FileNames = Output(watch)
