# Dynamo custom node Get RVT Link Filenames with Element and Type Workset Info.dyf (Dynamo 0.8.2.2371)
# category: Bakery.Links

rvtLinkInstances = Input()
watch = Watch(rvtLinkInstances)
workset = Custom[Element.Workset](Element_s=watch)  # Retrieves the workset of a given element
element_name_universal = Custom[Element Name Universal](Element_s=workset)  # Modified for 0.8.1
Instance_Worksets = Output(element_name_universal)
element_type_for_element_lists = Custom[Element Type for Element Lists](Element_s=watch)
workset_2 = Custom[Element.Workset](Element_s=element_type_for_element_lists)
element_name_universal_2 = Custom[Element Name Universal](Element_s=workset_2)
Type_Worksets = Output(element_name_universal_2)
element_name_universal_3 = Custom[Element Name Universal](Element_s=watch)
string = StringInput(" : ")
split = String.Split(element_name_universal_3, string)
firstItem = List.FirstItem()
map = List.Map(list=split, f_x=firstItem)
Filenames = Output(map)
Instance_Elements = Output(rvtLinkInstances)
