# Dynamo custom node Get Revit Link Names from an Element List.dyf (Dynamo 0.8.2.2392)
# category: Bakery.Revit.Document.Links

ElementList = Input()

# group: all elements in active view
watch = Watch(ElementList)

bv_get_category_name = Custom[bv Get Category Name](Elements=watch)  # forked from Blackbox
code_block = CodeBlock { "RVT Links"; }
eq = bv_get_category_name == code_block
filterByBoolMask = List.FilterByBoolMask(list=watch, mask=eq)
name = Element.Name(filterByBoolMask.in)
get_pure_filename_from_revit = Custom[Get Pure Filename from Revit Link Name String](LinkNames=name)
RevitLinkNames = Output(get_pure_filename_from_revit)
