# Dynamo custom node Get Revit Selection and Delete.dyf (Dynamo 0.8.2.2392)
# category: Bakery.Revit.Elements
# uses Eraser and Steamnodes, for deployment

bv_get_revit_selection = Custom[bv Get Revit Selection]()  # forked from SteamNodes package
bv_erase_or_delete_from_model = Custom[bv Erase or Delete from Model](Element_s=bv_get_revit_selection.Element)  # forked from SteamNodes
failures = Output(bv_erase_or_delete_from_model)
