# Dynamo custom node Get Shading Mode from Views.dyf (Dynamo 0.9.1.4062)
# category: Bakery.Revit.Views
# using built in parameter name

View_s = Input()  # "View(s)"
turnIntoList = Custom[Turn Into List](unknownItem=View_s)  # Turns an element (or a nested list) into a flat list
python_script = Python(IN[0]=turnIntoList)
# ---------- python_script.python (12 lines) ----------
import clr
clr.AddReference('RevitAPI')
from Autodesk.Revit.DB import *

views = UnwrapElement(IN[0])
elementlist = list()
for view in views:
	try:
		elementlist.append(str(view.DisplayStyle))
	except:
		elementlist.append('Undefined')
OUT = elementlist
# ----------------------------------------
returnListOrSingleValue = Custom[ReturnListOrSingleValue](unknownItem=turnIntoList, seq=python_script)  # If the item in input #1 is not a list, only the first item of the list in input #2 will be returned.
Shading_Mode_s = Output(returnListOrSingleValue)  # "Shading Mode(s)"
