# Dynamo custom node Get Sheet Element from View.dyf (Dynamo 0.8.2.2392)
# category: Bakery.Views

views = Input()
code_block = CodeBlock { "Sheet Number"; }
getParameterValueByName = Element.GetParameterValueByName(element=views, parameterName=code_block)
code_block_2 = CodeBlock { false; }
bv_collector_for_sheets = Custom[bv Collector for Sheets](name_s_number_s=getParameterValueByName, NameOrNumber=code_block_2)  # forked from spring nodes
sheets = Output(bv_collector_for_sheets.exact_match)
