# Dynamo custom node Get System Related Properties of Element.dyf (Dynamo 1.0.0.1180)
# category: Bakery.Revit.Elements.Properties
# use with List.Map

element = Input()
watch = Watch(element)
element_ids = Custom[Element Ids](Element_s=watch)  # This node will query an element id that can be used with Revit nodes. Dynamo Element Id node returns integer value.
firstItem = List.FirstItem(element_ids.Rvt_ElementId_s)
ID = Output(firstItem)
code_block = CodeBlock { "Category"; }
code_block_2 = CodeBlock { "no Category"; }
bruteforce_get_parameter_value = Custom[Bruteforce Get Parameter Value by Name](element_or_elements=watch, parameterName=code_block, replaceEmptyValueWith=code_block_2)  # If Element.Parameters shows a value, this node will search for it and return the value or an optional empty value replacement.
firstItem_2 = List.FirstItem(bruteforce_get_parameter_value.BruteForceValues)
Category = Output(firstItem_2)
code_block_3 = CodeBlock { "System Type"; }
getParameterValueByName = Element.GetParameterValueByName(element=watch, parameterName=code_block_3)
System_Type = Output(getParameterValueByName)
code_block_4 = CodeBlock { "System Name"; }
getParameterValueByName_2 = Element.GetParameterValueByName(element=watch, parameterName=code_block_4)
firstItem_3 = List.FirstItem(getParameterValueByName_2)
System_Name = Output(firstItem_3)
code_block_5 = CodeBlock { "System Classification"; }
getParameterValueByName_3 = Element.GetParameterValueByName(element=watch, parameterName=code_block_5)
firstItem_4 = List.FirstItem(getParameterValueByName_3)
System_Classification = Output(firstItem_4)
code_block_6 = CodeBlock { "Type"; }
code_block_7 = CodeBlock { "no Category"; }
bruteforce_get_parameter_value_2 = Custom[Bruteforce Get Parameter Value by Name](element_or_elements=watch, parameterName=code_block_6, replaceEmptyValueWith=code_block_7)
firstItem_5 = List.FirstItem(bruteforce_get_parameter_value_2.BruteForceValues)
Type = Output(firstItem_5)
code_block_8 = CodeBlock { "Category"; }
code_block_9 = CodeBlock { "no Category"; }
bruteforce_get_parameter_value_3 = Custom[Bruteforce Get Parameter Value by Name](element_or_elements=getParameterValueByName, parameterName=code_block_8, replaceEmptyValueWith=code_block_9)
firstItem_6 = List.FirstItem(bruteforce_get_parameter_value_3.BruteForceValues)
System_level_Category = Output(firstItem_6)  # "System-level Category"
code_block_10 = CodeBlock { "System Classification"; }
getParameterValueByName_4 = Element.GetParameterValueByName(element=getParameterValueByName, parameterName=code_block_10)
firstItem_7 = List.FirstItem(getParameterValueByName_4)
System_level_Classification = Output(firstItem_7)  # "System-level Classification"
code_block_11 = CodeBlock { "Type Name"; }
getParameterValueByName_5 = Element.GetParameterValueByName(element=getParameterValueByName, parameterName=code_block_11)
firstItem_8 = List.FirstItem(getParameterValueByName_5)
System_level_Type_Name = Output(firstItem_8)  # "System-level Type Name"
