# Dynamo custom node Get Tagged Linked Element Id.dyf (Dynamo 0.8.2.2371)
# category: Bakery.Revit.Elements.Tag

Tags = Input()
turnIntoList = Custom[Turn Into List](Tags)  # Turns an element into a (flat) list
get_info_from_a_linked_element = Custom[Get Info from a Linked Element Tag]()
map = List.Map(list=turnIntoList, f_x=get_info_from_a_linked_element)
tagInfoList = Output(map)
