# Dynamo custom node Get Text by View Workset and Value.dyf (Dynamo 0.8.2.2371)
# category: Bakery.2D

code_block = CodeBlock { "Text Notes"; }
turn_into_list = Custom[Turn Into List](item=code_block)  # Turns an element into a (flat) list
collect_elements_from_list_of = Custom[Collect Elements from List of Category Names](categoryNameList=turn_into_list)
workset = Custom[Element.Workset](Element_s=collect_elements_from_list_of.elements)  # Retrieves the workset of a given element
element_name_universal = Custom[Element Name Universal](Element_s=workset)  # Modified for 0.8.1
search_view_names = Input()
contains = String.Contains(str=element_name_universal, searchFor=search_view_names)
filterByBoolMask = List.FilterByBoolMask(list=collect_elements_from_list_of.elements, mask=contains)
watch = Watch(filterByBoolMask.in)
text = Custom[TextElement.Text](Element_s=watch)  # Gets the text stored in a text element (i.e. text node or model text)
search_text_values = Input()
contains_2 = String.Contains(str=text, searchFor=search_text_values)
filterByBoolMask_2 = List.FilterByBoolMask(list=watch, mask=contains_2)
in_ = Output(filterByBoolMask_2.in)  # "in"
