# Dynamo custom node Get This Dynamo Version.dyf (Dynamo 1.2.1.3083)
# category: Bakery.Standalone.DynamoMgmt

python_script = Python()
# ---------- python_script.python (6 lines) ----------
import clr
clr.AddReference('ProtoGeometry')
from Autodesk.DesignScript.Geometry import *
import System

OUT = System.Diagnostics.Process.GetCurrentProcess().MainModule.FileVersionInfo.FileVersion
# ----------------------------------------
version = Output(python_script)
