# Dynamo custom node Get Unique GUIDs from IFC File.dyf (Dynamo 1.1.0.2094)
# category: Bakery.BIM.IFC
# input is File Path to IFC

string = StringInput(",'ID(.*?)'")
path = Input()
fromPath = FileObject(path)  # "File.FromPath"
readText = File.ReadText(fromPath)
findRegularExpression = Custom[String.FindRegularExpression](RegEx=string, str=readText)  # Returns all occurences of a regular expression within a string (or list of strings). The syntax for regular expressions is explained at http://ironpython-test.readthedocs.org/en/latest/howto/regex.html
uniqueItems = List.UniqueItems(findRegularExpression)
unique_list_matching_NET = Output(uniqueItems)  # "unique list matching .NET"
total_list_matching_NET = Output(findRegularExpression)  # "total list matching .NET"
string_2 = StringInput("\('[a-zA-Z0-9]{22}'")
findRegularExpression_2 = Custom[String.FindRegularExpression](RegEx=string_2, str=readText)
code_block = CodeBlock { 0; }
code_block_2 = CodeBlock { 2; }
remove = String.Remove(str=findRegularExpression_2, startIndex=code_block, count=code_block_2)
code_block_3 = CodeBlock { 22; }
code_block_4 = CodeBlock { 1; }
remove_2 = String.Remove(str=remove, startIndex=code_block_3, count=code_block_4)
total_list_matching_IFC_format = Output(remove_2)
uniqueItems_2 = List.UniqueItems(remove_2)
unique_list_matching_IFC_format = Output(uniqueItems_2)
