# Dynamo custom node Get View Parameter and Check for File Dates and Sizes.dyf (Dynamo 0.8.2.2371)
# category: Bakery.Links

viewFromViewsList = Input()
id = Element.Id(viewFromViewsList)
current_document = Custom[Current Document]()  # Retrieves Current Document
id_to_element = Custom[Id to Element](Id_s=id, Doc=current_document)  # Selects elements in a model from id input (ElementId, string, integer or GUID)
firstItem = List.FirstItem(id_to_element)
parameterName = Input()
getParameterValueByName = Element.GetParameterValueByName(element=firstItem, parameterName=parameterName)
string = StringInput("\n")
split = String.Split(getParameterValueByName, string)
watch = Watch(split)
filenames_found = Output(watch)
