# Dynamo custom node Get Viewport Elements Using View Name Search.dyf (Dynamo 0.8.2.2392)
# category: Bakery.Revit.Views

code_block = CodeBlock { true; }
bv_collector_for_viewports = Custom[bv Collector for Viewports](RunMe=code_block)  # forked from Rhythm
viewNameContains = Input()
contains = String.Contains(str=bv_collector_for_viewports.ViewNames, searchFor=viewNameContains)
filterByBoolMask = List.FilterByBoolMask(list=bv_collector_for_viewports.Elements, mask=contains)
matchingViewports = Output(filterByBoolMask.in)
