# Dynamo custom node Get Views by Sheet Number Search.dyf (Dynamo 0.8.2.2371)
# category: Bakery.Revit.Views

sheetNumberContains = Input()
code_block = CodeBlock { false; }
bv_collector_for_sheets = Custom[bv Collector for Sheets](name_s_number_s=sheetNumberContains, NameOrNumber=code_block)  # forked from spring nodes
watch = Watch(bv_collector_for_sheets.partial_match)
views = Custom[Sheet.Views+](sheet_s=watch)  # Extracts all views placed on the input sheet(s). Will be depreciated once the bult in node works with all plan types.
flatten = Flatten(views)
viewsFound = Output(flatten)
