# Dynamo custom node Get Worksets with all Properties.dyf (Dynamo 1.0.0.1180)
# category: Bakery.Revit.Elements.Properties
# based on Konrad's, added some more properties of Worksets

current_document = Custom[Current Document]()  # Retrieves Current Document
python_script = Python(IN[0]=current_document)
# ---------- python_script.python (41 lines) ----------
#Copyright(c) 2015, Konrad Sobon
# @arch_laboratory, http://archi-lab.net

import clr
clr.AddReference('ProtoGeometry')
from Autodesk.DesignScript.Geometry import *

# Import DocumentManager
clr.AddReference("RevitServices")
import RevitServices
from RevitServices.Persistence import DocumentManager

# Import RevitAPI
clr.AddReference("RevitAPI")
import Autodesk

# Import ToDSType(bool) extension method
clr.AddReference("RevitNodes")
import Revit
from Autodesk.Revit.DB import *
clr.ImportExtensions(Revit.Elements)

#The inputs to this node will be stored as a list in the IN variable.
#doc = DocumentManager.Instance.CurrentDBDocument
uiapp = DocumentManager.Instance.CurrentUIApplication
app = uiapp.Application
doc = IN[0]

#create workset collector
userWorksets = FilteredWorksetCollector(doc).OfKind(WorksetKind.UserWorkset)
#extract workset's name and ids
names, ids, wsIsOpens, wsIsVis, wsIsDefault = [], [], [], [], []
for i in userWorksets:
	names.append(i.Name)
	ids.append(i.Id)
	wsIsOpens.append(i.IsOpen)
	wsIsVis.append(i.IsVisibleByDefault)
	wsIsDefault.append(i.IsDefaultWorkset)
	
#Assign your output to the OUT variable
OUT = userWorksets, names, ids, wsIsOpens, wsIsVis, wsIsDefault
# ----------------------------------------
number = DoubleInput(0)
getItemAtIndex = List.GetItemAtIndex(list=python_script, index=number)
Worksets = Output(getItemAtIndex)
number_2 = DoubleInput(2)
getItemAtIndex_2 = List.GetItemAtIndex(list=python_script, index=number_2)
Ids = Output(getItemAtIndex_2)
number_3 = DoubleInput(1)
getItemAtIndex_3 = List.GetItemAtIndex(list=python_script, index=number_3)
Names = Output(getItemAtIndex_3)
number_4 = DoubleInput(3)
getItemAtIndex_4 = List.GetItemAtIndex(list=python_script, index=number_4)
IsOpen = Output(getItemAtIndex_4)
number_5 = DoubleInput(4)
getItemAtIndex_5 = List.GetItemAtIndex(list=python_script, index=number_5)
VisibleByDefault = Output(getItemAtIndex_5)
number_6 = DoubleInput(5)
getItemAtIndex_6 = List.GetItemAtIndex(list=python_script, index=number_6)
IsDefaultWorkset = Output(getItemAtIndex_6)
