# Dynamo custom node Get XML Children Texts and Tags from XML Elements.dyf (Dynamo 0.8.2.2371)
# category: Bakery.XML

xml_elements = Input()
python_script = Python(IN[0]=xml_elements)
# ---------- python_script.python (34 lines) ----------
import clr
import sys
clr.AddReference('ProtoGeometry')
from Autodesk.DesignScript.Geometry import *
sys.path.append("C:\Program Files (x86)\IronPython 2.7\Lib")
#from xml.parsers.expat import expat -- can't find this
import xml.etree.ElementTree as ET
#The inputs to this node will be stored as a list in the IN variables.
xmElems = IN[0]

#xmParsed = xmTree.parse(xmlFile)
#root = xmTree.getroot()
subchildtags, subchildnums, subchildnames, childtexts = [], [], [], []
for elem in xmElems:
	try:
		subchildnums.append(len(elem.getchildren()))
	except:
		subchildnums.append(0)
	if elem.getchildren():
		subchildtags.append(str(elem.getchildren()))
		for x in elem.getchildren():
			subchildnames.append(x.tag)
			try:
				childtexts.append(x.text)
			except:
				childtexts.append("no texts")
	else:
		subchildtags.append("no children")
		subchildnames.append("no children")
		childtexts.append("no child texts")
#		if subchilds.tail:
#			subchildtexts.append(str(subchilds.tail)

OUT = subchildtags, subchildnums, subchildnames, childtexts
# ----------------------------------------
code_block = CodeBlock { 0; }
getItemAtIndex = List.GetItemAtIndex(list=python_script, index=code_block)
tags = Output(getItemAtIndex)
code_block_2 = CodeBlock { 1; }
getItemAtIndex_2 = List.GetItemAtIndex(list=python_script, index=code_block_2)
children_counts = Output(getItemAtIndex_2)
code_block_3 = CodeBlock { 3; }
getItemAtIndex_3 = List.GetItemAtIndex(list=python_script, index=code_block_3)
chopByLengths = Custom[List.ChopByLengths](lengths=getItemAtIndex_2, list=getItemAtIndex_3)  # Turns a list into a list of lists with sublists of varying lengths.
children_texts = Output(chopByLengths)
code_block_4 = CodeBlock { 2; }
getItemAtIndex_4 = List.GetItemAtIndex(list=python_script, index=code_block_4)
chopByLengths_2 = Custom[List.ChopByLengths](lengths=getItemAtIndex_2, list=getItemAtIndex_4)
children_names = Output(chopByLengths_2)
