# Dynamo custom node Get XML Element Names and Attributes.dyf (Dynamo 0.8.2.2371)
# category: Bakery.XML

xml_elements = Input()
python_script = Python(IN[0]=xml_elements)
# ---------- python_script.python (30 lines) ----------
import clr
import sys
clr.AddReference('ProtoGeometry')
from Autodesk.DesignScript.Geometry import *
sys.path.append("C:\Program Files (x86)\IronPython 2.7\Lib")
#from xml.parsers.expat import expat -- can't find this
import xml.etree.ElementTree as ET
#The inputs to this node will be stored as a list in the IN variables.
xmElems = IN[0]

#xmParsed = xmTree.parse(xmlFile)
#root = xmTree.getroot()
itertaglist, iterattriblist, attribnames, attribvals, itertexts = [], [], [], [], []
for elem in xmElems:
	itertaglist.append(elem.tag)
	if elem.keys():
		iterattriblist.append(len(elem.items()))
		for name, value in elem.items():
			attribnames.append(name)
			attribvals.append(value)
	else:
		iterattriblist.append(0)
		attribnames.append("no name")
		attribvals.append("no values")
	try:
		itertexts.append(elem.text)
	except:
		itertexts.append("no texts")

OUT = itertaglist, itertexts, iterattriblist, attribnames, attribvals
# ----------------------------------------
code_block = CodeBlock { 0; }
getItemAtIndex = List.GetItemAtIndex(list=python_script, index=code_block)
tags = Output(getItemAtIndex)
code_block_2 = CodeBlock { 2; }
getItemAtIndex_2 = List.GetItemAtIndex(list=python_script, index=code_block_2)
watch = Watch(getItemAtIndex_2)
code_block_3 = CodeBlock { 1; }
code_block_4 = CodeBlock { 0; }
eq = _ == code_block_4
replaceByCondition = Replace(watch, code_block_3, eq)
attribute_counts = Output(replaceByCondition)
code_block_5 = CodeBlock { 4; }
getItemAtIndex_3 = List.GetItemAtIndex(list=python_script, index=code_block_5)
chopByLengths = Custom[List.ChopByLengths](lengths=replaceByCondition, list=getItemAtIndex_3)  # Turns a list into a list of lists with sublists of varying lengths.
attribute_values = Output(chopByLengths)
code_block_6 = CodeBlock { 3; }
getItemAtIndex_4 = List.GetItemAtIndex(list=python_script, index=code_block_6)
chopByLengths_2 = Custom[List.ChopByLengths](lengths=replaceByCondition, list=getItemAtIndex_4)
attribute_names = Output(chopByLengths_2)
code_block_7 = CodeBlock { 1; }
getItemAtIndex_5 = List.GetItemAtIndex(list=python_script, index=code_block_7)
texts = Output(getItemAtIndex_5)
