# Dynamo custom node Get from Sublists using One Index.dyf (Dynamo 0.8.2.2371)
# category: Bakery.Core.List

list = Input()
desired_index = Input()
getItemAtIndex = List.GetItemAtIndex(index=desired_index)
map = List.Map(list=list, f_x=getItemAtIndex)
mapped = Output(map)
