# Dynamo custom node Get list of GUIDs for a Specific Shared Parameter Name.dyf (Dynamo 0.8.2.2392)
# category: Bakery.Parameters
# iterates through model elements

collect_all_familyinstance_using = Custom[Collect all FamilyInstance using Element Types]()  # should get model family instances
watch = Watch(collect_all_familyinstance_using)
symbol = FamilyInstance.Symbol(watch)
uniqueItems = List.UniqueItems(symbol)
bv_remove_nulls = Custom[bv Remove Nulls](List=uniqueItems)  # forked from Lunchbox
flatten = Flatten(bv_remove_nulls)
create = List.Create(watch, flatten)
TrueForType = Input()
create_2 = List.Create(TrueForType)
boolean = BoolSelector(false)
boolean_2 = BoolSelector(true)
create_3 = List.Create(boolean, boolean_2)
bv_if_equal_return_index = Custom[bv If Equal Return Index](listA=create_2, listB=create_3)  # forked
getItemAtIndex = List.GetItemAtIndex(list=create, index=bv_if_equal_return_index)
flatten_2 = Flatten(getItemAtIndex)
list_shared_parameter_guids_only = Custom[List Shared Parameter GUIDs only](ElementOrTypeList=flatten_2)  # faster
SPnameAsString = Input()
create_4 = List.Create(SPnameAsString)
bv_if_equal_return_index_2 = Custom[bv If Equal Return Index](listA=create_4, listB=list_shared_parameter_guids_only.SPNames)
getItemAtIndex_2 = List.GetItemAtIndex(list=list_shared_parameter_guids_only.SPGuids, index=bv_if_equal_return_index_2)
listOfGuids = Output(getItemAtIndex_2)
watch_2 = Watch(getItemAtIndex)
