# Dynamo custom node Group Elements by Parameter Value.dyf (Dynamo 0.9.1.4062)
# category: Bakery.Revit.Parameters
# gives a number of list outputs

elementList = Input()
watch = Watch(elementList)
paramNameAsString = Input()
getParameterValueByName = Element.GetParameterValueByName(element=watch, parameterName=paramNameAsString)
uniqueItems = List.UniqueItems(getParameterValueByName)
element_by_parameter_value = Custom[Element by Parameter Value](Element=watch, Parameter=paramNameAsString)  # Filter Revit elements by a parameter value
map = List.Map(list=uniqueItems, f_x=element_by_parameter_value.True)
restOfItems = List.RestOfItems()
map_2 = List.Map(list=map, f_x=restOfItems)
watch_2 = Watch(map_2)
flatten = Flatten(watch_2)
flattened_RestOfItems = Output(flatten)
firstItem = List.FirstItem()
map_3 = List.Map(list=map, f_x=firstItem)
watch_3 = Watch(map_3)
firstItems_in_Sublists = Output(watch_3)
mapped_with_Sublists = Output(map)
