# Dynamo custom node Inplace Family Check.dyf (Dynamo 0.9.1.4062)
# category: Bakery.Revit.Elements.Family
# this is adapted from clockwork

Family = Input()
turnIntoList = Custom[Turn Into List](unknownItem=Family)  # Turns an element (or a nested list) into a flat list
python_script = Python(IN[0]=turnIntoList)
# ---------- python_script.python (14 lines) ----------
import clr
import System
clr.AddReference('RevitAPI')
from Autodesk.Revit.DB import *

fams = IN[0]
elementlist = list()

for fam in fams:
	try:
		elementlist.append(fam.IsInPlace)
	except:
		elementlist.append(False)
OUT = elementlist
# ----------------------------------------
returnListOrSingleValue = Custom[ReturnListOrSingleValue](unknownItem=Family, seq=python_script)  # If the item in input #1 is not a list, only the first item of the list in input #2 will be returned.
bool = Output(returnListOrSingleValue)
