# Dynamo custom node Is Family Instance InPlace.dyf (Dynamo 0.8.1.1942)
# category: Bakery.Revit.Elements.Family
# takes FamilyInstance, returns bool

oneInstance = Input()
symbol = FamilyInstance.Symbol(oneInstance)
family = FamilySymbol.Family(symbol)
isInPlace = Custom[Family.IsInPlace](Family=family)  # Determines if a family is an in-place family
oneBool = Output(isInPlace)
