# Dynamo custom node LSJ MySql at localhost connection string.dyf (Dynamo 0.9.1.4062)
# category: Bakery.Data.Database

string = StringInput("Localhost")
string_2 = StringInput("3306")
string_3 = StringInput("root")
string_4 = StringInput("dynamo_123!")
string_5 = StringInput("20")
string_6 = StringInput("5")
mySQL_ConnectionString = Database.Connection.MySQL_ConnectionString(string, string_2, string_3, string_4, string_5, string_6)
string_7 = Output(mySQL_ConnectionString)  # "string"
