# Dynamo custom node Line Break String with Ids to Revit Elements.dyf (Dynamo 0.9.2.4472)
# category: Bakery.Revit.Selection

stringWithLineBreaks = Input()
convert_string_with_line_breaks = Custom[Convert String with Line Breaks into List of Strings](string=stringWithLineBreaks)
toNumber = String.ToNumber(convert_string_with_line_breaks)
bv_ids_to_elements = Custom[bv IDs to Elements](ID_s=toNumber)  # forked from CAAD_RWTH
Elements = Output(bv_ids_to_elements.Element_s)
