# Dynamo custom node Lines Between Start and End Points.dyf (Dynamo 1.2.0.2831)
# category: Bakery.Geometry

pointListOne = Input()
watch = Watch(pointListOne)
firstItem = List.FirstItem(watch@L2)
PointListTwo = Input()
watch_2 = Watch(PointListTwo)
firstItem_2 = List.FirstItem(watch_2@L2)
byStartPointEndPoint = Line.ByStartPointEndPoint(startPoint=firstItem, endPoint=firstItem_2)
Line1 = Output(byStartPointEndPoint)
lastItem = List.LastItem(watch@L2)
lastItem_2 = List.LastItem(watch_2@L2)
byStartPointEndPoint_2 = Line.ByStartPointEndPoint(startPoint=lastItem, endPoint=lastItem_2)
Line2 = Output(byStartPointEndPoint_2)
