# Dynamo custom node Linked Elements Revit File Name.dyf (Dynamo 1.2.1.3083)
# category: Bakery.Revit.Elements.Properties

item = Input()
element_document_parent_link = Custom[Element.Document Parent Link](Element=item)
fileName = Output(element_document_parent_link)
