# Dynamo custom node List Detail Lines by using View Workset Filter.dyf (Dynamo 0.8.2.2371)
# category: Bakery.Revit.Elements
# only works on workshared projects

element_list = Input()
watch = Watch(element_list)
workset = Custom[Element.Workset](element=watch)  # Retrieves the workset of a given element
element_name_universal = Custom[Element.Name (Universal)](element=workset)  # Gets an element's name (Dynamo's built-in Name nodes don't work for all element types, e.g. worksets...)
string = StringInput("Sheet")
boolean = BoolSelector(true)
contains = String.Contains(str=element_name_universal, searchFor=string, ignoreCase=boolean)
filterByBoolMask = List.FilterByBoolMask(list=watch, mask=contains)
detail_lines_on_sheets = Output(filterByBoolMask.in)
string_2 = StringInput("View")
boolean_2 = BoolSelector(true)
contains_2 = String.Contains(str=element_name_universal, searchFor=string_2, ignoreCase=boolean_2)
filterByBoolMask_2 = List.FilterByBoolMask(list=watch, mask=contains_2)
create = List.Create(filterByBoolMask_2.in, filterByBoolMask.in)
flatten = Flatten(create)
combined_list = Output(flatten)
detail_lines_in_views = Output(filterByBoolMask_2.in)
