# Dynamo custom node List Elements in View across Revit Links.dyf (Dynamo 0.8.2.2371)
# category: Bakery.Views

view = Input()
doc = Input()
python_script = Python(IN[0]=view, IN[1]=doc)
# ---------- python_script.python (34 lines) ----------
#LSJ

import clr
clr.AddReference('ProtoGeometry')
from Autodesk.DesignScript.Geometry import *

# Import DocumentManager
clr.AddReference("RevitServices")
import RevitServices
from RevitServices.Persistence import DocumentManager

# Import RevitAPI
clr.AddReference("RevitAPI")
import Autodesk

# Import ToDSType(bool) extension method
clr.AddReference("RevitNodes")
import Revit
from Autodesk.Revit.DB import *
clr.ImportExtensions(Revit.Elements)

import System

views = UnwrapElement(IN[0])

elementlist = []
doc = UnwrapElement(IN[1])

for view in views:
	collector = FilteredElementCollector(doc, view.Id)
	elementlist.append(collector.ToElements())

#Assign your output to the OUT variable
OUT = elementlist
# ----------------------------------------
output = Output(python_script)
