# Dynamo custom node List Groups.dyf (Dynamo 0.9.1.4062)
# category: Bakery.Elements

python_script = Python()
# ---------- python_script.python (46 lines) ----------
#Copyright(c) 2014, Nathan Miller
# The Proving Ground, http://theprovingground.org

import clr

# Import RevitAPI
clr.AddReference("RevitAPI")
import Autodesk
from Autodesk.Revit.DB import *

# Import DocumentManager and TransactionManager
clr.AddReference("RevitServices")
import RevitServices
from RevitServices.Persistence import DocumentManager
from RevitServices.Transactions import TransactionManager

# Import ToDSType(bool) extension method
clr.AddReference("RevitNodes")
import Revit
clr.ImportExtensions(Revit.Elements)

#The input to this node will be stored in the IN[0] variable.

doc =  DocumentManager.Instance.CurrentDBDocument
app =  DocumentManager.Instance.CurrentUIApplication.Application


collector = FilteredElementCollector(doc)
#collector.OfCategory(Group)
collector.OfClass(Group)
 
famtypeitr = collector.GetElementIdIterator()
famtypeitr.Reset()

outlist = []
groups = []
locations = []
failures = []

for item in famtypeitr:
	try:
		groups.append((item))
	except:
		failures.append("failed")
#Assign your output to the OUT variable
OUT = groups
# ----------------------------------------
Groups = Output(python_script)
id_to_element = Custom[Id to Element](Id=python_script)  # Selects elements in a model from id input (ElementId, string, integer or GUID)
groupElements = Output(id_to_element)
