# Dynamo custom node List Import Information.dyf (Dynamo 0.8.1.1942)
# category: Bakery.DocInfo
# shows Element ID, import name and Workset

string = StringInput("Category")
string_2 = StringInput("Workset")
linksAndImports = Custom[Document.LinksAndImports]()  # Gets all linked and imported files in the document
bruteforce_get_elem_id_and_two = Custom[Bruteforce Get Elem ID and Two Parameters and Make List of Strings](parameterOne=string, parameterTwo=string_2, elementList=linksAndImports.imports)  # takes list of elements
importInformation = Output(bruteforce_get_elem_id_and_two)
