# Dynamo custom node List Length Validator.dyf (Dynamo 0.8.2.2371)
# category: Bakery.Core.List

listOfLists = Input()
python_script = Python(IN[0]=listOfLists)
# ---------- python_script.python (20 lines) ----------
import clr
clr.AddReference('ProtoGeometry')
from Autodesk.DesignScript.Geometry import *
#The inputs to this node will be stored as a list in the IN variables.
lists = IN[0]
myList = []

for x in lists:
	myList.append(len(x))

#def checkEqual1(iterator):
#   try:
#      iterator = iter(iterator)
#      first = next(iterator)
#      return all(first == rest for rest in iterator)
#   except StopIteration:
#      return True

#Assign your output to the OUT variable.
OUT = all(x==myList[0] for x in myList)
# ----------------------------------------
equal_lengths = Output(python_script)  # "equal lengths?"
