# Dynamo custom node List Nested Node Nicknames for Folder.dyf (Dynamo 0.9.1.4062)
# category: Bakery.Standalone

string = StringInput("File Name")
dir = Input(dir : string)
string_2 = StringInput(".dyf")
all_directory_contents_of = Custom[All Directory Contents of Specific Filetype](dir=dir, file_extension_string_like_txt=string_2)
boolean = BoolSelector(false)
fileName = FilePath.FileName(all_directory_contents_of, boolean)
addItemToFront = List.AddItemToFront(item=string, list=fileName)
string_3 = StringInput("File Path")
addItemToFront_2 = List.AddItemToFront(item=string_3, list=all_directory_contents_of)
string_4 = StringInput("Custom Nodes")
show_dependency_nodes_for_one = Custom[Show Dependency Nodes for one DYF]()  # used with List.Map for a folder of them
map = List.Map(list=all_directory_contents_of, f_x=show_dependency_nodes_for_one)
watch = Watch(map)
watch_2 = Watch(watch)
merge_sublists_to_strings = Custom[Merge Sublists to Strings](list=watch_2)
watch_3 = Watch(merge_sublists_to_strings)
addItemToFront_3 = List.AddItemToFront(item=string_4, list=watch_3)
create = List.Create(addItemToFront, addItemToFront_2, addItemToFront_3)
list = Output(create)
