# Dynamo custom node List Nodes in DYFs for an Entire Folder.dyf (Dynamo 1.2.1.3083)
# category: Bakery.Standalone.DynamoMgmt
# takes Directory Path as input node

dir_string = Input()
contentsAll = Custom[Directory.ContentsAll](directoryPath=dir_string)  # Unlike the built-in node Directory.Contents, this node browses a directory recursively and returns all relevant files contained in subfolders as well.
flatten = Flatten(contentsAll)
show_dependency_nodes_for_one = Custom[Show Dependency Nodes for one DYF]()  # used with List.Map for a folder of them; unwired: path_to_DYF
map = List.Map(list=flatten, f_x=show_dependency_nodes_for_one)
mappedResult = Output(map)
fileList = Output(contentsAll)
