# Dynamo custom node List Phase Information.dyf (Dynamo 0.8.1.1942)
# category: Bakery.DocInfo
# uses Clockwork

phases = Custom[Document.Phases]()  # Retrieves all phases in the active document in *chronological* order
phaseElements = Output(phases)
code_block = CodeBlock { "Name"; }
getParameterValueByName = Element.GetParameterValueByName(parameterName=code_block)
map = List.Map(list=phases, f_x=getParameterValueByName)
phaseNames = Output(map)
string_from_array = FromArray(map)
phaseNamesAsString = Output(string_from_array)
