# Dynamo custom node List Revit Links Visible in View.dyf (Dynamo 0.8.2.2392)
# category: Bakery.Revit.Views
# use with list.map

get_all_revit_links_as_element = Custom[Get All Revit Links as Element List]()
View = Input()
bv_elements_in_views = Custom[bv Elements in Views](Views=View)  # forked
id = Element.Id(bv_elements_in_views)
flatten = Flatten(id)
id_2 = Element.Id(get_all_revit_links_as_element)
bv_if_equal_return_index = Custom[bv If Equal Return Index](listA=flatten, listB=id_2)  # forked
getItemAtIndex = List.GetItemAtIndex(list=get_all_revit_links_as_element, index=bv_if_equal_return_index)
LinksVisible = Output(getItemAtIndex)
