# Dynamo custom node List Unique Categories Present in Set of Elements.dyf (Dynamo 0.8.2.2392)
# category: Bakery.Revit.Document.Category
# uses Bruteforce, returns sorted list

elementList = Input()
flatten = Flatten(elementList)
string = StringInput("Category")
code_block = CodeBlock { "---null---"; }
bruteforce_get_parameter_via = Custom[Bruteforce Get Parameter via String Split V2](parameterName=string, replaceEmptyWithString=code_block)  # BETTER
map = List.Map(list=flatten, f_x=bruteforce_get_parameter_via)
bv_remove_nulls = Custom[bv Remove Nulls](List=map)  # forked from Lunchbox
flatten_2 = Flatten(bv_remove_nulls)
uniqueItems = List.UniqueItems(flatten_2)
sort = List.Sort(uniqueItems)
CategoryList = Output(sort)
