# Dynamo custom node List of File Paths to List of ElementTree objects.dyf (Dynamo 0.8.2.2371)
# category: Bakery.Data.XML

FilePaths = Input()
read_file_path_to_elementtree = Custom[Read File Path to ElementTree with UTF8 roundtrip]()  # to clean unsupported characters...
map = List.Map(list=FilePaths, f_x=read_file_path_to_elementtree)
flatten = Flatten(map)
ElementTrees = Output(flatten)
