# Dynamo custom node List of Model Elements simplified with Annotation removed.dyf (Dynamo 0.8.2.2392)
# category: Bakery.Collect
# also reports categories included and excluded. Only works on Workshared models...

list_of_model_elements = Custom[List of Model Elements simplified]()  # uses familyinstance select now
Original_Element_List = Output(list_of_model_elements.Element_List)
get_worksets = Custom[Get Worksets]()  # Retrieves user worksets from specified document
flat_list_to_list_of_strings = Custom[Flat List to List of Strings](Original_List=get_worksets.Ids)  # using python methods
string = StringInput("Workset")
getParameterValueByName = Element.GetParameterValueByName(element=list_of_model_elements.Element_List, parameterName=string)
create = List.Create(getParameterValueByName)
firstItem = List.FirstItem(create)
flat_list_to_list_of_strings_2 = Custom[Flat List to List of Strings](Original_List=firstItem)
bv_if_equal_return_index = Custom[bv If Equal Return Index](listA=flat_list_to_list_of_strings, listB=flat_list_to_list_of_strings_2)  # forked
removeItemAtIndex = List.RemoveItemAtIndex(list=list_of_model_elements.Element_List, indices=bv_if_equal_return_index)
bv_if_equal_return_index_2 = Custom[bv If Equal Return Index](listA=removeItemAtIndex, listB=list_of_model_elements.Element_List)
removeItemAtIndex_2 = List.RemoveItemAtIndex(list=list_of_model_elements.Element_List, indices=bv_if_equal_return_index_2)
Element_List_without_Annotation = Output(removeItemAtIndex_2)
get_categories_from_elements = Custom[Get Categories from Elements](Elements=removeItemAtIndex_2)  # designed to use document category list
Categories_kept = Output(get_categories_from_elements.CategoriesPresent)
get_categories_from_elements_2 = Custom[Get Categories from Elements](Elements=removeItemAtIndex)
Categories_removed = Output(get_categories_from_elements_2.CategoriesPresent)
