# Dynamo custom node List of Model Elements simplified.dyf (Dynamo 0.8.2.1601)
# category: Bakery.Collect
# uses familyinstance select now

collect_all_familyinstance_using = Custom[Collect all FamilyInstance using Element Types]()  # should get model family instances
flatten = Flatten(collect_all_familyinstance_using)
symbol = FamilyInstance.Symbol(flatten)
List_of_Types_symbols = Output(symbol)  # "List of Types (symbols)"
Element_List = Output(flatten)
