# Dynamo custom node List of Model Elements.dyf (Dynamo 0.9.1.4062)
# category: Bakery.Collect
# refined, removes tags, systems etc

collect_all_elements_in_model = Custom[Collect All Elements in Model]()  # uses a nested catch-all, then a refined selection by category
flat_list_to_list_of_strings = Custom[Flat List to List of Strings](Original_List=collect_all_elements_in_model.Categories)  # using python methods
string = StringInput("True")
create = List.Create(string)
string_2 = StringInput(".dwg")
contains = String.Contains(str=flat_list_to_list_of_strings, searchFor=string_2)
flat_list_to_list_of_strings_2 = Custom[Flat List to List of Strings](Original_List=contains)
if_equal_return_index = Custom[If Equal Return Index](listA=create, listB=flat_list_to_list_of_strings_2)  # If element in list A is equal to an element in list B then return index from list B.
removeItemAtIndex = List.RemoveItemAtIndex(list=flat_list_to_list_of_strings, indices=if_equal_return_index)
flat_list_to_list_of_strings_3 = Custom[Flat List to List of Strings](Original_List=removeItemAtIndex)
Categories_excluding_dwg = Output(flat_list_to_list_of_strings_3)
get_categories_with_builtins = Custom[Get Categories with Builtins]()  # get category names and ids
string_3 = StringInput("True")
create_2 = List.Create(string_3)
string_4 = StringInput("Insulations")
contains_2 = String.Contains(str=flat_list_to_list_of_strings_3, searchFor=string_4)
flat_list_to_list_of_strings_4 = Custom[Flat List to List of Strings](Original_List=contains_2)
if_equal_return_index_2 = Custom[If Equal Return Index](listA=create_2, listB=flat_list_to_list_of_strings_4)
removeItemAtIndex_2 = List.RemoveItemAtIndex(list=flat_list_to_list_of_strings_3, indices=if_equal_return_index_2)
flat_list_to_list_of_strings_5 = Custom[Flat List to List of Strings](Original_List=removeItemAtIndex_2)
string_5 = StringInput("True")
create_3 = List.Create(string_5)
string_6 = StringInput("Analytical")
contains_3 = String.Contains(str=flat_list_to_list_of_strings_5, searchFor=string_6)
flat_list_to_list_of_strings_6 = Custom[Flat List to List of Strings](Original_List=contains_3)
if_equal_return_index_3 = Custom[If Equal Return Index](listA=create_3, listB=flat_list_to_list_of_strings_6)
removeItemAtIndex_3 = List.RemoveItemAtIndex(list=flat_list_to_list_of_strings_5, indices=if_equal_return_index_3)
flat_list_to_list_of_strings_7 = Custom[Flat List to List of Strings](Original_List=removeItemAtIndex_3)
string_7 = StringInput("True")
create_4 = List.Create(string_7)
string_8 = StringInput("Systems")
contains_4 = String.Contains(str=flat_list_to_list_of_strings_7, searchFor=string_8)
flat_list_to_list_of_strings_8 = Custom[Flat List to List of Strings](Original_List=contains_4)
if_equal_return_index_4 = Custom[If Equal Return Index](listA=create_4, listB=flat_list_to_list_of_strings_8)
removeItemAtIndex_4 = List.RemoveItemAtIndex(list=flat_list_to_list_of_strings_7, indices=if_equal_return_index_4)
flat_list_to_list_of_strings_9 = Custom[Flat List to List of Strings](Original_List=removeItemAtIndex_4)
string_9 = StringInput("True")
create_5 = List.Create(string_9)
string_10 = StringInput("Tags")
contains_5 = String.Contains(str=flat_list_to_list_of_strings_9, searchFor=string_10)
flat_list_to_list_of_strings_10 = Custom[Flat List to List of Strings](Original_List=contains_5)
if_equal_return_index_5 = Custom[If Equal Return Index](listA=create_5, listB=flat_list_to_list_of_strings_10)
removeItemAtIndex_5 = List.RemoveItemAtIndex(list=flat_list_to_list_of_strings_9, indices=if_equal_return_index_5)
watch = Watch(removeItemAtIndex_5)
string_11 = StringInput("Ducts;Materials;Lines;Levels;Scope Boxes;Section Boxes;Pipes;Text Notes;Raster Images;HVAC Zones;Pipe Segments;Project Information;Grids;Detail Items;Spot Elevations;Conduits;Areas;Viewports;Plan Region;Schedule Graphics;Revision Clouds;Guide Grid;Ceilings;Elevations;Walls;Dimensions;Floors;Rooms;Railings;")
string_12 = StringInput(";")
split = String.Split(string_11, string_12)
create_6 = List.Create(split)
removeItemsFromOtherList = Custom[List.RemoveItemsFromOtherList](List_A=watch, List_B=create_6)  # This will take long list A, remove entries that appear in short list B, and give you list C. (JBE List Operations are probably more robust).
flat_list_to_list_of_strings_11 = Custom[Flat List to List of Strings](Original_List=get_categories_with_builtins.Names)
if_equal_return_index_6 = Custom[If Equal Return Index](listA=removeItemsFromOtherList, listB=flat_list_to_list_of_strings_11)
getItemAtIndex = List.GetItemAtIndex(list=get_categories_with_builtins.Builtin_Name, index=if_equal_return_index_6)
select_elements_using_builtin = Custom[Select Elements Using BuiltIn Category Names](builtIns=getItemAtIndex)  # uses a refined list to get it done
flatten = Flatten(select_elements_using_builtin)
Element_List = Output(flatten)
getItemAtIndex_2 = List.GetItemAtIndex(list=get_categories_with_builtins.Names, index=if_equal_return_index_6)
New_Category_List = Output(getItemAtIndex_2)
Removed_Category_List = Output(create_6)
flat_list_to_list_of_strings_12 = Custom[Flat List to List of Strings](Original_List=getItemAtIndex)
New_List_as_Builtins = Output(flat_list_to_list_of_strings_12)
type = Custom[Element.Type](element=flatten)  # Gets the family type of a given element (if applicable).
List_of_Types_symbols = Output(type)  # "List of Types (symbols)"
