# Dynamo custom node List of System Related Categories.dyf (Dynamo 0.8.2.2371)
# category: Bakery.Revit.Document.Category

code_block = CodeBlock { {"Air Terminals","Duct Accessories","Duct Fittings","Ducts","Mechanical Equipment","Pipes","Pipe Fittings","Pipe Accessories","Flex Pipes","Flex Ducts","Electrical Equipment","Cable Trays","Cable Tray Fittings","Fire Alarm Devices","Sprinklers","Plumbing Fixtures","Communication Devices"}; }
sort = List.Sort(code_block)
categoryNames = Output(sort)
