# Dynamo custom node List to Single String.dyf (Dynamo 1.0.0.1180)
# category: Bakery.Core.String
# renamed fork of "Convert List into List of Strings with Line Breaks"

Original_List = Input()
flat_list_to_list_of_strings = Custom[Flat List to List of Strings](Original_List=Original_List)  # using python methods
string = StringInput(",")
string_2 = StringInput(" _")
replace = String.Replace(searchFor=string, replaceWith=string_2)
map = List.Map(list=flat_list_to_list_of_strings, f_x=replace)
flatten = Flatten(map)
watch = Watch(flatten)
string_from_array = FromArray(watch)
string_3 = StringInput(",")
string_4 = StringInput("\n")
replace_2 = String.Replace(str=string_from_array, searchFor=string_3, replaceWith=string_4)
code_block = CodeBlock { 0; }
code_block_2 = CodeBlock { 1; }
remove = String.Remove(str=replace_2, startIndex=code_block, count=code_block_2)
length = String.Length(remove)
code_block_3 = CodeBlock(x=length) { x-1; }
code_block_4 = CodeBlock { 1; }
remove_2 = String.Remove(str=remove, startIndex=code_block_3, count=code_block_4)
str = Output(remove_2)
