# Dynamo custom node Make 3D Views in Rooms v1.dyf (Dynamo 0.8.2.2371)
# category: Bakery.Views

room_list = Input()
watch = Watch(room_list)
location = Custom[Element.Location](element=watch)  # Returns the location of an element as an XYZ (or if it's line-based the start and end point of the line), along with some booleans to help filtering the results. Use this for some element types (e.g. walls or lines) that do not work with the built-in Get Family Instance Location node.
watch_2 = Watch(location.points)
name_of_Room_Parameter_One = Input()
getParameterValueByName = Element.GetParameterValueByName(element=watch, parameterName=name_of_Room_Parameter_One)
name_of_Room_Parameter_Two = Input()
getParameterValueByName_2 = Element.GetParameterValueByName(element=watch, parameterName=name_of_Room_Parameter_Two)
create = List.Create(getParameterValueByName, getParameterValueByName_2)
transpose = List.Transpose(create)
code_block = CodeBlock { " "; }
bv_merge_sublists_with_a = Custom[bv Merge Sublists with a separator](List=transpose, Character=code_block)  # forked from Rhythm
code_block_2 = CodeBlock { false; }
byEyePointAndTarget = PerspectiveView.ByEyePointAndTarget(watch_2, watch_2, watch, bv_merge_sublists_with_a, code_block_2)
watch_3 = Watch(byEyePointAndTarget)
code_block_3 = CodeBlock { "Target Elevation"; }
deconstructPoint = Geometry.Points.DeconstructPoint(watch_2)
watch_4 = Watch(deconstructPoint.out2)
offset_z = Input()
code_block_4 = CodeBlock(x=watch_4, o=offset_z) { x+o; }
set_list_of_values_to_list_of = Custom[Set List of Values to List of Elements for One Parameter](elementList=watch_3, parameterNameAsString=code_block_3, valuesToSet=code_block_4)  # as described
watch_5 = Watch(set_list_of_values_to_list_of)
code_block_5 = CodeBlock { "Eye Elevation"; }
set_list_of_values_to_list_of_2 = Custom[Set List of Values to List of Elements for One Parameter](elementList=watch_5, parameterNameAsString=code_block_5, valuesToSet=code_block_4)
watch_6 = Watch(set_list_of_values_to_list_of_2)
views_made = Output(watch_6)
watch_7 = Watch(code_block_4)
watch_8 = Watch(bv_merge_sublists_with_a)
