# Dynamo custom node Make Geometry from View via SAT.dyf (Dynamo 1.3.3.4651)
# category: Bakery.Geometry
# uses element ID as SAT name

tempDirectory = Input()
view = Input()
watch = Watch(view)
id = Element.Id(watch)
string_from_object = FromObject(id)

# group: sat geometry method -- USES ACTIVE VIEW
string = StringInput("")
string_2 = StringInput("\")
python_script = Python(IN[0]=tempDirectory, IN[1]=string_from_object, IN[2]=watch)
# ---------- python_script.python (48 lines) ----------
import clr
clr.AddReference('ProtoGeometry')
from Autodesk.DesignScript.Geometry import *

# Import ToDSType(bool) extension method
clr.AddReference("RevitNodes")
import Revit
clr.ImportExtensions(Revit.Elements)

# Import geometry conversion extension methods
clr.ImportExtensions(Revit.GeometryConversion)

# Import DocumentManager and TransactionManager
clr.AddReference("RevitServices")
import RevitServices
from RevitServices.Persistence import DocumentManager
from RevitServices.Transactions import TransactionManager
from System.Collections.Generic import List

# Import RevitAPI
clr.AddReference("RevitAPI")
import Autodesk
from Autodesk.Revit.DB import *



ad = Autodesk.DesignScript.Geometry
doc = DocumentManager.Instance.CurrentDBDocument
uiapp = DocumentManager.Instance.CurrentUIApplication
app = uiapp.Application

output_folder = IN[0]
name = IN[1]

if isinstance(IN[2], list):
    Element_ids = UnwrapElement(IN[2])
else:
    Element_ids = [UnwrapElement(IN[2])]

IDs = [e.Id for e in Element_ids]

view_Ids = List[ElementId](IDs)



SAT_Export = doc.Export(output_folder, name, view_Ids, SATExportOptions())

OUT = output_folder, name, SAT_Export
# ----------------------------------------
code_block = CodeBlock { 0; }
getItemAtIndex = List.GetItemAtIndex(list=python_script, index=code_block)
code_block_2 = CodeBlock { 1; }
getItemAtIndex_2 = List.GetItemAtIndex(list=python_script, index=code_block_2)
join = String.Join(string_2, getItemAtIndex, getItemAtIndex_2)
string_3 = StringInput(".sat")
join_2 = String.Join(string, join, string_3)
code_block_3 = CodeBlock { 1000; }

watch_2 = Watch(join_2)

# group (continued): sat geometry method -- USES ACTIVE VIEW
importFromSAT = Geometry.ImportFromSAT(watch_2)

watch_3 = Watch(importFromSAT)
turnIntoList = Custom[TurnIntoList](unknownItem=watch_3)  # Turns an element (or a nested list) into a flat list

# group (continued): sat geometry method -- USES ACTIVE VIEW
bv_remove_nulls = Custom[bv Remove Nulls](List=turnIntoList)  # forked from Lunchbox

watch_4 = Watch(bv_remove_nulls)

# group (continued): sat geometry method -- USES ACTIVE VIEW
scale = Geometry.Scale(geometry=watch_4, amount=code_block_3)

watch_5 = Watch(scale)
Geoms = Output(watch_5)
