# Dynamo custom node Make Unique Identifier and Set it to Parameter.dyf (Dynamo 0.8.2.2392)
# category: Bakery.Revit.Parameters
# uses Family Name, Type Name and Location to make a pseudo-unique ID

elementList = Input()
watch = Watch(elementList)
ParameterToSet = Input()
create = List.Create(ParameterToSet)
count = List.Count(watch)
cycle = List.Cycle(list=create, amount=count)
symbol = FamilyInstance.Symbol(watch)
family = FamilySymbol.Family(symbol)
string_from_object = FromObject(family)
number_slider = DoubleSlider(0, range=0..100 step 0.1)
number_slider_2 = DoubleSlider(8, range=0..100 step 0.1)
remove = String.Remove(str=string_from_object, startIndex=number_slider, count=number_slider_2)
FamilyName_NumberOfChars = Input()
length = String.Length(remove)
sub = length - FamilyName_NumberOfChars
remove_2 = String.Remove(str=remove, startIndex=FamilyName_NumberOfChars, count=sub)
string_from_object_2 = FromObject(symbol)
number_slider_3 = DoubleSlider(0, range=0..100 step 0.1)
number_slider_4 = DoubleSlider(13, range=0..100 step 0.1)
remove_3 = String.Remove(str=string_from_object_2, startIndex=number_slider_3, count=number_slider_4)
TypeName_NumberOfChars = Input()
length_2 = String.Length(remove_3)
sub_2 = length_2 - TypeName_NumberOfChars
remove_4 = String.Remove(str=remove_3, startIndex=TypeName_NumberOfChars, count=sub_2)
location = Custom[Element.Location]()  # Returns the location of an element as an XYZ (or if it's line-based the start and end point of the line), along with some booleans to help filtering the results. Use this for some element types (e.g. walls or lines) that do not work with the built-in Get Family Instance Location node.
map = List.Map(list=watch, f_x=location.Points)
code_block = CodeBlock { "NoLocation"; }
replaceEmptyLists = Custom[List.ReplaceEmptyLists](list=map, replacement=code_block)  # Replaces all empty lists within a given list with a substitute
flatten = Flatten(replaceEmptyLists)
string_from_object_3 = FromObject(flatten)
length_3 = String.Length(string_from_object_3)
CharsToRemove = Input()
sub_3 = length_3 - CharsToRemove
remove_5 = String.Remove(startIndex=sub_3, count=CharsToRemove)
map_2 = List.Map(list=string_from_object_3, f_x=remove_5)
flatten_2 = Flatten(map_2)
create_2 = List.Create(remove_2, remove_4, flatten_2)
watch_2 = Watch(create_2)
ReplaceNullsWith = Input()
replaceNull = Custom[List.ReplaceNull](list=watch_2, replacement=ReplaceNullsWith)  # Replaces all null values within a given list with a substitute
transpose = List.Transpose(replaceNull)
separator = Input()
bv_merge_sublists_with_a = Custom[bv Merge Sublists with a separator](List=transpose, Character=separator)  # forked from Rhythm
watch_3 = Watch(bv_merge_sublists_with_a)
setParameterByName = Element.SetParameterByName(element=watch, parameterName=cycle, value=watch_3)
jobDone = Output(setParameterByName)
watch_4 = Watch(cycle)
watch_5 = Watch(watch_3)
watch_6 = Watch(flatten)
watch_7 = Watch(string_from_object_3)
