# Dynamo custom node Make View Filters for Multiple Categories.dyf (Dynamo 1.1.0.2094)
# category: Bakery.Revit.Views

filterNameList = Input()
count = Count(filterNameList)
code_block = CodeBlock(x=count) { 0..(x-1); }
categoryObjects = Input(categoryObjects : var[]..[])
code_block_2 = CodeBlock { " - "; }
code_block_3 = CodeBlock { "Category"; }
join = String.Join(code_block_2, code_block_3)
map = List.Map(list=filterNameList, f_x=join)

# group: Filter names
watch = Watch(map)

subnode_to_create_filter_for_all = Custom[subnode to Create Filter for All Categories](categoryObjects=categoryObjects, desiredFilterNames=watch)
map_2 = List.Map(list=code_block, f_x=subnode_to_create_filter_for_all)
flatten = Flatten(map_2)
clear_rules_from_view_filter = Custom[Clear Rules from View Filter]()  # wipes rules leaving only category selection
map_3 = List.Map(list=flatten, f_x=clear_rules_from_view_filter)
done = Output(map_3)
