# Dynamo custom node Match Link Level with Level in Host using Elevation.dyf (Dynamo 0.8.2.2371)
# category: Bakery.Revit.Document.Links

categories = Categories("Levels")
all_elements_of_category = ElementsOfCategory(categories)
watch = Watch(all_elements_of_category)
elevation = Level.Elevation(watch)
levelInLink = Input()
elevation_2 = Level.Elevation(levelInLink)
indexOf = IndexOf(elevation, elevation_2)
getItemAtIndex = List.GetItemAtIndex(list=watch, index=indexOf)
levelInHost = Output(getItemAtIndex)
