# Dynamo custom node Measure Perpendicular Lines.dyf (Dynamo 1.3.2.2480)
# category: Bakery.Geometry

lines = Input()
watch = Watch(lines)
endPoint = Curve.EndPoint(watch)
code_block = CodeBlock { 100; }
offset_point_z_value = Custom[Offset Point Z Value](points=endPoint, desiredOffset=code_block)
byLineAndPoint = Plane.ByLineAndPoint(watch, offset_point_z_value)
point = Input()
watch_2 = Watch(point)
closestPointTo = Geometry.ClosestPointTo(geometry=byLineAndPoint, other=watch_2)
resultPoint = Output(closestPointTo)
byStartPointEndPoint = Line.ByStartPointEndPoint(startPoint=point, endPoint=closestPointTo)
length = Curve.Length(byStartPointEndPoint)
lengths = Output(length)
