# Dynamo custom node Merge SQL Commands and Cleanup to One String.dyf (Dynamo 1.2.1.3083)
# category: Bakery.Data.Database

listOfCommands = Input()
create = List.Create(listOfCommands)
merge_sublists_to_strings = Custom[Merge Sublists to Strings](list=create)
firstItem = List.FirstItem(merge_sublists_to_strings)
watch = Watch(firstItem)
remove_first_and_last_characters = Custom[Remove First and Last Characters from String](stringIn=watch)
string = StringInput(";,")
string_2 = StringInput("")
string_3 = StringInput(";")
line_break_character = Custom[Line Break Character]()
join = String.Join(string_2, string_3, line_break_character)
replace = String.Replace(str=remove_first_and_last_characters, searchFor=string, replaceWith=join)
watch_2 = Watch(replace)
oneString = Output(watch_2)
