# Dynamo custom node Merge Sublists to Strings Pythonic.dyf (Dynamo 1.3.3.4651)
# category: Bakery.Core.List

twoLevelList = Input()
python_script = Python(IN[0]=twoLevelList)
# ---------- python_script.python (11 lines) ----------
import clr
clr.AddReference('ProtoGeometry')
from Autodesk.DesignScript.Geometry import *
#The inputs to this node will be stored as a list in the IN variables.
dataEnteringNode = IN[0]
merged = []
for x in dataEnteringNode:
	merged.append('-'.join(x))

#Assign your output to the OUT variable.
OUT = merged
# ----------------------------------------
flatStringList = Output(python_script)
