# Dynamo custom node Merge Sublists to Strings.dyf (Dynamo 0.9.1.4062)
# category: Bakery.Core.List

list = Input()
string_from_array = FromArray()
map = List.Map(list=list, f_x=string_from_array)
mapped = Output(map)
