# Dynamo custom node Mirror an Element.dyf (Dynamo 0.8.0.950)
# category: Bakery.Revit.Elements
# using python

elementList = Input()
planeList = Input()
python_script = Python(IN[0]=elementList, IN[1]=planeList)
# ---------- python_script.python (43 lines) ----------
import clr
clr.AddReference('RevitAPI')
import Autodesk
from Autodesk.Revit.DB import ElementTransformUtils, Plane

clr.AddReference("RevitServices")
import RevitServices
from RevitServices.Persistence import DocumentManager
from RevitServices.Transactions import TransactionManager

doc = DocumentManager.Instance.CurrentDBDocument

clr.AddReference("RevitNodes")
import Revit
clr.ImportExtensions(Revit.GeometryConversion)

clr.AddReference('ProtoGeometry')
from Autodesk.DesignScript.Geometry import *

walls = UnwrapElement(IN[0])
planes = IN[1]
rvt_planes =list()
mirrored = list()
count = 0

def Dyn2RvtPlane(pl1):
	normal1 = pl1.Normal.ToXyz(True)
	origin1 = pl1.Origin.ToXyz(True)
	return Autodesk.Revit.DB.Plane(normal1, origin1)

TransactionManager.Instance.EnsureInTransaction(doc)
for p in planes:
	rvt_planes.append(Dyn2RvtPlane(p))
for w, rp in zip(walls, rvt_planes):
	try:
#		item.Flip()
		ElementTransformUtils.MirrorElement(doc, w.Id, rp)
		count += 1
	except:
		count += 0
TransactionManager.Instance.TransactionTaskDone()
		
OUT = "%s elements mirrored" %count
# ----------------------------------------
Out = Output(python_script)
