# Dynamo custom node Modify Floor Element with Slab Shape Points.dyf (Dynamo 1.2.0.2831)
# category: Bakery.Revit.Elements

pointList = Input()
floor = Input()
python_script = Python(IN[0]=pointList, IN[1]=floor)
# ---------- python_script.python (29 lines) ----------
import clr
clr.AddReference('RevitAPI')
from Autodesk.Revit.DB import *

clr.AddReference("RevitNodes")
import Revit
clr.ImportExtensions(Revit.GeometryConversion)

clr.AddReference("RevitServices")
import RevitServices
from RevitServices.Persistence import DocumentManager
from RevitServices.Transactions import TransactionManager

doc = DocumentManager.Instance.CurrentDBDocument
xyzs = IN[0]
slabshape = UnwrapElement(IN[1])
successlist = list()
faillist = list()

TransactionManager.Instance.EnsureInTransaction(doc)
slabshape.SlabShapeEditor.ResetSlabShape()
for item in xyzs:
	try:
		slabshape.SlabShapeEditor.DrawPoint(item.ToXyz())
	except:
		faillist.append(item)
TransactionManager.Instance.TransactionTaskDone()

OUT = slabshape, faillist
# ----------------------------------------
firstItem = List.FirstItem(python_script)
modified = Output(firstItem)
lastItem = List.LastItem(python_script)
failed = Output(lastItem)
