# Dynamo custom node NavisworksExportOptions Builder.dyf (Dynamo 1.3.0.875)
# category: Bakery.Construction.Navisworks

oneView = Input()
id = Element.Id(oneView)
exportScope = Input()
exportCoordinates = Input()
exportLinks = Input(exportLinks : bool = true)
exportParts = Input(exportParts : bool = true)
ConvertElementProperties = Input(ConvertElementProperties : bool = true)
exportElementIds = Input(exportElementIds : bool = true)
DivideFileIntoLevels = Input(DivideFileIntoLevels : bool = true)
python_script = Python(IN[0]=id, IN[1]=exportScope, IN[2]=exportCoordinates, IN[3]=exportLinks, IN[4]=exportParts, IN[5]=ConvertElementProperties, IN[6]=exportElementIds, IN[7]=DivideFileIntoLevels)
# ---------- python_script.python (64 lines) ----------
#python nodes in dynamo 1.0
#proposed by Julien Benoit @jbenoit44 
#http://aecuandme.wordpress.com/
import clr
clr.AddReference('ProtoGeometry')
from Autodesk.DesignScript.Geometry import *
# Import ToDSType(bool) extension method
clr.AddReference("RevitNodes")
import Revit
clr.ImportExtensions(Revit.Elements)
# Import geometry conversion extension methods
clr.ImportExtensions(Revit.GeometryConversion)
# Import DocumentManager and TransactionManager
clr.AddReference("RevitServices")
import RevitServices
from RevitServices.Persistence import DocumentManager
from RevitServices.Transactions import TransactionManager
from System.Collections.Generic import *
# Import RevitAPI
clr.AddReference("RevitAPI")
import Autodesk
from Autodesk.Revit.DB import *

doc = DocumentManager.Instance.CurrentDBDocument
uiapp = DocumentManager.Instance.CurrentUIApplication
app = uiapp.Application
uidoc=DocumentManager.Instance.CurrentUIApplication.ActiveUIDocument

#view = []
#for i in IN[0]:
#	views.append(UnwrapElement(i))
view=IN[0]
exportscp=IN[1]
exportcoord=IN[2]
linkbool=IN[3]
partsbool=IN[4]
convelempropbool=IN[5]
ExportElementIdsbool=IN[6]
DivideFileIntoLevelsbool=IN[7]
# Start Transaction
#TransactionManager.Instance.EnsureInTransaction(doc)

#a=ViewSet()
#for v in views:
#	b= a.Insert(v)
	
x=NavisworksExportOptions()
viewasId=ElementId(view)
x.ViewId=viewasId
x.ExportScope=exportscp
x.Coordinates=exportcoord
x.ExportLinks=linkbool
x.ExportParts=partsbool
x.ConvertElementProperties=convelempropbool
x.ExportElementIds=ExportElementIdsbool
x.DivideFileIntoLevels=DivideFileIntoLevelsbool
#c=doc.Export(folder,name,x)



# End Transaction
#TransactionManager.Instance.TransactionTaskDone()

OUT=x
# ----------------------------------------
OUT = Output(python_script)
