# Dynamo custom node Nearest X and Y Walls for List of Elements.dyf (Dynamo 1.3.2.2480)
# category: Bakery.Revit.Elements.Wall

elementz = Input()
location = Custom[Element.Location](element=elementz)  # Returns the location of an element as an XYZ (or if it's line-based the start and end point of the line), along with some booleans to help filtering the results. Use this for some element types (e.g. walls or lines) that do not work with the built-in Get Family Instance Location node.
walls = Input()
watch = Watch(walls)
location_2 = Custom[Element.Location](element=watch)
watch_2 = Watch(location_2.curveEndpoints)
X = Point.X(watch_2)
all_equal_in_list = Custom[All Equal in List](sublists=X)  # doing string conversion to solve precision right now, need to fix
filterByBoolMask = List.FilterByBoolMask(list=watch, mask=all_equal_in_list.bools)
Y = Point.Y(watch_2)
all_equal_in_list_2 = Custom[All Equal in List](sublists=Y)
filterByBoolMask_2 = List.FilterByBoolMask(list=watch, mask=all_equal_in_list_2.bools)
nearest_x_and_y_walls_for_a = Custom[Nearest X and Y Walls for a Point](xAlignedWalls=filterByBoolMask.in, yAlignedWalls=filterByBoolMask_2.in)  # unwired: onePoint

# group: nearest walls
map = List.Map(list=location.points, f_x=nearest_x_and_y_walls_for_a)
watch_3 = Watch(map)

nearestWallsXthenYperElement = Output(watch_3)
