# Dynamo custom node Node Names From Directory String.dyf (Dynamo 1.2.1.3083)
# category: Bakery.Standalone.DynamoMgmt

dir_string = Input()

# group: use . for wildcard
string = StringInput(".")

summary_and_node_search_for_a = Custom[Summary and Node Search for a Folder of DYFs](Directory_Path=dir_string, node_name_to_search_for=string)  # can search for a node and tell you what file it is in
watch = Watch(summary_and_node_search_for_a.clean_source_node_names_from_files)
node_names = Output(watch)
