# Dynamo custom node Offset Points By PolyCurve and Distance.dyf (Dynamo 1.2.0.2690)
# category: Bakery.Geometry

points = Input(points : var[]..[])
points_to_polycurve_with = Custom[Points to PolyCurve with PruneDuplicates](points=points)
distanceMayBeNegative = Input(distanceMayBeNegative : var[]..[])
translate_points_on_curve_by = Custom[Translate Points on Curve by Average Vector](curve=points_to_polycurve_with.PolyCurve, points=points_to_polycurve_with.prunedPoints, distanceMayBeNegative=distanceMayBeNegative)

# group: match Z value with corresponding
deconstructPoint = Geometry.Points.DeconstructPoint(translate_points_on_curve_by, lacing=Longest)
deconstructPoint_2 = Geometry.Points.DeconstructPoint(points_to_polycurve_with.prunedPoints)
byCoordinates = Point.ByCoordinates(x=deconstructPoint.out0, y=deconstructPoint.out1, z=deconstructPoint_2.out2)

Point = Output(byCoordinates)
