# Dynamo custom node One Filled Region to Room Separation Lines in Active View.dyf (Dynamo 0.9.2.4472)
# category: Bakery.Revit.Elements.Room

oneItem = Input()
turnIntoList = Custom[TurnIntoList](unknownItem=oneItem)  # Turns an element (or a nested list) into a flat list
flatten = Flatten(turnIntoList)
filled_region_boundary_curves = Custom[Filled Region Boundary Curves](Filled_Region=flatten)  # This node will get the boundary curves for a filled region.
watch = Watch(filled_region_boundary_curves)
flatten_2 = Flatten(watch)
watch_2 = Watch(flatten_2)
single_curve_to_room_separation = Custom[Single Curve to Room Separation Line in Active View]()  # view should be a Plan View
map = List.Map(list=watch_2, f_x=single_curve_to_room_separation)
mapped = Output(map)
