# Dynamo custom node Output One GUID String.dyf (Dynamo 1.2.0.2831)
# category: Bakery.Core

code_block = CodeBlock { 0..1; }
uuid_guid_generator_for_lists = Custom[UUID GUID Generator for Lists](list=code_block)  # just makes a new GUID for every item in a list, has no relationship to item or element itself
firstItem = List.FirstItem(uuid_guid_generator_for_lists.uuidsAsStrings)
item = Output(firstItem)
