# Dynamo custom node Override Projection Lineweight in View.dyf (Dynamo 0.8.2.2371)
# category: Bakery.Revit.Views

Element_s = Input()  # "Element(s)"
Lineweight = Input()
View_s = Input()  # "View(s)"
turnIntoList = Custom[TurnIntoList](Element_s)  # Turns an element (or a nested list) into a flat list
count = Count(turnIntoList)
code_block = CodeBlock(x=count) { 0..(x-1); }
python_script = Python(IN[0]=Element_s, IN[1]=Lineweight, IN[2]=View_s, IN[3]=code_block)
# ---------- python_script.python (63 lines) ----------
#Created by DPS Design, dpsdesign.org
import clr
clr.AddReference('ProtoGeometry')
from Autodesk.DesignScript.Geometry import *

# Import ToDSType(bool) extension method
clr.AddReference("RevitNodes")
import Revit
clr.ImportExtensions(Revit.Elements)

# Import DocumentManager and TransactionManager
clr.AddReference("RevitServices")
import RevitServices
from RevitServices.Persistence import DocumentManager
from RevitServices.Transactions import TransactionManager

from System.Collections.Generic import *

# Import RevitAPI
clr.AddReference("RevitAPI")
import Autodesk

doc = DocumentManager.Instance.CurrentDBDocument
uiapp = DocumentManager.Instance.CurrentUIApplication
app = uiapp.Application

#The inputs to this node will be stored as a list in the IN variable.
dataEnteringNode = IN
listlength = IN[3]

#unwrap all elements to use with API
elements = []
for i in IN[0]:
	elements.append(UnwrapElement(i))

viewlist = []
for j in IN[2]:
	viewlist.append(UnwrapElement(j))
#create graphic overrides properties
gSettings = Autodesk.Revit.DB.OverrideGraphicSettings()

#set Projection Line weight
gSettings.SetProjectionLineWeight(IN[1])

# "Start" the transaction
TransactionManager.Instance.EnsureInTransaction(doc)

result = []
#apply lineweight override to elements in an input list
for k in listlength:
	try:
		id = elements[k].Id
		viewlist[k].SetElementOverrides(id, gSettings)
		result.append("success")
	except:
		result.append("failure")
	

# "End" the transaction
TransactionManager.Instance.TransactionTaskDone()

#Assign your output to the OUT variable
OUT = elements, result
# ----------------------------------------
code_block_2 = CodeBlock { 1; }
getItemAtIndex = List.GetItemAtIndex(list=python_script, index=code_block_2)
done = Output(getItemAtIndex)  # "done?"
viewsOut = Output(View_s)
