# Dynamo custom node Package Folder Details.dyf (Dynamo 1.2.1.3083)
# category: Bakery.Standalone.DynamoMgmt

package_path_string = Input()
fromPath = DirectoryObject(package_path_string)  # "Directory.FromPath"
contents = Directory.Contents(fromPath)
top_level = Output(contents.out1)
fromPath_2 = DirectoryObject(contents.out1)  # "Directory.FromPath"
contents_2 = Directory.Contents(fromPath_2)
second_level = Output(contents_2.out1)
fromPath_3 = DirectoryObject(contents_2.out1)  # "Directory.FromPath"
contents_3 = Directory.Contents(fromPath_3)
flatten = Flatten(contents_3)
files_at_third_level = Output(flatten)
