# Dynamo custom node Parse CSV Text of Elem IDs to Actual Revit Elements.dyf (Dynamo 0.8.0.950)
# category: Bakery.Standalone
# input file path

FilePathNode = Input()
fromPath = FileObject(FilePathNode)  # "File.FromPath"
readText = File.ReadText(fromPath)
string = StringInput(",")
split = String.Split(readText, string)
watch = Watch(split)
current_document = Custom[Current Document]()  # Retrieves Current Document
id_to_element = Custom[Id to Element](Id_s=watch, Doc=current_document)  # Selects elements in a model from id input (ElementId, string, integer or GUID)
elements = Output(id_to_element)
