# Dynamo custom node Parse XYZ from Delimited String List.dyf (Dynamo 1.2.1.3083)
# category: Bakery.Standalone

data = Input()
separater = Input()
split = String.Split(data, separater, lacing=Longest)
toNumber = String.ToNumber(split)
transpose = List.Transpose(toNumber)
Yindex = Input(Yindex : int)
getItemAtIndex = List.GetItemAtIndex(list=transpose, index=Yindex)
Yvalues = Output(getItemAtIndex)
Zindex = Input(Zindex : int)
getItemAtIndex_2 = List.GetItemAtIndex(list=transpose, index=Zindex)
Zvalues = Output(getItemAtIndex_2)
Xindex = Input(Xindex : int)
getItemAtIndex_3 = List.GetItemAtIndex(list=transpose, index=Xindex)
Xvalues = Output(getItemAtIndex_3)
