# Dynamo custom node Pile Column Layout Tool.dyf (Dynamo 1.2.0.2690)
# category: Bakery.Geometry
# uses a list of points and various offsets

drivingPoints = Input(drivingPoints : var[]..[])
A_offsetToColumnLine = Input()
offset_points_by_polycurve_and = Custom[Offset Points By PolyCurve and Distance](points=drivingPoints, distanceMayBeNegative=A_offsetToColumnLine)
watch = Watch(offset_points_by_polycurve_and)

# group: which one?
byControlPoints = NurbsCurve.ByControlPoints()  # unwired: arg0
byPoints = PolyCurve.ByPoints(points=watch)

B_startPointOffset = Input()
watch_2 = Watch(B_startPointOffset)

# group: starting point
pointAtSegmentLength = Curve.PointAtSegmentLength(curve=byPoints, segmentLength=watch_2)
firstItem = List.FirstItem(pointAtSegmentLength@L2)
firstItem_2 = List.FirstItem(firstItem)

C_spacing = Input()

# group: spacing
watch_3 = Watch(C_spacing)
to_float = Custom[To Float](unknown=watch_3)  # converts input object to a float with python

pointsAtSegmentLengthFromPoint = Curve.PointsAtSegmentLengthFromPoint(byPoints, firstItem_2, to_float)
D_topZoffset = Input()
watch_4 = Watch(D_topZoffset)

# group: top offset
offset_point_z_value = Custom[Offset Point Z Value](points=pointsAtSegmentLengthFromPoint, desiredOffset=watch_4)

E_columnLengthZOffset = Input()
watch_5 = Watch(E_columnLengthZOffset)

# group: pile cap length (height)
code_block = CodeBlock(z=watch_5) { z*-1; }
offset_point_z_value_2 = Custom[Offset Point Z Value](points=offset_point_z_value, desiredOffset=code_block)

byStartPointEndPoint = Line.ByStartPointEndPoint(startPoint=offset_point_z_value_2, endPoint=offset_point_z_value)
Line = Output(byStartPointEndPoint)
