# Dynamo custom node Place Family at Points and Set Parameter Values.dyf (Dynamo 0.8.2.2371)
# category: Bakery.Revit.Elements.Family

familySymbol = Input(familySymbol : FamilySymbol)
point_List = Input()
watch = Watch(point_List)
byPoint = FamilyInstance.ByPoint(familySymbol, watch)
watch_2 = Watch(byPoint)
first_Families_Placed = Output(watch_2)

# group: VB unique ID set
string = StringInput("VB Unique Issue ID")
uuid_guid_generator_for_lists = Custom[UUID GUID Generator for Lists](list=watch)  # just makes a new GUID for every item in a list, has no relationship to item or element itself
set_list_of_values_to_list_of = Custom[Set List of Values to List of Elements for One Parameter](elementList=watch_2, parameterNameAsString=string, valuesToSet=uuid_guid_generator_for_lists.uuidsAsStrings)  # as described

priority_List = Input()

# group: Set Priority Integer
string_2 = StringInput("Priority Integer")
set_list_of_values_to_list_of_2 = Custom[Set List of Values to List of Elements for One Parameter](elementList=set_list_of_values_to_list_of, parameterNameAsString=string_2, valuesToSet=priority_List)

watch_3 = Watch(set_list_of_values_to_list_of_2)
OneName = Input(OneName : var[]..[])
OneValues = Input(OneValues : var[]..[])
set_list_of_values_to_list_of_3 = Custom[Set List of Values to List of Elements for One Parameter](elementList=watch_3, parameterNameAsString=OneName, valuesToSet=OneValues)
TwoName = Input(TwoName : var[]..[])
TwoValues = Input(TwoValues : var[]..[])
set_list_of_values_to_list_of_4 = Custom[Set List of Values to List of Elements for One Parameter](elementList=set_list_of_values_to_list_of_3, parameterNameAsString=TwoName, valuesToSet=TwoValues)
string_3 = StringInput("X")
deconstructPoint = Geometry.Points.DeconstructPoint(watch)
set_list_of_values_to_list_of_5 = Custom[Set List of Values to List of Elements for One Parameter](elementList=set_list_of_values_to_list_of_4, parameterNameAsString=string_3, valuesToSet=deconstructPoint.out0)
string_4 = StringInput("Y")
set_list_of_values_to_list_of_6 = Custom[Set List of Values to List of Elements for One Parameter](elementList=set_list_of_values_to_list_of_5, parameterNameAsString=string_4, valuesToSet=deconstructPoint.out1)
string_5 = StringInput("Z")
set_list_of_values_to_list_of_7 = Custom[Set List of Values to List of Elements for One Parameter](elementList=set_list_of_values_to_list_of_6, parameterNameAsString=string_5, valuesToSet=deconstructPoint.out2)
ThreeName = Input(ThreeName : var[]..[])
ThreeValues = Input(ThreeValues : var[]..[])
set_list_of_values_to_list_of_8 = Custom[Set List of Values to List of Elements for One Parameter](elementList=set_list_of_values_to_list_of_7, parameterNameAsString=ThreeName, valuesToSet=ThreeValues)
FourName = Input(FourName : var[]..[])
FourValues = Input(FourValues : var[]..[])
set_list_of_values_to_list_of_9 = Custom[Set List of Values to List of Elements for One Parameter](elementList=set_list_of_values_to_list_of_8, parameterNameAsString=FourName, valuesToSet=FourValues)
FiveName = Input(FiveName : var[]..[])
FiveValues = Input(FiveValues : var[]..[])
set_list_of_values_to_list_of_10 = Custom[Set List of Values to List of Elements for One Parameter](elementList=set_list_of_values_to_list_of_9, parameterNameAsString=FiveName, valuesToSet=FiveValues)
final_Parameter_Set = Output(set_list_of_values_to_list_of_10)
watch_4 = Watch(set_list_of_values_to_list_of)
