# Dynamo custom node Place Family by Point Cloud.dyf (Dynamo 1.3.0.875)
# category: Bakery.Construction.PointCloud
# allows dropitems from 0 to 4 (discards half of the points at each drop level). Needs XYZ space or comma delimited text file. The Topography creation option does not seem to work well with huge numbers of points...
# Refer to What Revit Wants post for more details.

Delimiter = Input()
File_Path_to_Text_File = Input()
takeEveryNthItem = Input()
Yindex = Input()
Zindex = Input()
Xindex = Input()
make_points_from_point_cloud = Custom[Make Points From Point Cloud File](Delimiter=Delimiter, path=File_Path_to_Text_File, takeEveryNthItem=takeEveryNthItem, Yindex=Yindex, Zindex=Zindex, Xindex=Xindex)
familyType = Input()
family_instance_by_point_in = Custom[Family Instance By Point in Transaction](points=make_points_from_point_cloud, familyType=familyType)  # this is to skip binding problems with the core node, it was based on a clockwork node
FamilyInstances = Output(family_instance_by_point_in)
