# Dynamo custom node Place Free Instances to Match Project by Category.dyf (Dynamo 0.8.2.2392)
# category: Bakery.Revit.Document.Utility.Nested
# place instances and make a list. Needs OriginalElementID Instance Text parameter available in project.

list_of_model_elements = Custom[List of Model Elements simplified]()  # uses familyinstance select now
collect_all_familyinstance_using = Custom[Collect all FamilyInstance using Element Types]()  # should get model family instances
desiredCategory = Input()
isOfCategory = Custom[Element.IsOfCategory](element_s=collect_all_familyinstance_using, Category=desiredCategory)  # Checks whether an element is of a specified category
filterByBoolMask = List.FilterByBoolMask(list=collect_all_familyinstance_using, mask=isOfCategory)
location = FamilyInstance.Location(filterByBoolMask.in)
flatten = Flatten(location)
watch = Watch(flatten)
List_to_Copy_From = Output(filterByBoolMask.in)
Parent_Family_List = Output(filterByBoolMask.in)
symbol = FamilyInstance.Symbol(filterByBoolMask.in)
flatten_2 = Flatten(symbol)
location_2 = FamilyInstance.Location(filterByBoolMask.in)
flatten_3 = Flatten(location_2)
level = Custom[Element.Level](Element_s=filterByBoolMask.in)  # Gets an element's level
flatten_4 = Flatten(level)
byPointAndLevel = FamilyInstance.ByPointAndLevel(flatten_2, flatten_3, flatten_4)
Newly_Created_Instances = Output(byPointAndLevel)
flatten_5 = Flatten(filterByBoolMask.in)
get_element_position_rotate = Custom[Get Element Position Rotate Mirror](List_of_elements=flatten_5)  # details to various outputs
rotate_families_around_origin_by = Custom[Rotate Families Around Origin by Angle](FamilyElement=byPointAndLevel, DegreesToRotate=get_element_position_rotate.Rotation)  # this will take Family Instance and angles as list inputs, and rotate Families around their origin. Outputs provide feedback on information used.
bv_elements_to_ids = Custom[bv Elements to IDs](Element_s=filterByBoolMask.in)  # forked from CAAD_RWTH
ID_List = Output(bv_elements_to_ids.ID_s)
string = StringInput("OriginalElementID")
flat_list_to_list_of_strings = Custom[Flat List to List of Strings](Original_List=bv_elements_to_ids.ID_s)  # using python methods
setParameterByName = Element.SetParameterByName(element=byPointAndLevel, parameterName=string, value=flat_list_to_list_of_strings)
boolean = BoolSelector(true)
eq = get_element_position_rotate.FlippedFacing == boolean
filterByBoolMask_2 = List.FilterByBoolMask(list=byPointAndLevel, mask=eq)
watch_2 = Watch(filterByBoolMask_2.in)
FlippedFacing = Output(watch_2)
boolean_2 = BoolSelector(true)
eq_2 = get_element_position_rotate.FlippedHand == boolean_2
filterByBoolMask_3 = List.FilterByBoolMask(list=byPointAndLevel, mask=eq_2)
watch_3 = Watch(filterByBoolMask_3.in)
FlippedHand = Output(watch_3)
flipFacingOrientation = Custom[FamilyInstance.FlipFacingOrientation](Element_s=watch_2)  # Flips the facing orientation of a given family instance
flipHandOrientation = Custom[FamilyInstance.FlipHandOrientation](Element_s=watch_3)  # Flips the hand orientation of a given family instance
CanFlipHand = Output(get_element_position_rotate.CanFlipHand)
CanFlipFacing = Output(get_element_position_rotate.CanFlipFacing)
get_element_position_rotate_2 = Custom[Get Element Position Rotate Mirror](List_of_elements=watch_2)
boolean_3 = BoolSelector(true)
eq_3 = get_element_position_rotate_2.CanFlipFacing == boolean_3
filterByBoolMask_4 = List.FilterByBoolMask(list=watch_2, mask=eq_3)
FacingMirrorNeeded = Output(filterByBoolMask_4.out)
get_element_position_rotate_3 = Custom[Get Element Position Rotate Mirror](List_of_elements=watch_3)
boolean_4 = BoolSelector(true)
eq_4 = get_element_position_rotate_3.CanFlipHand == boolean_4
filterByBoolMask_5 = List.FilterByBoolMask(list=watch_3, mask=eq_4)
HandMirrorNeeded = Output(filterByBoolMask_5.out)
eq_5 = get_element_position_rotate.Is_Mirrorred == boolean
filterByBoolMask_6 = List.FilterByBoolMask(list=byPointAndLevel, mask=eq_5)
watch_4 = Watch(filterByBoolMask_6.in)
bv_if_equal_return_index = Custom[bv If Equal Return Index](listA=filterByBoolMask_4.out, listB=watch_4)  # forked
getItemAtIndex = List.GetItemAtIndex(list=watch_4, index=bv_if_equal_return_index)
FaceMirrorCompareList = Output(getItemAtIndex)
string_2 = StringInput("OriginalElementID")
bv_elements_to_ids_2 = Custom[bv Elements to IDs](Element_s=filterByBoolMask.in)
flat_list_to_list_of_strings_2 = Custom[Flat List to List of Strings](Original_List=bv_elements_to_ids_2.ID_s)
setParameterByName_2 = Element.SetParameterByName(element=filterByBoolMask.in, parameterName=string_2, value=flat_list_to_list_of_strings_2)
