# Dynamo custom node Place Soil Anchors at Spacing.dyf (Dynamo 1.2.0.2690)
# category: Bakery.Construction.Civil

pointList1 = Input()
pointList2 = Input()
spacing = Input()
anchorlength = Input()
perpendicular_curves_at_spacing = Custom[Perpendicular Curves at Spacing](pointListOne=pointList1, pointListTwo=pointList2, UVgridSpacing=spacing, length=anchorlength)
level = Input(level : Level)
structuralFramingType = Input(structuralFramingType : FamilyType)
beamByCurve = StructuralFraming.BeamByCurve(curve=perpendicular_curves_at_spacing, level=level, structuralFramingType=structuralFramingType)
StructuralFraming = Output(beamByCurve)
lines = Output(perpendicular_curves_at_spacing)
