# Dynamo custom node Point Lists to Shape Edited Floors.dyf (Dynamo 1.2.0.2831)
# category: Bakery.Civil
# Can use one or two point 'strings'

mainPointList = Input()

# group: primary point list
watch = Watch(mainPointList)

useBothPointListsBool = Input()
boolean = BoolSelector(false)
eq = useBothPointListsBool == boolean
offset = Input(offset : var[]..[])
offset_points_by_polycurve_and = Custom[Offset Points By PolyCurve and Distance](points=watch, distanceMayBeNegative=offset)

# group: lower line offsetted and Z matched
watch_2 = Watch(offset_points_by_polycurve_and)

switch = Custom[Switch](boolean_switch=eq, data=watch_2)
secondPointList = Input()
switch_2 = Custom[Switch](boolean_switch=useBothPointListsBool, data=secondPointList)
create = List.Create(switch, switch_2)
removeEmpty = Custom[List.RemoveEmpty](list=create)  # Removes empty indices from a list.
code_block = CodeBlock { 1; }
flatten = List.Flatten(list=removeEmpty, amt=code_block)

# group: offset or two point lists
watch_3 = Watch(flatten)

two_parallel_point_lists_to = Custom[Two Parallel Point Lists to Joined PolyCurve](mainPointList=watch, secondPointList=watch_3)

# group: Z OFFSETS
code_block_2 = CodeBlock { 0; }

replace_point_z_value = Custom[Replace Point Z Value](points=watch, desired_Z_value=code_block_2)
replace_point_z_value_2 = Custom[Replace Point Z Value](points=watch_3, desired_Z_value=code_block_2)
two_parallel_point_lists_to_2 = Custom[Two Parallel Point Lists to Joined PolyCurve](mainPointList=replace_point_z_value, secondPointList=replace_point_z_value_2)
watch_4 = Watch(two_parallel_point_lists_to_2.joinedPolyCurve)
floorType = Input(floorType : FloorType)
level = Input(level : Level)
byOutlineTypeAndLevel = Floor.ByOutlineTypeAndLevel(outline=watch_4, floorType=floorType, level=level)
end = Revit.Transaction.Transaction.End(byOutlineTypeAndLevel)
shape_edit_floor_with_points = Custom[Shape Edit Floor With Points](points=two_parallel_point_lists_to.pointsFromJoinedPC, floorElement=end)
end_2 = Revit.Transaction.Transaction.End(shape_edit_floor_with_points)
shapeEditedFloor = Output(end_2)
