# Dynamo custom node Points to PolyCurve with PruneDuplicates.dyf (Dynamo 1.2.0.2831)
# category: Bakery.Geometry

points = Input()
watch = Watch(points)
pruneDuplicates = Point.PruneDuplicates(points=watch)
prunedPoints = Output(pruneDuplicates)
byPoints = PolyCurve.ByPoints(points=pruneDuplicates)
PolyCurve = Output(byPoints)
