# Dynamo custom node Preflight to Make Revit Section Views from Lines.dyf (Dynamo 0.8.2.2371)
# category: Bakery.Views

element = Input(element : Element)
curves = Element.Curves(element)
firstItem = List.FirstItem(curves)
startPoint = Curve.StartPoint(firstItem)
endPoint = Curve.EndPoint(firstItem)
deconstructPoint = Geometry.Points.DeconstructPoint(endPoint)
ViewHeight = Input()
code_block = CodeBlock(z=deconstructPoint.out2, h=ViewHeight) { z+h; }
byCoordinates = Point.ByCoordinates(x=deconstructPoint.out0, y=deconstructPoint.out1, z=code_block)
deconstructPoint_2 = Geometry.Points.DeconstructPoint(startPoint)
code_block_2 = CodeBlock(z=deconstructPoint_2.out2, h=ViewHeight) { z+h; }
byCoordinates_2 = Point.ByCoordinates(x=deconstructPoint_2.out0, y=deconstructPoint_2.out1, z=code_block_2)
create = List.Create(startPoint, endPoint, byCoordinates, byCoordinates_2)
flatten = Flatten(create)
byPerimeterPoints = Surface.ByPerimeterPoints(flatten)
coordinateSystemAtParameter = Surface.CoordinateSystemAtParameter(byPerimeterPoints)
ZXPlane = CoordinateSystem.ZXPlane(coordinateSystemAtParameter)
flip = Input(flip : bool = false)
code_block_3 = CodeBlock { 180; }
code_block_4 = CodeBlock { 0; }
if_ = If(test=flip, true=code_block_3, false=code_block_4)
rotate = CoordinateSystem.Rotate(coordinateSystemAtParameter, ZXPlane, if_)
XYPlane = CoordinateSystem.XYPlane(rotate)
byPlane = CoordinateSystem.ByPlane(XYPlane)
XAxis = CoordinateSystem.XAxis(byPlane)
YAxis = CoordinateSystem.YAxis(byPlane)
origin = Plane.Origin(XYPlane)
vertices = Topology.Vertices(byPerimeterPoints)
pointGeometry = Vertex.PointGeometry(vertices)
identity = CoordinateSystem.Identity()
transform = Geometry.Transform(geometry=pointGeometry, fromCoordinateSystem=byPlane, contextCoordinateSystem=identity)
code_block_5 = CodeBlock { 0; }
ViewDepth = Input(ViewDepth : double = 100)
preflight_for_section_view = Custom[Preflight for Section View Creation](xAxis=XAxis, yAxis=YAxis, csOrigin=origin, PointList=transform, CropRegionOffset=code_block_5, ViewDepth=ViewDepth)
CoordinateSystem = Output(preflight_for_section_view.CoordinateSystem)
maxPoint = Output(preflight_for_section_view.maxPoint)
minPoint = Output(preflight_for_section_view.minPoint)
byOriginXAxisYAxis = Plane.ByOriginXAxisYAxis()
