# Dynamo custom node Process Family Type Excel Sheet and Get a Value To Write.dyf (Dynamo 0.9.2.4472)
# category: Bakery.Office.Excel
# column 1 - Family, column 2 - Type, column 3 - Value

listOfValuesToFind = Input(listOfValuesToFind : var[]..[])
Excel_FilePath = Input()
sheetName = Input(sheetName : string)

# group: Get Excel
fromPath = FileObject(Excel_FilePath)  # "File.FromPath"
readFromFile = Excel.ReadFromFile(file=fromPath, sheetName=sheetName)
watch = Watch(readFromFile)

# group: Make Family Type Name string
code_block = CodeBlock { 0; }
getItemAtIndex = List.GetItemAtIndex(index=code_block)
map = List.Map(list=watch, f_x=getItemAtIndex)
code_block_2 = CodeBlock { 1; }
dropItems = List.DropItems(list=map, amount=code_block_2)
code_block_3 = CodeBlock { 1; }
getItemAtIndex_2 = List.GetItemAtIndex(index=code_block_3)
map_2 = List.Map(list=watch, f_x=getItemAtIndex_2)
code_block_4 = CodeBlock { 1; }
dropItems_2 = List.DropItems(list=map_2, amount=code_block_4)
create = List.Create(dropItems, dropItems_2)
transpose = List.Transpose(create)
code_block_5 = CodeBlock { "---"; }

bv_merge_sublists_with_a = Custom[bv Merge Sublists with a separator](List=transpose, Character=code_block_5)  # forked from Rhythm
watch_2 = Watch(bv_merge_sublists_with_a)
ReplaceNullsWith = Input(ReplaceNullsWith : var[]..[])

# group: Current Designation Code List
code_block_6 = CodeBlock { 2; }
getItemAtIndex_3 = List.GetItemAtIndex(index=code_block_6)
map_3 = List.Map(list=watch, f_x=getItemAtIndex_3)
code_block_7 = CodeBlock { 1; }
dropItems_3 = List.DropItems(list=map_3, amount=code_block_7)

bv_replace_nulls = Custom[bv Replace Nulls](replacement=ReplaceNullsWith, seq=dropItems_3)
watch_3 = Watch(bv_replace_nulls)
search_one_list_based_on_second = Custom[Search One List Based on Second List and Get Values](listOfValuesToFind=listOfValuesToFind, listToSearchForValues=watch_2, ReplaceNullsWith=ReplaceNullsWith, listToGetValuesFrom=watch_3)  # get values from a 3rd list or the 1st list
watch_4 = Watch(search_one_list_based_on_second.indices)
TypeListInput = Input()
watch_5 = Watch(search_one_list_based_on_second.values)
eq = watch_5 == ReplaceNullsWith
filterByBoolMask = List.FilterByBoolMask(list=TypeListInput, mask=eq)
watch_6 = Watch(filterByBoolMask.out)
Type_List_passthrough = Output(watch_6)
count = Count(watch_6)
filterByBoolMask_2 = List.FilterByBoolMask(list=watch_5, mask=eq)
watch_7 = Watch(filterByBoolMask_2.out)
count_2 = Count(watch_7)
eq_2 = count == count_2
equalityCheck = Output(eq_2)
How_Many_New_Values = Output(count_2)  # "How Many New Values?"
valuesToWrite = Output(watch_7)
