# Dynamo custom node Project Base Point Details.dyf (Dynamo 0.8.2.2371)
# category: Bakery.Revit.Document
# some lists and details of project base point

categories = Categories("ProjectBasePoint")
all_elements_of_category = ElementsOfCategory(categories)
watch = Watch(all_elements_of_category)
string = StringInput("ProjectBasePoint")
string_2 = StringInput("---As one cell---")
string_3 = StringInput(",")
firstItem = List.FirstItem(all_elements_of_category)
parameters = Element.Parameters(firstItem)
sort = List.Sort(parameters)
flat_list_to_list_of_strings = Custom[Flat List to List of Strings](Original_List=sort)  # using python methods
string_from_array = FromArray(flat_list_to_list_of_strings)
number_slider = DoubleSlider(0, range=0..100 step 0.1)
number_slider_2 = DoubleSlider(1, range=0..100 step 0.1)
remove = String.Remove(str=string_from_array, startIndex=number_slider, count=number_slider_2)
length = String.Length(remove)
sub = length - number_slider_2
remove_2 = String.Remove(str=remove, startIndex=sub, count=number_slider_2)
string_4 = StringInput("\n")
replaceRegularExpression = Custom[String.ReplaceRegularExpression](regex=string_3, string_s=remove_2, replacement=string_4)  # Replaces all occurences of a regular expression within a given string (or list of strings) with another string. The syntax for regular expressions is explained at http://ironpython-test.readthedocs.org/en/latest/howto/regex.html
code_block = CodeBlock { "Angle to True North"; }
getParameterValueByName = Element.GetParameterValueByName(element=firstItem, parameterName=code_block)
string_from_object = FromObject(getParameterValueByName)
code_block_2 = CodeBlock { "N/S"; }
code_block_3 = CodeBlock { "no value"; }
bruteforce_get_parameter_value = Custom[Bruteforce Get Parameter Value by Name](element_or_elements=firstItem, parameterName=code_block_2, replaceEmptyValueWith=code_block_3)  # If Element.Parameters shows a value, this node will search for it and return the value or an optional empty value replacement.
code_block_4 = CodeBlock { "E/W"; }
code_block_5 = CodeBlock { "no value"; }
bruteforce_get_parameter_value_2 = Custom[Bruteforce Get Parameter Value by Name](element_or_elements=firstItem, parameterName=code_block_4, replaceEmptyValueWith=code_block_5)
string_5 = StringInput("--Sorted Param List---")
create = List.Create(string, string_2, replaceRegularExpression, code_block, string_from_object, code_block_2, bruteforce_get_parameter_value.BruteForceValues, code_block_4, bruteforce_get_parameter_value_2.BruteForceValues, string_5, flat_list_to_list_of_strings)
flatten = Flatten(create)
string_6 = StringInput("NULL VALUE")
replaceNull = Custom[List.ReplaceNull](list=flatten, replacement=string_6)  # Replaces all null values within a given list with a substitute
BasePointDetails = Output(replaceNull)
