# Dynamo custom node RVT Information for All RVTs in a Folder.dyf (Dynamo 1.2.1.3083)
# category: Bakery.Revit.Document
# including worksharing status

directoryPath = Input()
string = StringInput(".rvt")
all_directory_contents_of = Custom[All Directory Contents of Specific Filetype](dir_string=directoryPath, file_extension_string_like_txt=string)
watch = Watch(all_directory_contents_of)
from_file_path_into_rvt_build = Custom[From File Path into RVT Build Information]()  # unwired: fileObject
map = List.Map(list=watch, f_x=from_file_path_into_rvt_build)
code_block = CodeBlock { 1; }
getItemAtIndex = List.GetItemAtIndex(index=code_block)  # unwired: list
map_2 = List.Map(list=map, f_x=getItemAtIndex)
BuildInfo = Output(map_2)
code_block_2 = CodeBlock { 3; }
getItemAtIndex_2 = List.GetItemAtIndex(index=code_block_2)  # unwired: list
map_3 = List.Map(list=map, f_x=getItemAtIndex_2)
WorksharingInfo = Output(map_3)
FileList = Output(watch)
