# Dynamo custom node Read Civil CSV Into Lists.dyf (Dynamo 1.2.0.2831)
# category: Bakery.Construction.Civil

csvPath = Input()
fromPath = FileObject(csvPath)  # "File.FromPath"
readFromFile = CSV.ReadFromFile(fromPath)
transpose = List.Transpose(readFromFile)
watch = Watch(transpose)
firstItem = List.FirstItem(watch, lacing=Longest)
topRow = Output(firstItem)
first_three_rows_into_a_single = Custom[First Three Rows into a Single Header List](list=watch)  # this climbs from row 3 to row 1 replacing nulls

# group: Combined Headings
watch_2 = Watch(first_three_rows_into_a_single)

mergedHeaders = Output(watch_2)
code_block = CodeBlock { 1; }
getItemAtIndex = List.GetItemAtIndex(list=watch, index=code_block, lacing=Longest)
secondRow = Output(getItemAtIndex)
code_block_2 = CodeBlock { 3; }
dropItems = List.DropItems(list=watch, amount=code_block_2, lacing=Longest)

# group: Data Rows
watch_3 = Watch(dropItems)

dataRows = Output(watch_3)
