# Dynamo custom node Read Excel Into Lists.dyf (Dynamo 0.9.2.4472)
# category: Bakery.Office.Excel

string = StringInput("NULL_VALUE")
path = Input()
fromPath = FileObject(path)  # "File.FromPath"
sheetName = Input(sheetName : string)
code_block = CodeBlock { false; }
readFromFile = Excel.ReadFromFile(file=fromPath, sheetName=sheetName, readAsStrings=code_block)
bv_replace_nulls = Custom[bv Replace Nulls](replacement=string, seq=readFromFile)
dropRows = Input()
dropItems = List.DropItems(list=bv_replace_nulls, amount=dropRows)
watch = Watch(dropItems)
firstItem = List.FirstItem(watch)
headings = Output(firstItem)
code_block_2 = CodeBlock { 1; }
dropItems_2 = List.DropItems(list=watch, amount=code_block_2)
data = Output(dropItems_2)
