# Dynamo custom node Read File Path to ElementTree with UTF8 roundtrip.dyf (Dynamo 0.8.2.2371)
# category: Bakery.Data.XML
# to clean unsupported characters...

filePath = Input()
python_script = Python(IN[0]=filePath)
# ---------- python_script.python (17 lines) ----------
import clr
import sys
clr.AddReference('ProtoGeometry')
from Autodesk.DesignScript.Geometry import *
sys.path.append("C:\Program Files (x86)\IronPython 2.7\Lib")
#from xml.parsers.expat import expat -- can't find this
import xml.etree.ElementTree as ET
#The inputs to this node will be stored as a list in the IN variables.
filePath = IN[0]
uniStr = unicode(open(filePath, 'r').read())
#fixed = uniStr.encode('utf-8', 'replace')
fixed = uniStr.encode('ascii', 'replace')
fixed.decode('utf-8', 'replace')
tree = ET.ElementTree(ET.fromstring(fixed))
#start tree code
#Assign your output to the OUT variable.
OUT = tree
# ----------------------------------------
ElementTree = Output(python_script)
