# Dynamo custom node Reduce Text File Data.dyf (Dynamo 1.2.1.3083)
# category: Bakery.Standalone

path = Input()
fromPath = FileObject(path)  # "File.FromPath"
readText = File.ReadText(fromPath)
convert_string_with_line_breaks = Custom[Convert String with Line Breaks into List of Strings](string=readText)
flatten = Flatten(convert_string_with_line_breaks)
shuffle = List.Shuffle(flatten)
takeEveryNthItem = Input()
takeEveryNthItem_2 = List.TakeEveryNthItem(shuffle, takeEveryNthItem)
reducedList = Output(takeEveryNthItem_2)
count = Count(shuffle)
originalDataLength = Output(count)
count_2 = Count(takeEveryNthItem_2)
reducedDataLength = Output(count_2)
