# Dynamo custom node Remove From List by Revit Element Name Search.dyf (Dynamo 0.8.2.2371)
# category: Bakery.Core.List

list = Input()
watch = Watch(list)
element_name_universal = Custom[Element Name Universal](Element_s=watch)  # Modified for 0.8.1
searchAndRemoveNamesWith = Input()
contains = String.Contains(str=element_name_universal, searchFor=searchAndRemoveNamesWith)
filterByBoolMask = List.FilterByBoolMask(list=watch, mask=contains)
cleaned = Output(filterByBoolMask.out)
