# Dynamo custom node Remove Revision From Sheet subnode for listMap.dyf (Dynamo 0.8.2.2371)
# category: Bakery.Revit.Elements.Revision.Helper

sheetList = Input()
watch = Watch(sheetList)
counter = Input()
watch_2 = Watch(counter)
getItemAtIndex = List.GetItemAtIndex(list=watch, index=watch_2)
revisionList = Input()
getItemAtIndex_2 = List.GetItemAtIndex(list=revisionList, index=watch_2)
firstItem = List.FirstItem(getItemAtIndex_2)
code_block = CodeBlock { true; }
remove_revision_from_sheet = Custom[Remove Revision from Sheet](Sheet=getItemAtIndex, Revision=firstItem, RunIt=code_block)  # This node will remove specified Revisions from a sheet.
done = Output(remove_revision_from_sheet)
