# Dynamo custom node Rename All Fill Patterns with a Prefix.dyf (Dynamo 1.3.0.875)
# category: Bakery.Revit.Document.Utility

element_types = ElementTypes("FillPatternElement")
all_elements_of_type = ElementsOfType(element_types)
watch = Watch(all_elements_of_type)
element_name_universal = Custom[Element Name Universal](Elements=watch)  # Modified for 0.8.1
prefixToAdd = Input()
add_prefix_to_items_in_string = Custom[Add Prefix to Items in String List](string_list=element_name_universal, prefix=prefixToAdd)
watch_2 = Watch(add_prefix_to_items_in_string)
setName = Custom[Element.SetName](element=watch, name=watch_2)  # Gets the name of a given Revit element
done = Output(setName.Success)
