# Dynamo custom node Rename Families by Replacing Prefix.dyf (Dynamo 0.8.2.2371)
# category: Bakery.Revit.Elements.Family

familyList = Input()
flatten = Flatten(familyList)
uniqueItems = List.UniqueItems(flatten)
flatten_2 = Flatten(uniqueItems)
count = Count(flatten_2)
Number_of_families = Output(count)
element_name_universal = Custom[Element Name Universal](Element_s=uniqueItems)  # Modified for 0.8.1

# group: Get suffix
code_block = CodeBlock { 3; }
code_block_2 = CodeBlock { true; }
slice_string = Custom[Slice String](String_s=element_name_universal, of_Characters=code_block, Left_Right=code_block_2)  # Slices X number of leading or trailing characters from string (boolean true will slice from left while boolean set to false from right)

code_block_3 = CodeBlock { ""; }
desired_Prefix = Input()
join = String.Join(code_block_3, desired_Prefix)
map = List.Map(list=slice_string, f_x=join)
flatten_3 = Flatten(map)
setName = Custom[Element.SetName](element_s=uniqueItems, name=flatten_3)  # Gets the name of a given Revit element
rename_Success = Output(setName.Success)
new_Names = Output(map)
rename_Fail = Output(setName.Fail)
