# Dynamo custom node Rename Families with a Prefix.dyf (Dynamo 0.8.2.2371)
# category: Bakery.Families

familyList = Input()
flatten = Flatten(familyList)
uniqueItems = List.UniqueItems(flatten)
flatten_2 = Flatten(uniqueItems)
element_name_universal = Custom[Element Name Universal](Element_s=uniqueItems)  # Modified for 0.8.1
code_block = CodeBlock { ""; }
desired_Prefix = Input()
join = String.Join(code_block, desired_Prefix)
map = List.Map(list=element_name_universal, f_x=join)
flatten_3 = Flatten(map)
setName = Custom[Element.SetName](element_s=flatten_2, name=flatten_3)  # Gets the name of a given Revit element
rename_Success = Output(setName.Success)
rename_Fail = Output(setName.Fail)
new_Names = Output(map)
count = Count(flatten_2)
Number_of_families = Output(count)
