# Dynamo custom node Rename View by Replacing Prefix.dyf (Dynamo 0.8.2.2371)
# category: Bakery.Revit.Views
# replaces the same number of characters as the input string

views = Input()
code_block = CodeBlock { "View Name"; }
element_name_universal = Custom[Element Name Universal](Element_s=views)  # Modified for 0.8.1
code_block_2 = CodeBlock { 0; }
newPrefix = Input()
length = String.Length(newPrefix)
remove = String.Remove(str=element_name_universal, startIndex=code_block_2, count=length)
insert = String.Insert(str=remove, index=code_block_2, toInsert=newPrefix)
watch = Watch(insert)
set_list_of_values_to_list_of = Custom[Set List of Values to List of Elements for One Parameter](elementList=views, parameterNameAsString=code_block, valuesToSet=watch)  # as described
elementsOut = Output(set_list_of_values_to_list_of)
