# Dynamo custom node Rename Views by Appending Selected Suffix.dyf (Dynamo 0.8.2.2371)
# category: Bakery.Revit.Views

viewListIn = Input()
watch = Watch(viewListIn)
code_block = CodeBlock { "View Name"; }
create = List.Create(code_block)
code_block_2 = CodeBlock { "View Name"; }
getParameterValueByName = Element.GetParameterValueByName(element=watch, parameterName=code_block_2)
suffixToAppend = Input()
concat = String.Concat(arg1=suffixToAppend)
map = List.Map(list=getParameterValueByName, f_x=concat)
count = List.Count(map)
cycle = List.Cycle(list=create, amount=count)
setParameterByName = Element.SetParameterByName(element=watch, parameterName=cycle, value=map)
watch_2 = Watch(setParameterByName)
viewsOut = Output(watch_2)
