# Dynamo custom node Replace Item if True.dyf (Dynamo 1.0.0.1180)
# category: Bakery.Core.List
# takes two lists, plus a boolean list. If the boolean list says True, list1 item is replaced by list2 item

booleanlist = Input(booleanlist : var[])
code_block = CodeBlock { true; }
nullAllIndicesOf = Custom[NullAllIndicesOf](list=booleanlist, value=code_block)  # list all of the indices of a list that match the specified value. Capable of handling null values, part of the SmartCopyMonitor workflow.
indicesReplaced = Output(nullAllIndicesOf)
list1 = Input()
turnIntoList = Custom[TurnIntoList](unknownItem=list1)  # Turns an element (or a nested list) into a flat list
list2 = Input()
turnIntoList_2 = Custom[TurnIntoList](unknownItem=list2)
getItemAtIndex = List.GetItemAtIndex(list=turnIntoList_2, index=nullAllIndicesOf)
replaceItemAtIndex = Custom[List.ReplaceItemAtIndex](seq=turnIntoList, index=nullAllIndicesOf, replacement=getItemAtIndex)  # Replaces the item at a given index (or list of indices) of a list by another item
newList = Output(replaceItemAtIndex)
