# Dynamo custom node Replace Nulls with Other List Pythonic.dyf (Dynamo 1.3.3.4651)
# category: Bakery.Core.List
# replaces a null item with matching index in another list

replacementsAndNulls = Input()
originalList = Input()
python_script = Python(IN[0]=replacementsAndNulls, IN[1]=originalList)
# ---------- python_script.python (14 lines) ----------
import clr
clr.AddReference('ProtoGeometry')
from Autodesk.DesignScript.Geometry import *
#The inputs to this node will be stored as a list in the IN variables.
withnulls = IN[0]
originals = IN[1]
newlist = []
for x in range(len(withnulls)):
	if withnulls[x]:
		newlist.append(withnulls[x])
	else:
		newlist.append(originals[x])
#Assign your output to the OUT variable.
OUT = newlist
# ----------------------------------------
newlist = Output(python_script)
