# Dynamo custom node Report Dynamo Package Details by Folder.dyf (Dynamo 1.2.1.3083)
# category: Bakery.zBugCheckNeeded.Standalone.DynamoMgmt

path_To_Package_Folder = Input()
fromPath = DirectoryObject(path_To_Package_Folder)  # "Directory.FromPath"
contents = Directory.Contents(fromPath)
fromPath_2 = DirectoryObject(contents.out1)  # "Directory.FromPath"
contents_2 = Directory.Contents(fromPath_2)
fromPath_3 = DirectoryObject(contents_2.out1)  # "Directory.FromPath"
contents_3 = Directory.Contents(fromPath_3)
flatten = Flatten(contents_3)
string = StringInput("\dyf\")
split = String.Split(flatten, string, lacing=Longest)
lastItem = List.LastItem()  # unwired: arg0
map = List.Map(list=split, f_x=lastItem)
code_block = CodeBlock { 1; }
getItemAtIndex = List.GetItemAtIndex(index=code_block)  # unwired: list
map_2 = List.Map(list=map, f_x=getItemAtIndex)
fileListWithNulls = Output(map_2)
firstItem = List.FirstItem()  # unwired: arg0
map_3 = List.Map(list=map, f_x=firstItem)
code_block_2 = CodeBlock { "removeThese"; }
replaceNull = Custom[List.ReplaceNull](seq=map_2, replacement=code_block_2)  # Replaces all null values within a given list with a substitute
bv_all_indices_of = Custom[bv All Indices Of](list=replaceNull, indices=code_block_2)  # forked from Rhythm
removeItemAtIndex = List.RemoveItemAtIndex(list=map_3, indices=bv_all_indices_of)
string_2 = StringInput("\packages\")
split_2 = String.Split(removeItemAtIndex, string_2)
code_block_3 = CodeBlock { 1; }
getItemAtIndex_2 = List.GetItemAtIndex(index=code_block_3)  # unwired: list
map_4 = List.Map(list=split_2, f_x=getItemAtIndex_2)
watch = Watch(map_4)
package_name_for_dyfs_without_Nulls = Output(watch)
uniqueItems = List.UniqueItems(map_4)
watch_2 = Watch(uniqueItems)
Packages_Found = Output(watch_2)
create = List.Create(map_3, map_2)
watch_3 = Watch(create)
combined_List_of_dyfs_with_Parent_Folder = Output(watch_3)  # "combined List of dyfs with Parent Folder Path"
removeItemAtIndex_2 = List.RemoveItemAtIndex(list=replaceNull, indices=bv_all_indices_of)
watch_4 = Watch(removeItemAtIndex_2)
dyfs_found_without_Nulls = Output(watch_4)
searchFor = Input(searchFor : string)
code_block_4 = CodeBlock { true; }
contains = String.Contains(str=watch_4, searchFor=searchFor, ignoreCase=code_block_4)
filterByBoolMask = List.FilterByBoolMask(list=watch_4, mask=contains)
dyfs_Containing_Search_String = Output(filterByBoolMask.in)
filterByBoolMask_2 = List.FilterByBoolMask(list=watch, mask=contains)
packages_where_Dyfs_Match_Search = Output(filterByBoolMask_2.in)
removeItemAtIndex_3 = List.RemoveItemAtIndex(list=flatten, indices=bv_all_indices_of)
cleaned_path_list = Output(removeItemAtIndex_3)
