# Dynamo custom node Report RVT Links Visible in Views on Sheets.dyf (Dynamo 0.8.2.2371)
# category: Bakery.Revit.Views

list_views_not_on_sheets = Custom[List Views not on Sheets]()  # also give Views On Sheets as other output
element_name_universal = Custom[Element Name Universal](Element_s=list_views_not_on_sheets.ViewsOnSheetsAsElements)  # Modified for 0.8.1
code_block = CodeBlock { "Sheet Number"; }
getParameterValueByName = Element.GetParameterValueByName(element=list_views_not_on_sheets.ViewsOnSheetsAsElements, parameterName=code_block)
list_revit_links_visible_in_view = Custom[List Revit Links Visible in View]()  # use with list.map
map = List.Map(list=list_views_not_on_sheets.ViewsOnSheetsAsElements, f_x=list_revit_links_visible_in_view)
element_name_universal_2 = Custom[Element Name Universal]()
map_2 = List.Map(list=map, f_x=element_name_universal_2)
create = List.Create(list_views_not_on_sheets.ViewsOnSheetsAsElements, element_name_universal, getParameterValueByName, map, map_2)
code_block_2 = CodeBlock { 3; }
getItemAtIndex = List.GetItemAtIndex(list=create, index=code_block_2)
rvtLinksVisible = Output(getItemAtIndex)
code_block_3 = CodeBlock { 2; }
getItemAtIndex_2 = List.GetItemAtIndex(list=create, index=code_block_3)
sheetNumber = Output(getItemAtIndex_2)
code_block_4 = CodeBlock { 0; }
getItemAtIndex_3 = List.GetItemAtIndex(list=create, index=code_block_4)
viewsOnSheets = Output(getItemAtIndex_3)
code_block_5 = CodeBlock { 1; }
getItemAtIndex_4 = List.GetItemAtIndex(list=create, index=code_block_5)
viewNames = Output(getItemAtIndex_4)
code_block_6 = CodeBlock { 4; }
getItemAtIndex_5 = List.GetItemAtIndex(list=create, index=code_block_6)
rvtLinkNames = Output(getItemAtIndex_5)
