# Dynamo custom node Revit Element Clash Detection v1.dyf (Dynamo 1.0.0.1180)
# category: Bakery.Construction.Coordination

RevitElementSetA = Input()
RevitElementSetB = Input()
python_script = Python(IN[0]=RevitElementSetA, IN[1]=RevitElementSetB)
# ---------- python_script.python (81 lines) ----------
import clr
clr.AddReference('ProtoGeometry')
from Autodesk.DesignScript.Geometry import *
# Import ToDSType(bool) extension method
clr.AddReference("RevitNodes")
import Revit
clr.ImportExtensions(Revit.Elements)
# Import geometry conversion extension methods
clr.ImportExtensions(Revit.GeometryConversion)
# Import DocumentManager and TransactionManager
clr.AddReference("RevitServices")
import RevitServices
from RevitServices.Persistence import DocumentManager
from RevitServices.Transactions import TransactionManager
from System.Collections.Generic import *
# Import RevitAPI
clr.AddReference("RevitAPI")
import Autodesk
from Autodesk.Revit.DB import *

doc = DocumentManager.Instance.CurrentDBDocument
uiapp = DocumentManager.Instance.CurrentUIApplication
app = uiapp.Application
uidoc=DocumentManager.Instance.CurrentUIApplication.ActiveUIDocument

#The inputs to this node will be stored as a list in the IN variable.
#dataEnteringNode = IN

clashElementsAdirty=IN[0]
clashElementsBdirty=IN[1]

# Start Transaction
TransactionManager.Instance.EnsureInTransaction(doc)
clashElementsA = []
clashElementsB = []
clashGeomA = []
FailuresA = []
clashGeomB = []
FailuresB = []
clashFoundA = []
clashFoundB = []
clashSolids = []
clashPoints = []
for a in clashElementsAdirty:
	try:
		clashGeomA.append(a.Geometry()[0])
		clashElementsA.append(a)
	except:
		FailuresA.append(a)
for b in clashElementsBdirty:
	try:
		clashGeomB.append(b.Geometry()[0])
		clashElementsB.append(b)
	except:
		FailuresB.append(b)

counterA = range(len(clashElementsA))
counterB = range(len(clashElementsB))

for i in counterA:
	tempGeomA = clashGeomA[i]
	for j in counterB:
#		tempGeomB = clashGeomB[j]
#		clashIntersectResults.append(tempGeomB.DoesIntersect(tempGeomA))
#		if tempGeomA.DoesIntersect(tempGeomB):
		if clashGeomA[i].DoesIntersect(clashGeomB[j]) == True:
#		clashIntersectResults.append(clashGeomA[i].DoesIntersect(clashGeomB[j]))
			clashFoundA.append(clashElementsA[i])
			clashFoundB.append(clashElementsB[j])
			tempSolid = clashGeomA[i].Intersect(clashGeomB[j])
			clashSolids.append(tempSolid[0])
			clashPoints.append(tempSolid[0].Centroid())

# End Transaction
TransactionManager.Instance.TransactionTaskDone()

#if fileversion == "":
#	OUT="Default settings used"
#else:
#	OUT=total_export
OUT = clashFoundA, clashFoundB, clashSolids, clashPoints, FailuresA, FailuresB
# ----------------------------------------
code_block = CodeBlock { 0; }
getItemAtIndex = List.GetItemAtIndex(list=python_script, index=code_block)
clashSetA = Output(getItemAtIndex)
code_block_2 = CodeBlock { 1; }
getItemAtIndex_2 = List.GetItemAtIndex(list=python_script, index=code_block_2)
clashSetB = Output(getItemAtIndex_2)
code_block_3 = CodeBlock { 4; }
getItemAtIndex_3 = List.GetItemAtIndex(list=python_script, index=code_block_3)
SetA_GeometryFailures = Output(getItemAtIndex_3)
code_block_4 = CodeBlock { 5; }
getItemAtIndex_4 = List.GetItemAtIndex(list=python_script, index=code_block_4)
SetB_GeometryFailures = Output(getItemAtIndex_4)
code_block_5 = CodeBlock { 2; }
getItemAtIndex_5 = List.GetItemAtIndex(list=python_script, index=code_block_5)
intersectingSolid = Output(getItemAtIndex_5)
code_block_6 = CodeBlock { 3; }
getItemAtIndex_6 = List.GetItemAtIndex(list=python_script, index=code_block_6)
clashPoint = Output(getItemAtIndex_6)
