# Dynamo custom node Room List with Enclosure Tests.dyf (Dynamo 0.9.1.4062)
# category: Bakery.Revit.Elements.Room
# also includes some bools to handle empty / null lists. returns one large nested list.

list_room_and_space_elements = Custom[List Room and Space Elements]()  # with a general bool test too
integer_slider = IntegerSlider(1, range=0..100 step 1)
getItemAtIndex = List.GetItemAtIndex(list=list_room_and_space_elements, index=integer_slider)
string = StringInput("Perimeter")
getParameterValueByName = Element.GetParameterValueByName(element=getItemAtIndex, parameterName=string)
number = DoubleInput(0)
eq = getParameterValueByName == number
anyTrue = Custom[List.AnyTrue](seq=eq)  # Returns true if any item in a list of booleans is true.
watch = Watch(anyTrue)
location = Custom[Element.Location](element=getItemAtIndex)  # Returns the location of an element as an XYZ (or if it's line-based the start and end point of the line), along with some booleans to help filtering the results. Use this for some element types (e.g. walls or lines) that do not work with the built-in Get Family Instance Location node.
watch_2 = Watch(location.hasLocation)
anyFalse = Custom[List.AnyFalse](seq=watch_2)  # Returns true if any item in a list of booleans is false.
watch_3 = Watch(anyFalse)
create = List.Create(list_room_and_space_elements, watch, getParameterValueByName, watch_3)
watch_4 = Watch(create)
Big_List = Output(watch_4)
integer_slider_2 = IntegerSlider(1, range=0..100 step 1)
getItemAtIndex_2 = List.GetItemAtIndex(list=watch_4, index=integer_slider_2)
Any_Unenclosed = Output(getItemAtIndex_2)  # "Any Unenclosed?"
integer_slider_3 = IntegerSlider(0, range=0..100 step 1)
getItemAtIndex_3 = List.GetItemAtIndex(list=watch_4, index=integer_slider_3)
integer_slider_4 = IntegerSlider(0, range=0..100 step 1)
getItemAtIndex_4 = List.GetItemAtIndex(list=getItemAtIndex_3, index=integer_slider_4)
No_Rooms_in_Project = Output(getItemAtIndex_4)  # "No Rooms in Project?"
integer_slider_5 = IntegerSlider(1, range=0..100 step 1)
getItemAtIndex_5 = List.GetItemAtIndex(list=getItemAtIndex_3, index=integer_slider_5)
string_2 = StringInput("Name")
getParameterValueByName_2 = Element.GetParameterValueByName(element=getItemAtIndex_5, parameterName=string_2)
Room_List = Output(getParameterValueByName_2)
integer_slider_6 = IntegerSlider(3, range=0..100 step 1)
getItemAtIndex_6 = List.GetItemAtIndex(list=watch_4, index=integer_slider_6)
Any_Redundant = Output(getItemAtIndex_6)  # "Any Redundant?"
