# Dynamo custom node Room to Element Geometry Test for Preflight.dyf (Dynamo 0.8.2.2392)
# category: Bakery.Geometry

roomsIn = Input()
watch = Watch(roomsIn)
code_block = CodeBlock { "Area"; }
getParameterValueByName = Element.GetParameterValueByName(element=watch, parameterName=code_block)
watch_2 = Watch(getParameterValueByName)
removeRoomsWithAreaLessThanM2 = Input()
lt = watch_2 < removeRoomsWithAreaLessThanM2
code_block_2 = CodeBlock { true; }
replaceNulls = Lists.Manage.ReplaceNulls(lt, code_block_2)
filterByBoolMask = List.FilterByBoolMask(list=watch, mask=replaceNulls)
removedTooSmall = Output(filterByBoolMask.in)
watch_3 = Watch(filterByBoolMask.out)
geometry = Element.Geometry(watch_3)
firstItem = List.FirstItem()
map = List.Map(list=geometry, f_x=firstItem)
replaceNulls_2 = Lists.Manage.ReplaceNulls(map, code_block_2)
bv_all_indices_of = Custom[bv All Indices Of](list=replaceNulls_2, indices=code_block_2)  # forked from Rhythm
removeItemAtIndex = List.RemoveItemAtIndex(list=watch_3, indices=bv_all_indices_of)
roomListGoodToGo = Output(removeItemAtIndex)
getItemAtIndex = List.GetItemAtIndex(list=watch_3, index=bv_all_indices_of)
geometryFailed = Output(getItemAtIndex)
