# Dynamo custom node Rooms to Closed Polycurves without Nulls.dyf (Dynamo 0.8.2.2371)
# category: Bakery.Revit.Elements.Room

roomList = Input()
watch = Watch(roomList)
rooms_to_polycurves = Custom[Rooms to PolyCurves](roomList=watch)  # deeply nested, could be hidden
watch_2 = Watch(rooms_to_polycurves)
firstItem = List.FirstItem()
map = List.Map(list=watch_2, f_x=firstItem)
code_block = CodeBlock { null; }
bv_all_indices_of_that_can = Custom[bv All Indices Of that can handle Nulls](list=map, value=code_block)  # forked from spring nodes
watch_3 = Watch(bv_all_indices_of_that_can)
removeItemAtIndex = List.RemoveItemAtIndex(list=watch, indices=watch_3)
cleaned_Room_List = Output(removeItemAtIndex)
removeItemAtIndex_2 = List.RemoveItemAtIndex(list=map, indices=watch_3)
closeWithLine = PolyCurve.CloseWithLine()
map_2 = List.Map(list=removeItemAtIndex_2, f_x=closeWithLine)
watch_4 = Watch(map_2)
closed_Polycurves = Output(watch_4)
code_block_2 = CodeBlock { "Number"; }
getParameterValueByName = Element.GetParameterValueByName(element=removeItemAtIndex, parameterName=code_block_2)
room_Numbers = Output(getParameterValueByName)
