# Dynamo custom node Sample Curve By Divisions.dyf (Dynamo 1.2.0.2690)
# category: Bakery.Geometry

points = Input(points : Point[])
byControlPoints = NurbsCurve.ByControlPoints(points)
NurbsCurve = Output(byControlPoints)
divisions = Input()
code_block = CodeBlock(z=divisions) { 0..1..(1/z); }
pointAtParameter = Curve.PointAtParameter(curve=byControlPoints, param=code_block, lacing=Longest)
create = List.Create(pointAtParameter)
watch = Watch(create)
sampled = Output(watch)
