# Dynamo custom node Search Items in List and Return Matched Pairs.dyf (Dynamo 0.9.2.4472)
# category: Bakery.Core.List

searchForThese = Input()
searchInThisList = Input()
python_script = Python(IN[0]=searchForThese, IN[1]=searchInThisList)
# ---------- python_script.python (16 lines) ----------
import clr
clr.AddReference('ProtoGeometry')
from Autodesk.DesignScript.Geometry import *
#The inputs to this node will be stored as a list in the IN variables.
searchItems = IN[0]
searchIn = IN[1]
searchMatches = []
foundItems = []
for x in searchItems:
	for z in searchIn:
		if x in z:
			searchMatches.append(x)
			foundItems.append(z)

#Assign your output to the OUT variable.
OUT = searchMatches, foundItems
# ----------------------------------------
code_block = CodeBlock { 1; }
getItemAtIndex = List.GetItemAtIndex(list=python_script, index=code_block)
foundItems = Output(getItemAtIndex)
code_block_2 = CodeBlock { 0; }
getItemAtIndex_2 = List.GetItemAtIndex(list=python_script, index=code_block_2)
searchMatched = Output(getItemAtIndex_2)
