# Dynamo custom node Search Link Names and Send Instance Ids to Clipboard.dyf (Dynamo 0.8.2.2371)
# category: Bakery.Revit.Document.Links

get_linked_rvt_documents = Custom[Get Linked RVT Documents]()
searchFor = Input(searchFor : string)
contains = String.Contains(str=get_linked_rvt_documents.Link_Name, searchFor=searchFor)
filterByBoolMask = List.FilterByBoolMask(list=get_linked_rvt_documents.Link_Instance_Id, mask=contains)
watch = Watch(filterByBoolMask.in)
convert_list_to_comma_delimited = Custom[Convert List to Comma Delimited String](arr=watch)
sendTo = Custom[Clipboard.SendTo](str=convert_list_to_comma_delimited)  # Copies a string to the clipboard. ATTENTION: Will only work with strings and on top of Revit (not in sandbox mode).
sentToClipboard = Output(sendTo)
id_List = Output(watch)
filterByBoolMask_2 = List.FilterByBoolMask(list=get_linked_rvt_documents.Link_Instance, mask=contains)
link_instances = Output(filterByBoolMask_2.in)
filterByBoolMask_3 = List.FilterByBoolMask(list=get_linked_rvt_documents.Link_Doc, mask=contains)
link_docs = Output(filterByBoolMask_3.in)
filterByBoolMask_4 = List.FilterByBoolMask(list=get_linked_rvt_documents.Link_Name, mask=contains)
link_names = Output(filterByBoolMask_4.in)
