# Dynamo custom node Search One List Based on Second List and Get Values.dyf (Dynamo 0.9.2.4472)
# category: Bakery.Core.List
# get values from a 3rd list or the 1st list

listOfValuesToFind = Input()
listToSearchForValues = Input()
firstIndexOf = List.FirstIndexOf(list=listToSearchForValues)
map = List.Map(list=listOfValuesToFind, f_x=firstIndexOf)
listToGetValuesFrom = Input()
count = Count(listToGetValuesFrom)
code_block = CodeBlock { -1; }
eq = _ == code_block
replaceByCondition = Replace(map, count, eq)
indices = Output(replaceByCondition)
ReplaceNullsWith = Input()
addItemToEnd = List.AddItemToEnd(ReplaceNullsWith, listToGetValuesFrom)
watch = Watch(addItemToEnd)
bv_replace_nulls = Custom[bv Replace Nulls](replacement=ReplaceNullsWith, seq=watch)

# group: fix the -1 input to this
getItemAtIndex = List.GetItemAtIndex(list=bv_replace_nulls, index=replaceByCondition)

watch_2 = Watch(getItemAtIndex)
values = Output(watch_2)
