# Dynamo custom node Search One List with Sublists and Return from Another.dyf (Dynamo 0.8.2.2371)
# category: Bakery.Core.List

get_from_these_sublists = Input()
in_sublists_here = Input()
find_this = Input()
turn_into_list = Custom[Turn Into List](item=find_this)  # Turns an element into a (flat) list
if_equal_return_index_using = Custom[If Equal Return Index using IndexOf](searchForThese=turn_into_list)
map = List.Map(list=in_sublists_here, f_x=if_equal_return_index_using)
firstItem = List.FirstItem()
map_2 = List.Map(list=map, f_x=firstItem)
watch = Watch(map_2)
get_from_sublists_using_matching = Custom[Get From Sublists using matching List of Indices](lists_with_sublists=get_from_these_sublists, list_of_indices=watch)
values = Output(get_from_sublists_using_matching)
