# Dynamo custom node Search by Workset and return Items.dyf (Dynamo 0.9.1.4062)
# category: Bakery.Collect
# also has a bool result, FALSE if it contains items, TRUE if empty

get_worksets = Custom[Get Worksets]()  # Retrieves user worksets from specified document
Workset_Name = Input()
string_from_object = FromObject(Workset_Name)
turnIntoList = Custom[Turn Into List](unknownItem=string_from_object)  # Turns an element (or a nested list) into a flat list
turnIntoList_2 = Custom[Turn Into List](unknownItem=get_worksets.Names)
if_equal_return_index = Custom[If Equal Return Index](listA=turnIntoList, listB=turnIntoList_2)  # If element in list A is equal to an element in list B then return index from list B.
getItemAtIndex = List.GetItemAtIndex(list=get_worksets.Ids, index=if_equal_return_index)
string_from_object_2 = FromObject(getItemAtIndex)
toNumber = String.ToNumber(string_from_object_2)
collect_all_elements_in_model = Custom[Collect All Elements in Model faster]()  # does not report count or categories
flatten = Flatten(collect_all_elements_in_model)
string = StringInput("Workset")
getParameterValueByName = Element.GetParameterValueByName(element=flatten, parameterName=string)
if_equal_return_index_2 = Custom[If Equal Return Index](listA=toNumber, listB=getParameterValueByName)
isEmpty = List.IsEmpty(if_equal_return_index_2)
watch = Watch(isEmpty)
True_if_Empty = Output(watch)
getItemAtIndex_2 = List.GetItemAtIndex(list=flatten, index=if_equal_return_index_2)
elements_to_ids = Custom[Element.ID](Element_s=getItemAtIndex_2)  # Gets the ID(s) for a list of Revit elements (or a single element) - unlike the built-in Element.Id node, this node returns an actual Revit Element ID and *not* a number
watch_2 = Watch(elements_to_ids.ID_s)
Elements_on_Workset = Output(watch_2)
