# Dynamo custom node Search for DWGs in Document Link List.dyf (Dynamo 0.9.1.4062)
# category: Bakery.Revit.Document.Links
# returns true if they exist, and then lists parameters

linksAndImports = Custom[Document.LinksAndImports]()  # Gets all linked and imported files in the document
flatten = Flatten(linksAndImports.links)
parameters = Element.Parameters(flatten)
string = StringInput("No DWG links")
replaceNull = Custom[List.ReplaceNull](seq=parameters, replacement=string)  # Replaces all null values within a given list with a substitute
watch = Watch(replaceNull)
DWG_Link_Parameters = Output(watch)
string_from_object = FromObject(parameters)
string_2 = StringInput("dwg")
contains = String.Contains(str=string_from_object, searchFor=string_2)
string_from_object_2 = FromObject(contains)
string_3 = StringInput("true")
contains_2 = String.Contains(str=string_from_object_2, searchFor=string_3)
anyTrue = Custom[List.AnyTrue](seq=contains_2)  # Returns true if any item in a list of booleans is true.
watch_2 = Watch(anyTrue)
Any_DWGs_Links = Output(watch_2)  # "Any DWGs Links?"
