# Dynamo custom node Search for Matching Value and Summarise.dyf (Dynamo 0.8.2.2371)
# category: Bakery.Core.List

get_from_this_list = Input()
in_this_list = Input()
search_for = Input()
eq = in_this_list == search_for
filterByBoolMask = List.FilterByBoolMask(list=get_from_this_list, mask=eq)
matching = Output(filterByBoolMask.in)
countTrue = CountTrue(eq)
count = Output(countTrue)
