# Dynamo custom node Select Elements Using BuiltIn Category Names.dyf (Dynamo 0.9.1.4062)
# category: Bakery.Collect
# works on a list of BuiltIn Names

builtIns = Input()
select_based_on_a_single_builtin = Custom[Select based on a single builtin name]()  # asdf
map = List.Map(list=builtIns, f_x=select_based_on_a_single_builtin)
removeNulls = Lists.Manage.RemoveNulls(map)
flatten = Flatten(removeNulls)
elements = Output(flatten)
