# Dynamo custom node Select Family Definition in Link by Wildcard.dyf (Dynamo 1.2.1.3083)
# category: Bakery.Revit.Document.Links
# search link name and family names

searchLinkNames = Input()
get_link_document_from_link_name = Custom[Get Link Document from Link Name](searchFor=searchLinkNames)
get_family_list_for_document = Custom[Get Family List for Document](doc=get_link_document_from_link_name)
element_name_universal = Custom[Element Name Universal](Elements=get_family_list_for_document)  # Modified for 0.8.1
toUpper = String.ToUpper(element_name_universal)
searchFamilyNamesInLink = Input()
toUpper_2 = String.ToUpper(searchFamilyNamesInLink)
contains = String.Contains(str=toUpper, searchFor=toUpper_2)
filterByBoolMask = List.FilterByBoolMask(list=get_family_list_for_document, mask=contains)
FamiliesFound = Output(filterByBoolMask.in)
get_all_family_instances_from = Custom[Get All Family Instances From Link Doc](linkdoc=get_link_document_from_link_name)
get_family_from_element = Custom[Get Family from Element](oneElement=get_all_family_instances_from)  # working now
element_name_universal_2 = Custom[Element Name Universal](Elements=get_family_from_element)
toUpper_3 = String.ToUpper(element_name_universal_2)
contains_2 = String.Contains(str=toUpper_3, searchFor=toUpper_2)
filterByBoolMask_2 = List.FilterByBoolMask(list=get_all_family_instances_from, mask=contains_2)
ElementsFound = Output(filterByBoolMask_2.in)
