# Dynamo custom node Select Taggable Elements Not Tagged in Active View.dyf (Dynamo 1.2.0.2831)
# category: Bakery.Revit.Elements.Tag
# from the Dynamo Player samples

all_elements_in_active_view = ElementsInView()
element_types = ElementTypes("IndependentTag")
all_elements_of_type = ElementsOfType(element_types)
taggedElement = Tag.TaggedElement(all_elements_of_type)
containsItem = List.ContainsItem(list=taggedElement)  # unwired: item
filter = List.Filter(all_elements_in_active_view, containsItem)
select_elements = Python(IN[0]=filter.out1)
# ---------- select_elements.python (25 lines) ----------
import clr
clr.AddReference("RevitAPI")
clr.AddReference("RevitAPIUI")
import Autodesk
from Autodesk.Revit.UI import *
from Autodesk.Revit.DB import *
clr.AddReference("RevitServices")
import RevitServices
from RevitServices.Persistence import DocumentManager
clr.AddReference("RevitNodes")
import Revit
# clr.ImportExtensions(Revit.Elements)
from System.Collections.Generic import *

elems = UnwrapElement(IN[0])

elemIds = []
for elem in elems:
	elemIds.append(elem.Id)
	
uidoc = DocumentManager.Instance.CurrentUIDocument
uidoc.Selection.SetElementIds(List[ElementId](elemIds))

# Just for fun - give it to the output!
OUT = elemIds
# ----------------------------------------
selected = Output(select_elements)
