# Dynamo custom node Select Workset by Name.dyf (Dynamo 0.9.1.4062)
# category: Bakery.Revit.Document.Worksets

worksets = Custom[Document.Worksets]()  # Returns all Worksets in the current document
element_name_universal = Custom[Element Name Universal](Element_s=worksets)  # Modified for 0.8.1
worksetName = Input()
firstIndexOf = List.FirstIndexOf(list=element_name_universal, item=worksetName)
getItemAtIndex = List.GetItemAtIndex(list=worksets, index=firstIndexOf)
worksetDbElement = Output(getItemAtIndex)
