# Dynamo custom node Select based on a single builtin name.dyf (Dynamo 0.8.1.1942)
# category: Bakery.Collect
# use with List.Map for input of Built In Name list

builtinName = Input()
python_script = Python(IN[0]=builtinName)
# ---------- python_script.python (33 lines) ----------
#LSJ

import clr
clr.AddReference('ProtoGeometry')
from Autodesk.DesignScript.Geometry import *

# Import DocumentManager
clr.AddReference("RevitServices")
import RevitServices
from RevitServices.Persistence import DocumentManager

# Import RevitAPI
clr.AddReference("RevitAPI")
import Autodesk

# Import ToDSType(bool) extension method
clr.AddReference("RevitNodes")
import Revit
from Autodesk.Revit.DB import *
clr.ImportExtensions(Revit.Elements)

import System

builtInName = IN

#The inputs to this node will be stored as a list in the IN variable.
doc = DocumentManager.Instance.CurrentDBDocument
uiapp = DocumentManager.Instance.CurrentUIApplication
app = uiapp.Application

listed = []
listed.append(FilteredElementCollector(doc).WhereElementIsNotElementType().OfCategory(builtInName[0]).ToElements())
OUT = listed
# ----------------------------------------
elements = Output(python_script)
