# Dynamo custom node Send Element IDs to Clipboard.dyf (Dynamo 0.8.2.2371)
# category: Bakery.Revit.Clipboard
# Can be pasted into Select by ID

elementList = Input()
flatten = Flatten(elementList)
element_ids = Custom[Element Ids](Element_s=flatten)  # This node will query an element id that can be used with Revit nodes. Dynamo Element Id node returns integer value.
convert_list_to_comma_delimited = Custom[Convert List to Comma Delimited String](arr=element_ids.Rvt_ElementId_s)
bv_send_to_clipboard_from_revit = Custom[bv Send to Clipboard from Revit](str=convert_list_to_comma_delimited)
done = Output(bv_send_to_clipboard_from_revit)
