# Dynamo custom node Set Discipline Property for Views.dyf (Dynamo 1.2.0.2831)
# category: Bakery.Views

View = Input()
turnIntoList = Custom[Turn Into List](unknownItem=View)  # Turns an element (or a nested list) into a flat list
ViewDiscipline = Input()
python_script = Python(IN[0]=turnIntoList, IN[1]=ViewDiscipline)
# ---------- python_script.python (34 lines) ----------
import clr
clr.AddReference('RevitAPI')
from Autodesk.Revit.DB import *

clr.AddReference("RevitServices")
import RevitServices
from RevitServices.Persistence import DocumentManager
from RevitServices.Transactions import TransactionManager

doc = DocumentManager.Instance.CurrentDBDocument
viewinsts = UnwrapElement(IN[0])
vdmode = IN[1]
successlist = list()

booleans = list()
TransactionManager.Instance.EnsureInTransaction(doc)
for item in viewinsts:
	try:
#		p = item.get_Parameter(BuiltInParameter.VIEWER_OPTION_VISIBILITY)
#		p.Set(options[counter].Id)
		item.Set(ViewDiscipline.vdmode)
		booleans.append(True)
	except:
		booleans.append(False)
TransactionManager.Instance.TransactionTaskDone()

#for item in viewinsts:
#	try:
#		item.SetWorkSharingDisplayMode(wsmode)
#		successlist.append("Success")
#	except:
#		successlist.append("Failed")

OUT = booleans
# ----------------------------------------
success = Output(python_script)  # "success?"
