# Dynamo custom node Set Element Id to Mark Parameter.dyf (Dynamo 1.0.0.1180)
# category: Bakery.Revit.Parameters

elementList = Input()
string = StringInput("Mark")
id = Element.Id(elementList)
flat_list_to_list_of_strings = Custom[Flat List to List of Strings](Original_List=id)  # using python methods
set_list_of_values_to_list_of = Custom[Set List of Values to List of Elements for One Parameter](elementList=elementList, parameterNameAsString=string, valuesToSet=flat_list_to_list_of_strings)  # as described
elementsOut = Output(set_list_of_values_to_list_of)
