# Dynamo custom node Set List of Values to List of Elements for One Parameter.dyf (Dynamo 1.2.1.3083)
# category: Bakery.Revit.Parameters
# as described

elementList = Input()
parameterNameAsString = Input()
create = List.Create(parameterNameAsString)
count = List.Count(elementList)
cycle = List.Cycle(list=create, amount=count)
valuesToSet = Input()
setParameterByName = Element.SetParameterByName(element=elementList, parameterName=cycle, value=valuesToSet)
watch = Watch(setParameterByName)
elementsOut = Output(watch)
