# Dynamo custom node Set One Parameter to Many Elements.dyf (Dynamo 0.8.0.950)
# category: Bakery.Revit.Parameters
# elements as a list, single value and single parameter name

elementList = Input()
create = List.Create(elementList)
flatten = Flatten(create)
parameterNameAsString = Input()
create_2 = List.Create(parameterNameAsString)
count = List.Count(elementList)
cycle = List.Cycle(list=create_2, amount=count)
flatten_2 = Flatten(cycle)
valueToSet = Input()
create_3 = List.Create(valueToSet)
cycle_2 = List.Cycle(list=create_3, amount=count)
flatten_3 = Flatten(cycle_2)
setParameterByName = Element.SetParameterByName(element=flatten, parameterName=flatten_2, value=flatten_3)
elementsOut = Output(setParameterByName)
