# Dynamo custom node Set OriginalNesting Level Parameter for all FamilyInstances.dyf (Dynamo 0.8.2.2392)
# category: Bakery.Revit.Document.Utility.Nested
# Sets OriginalNestingLevel from 0 (not nested) to 3 (triple nested). Needs an instance Integer parameter called OriginalNestingLevel to be set for all Categories *prior* to running this node.

collect_all_familyinstance_using = Custom[Collect all FamilyInstance using Element Types]()  # should get model family instances
bv_get_nested_and_parent_family = Custom[bv Get Nested and Parent Family Relationships](Elements=collect_all_familyinstance_using)  # forked from Blackbox
bv_get_nested_and_parent_family_2 = Custom[bv Get Nested and Parent Family Relationships](Elements=bv_get_nested_and_parent_family.Parent_Family)
number_slider = DoubleSlider(0, range=0..100 step 0.1)
set_originalnestinglevel = Custom[Set OriginalNestingLevel Parameter to Element](elementToSet=bv_get_nested_and_parent_family_2.Parent_Family, valueToSetInteger=number_slider)  # needs bigger def to work
number_slider_2 = DoubleSlider(1, range=0..100 step 0.1)
set_originalnestinglevel_2 = Custom[Set OriginalNestingLevel Parameter to Element](elementToSet=bv_get_nested_and_parent_family_2.Nested_Family, valueToSetInteger=number_slider_2)
bv_get_nested_and_parent_family_3 = Custom[bv Get Nested and Parent Family Relationships](Elements=bv_get_nested_and_parent_family_2.Nested_Family)
number_slider_3 = DoubleSlider(2, range=0..100 step 0.1)
set_originalnestinglevel_3 = Custom[Set OriginalNestingLevel Parameter to Element](elementToSet=bv_get_nested_and_parent_family_3.Nested_Family, valueToSetInteger=number_slider_3)
bv_get_nested_and_parent_family_4 = Custom[bv Get Nested and Parent Family Relationships](Elements=bv_get_nested_and_parent_family_3.Nested_Family)
number_slider_4 = DoubleSlider(3, range=0..100 step 0.1)
set_originalnestinglevel_4 = Custom[Set OriginalNestingLevel Parameter to Element](elementToSet=bv_get_nested_and_parent_family_4.Nested_Family, valueToSetInteger=number_slider_4)
create = List.Create(bv_get_nested_and_parent_family.Error_s, bv_get_nested_and_parent_family_2.Error_s, bv_get_nested_and_parent_family_3.Error_s, bv_get_nested_and_parent_family_4.Error_s)
Any_errors = Output(create)  # "Any errors?"
