# Dynamo custom node Set Worksharing Display Mode for Views on Sheets.dyf (Dynamo 0.8.2.2371)
# category: Bakery.Revit.Views

enumerate_worksharing_display = Custom[Enumerate Worksharing Display Modes for Document]()
watch = Watch(enumerate_worksharing_display)
ListOfAllModes = Output(watch)
ViewsWhereSheetNumberContains = Input()
get_views_by_sheet_number_search = Custom[Get Views by Sheet Number Search](sheetNumberContains=ViewsWhereSheetNumberContains)
watch_2 = Watch(get_views_by_sheet_number_search)
viewFound = Output(watch_2)
flat_list_to_list_of_strings = Custom[Flat List to List of Strings](Original_List=watch)  # using python methods
WorksharingDisplayModeName = Input(WorksharingDisplayModeName : string = "Off")
firstIndexOf = List.FirstIndexOf(list=flat_list_to_list_of_strings, item=WorksharingDisplayModeName)
getItemAtIndex = List.GetItemAtIndex(list=watch, index=firstIndexOf)
set_worksharing_display_mode_for = Custom[Set Worksharing Display Mode for View](WorksharingDisplayMode=getItemAtIndex)
map = List.Map(list=watch_2, f_x=set_worksharing_display_mode_for)
flatten = Flatten(map)
Set_OK = Output(flatten)  # "Set OK?"
