# Dynamo custom node Sheet Reporting and Validation.dyf (Dynamo 0.9.1.4062)
# category: Bakery.Sheets
# tests schedules not on sheets, lists sheets

current_document = Custom[Current Document]()  # Retrieves Current Document
categories = Categories("Sheets")
all_elements_of_category = ElementsOfCategory(categories)
watch = Watch(all_elements_of_category)
firstItem = List.FirstItem(watch)
parameters = Element.Parameters(firstItem)
sample_parameter_set = Output(parameters)
string = StringInput("--No Sheets in Model?--")
integer_slider = IntegerSlider(1, range=0..100 step 1)
count = List.Count(watch)
lt = integer_slider < count
string_2 = StringInput("--Schedules not on Sheets?--")
schedules_on_sheets = Custom[Schedules on Sheets]()  # Queries all schedules and produces two lists: one with all schedules that are placed on sheets and one with schedules that are not placed on sheets.
string_3 = StringInput("--Sheet List below--")
elements_to_ids = Custom[Element.ID](Element_s=watch)  # Gets the ID(s) for a list of Revit elements (or a single element) - unlike the built-in Element.Id node, this node returns an actual Revit Element ID and *not* a number
id_to_element = Custom[Id to Element](Id=elements_to_ids.ID_s)  # Selects elements in a model from id input (ElementId, string, integer or GUID)
string_4 = StringInput("Sheet Number")
getParameterValueByName = Element.GetParameterValueByName(element=id_to_element, parameterName=string_4)
string_5 = StringInput("Sheet Name")
getParameterValueByName_2 = Element.GetParameterValueByName(element=id_to_element, parameterName=string_5)
create = List.Create(getParameterValueByName, getParameterValueByName_2)
create_2 = List.Create(string, lt, string_2, schedules_on_sheets.Not_on_Sheets, string_3, create)
List_with_inline_headings = Output(create_2)
Document_has_sheets = Output(lt)  # "Document has sheets?"
