# Dynamo custom node Show Categories containing Family Instances.dyf (Dynamo 0.9.2.4472)
# category: Bakery.Revit.Document.Category
# list

collect_all_familyinstance_using = Custom[Collect all FamilyInstance using Element Types]()  # should get model family instances
bv_get_category_name = Custom[bv Get Category Name](Elements=collect_all_familyinstance_using)  # forked from Blackbox
uniqueItems = List.UniqueItems(bv_get_category_name)
sort = List.Sort(uniqueItems)
Categories = Output(sort)
