# Dynamo custom node Show Dependency Ids for one DYF.dyf (Dynamo 1.2.1.3083)
# category: Bakery.Standalone.DynamoMgmt

path_to_DYF = Input()
fromPath = FileObject(path_to_DYF)  # "File.FromPath"
readText = File.ReadText(fromPath)

# group: GET
string = StringInput("guid=\"")

split = String.Split(readText, string)
watch = Watch(split)
code_block = CodeBlock { 1; }
dropItems = List.DropItems(list=watch, amount=code_block)
string_2 = StringInput("\"")
split_2 = String.Split(arg1=string_2)  # unwired: arg0
map = List.Map(list=dropItems, f_x=split_2)
watch_2 = Watch(map)
code_block_2 = CodeBlock { 0; }
getItemAtIndex = List.GetItemAtIndex(index=code_block_2)  # unwired: list
map_2 = List.Map(list=watch_2, f_x=getItemAtIndex)
uniqueItems = List.UniqueItems(map_2)
IDs = Output(uniqueItems)
