# Dynamo custom node Show Element Workset as Internal db name.dyf (Dynamo 0.8.1.1942)
# category: Bakery.Revit.Parameters

Element_s = Input()  # "Element(s)"
turn_into_list = Custom[Turn Into List](item=Element_s)  # Turns an element (or a nested list) into a flat list
python_script = Python(IN[0]=turn_into_list)
# ---------- python_script.python (17 lines) ----------
import clr
clr.AddReference('RevitAPI')
from Autodesk.Revit.DB import *

clr.AddReference("RevitServices")
import RevitServices
from RevitServices.Persistence import DocumentManager

doc = DocumentManager.Instance.CurrentDBDocument
faminsts = UnwrapElement(IN[0])
elementlist = list()
for item in faminsts:
	try:
		elementlist.append(doc.GetWorksetTable().GetWorkset(item.WorksetId))
	except:
		elementlist.append(list())
OUT = elementlist
# ----------------------------------------
Workset_s = Output(python_script)  # "Workset(s)"
