# Dynamo custom node Split XML and Return Lists.dyf (Dynamo 0.8.2.2371)
# category: Bakery.Data.XML

file_string = Input()
code_block = CodeBlock { ""; }
string = StringInput("<")
tagName = Input()
string_2 = StringInput(" ")
join = String.Join(code_block, string, tagName, string_2)
split = String.Split(file_string, join)
code_block_2 = CodeBlock { 1; }
dropItems = List.DropItems(list=split, amount=code_block_2)
string_3 = StringInput("/")
string_4 = StringInput(">")
join_2 = String.Join(code_block, string, string_3, tagName, string_4)
split_2 = String.Split(dropItems, join_2)
data_for_each_entry = Output(split_2)
turn_into_list = Custom[Turn Into List](item=join)  # Turns an element into a (flat) list
string_5 = StringInput("\"")
split_3 = String.Split(dropItems, string_5)
code_block_3 = CodeBlock { 1; }
getItemAtIndex = List.GetItemAtIndex(index=code_block_3)
map = List.Map(list=split_3, f_x=getItemAtIndex)
count = Count(map)
cycle = List.Cycle(list=turn_into_list, amount=count)
tags = Output(cycle)
names = Output(map)
