# Dynamo custom node Strings from Array.dyf (Dynamo 1.2.1.3083)
# category: Bakery.Core.String

stringIn = Input(stringIn : var[]..[])
remove_first_and_last_characters = Custom[Remove First and Last Characters from String](stringIn=stringIn)
code_block = CodeBlock { ","; }
split = String.Split(remove_first_and_last_characters, code_block)
strings = Output(split)
