# Dynamo custom node Structural Column By Curve In Transaction.dyf (Dynamo 1.2.0.2690)
# category: Bakery.Revit.Elements

curves = Input(curves : var[]..[])
dynamo_curves_to_revit_curves = Custom[Dynamo Curves to Revit Curves](curves=curves)
turnIntoList = Custom[TurnIntoList](unknownItem=dynamo_curves_to_revit_curves)  # Turns an element (or a nested list) into a flat list
columnType = Input()
level = Input()
python_script = Python(IN[0]=turnIntoList, IN[1]=columnType, IN[2]=level)
# ---------- python_script.python (51 lines) ----------
import clr
from System.Collections.Generic import *
clr.AddReference('RevitAPI')
from Autodesk.Revit.DB import *
import Autodesk

clr.AddReference("RevitNodes")
import Revit
clr.ImportExtensions(Revit.Elements)

clr.AddReference("RevitServices")
import RevitServices
from RevitServices.Persistence import DocumentManager
from RevitServices.Transactions import TransactionManager

#from System.Linq import *
from Autodesk.Revit.Creation import *
from Autodesk.Revit.DB import *
#from DynamoServices import *
from Revit.GeometryConversion import *
from RevitServices.Persistence import *
from RevitServices.Transactions import *

doc = DocumentManager.Instance.CurrentDBDocument
locations = UnwrapElement(IN[0])
famtypeIn = UnwrapElement(IN[1])
levelIn = UnwrapElement(IN[2])

elementlist = []

failures = []
#itemlist = List[FamilyInstanceCreationData](templist)
def GetCreationData(curve, level, structuralType, symbol):
	return FamilyInstanceCreationData(curve, symbol, level, structuralType)
	

		
TransactionManager.Instance.EnsureInTransaction(doc)
for l in locations:
	creationData = GetCreationData(l,levelIn,Autodesk.Revit.DB.Structure.StructuralType.Column,famtypeIn)
	creationdatas = List[FamilyInstanceCreationData]()
	creationdatas.Add(creationData)
#	listed = List[FamilyInstanceCreationData].append((creationData))
#	creationData = templist
	newobj = doc.Create.NewFamilyInstances2(creationdatas)
	elementlist.append(newobj)
#	except:
#		failures.append(l)
TransactionManager.Instance.TransactionTaskDone()

OUT = elementlist#, failures
# ----------------------------------------
flatten = Flatten(python_script)
bv_ids_to_elements = Custom[bv IDs to Elements](ID_s=flatten)  # forked from CAAD_RWTH
columns = Output(bv_ids_to_elements)
