# Dynamo custom node Sublists of Coordinates to Points.dyf (Dynamo 1.3.0.875)
# category: Bakery.Geometry

big_list = Input()
subnode_to_create_point_from_one = Custom[Subnode to create point from one XYZ sublist]()  # unwired: list
map = List.Map(list=big_list, f_x=subnode_to_create_point_from_one)
PointList = Output(map)
