# Dynamo custom node Subnode to get index from sublist.dyf (Dynamo 0.8.2.2371)
# category: Bakery.Core.List.Helper

list = Input(list : var[]..[])
index = Input(index : int)
getItemAtIndex = List.GetItemAtIndex(list=list, index=index)
list_2 = Input(list : var[]..[])
getItemAtIndex_2 = List.GetItemAtIndex(list=list_2, index=index)
getItemAtIndex_3 = List.GetItemAtIndex(list=getItemAtIndex, index=getItemAtIndex_2)
item = Output(getItemAtIndex_3)
