# Dynamo custom node Summary and Node Search for a Folder of DYFs.dyf (Dynamo 1.2.1.3083)
# category: Bakery.Standalone.DynamoMgmt
# can search for a node and tell you what file it is in

Directory_Path = Input()
list_nodes_in_dyfs_for_an_entire = Custom[List Nodes in DYFs for an Entire Folder](Directory_Path=Directory_Path)  # takes Directory Path as input node
all_node_names = Output(list_nodes_in_dyfs_for_an_entire.mappedResult)
all_file_names = Output(list_nodes_in_dyfs_for_an_entire.fileList)
node_name_to_search_for = Input()
contains = Contains(list_nodes_in_dyfs_for_an_entire.mappedResult, node_name_to_search_for)
does_directory_contain_ref_to_search_ter = Output(contains)  # "does directory contain ref to search term"
code_block = CodeBlock { true; }
create = List.Create(code_block)
containsItem = List.ContainsItem(item=node_name_to_search_for)  # unwired: list
map = List.Map(list=list_nodes_in_dyfs_for_an_entire.mappedResult, f_x=containsItem)
bv_if_equal_return_index = Custom[bv If Equal Return Index](listA=create, listB=map)  # forked
getItemAtIndex = List.GetItemAtIndex(list=list_nodes_in_dyfs_for_an_entire.fileList, index=bv_if_equal_return_index)
which_file_contains_the_reference = Output(getItemAtIndex)
flatten = Flatten(list_nodes_in_dyfs_for_an_entire.mappedResult)
uniqueItems = List.UniqueItems(flatten)
unique_nodes_referenced = Output(uniqueItems)
string = StringInput("\" ")
string_2 = StringInput("Name=")
extract_specific_tag_entries = Custom[Extract Specific Tag Entries from XML as Unique List](filePath=list_nodes_in_dyfs_for_an_entire.fileList, closingString=string, openingStringOfTag=string_2)
clean_source_node_names_from_files = Output(extract_specific_tag_entries.unique_list)
