# Dynamo custom node Super Collect Sheets from Document.dyf (Dynamo 0.8.2.2371)
# category: Bakery.Revit.Views

name_s_number_s = Input()  # "name(s)/number(s)"
NameOrNumber = Input(NameOrNumber:bool = true)
DOC = Input()
python_script = Python(IN[0]=name_s_number_s, IN[1]=NameOrNumber, IN[2]=DOC)
# ---------- python_script.python (55 lines) ----------
#Copyright(c) 2015, Dimitar Venkov
# @5devene, dimitar.ven@gmail.com

import clr

clr.AddReference("RevitServices")
import RevitServices
from RevitServices.Persistence import DocumentManager


clr.AddReference("RevitAPI")
from Autodesk.Revit.DB import *

doc = IN[2]

clr.AddReference("RevitNodes")
import Revit
clr.ImportExtensions(Revit.Elements)


def tolist(obj1):
	if hasattr(obj1,"__iter__"):
		return obj1
	else:
		return [obj1]

dataEnteringNode = IN
fn = tolist(IN[0])
fn = [str(n) for n in fn]
NameNumber = IN[1]


fec = FilteredElementCollector(doc).OfClass(View).GetElementIterator()
fec.Reset()
result = []
similar = []
names = []

for i in fec:
	if i.ViewType == ViewType.DrawingSheet:
		if NameNumber:
			n1 = i.ViewName
		else:
			n1 = i.SheetNumber
		names.append(n1)
		if any(fn1 == n1 for fn1 in fn):
			result.append(i.ToDSType(True))
		elif any(fn1.lower() in n1.lower() for fn1 in fn):
			similar.append(i.ToDSType(True))
if len(result) > 0:
	OUT = result,similar
if len(result) == 0 and len(similar) > 0:
	OUT = "No exact match found. Check partial below:",similar
if len(result) == 0 and len(similar) == 0:
	OUT = "No match found! Check values below:", names
# ----------------------------------------
code_block = CodeBlock(v=python_script) { v[0]; v[1]; }
exact_match_sheets = Output(code_block.out0)
partial_match_sheets = Output(code_block.out1)
python_script_2 = Python(IN[0]=code_block.out1, IN[1]=DOC)
# ---------- python_script_2.python (40 lines) ----------
#Copyright(c) 2015, Dimitar Venkov
# @5devene, dimitar.ven@gmail.com

import clr

clr.AddReference("RevitServices")
from RevitServices.Persistence import DocumentManager
doc = IN[1]
uiapp = DocumentManager.Instance.CurrentUIApplication
app = uiapp.Application

clr.AddReference("RevitNodes")
import Revit
clr.ImportExtensions(Revit.Elements)

def tolist(obj1):
	if hasattr(obj1,"__iter__"):
		return obj1
	else:
		return [obj1]

def output1(l1):
	if len(l1) == 1: return l1[0]
	else: return l1

sheets = UnwrapElement(tolist(IN[0]))
sheetviews = []

if app.VersionName == "Autodesk Revit 2014":
	for s in sheets:
		viewports = [doc.GetElement(v1) for v1 in s.GetAllViewports()]
		views = [doc.GetElement(v1.ViewId) for v1 in viewports]
		sheetviews.append(views)
	OUT = output1(sheetviews)
else:
	for s in sheets:
		viewsid = s.GetAllPlacedViews()
		views = [doc.GetElement(v).ToDSType(True) for v in viewsid]
		sheetviews.append(views)
	OUT = output1(sheetviews)
# ----------------------------------------
partial_match_view_s_from_sheets = Output(python_script_2)  # "partial match view(s) from sheets"
python_script_3 = Python(IN[0]=code_block.out0, IN[1]=DOC)  # same code as python_script_2
exact_match_view_s_from_sheets = Output(python_script_3)  # "exact match view(s) from sheets"
