# Dynamo custom node Super Get All Elevations View Name and Sheet for Multiple Documents.dyf (Dynamo 0.8.2.2371)
# category: Bakery.Revit.Views

searchLinkNames = Input()
get_link_names_and_link_docs_by = Custom[Get Link Names and Link Docs by Name Search](searchFor=searchLinkNames)

# group: Link Doc
watch = Watch(get_link_names_and_link_docs_by.link_docs)

get_all_elevations_view_name_and = Custom[Get All Elevations View Name and Sheet Number for Document]()
map = List.Map(list=watch, f_x=get_all_elevations_view_name_and)
watch_2 = Watch(map)
code_block = CodeBlock { 1; }
getItemAtIndex = List.GetItemAtIndex(index=code_block)
map_2 = List.Map(list=watch_2, f_x=getItemAtIndex)
flatten = Flatten(map_2)
View_Name = Output(flatten)
watch_3 = Watch(get_link_names_and_link_docs_by.cleaned_link_names)
firstItem = List.FirstItem()
map_3 = List.Map(list=watch_2, f_x=firstItem)
count = Count()
map_4 = List.Map(list=map_3, f_x=count)
cycle_entries_of_one_list_by = Custom[Cycle Entries of one List by List of Lengths](listToCycle=watch_3, listOfLengths=map_4)
flatten_2 = Flatten(cycle_entries_of_one_list_by)
Link_Filename = Output(flatten_2)
flatten_3 = Flatten(map_3)
Sheet_Number = Output(flatten_3)
