# Dynamo custom node Switch.dyf (Dynamo 0.9.2.4472)
# category: Bakery.Core.Logic

boolean_switch = Input()
data = Input()
code_block = CodeBlock { null; }
python_script = Python(IN[0]=boolean_switch, IN[1]=data, IN[2]=code_block)
# ---------- python_script.python (14 lines) ----------
import clr
clr.AddReference('ProtoGeometry')
from Autodesk.DesignScript.Geometry import *
#The inputs to this node will be stored as a list in the IN variables.
switch = IN[0]
data = IN[1]
temp = []
if switch:
	temp = data
else:
	temp.append(IN[2])

#Assign your output to the OUT variable.
OUT = temp
# ----------------------------------------
bv_remove_nulls = Custom[bv Remove Nulls](List=python_script)  # forked from Lunchbox
result = Output(bv_remove_nulls)
