# Dynamo custom node Text File to List of Strings.dyf (Dynamo 1.2.1.3083)
# category: Bakery.Standalone

path = Input()
fromPath = FileObject(path)  # "File.FromPath"
readText = File.ReadText(fromPath)
convert_string_with_line_breaks = Custom[Convert String with Line Breaks into List of Strings](string=readText)
flatten = Flatten(convert_string_with_line_breaks)
var = Output(flatten)  # "var[]..[]"
