# Dynamo custom node To Float.dyf (Dynamo 0.9.2.4472)
# category: Bakery.Core.Math
# converts input object to a float with python

unknown = Input()
python_script = Python(IN[0]=unknown)
# ---------- python_script.python (9 lines) ----------
import clr
clr.AddReference('ProtoGeometry')
from Autodesk.DesignScript.Geometry import *
import math
#The inputs to this node will be stored as a list in the IN variables.
temp = IN[0]
tostr = str(temp)
#Assign your output to the OUT variable.
OUT = float(tostr)
# ----------------------------------------
float = Output(python_script)
