# Dynamo custom node Triple Get.dyf (Dynamo 1.2.0.2831)
# category: Bakery.Core.List

dataSublists = Input()
indexList = Input()
indexToGet = Input()
getItemAtIndex = List.GetItemAtIndex(list=indexList, index=indexToGet)
getItemAtIndex_2 = List.GetItemAtIndex(list=dataSublists, index=getItemAtIndex)
rowIndex = Input()
getItemAtIndex_3 = List.GetItemAtIndex(list=getItemAtIndex_2, index=rowIndex)
item = Output(getItemAtIndex_3)
