# Dynamo custom node Two Parallel Point Lists to Joined PolyCurve.dyf (Dynamo 1.2.0.2831)
# category: Bakery.Geometry

secondPointList = Input()
points_to_polycurve_with = Custom[Points to PolyCurve with PruneDuplicates](points=secondPointList)
prunedSecondPoints = Output(points_to_polycurve_with.prunedPoints)
mainPointList = Input()
points_to_polycurve_with_2 = Custom[Points to PolyCurve with PruneDuplicates](points=mainPointList)
prunedMainPoints = Output(points_to_polycurve_with_2.prunedPoints)
mainPolyCurve = Output(points_to_polycurve_with_2.PolyCurve)
secondPolyCurve = Output(points_to_polycurve_with.PolyCurve)
byStartPointEndPoint = Line.ByStartPointEndPoint(startPoint=points_to_polycurve_with_2.prunedPoints, endPoint=points_to_polycurve_with.prunedPoints, lacing=Longest)
firstItem = List.FirstItem(byStartPointEndPoint@L2)
lastItem = List.LastItem(byStartPointEndPoint@L2)
create = List.Create(points_to_polycurve_with.PolyCurve, points_to_polycurve_with_2.PolyCurve, firstItem, lastItem)
flatten = Flatten(create)
group_curves = Custom[Group Curves](Curves=flatten)  # This node will take any input of flat list of curves and group them into sublists containing "joinable" curves that is continous curves. They might form closed curves or open curves. Use PolyCurve.ByJoinedCurves to convert output groups of curves into single PolyCurves
firstItem_2 = List.FirstItem(group_curves)
uniqueItems = List.UniqueItems(firstItem_2)
byJoinedCurves = PolyCurve.ByJoinedCurves(uniqueItems)
joinedPolyCurve = Output(byJoinedCurves)
curves = PolyCurve.Curves(byJoinedCurves)
code_block = CodeBlock { 0..0.99; }
pointAtParameter = Curve.PointAtParameter(curve=curves, param=code_block, lacing=Longest)
pruneDuplicates = Point.PruneDuplicates(points=pointAtParameter)
pointsFromJoinedPC = Output(pruneDuplicates)
