# Dynamo custom node Two Point Lists to Joined Curve.dyf (Dynamo 1.3.0.875)
# category: Bakery.Geometry

endPoint = Input()
watch = Watch(endPoint)
byPoints = PolyCurve.ByPoints(points=watch)
startPoint = Input()
watch_2 = Watch(startPoint)
byPoints_2 = PolyCurve.ByPoints(points=watch_2)
firstItem = List.FirstItem(watch_2)
firstItem_2 = List.FirstItem(watch)
byStartPointEndPoint = Line.ByStartPointEndPoint(startPoint=firstItem, endPoint=firstItem_2)
lastItem = List.LastItem(watch_2)
lastItem_2 = List.LastItem(watch)
byStartPointEndPoint_2 = Line.ByStartPointEndPoint(startPoint=lastItem, endPoint=lastItem_2)
create = List.Create(byPoints, byPoints_2, byStartPointEndPoint, byStartPointEndPoint_2)
flatten = Flatten(create)
group_curves = Custom[Group Curves](Curves=flatten)  # This node will take any input of flat list of curves and group them into sublists containing "joinable" curves that is continous curves. They might form closed curves or open curves. Use PolyCurve.ByJoinedCurves to convert output groups of curves into single PolyCurves
firstItem_3 = List.FirstItem(group_curves)
uniqueItems = List.UniqueItems(firstItem_3)
byJoinedCurves = PolyCurve.ByJoinedCurves(uniqueItems)
PolyCurve = Output(byJoinedCurves)
