# Dynamo custom node Use Floors to Make Named 3D Section Box View and Apply Template.dyf (Dynamo 0.8.2.2371)
# category: Bakery.Revit.Views

code_block = CodeBlock { " GLUE SECTION BOX"; }
code_block_2 = CodeBlock { "GLUE UPLOAD WITH COLOURS"; }
list_of_Floors = Input()
Comments_identifier = Input()
watch = Watch(Comments_identifier)
code_block_3 = CodeBlock { 50; }
code_block_4 = CodeBlock { ""; }
code_block_5 = CodeBlock { "Level "; }
Desired_Level = Input()
watch_2 = Watch(Desired_Level)
join = String.Join(code_block_4, code_block_5, watch_2)
filter_floors_by_comments_and = Custom[Filter Floors by Comments and Level and Make Section Box View](list_of_Floors=list_of_Floors, Comments_equals=watch, Offset=code_block_3, Level_name_contains=join)
watch_3 = Watch(filter_floors_by_comments_and)
View_Name_Suffix = Input()
join_2 = String.Join(code_block_4, watch_2, watch, View_Name_Suffix)
setName = Custom[Element.SetName](element=watch_3, name=join_2)  # Gets the name of a given Revit element
watch_4 = Watch(setName.Success)
View_Template_Name = Input()
applyViewTemplate = Custom[View.ApplyViewTemplate](View_s=watch_4, View_Template_Name=View_Template_Name)  # Applies a view template to any given view(s). Supply a string with a view template name.
Views_made_and_Template_applied = Output(applyViewTemplate)
