# Dynamo custom node View Templates for View List.dyf (Dynamo 0.8.2.2371)
# category: Bakery.Revit.Views

View_s = Input()  # "View(s)"
turn_into_list = Custom[Turn Into List](item=View_s)  # Turns an element (or a nested list) into a flat list
python_script = Python(IN[0]=turn_into_list)
# ---------- python_script.python (18 lines) ----------
import clr
clr.AddReference('RevitAPI')
from Autodesk.Revit.DB import *

clr.AddReference("RevitServices")
import RevitServices
from RevitServices.Persistence import DocumentManager

doc = DocumentManager.Instance.CurrentDBDocument
views = UnwrapElement(IN[0])
elementlist = list()

for view in views:
	if view.ViewTemplateId.IntegerValue == -1:
		elementlist.append(list())
	else:
		elementlist.append(doc.GetElement(view.ViewTemplateId))
OUT = elementlist
# ----------------------------------------
View_Templates_s = Output(python_script)  # "View Templates(s)"
