# Dynamo custom node Wildcard String Search One List in Another List (Faster).dyf (Dynamo 0.9.2.4472)
# category: Bakery.Core.List
# uses straight Python not String.Contains

code_block = CodeBlock { "nullSearchItemReplaced"; }
searchForTheseFragments = Input()
bv_replace_nulls = Custom[bv Replace Nulls](replacement=code_block, seq=searchForTheseFragments)
code_block_2 = CodeBlock { "nullTargetItemReplaced"; }
insideStringsInThisList = Input()
bv_replace_nulls_2 = Custom[bv Replace Nulls](replacement=code_block_2, seq=insideStringsInThisList)
python_script = Python(IN[0]=bv_replace_nulls, IN[1]=bv_replace_nulls_2)
# ---------- python_script.python (16 lines) ----------
import clr
clr.AddReference('ProtoGeometry')
from Autodesk.DesignScript.Geometry import *
#The inputs to this node will be stored as a list in the IN variables.
searchItems = IN[0]
searchIn = IN[1]
searchMatches = []
foundItems = []
for x in searchItems:
	for z in searchIn:
		if x in z:
			searchMatches.append(x)
			foundItems.append(z)

#Assign your output to the OUT variable.
OUT = searchMatches, foundItems
# ----------------------------------------
code_block_3 = CodeBlock { 0; }
getItemAtIndex = List.GetItemAtIndex(list=python_script, index=code_block_3)
SearchItems = Output(getItemAtIndex)
code_block_4 = CodeBlock { 1; }
getItemAtIndex_2 = List.GetItemAtIndex(list=python_script, index=code_block_4)
foundInThese = Output(getItemAtIndex_2)
