# Dynamo custom node Wildcard String Search One List in Another List.dyf (Dynamo 0.8.2.2371)
# category: Bakery.Core.List
# this is slow List.Map way

in_this_list = Input()
watch = Watch(in_this_list)
search_for_these_fragments = Input()
watch_2 = Watch(search_for_these_fragments)
subnode_to_search_list_for_one = Custom[subnode to Search List for One String Match](searchThisList=watch)
map = List.Map(list=watch_2, f_x=subnode_to_search_list_for_one.found_in)
flatten = Flatten(map)
firstIndexOf = List.FirstIndexOf(list=watch, item=flatten)
indices = Output(firstIndexOf)
found_in = Output(map)
