# Dynamo custom node Write Parameters from One Element List to Another.dyf (Dynamo 0.8.2.2392)
# category: Bakery.Revit.Parameters
# 1 to 1 list

WriteTo = Input()
firstItem = List.FirstItem(WriteTo)
get_element_parameters_and_split = Custom[Get Element Parameters and Split to Names and Values](element=firstItem)  # as per title, output is strings
parameterIsReadOnly = Custom[Element.ParameterIsReadOnly](Element=firstItem)  # Checks if a parameter of a given element is read-only
map = List.Map(list=get_element_parameters_and_split.ParamNames_str, f_x=parameterIsReadOnly)
watch = Watch(map)
filterByBoolMask = List.FilterByBoolMask(list=get_element_parameters_and_split.ParamNames_str, mask=watch)
watch_2 = Watch(filterByBoolMask.out)
ReadFrom = Input()
symbol = FamilyInstance.Symbol(ReadFrom)
get_element_parameters_and_split_2 = Custom[Get Element Parameters and Split to Names and Values](element=symbol)
watch_3 = Watch(get_element_parameters_and_split_2.ParamNames_str)
firstItem_2 = List.FirstItem(watch_3)
removeItemsFromOtherList = Custom[List.RemoveItemsFromOtherList](List_A=watch_2, List_B=firstItem_2)  # This will take long list A, remove entries that appear in short list B, and give you list C. (JBE List Operations are probably more robust).
watch_4 = Watch(removeItemsFromOtherList)
firstItem_3 = List.FirstItem(ReadFrom)
bv_get_parameter_value_as_string = Custom[bv Get Parameter Value as String](Element_s=firstItem_3, Parameter_Name=watch_4)  # forked from Rhythm
firstItem_4 = List.FirstItem(bv_get_parameter_value_as_string)
watch_5 = Watch(firstItem_4)
setParameterByName = Element.SetParameterByName(element=firstItem, parameterName=watch_4, value=watch_5)
Elements_modified = Output(setParameterByName)
