# Dynamo custom node bv All Indices Of.dyf (Dynamo 0.8.2.2392)
# category: Bakery.Dynamo.ForkedNodes
# forked from Rhythm

list = Input(list : var[]..[])
indices = Input(indices : var[]..[])
eq = list == indices
getKeys = GetKeys(eq)
filterByBoolMask = List.FilterByBoolMask(list=getKeys, mask=eq)
var = Output(filterByBoolMask.in)  # "var[]..[]"
