# Dynamo custom node bv Collector for Sheets.dyf (Dynamo 1.2.1.3083)
# category: Bakery.Dynamo.ForkedNodes
# forked from spring nodes

value = Input()
NameOrNumber = Input(NameOrNumber:bool = true)
boolean = BoolSelector(true)
sheets = Custom[Springs.Collector.Sheets](searchFor=value, NameOrNumber=NameOrNumber, refresh=boolean)  # Search for sheets by either their name or their number. Use a false boolean switch to search by number.
exact_match = Output(sheets.exact_match)
partial_match = Output(sheets.partial_match)
