# Dynamo custom node bv Elements in Views.dyf (Dynamo 0.8.2.2392)
# category: Bakery.Dynamo.ForkedNodes
# forked

Views = Input()
turn_into_list = Custom[Turn Into List](item=Views)  # Turns an element into a (flat) list
python_script = Python(IN[0]=turn_into_list)
# ---------- python_script.python (23 lines) ----------
#Made by Marc Tavenier @marctavenier
import clr
clr.AddReference('RevitAPI')
from Autodesk.Revit.DB import *

clr.AddReference('RevitServices')
import RevitServices
from RevitServices.Persistence import DocumentManager

#The inputs to this node will be stored as a list in the IN variable.
dataEnteringNode = IN

views = UnwrapElement(IN[0])

elementlist = []
doc = DocumentManager.Instance.CurrentDBDocument

for view in views:
	collector = FilteredElementCollector(doc, view.Id)
	elementlist.append(collector.ToElements())

#Assign your output to the OUT variable
OUT = elementlist
# ----------------------------------------
Elements = Output(python_script)
