# Dynamo custom node bv Elements to IDs.dyf (Dynamo 0.8.2.2392)
# category: Bakery.Dynamo.ForkedNodes
# forked from CAAD_RWTH

Element_s = Input()  # "Element(s)"
turn_into_list = Custom[Turn Into List](item=Element_s)  # Turns an element into a list
python_script = Python(IN[0]=turn_into_list)
# ---------- python_script.python (15 lines) ----------
# Default imports
import clr
clr.AddReference('RevitAPI')
clr.AddReference('RevitAPIUI')
from Autodesk.Revit.DB import *
import Autodesk

elementlist = list()
unmatched = list()
for item in IN[0]:
	try:
		elementlist.append(item.Id)
	except:
		unmatched.append(item)
OUT = (elementlist, unmatched)
# ----------------------------------------
firstItem = List.FirstItem(python_script)
returnListOrSingleValue = Custom[Return List Or Single Value](item_1_unknown=turn_into_list, item_2_list=firstItem)  # If the list in input #1 has only one item, only the first item of the list in input #2 will be returned.
ID_s = Output(returnListOrSingleValue)  # "ID(s)"
formula = Formula("1", lacing=Longest)
getItemAtIndex = List.GetItemAtIndex(list=python_script, index=formula)
unmatched = Output(getItemAtIndex)
