# Dynamo custom node bv Filter List by Mask.dyf (Dynamo 0.8.2.2392)
# category: Bakery.Dynamo.ForkedNodes
# can be used as a toggle switch to output empty list with false

list = Input(list : var[]..[])
boolean = Input(boolean : bool)
count = Count(list)
cycle = List.Cycle(list=boolean, amount=count)
filterByBoolMask = List.FilterByBoolMask(list=list, mask=cycle)
in_ = Output(filterByBoolMask.in)  # "in"
out = Output(filterByBoolMask.out)
