# Dynamo custom node bv Get Category Name.dyf (Dynamo 1.2.1.3083)
# category: Bakery.Dynamo.ForkedNodes
# forked from Blackbox

empty = List.Empty()
Elementz = Input()
create = List.Create(empty, Elementz)
flatten = Flatten(create)
python_script = Python(IN[0]=flatten)
# ---------- python_script.python (41 lines) ----------
#Copyright(c) 2014, Jason Andersen, andersen.ja@gmail.com
import clr

# Import RevitAPI
clr.AddReference("RevitAPI")
import Autodesk
from Autodesk.Revit.DB import *

# Import DocumentManager and TransactionManager
clr.AddReference("RevitServices")
import RevitServices
from RevitServices.Persistence import DocumentManager
from RevitServices.Transactions import TransactionManager

# Import ToDSType(bool) extension method
clr.AddReference("RevitNodes")
import Revit
clr.ImportExtensions(Revit.Elements)
clr.ImportExtensions(Revit.GeometryConversion)

import clr
clr.AddReference('ProtoGeometry')
from Autodesk.DesignScript.Geometry import *

doc =  DocumentManager.Instance.CurrentDBDocument
app =  DocumentManager.Instance.CurrentUIApplication.Application


#The input to this node will be stored in the IN[0] variable.
elements = UnwrapElement(IN[0])

#variables
output = []
catName = []

for item in elements:
    #print faminst
	catName.append(item.Category.Name)  	    	
output.append(catName)

OUT = output
# ----------------------------------------
flatten_2 = Flatten(python_script)
category = Custom[Element.Category](element=Elementz)  # This node will get the input element(s)' categories
CategoryName = Output(category)
