# Dynamo custom node bv Get Character from String at Index.dyf (Dynamo 0.8.2.2392)
# category: Bakery.Forks
# forked from Rhythm

code_block = CodeBlock()
# ---------- code_block.designscript (4 lines) ----------
def CharacterAtIndex (x,y)
{
return=x[y];
};
# ----------------------------------------
List = Input()
Index = Input()
code_block_2 = CodeBlock(x=List, y=Index) { CharacterAtIndex(x,y); }
Character = Output(code_block_2)
