# Dynamo custom node bv Get Parameter Value as String.dyf (Dynamo 0.8.2.2371)
# category: Bakery.Dynamo.ForkedNodes
# forked from Rhythm

Element_s = Input()  # "Element(s)"
Parameter_Name = Input()
getParameterValueByName = Element.GetParameterValueByName(parameterName=Parameter_Name)
map = List.Map(list=Element_s, f_x=getParameterValueByName)
string_from_object = FromObject(map)
Value = Output(string_from_object)
