# Dynamo custom node bv Get Parameter value from Type or Instance.dyf (Dynamo 0.8.2.2392)
# category: Bakery.Dynamo.ForkedNodes
# forked from Rhythm

element = Input()
empty = List.Empty()
addItemToFront = List.AddItemToFront(item=element, list=empty)
flatten = Flatten(addItemToFront)
python_script = Python(IN[0]=flatten)
# ---------- python_script.python (17 lines) ----------
import clr
clr.AddReference('RevitAPI')
from Autodesk.Revit.DB import *

clr.AddReference("RevitServices")
import RevitServices
from RevitServices.Persistence import DocumentManager

doc = DocumentManager.Instance.CurrentDBDocument
items = UnwrapElement(IN[0])
typelist = list()
for item in items:
	try: 
		typelist.append(doc.GetElement(item.GetTypeId()))
	except:
		typelist.append(list())
OUT = typelist
# ----------------------------------------
parameters = Element.Parameters(python_script)
flatten_2 = Flatten(parameters)
string_from_object = FromObject(parameters)
flatten_3 = Flatten(string_from_object)
code_block = CodeBlock { ":"; 1; }
indexOf = String.IndexOf(string=flatten_3, searchFor=code_block.out0)
sub = indexOf - code_block.out1
length = String.Length(flatten_3)
sub_2 = length - sub
remove = String.Remove(str=flatten_3, startIndex=sub, count=sub_2)
parameterName = Input()
bv_list_contains = Custom[bv List Contains](list=remove, item=parameterName)  # forked from Rhythm
filterByBoolMask = List.FilterByBoolMask(list=flatten_2, mask=bv_list_contains)
isEmpty = List.IsEmpty(filterByBoolMask.in)
getParameterValueByName = Element.GetParameterValueByName(element=element, parameterName=parameterName)
getParameterValueByName_2 = Element.GetParameterValueByName(element=python_script, parameterName=parameterName)
if_ = If(test=isEmpty, true=getParameterValueByName, false=getParameterValueByName_2)
bv_output_clean = Custom[bv Output Clean](input=if_)  # forked from Rhythm
var = Output(bv_output_clean)  # "var[]..[]"
