# Dynamo custom node bv Get Wall Width.dyf (Dynamo 1.0.0.1180)
# category: Bakery.Dynamo.ForkedNodes
# from steam nodes

Wall_s = Input()  # "Wall/s"
code_block = CodeBlock(item=Wall_s) { Flatten({item}); }
python_script = Python(IN[0]=code_block)
# ---------- python_script.python (46 lines) ----------
#python nodes in dynamo 0.7
#proposed by Julien Benoit @jbenoit44 
#http://aecuandme.wordpress.com/
import clr
clr.AddReference('ProtoGeometry')
from Autodesk.DesignScript.Geometry import *
# Import ToDSType(bool) extension method
clr.AddReference("RevitNodes")
import Revit
clr.ImportExtensions(Revit.Elements)
# Import geometry conversion extension methods
clr.ImportExtensions(Revit.GeometryConversion)
# Import DocumentManager and TransactionManager
clr.AddReference("RevitServices")
import RevitServices
from RevitServices.Persistence import DocumentManager
from RevitServices.Transactions import TransactionManager
from System.Collections.Generic import *
# Import RevitAPI
clr.AddReference("RevitAPI")
import Autodesk
from Autodesk.Revit.DB import *

doc = DocumentManager.Instance.CurrentDBDocument
uiapp = DocumentManager.Instance.CurrentUIApplication
app = uiapp.Application
uidoc=DocumentManager.Instance.CurrentUIApplication.ActiveUIDocument

elt = []
for i in IN[0]:
	elt.append(UnwrapElement(i))
list=[]
metersToFeet = 0.3048
feetToMeters = 1 / metersToFeet 

# Start Transaction
TransactionManager.Instance.EnsureInTransaction(doc)

for i in elt:
	a=i.Width*metersToFeet
	list.append(a)

# End Transaction
TransactionManager.Instance.TransactionTaskDone()

OUT=list
# ----------------------------------------
code_block_2 = CodeBlock(x=python_script) { x*1000; }
Width = Output(code_block_2)
code_block_3 = CodeBlock {  }
