# Dynamo custom node bv IDs to Elements.dyf (Dynamo 0.8.2.2392)
# category: Bakery.Forks
# forked from CAAD_RWTH

ID_s = Input()  # "ID(s)"
turn_into_list = Custom[Turn Into List](item=ID_s)  # Turns an element into a list
current = Document.Current(lacing=Longest)
python_script = Python(IN[0]=current, IN[1]=turn_into_list)
# ---------- python_script.python (18 lines) ----------
# Default imports
import clr
clr.AddReference('RevitAPI')
clr.AddReference('RevitAPIUI')
from Autodesk.Revit.DB import *
import Autodesk

doc = IN[0]
items = IN[1]

elementlist = list()
unmatched = list()
for item in items:
	try: 
		elementlist.append(doc.GetElement(item))
	except:
		unmatched.append(item)
OUT = (elementlist, unmatched)
# ----------------------------------------
firstItem = List.FirstItem(python_script)
returnListOrSingleValue = Custom[Return List Or Single Value](item_1_unknown=turn_into_list, item_2_list=firstItem)  # If the list in input #1 has only one item, only the first item of the list in input #2 will be returned.
Element_s = Output(returnListOrSingleValue)  # "Element(s)"
formula = Formula("1", lacing=Longest)
getItemAtIndex = List.GetItemAtIndex(list=python_script, index=formula)
unmatched = Output(getItemAtIndex)
