# Dynamo custom node bv If Equal Return Index.dyf (Dynamo 0.8.2.2392)
# category: Bakery.Dynamo.ForkedNodes
# forked

listA = Input()
listB = Input()
create_list = List.Create(listA, listB)
python_script = Python(IN[0]=create_list)
# ---------- python_script.python (10 lines) ----------
listaA = IN[0][0]
listaB = IN[0][1]
indiceslist = list()
for lA in listaA:
	counter = 0
	for lB in listaB:
		if (lA == lB):
			indiceslist.append(counter)
		counter += 1
OUT = indiceslist
# ----------------------------------------
Index = Output(python_script)
