# Dynamo custom node bv List Chop by Lengths.dyf (Dynamo 0.8.2.2371)
# category: Bakery.Dynamo.ForkedNodes

lengths = Input()
list = Input()
turnIntoList = Custom[Turn Into List](lengths)  # Turns an element (or a nested list) into a flat list
python_script = Python(IN[0]=list, IN[1]=turnIntoList)
# ---------- python_script.python (15 lines) ----------
import clr

inputlist = IN[0]
listlengths = IN[1]
rowcounter = 0
elementlist = list()
for item in listlengths:
	itemcounter = 0
	itemlist = list()
	while itemcounter < item:
		itemlist.append(inputlist[rowcounter])
		rowcounter += 1
		itemcounter += 1
	elementlist.append(itemlist)
OUT = elementlist
# ----------------------------------------
returnListOrSingleValue = Custom[ReturnListOrSingleValue](unknownItem=lengths, seq=python_script)  # If the item in input #1 is not a list, only the first item of the list in input #2 will be returned.
list_2 = Output(returnListOrSingleValue)  # "list"
