# Dynamo custom node bv List Contains.dyf (Dynamo 0.8.2.2392)
# category: Bakery.Dynamo.ForkedNodes
# forked from Rhythm

list = Input()
item = Input()
eq = item == _
map = List.Map(list=list, f_x=eq)
code_block = CodeBlock { true; }
containsItem = List.ContainsItem(list=map, item=code_block, lacing=Longest)
flatten = Flatten(containsItem)
mask = Output(flatten)
