# Dynamo custom node bv Remove from String after Character.dyf (Dynamo 0.8.2.2392)
# category: Bakery.Forks
# forked from Rhythm

str = Input(str : string)
Character = Input()
ignoreCase = Input(ignoreCase : bool=false)
indexOf = String.IndexOf(string=str, searchFor=Character, ignoreCase=ignoreCase)
length = String.Length(str)
code_block = CodeBlock(in1=length, in2=indexOf) { out1=in1-in2; out1; }
remove = String.Remove(str=str, startIndex=indexOf, count=code_block.out1)
string = Output(remove)
