# Dynamo custom node bv Replace Nulls.dyf (Dynamo 0.9.2.4472)
# category: Bakery.Forks

seq = Input()
replacement = Input()
python_script = Python(IN[0]=seq, IN[1]=replacement)
# ---------- python_script.python (8 lines) ----------
items = IN[0]
rep = IN[1]
elementlist = list()
for item in items:
	if item is None: 
		item = rep
	elementlist.append(item)
OUT = elementlist
# ----------------------------------------
seq_2 = Output(python_script)  # "seq"
