# Dynamo custom node bv Wall Finishes by Room.dyf (Dynamo 0.8.2.2371)
# category: Bakery.Forks

Rooms = Input()
python_script = Python()
# ---------- python_script.python (13 lines) ----------
import clr
clr.AddReference('ProtoGeometry')
from Autodesk.DesignScript.Geometry import *
#The inputs to this node will be stored as a list in the IN variables.
input = IN[0]

if isinstance(input,list) == False:
	elements = [input]
else:
	elements = input

#Assign your output to the OUT variable.
OUT = elements
# ----------------------------------------
python_script_2 = Python()
# ---------- python_script_2.python (18 lines) ----------
import clr
clr.AddReference('ProtoGeometry')
from Autodesk.DesignScript.Geometry import *
#The inputs to this node will be stored as a list in the IN variables.
RoomLevel = IN[0]
LevelId = IN[1]
LevelName = IN[2]

RoomLevelId = []

for l in RoomLevel:
	count = 0
	for n in LevelName:
		if l == n:
			RoomLevelId.append(LevelId[count])
		count = count + 1		
#Assign your output to the OUT variable.
OUT = RoomLevelId
# ----------------------------------------
ofRepeatedItem = List.OfRepeatedItem()
flatten = Flatten()
byJoinedCurves = PolyCurve.ByJoinedCurves()
basePlane = PolyCurve.BasePlane(byJoinedCurves)
normal = Plane.Normal(basePlane)
Z = Vector.Z(normal)
code_block = CodeBlock(a=Z) { a > 0; }
reverse = Curve.Reverse(byJoinedCurves)
if_ = If(test=code_block, true=byJoinedCurves, false=reverse)
count = Count()
map = List.Map(list=if_, f_x=count)
combine = List.Combine(ofRepeatedItem, flatten, map)
flatten_2 = Flatten(combine)
code_block_2 = CodeBlock { "Level"; }
getParameterValueByName = Element.GetParameterValueByName(element=flatten_2, parameterName=code_block_2)
categories = Categories("Levels")
all_elements_of_category = ElementsOfCategory(categories)
code_block_3 = CodeBlock { "Name"; }
getParameterValueByName_2 = Element.GetParameterValueByName(element=all_elements_of_category, parameterName=code_block_3)
python_script_3 = Python()
# ---------- python_script_3.python (14 lines) ----------
import clr
clr.AddReference('ProtoGeometry')
from Autodesk.DesignScript.Geometry import *
#The inputs to this node will be stored as a list in the IN variables.
heights = IN[0]
lines = IN[1]
a = []

for i in range(0,len(heights)):
	for j in range(0,len(lines[i])):
		a.append(heights[i])
	
#Assign your output to the OUT variable.
OUT = a
# ----------------------------------------
python_script_4 = Python()
# ---------- python_script_4.python (14 lines) ----------
import clr
clr.AddReference('ProtoGeometry')
from Autodesk.DesignScript.Geometry import *
#The inputs to this node will be stored as a list in the IN variables.
tipo = IN[0]
lineas = IN[1]
a = []

for i in range(0,len(tipo)):
	for j in range(0,len(lineas[i])):
		a.append(tipo[i])
	
#Assign your output to the OUT variable.
OUT = a
# ----------------------------------------
python_script_5 = Python()
# ---------- python_script_5.python (37 lines) ----------
#Copyright(c) 2015, Konrad Sobon
# @arch_laboratory, http://archi-lab.net

import clr
clr.AddReference('ProtoGeometry')
from Autodesk.DesignScript.Geometry import *

#The inputs to this node will be stored as a list in the IN variable.
inputCurves = IN[0]
outputCurves = []

#join/group curves function
def groupCurves(Line_List): 
	ignore_distance = 0.01 # Assume points this close or closer to each other are touching 
	Grouped_Lines = [] 
	Queue = set() 
	while Line_List: 
		Shape = [] 
		Queue.add(Line_List.pop()) # Move a line from the Line_List to our queue 
		while Queue: 
			Current_Line = Queue.pop() 
			Shape.append(Current_Line) 
			for Potential_Match in Line_List: 
				Points = (Potential_Match.StartPoint, Potential_Match.EndPoint)
				for P1 in Points: 
					for P2 in (Current_Line.StartPoint, Current_Line.EndPoint): 
						distance = P1.DistanceTo(P2) 
						if distance <= ignore_distance: 
							Queue.add(Potential_Match) 
			Line_List = [item for item in Line_List if item not in Queue]
		Grouped_Lines.append(Shape) 
	return Grouped_Lines
	
for a in inputCurves:
	outputCurves.append(groupCurves(a))

OUT = outputCurves
# ----------------------------------------
code_block_4 = CodeBlock { seq[0]; seq[1]; }
python_script_6 = Python()
# ---------- python_script_6.python (46 lines) ----------
import clr
clr.AddReference('RevitAPI')
from Autodesk.Revit.DB import *
import Autodesk

clr.AddReference("RevitNodes")
import Revit
clr.ImportExtensions(Revit.GeometryConversion)

clr.AddReference("RevitServices")
import RevitServices
from RevitServices.Persistence import DocumentManager

doc = DocumentManager.Instance.CurrentDBDocument
items = UnwrapElement(IN[0])
elementlist = list()
curvelist = list()

calculator = SpatialElementGeometryCalculator(doc)
options = Autodesk.Revit.DB.SpatialElementBoundaryOptions()
# get boundary location from area computation settings
boundloc = Autodesk.Revit.DB.AreaVolumeSettings.GetAreaVolumeSettings(doc).GetSpatialElementBoundaryLocation(SpatialElementType.Room)
options.SpatialElementBoundaryLocation = boundloc
for item in items:
	#method #1 - get boundary segments
	blist = list()
	clist = list()
	try:
		for boundarylist in item.GetBoundarySegments(options):
			for boundary in boundarylist:
				blist.append(boundary.Element)
				clist.append(boundary.Curve.ToProtoType())
	except:
		donothing = 1
	#method #2 - spatial element geometry calculator
	try:
		results = calculator.CalculateSpatialElementGeometry(item)
		for face in results.GetGeometry().Faces:
			for bface in results.GetBoundaryFaceInfo(face):
				blist.append(doc.GetElement(bface.SpatialBoundaryElement.HostElementId))
	except:
		donothing = 1	
	# write results to list
	elementlist.append(blist)
	curvelist.append(clist)
OUT = (elementlist,curvelist)
# ----------------------------------------
python_script_7 = Python()  # same code as python_script_6
python_script_8 = Python()
# ---------- python_script_8.python (13 lines) ----------
import clr
clr.AddReference('RevitAPI')
from Autodesk.Revit.DB import *

elements = UnwrapElement(IN[0])
cat = UnwrapElement(IN[1])
elementlist = list()
for item in elements:
	if item.Category.Id==cat.Id:
		elementlist.append(True)
	else:
		elementlist.append(False)
OUT = elementlist
# ----------------------------------------
categories_2 = Categories("Walls")
python_script_9 = Python()
# ---------- python_script_9.python (15 lines) ----------
import clr
clr.AddReference('RevitAPI')
from Autodesk.Revit.DB import *

clr.AddReference("RevitNodes")
import Revit
clr.ImportExtensions(Revit.GeometryConversion)

items = UnwrapElement(IN[0])
curves = list()

for item in items:
	curves.append(item.Location.Curve.ToProtoType())
			
OUT = curves
# ----------------------------------------
python_script_10 = Python()  # same code as python_script_4
Ceiling_Height_param = Input()
getParameterValueByName_3 = Element.GetParameterValueByName(element=flatten_2, parameterName=Ceiling_Height_param)
python_script_11 = Python()
# ---------- python_script_11.python (27 lines) ----------
import clr
clr.AddReference('RevitAPI')
from Autodesk.Revit.DB import *

clr.AddReference("RevitServices")
import RevitServices
from RevitServices.Persistence import DocumentManager
from RevitServices.Transactions import TransactionManager

doc = DocumentManager.Instance.CurrentDBDocument
walls = UnwrapElement(IN[0])
boolean = IN[1]
wallsFlipped = []
counter = 0

TransactionManager.Instance.EnsureInTransaction(doc)
for w in walls:
	if boolean[counter] == False:
		w.Flip()
		wallsFlipped.append(w)
	else:
		wallsFlipped.append(w)
	counter = counter + 1
	
TransactionManager.Instance.TransactionTaskDone()
		
OUT = wallsFlipped
# ----------------------------------------
python_script_12 = Python()  # same code as python_script_9
python_script_13 = Python()
# ---------- python_script_13.python (21 lines) ----------
import clr
clr.AddReference('RevitAPI')
from Autodesk.Revit.DB import *

clr.AddReference("RevitNodes")
import Revit
clr.ImportExtensions(Revit.GeometryConversion)

rooms = UnwrapElement(IN[0])
points = [x.ToXyz() for x in IN[1]]
booleans = []
counter = 0

for r in rooms:
	if r.IsPointInRoom(points[counter]):
		booleans.append(True)
	else:
		booleans.append(False)
	counter = counter + 1

OUT = booleans
# ----------------------------------------
code_block_5 = CodeBlock { 0.5; }
pointAtParameter = Curve.PointAtParameter(param=code_block_5)
startPoint = Curve.StartPoint()
endPoint = Curve.EndPoint()
byTwoPoints = Vector.ByTwoPoints(start=startPoint, end=endPoint)
ZAxis = Vector.ZAxis()
code_block_6 = CodeBlock { 270; }
rotate = Vector.Rotate(byTwoPoints, ZAxis, code_block_6)
flatten_3 = Flatten(if_)
WALL_Finish_param = Input()
getParameterValueByName_4 = Element.GetParameterValueByName(element=flatten_2, parameterName=WALL_Finish_param)
byName = WallType.ByName(getParameterValueByName_4)
code_block_7 = CodeBlock { "Width"; }
getParameterValueByName_5 = Element.GetParameterValueByName(element=byName, parameterName=code_block_7)
code_block_8 = CodeBlock { -1; }
code_block_9 = CodeBlock(x=getParameterValueByName_5, y=code_block_8) { x*y*0.5; }
code_block_10 = CodeBlock { false; }
offset = PolyCurve.Offset(flatten_3, code_block_9, code_block_10)
explode = Geometry.Explode(offset)
flatten_4 = Flatten(explode)
byCurveAndHeight = Wall.ByCurveAndHeight(curve=flatten_4)
code_block_11 = CodeBlock { "Location Line"; }
code_block_12 = CodeBlock { 0; }
setParameterByName = Element.SetParameterByName(element=byCurveAndHeight, parameterName=code_block_11, value=code_block_12)
name = WallType.Name(setParameterByName)
byName_2 = WallType.ByName(name)
code_block_13 = CodeBlock { "Width"; }
getParameterValueByName_6 = Element.GetParameterValueByName(element=byName_2, parameterName=code_block_13)
code_block_14 = CodeBlock(x=getParameterValueByName_6) { (x*0.6); }
translate = Geometry.Translate(geometry=pointAtParameter, direction=rotate, distance=code_block_14)
python_script_14 = Python()
# ---------- python_script_14.python (28 lines) ----------
import clr
clr.AddReference('RevitAPI')
from Autodesk.Revit.DB import *

clr.AddReference("RevitNodes")
import Revit
clr.ImportExtensions(Revit.Elements)

clr.AddReference("RevitServices")
import RevitServices
from RevitServices.Persistence import DocumentManager

doc = DocumentManager.Instance.CurrentDBDocument

walls = UnwrapElement(IN[0])
inserts = []
lengths = []

for w in walls:
	inserts.append(w.FindInserts(True, True, True, True))
for i in inserts:
	if len(i) > 0:
		lengths.append(True)
	else:
		lengths.append(False)
	

OUT = lengths
# ----------------------------------------
ofRepeatedItem_2 = List.OfRepeatedItem()
count_2 = Count()
map_2 = List.Map(list=explode, f_x=count_2)
combine_2 = List.Combine(ofRepeatedItem_2, flatten_2, map_2)
flatten_5 = Flatten(combine_2)
python_script_15 = Python()  # same code as python_script_9
code_block_15 = CodeBlock { 0.5; }
pointAtParameter_2 = Curve.PointAtParameter(param=code_block_15)
startPoint_2 = Curve.StartPoint()
endPoint_2 = Curve.EndPoint()
byTwoPoints_2 = Vector.ByTwoPoints(start=startPoint_2, end=endPoint_2)
ZAxis_2 = Vector.ZAxis()
code_block_16 = CodeBlock { 270; }
rotate_2 = Vector.Rotate(byTwoPoints_2, ZAxis_2, code_block_16)
reverse_2 = Vector.Reverse(rotate_2)
code_block_17 = CodeBlock { "Location Line"; }
code_block_18 = CodeBlock { 2; }
setParameterByName_2 = Element.SetParameterByName(parameterName=code_block_17, value=code_block_18)
name_2 = WallType.Name(setParameterByName_2)
byName_3 = WallType.ByName(name_2)
code_block_19 = CodeBlock { "Width"; }
getParameterValueByName_7 = Element.GetParameterValueByName(element=byName_3, parameterName=code_block_19)
code_block_20 = CodeBlock(x=getParameterValueByName_7) { (x*0.5)+(x*0.1); }
translate_2 = Geometry.Translate(geometry=pointAtParameter_2, direction=reverse_2, distance=code_block_20)
translate_3 = Geometry.Translate(geometry=pointAtParameter_2, direction=rotate_2, distance=code_block_20)
byStartPointEndPoint = Line.ByStartPointEndPoint(startPoint=translate_2, endPoint=translate_3)
filterByBoolMask = List.FilterByBoolMask()
code_block_21 = CodeBlock { seq[0]; seq[1]; }
isNull = Object.IsNull()
map_3 = List.Map(list=code_block_21.out0, f_x=isNull)
combine_3 = List.Combine(filterByBoolMask.out, code_block_21.out0, map_3)
uniqueItems = List.UniqueItems()
map_4 = List.Map(list=combine_3, f_x=uniqueItems)
flatten_6 = Flatten(map_4)
uniqueItems_2 = List.UniqueItems(flatten_6)
filterByBoolMask_2 = List.FilterByBoolMask(list=uniqueItems_2)
filterByBoolMask_3 = List.FilterByBoolMask(list=filterByBoolMask_2.in)
name_3 = WallType.Name(filterByBoolMask_3.in)
byName_4 = WallType.ByName(name_3)
code_block_22 = CodeBlock { "Width"; }
getParameterValueByName_8 = Element.GetParameterValueByName(element=byName_4, parameterName=code_block_22)
code_block_23 = CodeBlock(x=getParameterValueByName_8) { x*0.5; }
offset_2 = Curve.Offset(distance=code_block_23)
startPoint_3 = Curve.StartPoint(offset_2)
code_block_24 = CodeBlock { -1; }
code_block_25 = CodeBlock(x=code_block_23, y=code_block_24) { x*y; }
offset_3 = Curve.Offset(distance=code_block_25)
startPoint_4 = Curve.StartPoint(offset_3)
endPoint_3 = Curve.EndPoint(offset_3)
endPoint_4 = Curve.EndPoint(offset_2)
create = List.Create(startPoint_3, startPoint_4, endPoint_3, endPoint_4)
transpose = List.Transpose(create)
byPerimeterPoints = Surface.ByPerimeterPoints(transpose)
doesIntersect = Geometry.DoesIntersect(geometry=byPerimeterPoints)
map_5 = List.Map(list=byStartPointEndPoint, f_x=doesIntersect)
python_script_16 = Python()
# ---------- python_script_16.python (12 lines) ----------
walls = IN[0]
boolList = []

for a in walls:
	buffer = False
	for b in a:
		if (b):
			buffer = True
			break
	boolList.append(buffer)
		
OUT = boolList
# ----------------------------------------
python_script_17 = Python()
# ---------- python_script_17.python (14 lines) ----------
listaA = IN[0]

indiceslist = list()

for a in listaA:
	counter = 0
	for b in a:
		if (b):
			indiceslist.append(counter)
			break
		counter = counter + 1
		
OUT = indiceslist
#UnwrapElement(IN[0])
# ----------------------------------------
getItemAtIndex = List.GetItemAtIndex(list=filterByBoolMask_3.in)
filterByBoolMask_4 = List.FilterByBoolMask(list=setParameterByName_2)
python_script_18 = Python()
# ---------- python_script_18.python (36 lines) ----------
import clr
import System
clr.AddReference('ProtoGeometry')
clr.AddReference('RevitAPI') 
clr.AddReference('RevitAPIUI')
clr.AddReference("RevitServices")
clr.AddReference("RevitNodes")
from Autodesk.DesignScript.Geometry import *

# Import RevitAPI
import Autodesk
from Autodesk.Revit.DB import *
import RevitServices
from RevitServices.Persistence import DocumentManager
from RevitServices.Transactions import TransactionManager
import Revit
clr.ImportExtensions(Revit.Elements)

doc = DocumentManager.Instance.CurrentDBDocument

#The inputs to this node will be stored as a list in the IN variables.

wall1 = IN[0]
wall2 = IN[1]
counter = 0

TransactionManager.Instance.EnsureInTransaction(doc)

for wall in wall1:
	JoinGeometryUtils.JoinGeometry(doc, UnwrapElement(wall2[counter]), UnwrapElement(wall1[counter]))
	counter = counter + 1

TransactionManager.Instance.TransactionTaskDone()

#Assign your output to the OUT variable.
OUT = str(len(wall1)) + " joins have been done."
# ----------------------------------------
Walls = Output()
