# Dynamo custom node mysql Create Database by Name.dyf (Dynamo 0.8.2.2371)
# category: Bakery.Data.Database

mysql_default_connection_string = Custom[mysql Default Connection String]()
code_block = CodeBlock { true; }
databaseName = Input()
string = StringInput("CREATE DATABASE `")
string_2 = StringInput("`")
join = String.Join(databaseName, string, string_2)
mySQL_Command = Database.Command.MySQL_Command(mysql_default_connection_string, code_block, join)
Success = Output(mySQL_Command)  # "Success?"
