# Dynamo custom node mysql Create Table by Name.dyf (Dynamo 0.8.2.2371)
# category: Bakery.Data.Database

mysql_default_connection_string = Custom[mysql Default Connection String]()
code_block = CodeBlock { true; }
string = StringInput("""USE `zzxkr_dbName_zzxkr`;
SHOW VARIABLES LIKE 'collation_database';
CREATE TABLE `zzxkr_tableName_zzxkr` (
 `needed` INT NULL
)
COLLATE='latin1_swedish_ci'
ENGINE=InnoDB
;
SELECT `DEFAULT_COLLATION_NAME` FROM `information_schema`.`SCHEMATA` WHERE `SCHEMA_NAME`='zzxkr_dbName_zzxkr';
SHOW TABLE STATUS FROM `zzxkr_dbName_zzxkr`;
SHOW FUNCTION STATUS WHERE `Db`='zzxkr_dbName_zzxkr';
SHOW PROCEDURE STATUS WHERE `Db`='zzxkr_dbName_zzxkr';
SHOW TRIGGERS FROM `zzxkr_dbName_zzxkr`;
SELECT *, EVENT_SCHEMA AS `Db`, EVENT_NAME AS `Name` FROM information_schema.`EVENTS` WHERE `EVENT_SCHEMA`='zzxkr_dbName_zzxkr';
SHOW CREATE TABLE `zzxkr_dbName_zzxkr`.`zzxkr_tableName_zzxkr`;""")
string_2 = StringInput("zzxkr_dbName_zzxkr")
dbName = Input()
replace = String.Replace(str=string, searchFor=string_2, replaceWith=dbName)
string_3 = StringInput("zzxkr_tableName_zzxkr")
NewTableName = Input()
replace_2 = String.Replace(str=replace, searchFor=string_3, replaceWith=NewTableName)
mySQL_Command = Database.Command.MySQL_Command(mysql_default_connection_string, code_block, replace_2)
Success = Output(mySQL_Command)  # "Success?"
