# Dynamo custom node mysql Default Connection String.dyf (Dynamo 0.8.2.2371)
# category: Bakery.Data.Database

string = StringInput("Localhost")
string_2 = StringInput("3306")
string_3 = StringInput("root")
string_4 = StringInput("dynamo_123!")
string_5 = StringInput("20")
string_6 = StringInput("5")
mySQL_ConnectionString = Database.Connection.MySQL_ConnectionString(string, string_2, string_3, string_4, string_5, string_6)
string_7 = Output(mySQL_ConnectionString)  # "string"
