# Dynamo custom node mysql Export Template for Multiple Parameters.dyf (Dynamo 1.2.1.3083)
# category: Bakery.Data.Database

collect_all_familyinstance_using = Custom[Collect all FamilyInstance using Element Types]()  # should get model family instances
type = Custom[Element.Type](element=collect_all_familyinstance_using)  # Gets the family type of a given element (if applicable).
uniqueItems = List.UniqueItems(type)
code_block = CodeBlock { "nrah"; }
code_block_2 = CodeBlock { "Designation Code Export"; }
countOccurences = Custom[List.CountOccurences](seq=type)  # Counts the number of occurences of each unique element in a given list
watch = Watch(countOccurences.uniqueElements)
uuid_guid_generator_for_lists = Custom[UUID GUID Generator for Lists](list=watch)  # just makes a new GUID for every item in a list, has no relationship to item or element itself
modelNameAsString = Input()
cycle_one_item_into_list_to = Custom[Cycle One Item Into List to Match Length of Other List](OneItemToCycle=modelNameAsString, ListToMatchLength=watch)
family = FamilyType.Family(watch)
name = Element.Name(family)
code_block_3 = CodeBlock { "Designation Code"; }
getParameterValueByName = Element.GetParameterValueByName(element=countOccurences.uniqueElements, parameterName=code_block_3)
now = DateTime.Now()
cycle_one_item_into_list_to_2 = Custom[Cycle One Item Into List to Match Length of Other List](OneItemToCycle=now, ListToMatchLength=watch)
create = List.Create(uuid_guid_generator_for_lists.uuidsAsStrings, cycle_one_item_into_list_to, name, watch, getParameterValueByName, countOccurences.count, cycle_one_item_into_list_to_2)
code_block_4 = CodeBlock { {"dataUUID","Model Name","Family","Family Type","Designation Code","Count","Timestamp"}; }
watch_2 = Watch(code_block_4)
dbName = Input()
tableName = Input()
mysql_send_list_to_db_for = Custom[mysql Send List to Db for Multiple Columns](dataLists=create, ColumnNameList=watch_2, dbName=dbName, tableName=tableName)
Success = Output(mysql_send_list_to_db_for)  # "Success?"
