# Dynamo custom node mysql Insert Data into New Rows for Multiple Columns.dyf (Dynamo 0.9.1.4062)
# category: Bakery.Data.Database

lsj_mysql_at_localhost = Custom[LSJ MySql at localhost connection string]()
code_block = CodeBlock { true; }
code_block_2 = CodeBlock { ""; }
string = StringInput("""USE `zzxkr_dbName_zzxkr`;
INSERT INTO `zzxkr_dbName_zzxkr`.`zzxkr_tableName_zzxkr` (`zxkr_Column_zxkr`) VALUES (""")
string_2 = StringInput("zzxkr_dbName_zzxkr")
dbName = Input()
replace = String.Replace(str=string, searchFor=string_2, replaceWith=dbName)
string_3 = StringInput("zzxkr_tableName_zzxkr")
tableName = Input()
replace_2 = String.Replace(str=replace, searchFor=string_3, replaceWith=tableName)
string_4 = StringInput("zxkr_Column_zxkr")
ColumnNameList = Input()
string_from_array = FromArray(ColumnNameList)
code_block_3 = CodeBlock { ","; }
code_block_4 = CodeBlock { "`, `"; }
replace_3 = String.Replace(str=string_from_array, searchFor=code_block_3, replaceWith=code_block_4)
remove_first_and_last_characters = Custom[Remove First and Last Characters from String](stringIn=replace_3)
replace_4 = String.Replace(str=replace_2, searchFor=string_4, replaceWith=remove_first_and_last_characters)
dataPiece = Input()
string_from_object = FromObject(dataPiece)
code_block_5 = CodeBlock { 0; }
string_5 = StringInput(" '")
insert = String.Insert(str=string_from_object, index=code_block_5, toInsert=string_5)
length = String.Length(string_from_object)
code_block_6 = CodeBlock(x=length) { x+2; }
string_6 = StringInput("'")
insert_2 = String.Insert(str=insert, index=code_block_6, toInsert=string_6)
string_from_array_2 = FromArray(insert_2)
watch = Watch(string_from_array_2)
remove_first_and_last_characters_2 = Custom[Remove First and Last Characters from String](stringIn=watch)
string_7 = StringInput(");")
join = String.Join(code_block_2, replace_4, remove_first_and_last_characters_2, string_7)
mySQL_Command = Database.Command.MySQL_Command(lsj_mysql_at_localhost, code_block, join)
Success = Output(mySQL_Command)  # "Success?"
watch_2 = Watch(join)
