# Dynamo custom node subnode to Create Filter for All Categories.dyf (Dynamo 1.1.0.2094)
# category: Bakery.Revit.Views.Helper

categoryObjects = Input()
index = Input(index : int)
getItemAtIndex = List.GetItemAtIndex(list=categoryObjects, index=index)
turnIntoList = Custom[TurnIntoList](unknownItem=getItemAtIndex)  # Turns an element (or a nested list) into a flat list
string = StringInput("ALL_MODEL_INSTANCE_COMMENTS")

# group: PARAMETER NAME
watch = Watch(string)

string_2 = StringInput("""some
Comment""")

# group: PARAMETER VALUE
watch_2 = Watch(string_2)

desiredFilterNames = Input()
getItemAtIndex_2 = List.GetItemAtIndex(list=desiredFilterNames, index=index)
python_script = Python(IN[0]=turnIntoList, IN[1]=watch, IN[2]=watch_2, IN[3]=getItemAtIndex_2)
# ---------- python_script.python (58 lines) ----------
#from the forum originally
import clr

clr.AddReference("RevitServices")
import RevitServices
from RevitServices.Persistence import DocumentManager
from RevitServices.Transactions import TransactionManager

doc = DocumentManager.Instance.CurrentDBDocument

clr.AddReference("RevitAPI")
import Autodesk
from Autodesk.Revit.DB import *
import System
from System.Collections.Generic import *

dataEnteringNode = IN

def GetBuiltInParam(paramName):
	builtInParams = System.Enum.GetValues(BuiltInParameter)
	test = []
	for i in builtInParams:
		if i.ToString() == paramName:
			test.append(i)
			break
		else:
			continue
	return test [0]

cats = IN[0]
paramName = IN[1]
pValue = IN[2]
filName = IN[3]
#clearRules = IN[4]
#view = UnwrapElement(IN[4])

TransactionManager.Instance.EnsureInTransaction(doc)

catList = []
for i in cats:
	catList.append(i.Id)

typedCatList = List[ElementId](catList)

bip = GetBuiltInParam(paramName)

rules = []

rules.append(ParameterFilterRuleFactory.CreateContainsRule(ElementId(bip), pValue, 0.001))

try:
	filter = ParameterFilterElement.Create(doc, filName, typedCatList, rules)
except:
	filter = "Sorry, failed. Please check that you have a unique filter name."

TransactionManager.Instance.TransactionTaskDone()

OUT = filter
# ----------------------------------------
withRules = Output(python_script)
