# Dynamo custom node subnode to Search List for One String Match.dyf (Dynamo 0.8.2.2371)
# category: Bakery.Lists

oneItem = Input()
watch = Watch(oneItem)
item = Output(watch)
searchThisList = Input(searchThisList : var[]..[])
code_block = CodeBlock { true; }
contains = String.Contains(searchFor=oneItem, ignoreCase=code_block)
map = List.Map(list=searchThisList, f_x=contains)
watch_2 = Watch(map)
code_block_2 = CodeBlock { true; }
firstIndexOf = List.FirstIndexOf(list=watch_2, item=code_block_2)
watch_3 = Watch(firstIndexOf)
index = Output(watch_3)
getItemAtIndex = List.GetItemAtIndex(list=searchThisList, index=watch_3)
code_block_3 = CodeBlock { "MatchNotFound"; }
replaceNulls = Lists.Manage.ReplaceNulls(getItemAtIndex, code_block_3)
found_in = Output(replaceNulls)
