# Dynamo custom node subnode to Set Link Worksets by Name Match.dyf (Dynamo 1.3.0.875)
# category: Bakery.Revit.Document.Worksets.Helper

get_worksets_with_all_properties = Custom[Get Worksets with all Properties]()  # based on Konrad's, added some more properties of Worksets
watch = Watch(get_worksets_with_all_properties.Names)
rvtLinkInstances = Input(rvtLinkInstances : var[]..[])
get_rvt_link_filenames_with = Custom[Get RVT Link Filenames with Element and Type Workset Info](rvtLinkInstances=rvtLinkInstances)
index = Input(index : int)
getItemAtIndex = List.GetItemAtIndex(list=get_rvt_link_filenames_with.Filenames, index=index)
contains = String.Contains(searchFor=getItemAtIndex)  # unwired: str
map = List.Map(list=watch, f_x=contains)
code_block = CodeBlock { true; }
firstIndexOf = List.FirstIndexOf(list=map, item=code_block)
getItemAtIndex_2 = List.GetItemAtIndex(list=get_worksets_with_all_properties.Worksets, index=firstIndexOf)
getItemAtIndex_3 = List.GetItemAtIndex(list=get_rvt_link_filenames_with.Instance_Elements_as_Revit, index=index)
setWorkset = Custom[Element.SetWorkset](workset=getItemAtIndex_2, element=getItemAtIndex_3)  # Sets the workset of a given element
watch_2 = Watch(setWorkset.changedElements)
type = Custom[Element.Type](element=get_rvt_link_filenames_with.Instance_Elements_as_Revit)  # Gets the family type of a given element (if applicable).
getItemAtIndex_4 = List.GetItemAtIndex(list=type, index=index)
setWorkset_2 = Custom[Element.SetWorkset](workset=getItemAtIndex_2, element=getItemAtIndex_4)
watch_3 = Watch(setWorkset_2.changedElements)
create = List.Create(watch_2, watch_3)
list_length_validator = Custom[List Length Validator](listOfLists=create)
equal_lengths = Output(list_length_validator)  # "equal lengths?"
