# Dynamo custom node Create Independent Tag.dyf (Dynamo 1.3.4.6666)
# category: GeniusLoci.Tag
# Works only in Revit 2018 and later.
# This node will create an annotation tag at a given location, of given type and in a supplied view. If only single view is supplied then all tags will be created in that view.
# The node works also with Linked Elements, Multi Category tag and Material Tag.
# From archilab

TagLocations = Input()
TagType = Input()
Elements = Input()
Views = Input()
LinkInstance = Input(LinkInstance:var=null)
RunIt = Input(RunIt:bool=false)
python_script = Python(IN[0]=TagLocations, IN[1]=TagType, IN[2]=Elements, IN[3]=Views, IN[4]=LinkInstance, IN[5]=RunIt)
# ---------- python_script.python (223 lines) ----------
#Copyright(c) 2015, Konrad K Sobon
# @arch_laboratory, http://archi-lab.net
# From Kulkul
# From T_Pover
# From Fcampojr
# Ability to tag Linked elements by Alban de Chasteigner

import clr
clr.AddReference('ProtoGeometry')
from Autodesk.DesignScript.Geometry import *

# Import Element wrapper extension methods
clr.AddReference("RevitNodes")
import Revit
clr.ImportExtensions(Revit.Elements)

# Import geometry conversion extension methods
clr.ImportExtensions(Revit.GeometryConversion)

# Import DocumentManager and TransactionManager
clr.AddReference("RevitServices")
import RevitServices
from RevitServices.Persistence import DocumentManager
from RevitServices.Transactions import TransactionManager

doc = DocumentManager.Instance.CurrentDBDocument
uiapp = DocumentManager.Instance.CurrentUIApplication
app = uiapp.Application

# Import RevitAPI
clr.AddReference("RevitAPI")
import Autodesk
from Autodesk.Revit.DB import *

import sys
pyt_path = r'C:\Program Files (x86)\IronPython 2.7\Lib'
sys.path.append(pyt_path)

#The inputs to this node will be stored as a list in the IN variable.
dataEnteringNode = IN

locationPts = UnwrapElement(IN[0])
tagType = UnwrapElement(IN[1])
elements = UnwrapElement(IN[2])

if IN[4] != None:
	link = UnwrapElement(IN[4])
else:
	link = None
	
RunIt = IN[5]

if isinstance(IN[3], list):
	views = []
	for i in IN[3]:
		views.append(UnwrapElement(i))
else:
	views = UnwrapElement(IN[3])

def toRvtPoint(point):
	return point.ToXyz()

def toRvtId(_id):
	if isinstance(_id, int) or isinstance(_id, str):
		id = ElementId(int(_id))
		return id
	elif isinstance(_id, ElementId):
		return _id

def GetUVPoint(pt):
	if type(pt) == Autodesk.DesignScript.Geometry.Point:
		return Autodesk.Revit.DB.UV(pt.X, pt.Y)
	elif type(pt) == Autodesk.DesignScript.Geometry.UV:
		return Autodesk.Revit.DB.UV(pt.U, pt.V)

def CreateSpaceTag(space, uv, view):
	doc = DocumentManager.Instance.CurrentDBDocument
	return doc.Create.NewSpaceTag(space, uv, view)

tagTypeId = toRvtId(tagType.Id)
chk = []
try:
	errorReport = None
	if RunIt:
		if tagType.Category.Name == "Room Tags":

			roomTags = []
			if isinstance(views, list):
				#pulled views for statement out
				for j in views:

					for i,k in zip(elements, locationPts):
						TransactionManager.Instance.EnsureInTransaction(doc)
						#added the if statement to get roomId from the linked element.
						if link != None:
							roomId = LinkElementId(link.Id, i.Id)
						else:
							roomId = LinkElementId(i.Id)
						location = Autodesk.Revit.DB.UV(toRvtPoint(k).X, toRvtPoint(k).Y)
						roomTag = doc.Create.NewRoomTag(roomId, location, j.Id)
						roomTag.RoomTagType = tagType
						chk.append(roomId)
						roomTags.append(roomTag)
						TransactionManager.Instance.TransactionTaskDone()
			else:
				TransactionManager.Instance.EnsureInTransaction(doc)
				for i, j in zip(elements, locationPts):
					if link != None:
						roomId = LinkElementId(link.Id, i.Id)
					else:
						roomId = LinkElementId(i.Id)
					location = Autodesk.Revit.DB.UV(toRvtPoint(j).X, toRvtPoint(j).Y)
					roomTag = doc.Create.NewRoomTag(roomId, location, views.Id)
					roomTag.RoomTagType = tagType
					roomTags.append(roomTag)
				TransactionManager.Instance.TransactionTaskDone()
			result = roomTags
		elif tagType.Category.Name == "Space Tags":
			TransactionManager.Instance.EnsureInTransaction(doc)
			roomTags = []
			if isinstance(views, list):
				for j in views:
					for i, k in zip(elements, locationPts):
						uv = GetUVPoint(k)
						spaceTag = CreateSpaceTag(i, uv, j)
						spaceTag.SpaceTagType = tagType
						roomTags.append(spaceTag)
			else:
				for i, j in zip(elements, locationPts):
					uv = GetUVPoint(j)
					spaceTag = CreateSpaceTag(i, uv, views)
					spaceTag.SpaceTagType = tagType
					roomTags.append(spaceTag)
			TransactionManager.Instance.TransactionTaskDone()
			result = roomTags
		elif tagType.Category.Name == "Multi-Category Tags":
			TransactionManager.Instance.EnsureInTransaction(doc)
			multitags = []
			if isinstance(views, list):
				for j in views:
					for i, k in zip(elements, locationPts):
						if link != None:
							reference = Reference(i).CreateLinkReference(link)
						else:
							reference = Reference(i)
						location = toRvtPoint(k)
						tag = IndependentTag.Create(doc,j.Id, reference, False, TagMode.TM_ADDBY_MULTICATEGORY, TagOrientation.Horizontal, location)
					tag.ChangeTypeId(tagTypeId)
					multitags.append(tag)
			else:
				for i, j in zip(elements, locationPts):
					if link != None:
						reference = Reference(i).CreateLinkReference(link)
					else:
						reference = Reference(i)
					location = toRvtPoint(j)
					tag = IndependentTag.Create(doc, views.Id, reference, False, TagMode.TM_ADDBY_MULTICATEGORY, TagOrientation.Horizontal, location)
					tag.ChangeTypeId(tagTypeId)
					multitags.append(tag)
			TransactionManager.Instance.TransactionTaskDone()
			result = multitags
		elif tagType.Category.Name == "Material Tags":
			TransactionManager.Instance.EnsureInTransaction(doc)
			Mattags = []
			if isinstance(views, list):
				for i,j,k in zip(elements, views, locationPts):
					if link != None:
						reference = Reference(i).CreateLinkReference(link)
					else:
						reference = Reference(i)
					location = toRvtPoint(k)
					tag = IndependentTag.Create(doc, j.Id, reference, False, TagMode.TM_ADDBY_MATERIAL, TagOrientation.Horizontal, location)
					tag.ChangeTypeId(tagTypeId)
					Mattags.append(tag)
			else:
				for i, j in zip(elements, locationPts):
					if link != None:
						reference = Reference(i).CreateLinkReference(link)
					else:
						reference = Reference(i)
					location = toRvtPoint(j)
					tag = IndependentTag.Create(doc, views.Id, reference, False, TagMode.TM_ADDBY_MATERIAL, TagOrientation.Horizontal, location)
					tag.ChangeTypeId(tagTypeId)
					Mattags.append(tag)
			TransactionManager.Instance.TransactionTaskDone()
			result = Mattags
		else:
			TransactionManager.Instance.EnsureInTransaction(doc)
			tags = []
			if isinstance(views, list):
				for i,j,k in zip(elements, views, locationPts):
					if link != None:
						reference = Reference(i).CreateLinkReference(link)
					else:
						reference = Reference(i)
					location = toRvtPoint(k)
					tag = IndependentTag.Create(doc, j.Id, reference, False, TagMode.TM_ADDBY_CATEGORY, TagOrientation.Horizontal, location)
					tag.ChangeTypeId(tagTypeId)
					tags.append(tag)
			else:
				for i, j in zip(elements, locationPts):
					if link != None:
						reference = Reference(i).CreateLinkReference(link)
					else:
						reference = Reference(i)
					location = toRvtPoint(j)
					tag = IndependentTag.Create(doc, views.Id, reference, False, TagMode.TM_ADDBY_CATEGORY, TagOrientation.Horizontal, location)
					tag.ChangeTypeId(tagTypeId)
					tags.append(tag)
			TransactionManager.Instance.TransactionTaskDone()
			result = tags
	else:
		result = "RunIt is set to False."
except:
	# if error accurs anywhere in the process catch it
	import traceback
	errorReport = traceback.format_exc()

#Assign your output to the OUT variable
if errorReport == None:
	OUT = result
else:
	OUT = errorReport
# ----------------------------------------
Tags = Output(python_script)
