# Dynamo custom node Element Curve.dyf (Dynamo 1.3.4.6666)
# category: GeniusLoci.Geometry
# Get the curve from the element.

Element = Input()
python_script = Python(IN[0]=Element)
# ---------- python_script.python (31 lines) ----------
import clr
import math
clr.AddReference('RevitAPI')
from Autodesk.Revit.DB import *

clr.AddReference("RevitNodes")
import Revit
clr.ImportExtensions(Revit.GeometryConversion)

items = UnwrapElement(IN[0])
if not hasattr(items, '__iter__'):
	items = [items]
	
curves = []

for item in items:
	loc = item.Location
	if loc.ToString() == 'Autodesk.Revit.DB.LocationCurve':
		# line-based elements (e.g. walls)
		curves.append(loc.Curve.ToProtoType())
	else:
		try:
			curves.append(item.ToProtoType())
		except:
			try:
				curves.append(item.Curve.ToProtoType())
			except:
				curves.append(item.GeometryCurve.ToProtoType())

if isinstance(IN[0], (list)): OUT = curves
else: OUT = curves[0]
# ----------------------------------------
Curve = Output(python_script)
