# Dynamo custom node Enumerate DWG export options.dyf (Dynamo 1.3.3.4651)
# category: GeniusLoci.Export
# Enumerate Color mode, Autocad Version and Type of Units.

get_export_options = Python()
# ---------- get_export_options.python (20 lines) ----------
#From Bakery
import clr
clr.AddReference('ProtoGeometry')
from Autodesk.DesignScript.Geometry import *

# Import DocumentManager and TransactionManager
clr.AddReference("RevitServices")
import RevitServices
from RevitServices.Persistence import DocumentManager
from RevitServices.Transactions import TransactionManager

# Import RevitAPI
clr.AddReference("RevitAPI")
import Autodesk
from Autodesk.Revit.DB import *
from Autodesk.Revit.DB import Structure
import System

#Assign your output to the OUT variable
OUT = System.Enum.GetValues(Autodesk.Revit.DB.ExportColorMode),System.Enum.GetValues(Autodesk.Revit.DB.ACADVersion),System.Enum.GetValues(Autodesk.Revit.DB.ExportUnit)
# ----------------------------------------
code_block = CodeBlock(Option=get_export_options) { Option[0]; Option[1]; Option[2]; }
Colormode = Output(code_block.out0)
Autocad_Version = Output(code_block.out1)
Unit = Output(code_block.out2)
