# Dynamo custom node Enumerate DWG import options.dyf (Dynamo 1.3.3.4651)
# category: GeniusLoci.Import
# Enumerate Color mode, Type of Placement and Type of Unit.
# Work with node "Import DWG".

python_script = Python()
# ---------- python_script.python (20 lines) ----------
#From Bakery
import clr
clr.AddReference('ProtoGeometry')
from Autodesk.DesignScript.Geometry import *

# Import DocumentManager and TransactionManager
clr.AddReference("RevitServices")
import RevitServices
from RevitServices.Persistence import DocumentManager
from RevitServices.Transactions import TransactionManager

# Import RevitAPI
clr.AddReference("RevitAPI")
import Autodesk
from Autodesk.Revit.DB import *
from Autodesk.Revit.DB import Structure
import System

#Assign your output to the OUT variable
OUT = System.Enum.GetValues(Autodesk.Revit.DB.ImportColorMode), System.Enum.GetValues(Autodesk.Revit.DB.ImportPlacement),System.Enum.GetValues(Autodesk.Revit.DB.ImportUnit)
# ----------------------------------------
code_block = CodeBlock(Option=python_script) { Option[0]; Option[1]; Option[2]; }
Colormode = Output(code_block.out0)
Placement = Output(code_block.out1)
Unit = Output(code_block.out2)
