# Dynamo custom node FilledRegion Color Change.dyf (Dynamo 1.3.3.4651)
# category: GeniusLoci.Graphics
# Change the color of a Filled Region to another given color.

FilledRegion = Input()
color = Input()  # As many colors as FilledRegions
python_script = Python(IN[0]=FilledRegion, IN[1]=color)
# ---------- python_script.python (31 lines) ----------
#Alban de Chasteigner, 2018
#twitter : @geniusloci_bim
#geniusloci.bim@gmail.com

import clr
clr.AddReference('RevitAPI')
import Autodesk
from Autodesk.Revit.DB import *

clr.AddReference('RevitServices')
import RevitServices
from RevitServices.Persistence import DocumentManager
from RevitServices.Transactions import TransactionManager
doc = DocumentManager.Instance.CurrentDBDocument

def tolist(obj1):
	if hasattr(obj1,"__iter__"): return obj1
	else: return [obj1]
	
def ConvertColor(e):
	return Autodesk.Revit.DB.Color(e.Red, e.Green, e.Blue)

filledRegions = tolist(UnwrapElement(IN[0]))
colors = tolist(IN[1])

TransactionManager.Instance.EnsureInTransaction(doc)
for color,filledRegion in zip(colors,filledRegions) :
	(filledRegion.Document.GetElement(filledRegion.GetTypeId())).Color=ConvertColor(color)
TransactionManager.Instance.TransactionTaskDone()

OUT = filledRegions
# ----------------------------------------
FilledRegion_2 = Output(python_script)  # "FilledRegion"
