# Dynamo custom node Get CompoundStructureLayers.dyf (Dynamo 1.3.4.6666)
# category: GeniusLoci.CompoundStructure
# Retrieves the properties of the compound layers of wall, floor, roof or ceiling Type.

FamilyType = Input()
python_script = Python(IN[0]=FamilyType)
# ---------- python_script.python (49 lines) ----------
import clr

import System
from System.Collections.Generic import *

clr.AddReference("RevitServices")
import RevitServices
from RevitServices.Persistence import DocumentManager
from RevitServices.Transactions import TransactionManager
doc =  DocumentManager.Instance.CurrentDBDocument
app = DocumentManager.Instance.CurrentUIApplication.Application

clr.AddReference("RevitNodes")
import Revit
clr.ImportExtensions(Revit.Elements)
clr.ImportExtensions(Revit.GeometryConversion)

clr.AddReference("RevitAPI")
from Autodesk.Revit.DB import *

UIunit = Document.GetUnits(doc).GetFormatOptions(UnitType.UT_Length).DisplayUnits

# Inputs...
wallTypes = UnwrapElement(IN[0])
if not hasattr(wallTypes, '__iter__'):
	wallTypes = [wallTypes]
	
layerIds,layermat,layerfunc,layerwidth,layers,strucLayer = [],[],[],[],[],[]

# Get Compound Structure...
for wallType in wallTypes:
	ids,mat,func,width=[],[],[],[]
	compStr = wallType.GetCompoundStructure()
	# Get and sort layers by Id in reverse order (Highest id first)...
	layers = list(compStr.GetLayers())
	layers.sort(key=lambda x: x.LayerId)
	for l in layers:	
		ids.append(l.LayerId)
		mat.append(wallType.Document.GetElement(l.MaterialId))
		func.append(l.Function)
		width.append(UnitUtils.ConvertFromInternalUnits(l.Width,UIunit))
	layerIds.append(ids)
	layermat.append(mat)
	layerfunc.append(func)
	layerwidth.append(width)
	strucLayer.append(layers)
	
if isinstance(IN[0], (list)): OUT = layerwidth,layerfunc,layermat,layerIds,strucLayer
else: OUT = layerwidth[0],layerfunc[0],layermat[0],layerIds[0],strucLayer[0]
# ----------------------------------------
code_block = CodeBlock(x=python_script) { x[0]; x[1]; x[2]; x[3]; x[4]; }
Width = Output(code_block.out0)
Function = Output(code_block.out1)
Material = Output(code_block.out2)
Index = Output(code_block.out3)
Layers = Output(code_block.out4)
