# Dynamo custom node Get Project Locations.dyf (Dynamo 1.3.3.4651)
# category: GeniusLoci.Document
# Works only in Revit 2018 and later.
# Retrieves the project positions with the survey point as the origin.
# (Coordinates of Internal origin, project base point and survey point)

docOrRevitLinkInstance = Input(docOrRevitLinkInstance : var = null)  # Use only if you want to query a linked model
get_project_origin_basepoint_and = Python(IN[0]=docOrRevitLinkInstance)  # "Get Project Origin, BasePoint and SurveyPoint"
# ---------- get_project_origin_basepoint_and.python (60 lines) ----------
import clr
import math
# import Document Manager
clr.AddReference("RevitServices")
import RevitServices 
from RevitServices.Persistence import DocumentManager
doc = DocumentManager.Instance.CurrentDBDocument
clr.AddReference("RevitNodes")
import Revit
clr.ImportExtensions(Revit.Elements)
clr.ImportExtensions(Revit.GeometryConversion)
clr.AddReference("RevitAPI")
from Autodesk.Revit.DB import *
import Autodesk

#Part of script from Clockwork
inputdoc = UnwrapElement(IN[0])
if inputdoc == None:
	doc = DocumentManager.Instance.CurrentDBDocument
elif inputdoc.GetType().ToString() == "Autodesk.Revit.DB.RevitLinkInstance":
	doc = inputdoc.GetLinkDocument()
elif inputdoc.GetType().ToString() == "Autodesk.Revit.DB.Document":
	doc = inputdoc
else: doc = None

UIunit = Document.GetUnits(doc).GetFormatOptions(UnitType.UT_Length).DisplayUnits

outProjBasePt= []
outProjSurvPt = []
outProjLoc= []

pbp = FilteredElementCollector(doc).OfCategory(BuiltInCategory.OST_ProjectBasePoint).ToElements()
sbp = FilteredElementCollector(doc).OfCategory(BuiltInCategory.OST_SharedBasePoint).ToElements()

pbpEW = Autodesk.Revit.DB.UnitUtils.ConvertFromInternalUnits(pbp[0].get_Parameter(BuiltInParameter.BASEPOINT_EASTWEST_PARAM).AsDouble(),UIunit)
pbpNS = Autodesk.Revit.DB.UnitUtils.ConvertFromInternalUnits(pbp[0].get_Parameter(BuiltInParameter.BASEPOINT_NORTHSOUTH_PARAM).AsDouble(),UIunit)
pbpElev = Autodesk.Revit.DB.UnitUtils.ConvertFromInternalUnits(pbp[0].get_Parameter(BuiltInParameter.BASEPOINT_ELEVATION_PARAM).AsDouble(),UIunit)
pbpAngle = pbp[0].get_Parameter(BuiltInParameter.BASEPOINT_ANGLETON_PARAM).AsDouble()*180/math.pi    
# Create Point from Project Base Point Values...
outProjBasePt.append(round(pbpEW,6))
outProjBasePt.append(round(pbpNS,6))
outProjBasePt.append(round(pbpElev,6))
outProjBasePt.append(round(pbpAngle,6))

pspEW = Autodesk.Revit.DB.UnitUtils.ConvertFromInternalUnits(sbp[0].get_Parameter(BuiltInParameter.BASEPOINT_EASTWEST_PARAM).AsDouble(),UIunit)
pspNS = Autodesk.Revit.DB.UnitUtils.ConvertFromInternalUnits(sbp[0].get_Parameter(BuiltInParameter.BASEPOINT_NORTHSOUTH_PARAM).AsDouble(),UIunit)
pspElev = Autodesk.Revit.DB.UnitUtils.ConvertFromInternalUnits(sbp[0].get_Parameter(BuiltInParameter.BASEPOINT_ELEVATION_PARAM).AsDouble(),UIunit)
outProjSurvPt.append(round(pspEW,6))
outProjSurvPt.append(round(pspNS,6))
outProjSurvPt.append(round(pspElev,6))
	    	
projPos = doc.ActiveProjectLocation.GetProjectPosition(XYZ(0,0,0))

if projPos == None:
	outProjLoc.append("No Project Position at origin point")
else:
	outProjLoc.append(round(Autodesk.Revit.DB.UnitUtils.ConvertFromInternalUnits(projPos.EastWest,UIunit),6))
	outProjLoc.append(round(Autodesk.Revit.DB.UnitUtils.ConvertFromInternalUnits(projPos.NorthSouth,UIunit),6))
     
OUT = [outProjLoc, outProjBasePt, outProjSurvPt]
# ----------------------------------------
code_block = CodeBlock(x=get_project_origin_basepoint_and) { x[0]; x[1]; x[2]; }
Active_Project_Location = Output(code_block.out0)
Project_Base_Point = Output(code_block.out1)
Project_Survey_Point = Output(code_block.out2)
