# Dynamo custom node Get Shared Parameter.dyf (Dynamo 1.3.3.4651)
# category: GeniusLoci.Parameter
# Get the parameters names, the parameters groups and the parameters types of the active shared parameter file.

get_shared_parameter_name_and = Python()  # "Get Shared Parameter Name and Group"
# ---------- get_shared_parameter_name_and.python (43 lines) ----------
#Initially from Hot Gear
#Edited by Alban de Chasteigner
import clr
clr.AddReference('ProtoGeometry')
from Autodesk.DesignScript.Geometry import *

clr.AddReference("RevitAPI")
import Autodesk
from Autodesk.Revit.DB import *

clr.AddReference("RevitServices")
import RevitServices
from RevitServices.Persistence import DocumentManager
from RevitServices.Transactions import TransactionManager
from System.Collections.Generic import *

clr.AddReference("RevitNodes")
import Revit
clr.ImportExtensions(Revit.Elements)

import System

doc = DocumentManager.Instance.CurrentDBDocument
uiapp = DocumentManager.Instance.CurrentUIApplication
app = uiapp.Application

uniqueGr,definitions,external = [],[],[]
names,types,paramGroup,guids,groups = [],[],[],[],[]

file = app.OpenSharedParameterFile()
group = file.Groups
for i in group:
	uniqueGr.append(i.Name)
	definitions.append(i)
for j in definitions:
	external.append(j.Definitions)
for i in external:
	for j in i:
		names.append(j.Name)
		types.append(j.ParameterType)
		paramGroup.append(j.ParameterGroup)
		groups.append(j.OwnerGroup.Name)
OUT = names,types,paramGroup,groups,uniqueGr
# ----------------------------------------
code_block = CodeBlock(x=get_shared_parameter_name_and) { x[0]; x[1]; x[2]; x[3]; x[4]; }
Name_of_Parameter = Output(code_block.out0)
Type_of_Parameter = Output(code_block.out1)
Group_of_Parameter = Output(code_block.out2)
SharedParameter_Group = Output(code_block.out3)
Unique_SharedParameter_Group = Output(code_block.out4)
