# Dynamo custom node Get SubCategories Line Pattern.dyf (Dynamo 1.3.3.4651)
# category: GeniusLoci.Graphics
# Get the Line Patterns of the subcategories for a given category.
# From Forum DynamoBim

Category = Input()
python_script = Python(IN[0]=Category)
# ---------- python_script.python (48 lines) ----------
#From jmmiller, Brendan_Cassidy and T_Pover
#https://forum.dynamobim.com/t/help-retrieving-line-pattern-settings-from-object-styles/14076/13
import clr
clr.AddReference('RevitAPI')
from Autodesk.Revit.DB import *

clr.AddReference("RevitNodes")
import Revit
clr.ImportExtensions(Revit.Elements)

clr.AddReference("RevitServices")
import RevitServices
from RevitServices.Persistence import DocumentManager
from RevitServices.Transactions import TransactionManager

doc = DocumentManager.Instance.CurrentDBDocument
cat = UnwrapElement(IN[0])
subcat = cat.SubCategories

listNames = []
listPattern = []
patname = []
listout = []
listpatid = []
lineWeight = []
listRGB = []

for i in subcat:
	name = i.Name
	listNames.append(name)
	id = i.GetLinePatternId(GraphicsStyleType.Projection)
	pat = LinePatternElement.GetLinePattern(doc,id)
	weight = i.GetLineWeight(GraphicsStyleType.Projection)
	rgb = [i.LineColor.Red, i.LineColor.Green, i.LineColor.Blue]
	listRGB.append(rgb)
	lineWeight.append(weight)
	listPattern.append(pat)
	listpatid.append(id)
	try:
		patname.append(pat.Name)
	except:
		patname.append("Solid")
		
	style = i.GetGraphicsStyle(GraphicsStyleType.Projection)
	listout.append(style)


OUT = listout, listNames, listPattern, patname, listpatid, lineWeight, listRGB
# ----------------------------------------
code_block = CodeBlock(x=python_script) { x[0]; x[1]; x[2]; x[3]; x[4]; x[5]; x[6]; }
byID = Python(IN[0]=code_block.out4)  # "Element.ByID"
# ---------- byID.python (29 lines) ----------
#From Clockwork
import clr
clr.AddReference('RevitAPI')
from Autodesk.Revit.DB import *

clr.AddReference("RevitNodes")
import Revit
clr.ImportExtensions(Revit.Elements)

clr.AddReference("RevitServices")
import RevitServices
from RevitServices.Persistence import DocumentManager

doc = DocumentManager.Instance.CurrentDBDocument
uiapp = DocumentManager.Instance.CurrentUIApplication
app = uiapp.Application

items = UnwrapElement(IN[0])

elementlist = list()
for item in items:
	try: 
		elementlist.append(doc.GetElement(item).ToDSType(True))
	except:
		try:
			elementlist.append(doc.GetElement(ElementId(item)).ToDSType(True))
		except:
			elementlist.append(None)
OUT = elementlist
# ----------------------------------------
Element_list = Output(byID)
Line_Weight = Output(code_block.out5)
Line_Colors = Output(code_block.out6)
Line_Pattern_Name = Output(code_block.out3)
Line_Pattern = Output(code_block.out2)
SubCategory_Name = Output(code_block.out1)
Graphic_Style = Output(code_block.out0)
