# Dynamo custom node Get rooms by name or number.dyf (Dynamo 1.3.3.4651)
# category: GeniusLoci.Room
# Enter the name or number of room to get the room.
# Inspired by jeremy@learndynamo.com

Refresh = Input(Refresh :bool=true)
RoomName = Input(RoomName : string)
get_rooms_by_name_or_number = Python(IN[0]=Refresh, IN[1]=RoomName)
# ---------- get_rooms_by_name_or_number.python (38 lines) ----------
#Node Inspired by jeremy@learndynamo.com
#www.Learndynamo.com 

import clr
clr.AddReference('RevitAPI')
clr.AddReference("RevitServices")
clr.AddReference("RevitNodes")
import RevitServices
import Revit
import Autodesk
from Autodesk.Revit.DB import *

clr.ImportExtensions(Revit.GeometryConversion)
from RevitServices.Persistence import DocumentManager
from RevitServices.Transactions import TransactionManager

doc = DocumentManager.Instance.CurrentDBDocument

toggle = IN[0]
namnum= IN[1]

rooms = []
roomLevels = []
	
if toggle == True:
	collector = FilteredElementCollector(doc).OfCategory(BuiltInCategory.OST_Rooms)
	
	for i in collector:
		if namnum in i.get_Parameter(BuiltInParameter.ROOM_NAME).AsString() or namnum in i.get_Parameter(BuiltInParameter.ROOM_NUMBER).AsString():
		
			if i.Location != None:	
				rooms.append(i)
				roomLevels.append(i.Level)
										
	OUT = rooms, roomLevels

else:
	OUT = "Set toggle to True"
# ----------------------------------------
code_block = CodeBlock(x=get_rooms_by_name_or_number) { x[0]; x[1]; }
Rooms = Output(code_block.out0)
Levels = Output(code_block.out1)
