# Dynamo custom node Link DWG.dyf (Dynamo 1.3.3.4651)
# category: GeniusLoci.Import
# Link DWGs in views with options.
# Use with the Enumerate DWG import options node.
# Based on a archilab's script.

Filepaths = Input()
views = Input()  # As many Views as FilePaths
CustomScale = Input(CustomScale : double = 1)
Colormode = Input()
Placement = Input()
Unit = Input()
python_script = Python(IN[0]=Filepaths, IN[1]=views, IN[2]=CustomScale, IN[3]=Colormode, IN[4]=Placement, IN[5]=Unit)
# ---------- python_script.python (76 lines) ----------
#Based on a script by Konrad Sobon
#Additions by Joseph_Peel
#Additions by Alban de Chasteigner 2018

import clr
clr.AddReference('ProtoGeometry')
from Autodesk.DesignScript.Geometry import *

# Import DocumentManager and TransactionManager
clr.AddReference('RevitServices')
import RevitServices
from RevitServices.Persistence import DocumentManager
from RevitServices.Transactions import TransactionManager

doc = DocumentManager.Instance.CurrentDBDocument
uiapp = DocumentManager.Instance.CurrentUIApplication
app = uiapp.Application

# Import RevitAPI
clr.AddReference('RevitAPI')
import Autodesk
from Autodesk.Revit.DB import *

#The inputs to this node will be stored as a list in the IN variables.
dataEnteringNode = IN

filePaths = IN[0]

if not hasattr(filePaths, '__iter__'):
	filePaths = [filePaths]

views = UnwrapElement(IN[1])

if not hasattr(views, '__iter__'):
	views = [views]

customscale = IN[2]
colormode = IN[3]
placement = IN[4]
unit = IN[5]
viewsplaced = []
outName = []
CADlinktype = []
importinst = []

options = DWGImportOptions()
options.AutoCorrectAlmostVHLines = True
options.OrientToView = True
options.ThisViewOnly = True
options.VisibleLayersOnly = True
options.CustomScale = customscale
options.ColorMode = colormode
options.Placement= placement
options.Unit = unit

linkedElem = clr.Reference[ElementId]()

for view in range(len(views)):
	TransactionManager.Instance.EnsureInTransaction(doc)
	doc.Link(filePaths[view], options, views[view], linkedElem)
	TransactionManager.Instance.TransactionTaskDone()
	viewsplaced.append(views[view])
		
ImportInstances = FilteredElementCollector(doc).OfClass(ImportInstance).ToElements()

for importinstance in ImportInstances :
	if importinstance.IsLinked:
		importinst.append(importinstance)
		for importins in importinst :
			CADLink = doc.GetElement(importins.GetTypeId())
		CADlinktype.append(CADLink)
		name = Element.Name.GetValue(CADLink)
		outName.append(name)

#Assign your output to the OUT variable.
OUT = viewsplaced,outName,CADlinktype,importinst
# ----------------------------------------
code_block = CodeBlock(x=python_script) { x[0]; x[1]; x[2]; x[3]; }
Views = Output(code_block.out0)
Name = Output(code_block.out1)
CADLinkType = Output(code_block.out2)
ImportInstance = Output(code_block.out3)
