# Dynamo custom node Material Get Appearance Asset Element.dyf (Dynamo 1.3.3.4651)
# category: GeniusLoci.Material
# Works only in Revit 2018.1 and later.
# Retrieves the Appearance Asset Elements of the given material and its Rendering Asset.

Material = Input()
get_asset = Python(IN[0]=Material)
# ---------- get_asset.python (37 lines) ----------
#Inspired by Boris Shafiro from Autodesk
#Alban de Chasteigner 2018
#twitter : @geniusloci_bim
#geniusloci.bim@gmail.com

import clr
clr.AddReference('RevitAPI')
from Autodesk.Revit.DB import *
from Autodesk.Revit.DB.Visual import *
import System
clr.AddReference('RevitServices')
import RevitServices
from RevitServices.Persistence import DocumentManager
doc = DocumentManager.Instance.CurrentDBDocument

def toList(obj):
    if hasattr(obj, '__iter__'): return obj
    else: return [obj]
    
mats = toList(UnwrapElement(IN[0]))
assetElems=[]
names=[]
assets=[]
assetTypes=[]
titles=[]

for mat in mats:
	appearanceAssetId = mat.AppearanceAssetId
	assetElem = doc.GetElement(appearanceAssetId)
	asset = assetElem.GetRenderingAsset()
	assetElems.append(assetElem)
	assets.append(asset)
	assetTypes.append(asset.AssetType)
	titles.append(asset.Title)
	names.append(asset.Name)

OUT = assetElems,assets,assetTypes,titles,names
# ----------------------------------------
code_block = CodeBlock(x=get_asset) { x[0]; x[1]; x[2]; x[3]; x[4]; }
AppearanceAssetElement = Output(code_block.out0)
Asset = Output(code_block.out1)
Asset_Type = Output(code_block.out2)
Asset_Title = Output(code_block.out3)
Asset_Name = Output(code_block.out4)
