# Dynamo custom node New Get Material Properties.dyf (Dynamo 1.3.3.4651)
# category: GeniusLoci.Material
# Works only in Revit 2019 and later.
# Get name, color, transparency, SurfaceForeground, SurfaceBackground, CutForeground and CutBackground patterns id from the given material.

Material = Input()
material = Python(IN[0]=Material)
# ---------- material.python (55 lines) ----------
#Alban de Chasteigner 2018
#twitter : @geniusloci_bim
#geniusloci.bim@gmail.com

import clr
clr.AddReference("RevitAPI")
from Autodesk.Revit.DB import *
clr.AddReference("RevitServices")
import RevitServices
from RevitServices.Persistence import DocumentManager
from RevitServices.Transactions import TransactionManager
clr.AddReference("RevitNodes")
import Revit
clr.ImportExtensions(Revit.Elements)
clr.AddReference('DSCoreNodes')
import DSCore
from DSCore import Color

doc = DocumentManager.Instance.CurrentDBDocument

def tolist(obj1):
	if hasattr(obj1,"__iter__"): return obj1
	else: return [obj1]

materials = tolist(UnwrapElement(IN[0]))
colorname,colorlist,sforpatternlist,surforcolorlist,sbacpatternlist,surbaccolorlist,cforpatternlist,cutforcolorlist,cbacpatternlist,cutbaccolorlist,transparencylist,rgbList,rgbSurforList,rgbSurbacList,rgbCutforList,rgbCutbacList=[],[],[],[],[],[],[],[],[],[],[],[],[],[],[],[]

for material in materials :
	colorname.append(material.Name)
	colorlist.append(material.Color)
	sforpatternlist.append(material.SurfaceForegroundPatternId)
	surforcolorlist.append(material.SurfaceForegroundPatternColor)
	sbacpatternlist.append(material.SurfaceBackgroundPatternId)
	surbaccolorlist.append(material.SurfaceBackgroundPatternColor)	
	cforpatternlist.append(material.CutForegroundPatternId)
	cutforcolorlist.append(material.CutForegroundPatternColor)
	cbacpatternlist.append(material.CutBackgroundPatternId)
	cutbaccolorlist.append(material.CutBackgroundPatternColor)	
	transparencylist.append(material.Transparency)
	for colors in colorlist :
		rgb = DSCore.Color.ByARGB(255, colors.Red, colors.Green, colors.Blue)
	rgbList.Add(rgb)
	for surcolor in surforcolorlist :
		rgbSf = DSCore.Color.ByARGB(255, surcolor.Red, surcolor.Green, surcolor.Blue)
	rgbSurforList.Add(rgbSf)
	for surbaccolor in surbaccolorlist :
		rgbSb = DSCore.Color.ByARGB(255, surbaccolor.Red, surbaccolor.Green, surbaccolor.Blue)
	rgbSurbacList.Add(rgbSb)	
	for cutcolor in cutforcolorlist :
		rgbCf = DSCore.Color.ByARGB(255, cutcolor.Red, cutcolor.Green, cutcolor.Blue)
	rgbCutforList.Add(rgbCf)
	for cutbaccolor in cutbaccolorlist :
		rgbCb = DSCore.Color.ByARGB(255, cutbaccolor.Red, cutbaccolor.Green, cutbaccolor.Blue)
	rgbCutbacList.Add(rgbCb)
OUT = colorname,rgbList,sforpatternlist,rgbSurforList,sbacpatternlist,rgbSurbacList,cforpatternlist,rgbCutforList,cbacpatternlist,rgbCutbacList,transparencylist
# ----------------------------------------
code_block = CodeBlock(x=material) { x[0]; x[1]; x[2]; x[3]; x[4]; x[5]; x[6]; x[7]; x[8]; x[9]; x[10]; }
Material_Name = Output(code_block.out0)
Material_Color = Output(code_block.out1)
SurfaceForegroundPatternId = Output(code_block.out2)
SurfaceForegroundPatternColor = Output(code_block.out3)
SurfaceBackgroundPatternId = Output(code_block.out4)
SurfaceBackgroundPatternColor = Output(code_block.out5)
CutForegroundPatternId = Output(code_block.out6)
CutForegroundPatternColor = Output(code_block.out7)
CutBackgroundPatternId = Output(code_block.out8)
CutBackgroundPatternColor = Output(code_block.out9)
Material_Transparency = Output(code_block.out10)
