# Dynamo custom node Repath RevitLinkType.dyf (Dynamo 1.3.3.4651)
# category: GeniusLoci.Import
# Reloads all linked Revit files from an unique folder.
# Based on a Nick Boyts's script.

RunIt = Input(RunIt : bool=false)
DirectoryPath = Input()
python_script = Python(IN[0]=RunIt, IN[1]=DirectoryPath)
# ---------- python_script.python (42 lines) ----------
#From Nick_Boyts
import clr
clr.AddReference('ProtoGeometry')
from Autodesk.DesignScript.Geometry import *
# Import ToDSType(bool) extension method
clr.AddReference("RevitNodes")
import Revit
clr.ImportExtensions(Revit.Elements)
# Import geometry conversion extension methods
clr.ImportExtensions(Revit.GeometryConversion)
# Import DocumentManager and TransactionManager
clr.AddReference("RevitServices")
import RevitServices
from RevitServices.Persistence import DocumentManager
from RevitServices.Transactions import TransactionManager
from System.Collections.Generic import *
# Import RevitAPI
clr.AddReference("RevitAPI")
import Autodesk
from Autodesk.Revit.DB import *
doc = DocumentManager.Instance.CurrentDBDocument
uiapp = DocumentManager.Instance.CurrentUIApplication
app = uiapp.Application
uidoc=DocumentManager.Instance.CurrentUIApplication.ActiveUIDocument

collector = Autodesk.Revit.DB.FilteredElementCollector(doc)
linkInstances = collector.OfClass(Autodesk.Revit.DB.RevitLinkInstance)
toggle = IN[0]
folderpath = IN[1]
reloadedlinks = []

if toggle == True:
	for i in linkInstances:
		name = i.Name
		path = folderpath + "\\" + name
		paths = path.rsplit(' : ',2)[0]
		filepath = FilePath(paths)
		RevitLinkType  = doc.GetElement(i.GetTypeId())
		RevitLinkType.LoadFrom(filepath,None)
		reloadedlinks.append(RevitLinkType)

OUT= reloadedlinks
# ----------------------------------------
RevitLinkType = Output(python_script)
