# Dynamo custom node SelectByCategoryAndBoundingBox.dyf (Dynamo 1.3.3.4651)
# category: GeniusLoci.Select
# Collect elements by category from a BoundingBox.

BoundingBox = Input()
Category = Input()
python_script = Python(IN[0]=BoundingBox, IN[1]=Category)
# ---------- python_script.python (50 lines) ----------
#From Einar_Raknes

import clr
clr.AddReference('RevitAPI')
clr.AddReference('System')
clr.AddReference('RevitNodes')
clr.AddReference('RevitServices')
import Revit
import RevitServices
from Autodesk.Revit.DB import *
from System.Collections.Generic import List
from RevitServices.Persistence import DocumentManager
from RevitServices.Transactions import TransactionManager
clr.ImportExtensions(Revit.Elements)
clr.ImportExtensions(Revit.GeometryConversion)
doc = DocumentManager.Instance.CurrentDBDocument

#Functions for list handling
def ProcessList(_func, _list):
   return map( lambda x: ProcessList(_func, x) if type(x)==list else _func(x), _list )

#Preparing input from dynamo to revit

def ToRevit(item):
	return item.ToRevitType(True)

if isinstance(IN[0], list):
	bblist = ProcessList(ToRevit, IN[0])
else:
	bblist = [ToRevit(IN[0])]

if isinstance(IN[1], list):
	cats = ProcessList(UnwrapElement, IN[1])
else:
	cats = [UnwrapElement(IN[1])]

catlist = []
for cat in cats:
	catlist.append(cat.Id)
filtercats = List[ElementId](catlist)
catfilter = ElementMulticategoryFilter(filtercats)

def collectElementsInBB(bb):
	outline = Outline(bb.Min, bb.Max)
	bbfilter = BoundingBoxIntersectsFilter(outline)
	andfilter = LogicalAndFilter(catfilter,bbfilter)
	collector = FilteredElementCollector(doc).WherePasses(andfilter)
	return [e.ToDSType(True) for e in collector]

OUT = ProcessList(collectElementsInBB, bblist)[0]
# ----------------------------------------
Elements = Output(python_script)
