# Dynamo custom node SelectByCategoryAndHost3DView.dyf (Dynamo 1.3.3.4651)
# category: GeniusLoci.Select
# Collects elements in the given document by category and in the host 3D view of the active document.
# The transform CS is returned only with a LinkInstance input.

ThreeDView = Input()  # View of active document
Category = Input()
docOrRevitLinkInstance = Input(docOrRevitLinkInstance : var[] = null)  # Use only if you want to query a linked model
selectByCategoryAnd3DView = Python(IN[0]=ThreeDView, IN[1]=Category, IN[2]=docOrRevitLinkInstance)
# ---------- selectByCategoryAnd3DView.python (75 lines) ----------
#Inspired by Einar_Raknes
#Alban de Chasteigner 2018
#twitter : @geniusloci_bim
#geniusloci.bim@gmail.com

import clr
clr.AddReference('RevitAPI')
clr.AddReference('System')
clr.AddReference('RevitNodes')
clr.AddReference('RevitServices')
import Revit
import RevitServices
from Autodesk.Revit.DB import *
from System.Collections.Generic import List
from RevitServices.Persistence import DocumentManager
from RevitServices.Transactions import TransactionManager
clr.ImportExtensions(Revit.Elements)
clr.ImportExtensions(Revit.GeometryConversion)

def tolist(x):
    if hasattr(x,'__iter__'): return x
    else : return [x]

views = tolist(UnwrapElement(IN[0]))
cats = tolist(UnwrapElement(IN[1]))
inputdocs = tolist(UnwrapElement(IN[2]))
transforms = []

for inputdoc in inputdocs :
	if inputdoc == None:
		doc = DocumentManager.Instance.CurrentDBDocument
	elif inputdoc.GetType().ToString() == "Autodesk.Revit.DB.Document":
		doc = inputdoc
	elif inputdoc.GetType().ToString() == "Autodesk.Revit.DB.RevitLinkInstance":
		doc = inputdoc.GetLinkDocument()
		transforms.append(inputdoc.GetTotalTransform().ToCoordinateSystem(1))
	else: 
		transforms.append(None)

viewlist = []

for view in views:
    viewlist.append(view)
    sectionbox = view.GetSectionBox()
    transform = sectionbox.Transform
    sboxoriginx = transform.Origin.X
    sboxoriginy = transform.Origin.Y
    sboxoriginz = transform.Origin.Z
    minx = sectionbox.Min.X + sboxoriginx
    maxx = sectionbox.Max.X + sboxoriginx
    miny = sectionbox.Min.Y + sboxoriginy
    maxy = sectionbox.Max.Y + sboxoriginy
    minz = sectionbox.Min.Z + sboxoriginz
    maxz = sectionbox.Max.Z + sboxoriginz
    bbox = BoundingBoxXYZ()

catlist = []
linkedEl = []
elements = []

for cat in cats:
	catlist.append(cat.Id)
filtercats = List[ElementId](catlist)
catfilter = ElementMulticategoryFilter(filtercats)
	
outline = Outline(XYZ((minx), (miny), (minz)), XYZ((maxx), (maxy), (maxz)))
bbfilter = BoundingBoxIntersectsFilter(outline)
andfilter = LogicalAndFilter(catfilter,bbfilter)

collector = FilteredElementCollector(doc).WherePasses(andfilter)
for col in collector:
	linkedEl.append(col.ToDSType(True))
elements.append(linkedEl)

OUT = elements[0],transforms
# ----------------------------------------
code_block = CodeBlock(x=selectByCategoryAnd3DView) { x[0]; x[1]; }
Elements = Output(code_block.out0)
Transform = Output(code_block.out1)
