# Dynamo custom node Tag Set Location.dyf (Dynamo 1.3.4.6666)
# category: GeniusLoci.Tag
# Moves the head of the tag to the given location point.

Tag = Input()
Location = Input()
python_script = Python(IN[0]=Tag, IN[1]=Location)
# ---------- python_script.python (22 lines) ----------
import clr
clr.AddReference("RevitServices")
import RevitServices
from RevitServices.Persistence import DocumentManager
doc =  DocumentManager.Instance.CurrentDBDocument

clr.AddReference("RevitNodes")
import Revit
clr.ImportExtensions(Revit.Elements)
clr.ImportExtensions(Revit.GeometryConversion)

def tolist(obj1):
	if hasattr(obj1,"__iter__"): return obj1
	else: return [obj1]

tags = UnwrapElement(tolist(IN[0]))
locations = UnwrapElement(tolist(IN[1]))

for tag,location in zip(tags,locations):
	tag.TagHeadPosition = location.ToRevitType()

OUT = tags
# ----------------------------------------
Tag_2 = Output(python_script)  # "Tag"
