# Dynamo custom node View Get Color of Filter.dyf (Dynamo 1.3.3.4651)
# category: GeniusLoci.Graphics
# Note: This method is deprecated in Revit 2019.
# Get the view filter and its colors from the given view.

View = Input()
get_colors_of_filters = Python(IN[0]=View)
# ---------- get_colors_of_filters.python (76 lines) ----------
#Based on a Thomas Mahon'script
#Alban de Chasteigner 2018
#twitter : @geniusloci_bim
#geniusloci.bim@gmail.com

import clr
clr.AddReference('ProtoGeometry')
from Autodesk.DesignScript.Geometry import *

clr.AddReference('DSCoreNodes')
import DSCore
from DSCore import Color

#Import ToDSType(bool) extension method
clr.AddReference("RevitNodes")
import Revit
clr.ImportExtensions(Revit.Elements)

# Import geometry conversion extension methods
clr.ImportExtensions(Revit.GeometryConversion)

# Import DocumentManager and TransactionManager
clr.AddReference("RevitServices")
import RevitServices
from RevitServices.Persistence import DocumentManager
from RevitServices.Transactions import TransactionManager
from System.Collections.Generic import *

# Import RevitAPI
clr.AddReference("RevitAPI")
import Autodesk
from Autodesk.Revit.DB import *

doc = DocumentManager.Instance.CurrentDBDocument
uiapp = DocumentManager.Instance.CurrentUIApplication
app = uiapp.Application

def toRvtId(_id):
	if isinstance(_id, int) or isinstance(_id, str):
		id = ElementId(int(_id))
		return id
	elif isinstance(_id, ElementId):
		return _id

def tolist(obj1):
	if hasattr(obj1,"__iter__"): return obj1
	else: return [obj1]

views = tolist(UnwrapElement(IN[0]))

colList,cutList,elements,elementName = [],[],[],[]

for v in views:
	filters = v.GetFilters() # Get all the filter ids
	rgbList,rgbCutList = [],[]
	for f in filters:
		elements.append(doc.GetElement(toRvtId(f)).ToDSType(True))
		filterObject = v.GetFilterOverrides(f)
		col = filterObject.ProjectionFillColor
		if col.IsValid:
			rgb = DSCore.Color.ByARGB(255, col.Red, col.Green, col.Blue)
		else:
			rgb = None
		rgbList.Add(rgb)
		cut = filterObject.CutFillColor
		if cut.IsValid:
			rgbcut = DSCore.Color.ByARGB(255, cut.Red, cut.Green, cut.Blue)
		else:
			rgbcut = None
		rgbCutList.Add(rgbcut)
	colList.Add(rgbList)
	cutList.Add(rgbCutList)
	for element in elements:
		elementName.append(element.Name)
		
OUT = colList[0],cutList[0],elements, elementName
# ----------------------------------------
code_block = CodeBlock(x=get_colors_of_filters) { x[0]; x[1]; x[2]; x[3]; }
SurfacePatternColor = Output(code_block.out0)
CutPatternColor = Output(code_block.out1)
ViewFilter = Output(code_block.out2)
ViewFilter_Name = Output(code_block.out3)
