# Dynamo custom node Wall Layer References.dyf (Dynamo 1.3.4.6666)
# category: GeniusLoci.Reference
# Gets the references of the wall layers. (Wall's centerline, center of core, and faces of core)

Wall = Input()
wallLayerReferences = Python(IN[0]=Wall)
# ---------- wallLayerReferences.python (48 lines) ----------
#Inspired by FAIR59
import clr
clr.AddReference('RevitAPI')
from Autodesk.Revit.DB import *

clr.AddReference('RevitNodes')
import Revit
clr.ImportExtensions(Revit.GeometryConversion)
clr.ImportExtensions(Revit.Elements)

clr.AddReference('RevitServices')
import RevitServices
from RevitServices.Persistence import DocumentManager
from RevitServices.Transactions import TransactionManager

doc = DocumentManager.Instance.CurrentDBDocument

interior_face,core_inner,core_centre,wall_centre,core_outer,exterior_face=[],[],[],[],[],[]

#Converting input from Dynamo to Revit
walls = UnwrapElement(IN[0])
if not hasattr(walls, '__iter__'):
	walls = [walls]

for wall in walls:
	format = "{0}:{1}:{2}"
	uid = wall.UniqueId
	nines = -9999

	refString = str.Format(format,uid,nines,1)
	wall_centre.append(Reference.ParseFromStableRepresentation(doc,refString))

	refString = str.Format(format,uid,nines,2)
	core_outer.append(Reference.ParseFromStableRepresentation(doc,refString))

	refString = str.Format(format,uid,nines,3)
	core_inner.append(Reference.ParseFromStableRepresentation(doc,refString))

	refString = str.Format(format,uid,nines,4)
	core_centre.append(Reference.ParseFromStableRepresentation(doc,refString))

	refString = str.Format(format,uid,nines,5)
	interior_face.append(Reference.ParseFromStableRepresentation(doc,refString))

	refString = str.Format(format,uid,nines,6)
	exterior_face.append(Reference.ParseFromStableRepresentation(doc,refString))

OUT = exterior_face,core_outer,wall_centre,core_centre,core_inner,interior_face
# ----------------------------------------
code_block = CodeBlock(x=wallLayerReferences) { x[0]; x[1]; x[2]; x[3]; x[4]; x[5]; }
Exterior_Wall_Face = Output(code_block.out0)
Core_Exterior_Face = Output(code_block.out1)
Wall_s_Overall_Centre = Output(code_block.out2)  # "Wall's Overall Centre"
Core_Centre = Output(code_block.out3)
Core_Interior_Face = Output(code_block.out4)
Interior_Wall_Face = Output(code_block.out5)
