# Dynamo custom node LunchBox Create Room by Name and Number.dyf (Dynamo 1.1.0.2094)
# category: LunchBox.Revit.Elements.Create
# Creates an unplaced room element using a name and number.

Toggle = Input()
Number = Input()
Name = Input()
python_script = Python(IN[0]=Toggle, IN[1]=Number, IN[2]=Name)
# ---------- python_script.python (76 lines) ----------
import clr
clr.AddReference('ProtoGeometry')
from Autodesk.DesignScript.Geometry import *

# Import RevitAPI
clr.AddReference("RevitAPI")
import Autodesk
from Autodesk.Revit.DB import *

# Import DocumentManager and TransactionManager
clr.AddReference("RevitServices")
import RevitServices
from RevitServices.Persistence import DocumentManager
from RevitServices.Transactions import TransactionManager

# Import ToDSType(bool) extension method
clr.AddReference("RevitNodes")
import Revit
clr.ImportExtensions(Revit.Elements)
clr.ImportExtensions(Revit.GeometryConversion)

#The inputs to this node will be stored as a list in the IN variable.
doc =  DocumentManager.Instance.CurrentDBDocument
app =  DocumentManager.Instance.CurrentUIApplication.Application

bool = IN[0]
rmnumbers = IN[1]
rmnames = IN[2]

rooms = []

existrooms = []
existnames = []
existnumbers = []
collector = FilteredElementCollector(doc)
collector.OfCategory(BuiltInCategory.OST_Rooms)
for roomexist in collector:
	existrooms.append(roomexist)

if bool == True:
	
	# "Start" the transaction
	TransactionManager.Instance.EnsureInTransaction(doc)
	for i in range(0,len(rmnumbers)):
		name = rmnames[i]
		number = rmnumbers[i]

		v = doc.ActiveView
		p = v.get_Parameter(BuiltInParameter.VIEW_PHASE).AsElementId()
		phase = doc.GetElement(p)
		
		#search for matching rooms
		match = False
		for j in range(0, len(existrooms)):
			existrm = existrooms[j]
			existnm = ''
			for p in existrm.Parameters:
				if p.Definition.Name == 'Name':		
					existnm = p.AsString()
			existnum = existrm.Number
			if existnm == name and existnum == number:
				rooms.append(existrm)
				match = True
				break

		if match == False:
			room = doc.Create.NewRoom(phase)
			room.Name = name
			room.Number = str(number)
			rooms.append(room)
	
# "End" the transaction
TransactionManager.Instance.TransactionTaskDone()

#Assign your output to the OUT variable
OUT = rooms
# ----------------------------------------
Room = Output(python_script)
