# Dynamo custom node LunchBox Space Truss Structure.dyf "WireSpaceTruss" (Dynamo 0.7.5.3566)
# category: LunchBox.Geometry.Structure
# Create a space truss using a surface.

Surface = Input()
U = Input()
lunchbox_list_matcher = Custom[LunchBox List Matcher](ListA=Surface, ListB=U)  # Compares a List A against a List B and matches length of List A. If ListA > ListB, ListB will be extended. If ListA < ListB, ListB will be truncated.
V = Input()
lunchbox_list_matcher_2 = Custom[LunchBox List Matcher](ListA=Surface, ListB=V)
Depth = Input()
lunchbox_list_matcher_3 = Custom[LunchBox List Matcher](ListA=Surface, ListB=Depth)
python_script = Python(IN[0]=lunchbox_list_matcher.ListA, IN[1]=lunchbox_list_matcher.MatchListB, IN[2]=lunchbox_list_matcher_2.MatchListB, IN[3]=lunchbox_list_matcher_3.MatchListB)
# ---------- python_script.python (103 lines) ----------
#Copyright(c) 2014, Nathan Miller
# The Proving Ground, http://theprovingground.org

import clr
clr.AddReference('ProtoGeometry')
from Autodesk.DesignScript.Geometry import *

# Panel division class
class CenterlineDivision:
	
	# divide surface
	def SpaceTrussDivision(self, srf, udiv, vdiv, depth):
		lnsA = []
		lnsB = []
		lnsC = []
		lnsD = []
		lnsE = []
	
		ustep = 1.0/udiv
		vstep = 1.0/vdiv
		oset = srf.Offset(depth)
		for i in range(0,int(udiv)+1):
			for j in range(0,int(vdiv)+1):
				
				ptA = srf.PointAtParameter(i*ustep, j*vstep)
				if i<udiv:
					ptB = srf.PointAtParameter((i + 1) * ustep, j * vstep)
					ln = Line.ByStartPointEndPoint(ptA, ptB)
					lnsA.append(ln)
				if j < vdiv:
					ptB = srf.PointAtParameter(i * ustep, (j + 1) * vstep)
					ln = Line.ByStartPointEndPoint(ptA,ptB)
					lnsB.append(ln)
				
				if i<udiv and j<vdiv:
					lptA = oset.PointAtParameter((i * ustep) + (0.5 * ustep), (j * vstep) + (0.5 * vstep))
					if i<(udiv-1):
						lptB = oset.PointAtParameter(((i + 1) * ustep) + (0.5 * ustep), (j * vstep) + (0.5 * vstep))
						ln = Line.ByStartPointEndPoint(lptA, lptB)
						lnsC.append(ln)
					if j<(vdiv-1):
						lptB = oset.PointAtParameter((i * ustep) + (0.5 * ustep), ((j + 1) * vstep) + (0.5 * vstep))
						ln = Line.ByStartPointEndPoint(lptA, lptB)
						lnsD.append(ln)
					
					bptA = srf.PointAtParameter(i * ustep, j * vstep)
					bptB = srf.PointAtParameter((i + 1) * ustep, j * vstep)
					bptC = srf.PointAtParameter((i + 1) * ustep, (j + 1) * vstep)
					bptD = srf.PointAtParameter(i * ustep, (j + 1) * vstep)
					mpt = oset.PointAtParameter((i * ustep) + (0.5 * ustep), (j * vstep) + (0.5 * vstep)) 
					
					blnA = Line.ByStartPointEndPoint(bptA, mpt)
					blnB = Line.ByStartPointEndPoint(bptB, mpt)
					blnC = Line.ByStartPointEndPoint(bptC, mpt)
					blnD = Line.ByStartPointEndPoint(bptD, mpt)
					
					lnsE.append(blnA)
					lnsE.append(blnB)
					lnsE.append(blnC)
					lnsE.append(blnD)
					
		self.lnsA = lnsA
		self.lnsB = lnsB
		self.lnsC = lnsC
		self.lnsD = lnsD
		self.lnsE = lnsE

#main code here....
srf = IN[0]
udiv = IN[1]
vdiv = IN[2]
depth = IN[3]

lnsA = []
lnsB = []
lnsC = []
lnsD = []
lnsE = []
lns = []
	
for k in range(0, len(srf)):

	s = srf[k]
	u = udiv[k]
	v = vdiv[k]
	d = depth[k]
			
	divide = CenterlineDivision()
	divide.SpaceTrussDivision(s,u,v,d)
					
	lnsA.append(divide.lnsA)
	lnsB.append(divide.lnsB)
	lnsC.append(divide.lnsC)
	lnsD.append(divide.lnsD)
	lnsE.append(divide.lnsE)

lns.append(lnsA)
lns.append(lnsB)
lns.append(lnsC)
lns.append(lnsD)
lns.append(lnsE)

OUT = lns
# ----------------------------------------
number = DoubleInput(0)
getItemAtIndex = List.GetItemAtIndex(python_script, number)
CenterlinesA = Output(getItemAtIndex)
number_2 = DoubleInput(1)
getItemAtIndex_2 = List.GetItemAtIndex(python_script, number_2)
CenterlinesB = Output(getItemAtIndex_2)
number_3 = DoubleInput(2)
getItemAtIndex_3 = List.GetItemAtIndex(python_script, number_3)
CenterlinesC = Output(getItemAtIndex_3)
number_4 = DoubleInput(3)
getItemAtIndex_4 = List.GetItemAtIndex(python_script, number_4)
CenterlinesD = Output(getItemAtIndex_4)
number_5 = DoubleInput(4)
getItemAtIndex_5 = List.GetItemAtIndex(python_script, number_5)
CenterlinesE = Output(getItemAtIndex_5)
