# Dynamo custom node Rhythm.IntegerSlider.dyf (Dynamo 1.2.1.3083)
# category: Rhythm.Core.Input
# Provides an integer slider for the dynamo player. Has min, max and description.

currentUserAppData = Custom[OS.CurrentUserAppData]()  # This retrieves the current user's appdata location
string = StringInput("\Dynamo\Dynamo Revit\1.2\packages\Rhythm\extra\rhythm-logo-smaller.png")
add = currentUserAppData + string
windowTitle = Input(windowTitle : string = "Rhythm Integer Slider")
minValue = Input(minValue : int = 0)
maxValue = Input(maxValue : int = 100)
refresh = Input(refresh : bool=false)
slider_working = Python(IN[0]=add, IN[1]=windowTitle, IN[2]=minValue, IN[3]=maxValue, IN[4]=refresh)
# ---------- slider_working.python (94 lines) ----------
#Based on the code generously provided at http://zetcode.com/tutorials/ironpythontutorial/controlsII/
#Made for Dynamo by John Pierson
import clr
clr.AddReference("System.Windows.Forms")
clr.AddReference("System.Drawing")

from System.Windows.Forms import Application, Form, StatusBar
from System.Windows.Forms import RadioButton, GroupBox, Label, Button, AnchorStyles, DockStyle, PictureBox, PictureBoxSizeMode, TextBox
from System.Windows.Forms import TrackBar, TickStyle
from System.Drawing import Size, Point, Font, Color, Image

pathToFile = IN[0]
amount = []

class IForm(Form):

	def __init__(self):

		self.Text = IN[1]

		image = Image.FromFile(pathToFile)
		pictureBox = PictureBox()
		pictureBox.Size = Size(300,110)
		pictureBox.Location = Point(95,0)
		pictureBox.Image = image
		#pictureBox.Dock = DockStyle.Top
        
		self.Output1 = []
		self.Font = Font("Arial",12)
		self.BackColor = Color.White
		
		lb0 = Label()
		lb0.Parent = self
		lb0.Text = str('select value below')
		lb0.Location = Point(115, 125)
		lb0.AutoSize = True
		lb0.MaximumSize = Size(400,0)
		lb0.ForeColor = Color.RoyalBlue
		lb0.Font = Font("Arial",18)
		
		tb = TrackBar()
		tb.Font = Font("Arial Narrow",12)
		tb.TickStyle = TickStyle.BottomRight
		tb.SetRange(IN[2], IN[3])
		tb.ValueChanged += self.OnChanged
		tb.Location = Point(20,200)
		tb.Width = 350
		#tb.Dock = DockStyle.Bottom
		
		
		lb1 = Label()
		lb1.Parent = self
		lb1.Text = str(IN[2])
		lb1.Location = Point(0, 200)
		lb1.Height = 15
		lb1.Width = 45
		
		lb2 = Label()
		lb2.Parent = self
		lb2.Text = str(IN[3])
		lb2.Location = Point(375, 200)
		lb2.Height = 15
		lb2.Width = 45
		
		
		btn1 = Button()
		btn1.Text = "Accept"
		btn1.Parent = self
		btn1.Location = Point(175, 175)
		btn1.Click += self.close
		
		self.statusbar = StatusBar()
		self.statusbar.Parent = self
		
		self.Controls.Add(pictureBox)
		self.Controls.Add(tb)
		self.Controls.Add(lb1)
		self.Controls.Add(lb2)
		self.Controls.Add(lb0)
		self.CenterToScreen()
		self.AutoSize = True

	def OnChanged(self, sender, event):
		val = sender.Value
		self.statusbar.Text = str(sender.Value)
		amount.append(val)

	def close(self, sender, event):
		self.Close()
		
form = IForm()
Application.Run(form)

OUT = amount[-1]
# ----------------------------------------
int = Output(slider_working)
