# Dynamo custom node Rhythm.OverrideInteriorCrop.dyf (Dynamo 1.2.1.3083)
# category: Rhythm.Tools
# This node will override the lineweight of the crop region on interior elevations. This node would not be possible without the power of the Dynamo community. Specifically Danny Jones with Clark Patterson Lee.

categories = Categories("Views")
all_elements_of_category = ElementsOfCategory(categories)
RunMe = Input(RunMe : bool=false)
toggle = Custom[Rhythm.Toggle](list=all_elements_of_category, boolean=RunMe)  # Toggle that offers two outputs. Created for Dynamo 0.8.1 because of changes to the "IF" node
type = Custom[Element.Type](element=toggle.in)  # This retrieves the element type of the given elements. (if available) Similar to others available but no python here.
string_from_object = FromObject(type)
interiorElevationNamesContain = Input(interiorElevationNamesContain : string = "interior")
code_block = CodeBlock { true; }
contains = String.Contains(str=string_from_object, searchFor=interiorElevationNamesContain, ignoreCase=code_block)
filterByBoolMask = List.FilterByBoolMask(list=toggle.in, mask=contains)
code_block_2 = CodeBlock { "Crop Region Visible"; }
code_block_3 = CodeBlock { 1; }
setParameterByName = Element.SetParameterByName(element=filterByBoolMask.in, parameterName=code_block_2, value=code_block_3)
id = Element.Id(setParameterByName)
code_block_4 = CodeBlock { 1; }
sub = id - code_block_4

# group: All of the credit for this node goes to Konrad Sobon. I pulled this from custom node to eliminate dependencies.
python_script = Python(IN[0]=sub)
# ---------- python_script.python (78 lines) ----------
# Copyright(c) 2016, Konrad Sobon
# @arch_laboratory, http://archi-lab.net

# Import ToDSType(bool) extension method
import clr
clr.AddReference("RevitNodes")
import Revit
clr.ImportExtensions(Revit.Elements)

# Import DocumentManager and TransactionManager
clr.AddReference("RevitServices")
import RevitServices
from RevitServices.Persistence import DocumentManager
doc = DocumentManager.Instance.CurrentDBDocument

# Import RevitAPI
clr.AddReference("RevitAPI")
import Autodesk
from Autodesk.Revit.DB import *

import sys
pyt_path = r'C:\Program Files (x86)\IronPython 2.7\Lib'
sys.path.append(pyt_path)

from System.Collections.Generic import *

#The inputs to this node will be stored as a list in the IN variable.
dataEnteringNode = IN

def ProcessList(_func, _list):
    return map( lambda x: ProcessList(_func, x) if type(x)==list else _func(x), _list )

def Unwrap(item):
	return UnwrapElement(item)

def ToRevitId(_id):
	if isinstance(_id, int):
		id = ElementId(int(_id))
		return ("ElementId", id)
	elif isinstance(_id, basestring) and len(_id) > 8:
		return ("GUID", _id)
	elif isinstance(_id, basestring) and len(_id) < 8:
		id = ElementId(int(_id))
		return ("ElementId", id)
	elif isinstance(_id, Autodesk.Revit.DB.ElementId):
		return ("ElementId", _id)
	else:
		return None

def ProcessIds(_id):
	id = ToRevitId(_id)
	if id == None:
		return None
	elif id[0] == "ElementId":
		return doc.GetElement.Overloads[Autodesk.Revit.DB.ElementId](id[1]).ToDSType(True)
	else:
		return doc.GetElement.Overloads[str](id[1]).ToDSType(True)

#unwrap incoming information for use with API
if isinstance(IN[0], list):
	ids = ProcessList(Unwrap, IN[0])
else:
	ids = [Unwrap(IN[0])]
    
try:
	errorReport = None
	elements = []
	output = ProcessList(ProcessIds, ids)
except:
	# if error accurs anywhere in the process catch it
	import traceback
	errorReport = traceback.format_exc()

#Assign your output to the OUT variable
if errorReport == None:
	OUT = output
else:
	OUT = errorReport
# ----------------------------------------

Lineweight = Input(Lineweight : int=5)
python_script_2 = Python(IN[0]=python_script, IN[1]=Lineweight, IN[2]=filterByBoolMask.in)
# ---------- python_script_2.python (53 lines) ----------
#Copyright(c) 2016, John Pierson
# @60secondrevit, sixtysecondrevit@gmail.com
import clr
# Import ToDSType(bool) extension method
clr.AddReference("RevitNodes")
import Revit
clr.ImportExtensions(Revit.Elements)
# Import DocumentManager and TransactionManager
clr.AddReference("RevitServices")
import RevitServices
from RevitServices.Persistence import DocumentManager
from RevitServices.Transactions import TransactionManager

from System.Collections.Generic import *

# Import RevitAPI
clr.AddReference("RevitAPI")
import Autodesk

doc = DocumentManager.Instance.CurrentDBDocument
uiapp = DocumentManager.Instance.CurrentUIApplication
app = uiapp.Application

#The inputs to this node will be stored as a list in the IN variable.
dataEnteringNode = IN

#unwrap all elements to use with API
elements = []
for i in IN[0]:
	elements.append(UnwrapElement(i))

#create graphic overrides properties
gSettings = Autodesk.Revit.DB.OverrideGraphicSettings()

#set Projection Line weight
gSettings.SetProjectionLineWeight(IN[1])

views = UnwrapElement(IN[2])

# "Start" the transaction
TransactionManager.Instance.EnsureInTransaction(doc)

#apply lineweight override to elements in an input list
for i in elements:
	id = i.Id
	for j in views:
		j.SetElementOverrides(id, gSettings)

# "End" the transaction
TransactionManager.Instance.TransactionTaskDone()

#Assign your output to the OUT variable
OUT = IN[0]
# ----------------------------------------
Modified = Output(python_script_2)
