# Dynamo custom node Element.MakeParts.dyf (Dynamo 1.0.0.1180)
# category: SteamNodes.Element
# Create Parts from valid elements

Elements = Input()
code_block = CodeBlock(item=Elements) { Flatten({item}); }
python_script = Python(IN[0]=code_block)
# ---------- python_script.python (49 lines) ----------
#python nodes in dynamo 1.0
#proposed by Julien Benoit @jbenoit44 
#http://aecuandme.wordpress.com/
import clr
clr.AddReference('ProtoGeometry')
from Autodesk.DesignScript.Geometry import *
# Import ToDSType(bool) extension method
clr.AddReference("RevitNodes")
import Revit
clr.ImportExtensions(Revit.Elements)
# Import geometry conversion extension methods
clr.ImportExtensions(Revit.GeometryConversion)
# Import DocumentManager and TransactionManager
clr.AddReference("RevitServices")
import RevitServices
from RevitServices.Persistence import DocumentManager
from RevitServices.Transactions import TransactionManager
from System.Collections.Generic import *
# Import RevitAPI
clr.AddReference("RevitAPI")
import Autodesk
from Autodesk.Revit.DB import *

doc = DocumentManager.Instance.CurrentDBDocument
uiapp = DocumentManager.Instance.CurrentUIApplication
app = uiapp.Application

#feed IN[0] with elements
elts = []
Ids = []
Parts=[]
for i in IN[0]:
	elts.append(UnwrapElement(i))

for e in elts:
	Ids.append(e.Id)
	
IDS = List[ElementId](Ids)

# Start Transaction tt
TransactionManager.Instance.EnsureInTransaction(doc)

a=PartUtils.CreateParts(doc, IDS)
doc.Regenerate()

# End Transaction
TransactionManager.Instance.TransactionTaskDone()

OUT = elts
# ----------------------------------------
Parents = Output(python_script)
getParts = Custom[Element.GetParts](List=python_script)  # Get parts for the elements from Input. Returns Parts and Parent elements
Parts = Output(getParts.Parts)
