# Dynamo custom node Parts.ElementsAreValidToCreateParts.dyf (Dynamo 1.0.0.1180)
# category: SteamNodes.Parts
# Filter Elements to create Parts from

Elements = Input()
code_block = CodeBlock(item=Elements) { Flatten({item}); }
python_script = Python(IN[0]=code_block)
# ---------- python_script.python (41 lines) ----------
#python nodes in dynamo 1.0
#proposed by Julien Benoit @jbenoit44 
#http://aecuandme.wordpress.com/
import clr
clr.AddReference('ProtoGeometry')
from Autodesk.DesignScript.Geometry import *
# Import ToDSType(bool) extension method
clr.AddReference("RevitNodes")
import Revit
clr.ImportExtensions(Revit.Elements)
# Import geometry conversion extension methods
clr.ImportExtensions(Revit.GeometryConversion)
# Import DocumentManager and TransactionManager
clr.AddReference("RevitServices")
import RevitServices
from RevitServices.Persistence import DocumentManager
from RevitServices.Transactions import TransactionManager
from System.Collections.Generic import *
# Import RevitAPI
clr.AddReference("RevitAPI")
import Autodesk
from Autodesk.Revit.DB import *

doc = DocumentManager.Instance.CurrentDBDocument
uiapp = DocumentManager.Instance.CurrentUIApplication
app = uiapp.Application

elts = []
Ids = []
bool=[]

for i in IN[0]:
	elts.append(UnwrapElement(i))

for e in elts:
	Ids.append(e.Id)
	IDS = List[ElementId](Ids)
	bool.append(PartUtils.AreElementsValidForCreateParts(doc, IDS))


OUT = bool
# ----------------------------------------
filterByBoolMask = List.FilterByBoolMask(list=code_block, mask=python_script)
Valid = Output(filterByBoolMask.in)
Not_Valid = Output(filterByBoolMask.out)
