# Dynamo custom node Tool.AlignSheetViewsFromTemplateSheet.dyf (Dynamo 1.2.1.3083)
# category: SteamNodes.Tool
# Align views and schedules from a sheet template

Sheets = Input()
code_block = CodeBlock(a=Sheets) { Flatten({a}); }

# group: Get schedules from other sheets
python_script = Python(IN[0]=code_block)
# ---------- python_script.python (22 lines) ----------
import clr
clr.AddReference('RevitAPI')
from Autodesk.Revit.DB import *

clr.AddReference("RevitServices")
import RevitServices
from RevitServices.Persistence import DocumentManager

doc = DocumentManager.Instance.CurrentDBDocument
sheets = UnwrapElement(IN[0])
elementlist = list()

for sheet in sheets:
	try:
		viewlist = list()
		collector = FilteredElementCollector(doc, sheet.Id).OfClass(ScheduleSheetInstance)
		for item in collector:
			viewlist.append(doc.GetElement(item.ScheduleId))
		elementlist.append(viewlist)
	except:
		elementlist.append(list())
OUT = elementlist
# ----------------------------------------

TemplateSheet = Input()
code_block_2 = CodeBlock(a=TemplateSheet) { Flatten({a}); }

# group: Get schedules from template sheet, and get columns width
python_script_2 = Python(IN[0]=code_block_2)  # same code as python_script
getColumnWidth = Custom[ViewSchedule.GetColumnWidth](ViewSchedule_List=python_script_2)  # ViewSchedule.GetColumnWidth

# group: Set schedule column width
setColumnWidth = Custom[ViewSchedule.SetColumnWidth](Width_list=getColumnWidth)  # ViewSchedule.SetColumnWidth; unwired: ViewSchedule_List
map = List.Map(list=python_script, f_x=setColumnWidth)

# group: Get viewports from sheets
getViewport = Custom[View.GetViewport](Sheet=code_block)  # Get Vieworts from Views

# group: Get viewports from template sheet, get center points from viewport
getViewport_2 = Custom[View.GetViewport](Sheet=code_block_2)
code_block_3 = CodeBlock(a=getViewport_2) { Flatten({a}); }
viewPortBoxCenter = Custom[View.ViewPortBoxCenter](Viewports=code_block_3)  # Get ViewPort Box center point

# group: Set viewport center
setBoxCenter = Custom[Viewport.SetBoxCenter](Points=viewPortBoxCenter)  # API class; unwired: Viewport_list
map_2 = List.Map(list=getViewport, f_x=setBoxCenter)

Output = Output()  # ""; unwired: arg0

# group: Get schedule on sheet, get point and set point for others
python_script_3 = Python(IN[0]=code_block_2)
# ---------- python_script_3.python (22 lines) ----------
import clr
clr.AddReference('RevitAPI')
from Autodesk.Revit.DB import *

clr.AddReference("RevitServices")
import RevitServices
from RevitServices.Persistence import DocumentManager

doc = DocumentManager.Instance.CurrentDBDocument
sheets = UnwrapElement(IN[0])
elementlist = list()

for sheet in sheets:
	viewlist = list()
	collector = FilteredElementCollector(doc, sheet.Id).OfClass(ScheduleSheetInstance)
	for item in collector:
		try:
			viewlist.append(item.Point)
		except:
			0
	
OUT = viewlist
# ----------------------------------------
python_script_4 = Python(IN[0]=code_block, IN[1]=python_script_3)
# ---------- python_script_4.python (31 lines) ----------
import clr
clr.AddReference('RevitAPI')
from Autodesk.Revit.DB import *

clr.AddReference("RevitServices")
import RevitServices
from RevitServices.Persistence import DocumentManager
from RevitServices.Transactions import TransactionManager

doc = DocumentManager.Instance.CurrentDBDocument
sheets = UnwrapElement(IN[0])
pts = UnwrapElement(IN[1])
elementlist = list()

# Start Transaction
TransactionManager.Instance.EnsureInTransaction(doc)


for sheet in sheets:
	viewlist = list()
	collector = FilteredElementCollector(doc, sheet.Id).OfClass(ScheduleSheetInstance)
	for item,p in zip(collector,pts):
		if item.IsTitleblockRevisionSchedule == 0:
			item.Point=p
			elementlist.append(viewlist)			
		else:
			0
#doc.Regenerate()
# End Transaction
TransactionManager.Instance.TransactionTaskDone()	
OUT = elementlist
# ----------------------------------------
