# Dynamo custom node Tool.ElementsInGroup.dyf (Dynamo 1.0.0.1180)
# category: SteamNodes.Tool
# returns elements from a given group, selected by his name

element_types = ElementTypes("Group")
all_elements_of_type = ElementsOfType(element_types)
name = Element.Name(all_elements_of_type)
Group_Name = Input()
equals = Equals(name, Group_Name)
filterByBoolMask = List.FilterByBoolMask(list=all_elements_of_type, mask=equals)
firstItem = List.FirstItem(filterByBoolMask.in)
code_block = CodeBlock(item=firstItem) { Flatten({item}); }
python_script = Python(IN[0]=code_block)
# ---------- python_script.python (48 lines) ----------
#python nodes in dynamo 1.0
#proposed by Julien Benoit @jbenoit44 
#http://aecuandme.wordpress.com/
import clr
clr.AddReference('ProtoGeometry')
from Autodesk.DesignScript.Geometry import *
# Import ToDSType(bool) extension method
clr.AddReference("RevitNodes")
import Revit
clr.ImportExtensions(Revit.Elements)
# Import geometry conversion extension methods
clr.ImportExtensions(Revit.GeometryConversion)
# Import DocumentManager and TransactionManager
clr.AddReference("RevitServices")
import RevitServices
from RevitServices.Persistence import DocumentManager
from RevitServices.Transactions import TransactionManager
from System.Collections.Generic import *
# Import RevitAPI
clr.AddReference("RevitAPI")
import Autodesk
from Autodesk.Revit.DB import *

doc = DocumentManager.Instance.CurrentDBDocument
uiapp = DocumentManager.Instance.CurrentUIApplication
app = uiapp.Application


grp = []
ids = []
IDS = []
elt = []
for i in IN[0]:
	grp.append(UnwrapElement(i))
# Start Transaction
TransactionManager.Instance.EnsureInTransaction(doc)
for g in grp:
	ids.append(g.GetMemberIds())

import itertools
IDS = list(itertools.chain(*ids))

for id in IDS:
	elt.append(doc.GetElement(id).ToDSType(True))
# End Transaction
TransactionManager.Instance.TransactionTaskDone()

OUT = elt,IDS
# ----------------------------------------
code_block_2 = CodeBlock { 0; }
getItemAtIndex = List.GetItemAtIndex(list=python_script, index=code_block_2)
Elements = Output(getItemAtIndex)
code_block_3 = CodeBlock { 1; }
getItemAtIndex_2 = List.GetItemAtIndex(list=python_script, index=code_block_3)
Element_s_IDs = Output(getItemAtIndex_2)  # "Element's IDs"
