# Dynamo custom node Tool.GetPhaseByName.dyf (Dynamo 1.2.1.3083)
# category: SteamNodes.Tool
# Get Document Phases by String

empty = List.Empty()
python_script = Python(IN[0]=empty)
# ---------- python_script.python (40 lines) ----------
#python nodes in dynamo 1.2
#proposed by Julien Benoit @jbenoit44 
#http://aecuandme.wordpress.com/
import clr
clr.AddReference('ProtoGeometry')
from Autodesk.DesignScript.Geometry import *
# Import ToDSType(bool) extension method
clr.AddReference("RevitNodes")
import Revit
clr.ImportExtensions(Revit.Elements)
# Import geometry conversion extension methods
clr.ImportExtensions(Revit.GeometryConversion)
# Import DocumentManager and TransactionManager
clr.AddReference("RevitServices")
import RevitServices
from RevitServices.Persistence import DocumentManager
from RevitServices.Transactions import TransactionManager
from System.Collections.Generic import *
# Import RevitAPI
clr.AddReference("RevitAPI")
import Autodesk
from Autodesk.Revit.DB import *

doc = DocumentManager.Instance.CurrentDBDocument
uiapp = DocumentManager.Instance.CurrentUIApplication
app = uiapp.Application
uidoc=DocumentManager.Instance.CurrentUIApplication.ActiveUIDocument

phases=[]
names=[]
phaseslist=doc.Phases
# Start Transaction
#TransactionManager.Instance.EnsureInTransaction(doc)
for p in phaseslist:
	phases.append(p.ToDSType(False))
	names.append(p.Name)

# End Transaction
#TransactionManager.Instance.TransactionTaskDone()
OUT =phases,names
# ----------------------------------------
code_block = CodeBlock { 0; }
getItemAtIndex = List.GetItemAtIndex(list=python_script, index=code_block)
code_block_2 = CodeBlock { 1; }
getItemAtIndex_2 = List.GetItemAtIndex(list=python_script, index=code_block_2)
Phase_Name = Input()
boolean = BoolSelector(true)
contains = String.Contains(str=getItemAtIndex_2, searchFor=Phase_Name, ignoreCase=boolean)
filterByBoolMask = List.FilterByBoolMask(list=getItemAtIndex, mask=contains)
Phase = Output(filterByBoolMask.in)
filterByBoolMask_2 = List.FilterByBoolMask(list=getItemAtIndex_2, mask=contains)
Phase_s_Name = Output(filterByBoolMask_2.in)  # "Phase's Name"
Phases = Output(getItemAtIndex)
Names = Output(getItemAtIndex_2)
