# Dynamo custom node Tool.PlaceGroupAtPoint.dyf (Dynamo 1.0.0.1180)
# category: SteamNodes.Tool
# place a given group at given points

element_types = ElementTypes("GroupType")
all_elements_of_type = ElementsOfType(element_types)
name = Element.Name(all_elements_of_type)
GroupName = Input()
equals = Equals(name, GroupName)
filterByBoolMask = List.FilterByBoolMask(list=all_elements_of_type, mask=equals, lacing=Longest)
firstItem = List.FirstItem(filterByBoolMask.in)
Point = Input()
code_block = CodeBlock(item=Point) { Flatten({item}); }
python_script = Python(IN[0]=firstItem, IN[1]=code_block)
# ---------- python_script.python (48 lines) ----------
#python nodes in dynamo 1.0
#proposed by Julien Benoit @jbenoit44 
#http://aecuandme.wordpress.com/
import clr
clr.AddReference('ProtoGeometry')
from Autodesk.DesignScript.Geometry import *
# Import ToDSType(bool) extension method
clr.AddReference("RevitNodes")
import Revit
clr.ImportExtensions(Revit.Elements)
# Import geometry conversion extension methods
clr.ImportExtensions(Revit.GeometryConversion)
# Import DocumentManager and TransactionManager
clr.AddReference("RevitServices")
import RevitServices
from RevitServices.Persistence import DocumentManager
from RevitServices.Transactions import TransactionManager
from System.Collections.Generic import *
# Import RevitAPI
clr.AddReference("RevitAPI")
import Autodesk
from Autodesk.Revit.DB import *

doc = DocumentManager.Instance.CurrentDBDocument
uiapp = DocumentManager.Instance.CurrentUIApplication
app = uiapp.Application

#feed IN[0] with a GroupType
grp=[]
for g in IN[0]:
	grp.append(UnwrapElement(g))
#unwrap the points and turn into XYZ, UI units
pts = []
for i in IN[1]:
	pts.append(UnwrapElement(i.ToXyz(False)))

# Start Transaction
TransactionManager.Instance.EnsureInTransaction(doc)
groups=[]
#Revit API to place a group at XYZ
for pt,g in zip(pts,grp):
	b=doc.Create.PlaceGroup(pt,g)
	groups.append(b)
	
# End Transaction
TransactionManager.Instance.TransactionTaskDone()

OUT = groups
# ----------------------------------------
Output = Output(python_script)  # ""
