# Dynamo custom node Tool.UpdateString.dyf (Dynamo 0.8.2.1594)
# category: SteamNodes.Tool
# Replace a Parameter string value by another one

List = Input()
ParameterName = Input()
String_OUT = Input()
String_IN = Input()
code_block = CodeBlock(t2=List, t3=ParameterName, t5=String_OUT, t6=String_IN) { t1 = t2.GetParameterValueByName(t3); t4 = String.Replace(t1, t5, t6); t7 = t2.SetParameterByName(t3, t4); }
create = List.Create(code_block.t1, code_block.t4, code_block.t7)
Output = Output(create)  # ""
