# Dynamo custom node Cell Style Settings.dyf (Dynamo 1.2.0.2690)
# category: Archi-lab_Grimshaw.Views.Schedule
# This node will generate a Cell Style Settings that can be used to override cell properties.

BackgroundColor = Input(BackgroundColor: var = null)
Bold = Input(Bold: var = null)
Font = Input(Font: var = null)
FontColor = Input(FontColor: var = null)
FontSize = Input(FontSize: var = null)
Italics = Input(Italics: var = null)
Underline = Input(Underline: var = null)
Orientation = Input(Orientation: var = null)
HorizontalAlign = Input(HorizontalAlign: var = null)
VerticalAlign = Input(VerticalAlign: var = null)
HeaderText = Input(HeaderText: var = null)
BorderBottom = Input(BorderBottom: var = null)
BorderLeft = Input(BorderLeft: var = null)
BorderRight = Input(BorderRight: var = null)
BorderTop = Input(BorderTop: var = null)
python_script = Python(IN[0]=BackgroundColor, IN[1]=Bold, IN[2]=Font, IN[3]=FontColor, IN[4]=FontSize, IN[5]=Italics, IN[6]=Underline, IN[7]=Orientation, IN[8]=HorizontalAlign, IN[9]=VerticalAlign, IN[10]=HeaderText, IN[11]=BorderBottom, IN[12]=BorderLeft, IN[13]=BorderRight, IN[14]=BorderTop)
# ---------- python_script.python (128 lines) ----------
#Copyright(c) 2015, Konrad Sobon
# @arch_laboratory, http://archi-lab.net

import clr
clr.AddReference('ProtoGeometry')
from Autodesk.DesignScript.Geometry import *

# Import RevitAPI
clr.AddReference("RevitAPI")
import Autodesk
from Autodesk.Revit.DB import *

#The inputs to this node will be stored as a list in the IN variable.
dataEnteringNode = IN

_backgroundColor = IN[0]
_bold = IN[1]
_font = IN[2]
_fontColor = IN[3]
_fontSize = IN[4]
_italics = IN[5]
_underline = IN[6]
_orientation = IN[7]
_hAlign = IN[8]
_vAlign = IN[9]
_headerText = IN[10]

_borderBottom = IN[11]
_borderLeft = IN[12]
_borderRight = IN[13]
_borderTop = IN[14]


#design script color to RVT color function
def dsColorToRvtColor(dsColor):
	R = dsColor.Red
	G = dsColor.Green
	B = dsColor.Blue
	return Autodesk.Revit.DB.Color(R,G,B)

options = TableCellStyleOverrideOptions()

if _backgroundColor != None:
	options.BackgroundColor = True
if _bold != None:
	options.Bold = True

borderOptions = [_borderBottom, _borderLeft, _borderRight, _borderTop]
if any(item != None for item in borderOptions):
	options.BorderLineStyle = True

if _borderBottom != None:
	options.BorderBottomLineStyle = True
if _borderLeft != None:
	options.BorderLeftLineStyle = True
if _borderRight != None:
	options.BorderRightLineStyle = True
if _borderTop != None:
	options.BorderTopLineStyle = True

if _font != None:
	options.Font = True
if _fontColor != None:
	options.FontColor = True
if _fontSize != None:
	options.FontSize = True
if _italics != None:
	options.Italics = True
if _underline != None:
	options.Underline = True
if _orientation != None:
	options.TextOrientation = True

if _hAlign != None:
	options.HorizontalAlignment = True
if _vAlign != None:
	options.VerticalAlignment = True

tcs = TableCellStyle()
tcs.SetCellStyleOverrideOptions(options)

if _backgroundColor != None:
	tcs.BackgroundColor = dsColorToRvtColor(_backgroundColor)
if _bold != None:
	tcs.IsFontBold = _bold

if _borderBottom != None:
	tcs.BorderBottomLineStyle = UnwrapElement(_borderBottom).GraphicsStyleCategory.Id
if _borderLeft != None:
	tcs.BorderLeftLineStyle = UnwrapElement(_borderLeft).GraphicsStyleCategory.Id
if _borderRight != None:
	tcs.BorderRightLineStyle = UnwrapElement(_borderRight).GraphicsStyleCategory.Id
if _borderTop != None:
	tcs.BorderTopLineStyle = UnwrapElement(_borderTop).GraphicsStyleCategory.Id

if _font != None:
	tcs.FontName = _font
if _fontColor != None:
	tcs.TextColor = dsColorToRvtColor(_fontColor)
if _fontSize != None:
	tcs.TextSize = _fontSize
if _italics != None:
	tcs.IsFontItalic  = _italics
if _underline != None:
	tcs.IsFontUnderline  = _underline
if _orientation != None:
	tcs.TextOrientation = _orientation

if _hAlign != None:
	if _hAlign == "Left":
		has = HorizontalAlignmentStyle.Left
	elif _hAlign == "Center":
		has = HorizontalAlignmentStyle.Center
	elif _hAlign == "Right":
		has = HorizontalAlignmentStyle.Right
	tcs.FontHorizontalAlignment = has
if _vAlign != None:
	if _vAlign == "Top":
		vas = VerticalAlignmentStyle.Top
	elif _vAlign == "Middle":
		vas = VerticalAlignmentStyle.Middle
	elif _vAlign == "Bottom":
		vas = VerticalAlignmentStyle.Bottom
	tcs.FontVerticalAlignment = vas

_headerOut = [tcs, _headerText]
#Assign your output to the OUT variable
OUT = _headerOut
# ----------------------------------------
OUT = Output(python_script)
