# Dynamo custom node Get Tagged Element Id.dyf (Dynamo 0.8.0.950)
# category: Archi-lab_Grimshaw.Element Properties
# Retrives an Element Id from input of element tags. For example if wall tags are inputted it will return tagged wall Ids.

Tags = Input()
python_script = Python(IN[0]=Tags)
# ---------- python_script.python (43 lines) ----------
#Copyright(c) 2015, Konrad K Sobon
# @arch_laboratory, http://archi-lab.net

import clr
clr.AddReference('ProtoGeometry')
from Autodesk.DesignScript.Geometry import *

# Import DocumentManager and TransactionManager
clr.AddReference("RevitServices")
import RevitServices
from RevitServices.Persistence import DocumentManager
from RevitServices.Transactions import TransactionManager

doc = DocumentManager.Instance.CurrentDBDocument
uiapp = DocumentManager.Instance.CurrentUIApplication
app = uiapp.Application

# Import RevitAPI
clr.AddReference("RevitAPI")
import Autodesk
from Autodesk.Revit.DB import *

#The inputs to this node will be stored as a list in the IN variable.
dataEnteringNode = IN

def ProcessList(_func, _list):
    return map( lambda x: ProcessList(_func, x) if type(x)==list else _func(x), _list )

if isinstance(IN[0], list):
	ids, tags = [], []
	for i in IN[0]:
		if i.TaggedLocalElementId.IntegerValue != -1:
			ids.append(i.TaggedLocalElementId)
			tags.append(i)
		else:
			continue
else:
	if IN[0].TaggedLocalElementId.IntegerValue != -1:
		ids = IN[0].TaggedLocalElementId
		tags = IN[0]

#Assign your output to the OUT variable
OUT = ids, tags
# ----------------------------------------
ElementId_s = Output(python_script)  # "ElementId(s)"
