# Dynamo custom node Viewport Properties.dyf (Dynamo 0.8.2.2311)
# category: Archi-lab_Grimshaw.Element Properties
# This node will return certain properties from a Viewport input.

Viewport = Input()
python_script = Python(IN[0]=Viewport)
# ---------- python_script.python (40 lines) ----------
# Copyright(c) 2015, Konrad K Sobon
# @arch_laboratory, http://archi-lab.net

import clr
clr.AddReference('ProtoGeometry')
from Autodesk.DesignScript.Geometry import *

# Import Element wrapper extension methods
clr.AddReference("RevitNodes")
import Revit
clr.ImportExtensions(Revit.Elements)

# Import geometry conversion extension methods
clr.ImportExtensions(Revit.GeometryConversion)

# Import DocumentManager and TransactionManager
clr.AddReference("RevitServices")
import RevitServices
from RevitServices.Persistence import DocumentManager
from RevitServices.Transactions import TransactionManager

doc = DocumentManager.Instance.CurrentDBDocument
uiapp = DocumentManager.Instance.CurrentUIApplication
app = uiapp.Application

#The inputs to this node will be stored as a list in the IN variables.
dataEnteringNode = IN

viewports = IN[0]

def ProcessList(_func, _list):
    return map( lambda x: ProcessList(_func, x) if type(x)==list else _func(x), _list )

def GetLocation(v):
	v = UnwrapElement(v)
	outline = v.GetBoxOutline()
	return outline.MinimumPoint.ToPoint()

#Assign your output to the OUT variable.
OUT = ProcessList(GetLocation, viewports)
# ----------------------------------------
MinPoint = Output(python_script)
